# Grasshopper definition LA_ex4_mobile_robot_model.ghx (Grasshopper 1.0.7)
# plug-ins: CEM_Build_Topology, CEM_Deviation, CEM_Extract_Topology, CEM_Support, CEM_Trail, CEM_Calculate_Structure, CEM_Extract_Structure, CEM_Origin_Node, CEM_Load

r_m = Slider(2.2, range=0.1..100)
l_int = Slider(9, range=2..100)
res_int = Slider(17, range=4..100)

# ----
# 00 - Input
tp = GhPythonScript(r=r_m, l=l_int, res=res_int)  # -> T, N, Dt, D, S; inputs r: Int32, l: Int32, res: Int32
# ---------- tp: Python ----------
"""Creates a CEM Topology.
    Inputs:
        r: Base radius [m]
        l: Number of layer [int]
        res: Resolution [int]
    Output:
        T: Trail elements
        N: Nodes of the strucutre
        Dt: First Ring of Deviation Elements
        D: Deviation Elements
        S: Support Nodes"""

__author__ = "Frederic Chovghi"

import ghpythonlib.components as gh



###########################################################
## Create CEM Topology
###########################################################

T = []
N = []
Dt = []
D = []
S = []

bp = gh.XYPlane(gh.ConstructPoint(0,0,0)) #Base  plane

for i in range(l):
    
    circle = gh.Circle(bp, r+(i*0.5))
    cp = gh.DivideCurve(circle, res, False)[0]
    N.extend(cp)
    
    pl = gh.PolyLine(cp, True)
    pl = gh.Explode(pl, True)[0]
    
    if i != 0:
        tl = [gh.Line(cp[x], cpp[x]) for x in range(len(cp))]
        T.extend(tl)
    
    cpp = cp[:]
    
    #Export Elements
    if i == 0: Dt.extend(pl)
    if i != 0: D.extend(pl)
    
    if i ==l-1: S.extend(cp)
# ---------- end tp ----------

number_slider = Slider(2, range=-100..100)

# ----
# Color Coding
swatch = ColourSwatch(SwatchColor=RGB(255, 192, 0))
color_coding = GhPythonScript(
    is_planned=swatch,
    is_built=ColourSwatch(SwatchColor=RGB(207, 255, 181)),
    is_support=ColourSwatch(SwatchColor=RGB(0, 0, 255)),
    has_open_connector=ColourSwatch(SwatchColor=RGB(126, 255, 61)),
    has_no_open_connectors=ColourSwatch(SwatchColor=RGB(200, 200, 200)),
    is_built_by_robot=ColourSwatch(SwatchColor=RGB(175, 224, 220)),
    is_built_by_human=ColourSwatch(SwatchColor=RGB(242, 229, 0)))  # -> out, color_coding
# ---------- color_coding: Python ----------
import rhinoscriptsyntax as rs
from compas.colors import Color


color_is_planned = Color(is_planned.R/255 , is_planned.G/255, is_planned.B/255)
color_is_built = Color(is_built.R/255 , is_built.G/255, is_built.B/255)
color_is_support = Color(is_support.R/255 , is_support.G/255, is_support.B/255)
color_has_open_connector = Color(has_open_connector.R/255 , has_open_connector.G/255,has_open_connector.B/255)
color_has_no_open_connectors = Color(has_no_open_connectors.R/255 , has_no_open_connectors.G/255, has_no_open_connectors.B/255)
color_is_built_by_robot = Color(is_built_by_robot.R/255 , is_built_by_robot.G/255, is_built_by_robot.B/255)
color_is_built_by_human = Color(is_built_by_human.R/255 , is_built_by_human.G/255, is_built_by_human.B/255)

color_coding = {'color_is_planned':color_is_planned, 'color_is_built':color_is_built, 'color_is_support':color_is_support, 'color_has_open_connector':color_has_open_connector, 'color_has_no_open_connectors':color_has_no_open_connectors, 'color_is_built_by_robot':color_is_built_by_robot, 'color_is_built_by_human':color_is_built_by_human}

print color_coding
# ---------- end color_coding ----------
panel = Panel(color_coding.out)

panel_2 = Panel("Unload libraries")
bang = Button()
unload = PythonScript(bang=bang)
# ---------- unload: Python ----------
from compas_rhino.utilities.misc import get_tolerance
from compas_rhino.utilities.misc import unload_modules

unload_modules("cdf_2023")
# ---------- end unload ----------

py = PythonScript()  # -> ENVIRONMENT_NAME, HERE, DATA
# ---------- py: Python ----------
import os
import compas_bootstrapper

HERE = os.path.dirname(ghdoc.Path)
DATA = os.path.abspath(os.path.join(HERE, "..", "data"))
ENVIRONMENT_NAME = compas_bootstrapper.ENVIRONMENT_NAME
print(HERE)
print(DATA)
print(ENVIRONMENT_NAME)
# ---------- end py ----------

# ----
# Load existing assembly
# Import assembly from .json.
list = ValueList({"1. Assembly model": 0, "2. Assembly model": 1, "3. Assembly model": 2}, selected="2. Assembly model")
import = Button(ExpressionNormal="True", ExpressionPressed="False")
initial_assembly = GhPythonScript(DATA=py.DATA, assembly_preset=list, import_from_json=import)  # -> out, assembly; inputs import_from_json: Boolean
# ---------- initial_assembly: Python ----------
import os
import json
from scriptcontext import sticky

from cdf_2023.assembly import Assembly

if import_from_json:
    if assembly_preset == 0:
        filename = "start_assembly.json"
    elif assembly_preset == 1:
        filename = "design_03_part05.json"
    else:
        filename = "study_1e.json"
    PATH = os.path.join(DATA, "assembly", filename)
    assembly = Assembly.from_json(PATH)
    assembly.support_keys = []

# create a dictionary to store global value in 
assembly.globals = {}

# define global values
assembly.globals['rod_radius'] = 0.01
assembly.globals['rod_length'] = 0.8
assembly.globals['rf_unit_offset'] = 0.2
assembly.globals['rf_unit_radius'] = 0.15
# ---------- end initial_assembly ----------

brep = Brep(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)
brep_2 = Brep(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)

# ----
# New assembly & element definition
# Create an element object.
reset_assembly = Button()
globals = GhPythonScript(reset=reset_assembly)  # -> out, assembly
# ---------- globals: Python ----------
from cdf_2023.assembly import Assembly

# create assembly
assembly = Assembly()

# create a dictionary to store global value in 
assembly.globals = {}

# define global values
#assembly.globals['rod_radius'] = 0.011
#assembly.globals['rod_length'] = 0.8
#assembly.globals['rf_unit_offset'] = 0.2
#assembly.globals['rf_unit_radius'] = 0.12

# define global values length = 0.6
assembly.globals['rod_radius'] = 0.011
assembly.globals['rod_length'] = 0.6
assembly.globals['rf_unit_offset'] = 0.15
assembly.globals['rf_unit_radius'] = 0.12

print assembly.globals
# ---------- end globals ----------
assembly_globals = Panel(globals.out)
show = BooleanToggle(False)
show_2 = BooleanToggle(False)
elem_def = GhPythonScript(assembly=globals.assembly, show_connectors=show_2, angle=Slider(6, range=4..12), cr1=brep, cr2=brep_2)  # -> assembly, elem; inputs cr1: Surface, cr2: Surface
# ---------- elem_def: Python ----------
import os
import sys
import json
import math

from compas.geometry import Frame, Plane, Rotation, Vector, Point
from compas.geometry import Circle, Cylinder, Translation, Line, Cone
from compas.artists import Artist
from compas_rhino.conversions import RhinoSurface
from cdf_2023.assembly import Element

rf_unit_offset = assembly.globals['rf_unit_offset']
rf_unit_radius = assembly.globals['rf_unit_radius']
radius = assembly.globals['rod_radius']
length = assembly.globals['rod_length']

cross_section_plane = Plane.from_frame(Frame.worldYZ())
cross_section = Circle(cross_section_plane, radius)
elem_geo = Cylinder(cross_section, length)
#elem_geo = Line([-length/2.,0,0],[length/2.,0,0])

elem = Element.from_shape(elem_geo, Frame.worldXY())

connector_frame_1 = Frame([rf_unit_offset,-rf_unit_radius/2,0], [1,0,0], [0,1,0])
connector_frame_2 = Frame([-rf_unit_offset,rf_unit_radius/2,0], [-1,0,0], [0,-1,0])

R1 = Rotation.from_axis_and_angle(connector_frame_1.yaxis, math.radians(angle), connector_frame_1.point)
R2 = Rotation.from_axis_and_angle(connector_frame_2.yaxis, math.radians(angle), connector_frame_2.point)

connector_frame_1.transform(R1)
connector_frame_2.transform(R2)

elem.connector_frame_1 = connector_frame_1
elem.connector_frame_2 = connector_frame_2

elem.line = Line([-length/2.,0,0],[length/2.,0,0])


#circle_frame_1 = Frame([-0.34,0,0],[0,0,-1],[0,1,0])
#circle_frame_2 = Frame([0.34,0,0],[0,0,1],[0,1,0])
#circle_1 = Circle(Plane.from_frame(circle_frame_1), 0.5)
#circle_2 = Circle(Plane.from_frame(circle_frame_2), 0.5)
#cone_2 = Cone(circle_1, 0.32)
#cone_1 = Cone(circle_2, 0.32)
#
#elem.connector_range_1 = cone_1
#elem.connector_range_2 = cone_2

#print elem.connector_range_1

source1 = RhinoSurface.from_geometry(cr1)
source2 = RhinoSurface.from_geometry(cr2)


elem.connector_range_1 = source1.to_compas()
elem.connector_range_2 = source2.to_compas()
# ---------- end elem_def ----------
draw = PythonScript(elements=elem_def.elem, show=show)  # -> M, F, C; inputs elements: list
# ---------- draw: Python ----------
from compas.artists import Artist

M = []
C = []
F = []
T = []

if show:
    for elem in elements:
        C.append(Artist(elem.connector_frame_1).draw())
        C.append(Artist(elem.connector_frame_2).draw())
        M += [Artist(elem._mesh).draw([0,0,1,1])]
        F += [Artist(elem.frame).draw()]
        T += [Artist(elem.tool_frame).draw()]
# ---------- end draw ----------
pln = Plane(draw.F)
mesh = Mesh(draw.M)
pln_2 = Plane(draw.C)
custom_preview = CustomPreview(Geometry=mesh, Material=ColourSwatch(SwatchColor=RGB(221, 0, 0)))

panel_3 = Panel(py.ENVIRONMENT_NAME)
# Generate assembly
number_slider_2 = Slider(0.1, range=0..1)

# ----
# 3. Select a stability criteria
list_2 = ValueList({"1. GLOBAL stability": 0, "2. LOCAL stability": 1, "3. NO stability criteria": 2}, selected="1. GLOBAL stability")

# ----
# 4. Set key to "0"
reset_key = Button()

# ----
# 1. Select open connector
shift_value = Slider(-0.02, range=-0.15..0.05)
angle = Slider(320, range=0..360)
previous = Button()
next = Button()

key = Slider(0, range=0..100)
key_2 = Slider(157, range=0..200)
Z = UnitZ(Factor=expr("-x", number_slider_2))
crv = Curve([<curve referenced from the Rhino model> x3])
closing_two_y_triplets = GhPythonScript()  # -> Out, A; disabled
pln_3 = Plane([Plane(origin=(-0.002611679333, -0.7707588361, 0.4218038534), x=(0.00338212045, -0.1931022184, 0.9811728158), y=(-0.9998466536, -0.01751197807, 0)), Plane(origin=(-0.7707588361, 0.002611679333, 0.4218038534), x=(-0.1931022184, -0.00338212045, 0.9811728158), y=(-0.01751197807, 0.9998466536, 0)), Plane(origin=(0.002611679333, 0.7707588361, 0.4218038534), x=(-0.00338212045, 0.1931022184, 0.9811728158), y=(0.9998466536, 0.01751197807, 0)), Plane(origin=(0.7707588361, -0.002611679333, 0.4218038534), x=(0.1931022184, 0.00338212045, 0.9811728158), y=(0.01751197807, -0.9998466536, 0))])
pln_4 = Plane([Plane(origin=(-0.002611679333, -0.7707588361, 0.4218038534), x=(0.00338212045, -0.1931022184, 0.9811728158), y=(-0.9998466536, -0.01751197807, 0)), Plane(origin=(0.002611679333, 0.7707588361, 0.4218038534), x=(-0.00338212045, 0.1931022184, 0.9811728158), y=(0.9998466536, 0.01751197807, 0))])
pln_5 = Plane([Plane(origin=(-0.4707588361, 0.002611679333, 0.3218038534), x=(-0.1931022184, -0.00338212045, 0.9811728158), y=(-0.01751197807, 0.9998466536, 0)), Plane(origin=(0.002611679333, 0.4707588361, 0.3218038534), x=(-0.00338212045, 0.1931022184, 0.9811728158), y=(0.9998466536, 0.01751197807, 0)), Plane(origin=(0.4707588361, -0.002611679333, 0.3218038534), x=(0.1931022184, 0.00338212045, 0.9811728158), y=(0.01751197807, -0.9998466536, 0)), Plane(origin=(-0.002611679333, -0.4707588361, 0.3218038534), x=(0.00338212045, -0.1931022184, 0.9811728158), y=(-0.9998466536, -0.01751197807, 0))])
loft = Loft(Curves=crv, Options={Adjust=False, Closed=False, LoftEnds=0, LoftSimp=0, LoftType=0, Rebuild=10, Refit=0.01})

# ----
# 2. Define a target geometry
distance_weight = Slider(0, range=0..1)
angle_weight = Slider(1, range=0.1..1.1)
support_geo = Brep(<brep referenced from the Rhino model>)
target_geo = Mesh(loft)

move = Move(Geometry=pln_3, Motion=Z)  # -> Geometry, Transform
item = ListItem(List=pln_5, Index=3, Wrap=True)
split = SplitList(List=move.Geometry, Index=2)  # -> ListA, ListB

# ----
# Initial Assembly Configuration
pt = Point(Point(-0.002611679333, -0.4167082675, 0.4218038534))
x = Curve(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)
y = Curve(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)
pl = ConstructPlane(Origin=pt, XAxis=x, YAxis=y)
worldxy = Plane(PlaneXY(0, 0, 0))
initial_configuration = GhPythonScript(assembly=elem_def.assembly, planes=split.ListA, elem=elem_def.elem, show_open_connectors=Toggle(False))  # -> out, assembly, connector_planes; inputs planes: list of Plane
# ---------- initial_configuration: Python ----------
import Rhino.Geometry as rg
import math
from scriptcontext import sticky as st

from compas.geometry import Frame, Vector
from compas.geometry import Rotation, Transformation
from compas.artists import Artist


connector_planes = []
support_keys = []

radius = assembly.globals['rod_radius']
length = assembly.globals['rod_length']
rf_unit_offset = assembly.globals['rf_unit_offset']
rf_unit_radius = assembly.globals['rf_unit_radius']


for plane in planes:
    T1 = Transformation.from_frame_to_frame(Frame.worldXY(), Frame(plane.Origin, plane.XAxis, plane.YAxis))
    elem_1 = elem.transformed(T1)
    
    R1 = Rotation.from_axis_and_angle(elem_1.frame.zaxis, math.radians(120), [0,0,0])
    R2 = Rotation.from_axis_and_angle(elem_1.frame.zaxis, math.radians(240), [0,0,0])
    
    # set connector state
    elem_1.connector_1_state = True
    elem_1.connector_2_state = False
    
    # add element to assembly
    assembly.add_element(elem_1, placed_by='initial', is_support=True, frame_id=None)
    
    # show open connectors
    if show_open_connectors:
        for key, connectors in assembly.connectors(state='open'):
            for connector in connectors:
                connector_planes.append(Artist(connector).draw())

for key, element in assembly.elements():
    support_keys.append(key)
    
assembly.support_keys = support_keys
# ---------- end initial_configuration ----------
pln_6 = Plane(initial_configuration.connector_planes)

custom_preview_2 = CustomPreview(Geometry=loft, Material=ColourSwatch(SwatchColor=RGB(227, 166, 166)))  # disabled

# ----
# Transform Assembly
x_2 = Curve(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)
pt_2 = Point(Point(-0.02953462923, 0.4150182858, 0.4218038534))
y_2 = Curve(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)
pl_2 = ConstructPlane(Origin=pt_2, XAxis=x_2, YAxis=y_2)
transform = GhPythonScript(assembly=initial_configuration.assembly, transform=Toggle(False), trnsf_plane=pl_2)  # -> out, assembly
# ---------- transform: Python ----------
from compas.geometry import Frame
from compas.geometry import Transformation
import Rhino.Geometry as rg
from compas.artists import Artist


if transform:
    T = Transformation.from_frame_to_frame(assembly.element(0).frame, Frame(trnsf_plane.Origin, trnsf_plane.XAxis, trnsf_plane.YAxis))
    assembly.transform(T)
    assembly.network.transform(T)
# ---------- end transform ----------

# ----
# Choose assembly
list_3 = ValueList({"New assembly": 1, "From json": 2}, selected="From json")
python = GhPythonScript(selection=list_3, new_assembly=transform.assembly, imported_assembly=initial_assembly.assembly)  # -> out, assembly
# ---------- python: Python ----------
import rhinoscriptsyntax as rs

if selection == 1:
    assembly = new_assembly
else:
    assembly = imported_assembly
# ---------- end python ----------

show_3 = BooleanToggle(False)
list_4 = ValueList({"Manual": 0, "Automatic": 1}, selected="Manual")

# ---- group: capture
viewport_name = Text("workflow_2")
capture_to_bitmap = PythonScript(DATA=py.DATA, capture=Button(), viewport_name=viewport_name, idx=Slider(2, range=0..10))  # -> out, a; inputs capture: Boolean, idx: Int32
# ---------- capture_to_bitmap: Python ----------
import Rhino
import System.Drawing
from scriptcontext import sticky as st

import sys, os
import ghpythonlib.components as ghcomp
import Grasshopper as gh
import datetime


ghComp = ghenv.Component
ghDoc = ghComp.OnPingDocument()

def rCommonCap(filePath, viewportName,scaleFactor):
    RhinoDocument = Rhino.RhinoDoc.ActiveDoc
    view = RhinoDocument.Views.Find(viewportName, False)
    vp = view.ActiveViewport
    size = System.Drawing.Size(vp.Size.Width*scaleFactor,vp.Size.Height*scaleFactor)
    capture = view.CaptureToBitmap(size)
    capture.Save(filePath);


export_dir = os.path.join(DATA, 'parameter_studies')
if not os.path.isdir(export_dir): os.mkdir(export_dir)
print export_dir
filename = os.path.join(export_dir, 'capture_' + str(idx) + '.png') 
print filename

zoom = 1

if capture:
    rCommonCap(filename, viewport_name, zoom)
# ---------- end capture_to_bitmap ----------

# ----
# 01 - CEM Model
series = Series(Start=0, Step=expr("1/(x-2)", l_int), Count=expr("x-1", l_int))
graph_mapper = GraphMapper(
    series,
    x0=0,
    x1=1,
    y0=0,
    y1=1,
    container_name="Bezier",
    cpx=[0, 0.5724637508, 0.7695683837, 1],
    cpy=[0.1269744635, 0.09536236525, 0.4008698463, 1])
construct_domain = ConstructDomain(DomainStart=number_slider, DomainEnd=Slider(-5, range=-100..100))
remap_numbers = RemapNumbers(Value=graph_mapper, Source=Domain(0, 1), Target=construct_domain)  # -> graft(Mapped), Clipped
repeat_data = RepeatData(Data=remap_numbers.Mapped, Length=res_int)  # -> flatten(Data)
cem_deviation = CEM_Deviation(DeviationEdge=tp.Dt, DeviationMagn=number_slider)
cem_deviation_2 = CEM_Deviation(DeviationEdge=tp.D, DeviationMagn=repeat_data)
cem_load = CEM_Load(PointLoad=tp.N, LoadMagnZ=Slider(-1, range=-100..100))
cem_trail = CEM_Trail(TrailEdge=tp.T, TrailLen=Slider(-0.5, range=-100..100))
cem_support = CEM_Support(Support=tp.S)
cem_build_topology = CEM_Build_Topology(T=flatten(cem_trail), L=cem_load, D=flatten([cem_deviation, cem_deviation_2]), S=flatten(cem_support))
cem_extract_topology = CEM_Extract_Topology(TP=cem_build_topology)  # -> Nodes, NodesID, Edges, EdgesID, ConstraintPlane, ConstraintPlaneID, OriginNode, OriginNodeID
cem_origin_node = CEM_Origin_Node(OriginNode=cem_extract_topology.OriginNode, OriginNodeID=cem_extract_topology.OriginNodeID)
cem_calculate_structure = CEM_Calculate_Structure(TP=cem_build_topology, N=cem_origin_node)
cem_extract_structure = CEM_Extract_Structure(M=cem_calculate_structure)  # -> Nodes, NodesID, Trails, TrailsID, TrailsCol, TrailsMag, Deviations, DeviationsID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
end_points = EndPoints(Curve=cem_extract_structure.ExternalForces)  # -> Start, End
scale = Scale(Geometry=cem_extract_structure.ExternalForces, Center=end_points.Start, Factor=0.25)  # -> Geometry, Transform

# ----
# 02 - Mesh model
join_curves = JoinCurves(Curves=cem_extract_structure.Deviations, Preserve=False)
construct_point = ConstructPoint(XCoordinate=100, YCoordinate=0, ZCoordinate=0)
curve_closest_point = CurveClosestPoint(Point=construct_point, Curve=join_curves)  # -> Point, Parameter, Distance
deconstruct = Deconstruct(Point=curve_closest_point.Point)  # -> XComponent, YComponent, ZComponent
seam = Seam(Curve=flatten(join_curves), Seam=flatten(curve_closest_point.Parameter))
sort_list = SortList(Keys=deconstruct.ZComponent, ValuesValuesA=seam)  # -> Keys, ValuesValuesA
mesh_2 = GhPythonScript(C=sort_list.ValuesValuesA)  # -> M; inputs C: list of Curve
# ---------- mesh_2: Python ----------
import ghpythonlib.components as gh

M = []

for i in range(len(C)-1):
    
    cp_a = gh.ControlPoints(C[i])[0]
    cp_b = gh.ControlPoints(C[i+1])[0]
    
    for k in range(len(cp_a)-1):
        
        mloc = gh.ConstructMesh([cp_a[k], cp_a[k+1], cp_b[k+1], cp_b[k]], 'Q{0;1;2;3}')
        M.append(mloc)

M = gh.MeshJoin(M)
# ---------- end mesh_2 ----------
deconstruct_box = DeconstructBox(Box=mesh_2)  # -> Plane, X, Y, Z
unit_z = UnitZ(Factor=deconstruct_box.Z)
move_2 = Move(Geometry=mesh_2, Motion=unit_z)  # -> Geometry, Transform
custom_preview_3 = CustomPreview(Geometry=move_2.Geometry, Material=ColourSwatch(SwatchColor=RGBA(76, 76, 76, 44)))

move_3 = Move(Geometry=flatten([cem_extract_structure.Trails, cem_extract_structure.Deviations]), Motion=unit_z)  # -> Geometry, Transform
move_4 = Move(Geometry=flatten(scale.Geometry), Motion=unit_z)  # -> Geometry, Transform
custom_preview_4 = CustomPreview(Geometry=move_3.Geometry, Material=[cem_extract_structure.TrailsCol, cem_extract_structure.DeviationsCol])
custom_preview_5 = CustomPreview(Geometry=move_4.Geometry, Material=cem_extract_structure.ExternalForcesCol)

# ----
# Inputs
show_close_pairs = BooleanToggle(False)
show_resultant = BooleanToggle(False)
collision = BooleanToggle(True)
flip = BooleanToggle(True)

# ----
# Assembly branches
number_slider_3 = Slider(0, range=0..10)  # disabled

# ----
# Assembly visualization
# 1. Visualize assembly.
# 2. Visualize selected option.
# 3. Visuilize current options (all/filtered).
show_4 = BooleanToggle(True)
show_5 = BooleanToggle(False)
show_6 = BooleanToggle(False)
show_7 = BooleanToggle(False)
show_8 = BooleanToggle(False)
show_9 = BooleanToggle(True)
show_10 = BooleanToggle(False)
number_slider_4 = Slider(42, range=0..360)  # disabled

# ----
# Assembly growth
options_num = Slider(80, range=1..100)
iterations = Slider(1, range=1..10)
height = Slider(0.07, range=0..2)
add = Button()
random_key = BooleanToggle(True)
update = GhPythonScript(trigger=add)  # -> update; inputs trigger: list
# ---------- update: Python ----------
update = False

for value in trigger:
    if value:
        update = True

print update
# ---------- end update ----------

inputs = GhPythonScript(
    assembly=python.assembly,
    next_element=next,
    prev_element=previous,
    angle=angle,
    shift_value=shift_value,
    target_geo=target_geo,
    support_geo=support_geo,
    distance_weight=distance_weight,
    angle_weight=angle_weight,
    stability_criteria=list_2,
    show_resultant=show_resultant,
    collision=collision,
    flip_human_robot=flip,
    show_close_pairs=show_close_pairs,
    select_key=key,
    reset_key=reset_key,
    height=height,
    update=update)  # -> out, assembly, selected_key, angle, shift_value, is_colliding, stability_feedback, resultant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; inputs target_geo: Mesh, support_geo: Brep, select_key: Int32
# ---------- inputs: Python ----------
import math
import random
from scriptcontext import sticky as st
import Rhino.Geometry as rg

import ghpythonlib.components as ghcomp

from compas.geometry import Frame, Box, Point
from compas.geometry import Vector, Translation, angle_vectors, Rotation
from compas.artists import Artist
import rhinoscriptsyntax as rs

all_options = []
filtered_keys = []
distances = []
vectors = []
origins = []

stability_check = {0:'global', 1:'local', 2:'no_stability_check'}
assembly.stability_check = stability_check[stability_criteria]
assembly.support = support_geo
assembly.target_geo = target_geo

flip = 'AA'


# all keys
key_index = assembly.network.key_index()
keys = [key_index[key] for key in assembly.network.nodes()]

#############################################################################
## OPTIONS
#############################################################################

for key, element in assembly.elements():
    for origin, vector in element.current_option_vectors(0.40):
        all_options.append((key, origin, vector))

assembly.current_options = all_options

# all options keys
open_connectors_keys = [option[0] for option in assembly.current_options]
#open_connectors_keys = [option[0] for option in assembly.current_options if option[1].z > height]

open_connectors_keys = list(set(open_connectors_keys))
assembly.open_connectors_keys = open_connectors_keys


#############################################################################
## SELECT A KEY
#############################################################################

guid = str(ghenv.Component.InstanceGuid)
element_key = "elem_" + guid

if element_key not in st or None:
    st[element_key] = 0

if reset_key:
    st[element_key] = 0

if next_element:
    if st[element_key] < len(open_connectors_keys) - 1:
        st[element_key] += 1

if prev_element:
    if st[element_key] <= len(open_connectors_keys) - 1:
        st[element_key] -= 1

    if st[element_key] < 1:
        st[element_key] = 0


#############################################################################
## OPEN CONNECTORS
#############################################################################

if len(open_connectors_keys) == 0: 
    selected_key = 0
    print("!!! NO OPEN CONNECTORS AVAILABLE !!!")
    print("Suggestion: RESET KEY!")
else:
    if st[element_key] < len(open_connectors_keys) - 1:
        #print st[element_key] 
        selected_key = open_connectors_keys[st[element_key]]
        #selected_key = open_connectors_keys[select_key]
        #selected_key = select_key
        #print("Element with key {} selected.".format(selected_key))

if selected_key != None:
    selected_elem = assembly.network.node[selected_key]['element']

#############################################################################
## DISPLAY SELECTED CONNECTOR
#############################################################################


selected_connenctor_frame = assembly.element(selected_key).connectors(state='open')[0]

R = Rotation.from_axis_and_angle(selected_elem.frame.xaxis, math.radians(angle), selected_elem.frame.point)

selected_connenctor_frame_copy = selected_connenctor_frame.transformed(R)
selected_connector_plane = Artist(selected_connenctor_frame_copy).draw()

elem_options = assembly.element(selected_key).current_option_elements(flip, angle, shift_value)

#############################################################################
## COLLISION CHECK
#############################################################################

# check if the selected option elements collide with anything
is_colliding = assembly.collision_check(elem_options, tolerance = -0.001) if collision else False

#############################################################################
## GLOBAL/LOCAL EQUILIBRIUM CHECK
#############################################################################

if stability_criteria == 0:
    # calculate global equilibrium and the resultant force of the selected option elements
    equlibrium, resultant, stability_feedback = assembly.calculate_global_equilibrium(support_geo, elem_options, radius=0.01)
    resultant = rs.coercecurve(resultant)
    
elif stability_criteria == 1:
    cp = [Artist(assembly.element(key).line.midpoint).draw() for key, element in assembly.elements()]
    cp += [Artist(elem_options.line.midpoint).draw() for elem_options in elem_options]
    sp = [Artist(assembly.element(0).line.end).draw()]

    # calculate local equilibrium (level arm) and the resultant point of the selected option elements
    lever_arm, resultant_point = assembly.calculate_local_equilibrium(cp, sp, assembly.globals['rod_length'], assembly.globals['rod_radius'])
    stability_feedback = "Lever arm is {len:.4f}m long.".format(len=lever_arm[0])
    resultant_point = rs.coerce3dpoint(resultant_point)
    resultant = rg.Line(resultant_point, rg.Vector3d.ZAxis, 0.1)
    
else:
    stability_feedback = "No stability criteria selected."

if show_resultant:
    cone_base_plane = rg.Plane(resultant.PointAt(0), rg.Vector3d.ZAxis*-1)
    resultant = rg.Cone(cone_base_plane,-0.3, 0.03)

#############################################################################
## DISTANCE TO INPUT GEO
#############################################################################

distance, shortest_vector_1 = assembly.distance_to_target_geo(selected_key, angle, target_geo)

# Vector Display
vectors.append(shortest_vector_1)
origins.append(selected_connector_plane.Origin)

target_geo_feedback = ['Key {}: Distance to target geometry: {dist:.2f}m'. format(selected_key, dist=distance)]

#############################################################################
## ORIENTATION TO INPUT GEO
#############################################################################

output_value, shortest_vector_2 = assembly.orientation_to_target_geo(selected_key, angle, target_geo)

# Vector Dispaly
vectors.append(rg.Vector3d(shortest_vector_2.x,shortest_vector_2.y,shortest_vector_2.z))
origins.append(selected_connector_plane.Origin)

target_geo_feedback.append('Key {}: Orientation to target geometry: {len:.2f}%'. format(selected_key, len=output_value))

#############################################################################
## LAST ADDED KEYS
#############################################################################

new_keys = keys[-2:]
assembly.last_added = new_keys
print 'Last added keys:', ', '.join(map(str, new_keys))

#############################################################################
## INTERSECTING CONNECTORS RANGES
#############################################################################


conn_ranges = []
ranges_test = []
pairs = []

for key, conn_range in assembly.connectors_ranges(state='open'):
    if len(conn_range) != 0:
        #print range
        conn_ranges.append((key, Artist(conn_range[0]).draw()))

for i in range(len(conn_ranges)):
    for j in range(i + 1, len(conn_ranges)):
        is_intersecting, intersection, p_array = rg.Intersect.Intersection.SurfaceSurface(conn_ranges[i][1], conn_ranges[j][1], 0.001)
        if is_intersecting:
            pairs.append((conn_ranges[i][0], conn_ranges[j][0]))
            
print 'Following element pair(s) {} could be joined.'.format(pairs)

assembly.keys_pairs_to_join = [key for pair in pairs for key in pair]

#assembly.network.delete_node(23)
# ---------- end inputs ----------
keys_status_update = Panel(inputs.out)
pln_7 = Plane(inputs.selected_connector_plane)
srf = Surface(inputs.resultant)
preview = CustomPreview(Geometry=srf, Material=ColourSwatch(SwatchColor=RGB(255, 0, 0)))
vdis = VectorDisplay(Anchor=inputs.origins, Vector=inputs.vectors)

grow_assembly = GhPythonScript(
    assembly=inputs.assembly,
    elem=elem_def.elem,
    mode=list_4,
    selected_key=inputs.selected_key,
    angle=inputs.angle,
    shift_value=inputs.shift_value,
    distance_weight=distance_weight,
    angle_weight=angle_weight,
    flip_human_robot=flip,
    collision_check=collision,
    add=add,
    options_num=options_num,
    iterations=iterations,
    generate_random_key=random_key,
    height=height)  # -> out, assembly, selected_key, angle, shift_value, flip_human_robot; inputs options_num: Int32, iterations: Int32, generate_random_key: Boolean
# ---------- grow_assembly: Python ----------
import sys
import random
from scriptcontext import sticky as st
import ghpythonlib.components as ghcomp
import math


from compas.geometry import distance_line_line, Line, is_intersection_line_line, Plane, Frame, is_intersection_line_plane
from compas.artists import Artist
import Rhino.Geometry as rg
import rhinoscriptsyntax as rs

import ghpythonlib.components as gh

import time


    
flip = 'AA'

#############################################################################
## ADD ELEMENTS TO ASSEMBLY
#############################################################################

# Add two elements
if add and mode == 0:
    assembly.close_rf_unit(selected_key, flip, angle, shift_value, on_ground = False)

def get_key():
    if generate_random_key:
        random_key = random.choice(open_keys)
    else:
        if selected_key in open_keys:
            random_key = selected_key
        else:
            random_key = open_keys[-1]
    return random_key

#############################################################################
## GROWTH ALONG AN INPUT GEOMETRY WITH GLOBAL STABILITY
#############################################################################

if add and mode == 1 and assembly.stability_check == 'global':
    msgs = []
    
    # precompute the keys of open connectors
    open_keys = [key for key, frames in assembly.connectors('open') if frames!=[]]

    # precompute the surface area centroid of the support
    support_centroid = rs.SurfaceAreaCentroid(assembly.support)[0]
    
    for i in range(iterations):
        print('---------------------- Start ----------------------')
        
        options_count = 0
        fitness_table = []       

        while options_count < options_num: 
            
            # pick a random key
            random_key = get_key() 
            #print random_key
            
            # generate a random angle and shift
            random_angle = random.randint(0, 36) * 10 
            random_shift = 0
            #random_shift = random.uniform(-0.04, 0.04) 
            
            # get the current option elements of the random key with the given flip, angle, and shift
            random_option_elems = assembly.element(random_key).current_option_elements(flip, random_angle, random_shift)
            
            # check if the random option elements collide with anything
            is_colliding = assembly.collision_check(random_option_elems, tolerance = -0.001)
            
            # calculate global equilibrium and the resultant force of the random option elements
            global_equilibrium, resultant, msg = assembly.calculate_global_equilibrium(assembly.support, random_option_elems, radius=0.01)
            
            # check if all the random option elements are away from the ground
            random_elems_frames = [element.frame for element in random_option_elems]
            is_away_from_ground = all(frame.point.z > 0.2 for frame in random_elems_frames)
            
            if not is_colliding and global_equilibrium and is_away_from_ground:
                
                # calculate the orientation to the target geometry and the distance to the target geometry
                output_value, vector1 = assembly.orientation_to_target_geo(selected_key, random_angle, assembly.target_geo)
                distance, vector2 = assembly.distance_to_target_geo(selected_key, random_angle, assembly.target_geo)

                # calculate the distance between the resultant force and the surface area centroid of the support
                dist = rs.Distance(rs.CurveEndPoint(resultant), support_centroid)
                
                if distance < 0.3 and output_value > 80.0:
                    # calculate the score of the random option elements
                    score = output_value*angle_weight + distance*distance_weight + 1/dist
                    #print 'orientation_value', output_value

                # create a fitness table the random values and corresponding scores
                fitness_table.append([random_key, random_angle, random_shift, score])
                
                options_count += 1
                
        # store the random values and corresponding scores to the fitness tabl
        fitness_table_sorted = sorted(fitness_table, key=lambda x:x[3], reverse=True)
        
        msgs.append('{}.ITERATION:'.format(i))
        msgs.append('ELEMENT KEY {} with the highest score: {}'.format(fitness_table_sorted[0][0], fitness_table_sorted[0][3]))
        
        selected_key = fitness_table_sorted[0][0]
        angle = fitness_table_sorted[0][1]
        shift_value = fitness_table_sorted[0][2]
        print selected_key
        print angle
        print shift_value
        
        if True:
            result = rs.MessageBox("Add option with highest score?", 3 | 64)
            if result == 1:
                continue
            if result == 7:
                break
            if result == 2:
                continue
            rs.MessageBox(result, 1 | 64, "Result")
    
        # close a reciprocal frame unit with the option elements with the highest score
        assembly.close_rf_unit(fitness_table_sorted[0][0], flip, fitness_table_sorted[0][1], fitness_table_sorted[0][2], on_ground=False)
        
        msgs.append('------- New elements added to assembly -------')
        
        # print the messages
        for msg in msgs:
            print(msg)


#############################################################################
## GROWTH ALONG AN INPUT GEOMETRY WITH LOCAL STABILITY
#############################################################################

if add and mode == 1 and assembly.stability_check == 'local':
    msgs = []
    
    # precompute the keys of open connectors
    open_keys = [key for key, frames in assembly.connectors('open') if frames != []]
    cp = [Artist(assembly.element(key).line.midpoint).draw() for key, element in assembly.elements()]
    
    for i in range(iterations): 
        
        options_count = 0
        fitness_table = []
        
        while options_count < options_num: 
        
            # pick a random key
            random_key = get_key() 
            #print random_key
            
            # generate a random angle and shift
            random_angle = random.randint(0, 36) * 10 
            random_shift = 0
            #random_shift = random.uniform(-0.04, 0.04) 
            
            # get the current option elements of the random key with the given flip, angle, and shift
            random_option_elems = assembly.element(random_key).current_option_elements(flip, random_angle, random_shift)
            
            # check if the random option elements collide with anything
            is_colliding = assembly.collision_check(random_option_elems, tolerance = -0.001)
            
            cp += [Artist(random_option_elem.line.midpoint).draw() for random_option_elem in random_option_elems]
            sp = [Artist(assembly.element(0).line.end).draw()]
            
            # calculate local equilibrium (level arm) and the resultant point of the random option elements
            lever_arm, resultant_point = assembly.calculate_local_equilibrium(cp, sp, assembly.globals['rod_length'], assembly.globals['rod_radius'])
            
            # check if all the random option elements are away from the ground
            random_elems_frames = [element.frame for element in random_option_elems]
            is_away_from_ground = all(frame.point.z > 0.2 for frame in random_elems_frames)
            
            if not is_colliding and is_away_from_ground:
                
                # calculate the orientation to the target geometry and the distance to the target geometry
                output_value, vector1 = assembly.orientation_to_target_geo(random_key, random_angle, assembly.target_geo)
                distance, vector2 = assembly.distance_to_target_geo(random_key, random_angle, assembly.target_geo)
            else:
                break
                
            if distance < 0.3 and output_value > 80.0:
                # calculate the score of the random option elements
                score = output_value*angle_weight + 1/distance*distance_weight + 1/lever_arm[0]
            else:
                break
            
            # store the random values and corresponding scores to the fitness table
            fitness_table.append([random_key, random_angle, random_shift, score])
            
            options_count += 1
            
        # sort the fitness table by score in descending order
        fitness_table_sorted = sorted(fitness_table, key=lambda x:x[3], reverse=True)
        
        msgs.append('{}.ITERATION:'.format(i))
        msgs.append('ELEMENT KEY {} with the highest score: {}'.format(fitness_table_sorted[0][0], fitness_table_sorted[0][3]))
        
        # close a reciprocal frame unit with the option elements with the highest score
        assembly.close_rf_unit(fitness_table_sorted[0][0], flip, fitness_table_sorted[0][1], fitness_table_sorted[0][2], on_ground=False)
        msgs.append('------- New elements added to assembly -------')
        
    for msg in msgs:
        print(msg)


#############################################################################
## RANDOM GROWTH
#############################################################################

if add and mode == 1 and assembly.stability_check == 'no_stability_check':
    msgs = []
    start_time_loop = time.time() # timestamp
    
    open_keys = [key for key, frames in assembly.connectors('open') if frames!=[]]
    
    for i in range (iterations): 
        print('---------------------- Start ----------------------')
        
        options_count = 0
        fitness_table = []
        
        while options_count < options_num: 

            # pick a random key
            random_key = get_key() 
            #print random_key
            
            # generate a random angle and shift
            random_angle = random.randint(0, 36) * 10 
            random_shift = 0
            #random_shift = random.uniform(-0.04, 0.04) 
            
            # get the current option elements of the random key with the given flip, angle, and shift
            random_option_elems = assembly.element(random_key).current_option_elements(flip, random_angle, random_shift)
            
            # check if the random option elements collide with anything
            is_colliding = assembly.collision_check(random_option_elems, tolerance = -0.001)
            
            # check if all the random option elements are away from the ground
            random_elems_frames = [element.frame for element in random_option_elems]
            is_away_from_ground = all(frame.point.z > height for frame in random_elems_frames)
            
            end_time_random_elems = time.time() # timestamp
            
            if not is_colliding and is_away_from_ground:
                
                start_time_target_geo = time.time() # timestamp
                
                # calculate the orientation to the target geometry and the distance to the target geometry
                output_value, vector1 = assembly.orientation_to_target_geo(random_key, random_angle, assembly.target_geo)
                distance, vector2 = assembly.distance_to_target_geo(random_key, random_angle, assembly.target_geo)
                
                if distance < 0.5 and output_value > 80.0:
                    print 'distance', distance
                    print 'output_value', output_value
                    score = output_value*angle_weight + 1/distance*distance_weight
                else:
                    print 'Global growth conditions not satisfied!'
                    break
                
                fitness_table.append([random_key, random_angle, random_shift, score])
                
                options_count += 1
                
                end_time_target_geo = time.time() # timestamp
                
        start_time_fitness_table_sorted = time.time() # timestamp
        
        fitness_table_sorted = sorted(fitness_table,key=lambda x:x[3], reverse=True)
        
        end_time_fitness_table_sorted = time.time() # timestamp
        
        msgs.append('{}.ITERATION:'.format(i))
        msgs.append('ELEMENT KEY {} with the highest score: {}'.format(fitness_table_sorted[0][0], fitness_table_sorted[0][3]))
        
        start_time_close_rf_unit = time.time() # timestamp
        assembly.close_rf_unit(fitness_table_sorted[0][0], flip, fitness_table_sorted[0][1], fitness_table_sorted[0][2], on_ground = False)
        end_time_close_rf_unit = time.time() # timestamp
        
        msgs.append('------- New elements added to assembly -------')
        for msg in msgs:
            print(msg)

    print("--- Create random elems %s seconds ---" % (end_time_random_elems - start_time_loop))
    print("--- Target geometry %s seconds ---" % (end_time_target_geo - start_time_target_geo))
    print("--- Sort fitness table %s seconds ---" % (end_time_fitness_table_sorted - start_time_fitness_table_sorted))
    print("--- Close reciprocal frame unit %s seconds ---" % (end_time_close_rf_unit - start_time_close_rf_unit))
    print("--- Total time %s seconds ---" % (end_time_close_rf_unit- start_time_loop))
# ---------- end grow_assembly ----------
rec = DataRecorder(grow_assembly.out, DataLimit=-10, RecordData=True)
assembly_growth_update = Panel(rec)

assembly_viz = PythonScript(
    assembly=grow_assembly.assembly,
    show_assembly=show_4,
    show_support=show_8,
    show_option=show_9,
    show_arrows=show_5,
    show_open_connectors=show_6,
    show_connectors_ranges=show_7,
    show_close_pairs=show_3,
    show_keys=show_10,
    current_key=grow_assembly.selected_key,
    angle=grow_assembly.angle,
    shift_value=grow_assembly.shift_value,
    flip_human_robot=grow_assembly.flip_human_robot)  # -> out, G_planned, G_built, G_supports, G_open_connectors, G_connectors_ranges, G_planned_2, G_close_pairs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; inputs current_key: Int32
# ---------- assembly_viz: Python ----------
import os
import sys
from scriptcontext import sticky as st
import Rhino.Geometry as rg

import math
from math import pi

from compas.geometry import Vector, Translation, Frame
from compas.artists import Artist
from compas.colors import Color

G_selected = []
G_planned = []
G_built = []
G_supports = []
G_close_pairs = []
G_open_connectors = []
G_cones = []
G_connectors_ranges = []

option_vectors = []
origin_option_vectors = []
flip = 'AA'

key_tag_text = []
key_tag_location= []
lines = []

# Color coding
color_coding = {'color_close_pairs': Color(1.0, 0., 0.0, 1.0),
                'color_is_planned': Color(1.0, 0.752941176471, 0.0, 1.0), 
                'color_is_support': Color(0.0, 0.0, 1.0, 1.0), 
                'color_has_open_connector': Color(0.494117647059, 1.0, 0.239215686275, 1.0), 
                'color_has_no_open_connectors': Color(0.78431372549, 0.78431372549, 0.78431372549, 1.0), 
                'color_is_built': Color(0.811764705882, 1.0, 0.709803921569, 1.0), 
                'color_is_built_by_robot': Color(0.686274509804, 0.878431372549, 0.862745098039, 1.0), 
                'color_is_built_by_human': Color(0.949019607843, 0.898039215686, 0.0, 1.0)}

keys = [key for key, element in assembly.elements()]
lines = [Artist(assembly.element(key).line).draw() for key in keys]

open_connectors_frames = [assembly.element(key).connectors(state='open') for key in keys]
connectors_ranges = [assembly.element(key).connectors_ranges(state='open') for key in keys]

if show_open_connectors:
    open_connectors_planes = [Artist(connector).draw() for connectors in open_connectors_frames for connector in connectors if connectors != []]
    
if show_connectors_ranges:
    G_connectors_ranges = [Artist(connector).draw() for connectors in connectors_ranges for connector in connectors if connectors != []]
    
def show(element, output_geo, color):
    mesh = Artist(element.mesh).draw(color)
    output_geo.append(mesh)

def show_multiple(elements, output_geo, color):
    for element in elements:
        mesh = Artist(element.mesh).draw(color)
        output_geo.append(mesh)

if assembly:
    radius = assembly.globals['rod_radius']
    
    if current_key != None:
        current_element = assembly.element(current_key)
        elem_options = assembly.element(current_key).current_option_elements(flip, angle, shift_value)
        G_selected = Artist(assembly.element(current_key).mesh).draw(color_coding['color_is_support'])
    else:
        current_element = None
        elem_options = []
    
    if len(elem_options) != 0:
        elem_option = elem_options[0]
    
    if flip_human_robot:
        elem_options.reverse()
    
        
    planned_keys = list(assembly.network.nodes_where({'is_planned':True}))
    built_keys = list(assembly.network.nodes_where({'is_built':True}))
    support_keys = assembly.support_keys
    built_keys = [key for key in built_keys if key not in assembly.open_connectors_keys and key not in support_keys]
    #support_keys = [key for key in support_keys if key not in assembly.open_connectors_keys]
    
    print 'planned keys:', planned_keys
    print 'built keys:', built_keys
    print 'support keys:', support_keys
    print 'open connectors keys:', assembly.open_connectors_keys
    
    planned_elements = [assembly.element(key) for key in planned_keys] 
    built_elements = [assembly.element(key) for key in built_keys] 
    support_elements = [assembly.element(key) for key in support_keys] 
    open_connectors_elements = [assembly.element(key) for key in assembly.open_connectors_keys]
    
    # Visualize assembly
    if show_assembly:
        for element in planned_elements:
            mesh = Artist(element.mesh).draw(color_coding['color_is_planned'])
            G_planned.append(mesh)
        for element in built_elements:
            mesh = Artist(element.mesh).draw(color_coding['color_has_no_open_connectors'])
            G_built.append(mesh)
        for element in support_elements:
            mesh = Artist(element.mesh).draw(color_coding['color_is_support'])
            G_supports.append(mesh)
        for element in open_connectors_elements:
            mesh = Artist(element.mesh).draw(color_coding['color_has_open_connector'])
            G_open_connectors.append(mesh)
    
    # Vizualize current connector 
    if show_option and show_assembly:
        if elem_options:
            show(elem_options[0], G_planned, color_coding['color_is_planned'])
            show(elem_options[1], G_planned, color_coding['color_is_planned'])
            lines.append(Artist(elem_options[0].line).draw())
            lines.append(Artist(elem_options[1].line).draw())
        else:
            print('No open connectors')
    
#    if show_last and show_assembly:
#        if len(assembly.last_added) > 1:
#            show(assembly.element(assembly.last_added[0]), G_planned, color_coding['color_has_open_connector'])
#            show(assembly.element(assembly.last_added[1]), G_planned, color_coding['color_has_open_connector'])
#        else:
#            print('No open connectors')
    
    # Visualize all options
    if show_arrows and show_assembly:
        for key, o, v in assembly.current_options:
                option_vectors.append(rg.Vector3d(*tuple(v)))
                origin_option_vectors.append(rg.Point3d(o.x, o.y, o.z))
    
    elem_option_robot = Artist(elem_options[0].frame).draw() # elem for planning robot routine
    
    if show_keys:
        for key, element in assembly.elements():
            key_tag_text.append(str(key))
            key_tag_location.append(Artist(element.frame).draw().Origin)
            
    if show_support:
        G_supports.append(assembly.support)

    elements_pairs = [assembly.element(key) for key in assembly.keys_pairs_to_join]
    
    if show_close_pairs:
        for element in elements_pairs:
            mesh = Artist(element.mesh).draw(color_coding['color_close_pairs'])
            G_close_pairs.append(mesh)
# ---------- end assembly_viz ----------
rot = GhPythonScript(plane=assembly_viz.elem_option_robot, angle=number_slider_4)  # -> out, plane; disabled
# ---------- rot: Python ----------
import math
from compas.geometry import Frame, Rotation
from compas.artists import Artist

frame = Frame(plane.Origin, plane.XAxis, plane.YAxis)

R = Rotation.from_axis_and_angle(frame.xaxis, math.radians(angle), frame.point)
frame.transform(R)

plane = Artist(frame).draw()
# ---------- end rot ----------
mesh_3 = Mesh(assembly_viz.G_planned)
mesh_4 = Mesh(assembly_viz.G_built)
mesh_5 = Mesh(assembly_viz.G_supports)
mesh_6 = Mesh(assembly_viz.G_planned_2)
mesh_7 = Mesh(assembly_viz.G_open_connectors)
pln_8 = Plane(assembly_viz.open_connectors_planes)
tag = TextTag(Location=assembly_viz.key_tag_location, Text=assembly_viz.key_tag_text)
vdis_2 = VectorDisplay(Anchor=assembly_viz.origin_option_vectors, Vector=assembly_viz.option_vectors)
cir = Circle(Plane=pln_8, Radius=0.2)

branches = GhPythonScript(assembly=grow_assembly.assembly, branch_idx=number_slider_3)  # -> out, G_branch_elems, G_branch_midpoints; inputs branch_idx: Int32; disabled
# ---------- branches: Python ----------
import rhinoscriptsyntax as rs
from compas.geometry import Line
from compas.topology import connected_components
from compas.artists import Artist


branches = connected_components(assembly.network.adjacency)
print 'The assembly structure has {} branches.'.format(len(branches))
G_branch_elems = [Artist(assembly.element(key).mesh).draw() for key in branches[branch_idx]]
G_branch_midpoints = [Artist(assembly.element(key).line.midpoint).draw() for key in branches[branch_idx]]
# ---------- end branches ----------
mesh_8 = Mesh(branches.G_branch_elems)  # disabled
pt_3 = Point(branches.G_branch_midpoints)  # disabled
assembly_branches = Panel(branches.out)  # disabled

mesh_9 = Mesh(assembly_viz.G_connectors_ranges)
line = Line(assembly_viz.lines)
mesh_10 = Mesh(assembly_viz.G_close_pairs)

# ----
# Network visualization
number_slider_5 = Slider(0, range=0..47)
show_11 = BooleanToggle(False)
network_viz = GhPythonScript(assembly=grow_assembly.assembly, show_network=show_11, key=number_slider_5)  # -> out, nodes, edges, current_node, current_node_neighbors; inputs key: Int32
# ---------- network_viz: Python ----------
import sys, os
import ghpythonlib.components as ghcomp
from compas.datastructures import Network
from compas_ghpython.artists import NetworkArtist
from compas_rhino.geometry import RhinoLine

import compas_ghpython
import Rhino.Geometry as rg


data = assembly.network.to_data()
network = Network.from_data(data)

print assembly.network.number_of_nodes()

def draw_network(network):
    """Draw a network in Grasshopper.
    """
    points = []
    for key, attr in network.nodes(True):
        points.append({
            'pos': network.node_coordinates(key),
        })

    lines = []
    for (u, v), attr in network.edges(True):
        lines.append({
            'start': network.node_coordinates(u),
            'end': network.node_coordinates(v),
        })

    points_rg = compas_ghpython.draw_points(points)
    lines_rg = compas_ghpython.draw_lines(lines)

    return points_rg, lines_rg

if show_network:
    nodes, edges = draw_network(network)
    
    current_node = {'pos': network.node_coordinates(key), 'radius': 0.03}
    current_node = compas_ghpython.draw_spheres([current_node])
    
    current_node_neighbors_keys = network.neighbors(key)
    current_node_neighbors = [{'pos': network.node_coordinates(key), 'radius': 0.02} for key in current_node_neighbors_keys]
    current_node_neighbors = compas_ghpython.draw_spheres(current_node_neighbors)
# ---------- end network_viz ----------
pt_4 = Point(network_viz.nodes)
line_2 = Line(network_viz.edges)
brep_3 = Brep(network_viz.current_node)
brep_4 = Brep(network_viz.current_node_neighbors)
preview_2 = CustomPreview(Geometry=brep_4, Material=ColourSwatch(SwatchColor=RGB(255, 207, 207)))
preview_3 = CustomPreview(Geometry=[brep_3, line_2], Material=ColourSwatch(SwatchColor=RGB(0, 0, 0)))

stats = GhPythonScript(assembly=grow_assembly.assembly)  # -> out
# ---------- stats: Python ----------
total_elements = assembly.network.number_of_nodes()
print total_elements, "element(s) in assembly."
# ---------- end stats ----------
numbers = Panel(stats)

# ----
# Export .json
export = Button()
export_2 = Button()
export_3 = PythonScript(DATA=py.DATA, assembly=grow_assembly.assembly, export_to_json=export, export_to_json_unity=export_2)
# ---------- export_3: Python ----------
import os
from compas.datastructures.mesh import mesh_quads_to_triangles
from compas.datastructures.mesh import mesh_unify_cycles

if export_to_json:
    filename = "design_03_part05.json"
    PATH = os.path.join(DATA, "assembly", filename)
    
    # the assembly has to be serialized such that it can be called from CPython, True to enable pretty print
    assembly.to_json(PATH, True)
    

if export_to_json_unity:
    
    for key, e in assembly.elements():
    
        #convert to trimesh
        mesh_quads_to_triangles(e._mesh, check_angles=False)
        #mesh_unify_cycles(e._mesh)
        #print e._mesh.faces
        #print e._mesh.face_vertices(list(e._mesh.faces())[0])

    filename = "unity_assembly_test.json"
    PATH = os.path.join(DATA, "assembly", filename)
    assembly.to_json(PATH)
# ---------- end export_3 ----------

# ----
# Feedback
selected_key = Panel(inputs.selected_key)
target_geometry = Panel(inputs.target_geo_feedback)
shift_value_2 = Panel(inputs.shift_value)
is_colliding = Panel(inputs.is_colliding)
angle_2 = Panel(inputs.angle)
stability_feedback = Panel(inputs.stability_feedback)
