# Grasshopper definition ex1_assembly_1a.ghx (Grasshopper 1.0.7)

panel = Panel("Unload libraries")
bang = Button()
unload = PythonScript(bang=bang)
# ---------- unload: Python ----------
from compas_rhino.utilities.misc import get_tolerance
from compas_rhino.utilities.misc import unload_modules

unload_modules("cdf_2023")
# ---------- end unload ----------

py = PythonScript()  # -> ENVIRONMENT_NAME, HERE, DATA
# ---------- py: Python ----------
import os
import compas_bootstrapper

HERE = os.path.dirname(ghdoc.Path)
DATA = os.path.abspath(os.path.join(HERE, "..", "data"))
ENVIRONMENT_NAME = compas_bootstrapper.ENVIRONMENT_NAME
print(HERE)
print(DATA)
print(ENVIRONMENT_NAME)
# ---------- end py ----------

# ----
# Load Assembly
# Import assembly from .json.
import = Button(ExpressionNormal="True", ExpressionPressed="False")
initial_assembly = GhPythonScript(DATA=py.DATA, import_from_json=import)  # -> out, assembly; inputs import_from_json: Boolean
# ---------- initial_assembly: Python ----------
import os
import json
from scriptcontext import sticky

from cdf_2023.assembly import Assembly

if import_from_json:
    filename = "assembly_part1.json"
    PATH = os.path.join(DATA, "assembly", filename)
    assembly = Assembly.from_json(PATH)

# create a dictionary to store global value in 
assembly.globals = {}

# define global values
assembly.globals['rod_radius'] = 0.01
assembly.globals['rod_length'] = 0.8
assembly.globals['rf_unit_offset'] = 0.2
assembly.globals['rf_unit_radius'] = 0.15
# ---------- end initial_assembly ----------

show = BooleanToggle(True)

# ----
# Assembly Definition
# Create an element object.
reset = Button()
show_2 = BooleanToggle(False)
globals = GhPythonScript(reset=reset)  # -> out, assembly
# ---------- globals: Python ----------
from cdf_2023.assembly import Assembly

# create assembly
assembly = Assembly()

# create a dictionary to store global value in 
assembly.globals = {}

# define global values
assembly.globals['rod_radius'] = 0.01
assembly.globals['rod_length'] = 0.8
assembly.globals['rf_unit_offset'] = 0.2
assembly.globals['rf_unit_radius'] = 0.15


print assembly.globals
# ---------- end globals ----------
assembly_globals = Panel(globals.out)
elem_def = GhPythonScript(assembly=globals.assembly, show_connectors=show, angle=Slider(4.5, range=4..12))  # -> assembly, elem, connector_planes
# ---------- elem_def: Python ----------
import os
import sys
import json
import math

from compas.geometry import Frame, Plane, Rotation, Vector, Point
from compas.geometry import Circle, Cylinder, Translation
from compas.artists import Artist

from cdf_2023.assembly import Element

rf_unit_offset = assembly.globals['rf_unit_offset']
rf_unit_radius = assembly.globals['rf_unit_radius']
radius = assembly.globals['rod_radius']
length = assembly.globals['rod_length']

cross_section_plane = Plane.from_frame(Frame.worldYZ())
cross_section = Circle(cross_section_plane, radius)
elem_geo = Cylinder(cross_section, length)

elem = Element.from_shape(elem_geo, Frame.worldXY())

connector_frame_1 = Frame([rf_unit_offset,-rf_unit_radius/2,0], [1,0,0], [0,1,0])
connector_frame_2 = Frame([-rf_unit_offset,rf_unit_radius/2,0], [-1,0,0], [0,-1,0])

R1 = Rotation.from_axis_and_angle(connector_frame_1.yaxis, math.radians(angle), connector_frame_1.point)
R2 = Rotation.from_axis_and_angle(connector_frame_2.yaxis, math.radians(angle), connector_frame_2.point)

connector_frame_1.transform(R1)
connector_frame_2.transform(R2)

elem.connector_frame_1 = connector_frame_1
elem.connector_frame_2 = connector_frame_2

if show_connectors:
    connector_planes = [Artist(connector_frame_1).draw()]
    connector_planes.append(Artist(connector_frame_2).draw())
# ---------- end elem_def ----------
draw = PythonScript(elements=elem_def.elem, show=show_2)  # -> M, F, C; inputs elements: list
# ---------- draw: Python ----------
from compas.artists import Artist

M = []
C = []
F = []
T = []
connectors = []

if show:
    for elem in elements:
        connectors.append(elem.connector_frame_1)
        connectors.append(elem.connector_frame_2)
        M += [Artist(elem._mesh).draw([0,0,1,1])]
        #C += [Artist(frame).draw() for frame in connectors]
        F += [Artist(elem.frame).draw()]
        T += [Artist(elem.tool_frame).draw()]
# ---------- end draw ----------
pln = Plane(draw.F)
mesh = Mesh(draw.M)
pln_2 = Plane(draw.C)
custom_preview = CustomPreview(Geometry=mesh, Material=ColourSwatch(SwatchColor=RGB(221, 0, 0)))
pln_3 = Plane(elem_def.connector_planes)

panel_2 = Panel(py.ENVIRONMENT_NAME)
angle = Slider(494.7, range=0..720)
element = Button()
element_2 = Button()
reset_key = Button()

# ----
# Controls
threshhold = Slider(87, range=0..180)
human_adds = Button()
robot_adds = Button()
element_3 = Button()
element_4 = Button()
aggregate = Button()
reset_key_2 = Button()
collision = BooleanToggle(False)
add_two = Button()
filter = BooleanToggle(False)
flip = BooleanToggle(False)
pts = Point([Point(2.175463709, 0.6372586271, 1.820186629), Point(2.274348353, -0.8823302572, 0.1857535972)])

set_from_inputs = BooleanToggle(False)
robot_base_plane = Plane(Plane(origin=(-0.151004, 0.002833317895, 0.625169), x=(0, -1, 0), y=(1, 0, 0)))
assembly = Data(elem_def.assembly)
element_5 = Data(elem_def.elem)

# ----
# Generate Assembly
pt = Point(<point referenced from the Rhino model>)
y = Curve(<curve referenced from the Rhino model>)
x = Curve(<curve referenced from the Rhino model>)
pl = ConstructPlane(Origin=pt, XAxis=x, YAxis=y)
inputs = GhPythonScript(element_up=element, element_down=element_2, reset_key=reset_key, angle=angle)  # -> out, current_key, shift_value, angle; unedited script template
pln_4 = Plane(Plane(origin=(2.017317201, -1.06869411, 0), x=(0, -1, 0), y=(1, 0, 0)))
initial_configuration = GhPythonScript(assembly=elem_def.assembly, plane=pl, elem=elem_def.elem)  # -> out, assembly, connector_planes; inputs plane: Plane
# ---------- initial_configuration: Python ----------
import Rhino.Geometry as rg
import math
from scriptcontext import sticky as st

from compas.geometry import Frame, Vector
from compas.geometry import Rotation, Translation, Transformation
from compas.geometry import Point
from compas.artists import Artist


# just for vizualisation
connector_planes = []

radius = assembly.globals['rod_radius']
length = assembly.globals['rod_length']
rf_unit_offset = assembly.globals['rf_unit_offset']
rf_unit_radius = assembly.globals['rf_unit_radius']


T1 = Transformation.from_frame_to_frame(Frame.worldXY(), Frame(plane.Origin, plane.XAxis, plane.YAxis))
#T1 = Transformation.from_frame_to_frame(elem.connector_frame_2, Frame.worldXY())
elem_1 = elem.transformed(T1)

R1 = Rotation.from_axis_and_angle(elem_1.frame.zaxis, math.radians(120), [0,0,0])
R2 = Rotation.from_axis_and_angle(elem_1.frame.zaxis, math.radians(240), [0,0,0])

#T2 = Transformation.from_frame_to_frame(elem.frame, elem.connector_frame_1)
#T3 = Transformation.from_frame_to_frame(elem.frame, elem.connector_frame_2)

#elem_2 = elem_1.transformed(R1)
#elem_3 = elem_1.transformed(R2)

elem_1.connector_1_state = True
elem_1.connector_2_state = False

#elem_2.connector_1_state = False
#elem_2.connector_2_state = False
#
#elem_3.connector_1_state = False
#elem_3.connector_2_state = False


assembly.add_element(elem_1, placed_by = 'initial', frame_id=None)
#assembly.add_element(elem_2, placed_by = 'initial', frame_id=None)
#assembly.add_element(elem_3, placed_by = 'initial', frame_id=None)
#
#assembly.network.add_edge(0, 1, edge_of = 'parent')
#assembly.network.add_edge(0, 2, edge_of = 'parent')
#assembly.network.add_edge(1, 2, edge_of = 'parent')
#
#
#options = assembly.element(1).current_option_vectors(0.4)
#
#
#vr=[]
#pr=[]
#
#print options
#for o, v in options:
#    start = assembly.element(0).frame.point
#    vr.append(rg.Vector3d(*tuple(v)))
#    pr.append(rg.Point3d(o.x, o.y, o.z))
#
#
#print assembly.connectors(state='open')
#
connector_planes = [Artist(connector).draw() for connectors in assembly.connectors(state='open') for connector in connectors]
# ---------- end initial_configuration ----------
pln_5 = Plane(initial_configuration.connector_planes)
generate_assembly = GhPythonScript(
    assembly=assembly,
    elem=element_5,
    set_from_inputs=set_from_inputs,
    robot_base_plane=robot_base_plane,
    angle_threshold=threshhold,
    target_pts=pts,
    filter_options=filter,
    element_up=element_3,
    element_down=element_4,
    reset=reset_key_2,
    angle=inputs.angle,
    flip_human_robot=flip,
    check_for_collisions=collision,
    robot_adds=robot_adds,
    human_adds=human_adds,
    add_two=add_two,
    aggregate=aggregate)  # -> out, assembly, current_key; inputs robot_base_plane: Plane, target_pts: list of Point3d
# ---------- generate_assembly: Python ----------
import Rhino.Geometry as rg
import rhinoscriptsyntax as rs
import math
import random
from scriptcontext import sticky as st
import sys

import ghpythonlib.components as ghcomp

from compas.geometry import Frame, Box, Point
from compas.geometry import Vector, Translation, angle_vectors
from compas.datastructures import mesh_offset
from compas.artists import Artist

from compas.rpc import Proxy

all_options = []
filtered_keys = []
open_connectors_keys = []
flip = 'AA'

#L = list(assembly.elements())

def range_filter(options, robot_base_frame):
    ur_range_max = 1.2
    ur_range_min = 0.75
    filtered_options = []
    for key, elem_origin, option_vector in options:
        v = Vector.from_start_end(elem_origin, robot_base_frame.point)
        dist = v.length
        if ur_range_min <= dist <= ur_range_max:
            filtered_options.append((key, elem_origin, option_vector))
    return filtered_options


def options_filter(all_options, target_points):
    filtered_options = []
    for point in target_points:
        for key, elem_origin, option_vector in all_options:
            v = Vector.from_start_end(elem_origin, point)
            angle = angle_vectors(option_vector, v, deg=True)
            if angle < angle_threshold:
                filtered_options.append((key, elem_origin, option_vector))
    return filtered_options

for key, element in assembly.elements():
    for origin, vector in element.current_option_vectors(0.40):
        all_options.append((key, origin, vector))

#############################################################################
## OPTIONS
#############################################################################

compas_target_pts = [Point(p.X, p.Y, p.Z) for p in target_pts]
robot_base_frame = Frame(robot_base_plane.Origin, robot_base_plane.XAxis, robot_base_plane.YAxis)

# all options
assembly.all_options = all_options

# filtered options
filtered_options = options_filter(all_options, target_pts)
assembly.filtered_options = filtered_options

# current options
current_options_map = {0:all_options, 1: filtered_options}
assembly.current_options = current_options_map[filter_options]

for option in current_options_map[filter_options]:
    open_connectors_keys.append(option[0])

open_connectors_keys = list(set(open_connectors_keys))

#############################################################################
## SELECT A KEY
#############################################################################

guid = str(ghenv.Component.InstanceGuid)
element_key = "elem_" + guid

if element_key not in st:
    st[element_key] = 0

if reset:
    st[element_key] = 0

if element_up:
    if st[element_key] < len(open_connectors_keys) - 1:
        st[element_key] += 1

if element_down:
    if st[element_key] <= len(open_connectors_keys) - 1:
        st[element_key] -= 1

    if st[element_key] < 1:
        st[element_key] = 0

#############################################################################
## OPEN CONNECTORS
#############################################################################

if len(open_connectors_keys) > 0:
    if set_from_inputs:
        current_key = current_key
    else:
        current_key = open_connectors_keys[st[element_key]]
        current_elem = assembly.network.node[current_key]['element']
    if len(open_connectors_keys) == 1:
        print 'OPEN CONNECTORS AT KEY:', open_connectors_keys[0]
    else:
        open_connectors_keys.sort()
        print 'OPEN CONNECTORS AT KEYS:', ', '.join(map(str, open_connectors_keys))
else: 
    current_key = None
    current_elem = None
    #print 
    print("!!! NO OPEN CONNECTORS AVAILABLE !!!")
    print("Suggestion 1: INCREASE 'angle_threshold'!")
    print("Suggestion 2: REPOSITION 'target_pts'!")

# Visualize all open connector frames
#connector_frames = [frame for elem_connectors in assembly.connectors(state='open') for frame in elem_connectors]
#
#for frame in connector_frames:
#    p = frame.point + frame.xaxis*0.0
#    T = Translation.from_vector(frame.yaxis*rf_unit_radius/2.)
#    connector_frame = Frame(p, frame.xaxis, frame.yaxis).transformed(T)
#    open_connectors_frames.append(connector_frame)
#    
#assembly.open_connectors_frames = open_connectors_frames

#############################################################################
## LAST ADDED KEYS
#############################################################################

key_index = assembly.network.key_index()
keys = [key_index[key] for key in assembly.network.nodes()]
new_keys = keys[-2:]
print 'LAST ADDED KEYS:', ', '.join(map(str, new_keys))

#############################################################################
## ADD ELEMENTS TO ASSEMBLY
#############################################################################

# Robot adds first element
if robot_adds:
    assembly.add_rf_unit_element(current_key, flip, angle, placed_by ='robot', on_ground=False, collision_check=check_for_collisions, unit_index=0)
    
# Human adds second element element
if human_adds:
    assembly.add_rf_unit_element(current_key, flip, angle, placed_by ='human', on_ground=False, collision_check=check_for_collisions, unit_index=1)

# Add two elements
if add_two:
    assembly.close_rf_unit(current_key, flip, angle, on_ground = False, collision_check=check_for_collisions)

#############################################################################
## RANDOM GROWTH
#############################################################################

if aggregate:
    for i in range (20):
        key_index = assembly.network.key_index()
        keys = [key_index[key] for key in assembly.network.nodes()]
        random_index = random.randint(0, len(keys)-1)
        random_key = keys[random_index]
        random_elem = assembly.network.node[random_key]['element']
        if random_elem.connector_1_state or random_elem.connector_2_state:
            random_angle = random.uniform(0., 360.)
            elem_options = assembly.element(random_key).current_option_elements(flip, random_angle)
            #random_angle = random.randrange(0., 360., 20)
            assembly.close_rf_unit(random_key, flip, random_angle, on_ground = False, collision_check=check_for_collisions)
            #assembly.range_filter(robot_base_frame)
        else:
            print 'No open connectors'
            


#############################################################################
## COLLISION CHECK
#############################################################################

#def c_check(elem_options):
#    collision = False
#    for option in elem_options:
#        c = assembly.collision_check(option, tolerance = -0.001)
#        if c == True:
#            collision = True
#        return collision
#        
#print c_check(elem_options)




"""
### UNSOLVED: Error loading compas_cgal intersection module's .dll file ###

collision_func = Proxy('assembly_information_model.assembly.collision', python = 'C://Users//lidet//anaconda3//envs//cgal//python.exe')

print collision_func._python

collision_func.stop_server()
collision_func.start_server()

test = collision_func.collision_check_cgal(assembly, new_elem)
print test
"""
# ---------- end generate_assembly ----------
current_key = Panel(generate_assembly.current_key)
status_update = Panel(generate_assembly.out)

# ----
# Assembly Visualization
# 1. Visualize assembly.
# 2. Visualize selected option.
# 3. Visuilize current options (all/filtered).
show_3 = BooleanToggle(True)
show_4 = BooleanToggle(True)
show_5 = BooleanToggle(True)
show_6 = BooleanToggle(True)
show_7 = BooleanToggle(False)
assembly_viz = PythonScript(
    assembly=generate_assembly.assembly,
    show_assembly=show_6,
    show_option=show_4,
    show_arrows=show_5,
    show_spheres=show_3,
    show_keys=show_7,
    filter_options=filter,
    current_key=generate_assembly.current_key,
    angle=inputs.angle,
    flip_human_robot=flip)  # -> out, G_initial, G_built_by_human, G_built_by_robot, G_selected, G_option_human, G_option_robot, connector_planes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; inputs current_key: Int32
# ---------- assembly_viz: Python ----------
import os
import sys
from scriptcontext import sticky as st
import Rhino.Geometry as rg

import math
from math import pi

from compas.geometry import Vector, Translation, Frame
from compas.artists import Artist

connector_planes = []
connectors = []
G_selected = []
G_initial = []
G_built_by_human = []
G_built_by_robot = []
G_option_robot = []
G_option_human = []
option_vectors = []
origin_option_vectors = []
flip = 'AA'

tag_text = []
tag_point = []

radius = assembly.globals['rod_radius']
rf_unit_radius = assembly.globals['rf_unit_radius']

def show(element, output_geo, color):
    mesh = Artist(element.mesh).draw(color)
    output_geo.append(mesh)

def show_multiple(elements, output_geo, color):
    for element in elements:
        mesh = Artist(element.mesh).draw(color)
        output_geo.append(mesh)
        
if current_key != None:
    current_element = assembly.element(current_key)
    elem_options = assembly.element(current_key).current_option_elements(flip, angle)
    G_selected = Artist(assembly.element(current_key).mesh).draw()
else:
    current_element = None
    elem_options = []



if len(elem_options) != 0:
    elem_option = elem_options[0]

if flip_human_robot:
    elem_options.reverse()

print elem_options

robot_keys = list(assembly.network.nodes_where({'placed_by':'robot'}))
human_keys = list(assembly.network.nodes_where({'placed_by':'human'}))
initial_keys = list(assembly.network.nodes_where({'placed_by':'initial'}))

robot_elements = [assembly.element(key) for key in robot_keys] 
human_elements = [assembly.element(key) for key in human_keys] 
initial_elements = [assembly.element(key) for key in initial_keys] 


# Visualize assembly
if show_assembly:
    for element in robot_elements:
        mesh = Artist(element.mesh).draw([0.7,0.7,0.75,0.1])
        G_built_by_robot.append(mesh)
    for element in human_elements:
        mesh = Artist(element.mesh).draw([1.,0.7,0.65,0.1])
        G_built_by_human.append(mesh)
    for element in initial_elements:
        mesh = Artist(element.mesh).draw([0.8,0.8,0.8,0.1])
        G_initial.append(mesh)

# Vizualize current connector 
if show_option and show_assembly:
    if elem_options:
        show(elem_options[0], G_option_robot, [0.7,0.9,0.9,0.8])
        show(elem_options[1], G_option_human, [0.8,0.2,0.1,0.1])
    else:
        print('No open connectors')

# Visualize all options
if show_arrows and show_assembly:
    for key, o, v in assembly.current_options:
            option_vectors.append(rg.Vector3d(*tuple(v)))
            origin_option_vectors.append(rg.Point3d(o.x, o.y, o.z))

#elem_option_robot = elem_options[0] # elem for planning robot routine

if show_keys:
    for key, element in assembly.elements():
        tag_text.append(str(key))
        tag_point.append(Artist(element.frame).draw().Origin)
# ---------- end assembly_viz ----------
mesh_2 = Mesh(assembly_viz.G_initial)
mesh_3 = Mesh(assembly_viz.G_option_robot)
vec = Vector(assembly_viz.option_vectors)
mesh_4 = Mesh(assembly_viz.G_built_by_robot)
mesh_5 = Mesh(assembly_viz.G_option_human)
pln_6 = Plane(assembly_viz.connector_planes)
pt_2 = Point(assembly_viz.origin_option_vectors)
mesh_6 = Mesh(assembly_viz.G_built_by_human)
mesh_7 = Mesh(assembly_viz.G_selected)
tag = TextTag(Location=assembly_viz.tag_point, Text=assembly_viz.tag_text)
vdis = VectorDisplay(Anchor=pt_2, Vector=vec)
sph = Sphere(Base=assembly_viz.connectors, Radius=Slider(0.05, range=0..1))
custom_preview_2 = CustomPreview(Geometry=mesh_2, Material=ColourSwatch(SwatchColor=RGBA(189, 189, 189, 197)))
custom_preview_3 = CustomPreview(Geometry=mesh_6, Material=ColourSwatch(SwatchColor=RGB(255, 196, 196)))
custom_preview_4 = CustomPreview(Geometry=mesh_4, Material=ColourSwatch(SwatchColor=RGBA(154, 196, 212, 164)))
preview = CustomPreview(Geometry=mesh_5, Material=ColourSwatch(SwatchColor=RGB(255, 92, 92)))
custom_preview_5 = CustomPreview(Geometry=mesh_3, Material=ColourSwatch(SwatchColor=RGBA(178, 219, 212, 164)))
custom_preview_6 = CustomPreview(Geometry=sph, Material=ColourSwatch(SwatchColor=RGBA(214, 255, 123, 108)))

# ----
# Transform Assembly
pt_3 = Point(<point referenced from the Rhino model>)
x_2 = Curve(<curve referenced from the Rhino model>)
y_2 = Curve(<curve referenced from the Rhino model>)
pl_2 = ConstructPlane(Origin=pt_3, XAxis=x_2, YAxis=y_2)
transform = GhPythonScript(assembly=initial_configuration.assembly, transform=Toggle(False), trnsf_plane=pl_2)  # -> out, assembly, planes
# ---------- transform: Python ----------
from compas.geometry import Frame
from compas.geometry import Transformation, Translation
import Rhino.Geometry as rg

from compas.artists import Artist

planes = []

trnsf_plane.Transform(rg.Transform.Translation(0.03,0,0))

if transform:
    T = Transformation.from_frame_to_frame(Frame.worldXY(), Frame(trnsf_plane.Origin, trnsf_plane.XAxis, trnsf_plane.YAxis))
    assembly.transform(T)
    assembly.network.transform(T)
    
    
for key, element in assembly.elements():
    planes.append(Artist(element.frame).draw())
# ---------- end transform ----------

outputs = GhPythonScript(assembly=generate_assembly.assembly)  # -> out, assembly, open_connectors_keys; unedited script template

# ----
# Network Visualization
number_slider = Slider(0, range=0..47)
show_8 = BooleanToggle(False)
network_viz = GhPythonScript(assembly=generate_assembly.assembly, show_network=show_8, key=number_slider)  # -> out, nodes, edges, current_node, current_node_neighbors; inputs key: Int32
# ---------- network_viz: Python ----------
import sys, os
import ghpythonlib.components as ghcomp
from compas.datastructures import Network
from compas_ghpython.artists import NetworkArtist
from compas_rhino.geometry import RhinoLine

import compas_ghpython
import Rhino.Geometry as rg


data = assembly.network.to_data()
network = Network.from_data(data)

print assembly.network.number_of_nodes()

def draw_network(network):
    """Draw a network in Grasshopper.
    """
    points = []
    for key, attr in network.nodes(True):
        points.append({
            'pos': network.node_coordinates(key),
        })

    lines = []
    for (u, v), attr in network.edges(True):
        lines.append({
            'start': network.node_coordinates(u),
            'end': network.node_coordinates(v),
        })

    points_rg = compas_ghpython.draw_points(points)
    lines_rg = compas_ghpython.draw_lines(lines)

    return points_rg, lines_rg

if show_network:
    nodes, edges = draw_network(network)
    
    current_node = {'pos': network.node_coordinates(key), 'radius': 0.03}
    current_node = compas_ghpython.draw_spheres([current_node])
    
    current_node_neighbors_keys = network.neighbors(key)
    current_node_neighbors = [{'pos': network.node_coordinates(key), 'radius': 0.02} for key in current_node_neighbors_keys]
    current_node_neighbors = compas_ghpython.draw_spheres(current_node_neighbors)
# ---------- end network_viz ----------
pt_4 = Point(network_viz.nodes)
line = Line(network_viz.edges)
brep = Brep(network_viz.current_node)
brep_2 = Brep(network_viz.current_node_neighbors)
preview_2 = CustomPreview(Geometry=[brep, line], Material=ColourSwatch(SwatchColor=RGB(0, 0, 0)))
preview_3 = CustomPreview(Geometry=brep_2, Material=ColourSwatch(SwatchColor=RGB(255, 207, 207)))

# ----
# Add support
toggle = BooleanToggle(False)
pln_7 = Plane(Plane(origin=(0.8284965546, -0.116329934, 0.3446181635), x=(0.5836778286, 0.5396858127, -0.6066790058), y=(0.6788954185, -0.7342349834, 0)))
support = GhPythonScript(assembly=transform.assembly, add_support=toggle, elem=elem_def.elem, support_plane=pln_7)  # -> out, support_geo, assembly, elem_plane
# ---------- support: Python ----------
from compas.geometry import Frame, Transformation
from compas.artists import Artist
import Rhino.Geometry as rg

support_plane.Transform(rg.Transform.Translation(0.03,0,0))

T_support = Transformation.from_frame(Frame(support_plane.Origin, -support_plane.XAxis, support_plane.YAxis))

if add_support:
    added_support_elem = elem.transformed(T_support)
    support_geo = Artist(added_support_elem.mesh).draw()

    added_support_elem.connector_frame_1 = Frame.worldXY()
    added_support_elem.connector_frame_2 = Frame.worldXY()
    
    added_support_elem.connector_1_state = False
    added_support_elem.connector_2_state = False
    
    assembly.add_element(added_support_elem, placed_by = 'initial', frame_id=None)
    
    elem_plane = Artist(added_support_elem.frame).draw()
# ---------- end support ----------
pln_8 = Plane(support.elem_plane)
mesh_8 = Mesh(support.support_geo)

# ----
# Export .json
export = Button()
export_2 = Button()
export_3 = PythonScript(DATA=py.DATA, assembly=generate_assembly.assembly, export_to_json=export, export_to_json_unity=export_2)
# ---------- export_3: Python ----------
import os
from compas.datastructures.mesh import mesh_quads_to_triangles
from compas.datastructures.mesh import mesh_unify_cycles

if export_to_json:
    filename = "assembly_part1.json"
    PATH = os.path.join(DATA, "assembly", filename)
    
    # the assembly has to be serialized such that it can be called from CPython, True to enable pretty print
    assembly.to_json(PATH, True)
    

if export_to_json_unity:
    
    for key, e in assembly.elements():
    
        #convert to trimesh
        mesh_quads_to_triangles(e._mesh, check_angles=False)
        #mesh_unify_cycles(e._mesh)
        #print e._mesh.faces
        #print e._mesh.face_vertices(list(e._mesh.faces())[0])

    filename = "unity_assembly_test.json"
    PATH = os.path.join(DATA, "assembly", filename)
    assembly.to_json(PATH)
# ---------- end export_3 ----------
