# Grasshopper definition ex1_assembly_1b.ghx (Grasshopper 1.0.7)

# ----
# Color Coding
swatch = ColourSwatch(SwatchColor=RGB(255, 222, 3))
color_coding = GhPythonScript(
    is_planned=swatch,
    is_built=ColourSwatch(SwatchColor=RGB(207, 255, 181)),
    is_support=ColourSwatch(SwatchColor=RGB(0, 0, 255)),
    is_held_by_robot=ColourSwatch(SwatchColor=RGB(255, 2, 102)),
    has_open_connector=ColourSwatch(SwatchColor=RGB(126, 255, 61)))  # -> out, color_coding
# ---------- color_coding: Python ----------
import rhinoscriptsyntax as rs
from compas.colors import Color


color_is_planned = Color(is_planned.R/255 , is_planned.G/255, is_planned.B/255)
color_is_built = Color(is_built.R/255 , is_built.G/255, is_built.B/255)
color_is_support = Color(is_support.R/255 , is_support.G/255, is_support.B/255)
color_is_held_by_robot = Color(is_held_by_robot.R/255 , is_held_by_robot.G/255, is_held_by_robot.B/255)
color_has_open_connector = Color(has_open_connector.R/255 , has_open_connector.G/255,has_open_connector.B/255)

color_coding = {'color_is_planned':color_is_planned, 'color_is_built':color_is_built, 'color_is_support':color_is_support, 'color_is_held_by_robot':color_is_held_by_robot, 'color_has_open_connector':color_has_open_connector}

print color_coding
# ---------- end color_coding ----------
panel = Panel(color_coding.out)

panel_2 = Panel("Unload libraries")
bang = Button()
unload = PythonScript(bang=bang)
# ---------- unload: Python ----------
from compas_rhino.utilities.misc import get_tolerance
from compas_rhino.utilities.misc import unload_modules

unload_modules("cdf_2023")
# ---------- end unload ----------

py = PythonScript()  # -> ENVIRONMENT_NAME, HERE, DATA
# ---------- py: Python ----------
import os
import compas_bootstrapper

HERE = os.path.dirname(ghdoc.Path)
DATA = os.path.abspath(os.path.join(HERE, "..", "data"))
ENVIRONMENT_NAME = compas_bootstrapper.ENVIRONMENT_NAME
print(HERE)
print(DATA)
print(ENVIRONMENT_NAME)
# ---------- end py ----------

# ----
# Load Assembly
# Import assembly from .json.
import = Button(ExpressionNormal="True", ExpressionPressed="False")
initial_assembly = GhPythonScript(DATA=py.DATA, import_from_json=import)  # -> out, assembly; inputs import_from_json: Boolean
# ---------- initial_assembly: Python ----------
import os
import json
from scriptcontext import sticky

from cdf_2023.assembly import Assembly

if import_from_json:
    filename = "study_1e.json"
    PATH = os.path.join(DATA, "assembly", filename)
    assembly = Assembly.from_json(PATH)

# create a dictionary to store global value in 
assembly.globals = {}

# define global values
assembly.globals['rod_radius'] = 0.01
assembly.globals['rod_length'] = 0.8
assembly.globals['rf_unit_offset'] = 0.2
assembly.globals['rf_unit_radius'] = 0.15
# ---------- end initial_assembly ----------

brep = Brep(<brep referenced from the Rhino model>)

# ----
# Assembly Definition
# Create an element object.
reset_assembly = Button()
globals = GhPythonScript(reset=reset_assembly)  # -> out, assembly
# ---------- globals: Python ----------
from cdf_2023.assembly import Assembly

# create assembly
assembly = Assembly()

# create a dictionary to store global value in 
assembly.globals = {}

# define global values
assembly.globals['rod_radius'] = 0.01
assembly.globals['rod_length'] = 0.95
assembly.globals['rf_unit_offset'] = 0.25
assembly.globals['rf_unit_radius'] = 0.15


print assembly.globals
# ---------- end globals ----------
assembly_globals = Panel(globals.out)
show = BooleanToggle(False)
show_2 = BooleanToggle(True)
elem_def = GhPythonScript(assembly=globals.assembly, show_connectors=show_2, angle=Slider(4.5, range=4..12), conn_range=brep)  # -> assembly, elem; inputs conn_range: Brep
# ---------- elem_def: Python ----------
import os
import sys
import json
import math

from compas.geometry import Frame, Plane, Rotation, Vector, Point
from compas.geometry import Circle, Cylinder, Translation, Line, Cone
from compas.artists import Artist

from cdf_2023.assembly import Element

rf_unit_offset = assembly.globals['rf_unit_offset']
rf_unit_radius = assembly.globals['rf_unit_radius']
radius = assembly.globals['rod_radius']
length = assembly.globals['rod_length']

cross_section_plane = Plane.from_frame(Frame.worldYZ())
cross_section = Circle(cross_section_plane, radius)
elem_geo = Cylinder(cross_section, length)

elem = Element.from_shape(elem_geo, Frame.worldXY())

connector_frame_1 = Frame([rf_unit_offset,-rf_unit_radius/2,0], [1,0,0], [0,1,0])
connector_frame_2 = Frame([-rf_unit_offset,rf_unit_radius/2,0], [-1,0,0], [0,-1,0])

R1 = Rotation.from_axis_and_angle(connector_frame_1.yaxis, math.radians(angle), connector_frame_1.point)
R2 = Rotation.from_axis_and_angle(connector_frame_2.yaxis, math.radians(angle), connector_frame_2.point)

connector_frame_1.transform(R1)
connector_frame_2.transform(R2)

elem.connector_frame_1 = connector_frame_1
elem.connector_frame_2 = connector_frame_2

elem.line = Line([-length/2.,0,0],[length/2.,0,0])


circle_frame_1 = Frame([-0.34,0,0],[0,0,-1],[0,1,0])
circle_frame_2 = Frame([0.34,0,0],[0,0,1],[0,1,0])
circle_1 = Circle(Plane.from_frame(circle_frame_1), 0.5)
circle_2 = Circle(Plane.from_frame(circle_frame_2), 0.5)
cone_2 = Cone(circle_1, 0.32)
cone_1 = Cone(circle_2, 0.32)

elem.connector_range_1 = cone_1
elem.connector_range_2 = cone_2

#print elem.connector_range_1
# ---------- end elem_def ----------
draw = PythonScript(elements=elem_def.elem, show=show)  # -> M, F, C; inputs elements: list
# ---------- draw: Python ----------
from compas.artists import Artist

M = []
C = []
F = []
T = []

if show:
    for elem in elements:
        C.append(Artist(elem.connector_frame_1).draw())
        C.append(Artist(elem.connector_frame_2).draw())
        M += [Artist(elem._mesh).draw([0,0,1,1])]
        F += [Artist(elem.frame).draw()]
        T += [Artist(elem.tool_frame).draw()]
# ---------- end draw ----------
mesh = Mesh(draw.M)
pln = Plane(draw.F)
pln_2 = Plane(draw.C)
custom_preview = CustomPreview(Geometry=mesh, Material=ColourSwatch(SwatchColor=RGB(221, 0, 0)))

panel_3 = Panel(py.ENVIRONMENT_NAME)

# ----
# Generate Assembly
# Initial Assembly Configuration
pt = Point(<point referenced from the Rhino model>)
x = Curve(<curve referenced from the Rhino model>)
y = Curve(<curve referenced from the Rhino model>)
pl = ConstructPlane(Origin=pt, XAxis=x, YAxis=y)
worldxy = Plane(PlaneXY(0, 0, 0))
initial_configuration = GhPythonScript(assembly=elem_def.assembly, planes=pl, elem=elem_def.elem, show_open_connectors=Toggle(False))  # -> out, assembly, connector_planes; inputs planes: list of Plane
# ---------- initial_configuration: Python ----------
import Rhino.Geometry as rg
import math
from scriptcontext import sticky as st

from compas.geometry import Frame, Vector
from compas.geometry import Rotation, Translation, Transformation
from compas.geometry import Point
from compas.artists import Artist


# just for vizualisation
connector_planes = []

radius = assembly.globals['rod_radius']
length = assembly.globals['rod_length']
rf_unit_offset = assembly.globals['rf_unit_offset']
rf_unit_radius = assembly.globals['rf_unit_radius']


for plane in planes:
    T1 = Transformation.from_frame_to_frame(Frame.worldXY(), Frame(plane.Origin, plane.XAxis, plane.YAxis))
    #T1 = Transformation.from_frame_to_frame(elem.connector_frame_2, Frame.worldXY())
    elem_1 = elem.transformed(T1)
    
    R1 = Rotation.from_axis_and_angle(elem_1.frame.zaxis, math.radians(120), [0,0,0])
    R2 = Rotation.from_axis_and_angle(elem_1.frame.zaxis, math.radians(240), [0,0,0])
    
    #T2 = Transformation.from_frame_to_frame(elem.frame, elem.connector_frame_1)
    #T3 = Transformation.from_frame_to_frame(elem.frame, elem.connector_frame_2)
    
    #elem_2 = elem_1.transformed(R1)
    #elem_3 = elem_1.transformed(R2)
    
    elem_1.connector_1_state = True
    elem_1.connector_2_state = False

#elem_2.connector_1_state = False
#elem_2.connector_2_state = False
#
#elem_3.connector_1_state = False
#elem_3.connector_2_state = False


    assembly.add_element(elem_1, placed_by='initial', is_support=True, frame_id=None)
#assembly.add_element(elem_2, placed_by='initial', frame_id=None)
#assembly.add_element(elem_3, placed_by='initial', frame_id=None)
#
#assembly.network.add_edge(0, 1, edge_of='parent')
#assembly.network.add_edge(0, 2, edge_of='parent')
#assembly.network.add_edge(1, 2, edge_of='parent')

if show_open_connectors:
    for key, connectors in assembly.connectors(state='open'):
        for connector in connectors:
            connector_planes.append(Artist(connector).draw())
# ---------- end initial_configuration ----------
pln_3 = Plane(initial_configuration.connector_planes)

supports = Brep(<brep referenced from the Rhino model>)
mesh_2 = Mesh(<mesh referenced from the Rhino model>)

# ----
# Transform Assembly
pt_2 = Point(<point referenced from the Rhino model>)
x_2 = Curve(<curve referenced from the Rhino model>)
y_2 = Curve(<curve referenced from the Rhino model>)
pl_2 = ConstructPlane(Origin=pt_2, XAxis=x_2, YAxis=y_2)
transform = GhPythonScript(assembly=initial_configuration.assembly, transform=Toggle(False), trnsf_plane=pl_2)  # -> out, assembly
# ---------- transform: Python ----------
from compas.geometry import Frame
from compas.geometry import Transformation
import Rhino.Geometry as rg

from compas.artists import Artist

planes = []

if transform:
    T = Transformation.from_frame_to_frame(assembly.element(0).frame, Frame(trnsf_plane.Origin, trnsf_plane.XAxis, trnsf_plane.YAxis))
    assembly.transform(T)
    assembly.network.transform(T)
# ---------- end transform ----------

# ---- group: capture
viewport_name = Text("workflow_2")
capture_to_bitmap = PythonScript(DATA=py.DATA, capture=Button(), viewport_name=viewport_name, idx=Slider(2, range=0..10))  # -> out, a; inputs capture: Boolean, idx: Int32
# ---------- capture_to_bitmap: Python ----------
import Rhino
import System.Drawing
from scriptcontext import sticky as st

import sys, os
import ghpythonlib.components as ghcomp
import Grasshopper as gh
import datetime


ghComp = ghenv.Component
ghDoc = ghComp.OnPingDocument()

def rCommonCap(filePath, viewportName,scaleFactor):
    RhinoDocument = Rhino.RhinoDoc.ActiveDoc
    view = RhinoDocument.Views.Find(viewportName, False)
    vp = view.ActiveViewport
    size = System.Drawing.Size(vp.Size.Width*scaleFactor,vp.Size.Height*scaleFactor)
    capture = view.CaptureToBitmap(size)
    capture.Save(filePath);


export_dir = os.path.join(DATA, 'parameter_studies')
if not os.path.isdir(export_dir): os.mkdir(export_dir)
print export_dir
filename = os.path.join(export_dir, 'capture_' + str(idx) + '.png') 
print filename

zoom = 1

if capture:
    rCommonCap(filename, viewport_name, zoom)
# ---------- end capture_to_bitmap ----------

# ----
# Settings
reset_key = Button()
angle_weight = Slider(1, range=0.1..1.1)
dist_weight = Slider(1, range=0..1)
shift_value = Slider(0, range=-0.15..0.05)
angle = Slider(360, range=0..360)
equlibrium = BooleanToggle(False)
collision = BooleanToggle(True)
next = Button()
prev = Button()
join = BooleanToggle(False)  # disabled
flip = BooleanToggle(False)

# ----
# Assembly Branches
number_slider = Slider(0, range=0..10)

# ----
# Assembly Visualization
# 1. Visualize assembly.
# 2. Visualize selected option.
# 3. Visuilize current options (all/filtered).
list = ValueList({"'Built by Human/Robot'": 0, "'Design Generation'": 1, "'Assembly Workflow'": 2}, selected="'Built by Human/Robot'")
show_3 = BooleanToggle(True)
show_4 = BooleanToggle(False)
show_5 = BooleanToggle(False)
show_6 = BooleanToggle(True)
show_7 = BooleanToggle(False)
show_8 = BooleanToggle(False)
show_9 = BooleanToggle(False)
show_10 = BooleanToggle(False)
custom_preview_2 = CustomPreview(Material=ColourSwatch(SwatchColor=RGB(201, 235, 232)))

# ----
# Aggregate
options_num = Slider(80, range=1..100)
iterations = Slider(1, range=1..50)
list_2 = ValueList({"1. FROM RANDOM VALUES": 0, "2. FROM INPUT GEOMETRY": 1}, selected="2. FROM INPUT GEOMETRY")
human_adds = Button()
robot_adds = Button()
aggregate = Button()
add_two = Button()
update = GhPythonScript(trigger=[robot_adds, human_adds, add_two, aggregate])  # -> update; inputs trigger: list
# ---------- update: Python ----------
update = False

for value in trigger:
    if value:
        update = True

print update
# ---------- end update ----------

inputs = GhPythonScript(
    assembly=elem_def.assembly,
    input_geo=mesh_2,
    support=supports,
    next_element=next,
    prev_element=prev,
    angle=angle,
    shift_value=shift_value,
    dist_weight=dist_weight,
    angle_weight=angle_weight,
    collision_check=collision,
    equilibrium_check=equlibrium,
    join_branches=join,
    reset_key=reset_key,
    update=update)  # -> out, assembly, selected_key, angle, shift_value, origins, vectors, sel_conn_plane; inputs input_geo: Mesh, support: Brep
# ---------- inputs: Python ----------
import math
import random
from scriptcontext import sticky as st
import Rhino.Geometry as rg

import ghpythonlib.components as ghcomp

from compas.geometry import Frame, Box, Point
from compas.geometry import Vector, Translation, angle_vectors, Rotation
from compas.artists import Artist

all_options = []
filtered_keys = []
distances = []
vectors = []
origins = []

assembly.support = support
assembly.input_geo = input_geo

def range_filter(options, robot_base_frame):
    ur_range_max = 1.2
    ur_range_min = 0.75
    filtered_options = []
    for key, elem_origin, option_vector in options:
        v = Vector.from_start_end(elem_origin, robot_base_frame.point)
        dist = v.length
        if ur_range_min <= dist <= ur_range_max:
            filtered_options.append((key, elem_origin, option_vector))
    return filtered_options

def options_filter(all_options, target_points):
    filtered_options = []
    for point in target_points:
        for key, elem_origin, option_vector in all_options:
            v = Vector.from_start_end(elem_origin, point)
            angle = angle_vectors(option_vector, v, deg=True)
            if angle < angle_threshold:
                filtered_options.append((key, elem_origin, option_vector))
    return filtered_options

for key, element in assembly.elements():
    for origin, vector in element.current_option_vectors(0.40):
        all_options.append((key, origin, vector))

#############################################################################
## OPTIONS
#############################################################################

#compas_target_pts = [Point(p.X, p.Y, p.Z) for p in target_pts]
#robot_base_frame = Frame(robot_base_plane.Origin, robot_base_plane.XAxis, robot_base_plane.YAxis)

# all options (key, origin, vector)
assembly.all_options = all_options

# filtered options
#filtered_options = options_filter(all_options, target_pts)
#assembly.filtered_options = filtered_options

# current options
#current_options_map = {0:all_options, 1: filtered_options}
assembly.current_options = all_options

# all options keys
open_connectors_keys = [option[0] for option in assembly.current_options]
print open_connectors_keys

open_connectors_keys = list(set(open_connectors_keys))
assembly.open_connectors_keys = open_connectors_keys

#############################################################################
## SELECT A KEY
#############################################################################

guid = str(ghenv.Component.InstanceGuid)
element_key = "elem_" + guid

if element_key not in st or None:
    st[element_key] = 0

if reset_key:
    st[element_key] = 0

if next_element:
    if st[element_key] < len(open_connectors_keys) - 1:
        st[element_key] += 1

if prev_element:
    if st[element_key] <= len(open_connectors_keys) - 1:
        st[element_key] -= 1

    if st[element_key] < 1:
        st[element_key] = 0


#############################################################################
## OPEN CONNECTORS
#############################################################################

if len(open_connectors_keys) == 0: 
    selected_key = 0
    print("!!! NO OPEN CONNECTORS AVAILABLE !!!")
    print("Suggestion: RESET KEY!")
else:
    selected_key = open_connectors_keys[st[element_key]]
    print("Element with key {} selected.".format(selected_key))
    
sel_elem = assembly.network.node[selected_key]['element']

#############################################################################
## DISPLAY SELECTED CONNECTOR
#############################################################################

if selected_key:
    sel_conn_frame = assembly.element(selected_key).connectors(state='open')[0]

    R = Rotation.from_axis_and_angle(sel_elem.frame.xaxis, math.radians(angle), sel_elem.frame.point)
    
    sel_conn_frame_copy = sel_conn_frame.transformed(R)
    sel_conn_plane = Artist(sel_conn_frame_copy).draw()

#############################################################################
## DISTANCE TO INPUT GEO
#############################################################################

    distance, shortest_vector = assembly.distance_to_input_geo(selected_key, angle, input_geo)
    
    # Vector Display
    vectors.append(shortest_vector)
    origins.append(sel_conn_plane.Origin)
    
    print 'Key {}: {dist:.2f}m is the distance to the input geometry.'. format(selected_key, dist=distance)

#############################################################################
## ORIENTATION TO INPUT GEO
#############################################################################

    output_value, shortest_vector = assembly.orientation_to_input_geo(selected_key, angle, input_geo)
    
    # Vector Dispaly
    vectors.append(sel_conn_plane.ZAxis)
    origins.append(sel_conn_plane.Origin)
    
    print 'Key {}: {len:.2f} is the length of the cross product vector.'. format(selected_key, len=output_value)

#############################################################################
## LAST ADDED KEYS
#############################################################################

key_index = assembly.network.key_index()
keys = [key_index[key] for key in assembly.network.nodes()]
new_keys = keys[-2:]
assembly.last_added = new_keys
print 'Last added keys:', ', '.join(map(str, new_keys))
# ---------- end inputs ----------
keys_status_update = Panel(inputs.out)
pln_4 = Plane(inputs.sel_conn_plane)
vdis = VectorDisplay(Anchor=inputs.origins, Vector=inputs.vectors)
angle_2 = Panel(inputs.angle)
shift_value_2 = Panel(inputs.shift_value)
selected_key = Panel(inputs.selected_key)

aggregate_2 = GhPythonScript(
    assembly=transform.assembly,
    elem=elem_def.elem,
    selected_key=inputs.selected_key,
    angle=inputs.angle,
    shift_value=inputs.shift_value,
    dist_weight=dist_weight,
    angle_weight=angle_weight,
    flip_human_robot=flip,
    collision_check=collision,
    equilibrium_check=equlibrium,
    robot_adds=robot_adds,
    human_adds=human_adds,
    add_two=add_two,
    options_num=options_num,
    iterations=iterations,
    mode=list_2)  # -> out, assembly, a_line, b_line, c_line; inputs equilibrium_check: Boolean, iterations: Int32
# ---------- aggregate_2: Python ----------
import sys
import random
from scriptcontext import sticky as st
import ghpythonlib.components as ghcomp
import math

from compas.geometry import distance_line_line, Line, is_intersection_line_line, Plane, Frame, is_intersection_line_plane
from compas.artists import Artist
import Rhino.Geometry as rg
import rhinoscriptsyntax as rs

import ghpythonlib.components as gh

flip = 'AA'
#selected_key = st["selected_key"]

#############################################################################
## ADD ELEMENTS TO ASSEMBLY
#############################################################################

# Robot adds first element
if robot_adds:
    assembly.add_rf_unit_element(selected_key, flip, angle, shift_value, placed_by ='robot', on_ground=False, unit_index=0)
    
# Human adds second element element
if human_adds:
    assembly.add_rf_unit_element(selected_key, flip, angle, shift_value, placed_by ='human', on_ground=False, unit_index=1)

# Add two elements
if add_two:
    assembly.close_rf_unit(selected_key, flip, angle, shift_value, on_ground = False)


#############################################################################
## GROWTH ALONG AN INPUT GEOMETRY
#############################################################################

if aggregate and mode == 1:
    msgs = []
    for i in range (iterations): 
        print('---------------------- Start ----------------------')
        keys = [key for key, frames in assembly.connectors('open') if frames!=[]]
        options_count = 0
        fitness_table = []
        while options_count < options_num: 
            #print('I am in! i:', i, 'options_count:', options_count)
            
            random_key = random.choice(keys)
            random_angle = random.uniform(0., 360.)
            #random_angle = 0
            random_shift = random.uniform(-0.04, 0.04)
            random_option_elems = assembly.element(random_key).current_option_elements(flip, random_angle, random_shift)
            #print('Option {}/{}: random_key = {}, random_angle = {}, random_shift = {}:'.format(options_count+1, options_num, random_key, random_angle, random_shift))
            
            is_colliding = assembly.collision_check(random_option_elems, tolerance = -0.001) if collision_check else False
            
            if equilibrium_check:
                equilibrium, resultant = assembly.static_equilibrium_check(assembly.support, random_option_elems, radius=0.01)
            else:
                equilibrium = True
            
            random_elems_frames = [element.frame for element in random_option_elems]
            is_away_from_ground = all(frame.point.z > 0.2 for frame in random_elems_frames)
            
            if not is_colliding and equilibrium and is_away_from_ground:
                
                output_value, vector = assembly.orientation_to_input_geo(selected_key, random_angle, assembly.input_geo)
                distance, vector = assembly.distance_to_input_geo(selected_key, random_angle, assembly.input_geo)
                #print distance 
                if distance > 1.0:
                    print "Interrupted"
                    break
                else:
                    score = output_value*angle_weight + distance*dist_weight
                
                fitness_table.append([random_key, random_angle, random_shift, score])
                
                options_count += 1
                
        fitness_table_sorted = sorted(fitness_table,key=lambda x:x[3], reverse=True)
        msgs.append('{}.ITERATION:'.format(i))
#        msgs.append('KEYS: {}'.format(keys))
#        msgs.append('SCORES: {}'.format(scores))
        #msgs.append('HIGHEST SCORE: {}.'.format(fitness_table_sorted[0][3]))
        msgs.append('ELEMENT KEY of the option with the highest score: {}'.format(fitness_table_sorted[0][0]))
        assembly.close_rf_unit(fitness_table_sorted[0][0], flip, fitness_table_sorted[0][1], fitness_table_sorted[0][2], on_ground = False)
        msgs.append('------- New elements added to assembly -------')
        for msg in msgs:
            print(msg)

#############################################################################
## RANDOM GROWTH
#############################################################################

if aggregate and mode == 0:
    msgs = []
    i = 0
    while i < iterations: 
        print('-------------------- Start --------------------')
        keys = [key for key, frames in assembly.connectors('open') if frames!=[]]
       
        random_key = random.choice(keys)
        random_angle = random.uniform(0., 180.)
        random_shift = random.uniform(-0.04, 0.04)
        random_option_elems = assembly.element(random_key).current_option_elements(flip, random_angle, random_shift)

        is_colliding = assembly.collision_check(random_option_elems, tolerance = -0.001) if collision_check else False
        
        if equilibrium_check:
            equilibrium, resultant = assembly.static_equilibrium_check(assembly.support, random_option_elems, radius=0.01)
        else:
            equilibrium = True
            
        # check if options frames lie below 0.2m height
        random_elems_frames = [element.frame for element in random_option_elems]
        is_away_from_ground = all(frame.point.z > 0.2 for frame in random_elems_frames)
            
        if not is_colliding and equilibrium and is_away_from_ground:
            if all(random_option_elem.frame.point.z > 0.4 for random_option_elem in random_option_elems):
                assembly.close_rf_unit(random_key, flip, random_angle, random_shift, on_ground = False)
                i += 1
                print('------- New elements added to assembly. -------')
            else:
                print('------- Option elements lie below ground level. -------')
        else:
            print('--- Stabilitry or collision avoidance criteria not satisfied. ---')
            
            break
            
        for msg in msgs:
            print(msg)

#############################################################################
## COLLISION CHECK TEST
#############################################################################


current_elem_options = assembly.element(selected_key).current_option_elements(flip, angle, shift_value)
assembly.current_elem_options = current_elem_options

#collision_test = assembly.collision_check(current_elem_options, tolerance = 0.0001)
#print collision_test


#############################################################################
## STATIC EQUILIBRIUM CHECK TEST
#############################################################################

#static_eqilibrium_check, resultant = assembly.static_equilibrium_check(assembly.support, current_elem_options, radius=0.01, allow_temp_support=True)
#print static_eqilibrium_check

"""
keys = [key for key, frames in assembly.connectors('open') if frames!=[]]
random_key = random.choice(keys)
random_angle = random.uniform(0., 180.)
random_shift = random.uniform(-0.04, 0.04)
random_option_elems = assembly.element(random_key).current_option_elements(flip, random_angle, random_shift)

ground_plane = rg.Plane.WorldXY

for option in random_option_elems:
    intersection = rg.Intersect.Intersection.LinePlane(Artist(option.line).draw(), ground_plane)
    print intersection
"""
# ---------- end aggregate_2 ----------
rec = DataRecorder(aggregate_2.out, DataLimit=-10, RecordData=True)
panel_4 = Panel(rec)

branches = GhPythonScript(assembly=aggregate_2.assembly, branch_idx=number_slider)  # -> out, G_branch_elems, G_branch_midpoints; inputs branch_idx: Int32
# ---------- branches: Python ----------
import rhinoscriptsyntax as rs
from compas.geometry import Line
from compas.topology import connected_components
from compas.artists import Artist


branches = connected_components(assembly.network.adjacency)
print 'The assembly structure has {} branches.'.format(len(branches))
G_branch_elems = [Artist(assembly.element(key).mesh).draw() for key in branches[branch_idx]]
G_branch_midpoints = [Artist(assembly.element(key).line.midpoint).draw() for key in branches[branch_idx]]
# ---------- end branches ----------
mesh_3 = Mesh(branches.G_branch_elems)
pt_3 = Point(branches.G_branch_midpoints)
assembly_branches = Panel(branches.out)

assembly_viz = PythonScript(
    assembly=aggregate_2.assembly,
    preview_mode=list,
    show_assembly=show_3,
    show_support=show_4,
    show_input_geo=show_5,
    show_option=show_6,
    show_last=show_7,
    show_arrows=show_8,
    show_open_connectors=show_9,
    show_keys=show_10,
    current_key=inputs.selected_key,
    angle=inputs.angle,
    shift_value=inputs.shift_value,
    flip_human_robot=flip)  # -> out, G_planned, G_built, G_input_geo, G_supports, G_open_connectors, G_selected, G_planned_2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; inputs current_key: Int32
# ---------- assembly_viz: Python ----------
import os
import sys
from scriptcontext import sticky as st
import Rhino.Geometry as rg

import math
from math import pi

from compas.geometry import Vector, Translation, Frame
from compas.artists import Artist
from compas.colors import Color

G_selected = []

G_planned = []
G_built = []
G_supports = []
G_held_by_robot = []
G_open_connectors = []
G_cones = []

connectors_ranges = []

option_vectors = []
origin_option_vectors = []
flip = 'AA'

key_tag_text = []
key_tag_location= []
lines = []

# Color coding
color_coding = {'color_is_planned': Color(1.0, 0.870588235294, 0.0117647058824, 1.0), 'color_is_support': Color(0.0, 0.0, 1.0, 1.0), 'color_has_open_connector': Color(0.494117647059, 1.0, 0.239215686275, 1.0), 'color_is_built': Color(0.811764705882, 1.0, 0.709803921569, 1.0), 'color_is_held_by_robot': Color(1.0, 0.0078431372549, 0.4, 1.0)}

keys = [key for key, element in assembly.elements()]
print len(keys)
lines = [Artist(assembly.element(key).line).draw() for key in keys]

open_connectors_frames = [assembly.element(key).connectors(state='open') for key in keys]
#open_connectors_ranges = [assembly.element(key).connectors_ranges(state='open') for key in keys]
#open_connectors_ranges = [Artist(connector).draw() for connectors in open_connectors_ranges for connector in connectors if connectors != []]

if show_open_connectors:
    open_connectors_planes = [Artist(connector).draw() for connectors in open_connectors_frames for connector in connectors if connectors != []]
#    print open_connectors_planes
#    open_connectors_planes_trnsf = [rg.Plane.Clone(plane) for plane in open_connectors_planes]
#    [plane.Translate(plane.YAxis*0.075) for plane in open_connectors_planes_trnsf]


def show(element, output_geo, color):
    mesh = Artist(element.mesh).draw(color)
    output_geo.append(mesh)

def show_multiple(elements, output_geo, color):
    for element in elements:
        mesh = Artist(element.mesh).draw(color)
        output_geo.append(mesh)

if assembly:
    radius = assembly.globals['rod_radius']
    
    if current_key != None:
        current_element = assembly.element(current_key)
        elem_options = assembly.element(current_key).current_option_elements(flip, angle, shift_value)
        G_selected = Artist(assembly.element(current_key).mesh).draw(color_coding['color_is_support'])
    else:
        current_element = None
        elem_options = []
    
    if len(elem_options) != 0:
        elem_option = elem_options[0]
    
    if flip_human_robot:
        elem_options.reverse()
    
    planned_keys = list(assembly.network.nodes_where({'is_planned':True}))
    built_keys = list(assembly.network.nodes_where({'is_built':True,'is_support':False}))
    built_keys = [key for key in built_keys if key not in assembly.open_connectors_keys]
    support_keys = list(assembly.network.nodes_where({'is_support':True}))
    support_keys = [key for key in support_keys if key not in assembly.open_connectors_keys]
    
    print 'planned keys:', planned_keys
    print 'built keys:', built_keys
    print 'support keys:', support_keys
    print 'open connectors keys:', assembly.open_connectors_keys
    
    planned_elements = [assembly.element(key) for key in planned_keys] 
    built_elements = [assembly.element(key) for key in built_keys if key not in assembly.last_added] 
    support_elements = [assembly.element(key) for key in support_keys] 
    open_connectors_elements = [assembly.element(key) for key in assembly.open_connectors_keys if key not in assembly.last_added]
    
    # Visualize assembly
    if show_assembly:
        for element in planned_elements:
            mesh = Artist(element.mesh).draw(color_coding['color_is_planned'])
            G_planned.append(mesh)
        for element in built_elements:
            mesh = Artist(element.mesh).draw(color_coding['color_is_built'])
            G_built.append(mesh)
        for element in support_elements:
            mesh = Artist(element.mesh).draw(color_coding['color_is_support'])
            G_supports.append(mesh)
        for element in open_connectors_elements:
            mesh = Artist(element.mesh).draw(color_coding['color_has_open_connector'])
            G_open_connectors.append(mesh)
    
    # Vizualize current connector 
    if show_option and show_assembly:
        if elem_options:
            show(elem_options[0], G_held_by_robot, color_coding['color_is_planned'])
            show(elem_options[1], G_planned, color_coding['color_is_planned'])
            lines.append(Artist(elem_options[0].line).draw())
            lines.append(Artist(elem_options[1].line).draw())
            cone_1 = rg.RevSurface.Create(Artist(elem_options[0].line).draw(), Artist(assembly.element(current_key).line).draw())
            cone_2 = rg.RevSurface.Create(Artist(elem_options[1].line).draw(), Artist(assembly.element(current_key).line).draw())
            G_cones.append(cone_1)
            G_cones.append(cone_2)
            print elem_options[0].line
        else:
            print('No open connectors')
    
    if show_last and show_assembly:
        if len(assembly.last_added) > 1:
            show(assembly.element(assembly.last_added[0]), G_held_by_robot, color_coding['color_has_open_connector'])
            show(assembly.element(assembly.last_added[1]), G_planned, color_coding['color_has_open_connector'])
        else:
            print('No open connectors')
    
    # Visualize all options
    if show_arrows and show_assembly:
        for key, o, v in assembly.current_options:
                option_vectors.append(rg.Vector3d(*tuple(v)))
                origin_option_vectors.append(rg.Point3d(o.x, o.y, o.z))
    
    #elem_option_robot = Artist(elem_options[0].frame).draw() # elem for planning robot routine
    
    if show_keys:
        for key, element in assembly.elements():
            key_tag_text.append(str(key))
            key_tag_location.append(Artist(element.frame).draw().Origin)
            
    if show_support:
        G_supports.append(assembly.support)
        
    if show_input_geo:
        G_input_geo = assembly.input_geo


#for key, element in assembly.elements():
#    print element.connector_1_joints
#    joints_1 = [Artist(joint).draw for joint in element.connector_1_joints]
#    joints_2 = [Artist(joint).draw for joint in element.connector_2_joints]
# ---------- end assembly_viz ----------
rot = GhPythonScript(plane=assembly_viz.elem_option_robot, angle=Slider(42, range=0..360))  # -> out, plane; disabled
# ---------- rot: Python ----------
import math
from compas.geometry import Frame, Rotation
from compas.artists import Artist

frame = Frame(plane.Origin, plane.XAxis, plane.YAxis)

R = Rotation.from_axis_and_angle(frame.xaxis, math.radians(angle), frame.point)
frame.transform(R)

plane = Artist(frame).draw()
# ---------- end rot ----------
mesh_4 = Mesh(assembly_viz.G_planned)
mesh_5 = Mesh(assembly_viz.G_built)
mesh_6 = Mesh(assembly_viz.G_input_geo)
mesh_7 = Mesh(assembly_viz.G_supports)
mesh_8 = Mesh(assembly_viz.G_open_connectors)
mesh_9 = Mesh(assembly_viz.G_selected)
mesh_10 = Mesh(assembly_viz.G_planned_2)
pln_5 = Plane(assembly_viz.open_connectors_planes)
vdis_2 = VectorDisplay(Anchor=assembly_viz.origin_option_vectors, Vector=assembly_viz.option_vectors)
tag = TextTag(Location=assembly_viz.key_tag_location, Text=assembly_viz.key_tag_text)
mesh_11 = Mesh(assembly_viz.G_held_by_robot)
srf = Surface(assembly_viz.G_cones)
cir = Circle(Plane=pln_5, Radius=0.2)  # disabled
mesh_12 = Mesh(assembly_viz.open_connectors_ranges)  # disabled
custom_preview_3 = CustomPreview(Geometry=mesh_6, Material=ColourSwatch(SwatchColor=RGBA(240, 226, 214, 124)))

# ----
# Network Visualization
number_slider_2 = Slider(0, range=0..47)
show_11 = BooleanToggle(False)
network_viz = GhPythonScript(assembly=aggregate_2.assembly, show_network=show_11, key=number_slider_2)  # -> out, nodes, edges, current_node, current_node_neighbors; inputs key: Int32
# ---------- network_viz: Python ----------
import sys, os
import ghpythonlib.components as ghcomp
from compas.datastructures import Network
from compas_ghpython.artists import NetworkArtist
from compas_rhino.geometry import RhinoLine

import compas_ghpython
import Rhino.Geometry as rg


data = assembly.network.to_data()
network = Network.from_data(data)

print assembly.network.number_of_nodes()

def draw_network(network):
    """Draw a network in Grasshopper.
    """
    points = []
    for key, attr in network.nodes(True):
        points.append({
            'pos': network.node_coordinates(key),
        })

    lines = []
    for (u, v), attr in network.edges(True):
        lines.append({
            'start': network.node_coordinates(u),
            'end': network.node_coordinates(v),
        })

    points_rg = compas_ghpython.draw_points(points)
    lines_rg = compas_ghpython.draw_lines(lines)

    return points_rg, lines_rg

if show_network:
    nodes, edges = draw_network(network)
    
    current_node = {'pos': network.node_coordinates(key), 'radius': 0.03}
    current_node = compas_ghpython.draw_spheres([current_node])
    
    current_node_neighbors_keys = network.neighbors(key)
    current_node_neighbors = [{'pos': network.node_coordinates(key), 'radius': 0.02} for key in current_node_neighbors_keys]
    current_node_neighbors = compas_ghpython.draw_spheres(current_node_neighbors)
# ---------- end network_viz ----------
pt_4 = Point(network_viz.nodes)
line = Line(network_viz.edges)
brep_2 = Brep(network_viz.current_node)
brep_3 = Brep(network_viz.current_node_neighbors)
preview = CustomPreview(Geometry=brep_3, Material=ColourSwatch(SwatchColor=RGB(255, 207, 207)))
preview_2 = CustomPreview(Geometry=[brep_2, line], Material=ColourSwatch(SwatchColor=RGB(0, 0, 0)))

number_slider_3 = Slider(0.07, range=0..1)  # disabled
sph = Sphere(Base=pln_5, Radius=number_slider_3)  # disabled
colour_swatch = ColourSwatch(SwatchColor=RGBA(216, 255, 132, 151))  # disabled
custom_preview_4 = CustomPreview(Geometry=sph, Material=colour_swatch)  # disabled

# ----
# Export .json
export = Button()
export_2 = Button()
export_3 = PythonScript(DATA=py.DATA, assembly=aggregate_2.assembly, export_to_json=export, export_to_json_unity=export_2)
# ---------- export_3: Python ----------
import os
from compas.datastructures.mesh import mesh_quads_to_triangles
from compas.datastructures.mesh import mesh_unify_cycles

if export_to_json:
    filename = "equilibrium_50_4p_3.json"
    PATH = os.path.join(DATA, "assembly", filename)
    
    # the assembly has to be serialized such that it can be called from CPython, True to enable pretty print
    assembly.to_json(PATH, True)
    

if export_to_json_unity:
    
    for key, e in assembly.elements():
    
        #convert to trimesh
        mesh_quads_to_triangles(e._mesh, check_angles=False)
        #mesh_unify_cycles(e._mesh)
        #print e._mesh.faces
        #print e._mesh.face_vertices(list(e._mesh.faces())[0])

    filename = "unity_assembly_test.json"
    PATH = os.path.join(DATA, "assembly", filename)
    assembly.to_json(PATH)
# ---------- end export_3 ----------
