# Grasshopper definition ex1_assembly_1b_.ghx (Grasshopper 1.0.7)

# ----
# Color Coding
swatch = ColourSwatch(SwatchColor=RGB(255, 222, 3))
color_coding = GhPythonScript(
    is_planned=swatch,
    is_built=ColourSwatch(SwatchColor=RGB(207, 255, 181)),
    is_support=ColourSwatch(SwatchColor=RGB(0, 0, 255)),
    is_held_by_robot=ColourSwatch(SwatchColor=RGB(255, 2, 102)),
    has_open_connector=ColourSwatch(SwatchColor=RGB(126, 255, 61)))  # -> out, color_coding
# ---------- color_coding: Python ----------
import rhinoscriptsyntax as rs
from compas.colors import Color


color_is_planned = Color(is_planned.R/255 , is_planned.G/255, is_planned.B/255)
color_is_built = Color(is_built.R/255 , is_built.G/255, is_built.B/255)
color_is_support = Color(is_support.R/255 , is_support.G/255, is_support.B/255)
color_is_held_by_robot = Color(is_held_by_robot.R/255 , is_held_by_robot.G/255, is_held_by_robot.B/255)
color_has_open_connector = Color(has_open_connector.R/255 , has_open_connector.G/255,has_open_connector.B/255)

color_coding = {'color_is_planned':color_is_planned, 'color_is_built':color_is_built, 'color_is_support':color_is_support, 'color_is_held_by_robot':color_is_held_by_robot, 'color_has_open_connector':color_has_open_connector}

print color_coding
# ---------- end color_coding ----------
panel = Panel(color_coding.out)

panel_2 = Panel("Unload libraries")
bang = Button()
unload = PythonScript(bang=bang)
# ---------- unload: Python ----------
from compas_rhino.utilities.misc import get_tolerance
from compas_rhino.utilities.misc import unload_modules

unload_modules("cdf_2023")
# ---------- end unload ----------

py = PythonScript()  # -> ENVIRONMENT_NAME, HERE, DATA
# ---------- py: Python ----------
import os
import compas_bootstrapper

HERE = os.path.dirname(ghdoc.Path)
DATA = os.path.abspath(os.path.join(HERE, "..", "data"))
ENVIRONMENT_NAME = compas_bootstrapper.ENVIRONMENT_NAME
print(HERE)
print(DATA)
print(ENVIRONMENT_NAME)
# ---------- end py ----------

# ----
# Load Assembly
# Import assembly from .json.
import = Button(ExpressionNormal="True", ExpressionPressed="False")
initial_assembly = GhPythonScript(DATA=py.DATA, import_from_json=import)  # -> out, assembly; inputs import_from_json: Boolean
# ---------- initial_assembly: Python ----------
import os
import json
from scriptcontext import sticky

from cdf_2023.assembly import Assembly

if import_from_json:
    filename = "study_1e.json"
    PATH = os.path.join(DATA, "assembly", filename)
    assembly = Assembly.from_json(PATH)

# create a dictionary to store global value in 
assembly.globals = {}

# define global values
assembly.globals['rod_radius'] = 0.01
assembly.globals['rod_length'] = 0.8
assembly.globals['rf_unit_offset'] = 0.2
assembly.globals['rf_unit_radius'] = 0.15
# ---------- end initial_assembly ----------

brep = Brep(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)
brep_2 = Brep(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)

# ----
# Assembly Definition
# Create an element object.
reset_assembly = Button()
globals = GhPythonScript(reset=reset_assembly)  # -> out, assembly
# ---------- globals: Python ----------
from cdf_2023.assembly import Assembly

# create assembly
assembly = Assembly()

# create a dictionary to store global value in 
assembly.globals = {}

# define global values
assembly.globals['rod_radius'] = 0.01
assembly.globals['rod_length'] = 0.95
assembly.globals['rf_unit_offset'] = 0.25
assembly.globals['rf_unit_radius'] = 0.15


print assembly.globals
# ---------- end globals ----------
assembly_globals = Panel(globals.out)
show = BooleanToggle(False)
show_2 = BooleanToggle(True)
elem_def = GhPythonScript(
    assembly=globals.assembly,
    show_connectors=show_2,
    angle=Slider(4.5, range=4..12),
    conn_range_1=brep,
    conn_range_2=brep_2)  # -> assembly, elem; inputs conn_range_1: Surface, conn_range_2: Surface
# ---------- elem_def: Python ----------
import os
import sys
import json
import math

from compas.geometry import Frame, Plane, Rotation, Vector, Point
from compas.geometry import Circle, Cylinder, Translation, Line, Cone
from compas.artists import Artist
import Rhino.Geometry as rg
from compas_rhino.conversions import RhinoSurface

from cdf_2023.assembly import Element

rf_unit_offset = assembly.globals['rf_unit_offset']
rf_unit_radius = assembly.globals['rf_unit_radius']
radius = assembly.globals['rod_radius']
length = assembly.globals['rod_length']

cross_section_plane = Plane.from_frame(Frame.worldYZ())
cross_section = Circle(cross_section_plane, radius)
elem_geo = Cylinder(cross_section, length)

elem = Element.from_shape(elem_geo, Frame.worldXY())

connector_frame_1 = Frame([rf_unit_offset,-rf_unit_radius/2,0], [1,0,0], [0,1,0])
connector_frame_2 = Frame([-rf_unit_offset,rf_unit_radius/2,0], [-1,0,0], [0,-1,0])

R1 = Rotation.from_axis_and_angle(connector_frame_1.yaxis, math.radians(angle), connector_frame_1.point)
R2 = Rotation.from_axis_and_angle(connector_frame_2.yaxis, math.radians(angle), connector_frame_2.point)

connector_frame_1.transform(R1)
connector_frame_2.transform(R2)

elem.connector_frame_1 = connector_frame_1
elem.connector_frame_2 = connector_frame_2

elem.line = Line([-length/2.,0,0],[length/2.,0,0])


circle_frame_1 = Frame([-0.34,0,0],[0,0,-1],[0,1,0])
circle_frame_2 = Frame([0.34,0,0],[0,0,1],[0,1,0])
circle_1 = Circle(Plane.from_frame(circle_frame_1), 0.5)
circle_2 = Circle(Plane.from_frame(circle_frame_2), 0.5)
cone_2 = Cone(circle_1, 0.32)
cone_1 = Cone(circle_2, 0.32)

source1 = RhinoSurface.from_geometry(conn_range_1)
source2 = RhinoSurface.from_geometry(conn_range_2)

elem.connector_range_1 = source1.to_compas()
elem.connector_range_2 = source2.to_compas()
# ---------- end elem_def ----------
draw = PythonScript(elements=elem_def.elem, show=show)  # -> M, F, C; inputs elements: list
# ---------- draw: Python ----------
from compas.artists import Artist

M = []
C = []
F = []
T = []

if show:
    for elem in elements:
        C.append(Artist(elem.connector_frame_1).draw())
        C.append(Artist(elem.connector_frame_2).draw())
        M += [Artist(elem._mesh).draw([0,0,1,1])]
        F += [Artist(elem.frame).draw()]
        T += [Artist(elem.tool_frame).draw()]
# ---------- end draw ----------
mesh = Mesh(draw.M)
pln = Plane(draw.F)
pln_2 = Plane(draw.C)
custom_preview = CustomPreview(Geometry=mesh, Material=ColourSwatch(SwatchColor=RGB(221, 0, 0)))

panel_3 = Panel(py.ENVIRONMENT_NAME)
pln_3 = Plane(Plane(origin=(-0.4170292646, -0.01749036416, 0.4218038534), x=(-0.193131676, 0.000247385366, 0.9811728158), y=(0.001280914494, 0.9999991796, 0)))

# ----
# Generate Assembly
# Initial Assembly Configuration
worldxy = Plane(PlaneXY(0, 0, 0))
initial_configuration = GhPythonScript(assembly=elem_def.assembly, planes=pln_3, elem=elem_def.elem)  # -> out, assembly, connector_planes; inputs planes: list of Plane
# ---------- initial_configuration: Python ----------
import Rhino.Geometry as rg
import math
from scriptcontext import sticky as st

from compas.geometry import Frame, Vector
from compas.geometry import Rotation, Translation, Transformation
from compas.geometry import Point
from compas.artists import Artist


# just for vizualisation
connector_planes = []

radius = assembly.globals['rod_radius']
length = assembly.globals['rod_length']
rf_unit_offset = assembly.globals['rf_unit_offset']
rf_unit_radius = assembly.globals['rf_unit_radius']

for plane in planes:
    T1 = Transformation.from_frame_to_frame(Frame.worldXY(), Frame(plane.Origin, plane.XAxis, plane.YAxis))
    #T1 = Transformation.from_frame_to_frame(elem.connector_frame_2, Frame.worldXY())
    elem_1 = elem.transformed(T1)
    
    R1 = Rotation.from_axis_and_angle(elem_1.frame.zaxis, math.radians(120), [0,0,0])
    R2 = Rotation.from_axis_and_angle(elem_1.frame.zaxis, math.radians(240), [0,0,0])
    
    #T2 = Transformation.from_frame_to_frame(elem.frame, elem.connector_frame_1)
    #T3 = Transformation.from_frame_to_frame(elem.frame, elem.connector_frame_2)
    
    #elem_2 = elem_1.transformed(R1)
    #elem_3 = elem_1.transformed(R2)
    
    elem_1.connector_1_state = True
    elem_1.connector_2_state = False

#elem_2.connector_1_state = False
#elem_2.connector_2_state = False
#
#elem_3.connector_1_state = False
#elem_3.connector_2_state = False


    assembly.add_element(elem_1, placed_by='initial', is_support=True, frame_id=None)
#assembly.add_element(elem_2, placed_by='initial', frame_id=None)
#assembly.add_element(elem_3, placed_by='initial', frame_id=None)
#
#assembly.network.add_edge(0, 1, edge_of='parent')
#assembly.network.add_edge(0, 2, edge_of='parent')
#assembly.network.add_edge(1, 2, edge_of='parent')


for key, connectors in assembly.connectors(state='open'):
    for connector in connectors:
        connector_planes.append(Artist(connector).draw())
# ---------- end initial_configuration ----------
pln_4 = Plane(initial_configuration.connector_planes)

mesh_2 = Mesh(<mesh referenced from the Rhino model>)
supports = Brep(<brep referenced from the Rhino model>)

# ----
# Transform Assembly
pt = Point(<point referenced from the Rhino model>)
x = Curve(<curve referenced from the Rhino model>)
y = Curve(<curve referenced from the Rhino model>)
pl = ConstructPlane(Origin=pt, XAxis=x, YAxis=y)
transform = GhPythonScript(assembly=initial_configuration.assembly, transform=Toggle(False), trnsf_plane=pl)  # -> out, assembly, planes
# ---------- transform: Python ----------
from compas.geometry import Frame
from compas.geometry import Transformation, Translation
import Rhino.Geometry as rg

from compas.artists import Artist

planes = []

trnsf_plane.Transform(rg.Transform.Translation(0.03,0,0))

if transform:
    T = Transformation.from_frame_to_frame(Frame.worldXY(), Frame(trnsf_plane.Origin, trnsf_plane.XAxis, trnsf_plane.YAxis))
    assembly.transform(T)
    assembly.network.transform(T)
    
    
for key, element in assembly.elements():
    planes.append(Artist(element.frame).draw())
# ---------- end transform ----------

pln_5 = Plane(Plane(origin=(-0.3182084628, 5.767303316, 1.540590538), x=(0, 1, 0), y=(1, 0, 0)))

# ----
# Add additional supports
toggle = BooleanToggle(False)  # disabled
pln_6 = Plane(Plane(origin=(0.8284965546, -0.116329934, 0.3446181635), x=(0.5836778286, 0.5396858127, -0.6066790058), y=(0.6788954185, -0.7342349834, 0)))  # disabled
support = GhPythonScript(assembly=transform.assembly, add_support=toggle, elem=elem_def.elem, support_plane=pln_6)  # -> out, support_geo, assembly, elem_plane; disabled
# ---------- support: Python ----------
from compas.geometry import Frame, Transformation
from compas.artists import Artist
import Rhino.Geometry as rg

support_plane.Transform(rg.Transform.Translation(0.03,0,0))

T_support = Transformation.from_frame(Frame(support_plane.Origin, -support_plane.XAxis, support_plane.YAxis))

if add_support:
    added_support_elem = elem.transformed(T_support)
    support_geo = Artist(added_support_elem.mesh).draw()

    added_support_elem.connector_frame_1 = Frame.worldXY()
    added_support_elem.connector_frame_2 = Frame.worldXY()
    
    added_support_elem.connector_1_state = False
    added_support_elem.connector_2_state = False
    
    assembly.add_element(added_support_elem, placed_by = 'initial', frame_id=None)
    
    elem_plane = Artist(added_support_elem.frame).draw()
# ---------- end support ----------
pln_7 = Plane(support.elem_plane)  # disabled
mesh_3 = Mesh(support.support_geo)  # disabled

# ---- group: capture
viewport_name = Text("workflow_2")
capture_to_bitmap = PythonScript(DATA=py.DATA, capture=Button(), viewport_name=viewport_name, idx=Slider(2, range=0..10))  # -> out, a; inputs capture: Boolean, idx: Int32
# ---------- capture_to_bitmap: Python ----------
import Rhino
import System.Drawing
from scriptcontext import sticky as st

import sys, os
import ghpythonlib.components as ghcomp
import Grasshopper as gh
import datetime


ghComp = ghenv.Component
ghDoc = ghComp.OnPingDocument()

def rCommonCap(filePath, viewportName,scaleFactor):
    RhinoDocument = Rhino.RhinoDoc.ActiveDoc
    view = RhinoDocument.Views.Find(viewportName, False)
    vp = view.ActiveViewport
    size = System.Drawing.Size(vp.Size.Width*scaleFactor,vp.Size.Height*scaleFactor)
    capture = view.CaptureToBitmap(size)
    capture.Save(filePath);


export_dir = os.path.join(DATA, 'parameter_studies')
if not os.path.isdir(export_dir): os.mkdir(export_dir)
print export_dir
filename = os.path.join(export_dir, 'capture_' + str(idx) + '.png') 
print filename

zoom = 1

if capture:
    rCommonCap(filename, viewport_name, zoom)
# ---------- end capture_to_bitmap ----------

# ----
reset = Button()  # disabled
run = BooleanToggle(False)  # disabled
list = ValueList({"100", "200", "500"}, selected="100")  # disabled
list_2 = ValueList({"20", "50", "100", "500"}, selected="500")  # disabled
python = PythonScript(run=run, reset=reset, count=list, timer_speed=list_2)  # -> C; inputs count: Int32, timer_speed: Int32; disabled
# ---------- python: Python ----------
from scriptcontext import sticky as st
import Grasshopper as gh

guid = str(ghenv.Component.InstanceGuid)

counter_key = "counter_" + guid
anchors = "anchors_" + guid
length = count


def ghComponentTimer(run,interval):
    """ Update the component at the interval like using a GH timer """
    
    # Ensure interval is larger than zero
    if interval <= 0:
        interval = 1
        
    # Get the Grasshopper document and component that owns this script
    ghComp = ghenv.Component
    ghDoc = ghComp.OnPingDocument()
    
    # Define the callback function
    def callBack(ghDoc):
        ghComp.ExpireSolution(False)
        
    # Update the solution
    if run:
        ghDoc.ScheduleSolution(interval, gh.Kernel.GH_Document.GH_ScheduleDelegate(callBack))


if reset or counter_key not in st:
    st[counter_key] = 0

else:
    if run:
        if st[counter_key] < length - 1:
            ghComponentTimer(run, timer_speed)
            st[counter_key] += 1
        else:
            st[counter_key] = 0
            ghComponentTimer(run, timer_speed)
            

C = st[counter_key]
# ---------- end python ----------
idx = Panel(python)  # disabled

python_2 = GhPythonScript(assembly=initial_assembly.assembly, counter=python)  # -> out, G_elements
# ---------- python_2: Python ----------
import rhinoscriptsyntax as rs
import Rhino.Geometry as rg
from compas.artists import Artist
from compas.colors import Color

G_elements = []

elements = [element for key, element in assembly.elements()]

for element in elements[0:counter]:
    print element
    G_elements.append(Artist(element.mesh).draw(Color(1.0, 0.870588235294, 0.0117647058824, 1.0)))


#G_elements = [mesh.Flip(False,False,False,False) for mesh in G_elements]
# ---------- end python_2 ----------

# ----
# Counter
key = Slider(28, range=0..388)  # disabled
till_key = Button()  # disabled
reset_2 = Button()  # disabled
back = Button()  # disabled
start = Button()  # disabled
step = Button()  # disabled
stop = Button()  # disabled
full = Button()  # disabled
list_3 = ValueList({"20", "50", "100", "500", "1000", "5000"}, selected="50")  # disabled
counter = CountThroughList(
    assembly=initial_assembly.assembly,
    start=start,
    stop=stop,
    step=step,
    step_back=back,
    reset=reset_2,
    full=full,
    till_key=till_key,
    key=key,
    interval=list_3)  # -> item, counter; inputs start: Boolean, stop: Boolean, step_back: Boolean, key: Int32; disabled
# ---------- counter: Python ----------
from scriptcontext import sticky as st
from compas_ghpython import update_component
from compas.artists import Artist

if assembly.elements():
    L = [element for key, element in assembly.elements()]
else:
    L = []

# store data in component
guid = str(ghenv.Component.InstanceGuid)
counter_key = "counter_" + guid
running_key = "running_" + guid

if counter_key not in st:
    st[counter_key] = 0

if running_key not in st:
    st[running_key] = False
    

if st[running_key]:
    if st[counter_key] < len(L) - 1:
        st[counter_key] += 1
        update_component(ghenv, interval)
    else:
        st[counter_key] = 0
        st[running_key] = False
    
if start:
    st[running_key] = True

if stop:
    st[running_key] = False

if step:
    if st[counter_key] < len(L) - 1:
        st[counter_key] += 1

if step_back:
    if  0 < st[counter_key] < len(L):
        st[counter_key] -= 1

if reset:
    st[counter_key] = 0

if till_key:
    st[counter_key] = key

if full:
    st[counter_key] = len(L)-1

if len(L):
    key = L[st[counter_key]]
    print key
    #item = Artist(assembly.element(key).mesh).draw()

#st["visualisation_counter"] = st[counter_key]
#st[counter_key]= 500
counter = st[counter_key]
# ---------- end counter ----------
colour_swatch = ColourSwatch(SwatchColor=RGB(224, 255, 116))  # disabled
mesh_4 = Mesh(python_2.G_elements)  # disabled
preview = CustomPreview(Geometry=mesh_4, Material=colour_swatch)

py_2 = PythonScript()  # -> repositories_path, rbvogui_data_path, ur_data_path
# ---------- py_2: Python ----------
import os

"""
ASSUMING THE BELOW PACKAGES ARE STORED IN THE SAME LOCATION:
    ur_fabrication_control;
    rbvogui_common; and
    mobile_additive_manufacturing.
"""

repositories_path = os.path.abspath(os.path.join(ghdoc.Path,"../../../"))

assert os.path.exists(os.path.join(repositories_path, "ur_fabrication_control/data"))
assert os.path.exists(os.path.join(repositories_path, "rbvogui_common/rbvogui_description"))
assert os.path.exists(os.path.join(repositories_path, "mobile_robot_control"))

ur_data_path = os.path.abspath(os.path.join(ghdoc.Path,"../../../ur_fabrication_control/data"))
rbvogui_data_path = os.path.abspath(os.path.join(repositories_path, "rbvogui_common"))
# ---------- end py_2 ----------
list_4 = ValueList({"indoor", "outdoor"}, selected="indoor")
base_plane = Plane(Plane(origin=(-1.055704921, 5.324883333, 2.914916263e-11), x=(0.9028524237, 0.4299505798, 0), y=(-0.4299505798, 0.9028524237, -1.897739398e-10)))
list_5 = ValueList({"default", "measured", "initial"}, selected="default")
l = Slider(0, range=0..0.72)

# ----
# Load robot from local package
python_3 = GhPythonScript(choice=list_5, vertical_axis_height=Slider(0.021, range=0..0.72), vertical_axis_correction=Slider(0, range=-0.1..0.1))  # -> out, ur_base_frame_rhino_local_tf, ur_base_plane
# ---------- python_3: Python ----------
import rhinoscriptsyntax as rs
from compas.geometry import Frame
from compas.geometry import Translation
from compas_ghpython.utilities import draw_frame

if choice=="measured":
    ur_base_frame_rhino_local_tf = Frame(ur_base_plane_rhino_local_tf.Origin, 
                                         ur_base_plane_rhino_local_tf.XAxis, 
                                         ur_base_plane_rhino_local_tf.YAxis)
    T = Translation.from_vector(ur_base_frame_rhino_local_tf.zaxis*(vertical_axis_height+vertical_axis_correction))
    ur_base_frame_rhino_local_tf = ur_base_frame_rhino_local_tf.transformed(T)
elif choice=="initial":
    ur_base_frame_rhino_local_tf = Frame(ur_base_plane_init.Origin, 
                                         ur_base_plane_init.XAxis, 
                                         ur_base_plane_init.YAxis)
    T = Translation.from_vector(ur_base_frame_rhino_local_tf.zaxis*(vertical_axis_height+vertical_axis_correction))
    ur_base_frame_rhino_local_tf = ur_base_frame_rhino_local_tf.transformed(T)

elif choice =="default":
    ur_base_frame_rhino_local_tf = Frame([0.275, 0.0, 1.105], [-0.707, 0.707, 0.0], [-0.707, -0.707,0.0])
    T = Translation.from_vector(ur_base_frame_rhino_local_tf.zaxis*(vertical_axis_height+vertical_axis_correction))
    ur_base_frame_rhino_local_tf = ur_base_frame_rhino_local_tf.transformed(T)


ur_base_plane = draw_frame(ur_base_frame_rhino_local_tf)
# ---------- end python_3 ----------

# ----
# Robot Model
py_3 = PythonScript(
    repositories_path=py_2.repositories_path,
    rbvogui_data_path=py_2.rbvogui_data_path,
    ur_data_path=py_2.ur_data_path,
    wheel_type=list_4)  # -> loaders, urdf_filename, srdf_filename
# ---------- py_3: Python ----------
import os
from compas.robots import LocalPackageMeshLoader

#loaders

ur_path = os.path.join(ur_data_path, "robot_description")
ur_packages = ["ur_description", "ur_e_description", "ur_end_effectors", "ur_setups"]
ur_loaders = [LocalPackageMeshLoader(ur_path, pck) for pck in ur_packages]

rbvogui_packages = ["rbvogui_description"]
rbvogui_loaders = [LocalPackageMeshLoader(rbvogui_data_path, pck) for pck in rbvogui_packages]

ewellix_packages = ["ewellix_description"]
ewellix_loaders = [LocalPackageMeshLoader(repositories_path, pck) for pck in ewellix_packages]

sensors_packages = ["robotnik_sensors"]
sensors_loaders = [LocalPackageMeshLoader(repositories_path, pck) for pck in sensors_packages]

loaders = ur_loaders + rbvogui_loaders + ewellix_loaders + sensors_loaders

#files
if wheel_type=="indoor":
    urdf_filename = os.path.join(repositories_path, r"mobile_robot_control\data\rbvogui_xl_lift_ur10e_indoor.urdf")
if wheel_type == "outdoor":
    urdf_filename = os.path.join(repositories_path, r"mobile_robot_control\data\rbvogui_xl_lift_ur10e.urdf")
srdf_filename = os.path.join(repositories_path, r"mobile_robot_control\data\rbvogui.srdf")

assert os.path.isfile(urdf_filename)
assert os.path.isfile(srdf_filename)
# ---------- end py_3 ----------
units = ValueList({"m": 1, "cm": 100, "mm": 1000}, selected="m")
load = Button()
create = PythonScript(
    load=load,
    ur_base_frame_rhino_local_tf=python_3.ur_base_frame_rhino_local_tf,
    loaders=py_3.loaders,
    urdf_filename=py_3.urdf_filename,
    srdf_filename=py_3.srdf_filename,
    scale_factor=units)  # -> out, robot, rcf; inputs load: Boolean, loaders: list
# ---------- create: Python ----------
import os
from scriptcontext import sticky as st

import compas

from compas_ghpython import draw_frame
from compas.robots import RobotModel
from compas.robots import LocalPackageMeshLoader

from mobile_robot_control.mobile_robot import MobileRobot
from compas_fab.robots import RobotSemantics
from compas_fab.ghpython import RobotArtist

compas.PRECISION = '12f'

# store robot in component
guid = str(ghenv.Component.InstanceGuid)
robot_key = "robot"

if robot_key not in st:
    st[robot_key] = None

#print loaders
if load:
    model = RobotModel.from_urdf_file(urdf_filename)
    
    model.load_geometry(*loaders)
    artist = RobotArtist(model)
    semantics = RobotSemantics.from_srdf_file(srdf_filename, model)
    robot = MobileRobot(model, artist, semantics, client=None)
    
    st[robot_key] = robot

robot = st[robot_key]
print(robot)
#rcf = draw_frame(robot.get_RCF())
#print(rcf)

if robot:
    robot.scale(scale_factor)
    #robot.RCF_in_WCF = ur_base_frame_rhino_local_tf
# ---------- end create ----------
robot = Data(create.robot)

# ----
# Tool
list_6 = ValueList({"measurement_tool": 0, "parallel_gripper": 1}, selected="parallel_gripper")
show_3 = BooleanToggle(True)
py_4 = PythonScript()  # -> DATA
# ---------- py_4: Python ----------
import os

#package_path = os.path.dirname(mobile_fabrication_control.__file__)


package_path = ghdoc.Path
DATA = os.path.abspath(os.path.join(package_path,"../../data"))

# package_path = os.path.dirname(ur_fabrication_control.__file__)
#DATA = os.path.abspath(os.path.join(package_path,"../../data"))

# .stl files not stored in am_hackathon repo. but in mobile_fabrication_control
#DATA = os.path.abspath(os.path.join(package_path,"../../../workshop_aaec_revamp/data"))

print(package_path)
print(DATA)
# ---------- end py_4 ----------
tool = PythonScript(data_path=py_4, tool=list_6, show=show_3)  # -> tool, M, ee_plane
# ---------- tool: Python ----------
import os, math
from compas.geometry import Frame, Rotation
from compas.datastructures import Mesh
from compas_ghpython.artists import MeshArtist
from compas_fab.robots import Tool
from compas_ghpython.utilities import draw_frame

tolerance = 0

if tool == 0:
    filename = 'measurement_tool_zaxis.stl'
    ee_frame = Frame([0, 0, 0.109], [1, 0, 0], [0, 1, 0])

elif tool == 1:
    #filename = 'parallel_gripper_muc.stl'
    filename = 'parallel_gripper_without_rod.stl'
    ee_frame = Frame([0, 0, 0.145], [1, 0, 0], [0, 1, 0])


data_path = os.path.join(data_path, "tool_geometry")
fullfilename = os.path.join(data_path, filename)
print fullfilename

ee_mesh = Mesh.from_stl(fullfilename)

if show:
    artist = MeshArtist(ee_mesh)
    M = artist.draw()

tool = Tool(ee_mesh, ee_frame)
ee_plane = draw_frame(ee_frame)
print(ee_frame.quaternion.xyzw)
ee_framek = Frame([0.0110607,0.00809854,0.41498], [0,1,0], [1,0,0])
print(ee_framek.quaternion.xyzw)
# ---------- end tool ----------
panel_4 = Panel("Attach a custom tool")
remove = Button()
add = Button()
attach_remove = PythonScript(robot=robot, tool=tool.tool, attach=add, remove=remove)  # -> out, bang
# ---------- attach_remove: Python ----------
if attach:
    robot.attach_tool(tool)
if remove:
    robot.detach_tool()
# ---------- end attach_remove ----------

# ----
# Base
set_base_frame = PythonScript(robot=robot, base_plane=base_plane)  # -> bang
# ---------- set_base_frame: Python ----------
from compas_ghpython import draw_frame
from compas.geometry import Frame, Point, Vector, Transformation
from compas.datastructures import Mesh
from compas_rhino.geometry import RhinoMesh
from compas_fab.robots import CollisionMesh

if base_plane:
    base_frame = Frame(base_plane.Origin, base_plane.XAxis, base_plane.YAxis)
else:
    base_frame = Frame.worldXY()

if robot:
    # base_frame is BCF in WCF
    robot.BCF = base_frame
    
    print(robot.BCF)
# ---------- end set_base_frame ----------

# ----
# Info
info = PythonScript(robot=robot)  # -> out, main_group_name
# ---------- info: Python ----------
if robot:
    robot.info()
    main_group_name = robot.main_group_name
# ---------- end info ----------
panel_5 = Panel(info.out)

# ---- group: forward kinematics
a6 = Slider(0, range=-360..360)
a1 = Slider(30, range=-360..360)
a2 = Slider(-90, range=-360..360)
a3 = Slider(90, range=-360..360)
a4 = Slider(0, range=-360..360)
a5 = Slider(90, range=-360..360)
jp = GhPythonScript()  # -> joint_positions
# ---------- jp: Python ----------
import math

joint_positions = [0, 0,-90,90,0,90,0]
joint_positions = [math.radians(a) for a in joint_positions]
#joint_positions = [-3.136, -0.328, -1.218, 3.129, 0.852, 0.008]
#joint_positions = [0] * 6



print joint_positions
# ---------- end jp ----------
forward_kinematics = PythonScript(robot=robot, set_joint_positions=Button(), joint_positions=jp, lift=l, a1=a1, a2=a2, a3=a3, a4=a4, a5=a5, a6=a6)  # -> full_configuration; inputs joint_positions: list
# ---------- forward_kinematics: Python ----------
import math
import Grasshopper
from compas.robots import Joint
from compas_fab.robots import Configuration

if set_joint_positions:
    j = 0
    for i in range(ghenv.Component.Params.Input.Count):
        nslider = ghenv.Component.Params.Input[i].Sources[0]
        if nslider.GetType() == Grasshopper.Kernel.Special.GH_NumberSlider:
            nslider.TrySetSliderValue(math.degrees(joint_positions[j]))
            j += 1

if robot:
    joint_positions = [lift, a1, a2, a3, a4, a5, a6]
    joint_types = robot.get_configurable_joint_types()
    joint_names = robot.get_configurable_joint_names()
#    joint_types = [type for type in joint_types if type == Joint.REVOLUTE]
    
    for i, joint_type in enumerate(joint_types):
        if joint_type == Joint.REVOLUTE:
            joint_positions[i] = math.radians(joint_positions[i])
        else:
            joint_positions[i] = joint_positions[i]
    
    full_configuration = Configuration(joint_positions, joint_types, joint_names)
    
print(full_configuration)
# ---------- end forward_kinematics ----------

# ----
# Settings
robot_base_plane = Plane(Plane(origin=(-0.151004, 0.002833317895, 0.625169), x=(0, -1, 0), y=(1, 0, 0)))  # disabled
reset_key = Button()
angle_weight = Slider(1, range=0.1..1.1)
dist_weight = Slider(1, range=0..1)
shift_value = Slider(0, range=-0.15..0.05)
angle = Slider(282.86, range=0..360)
equlibrium = BooleanToggle(False)
collision = BooleanToggle(True)
next = Button()
prev = Button()
join = BooleanToggle(False)  # disabled
flip = BooleanToggle(False)
mesh_5 = Mesh(<mesh referenced from the Rhino model>)

pln_8 = Plane(create.rcf)

# ----
# Assembly Branches
number_slider = Slider(3, range=0..10)  # disabled

# ---- group: inverse kinematics
select_configuration = Slider(2, range=0..7)

# ----
# Configuration
# Block is red due to invalid inputs, though remains perfectly functional
inverse = PythonScript(robot=robot, group=info.main_group_name, plane_WCS=pln_5, idx=select_configuration)  # -> out, plane_tool0_RCS, plane_tcp_RCS, configuration; inputs plane_WCS: Plane, idx: Int32
# ---------- inverse: Python ----------
import Rhino.Geometry as rg
import math
from compas.geometry import Frame, Transformation, Rotation
from compas_fab.robots import Configuration
from ur_fabrication_control.kinematics.ur_kinematics import inverse_kinematics
from ur_fabrication_control.kinematics.ur_params import ur_params
from compas_ghpython import draw_frame

tcp_WCS = Frame(plane_WCS.Origin, plane_WCS.XAxis, plane_WCS.YAxis)

# transform frame to robot coordinate system
print tcp_WCS
print plane_WCS
#tcp_RCS = robot.RCF_in_WCF.to_local_coordinates(tcp_WCS)
tcp_BCS = robot.to_local_coordinates(tcp_WCS)
#tcp_BCS = tcp_WCS.transformed(robot.transformation_WCF_BCF())
tcp_RCS = tcp_BCS.transformed(robot.transformation_RCF_BCF().inverse())

tool0_RCS = robot.from_tcf_to_t0cf([tcp_RCS])[0]
print tcp_RCS
print tool0_RCS
plane_tool0_RCS = draw_frame(tool0_RCS)
plane_tcp_RCS = draw_frame(tcp_RCS)
# calculate solutions to frame
ur_params = ur_params["ur10e"] # get the parameters according to the robot model
print ur_params
solutions = inverse_kinematics(tool0_RCS, ur_params)
print solutions

if not len(solutions):
    joint_values = [0,0,0,0,0,0]
    configuration = Configuration.from_revolute_values(joint_values)
else:
    joint_values = solutions[idx]
    #print joint_values
    
    ### ***** HACK ***** ##### TODO: CHECK!!!
    for i, v in enumerate(joint_values):
        if v > math.pi:
            v -= 2*math.pi
        if v < -math.pi:
            v += 2*math.pi
        joint_values[i] = v
    ### ***** HACK ***** ##### TODO: CHECK!!!
    configuration = [Configuration.from_revolute_values(joint_values)]

print(configuration)
# ---------- end inverse ----------

list_7 = ValueList({"0 forward_kinematics": 0, "1 inverse_kinematics": 1}, selected="1 inverse_kinematics")
filter = StreamFilter(Gate=list_7, Stream0=forward_kinematics, Stream1=inverse.configuration)

# ----
# Visualisation
show_end_effector_frame = BooleanToggle(False)
show_base_frame = BooleanToggle(False)
show_collision = BooleanToggle(False)
show_frames = BooleanToggle(False)
show_visual = BooleanToggle(True)
show_acm = BooleanToggle(False)
list_8 = ValueList({"Zero": 0, "One": 1, "Two": 2, "Three": 3, "Four": 4, "Five": 5}, selected="Zero")
visualize = PythonScript(
    robot=robot,
    tool=tool.tool,
    group=info.main_group_name,
    configuration=filter,
    redraw=[attach_remove.bang, set_base_frame],
    show_visual=show_visual,
    show_collision=show_collision,
    show_end_effector_frame=show_end_effector_frame,
    show_frames=show_frames,
    show_base_frame=show_base_frame,
    show_acm=show_acm,
    station=list_8)  # -> out, robot, visual, collision, attached_meshes, frames, ee_frame, tool0_frame, base_frame, base_pt; inputs redraw: list, attached_collision_meshes: list, station_pts: list
# ---------- visualize: Python ----------
import rhinoscriptsyntax as rs
import Rhino.Geometry as rg
import ghpythonlib.components as ghcomp
from compas.geometry import Vector
from compas.geometry import Point
from compas.geometry import Transformation
from compas.geometry import Frame
from compas_ghpython.artists import MeshArtist
from compas_ghpython.utilities import draw_frame
from compas_fab.robots import Configuration
from ur_fabrication_control.kinematics.ur_kinematics import forward_kinematics
from ur_fabrication_control.kinematics.ur_params import ur_params

print(configuration)

if robot and configuration:
    robot.update(configuration, visual=show_visual, collision=show_collision)
    ur_params = ur_params[robot.main_group_name]
    print(ur_params)
    if show_visual:
        visual = robot.artist.draw_visual()
        robot_BCF = draw_frame(robot.BCF) 
        init_robot_plane = rg.Plane.WorldXY
        #robot_RCF = draw_frame(robot.RCF_in_WCF)
        #init_robot_plane = rg.Plane(rg.Point3d(0.275, 0.0, 1.105), rg.Vector3d(-0.707, 0.707, 0.0), rg.Vector3d(-0.707, -0.707,0.0))
        #visual = ghcomp.Orient(visual, init_robot_plane, robot_RCF)[0]
        visual = ghcomp.Orient(visual, init_robot_plane, robot_BCF)[0]
        
    if show_collision:
        collision = robot.artist.draw_collision()
    
    frames = robot.transformed_frames(configuration, group)

    if show_base_frame:
        base_frame = frames[0]

    if show_end_effector_frame:
#        tool0_frame = forward_kinematics(configuration.revolute_values, ur_params)
        ee_frame = robot.forward_kinematics(configuration, group)
        print ee_frame
        if robot.attached_tool:
            tool0_frame = robot.from_tcf_to_t0cf([ee_frame])
        print("End-effector", ee_frame)
    
    if not show_frames:
        frames = None

#    frame = forward_kinematics(configuration.revolute_values, ur_params)
    frame = robot.forward_kinematics(configuration, options=dict(solver='model'))
    #robot.artist.update_tool(visual=visual, collision=collision, transformation=Transformation.from_frame_to_frame(Frame.worldXY(), tool0_frame))
    
    if show_acm:
        M = []
        for acm in attached_collision_meshes:
            frame = robot.forward_kinematics(configuration, options=dict(solver='model', link_name=acm.link_name))
            T = Transformation.from_frame_to_frame(Frame.worldXY(), frame)
            mesh = acm.collision_mesh.mesh.transformed(T)
            M.append(MeshArtist(mesh).draw())
        attached_meshes = M
# ---------- end visualize ----------
geo = Geometry(visualize.collision)
geo_2 = Geometry(visualize.visual)
draw_2 = GhPythonScript(frames=[visualize.frames, visualize.ee_frame, visualize.base_frame], scale=Slider(0.1, range=0..1))  # -> P, V, C, W; inputs frames: list
# ---------- draw_2: Python ----------
from System.Drawing import Color
from compas_ghpython.utilities import draw_frame

red = Color.FromArgb(255, 0, 0)
green = Color.FromArgb(0, 255, 0)
blue = Color.FromArgb(0, 0, 255)

P = []
V = []
C = []

scale = float(scale)

for frame in frames:
    if not frame:
        continue
    plane = draw_frame(frame)
    P += [plane.Origin] * 3
    V.append(plane.XAxis * scale)
    V.append(plane.YAxis * scale)
    V.append(plane.ZAxis * scale)
    C += [red, green, blue]

W = 3
# ---------- end draw_2 ----------
preview_2 = CustomPreview(Geometry=geo_2, Shader=ColourSwatch(SwatchColor=RGB(105, 105, 105)))
preview_3 = CustomPreview(Geometry=visualize.attached_meshes, Shader=ColourSwatch(SwatchColor=RGB(255, 255, 255)))
vdisex = VectorDisplayEx(Point=draw_2.P, Vector=draw_2.V, Colour=draw_2.C, Width=draw_2.W)

panel_6 = Panel(visualize.visual)

# ----
# Assembly Visualization
# 1. Visualize assembly.
# 2. Visualize selected option.
# 3. Visuilize current options (all/filtered).
list_9 = ValueList({"'Built by Human/Robot'": 0, "'Design Generation'": 1, "'Assembly Workflow'": 2}, selected="'Built by Human/Robot'")
show_4 = BooleanToggle(True)
show_5 = BooleanToggle(False)
show_6 = BooleanToggle(False)
show_7 = BooleanToggle(True)
show_8 = BooleanToggle(True)
show_9 = BooleanToggle(False)
show_10 = BooleanToggle(False)
show_11 = BooleanToggle(False)
custom_preview_2 = CustomPreview(Material=ColourSwatch(SwatchColor=RGB(201, 235, 232)))

# ----
# Aggregate
options_num = Slider(80, range=1..100)
list_10 = ValueList({"1. FROM RANDOM VALUES": 0, "2. FROM INPUT GEOMETRY": 1}, selected="1. FROM RANDOM VALUES")
iterations = Slider(10, range=1..50)
human_adds = Button()
robot_adds = Button()
add_two = Button()
aggregate = Button()
update = GhPythonScript(trigger=[robot_adds, human_adds, add_two, aggregate])  # -> update; inputs trigger: list
# ---------- update: Python ----------
update = False

for value in trigger:
    if value:
        update = True

print update
# ---------- end update ----------

inputs = GhPythonScript(
    assembly=initial_configuration.assembly,
    input_geo=mesh_2,
    support=supports,
    next_element=next,
    prev_element=prev,
    angle=angle,
    shift_value=shift_value,
    dist_weight=dist_weight,
    angle_weight=angle_weight,
    collision_check=collision,
    equilibrium_check=equlibrium,
    join_branches=join,
    reset_key=reset_key,
    update=update)  # -> out, assembly, selected_key, angle, shift_value, origins, vectors, sel_conn_plane; inputs input_geo: Mesh, support: Brep
# ---------- inputs: Python ----------
import math
import random
from scriptcontext import sticky as st
import Rhino.Geometry as rg

import ghpythonlib.components as ghcomp

from compas.geometry import Frame, Box, Point
from compas.geometry import Vector, Translation, angle_vectors, Rotation
from compas.artists import Artist

all_options = []
filtered_keys = []
distances = []
vectors = []
origins = []

assembly.support = support
assembly.input_geo = input_geo

def range_filter(options, robot_base_frame):
    ur_range_max = 1.2
    ur_range_min = 0.75
    filtered_options = []
    for key, elem_origin, option_vector in options:
        v = Vector.from_start_end(elem_origin, robot_base_frame.point)
        dist = v.length
        if ur_range_min <= dist <= ur_range_max:
            filtered_options.append((key, elem_origin, option_vector))
    return filtered_options

def options_filter(all_options, target_points):
    filtered_options = []
    for point in target_points:
        for key, elem_origin, option_vector in all_options:
            v = Vector.from_start_end(elem_origin, point)
            angle = angle_vectors(option_vector, v, deg=True)
            if angle < angle_threshold:
                filtered_options.append((key, elem_origin, option_vector))
    return filtered_options

for key, element in assembly.elements():
    for origin, vector in element.current_option_vectors(0.40):
        all_options.append((key, origin, vector))

#############################################################################
## OPTIONS
#############################################################################

#compas_target_pts = [Point(p.X, p.Y, p.Z) for p in target_pts]
#robot_base_frame = Frame(robot_base_plane.Origin, robot_base_plane.XAxis, robot_base_plane.YAxis)

# all options (key, origin, vector)
assembly.all_options = all_options

# filtered options
#filtered_options = options_filter(all_options, target_pts)
#assembly.filtered_options = filtered_options

# current options
#current_options_map = {0:all_options, 1: filtered_options}
assembly.current_options = all_options

# all options keys
open_connectors_keys = [option[0] for option in assembly.current_options]
print open_connectors_keys

open_connectors_keys = list(set(open_connectors_keys))
assembly.open_connectors_keys = open_connectors_keys

#############################################################################
## SELECT A KEY
#############################################################################

guid = str(ghenv.Component.InstanceGuid)
element_key = "elem_" + guid

if element_key not in st or None:
    st[element_key] = 0

if reset_key:
    st[element_key] = 0

if next_element:
    if st[element_key] < len(open_connectors_keys) - 1:
        st[element_key] += 1

if prev_element:
    if st[element_key] <= len(open_connectors_keys) - 1:
        st[element_key] -= 1

    if st[element_key] < 1:
        st[element_key] = 0


#############################################################################
## OPEN CONNECTORS
#############################################################################

if len(open_connectors_keys) == 0: 
    selected_key = 0
    print("!!! NO OPEN CONNECTORS AVAILABLE !!!")
    print("Suggestion: RESET KEY!")
else:
    selected_key = open_connectors_keys[st[element_key]]
    print("Element with key {} selected.".format(selected_key))
    
sel_elem = assembly.network.node[selected_key]['element']




#############################################################################
## LAST ADDED KEYS
#############################################################################

key_index = assembly.network.key_index()
keys = [key_index[key] for key in assembly.network.nodes()]
new_keys = keys[-2:]
assembly.last_added = new_keys
print 'Last added keys:', ', '.join(map(str, new_keys))
# ---------- end inputs ----------
keys_status_update = Panel(inputs.out)
pln_9 = Plane(inputs.sel_conn_plane)
vdis = VectorDisplay(Anchor=inputs.origins, Vector=inputs.vectors)
angle_2 = Panel(inputs.angle)
shift_value_2 = Panel(inputs.shift_value)
selected_key = Panel(inputs.selected_key)

aggregate_2 = GhPythonScript(
    assembly=inputs.assembly,
    elem=elem_def.elem,
    selected_key=inputs.selected_key,
    angle=inputs.angle,
    shift_value=inputs.shift_value,
    dist_weight=dist_weight,
    angle_weight=angle_weight,
    flip_human_robot=flip,
    collision_check=collision,
    equilibrium_check=equlibrium,
    robot_adds=robot_adds,
    human_adds=human_adds,
    add_two=add_two,
    options_num=options_num,
    iterations=iterations,
    mode=list_10,
    aggregate=aggregate)  # -> out, assembly, a_line, b_line, c_line; inputs equilibrium_check: Boolean, iterations: Int32
# ---------- aggregate_2: Python ----------
import sys
import random
from scriptcontext import sticky as st
import ghpythonlib.components as ghcomp
import math

from compas.geometry import distance_line_line, Line, is_intersection_line_line, Plane, Frame, is_intersection_line_plane
from compas.artists import Artist
import Rhino.Geometry as rg
import rhinoscriptsyntax as rs

import ghpythonlib.components as gh

flip = 'AA'
#selected_key = st["selected_key"]

#############################################################################
## ADD ELEMENTS TO ASSEMBLY
#############################################################################

# Robot adds first element
if robot_adds:
    assembly.add_rf_unit_element(selected_key, flip, angle, shift_value, placed_by ='robot', on_ground=False, unit_index=0)
    
# Human adds second element element
if human_adds:
    assembly.add_rf_unit_element(selected_key, flip, angle, shift_value, placed_by ='human', on_ground=False, unit_index=1)

# Add two elements
if add_two:
    assembly.close_rf_unit(selected_key, flip, angle, shift_value, on_ground = False)


#############################################################################
## GROWTH ALONG AN INPUT GEOMETRY
#############################################################################

if aggregate and mode == 1:
    msgs = []
    for i in range (iterations): 
        print('---------------------- Start ----------------------')
        keys = [key for key, frames in assembly.connectors('open') if frames!=[]]
        options_count = 0
        fitness_table = []
        while options_count < options_num: 
            #print('I am in! i:', i, 'options_count:', options_count)
            
            random_key = random.choice(keys)
            random_angle = random.uniform(0., 360.)
            #random_angle = 0
            random_shift = random.uniform(-0.04, 0.04)
            random_option_elems = assembly.element(random_key).current_option_elements(flip, random_angle, random_shift)
            #print('Option {}/{}: random_key = {}, random_angle = {}, random_shift = {}:'.format(options_count+1, options_num, random_key, random_angle, random_shift))
            
            is_colliding = assembly.collision_check(random_option_elems, tolerance = -0.001) if collision_check else False
            
            if equilibrium_check:
                equilibrium, resultant = assembly.static_equilibrium_check(assembly.support, random_option_elems, radius=0.01)
            else:
                equilibrium = True
            
            random_elems_frames = [element.frame for element in random_option_elems]
            is_away_from_ground = all(frame.point.z > 0.2 for frame in random_elems_frames)
            
            if not is_colliding and equilibrium and is_away_from_ground:
                
                output_value, vector = assembly.orientation_to_input_geo(selected_key, random_angle, assembly.input_geo)
                distance, vector = assembly.distance_to_input_geo(selected_key, random_angle, assembly.input_geo)
                #print distance 
                if distance > 1.0:
                    print "Interrupted"
                    break
                else:
                    score = output_value*angle_weight + distance*dist_weight
                
                fitness_table.append([random_key, random_angle, random_shift, score])
                
                options_count += 1
                
        fitness_table_sorted = sorted(fitness_table,key=lambda x:x[3], reverse=True)
        msgs.append('{}.ITERATION:'.format(i))
#        msgs.append('KEYS: {}'.format(keys))
#        msgs.append('SCORES: {}'.format(scores))
        #msgs.append('HIGHEST SCORE: {}.'.format(fitness_table_sorted[0][3]))
        msgs.append('ELEMENT KEY of the option with the highest score: {}'.format(fitness_table_sorted[0][0]))
        assembly.close_rf_unit(fitness_table_sorted[0][0], flip, fitness_table_sorted[0][1], fitness_table_sorted[0][2], on_ground = False)
        msgs.append('------- New elements added to assembly -------')
        for msg in msgs:
            print(msg)

#############################################################################
## RANDOM GROWTH
#############################################################################

if aggregate and mode == 0:
    msgs = []
    i = 0
    while i < iterations: 
        print('-------------------- Start --------------------')
        keys = [key for key, frames in assembly.connectors('open') if frames!=[]]
       
        random_key = random.choice(keys)
        random_angle = random.uniform(0., 180.)
        random_shift = random.uniform(-0.04, 0.04)
        random_option_elems = assembly.element(random_key).current_option_elements(flip, random_angle, random_shift)

        is_colliding = assembly.collision_check(random_option_elems, tolerance = -0.001) if collision_check else False
        
        equilibrium = True
            
        # check if options frames lie below 0.2m height
        random_elems_frames = [element.frame for element in random_option_elems]
        is_away_from_ground = all(frame.point.z > 0.2 for frame in random_elems_frames)
            
        if not is_colliding and equilibrium and is_away_from_ground:
            if all(random_option_elem.frame.point.z > 0.4 for random_option_elem in random_option_elems):
                assembly.close_rf_unit(random_key, flip, random_angle, random_shift, on_ground = False)
                i += 1
                print('------- New elements added to assembly. -------')
            else:
                print('------- Option elements lie below ground level. -------')
        else:
            print('--- Stabilitry or collision avoidance criteria not satisfied. ---')
            
            break
            
        for msg in msgs:
            print(msg)

#############################################################################
## COLLISION CHECK TEST
#############################################################################


current_elem_options = assembly.element(selected_key).current_option_elements(flip, angle, shift_value)
assembly.current_elem_options = current_elem_options

#collision_test = assembly.collision_check(current_elem_options, tolerance = 0.0001)
#print collision_test


#############################################################################
## STATIC EQUILIBRIUM CHECK TEST
#############################################################################

#static_eqilibrium_check, resultant = assembly.static_equilibrium_check(assembly.support, current_elem_options, radius=0.01, allow_temp_support=True)
#print static_eqilibrium_check

"""
keys = [key for key, frames in assembly.connectors('open') if frames!=[]]
random_key = random.choice(keys)
random_angle = random.uniform(0., 180.)
random_shift = random.uniform(-0.04, 0.04)
random_option_elems = assembly.element(random_key).current_option_elements(flip, random_angle, random_shift)

ground_plane = rg.Plane.WorldXY

for option in random_option_elems:
    intersection = rg.Intersect.Intersection.LinePlane(Artist(option.line).draw(), ground_plane)
    print intersection
"""
# ---------- end aggregate_2 ----------
rec = DataRecorder(aggregate_2.out, DataLimit=-10, RecordData=True)
panel_7 = Panel(rec)

branches = GhPythonScript(assembly=aggregate_2.assembly, branch_idx=number_slider)  # -> out, G_branch_elems, G_branch_midpoints; inputs branch_idx: Int32; disabled
# ---------- branches: Python ----------
import rhinoscriptsyntax as rs
from compas.geometry import Line
from compas.topology import connected_components
from compas.artists import Artist


branches = connected_components(assembly.network.adjacency)
print 'The assembly structure has {} branches.'.format(len(branches))
G_branch_elems = [Artist(assembly.element(key).mesh).draw() for key in branches[branch_idx]]
G_branch_midpoints = [Artist(assembly.element(key).line.midpoint).draw() for key in branches[branch_idx]]
# ---------- end branches ----------
assembly_branches = Panel(branches.out)  # disabled
mesh_6 = Mesh(branches.G_branch_elems)  # disabled
pt_2 = Point(branches.G_branch_midpoints)  # disabled

assembly_viz = PythonScript(
    assembly=aggregate_2.assembly,
    preview_mode=list_9,
    show_assembly=show_4,
    show_support=show_5,
    show_input_geo=show_6,
    show_option=show_7,
    show_last=show_8,
    show_arrows=show_9,
    show_open_connectors=show_10,
    show_keys=show_11,
    current_key=inputs.selected_key,
    angle=inputs.angle,
    shift_value=inputs.shift_value,
    flip_human_robot=flip)  # -> out, G_planned, G_built, G_input_geo, G_supports, G_open_connectors, G_selected, G_planned_2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; inputs current_key: Int32
# ---------- assembly_viz: Python ----------
import os
import sys
from scriptcontext import sticky as st
import Rhino.Geometry as rg

import math
from math import pi

from compas.geometry import Vector, Translation, Frame
from compas.artists import Artist
from compas.colors import Color

G_selected = []

G_planned = []
G_built = []
G_supports = []
G_held_by_robot = []
G_open_connectors = []
G_cones = []

connectors_ranges = []

option_vectors = []
origin_option_vectors = []
flip = 'AA'

key_tag_text = []
key_tag_location= []
lines = []

# Color coding
color_coding = {'color_is_planned': Color(1.0, 0.870588235294, 0.0117647058824, 1.0), 'color_is_support': Color(0.0, 0.0, 1.0, 1.0), 'color_has_open_connector': Color(0.494117647059, 1.0, 0.239215686275, 1.0), 'color_is_built': Color(0.811764705882, 1.0, 0.709803921569, 1.0), 'color_is_held_by_robot': Color(1.0, 0.0078431372549, 0.4, 1.0)}

keys = [key for key, element in assembly.elements()]
print len(keys)
lines = [Artist(assembly.element(key).line).draw() for key in keys]

open_connectors_frames = [assembly.element(key).connectors(state='open') for key in keys]
open_connectors_ranges = [assembly.element(key).connectors_ranges(state='open') for key in keys]
open_connectors_ranges = [Artist(connector).draw() for connectors in open_connectors_ranges for connector in connectors if connectors != []]

if show_open_connectors:
    open_connectors_planes = [Artist(connector).draw() for connectors in open_connectors_frames for connector in connectors if connectors != []]
#    print open_connectors_planes
#    open_connectors_planes_trnsf = [rg.Plane.Clone(plane) for plane in open_connectors_planes]
#    [plane.Translate(plane.YAxis*0.075) for plane in open_connectors_planes_trnsf]


def show(element, output_geo, color):
    mesh = Artist(element.mesh).draw(color)
    output_geo.append(mesh)

def show_multiple(elements, output_geo, color):
    for element in elements:
        mesh = Artist(element.mesh).draw(color)
        output_geo.append(mesh)

if assembly:
    radius = assembly.globals['rod_radius']
    
    if current_key != None:
        current_element = assembly.element(current_key)
        elem_options = assembly.element(current_key).current_option_elements(flip, angle, shift_value)
        G_selected = Artist(assembly.element(current_key).mesh).draw(color_coding['color_is_support'])
    else:
        current_element = None
        elem_options = []
    
    if len(elem_options) != 0:
        elem_option = elem_options[0]
    
    if flip_human_robot:
        elem_options.reverse()
    
    planned_keys = list(assembly.network.nodes_where({'is_planned':True}))
    built_keys = list(assembly.network.nodes_where({'is_built':True,'is_support':False}))
    built_keys = [key for key in built_keys if key not in assembly.open_connectors_keys]
    support_keys = list(assembly.network.nodes_where({'is_support':True}))
    support_keys = [key for key in support_keys if key not in assembly.open_connectors_keys]
    
    print 'planned keys:', planned_keys
    print 'built keys:', built_keys
    print 'support keys:', support_keys
    print 'open connectors keys:', assembly.open_connectors_keys
    
    planned_elements = [assembly.element(key) for key in planned_keys] 
    built_elements = [assembly.element(key) for key in built_keys if key not in assembly.last_added] 
    support_elements = [assembly.element(key) for key in support_keys] 
    open_connectors_elements = [assembly.element(key) for key in assembly.open_connectors_keys if key not in assembly.last_added]
    
    # Visualize assembly
    if show_assembly:
        for element in planned_elements:
            mesh = Artist(element.mesh).draw(color_coding['color_is_planned'])
            G_planned.append(mesh)
        for element in built_elements:
            mesh = Artist(element.mesh).draw(color_coding['color_is_built'])
            G_built.append(mesh)
        for element in support_elements:
            mesh = Artist(element.mesh).draw(color_coding['color_is_support'])
            G_supports.append(mesh)
        for element in open_connectors_elements:
            mesh = Artist(element.mesh).draw(color_coding['color_has_open_connector'])
            G_open_connectors.append(mesh)
    
    # Vizualize current connector 
    if show_option and show_assembly:
        if elem_options:
            show(elem_options[0], G_held_by_robot, color_coding['color_is_planned'])
            show(elem_options[1], G_planned, color_coding['color_is_planned'])
            lines.append(Artist(elem_options[0].line).draw())
            lines.append(Artist(elem_options[1].line).draw())
            cone_1 = rg.RevSurface.Create(Artist(elem_options[0].line).draw(), Artist(assembly.element(current_key).line).draw())
            cone_2 = rg.RevSurface.Create(Artist(elem_options[1].line).draw(), Artist(assembly.element(current_key).line).draw())
            G_cones.append(cone_1)
            G_cones.append(cone_2)
            print elem_options[0].line
        else:
            print('No open connectors')
    
    if show_last and show_assembly:
        if len(assembly.last_added) > 1:
            show(assembly.element(assembly.last_added[0]), G_held_by_robot, color_coding['color_has_open_connector'])
            show(assembly.element(assembly.last_added[1]), G_planned, color_coding['color_has_open_connector'])
        else:
            print('No open connectors')
    
    # Visualize all options
    if show_arrows and show_assembly:
        for key, o, v in assembly.current_options:
                option_vectors.append(rg.Vector3d(*tuple(v)))
                origin_option_vectors.append(rg.Point3d(o.x, o.y, o.z))
    
    #elem_option_robot = Artist(elem_options[0].frame).draw() # elem for planning robot routine
    
    if show_keys:
        for key, element in assembly.elements():
            key_tag_text.append(str(key))
            key_tag_location.append(Artist(element.frame).draw().Origin)
            
    if show_support:
        G_supports.append(assembly.support)
        
    if show_input_geo:
        G_input_geo = assembly.input_geo


#for key, element in assembly.elements():
#    print element.connector_1_joints
#    joints_1 = [Artist(joint).draw for joint in element.connector_1_joints]
#    joints_2 = [Artist(joint).draw for joint in element.connector_2_joints]
# ---------- end assembly_viz ----------
rot = GhPythonScript(plane=assembly_viz.elem_option_robot, angle=Slider(42, range=0..360))  # -> out, plane; disabled
# ---------- rot: Python ----------
import math
from compas.geometry import Frame, Rotation
from compas.artists import Artist

frame = Frame(plane.Origin, plane.XAxis, plane.YAxis)

R = Rotation.from_axis_and_angle(frame.xaxis, math.radians(angle), frame.point)
frame.transform(R)

plane = Artist(frame).draw()
# ---------- end rot ----------
mesh_7 = Mesh(assembly_viz.G_planned)
mesh_8 = Mesh(assembly_viz.G_built)
mesh_9 = Mesh(assembly_viz.G_input_geo)
mesh_10 = Mesh(assembly_viz.G_supports)
mesh_11 = Mesh(assembly_viz.G_open_connectors)
mesh_12 = Mesh(assembly_viz.G_selected)
mesh_13 = Mesh(assembly_viz.G_planned_2)
pln_10 = Plane(assembly_viz.open_connectors_planes)
vdis_2 = VectorDisplay(Anchor=assembly_viz.origin_option_vectors, Vector=assembly_viz.option_vectors)
tag = TextTag(Location=assembly_viz.key_tag_location, Text=assembly_viz.key_tag_text)
mesh_14 = Mesh(assembly_viz.G_held_by_robot)
srf = Surface(assembly_viz.G_ranges)
cir = Circle(Plane=pln_10, Radius=0.2)  # disabled
mesh_15 = Mesh(assembly_viz.open_connectors_ranges)
custom_preview_3 = CustomPreview(Geometry=mesh_9, Material=ColourSwatch(SwatchColor=RGBA(240, 226, 214, 124)))

# ---- group: inverse kinematics (continued)
plane = Plane(rot.plane)

# ----
# Network Visualization
number_slider_2 = Slider(0, range=0..47)
show_12 = BooleanToggle(False)
network_viz = GhPythonScript(assembly=aggregate_2.assembly, show_network=show_12, key=number_slider_2)  # -> out, nodes, edges, current_node, current_node_neighbors; inputs key: Int32
# ---------- network_viz: Python ----------
import sys, os
import ghpythonlib.components as ghcomp
from compas.datastructures import Network
from compas_ghpython.artists import NetworkArtist
from compas_rhino.geometry import RhinoLine

import compas_ghpython
import Rhino.Geometry as rg


data = assembly.network.to_data()
network = Network.from_data(data)

print assembly.network.number_of_nodes()

def draw_network(network):
    """Draw a network in Grasshopper.
    """
    points = []
    for key, attr in network.nodes(True):
        points.append({
            'pos': network.node_coordinates(key),
        })

    lines = []
    for (u, v), attr in network.edges(True):
        lines.append({
            'start': network.node_coordinates(u),
            'end': network.node_coordinates(v),
        })

    points_rg = compas_ghpython.draw_points(points)
    lines_rg = compas_ghpython.draw_lines(lines)

    return points_rg, lines_rg

if show_network:
    nodes, edges = draw_network(network)
    
    current_node = {'pos': network.node_coordinates(key), 'radius': 0.03}
    current_node = compas_ghpython.draw_spheres([current_node])
    
    current_node_neighbors_keys = network.neighbors(key)
    current_node_neighbors = [{'pos': network.node_coordinates(key), 'radius': 0.02} for key in current_node_neighbors_keys]
    current_node_neighbors = compas_ghpython.draw_spheres(current_node_neighbors)
# ---------- end network_viz ----------
pt_3 = Point(network_viz.nodes)
line = Line(network_viz.edges)
brep_3 = Brep(network_viz.current_node)
brep_4 = Brep(network_viz.current_node_neighbors)
preview_4 = CustomPreview(Geometry=brep_4, Material=ColourSwatch(SwatchColor=RGB(255, 207, 207)))
preview_5 = CustomPreview(Geometry=[brep_3, line], Material=ColourSwatch(SwatchColor=RGB(0, 0, 0)))

number_slider_3 = Slider(0.07, range=0..1)  # disabled
sph = Sphere(Base=pln_10, Radius=number_slider_3)  # disabled
colour_swatch_2 = ColourSwatch(SwatchColor=RGBA(216, 255, 132, 151))  # disabled
custom_preview_4 = CustomPreview(Geometry=sph, Material=colour_swatch_2)  # disabled

# ----
# Export .json
export = Button()
export_2 = Button()
export_3 = PythonScript(DATA=py.DATA, assembly=aggregate_2.assembly, export_to_json=export, export_to_json_unity=export_2)
# ---------- export_3: Python ----------
import os
from compas.datastructures.mesh import mesh_quads_to_triangles
from compas.datastructures.mesh import mesh_unify_cycles

if export_to_json:
    filename = "intersection_test.json"
    PATH = os.path.join(DATA, "assembly", filename)
    
    # the assembly has to be serialized such that it can be called from CPython, True to enable pretty print
    assembly.to_json(PATH, True)
    

if export_to_json_unity:
    
    for key, e in assembly.elements():
    
        #convert to trimesh
        mesh_quads_to_triangles(e._mesh, check_angles=False)
        #mesh_unify_cycles(e._mesh)
        #print e._mesh.faces
        #print e._mesh.face_vertices(list(e._mesh.faces())[0])

    filename = "unity_assembly_test.json"
    PATH = os.path.join(DATA, "assembly", filename)
    assembly.to_json(PATH)
# ---------- end export_3 ----------

line_2 = Line(assembly_viz.lines)  # disabled

line_3 = Line(aggregate_2.a_line)
line_4 = Line(aggregate_2.b_line)
item = ListItem(List=line_4, Index=1, Wrap=True)  # disabled
item_2 = ListItem(List=line_3, Index=6, Wrap=True)
crvprox = CurveProximity(CurveA=item_2, CurveB=item)  # -> PointA, PointB, Distance

# ----
# Assembly Sequence
show_13 = BooleanToggle(False)  # disabled
sequence = GhPythonScript(compute_fab_sequence=show_13, assembly=aggregate_2.assembly)  # -> out, assembly; disabled
# ---------- sequence: Python ----------
import rhinoscriptsyntax as rs

from compas.colors import Color
from compas.artists import Artist
from compas.topology import shortest_path
from compas.topology import adjacency_from_edges
from compas.topology import breadth_first_traverse

if compute_fab_sequence:
    adjacency = adjacency_from_edges(assembly.network.edges())
    shortest_path_keys = shortest_path(adjacency, 142, 238)
    
    #print adjacency
    print len(shortest_path_keys)
    print shortest_path_keys
    
    def get_neighbors_from_keys_list(keys):
        new_list = []
        for key in shortest_path_keys:
            for neighbor in assembly.network.neighbors(key):
                new_list.append(neighbor)
        return new_list
    
    new_list = list(dict.fromkeys(get_neighbors_from_keys_list(shortest_path_keys)))
    print new_list 
    
    shortest_path_keys = shortest_path_keys + new_list 
    print shortest_path_keys
    
    assembly.fab_sequence = shortest_path_keys
else:
    assembly.fab_sequence = None
# ---------- end sequence ----------
