# Grasshopper definition ex3_assembly_target_geometry_growth [Feb-02 '24, 1517].ghx (Grasshopper 1.0.7)
# plug-ins: Human, WizardPlugin

line = Line(Line((3.201488057, 0.9305529557, -0.1177667126), (2.915630832, 0.4904815192, 0.6134123199)))  # disabled
line_2 = Line([Line((3.105030366, -0.7346415294, -0.0594294727), (2.870967758, -0.319330796, 0.7039391735)), Line((2.803390864, 0.2118405089, 0.5873990749), (3.248678028, -0.2383507852, -0.05216885742))])  # disabled
line_3 = Line(Line((3.201488057, 0.9305529557, -0.1177667126), (2.915630832, 0.4904815192, 0.6134123199)))  # disabled
C = CurveMiddle(Curve=[line_2, line_3, line])  # disabled
circle = CircleCNR(Center=C, Normal=line_2, Radius=0.01)  # disabled

pt = Point(<point referenced from the Rhino model>)
y = Curve(<curve referenced from the Rhino model>)
pt_2 = Point(<point referenced from the Rhino model>)
x = Curve(<curve referenced from the Rhino model>)
y_2 = Curve(<curve referenced from the Rhino model>)
x_2 = Curve(<curve referenced from the Rhino model>)
y_3 = Curve(<curve referenced from the Rhino model>)
pt_3 = Point(<point referenced from the Rhino model>)
x_3 = Curve(<curve referenced from the Rhino model>)
pl = ConstructPlane(Origin=pt, XAxis=x_2, YAxis=y_3)
pl_2 = ConstructPlane(Origin=pt_2, XAxis=x, YAxis=y_2)
pl_3 = ConstructPlane(Origin=pt_3, XAxis=x_3, YAxis=y)

x_4 = Curve(<curve referenced from the Rhino model>)
pt_4 = Point(<point referenced from the Rhino model>)
y_4 = Curve(<curve referenced from the Rhino model>)
pt_5 = Point(<point referenced from the Rhino model>)
x_5 = Curve(<curve referenced from the Rhino model>)
y_5 = Curve(<curve referenced from the Rhino model>)
pt_6 = Point(<point referenced from the Rhino model>)
x_6 = Curve(<curve referenced from the Rhino model>)
y_6 = Curve(<curve referenced from the Rhino model>)
pl_4 = ConstructPlane(Origin=pt_5, XAxis=x_5, YAxis=y_5)
pl_5 = ConstructPlane(Origin=pt_4, XAxis=x_4, YAxis=y_4)
pl_6 = ConstructPlane(Origin=pt_6, XAxis=x_6, YAxis=y_6)

pln = Plane([pl_5, pl_4, pl_6])
pln_2 = Plane([pl_2, pl, pl_3])  # disabled
panel = Panel("""orange
42,88,88 (255)""")
panel_2 = Panel("""green
97,51,64 (255)""")
knob = ControlKnob(Decimals=0, Limit=False, Maximum=359, Minimum=0, Range=360, Value=1820)
support_geo_umb = Brep(<brep referenced from the Rhino model>)
gui = GhPythonScript()  # -> out, a; disabled
# ---------- gui: Python ----------
import Rhino.UI
from cdf_2023.assembly.gui import ErrorDialog

ErrorDialog('test').display()
# ---------- end gui ----------
panel_3 = Panel("Geometry Studies")
panel_4 = Panel("Constrains")
panel_5 = Panel("Assembly step-by-step")
option_2_dome = Brep(<brep referenced from the Rhino model>)
option_4_tipi = Brep(<brep referenced from the Rhino model>)
support_geo_tipi = Brep(<brep referenced from the Rhino model>)
panel_6 = Panel(ColourSwatch(SwatchColor=RGB(224, 165, 27)))
option_3_umbrella = Brep(<brep referenced from the Rhino model>)
# 1.    Define constraints
lockpos = LockPosition(EnableLockPosition=False, PinLockPosition=False)

# ----
# 2.1 Select key
previous = Button()
next = Button()
by_index = ValueList({"OFF": 0, "ON": 1}, selected="OFF")
key_by_index = Slider(25, range=0..80)

unit_size = Slider(0.14, range=0.08..0.5)
shift_value = Slider(0.07, range=0..0.5)
mirror_unit = ValueList({"TRUE": 1, "FALSE": 0}, selected="TRUE")

# ----
# 2.2 Generate option
last_key = Button()

# ----
# (1) 'Manual mode' (ON by default)
# define all the values yourself
angle = Slider(193, range=0..360)

rod_radius = Slider(0.01, range=0.01..0.02)
rod_length = Slider(0.9, range=0.7..1.7)
joint_dist = Slider(0.015, range=0..0.03)

option_0_worldxy = Plane(PlaneXY(0, 0, 0))
option_1_4_planes = Plane([Plane(origin=(-0.002611679333, -0.7707588361, 0.4118038534), x=(0.00338212045, -0.1931022184, 0.9811728158), y=(-0.9998466536, -0.01751197807, 0)), Plane(origin=(-0.7707588361, 0.002611679333, 0.4118038534), x=(-0.1931022184, -0.00338212045, 0.9811728158), y=(-0.01751197807, 0.9998466536, 0)), Plane(origin=(0.002611679333, 0.7707588361, 0.4118038534), x=(-0.00338212045, 0.1931022184, 0.9811728158), y=(0.9998466536, 0.01751197807, 0)), Plane(origin=(0.7707588361, -0.002611679333, 0.4118038534), x=(0.1931022184, 0.00338212045, 0.9811728158), y=(0.01751197807, -0.9998466536, 0))])
option_3_3_planes = Plane([Plane(origin=(-0.001322382405, -0.4694115256, 0.1787689775), x=(0.3398541508, 0.09989969682, 0.9351573166), y=(-0.9398572889, -4.83719427e-05, 0.3415673786)), Plane(origin=(0.4071834972, 0.233560546, 0.1787689775), x=(-0.2564427507, 0.2443724798, 0.9351573166), y=(0.4699705358, -0.8139161022, 0.3415673786)), Plane(origin=(-0.4058611148, 0.2358509795, 0.1787689776), x=(-0.08341140028, -0.3442721775, 0.9351573162), y=(-0.4698867533, -0.8139644737, -0.3415673794))])
option_4_3_planes = Plane([Plane(origin=(0.4071834972, 0.233560546, 0.1787689775), x=(-0.08627357513, -0.05036917882, 0.994997395), y=(-0.5000418324, 0.8660011165, 0.0004817786491)), Plane(origin=(-0.001322382405, -0.4694115256, 0.1787689775), x=(-0.0004842008583, 0.09989969714, 0.994997395), y=(0.9999998828, 4.837152477e-05, 0.0004817786491)), Plane(origin=(-0.4058611148, 0.2358509796, 0.1787689775), x=(0.08675777599, -0.04953051833, 0.994997395), y=(-0.4999580504, -0.866049488, 0.0004817786491))])

# ----
# 2.     Step-By-Step Generation
support_geo_arch = Brep([<brep referenced from the Rhino model> x2])

# ----
# (1) New assembly
# 1. Define material parameters:
# 2. Define target geometry:
#     Describes the general appearence
#     of the structure
# 3. Define suppoprting elements:
#     From these elements structure will grow
# 4. Define support geometry:
#     Foundation of the structure
support_geo_arch_2 = Brep(<brep referenced from the Rhino model>)
option_1_arch = Brep(<brep referenced from the Rhino model>)
support_elem = Plane(pln)
support_geo = Brep(support_geo_arch)
target_geo = Mesh(option_1_arch)

# ----
# 1.1 Select if you want to create a new assembly or load existing one
# Assembly
list = ValueList({"(1) New assembly": 1, "(2) Load assembly (.json)": 2}, selected="(2) Load assembly (.json)")

reset_key = Button()

# ----
# (2) 'Automatic mode'
# Compute selected values based on target geometry,
# other values are taken from Manual mode.
# (Angle is always culculated automatically)
compute = ValueList({"unit_size", "shift_value", "mirror_unit"}, selected=["unit_size", "shift_value", "mirror_unit"])
recompute = Button()
list_2 = ValueList({"ON": 1, "OFF": 0}, selected="OFF")

# ----
# add third elemet to close rf-unit?
# positioning 3rd element
# (should be done manually)
point1 = Slider(0.84, range=0..1)
point2 = Slider(0.49, range=0..1)
shift_value_n = Slider(0, range=-1..1)
_3rd_element = ValueList({"ON": 1, "OFF": 0}, selected="OFF")

option_elem_num = Slider(0, range=0..1)
# (1)
reset = Button()
panel_7 = Panel("Glossary_assembly_11_2024-01-25_14-21.json")

# ----
# repeat cycle
# Key Actions
close_connector = Button()
open_connector = Button()
make_a_support = Button()
delete_all_after_key = Button()

# ----
# 2.3 Add option
add = Button()
# (2)
import = Button(ExpressionNormal="True", ExpressionPressed="False")
supp_h = GhPythonScript(support_geo=support_geo)  # -> out, bbox_z; inputs support_geo: Brep
# ---------- supp_h: Python ----------
import Rhino.Geometry as rg
import ghpythonlib.components as gh

pt = rg.Point3d(0, 0, 0)
bbox = gh.BoundingBox(support_geo, gh.XYPlane(pt))[0]
bbox_z = gh.DeconstructBox(bbox)[3]
print type(bbox_z)
#bbox_z_pl = gh.ConstructPlane(
# ---------- end supp_h ----------
pair_index = Slider(0, range=0..10)

panel_8 = Panel("Unload libraries")
bang = Button()
unload = PythonScript(bang=bang)
# ---------- unload: Python ----------
from compas_rhino.utilities.misc import get_tolerance
from compas_rhino.utilities.misc import unload_modules

unload_modules("cdf_2023")
# ---------- end unload ----------

foundation_height = Panel(supp_h.bbox_z)
py = PythonScript()  # -> ENVIRONMENT_NAME, HERE, DATA
# ---------- py: Python ----------
import os
import compas_bootstrapper

HERE = os.path.dirname(ghdoc.Path)
DATA = os.path.abspath(os.path.join(HERE, "..", "data"))
ENVIRONMENT_NAME = compas_bootstrapper.ENVIRONMENT_NAME
print(HERE)
print(DATA)
print(ENVIRONMENT_NAME)
# ---------- end py ----------
panel_9 = Panel(py.ENVIRONMENT_NAME)

# ---- group: Advanced parameters
random_key = BooleanToggle(False)
options_num = Slider(100, range=1..300)
distance_weight = Slider(1, range=0..1)
angle_weight = Slider(0.1, range=0.1..1.1)

# ---- group: Set as default
la_limit = Slider(0.5, range=0..1)

# ---- group: Platzhalter
bcf_wcs_aa = Plane(Plane(origin=(-1.117452192, -0.4208430177, 0.01980614689), x=(0.5723915496, -0.8199742309, 0.003189757304), y=(0.8199580906, 0.5723429035, -0.009608873971)))
bcf_wcs_ab = Plane(Plane(origin=(0.9896612368, 0.9287122403, 0.007218178072), x=(-0.9475576884, 0.3195482043, -0.004834489242), y=(-0.3195383255, -0.9475694642, -0.002714584304)))
aa_arm = Plane(Plane(origin=(-1.117452192, -0.4208430177, 1.019806147), x=(0.5723915496, -0.8199742309, 0.003189757304), y=(0.8199580906, 0.5723429035, -0.009608873971)))
ab_arm = Plane(Plane(origin=(0.9896612368, 0.9287122403, 1.007218178), x=(-0.9475576884, 0.3195482043, -0.004834489242), y=(-0.3195383255, -0.9475694642, -0.002714584304)))

# ----
# Preview Mode
mode = Slider(1, range=0..3)
panel_10 = Panel("""Built by Human/Robot
Design Generation
Branches
Sequence""")
item = ListItem(List=panel_10, Index=mode, Wrap=True)
panel_11 = Panel(item)

# ----
# 4. Collision detection
collision_check = BooleanToggle(True)

open_connectors = BooleanToggle(True)
panel_12 = Panel(ColourSwatch(SwatchColor=RGBA(255, 0, 0, 120)))
panel_13 = Panel(ColourSwatch(SwatchColor=RGB(255, 129, 120)))
panel_14 = Panel([ColourSwatch(SwatchColor=RGB(181, 0, 0)), ColourSwatch(SwatchColor=RGB(186, 105, 0)), ColourSwatch(SwatchColor=RGB(70, 128, 0))])
crv = Curve(<curve referenced from the Rhino model>)
crv_2 = Curve(<curve referenced from the Rhino model>)
crvprox = CurveProximity(CurveA=crv, CurveB=crv_2)  # -> PointA, PointB, Distance
geo = Geometry(<brep referenced from the Rhino model>)
geo_2 = Geometry(<brep referenced from the Rhino model>)
geo_3 = Geometry([<brep referenced from the Rhino model> x2])
ln = Line(StartPoint=crvprox.PointA, EndPoint=crvprox.PointB)
circle_2 = CircleCNR(Center=crvprox.PointA, Normal=crv, Radius=0.01)
circle_3 = CircleCNR(Center=crvprox.PointB, Normal=crv_2, Radius=0.01)
preview = CustomPreview(Geometry=geo, Material=ColourSwatch(SwatchColor=RGB(255, 170, 0)))
preview_2 = CustomPreview(
    Geometry=geo_3,
    Material={diffuse=RGB(221, 160, 221), emission=RGB(66, 48, 66), shine=0.5, specular=RGB(255, 255, 255), transparency=0})

# ----
# (3) 'Joining mode'
# automatically join two elements, if they are close enough:
# (with the option parameters from Manual Mode)
# (1) with one rf-unit      (2) with 2 rf-units
# - Select Case
# - Select Option
case = ValueList({"(1) ONE options-pair": 0, "(2) TWO options-pairs": 1}, selected="(1) ONE options-pair")
number_slider = Slider(1, range=0..1)
# 3.     Export                           _
direction = ValueList({"Right": 0, "Left": 1}, selected="Left")
previous_2 = Button()
next_2 = Button()
list_3 = ValueList({"ON": 1, "OFF": 0}, selected="OFF")

# ----
# Export .json
project_name = Panel("test_attr")
export_assembly = Button()

# ----
# Capture to bitmap
view_name = Panel("Constrains")
capture = Button()

# ----
# Bake Geometry to Rhino
name_of_the_layer = Panel("00_GEO_option")
bake = Button()

# ----
# (2) Load assembly (.json)
# 1. Write the name of your saved assembly
#     to continue with generation:
# All the necessary parameters are already saved there
panel_15 = Panel("Jan-01_assembly_36_2024-01-27_16-30.json")
filename = Text("TEST_Arch_assembly_39_2024-01-13_13-59.json")

# ----
# 1. Create new assembly:
# globals, rod and joint geo, supporting elements
mesh = Mesh(<mesh referenced from the Rhino model>)
# (2) Load assembly from path
_2_load = GhPythonScript(DATA=py.DATA, filename=filename, import_from_json=import)  # -> out, imp_assembly; inputs import_from_json: Boolean
# ---------- _2_load: Python ----------
import os

import Rhino.UI
from cdf_2023.assembly.gui import ErrorDialog
from cdf_2023.assembly import Assembly


if import_from_json:
    try:
        PATH = os.path.join(DATA, "assembly", filename)
        imp_assembly = Assembly.from_json(PATH)
    except:
        ErrorDialog('This file is not existing').display()

print imp_assembly
# ---------- end _2_load ----------
# 1. Define main parameters
_1_new_assembly = GhPythonScript(
    selection=list,
    rod_radius=rod_radius,
    rod_length=rod_length,
    joint_dist=joint_dist,
    joint_geo=mesh,
    planes=support_elem,
    reset=reset)  # -> new_assembly, elem, joint_elem; inputs planes: list of Plane
# ---------- _1_new_assembly: Python ----------
import rhinoscriptsyntax as rs

from compas.geometry import Frame, Plane, Rotation
from compas.geometry import Circle, Cylinder, Line
from compas.geometry import Transformation

from compas_rhino.conversions import RhinoSurface, RhinoMesh

from cdf_2023.assembly import Assembly
from cdf_2023.assembly import Element


#########################################################################
## ELEMENT DEFINITION
#########################################################################

# define cross section for the rod
cross_section_plane = Plane.from_frame(Frame.worldYZ())
cross_section = Circle(cross_section_plane, rod_radius)

elem_geo = Cylinder(cross_section, rod_length)

# create element
elem = Element.from_shape(elem_geo, Frame.worldXY())

# set 0-position of connector frames in the middle of element [0,0,0], but with different axis directions
"""the exact position of connector frame is found later dapanding on unit size and shift value"""
connector_frame_1 = Frame([0,0,0], [1,0,0], [0,1,0])
connector_frame_2 = Frame([0,0,0], [-1,0,0], [0,-1,0])

elem.connector_frame_1 = connector_frame_1
elem.connector_frame_2 = connector_frame_2

# define geometry for element line
elem.line = Line([-rod_length/2.,0,0],[rod_length/2.,0,0])


#############################################################################
## ALL OPEN CONNECTORS KEYS
#############################################################################

if selection == 1:
    print "here"
    #########################################################################
    ## CREATE ASSEMBLY
    #########################################################################
    new_assembly = Assembly()
    
    # define global values
    new_assembly.globals['rod_radius'] = rod_radius
    new_assembly.globals['rod_length'] = rod_length
    new_assembly.globals['joint_dist'] = joint_dist
    
    #assembly.globals['foundation_height'] = found_h
    
    
    #########################################################################
    ## JOINT DEFINITION
    #########################################################################
    """not used in this version of script"""
#    joint_rhino_mesh = RhinoMesh.from_geometry(joint_geo)
#    joint_compas_mesh = joint_rhino_mesh.to_compas()
#    joint_elem = Element.from_shape(joint_compas_mesh, Frame.worldXY())
#    
#    joint_geo_mir = rs.MirrorObject(joint_geo, (0,0,0) , (0,1,0), True)
#    joint_rhino_mesh = RhinoMesh.from_geometry(joint_geo)
#    joint_compas_mesh = joint_rhino_mesh.to_compas()
#    joint_elem_mir = Element.from_shape(joint_compas_mesh, Frame.worldXY())

    #########################################################################
    ## SUPPORTING ELEMENTS
    #########################################################################
    
    for plane in planes:
        T1 = Transformation.from_frame_to_frame(Frame.worldXY(), Frame(plane.Origin, plane.XAxis, plane.YAxis))
        new_elem = elem.transformed(T1)
        
        # set connector state
        new_elem.connector_1_state = True
        new_elem.connector_2_state = False
    
        # add element to assembly
        new_assembly.add_element(new_elem, 
                             placed_by='human', 
                             robot_name='AA',
                             robot_AA_base_frame=Frame.worldXY(),
                             robot_AB_base_frame=Frame.worldXY(),
                             is_support=True,
                             is_built=True,
                             is_planned=True)
    
    #target_geo_mesh = RhinoMesh.from_geometry(target_geo)
    #new_assembly.support = support_geo
    #new_assembly.target_geo = target_geo_mesh

    #print type(new_assembly.target_geo)
# ---------- end _1_new_assembly ----------
# Select between
# (1) New and (2) Load
select = GhPythonScript(selection=list, new_assembly=_1_new_assembly.new_assembly, imported_assembly=_2_load.imp_assembly)  # -> out, assembly
# ---------- select: Python ----------
import rhinoscriptsyntax as rs

if selection == 1:
    assembly = new_assembly
else:
    assembly = imported_assembly
    
print assembly.globals
print assembly
# ---------- end select ----------

delete = GhPythonScript(assembly=select.assembly, selected_key=key_by_index, remove=delete_all_after_key)  # -> out, assembly, action_history; inputs selected_key: Int32; disabled
# ---------- delete: Python ----------
from compas.artists import Artist
from scriptcontext import sticky as st

from compas.geometry import Frame

action_history = []

#############################################################################
## Delete childs
#############################################################################

all_keys = [key for key in assembly.network.nodes()]
print all_keys

try:
    keys_to_delete = all_keys[selected_key+1:]
    keys_to_delete.reverse()
    print keys_to_delete
except:
    print 'no'

keys = [key for key in assembly.network.nodes()]

if remove:
    for i_key in keys_to_delete:
        assembly.delete_element(i_key)
    
    action_history = ['Elements {} deleted from assembly'.format(str(keys_to_delete))]
    
    
print assembly.network.number_of_nodes()
# ---------- end delete ----------
python = GhPythonScript(assembly=delete.assembly)  # -> out, a; disabled
# ---------- python: Python ----------
## ALL keys
keys = [key for key in assembly.network.nodes()]
print 'keys by nodes:', keys

key_index = assembly.network.key_index()
print 'key_index', key_index

#current_elem = assembly.network.node[current_key]['element']
keys = [key_index[key] for key in assembly.network.nodes()]
print 'keys by key_index:', keys

#print assembly.network.node[31]['element']

print 'nodes:', list(assembly.network.nodes())



#index_key = assembly.network.index_key()
#i_key = 31
#n_key = index_key[i_key]
#print n_key
# ---------- end python ----------

# ----
# Manual and automatic
mod = Modulus(A=angle, B=360)
M = MeshJoin(Meshes=support_geo)
res = GhPythonScript(t=[reset_key, reset])  # -> res; inputs t: list
# ---------- res: Python ----------
res = False

for value in t:
    if value:
        res = True

print res
# ---------- end res ----------

# ----
# Join branches
selected_connectors_ranges = BooleanToggle(False)
all_connectors_ranges = BooleanToggle(False)
intersections = BooleanToggle(True)

capture_to_bitmap = PythonScript(DATA=py.DATA, viewport_name=view_name, idx=Slider(1, range=0..10), capture=capture)  # -> out, filename_short; inputs idx: Int32
# ---------- capture_to_bitmap: Python ----------
import Rhino
import System.Drawing
from scriptcontext import sticky as st

import sys, os
import ghpythonlib.components as ghcomp
import Grasshopper as gh
from datetime import datetime


ghComp = ghenv.Component
ghDoc = ghComp.OnPingDocument()

def rCommonCap(filePath, viewportName,scaleFactor):
    RhinoDocument = Rhino.RhinoDoc.ActiveDoc
    view = RhinoDocument.Views.Find(viewportName, False)
    vp = view.ActiveViewport
    size = System.Drawing.Size(vp.Size.Width*scaleFactor,vp.Size.Height*scaleFactor)
    capture = view.CaptureToBitmap(size)
    capture.Save(filePath);

now = datetime.now() # current date and time
date_time = now.strftime("%Y-%m-%d_%H-%M")

filename_short = 'capture_{}_{}_{}.png'.format(viewport_name,idx, "{date}")
export_dir = os.path.join(DATA, 'parameter_studies')
if not os.path.isdir(export_dir): os.mkdir(export_dir)
print export_dir
filename = os.path.join(export_dir, 'capture_{}_{}_{}.png'.format(viewport_name,idx,date_time)) 
print filename

zoom = 1

if capture:
    rCommonCap(filename, viewport_name, zoom)
# ---------- end capture_to_bitmap ----------

output_filename = Panel(capture_to_bitmap.filename_short)

# ----
# Join branches
selected_connectors_ranges_2 = BooleanToggle(False)  # disabled
all_connectors_ranges_2 = BooleanToggle(False)  # disabled
intersections_2 = BooleanToggle(True)  # disabled

# ----
# Stability calculation
stability_feedback = BooleanToggle(True)

# ----
# 2.3 Add elements
update = GhPythonScript(trigger=[close_connector, delete_all_after_key, make_a_support, add, open_connector])  # -> update; inputs trigger: list
# ---------- update: Python ----------
update = False

for value in trigger:
    if value:
        update = True

print update
# ---------- end update ----------
panel_16 = Panel(update)

# ----
# 2.1 Generate option
settings_parameters = GhPythonScript(
    assembly=select.assembly,
    automatic=list_2,
    next_element=next,
    prev_element=previous,
    last_element=last_key,
    get_key_by_index=by_index,
    key_at_index=key_by_index,
    selected_angle=mod,
    selected_shift_value=shift_value,
    selected_unit_size=unit_size,
    selected_mirror_unit=mirror_unit,
    reset_key=res,
    compute=recompute,
    random_options_num=options_num,
    generate_random_key=random_key,
    random_params=compute,
    target_geo=target_geo,
    support_geo=flatten(M),
    distance_weight=distance_weight,
    angle_weight=angle_weight,
    robot_AA_base_plane=bcf_wcs_aa,
    ur_arm_AA_base_plane=aa_arm,
    robot_AB_base_plane=bcf_wcs_ab,
    ur_arm_AB_base_plane=ab_arm,
    show_resultant=stability_feedback,
    collision=collision_check,
    la_limit=la_limit,
    get_joining_options=list_3,
    update=update)  # -> out, status, assembly, selected_mode, selected_key, current_key, current_angle, current_shift_value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; inputs key_at_index: Int32, random_options_num: Int32, generate_random_key: Boolean, random_params: list, target_geo: Mesh, support_geo: Mesh, robot_AA_base_plane: Plane
# ---------- settings_parameters: Python ----------
import math
import random
import System.Threading.Tasks as tasks
from scriptcontext import sticky as st
import Rhino.Geometry as rg
import rhinoscriptsyntax as rs

import ghpythonlib.components as ghcomp

from compas.geometry import Frame, Box, Point, Plane
from compas.geometry import Vector, Translation, angle_vectors, Rotation
from compas.artists import Artist
from compas.topology import connected_components
from compas_rhino.conversions import plane_to_compas_frame

import Rhino.UI
from cdf_2023.assembly.gui import ErrorDialog

import time
import sys


msg = []

filter_keys = False

all_options = []
distances = []
vectors = []
origins = []
filtered_keys = []

stability_check = {0:'global', 1:'local', 2:'no_stability_check'}
stability_criteria = 1 # pre-definiert - always local
assembly.stability_check = stability_check[stability_criteria]

assembly.support = support_geo
assembly.target_geo = target_geo

fitness_table = []

total_elements = assembly.network.number_of_nodes()

parallel = True
#only_grow_top = True
top_keys = 30
iterations = 1


def generate_option(support_centroid, fitness_table, open_keys, cp=None):
    # The calculation order was adapted to the ratio of elements which do not pass the tests. There is a high properbility that the output value test is failed.
    # Therefore, this test is perofrmed first and we immeditely return if it failed and do not do any further calculations.
    
    # pick a key
    option_key = selected_key if not generate_random_key else random.choice(open_keys)
    
    # generate a random angle and shift
    random_angle = random.randint(0, 90) * 4
    random_shift = selected_shift_value if not "shift_value" in random_params else round(random.uniform(0, 0.15),2)
    random_bool_mirror_unit = selected_mirror_unit if not "mirror_unit" in random_params else bool(random.getrandbits(1))
    random_unit_size = selected_unit_size if not "unit_size" in random_params else round(random.uniform(0.08, 0.20),2)
    
    # get the current option elements of the random key with the given angle and shift value
    random_option_elems, new_connector_frame = assembly.element(option_key).current_option_elements(assembly, random_bool_mirror_unit, random_unit_size, random_angle, random_shift)
    
    # calculate the orientation to the target geometry and the distance to the target geometry
    elem = random_option_elems[0]
    output_value, vector1 = assembly.orientation_to_target_geo(option_key, random_option_elems,
                                                               assembly.target_geo)
    
    if not output_value > 80.0:
        return
    
    # check if the random option elements collide with anything
    coll, d, d_elems, line = assembly.collision_check(option_key, random_option_elems, tolerance=-0.001)
    if coll:
        return
    
    # check if all the random option elements are away from the ground
    random_elems_frames = [element.frame for element in random_option_elems]
    if not all(frame.point.z > 0.2 for frame in random_elems_frames):
        return

    distance, vector2 = assembly.distance_to_target_geo(option_key, random_option_elems, assembly.target_geo)

    if not distance < 1:
        return

    # calculation witgout stability criteria
    score = output_value * angle_weight + 1 / distance * distance_weight

    # create a fitness table the random values and corresponding scores
    fitness_table.append([option_key, random_angle, random_unit_size, random_shift, random_bool_mirror_unit, score])


def get_option_with_highest_score():
    computed_values = []
    msgs = []
    if assembly.stability_check == 'local':
        cp = [Artist(assembly.element(bkey).line.midpoint).draw() for bkey, element in assembly.elements()]
    else:
        cp = None

    start_time_loop = time.time()  # timestamp

    for i in range(iterations):
        fitness_table = []
        # precompute the keys of open connectors
        #open_keys = [key for key, frames in assembly.connectors('open') if frames != []]
        open_keys = open_connectors_keys
        #print(open_keys)
        
        
        # To ensure that the algorithm does not lose efficiency when growing along a geometry due to the increasing options, we only choose between the top keys
        if len(open_keys) > top_keys:
            open_keys = open_keys[len(open_keys)-top_keys:]
            
        #print open_keys

        # precompute the surface area centroid of the support#
        support_centroid = None
        #support_centroid = rs.SurfaceAreaCentroid(assembly.support)[0]

        # Here we leverage multiple cores at once. If the computer has more then one core this speeds of significantly
        if parallel:
            #print 'yes'
            #tasks.Parallel.ForEach(xrange(random_options_num), lambda i: generate_option(support_centroid, fitness_table, open_keys, cp=cp))
        #else:
            for i in range(random_options_num):
                generate_option(support_centroid, fitness_table, open_keys, cp=cp)

        fitness_table_sorted = sorted(fitness_table, key=lambda x: x[5], reverse=True)
        
        msgs.append('{}. ITERATION:'.format(i))

        if fitness_table_sorted:
            msgs.append(
                'Element key {} with the highest score: {}'.format(fitness_table_sorted[0][0], fitness_table_sorted[0][5]))

            best_key = fitness_table_sorted[0][0]
            best_angle = fitness_table_sorted[0][1]
            best_unit_size = fitness_table_sorted[0][2]
            best_shift_value = fitness_table_sorted[0][3]
            best_mirror_unit = fitness_table_sorted[0][4]

            computed_values = {'key': best_key, 'angle': best_angle, 'unit_size': best_unit_size, 'shift_value': best_shift_value, "mirror_unit": best_mirror_unit}
            
        else:
            msgs.append('No elements found which fit to the assembly. Increase the number of options or try finding a fit manually.')
    #print("--- Total time %s seconds ---" % (time.time() - start_time_loop))
    # print the messages
    for msg in msgs:
        print(msg)
    
    #print computed_values
    return computed_values


#############################################################################
## SELECT MODE
#############################################################################

selected_mode = "(1) Manual" # set as default

if get_joining_options:
    selected_mode = "(3) Join branches"
if automatic:
    selected_mode = "(2) Automatic"

#############################################################################
## ALL OPEN CONNECTORS KEYS
#############################################################################

## ALL keys
key_index = assembly.network.key_index()
keys = [key_index[key] for key in assembly.network.nodes()]
#keys = [key for key in assembly.network.nodes()]
print key_index

print list(assembly.network.nodes())

for tkey in assembly.network.nodes():
     print tkey , assembly.network.node[tkey]['element']


#print list(assembly.connectors(state='open'))
#for key, frame in assembly.connectors(state='open'):
#    print key

open_connectors_keys = [key for key, frame in assembly.connectors(state='open')]
assembly.open_connectors_keys = open_connectors_keys
#print open_connectors_keys

#############################################################################
## Filter key according to current robot location
#############################################################################

assembly.robot_AA_base_plane = robot_AA_base_plane
assembly.ur_arm_AA_base_plane = ur_arm_AA_base_plane
assembly.robot_AB_base_plane = robot_AB_base_plane
assembly.ur_arm_AB_base_plane = ur_arm_AB_base_plane

"""if filter_keys:
    for key, element in assembly.elements():
        if key in open_connectors_keys:
            distance1 = element.frame.point.distance_to_point(ur_arm_AA_base_plane.Origin)
            distance2 = element.frame.point.distance_to_point(ur_arm_AB_base_plane.Origin)
            if distance1 < 1.25 or distance2 < 1.25:
                filtered_keys.append(key)
    open_connectors_keys = filtered_keys"""

#############################################################################
## SELECT A KEY MANUALLY
#############################################################################

guid = str(ghenv.Component.InstanceGuid)
element_key = "elem_" + guid

if next_element:
    if get_key_by_index:
        ErrorDialog('Get_key_by_index is turned on. Set it to FALSE to proceed').display()
        get_key_by_index = False

    if st[element_key] < len(open_connectors_keys) - 1:
        st[element_key] += 1

if prev_element:
    if get_key_by_index:
        ErrorDialog('Get_key_by_index is turned on. Set it to FALSE to proceed').display()
        get_key_by_index = False

    if st[element_key] <= len(open_connectors_keys) - 1:
        st[element_key] -= 1

    if st[element_key] < 1:
        st[element_key] = 0

if last_element:
    st[element_key] = len(open_connectors_keys) - 1

if element_key not in st or None:
    print "here not in st"
    st[element_key] = 0

if reset_key:
    st[element_key] = 0

print open_connectors_keys
print 'key', st[element_key]

#############################################################################
## SELECT KEY manually OR by index
#############################################################################

if get_key_by_index:
    selected_key = key_at_index

else:
    if len(open_connectors_keys) == 0: 
        ErrorDialog('No open connectors available! Suggestion: RESET KEY!').display()
    
    else:
        try:
            selected_key = open_connectors_keys[st[element_key]]
        except:
            ErrorDialog('Index out of range. Reset the key').display()

#############################################################################
## GET SELECTED KEY CONNECTOR STATUS
#############################################################################

if selected_key in open_connectors_keys:
    selected_key_status = 'open'
else:
    selected_key_status = 'close'
    elem_options = None
print selected_key, selected_key_status

#############################################################################
## GET PARAMETERS
#############################################################################
params = 'params'

if params not in st or st['params'] is None:
    st[params] = {'key' : selected_key, 'angle': 0, 'unit_size': 0.15, 'shift_value': 0, 'mirror_unit': False}

if selected_mode == "(1) Manual" or selected_mode == "(3) Join branches":
    st[params] = {'key' : selected_key, 'angle': selected_angle, 'unit_size': selected_unit_size, 'shift_value': selected_shift_value, 'mirror_unit': selected_mirror_unit}

if selected_mode == "(2) Automatic":
    try: 
        st[params]['key'] == selected_key 
    except:
        ErrorDialog('Probably the target geometry is too far away from the current key. Firstly return back to Manual Mode').display()
        st[params] = {}
    
    if compute:
        st[params] = get_option_with_highest_score()
        #print st[params]
#elif selected_mode == "(1) Manual" or selected_mode == "(3) Join branches":
#    st[params] = {'key' : selected_key, 'angle': selected_angle, 'unit_size': selected_unit_size, 'shift_value': selected_shift_value, 'mirror_unit': selected_mirror_unit}

parameters = st[params]

if parameters != {}:
    current_key = parameters['key']
    current_angle = parameters['angle']
    current_unit_size = parameters['unit_size']
    current_shift_value = parameters['shift_value']
    current_mirror_unit = parameters['mirror_unit']
else:
    current_key = selected_key
    current_angle = selected_angle
    current_unit_size = selected_unit_size
    current_shift_value = selected_shift_value
    current_mirror_unit = selected_mirror_unit

if current_key not in open_connectors_keys:
    current_key = open_connectors_keys[0]
    #selected_key = open_connectors_keys[0]
if current_key != None:
    selected_elem = assembly.network.node[current_key]['element']

assembly.parameters = parameters

#############################################################################
## DISPLAY SELECTED CONNECTOR and ASSIGN GENERATED OPTION
#############################################################################



if selected_key in open_connectors_keys and parameters != {}:
    
    elem_options, selected_connector_frame_copy  = assembly.element(current_key).current_option_elements(assembly, current_mirror_unit, current_unit_size, current_angle, current_shift_value)
    selected_connector_plane = Artist(selected_connector_frame_copy).draw()
    #assembly.elem_options = elem_options
else:
    elem_options = []

assembly.elem_options = elem_options
print elem_options

#############################################################################
## DISTANCE TO INPUT GEO
#############################################################################

if selected_key in open_connectors_keys and parameters != {}:
    distance, shortest_vector_1 = assembly.distance_to_target_geo(current_key, elem_options, target_geo)
    
    # Vector Display
    vectors.append(shortest_vector_1)
    origins.append(selected_connector_plane.Origin)
    
    target_geo_feedback = ['Key {}: Distance to target geometry: {dist:.2f}m'. format(current_key, dist=distance)]

#############################################################################
## ORIENTATION TO INPUT GEO
#############################################################################

    output_value, shortest_vector_2 = assembly.orientation_to_target_geo(current_key, elem_options, target_geo)
    
    # Vector Dispaly
    vectors.append(rg.Vector3d(shortest_vector_2.x,shortest_vector_2.y,shortest_vector_2.z))
    origins.append(selected_connector_plane.Origin)
    
    target_geo_feedback.append('Key {}: Orientation to target geometry: {len:.2f}%'. format(current_key, len=output_value))

else:
    target_geo_feedback = 'Selected key ({}) is closed: no option is generated.'.format(selected_key)

#############################################################################
## LAST ADDED KEYS
#############################################################################

new_keys = keys[-2:]
assembly.last_added = new_keys
#print 'Last added keys:', ', '.join(map(str, new_keys))

#############################################################################
## Close connector
#############################################################################


"""if close_connector:
    if selected_key in open_connectors_keys:
        print ("closed")
        assembly.element(selected_key).connector_1_state = False
        assembly.element(selected_key).connector_2_state = False
    else:
        print("Error:TRUE")
        print("Not possible to close this connector.")
        """

robot_AA_base_frame = plane_to_compas_frame(robot_AA_base_plane)
robot_AB_base_frame = plane_to_compas_frame(robot_AB_base_plane)

for key, element in assembly.elements():

    assembly.network.node_attribute(key, 'robot_AA_base_frame', robot_AA_base_frame)
    assembly.network.node_attribute(key, 'robot_AB_base_frame', robot_AB_base_frame)

assembly.open_connectors_keys = open_connectors_keys

# status
total_joints = assembly.network.number_of_edges()
total_elements = assembly.network.number_of_nodes()
status = ["Total ELEMENTS: {}".format(total_elements)]
status.append("Total JOINTS: {}".format(total_joints))
# ---------- end settings_parameters ----------
error = GhPythonScript(inp=settings_parameters.out)  # inputs inp: list
# ---------- error: Python ----------
import Rhino.UI
from cdf_2023.assembly.gui import ErrorDialog

for line in inp:
    if "KeyError" in line:
        ErrorDialog('Error Key. Try to reset the key and check if key_by_index is set to False').display()
# ---------- end error ----------
vdis = VectorDisplay(Anchor=settings_parameters.origins, Vector=settings_parameters.vectors)

panel_17 = Panel(settings_parameters.selected_mode)
selected_key = Panel(settings_parameters.selected_key)

# ----
# Current mode
panel_18 = Panel(settings_parameters.selected_mode)

# ----
# Status bar
panel_19 = Panel(settings_parameters.status)

joining_branches_new = GhPythonScript(
    elem=_1_new_assembly.elem,
    get_joining_options=list_3,
    joining_case=case,
    show_new_element=_3rd_element,
    pair_index=pair_index,
    point_on_intersection=number_slider,
    point1=point1,
    point2=point2,
    current_key=settings_parameters.current_key,
    shift_value=settings_parameters.current_shift_value,
    shift_value_n=shift_value_n,
    mirror_unit=settings_parameters.current_mirror_unit,
    unit_size=settings_parameters.current_unit_size,
    option_elem_num=option_elem_num,
    show_all_con_ranges=all_connectors_ranges_2,
    show_sel_con_ranges=selected_connectors_ranges_2,
    show_intersections=intersections_2,
    show_resultant=stability_feedback,
    la_limit=la_limit)  # -> out, assembly, join_branch_feedback, elem_line1, elem_line2, new_elem_mesh, new_elem, G_intersection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; inputs pair_index: Int32, option_elem_num: Int32; disabled
# ---------- joining_branches_new: Python ----------
import math
import rhinoscriptsyntax as rs
import Rhino.Geometry as rg


from compas.geometry import Point, Vector, Frame, Plane, Vector, Line, Transformation, Rotation, Translation
from compas.geometry import angle_vectors, closest_point_on_line, intersection_line_plane, angles_points
from compas.artists import Artist
from compas_rhino.conversions import line_to_rhino_curve, point_to_compas, point_to_rhino, plane_to_compas_frame, cylinder_to_rhino, vector_to_rhino
from compas.topology import connected_components

import ghpythonlib.components as gh

import Rhino.UI
from cdf_2023.assembly.gui import ErrorDialog

connector_ranges = []
connectors_pairs = []
intersections = []

G_intersection = []
G_connectors_ranges = []

#option_elem_num # number of the element in the generated option which is touching other element
#                       # 0 - by robot, 1 - by human

epsilon = 0.001

open_connectors_keys = [key for key, frames in assembly.connectors(state='open')]

robot_AA_base_frame = plane_to_compas_frame(assembly.robot_AA_base_plane)
robot_AB_base_frame = plane_to_compas_frame(assembly.robot_AB_base_plane)

def generate_connector_range(key):
    elem = assembly.element(key)

    # generate option based on input parameters
    elem_options = elem.current_option_elements(assembly, mirror_unit, unit_size, 0, shift_value)
    selected_option = Artist(elem_options[option_elem_num].line).draw()
    
    rod_length =  assembly.globals['rod_length']
    l1 = math.sqrt(3)*unit_size + shift_value
    # find the point depending on the open connector
    if elem.connector_1_state == True:
        n = 0.0
        l1 = rod_length - l1 - 0.05
    if elem.connector_2_state == True:
        n = 1.0
        l1 = l1 + 0.05
    
    start_pt = rg.Line.PointAt(selected_option, n)
    end_pt = rg.Line.PointAtLength(selected_option, l1)
    
    # create connector range based on line
    section_line = rg.Line(start_pt, end_pt)
    rot_axis = Artist(assembly.element(key).line).draw()
    connector_range = rg.RevSurface.Create(section_line, rot_axis)
    
    return connector_range

def angle_between_points(p_A, p_B, p_O, v):
    # Vector from point O to point A
    vec_A = rg.Vector3d(p_A - p_O)
    
    # Vector from point O to point B
    vec_B = rg.Vector3d(p_B - p_O)
    
    # Cross product to find the axis of rotation
    axis_of_rotation = rg.Vector3d.CrossProduct(vec_A, vec_B)

    # Dot product to find the cosine of the angle
    cos_angle = rg.Vector3d.Multiply(vec_A, vec_B) / (vec_A.Length * vec_B.Length)
    
    # Ensure the cosine value is within the valid range
    cos_angle = max(min(cos_angle, 1.0), -1.0)
    
    # Calculate the angle in radians
    angle_rad = math.acos(cos_angle)
    
    # Convert the angle to degrees
    angle_deg = math.degrees(angle_rad)
    
    # Check the direction of rotation using the axis of rotation
    if rg.Vector3d.Multiply(axis_of_rotation, rg.Vector3d.ZAxis) < 0:
        #print 'here axis'
        angle_deg = 360 - angle_deg
        
    # Check the direction of rotation using the axis of rotation
    if rg.Vector3d.Multiply(v, rg.Vector3d.ZAxis) < 0:
        #print 'here v'
        angle_deg = 360 - angle_deg
        
    return angle_deg, v


open_connectors_keys = [key for key, frames in assembly.connectors(state='open')]
open_connectors_ranges = []
#print open_connectors_keys
elem_options = []

#############################################################################
## GENERATE CONNECTOR RANGES
#############################################################################

# Generate connector ranges based on input parameters for all open connectors
for key in open_connectors_keys:
    open_connectors_ranges.append([key, generate_connector_range(key)])

#############################################################################
## CASE 1
#############################################################################

if get_joining_options and joining_case == 0:
    
    for i in range(len(open_connectors_ranges)):
        for open_connectors_key in open_connectors_keys:
            intersection = rg.Intersect.Intersection.CurveSurface(line_to_rhino_curve(assembly.element(open_connectors_key).line), open_connectors_ranges[i][1], 0.001, 0.001)
            if intersection:
                for c in intersection:
                    intersections.append(c.PointA)
                connectors_pairs.append((open_connectors_ranges[i][0], open_connectors_key))
    
    print connectors_pairs
    #print len(intersection_curves)
    
    if len(connectors_pairs) != 0:
        if pair_index > len(connectors_pairs) -1:
            ErrorDialog('Selected pair_index is bigger than number of options').display()
        else:
            intersection_point = intersections[pair_index]
            selected_keys_pair = [pkey for pkey in connectors_pairs[pair_index]]
            connectors_pairs_list = [key for pair in connectors_pairs for key in pair]
            
            assembly.selected_keys_pair = [selected_keys_pair[0]]
            #print selected_keys_pair[0]
            assembly.connectors_pairs_list = connectors_pairs_list
            assembly.selected_connectors_ranges_intersection_point = intersection_point
            
            # Convert in COMPAS Point
            cp = point_to_compas(intersection_point)
            
            # Compute angle for option pair
            open_connector_elem_1 = assembly.element(selected_keys_pair[0])
            #print open_connector_elem_1
            cutting_plane_origin_1 = closest_point_on_line(cp, open_connector_elem_1.line) # 
            cutting_plane_1 = Plane(cutting_plane_origin_1, open_connector_elem_1.line.vector)
            plane_pt = Artist(cutting_plane_1.point).draw()#
            plane_v = Artist(cutting_plane_1.normal).draw()#
            line_int = Artist(open_connector_elem_1.current_option_elements(assembly, mirror_unit, unit_size, 0, shift_value)[option_elem_num].line).draw()
            intersection_point_1 = intersection_line_plane(open_connector_elem_1.current_option_elements(assembly, mirror_unit, unit_size, 0, shift_value)[option_elem_num].line, cutting_plane_1)
            
            
            #angles1 = angles_points(cutting_plane_origin_1, intersection_point_1, cp, deg=True)
            #print angles1
            #angles1 = angles_points(cutting_plane_origin_1, cp, intersection_point_1, deg=True)
            #print angles1
            
            p_A = intersection_point
            p_B = point_to_rhino(intersection_point_1)
            p_O = point_to_rhino(cutting_plane_origin_1)
            v = vector_to_rhino(open_connector_elem_1.line.vector)
            #print type(v)
            
            angle1, v = angle_between_points(p_B, p_A, p_O, v)
           # print result_angle
            
            #print 'list deg', angles1
            #angle1 = result_angle # not the smallest angle
            #print 'around', angle1
            
            #if open_connector_elem_1.connector_2_state == True:
                #print "Connector 2"
            #else:
                #print "Connector 1"
            
            
            current_option = assembly.element(selected_keys_pair[0]).current_option_elements(assembly, mirror_unit, unit_size, angle1, shift_value)
            
            rot_line = Artist(assembly.element(selected_keys_pair[0]).line).draw()
            rot_axis = rg.Vector3d(rot_line.From - rot_line.To)
            rot_point = Artist(assembly.element(selected_keys_pair[0]).frame.point).draw()
            elem_line1 = Artist(current_option[option_elem_num].line).draw()
            elem_line2 = Artist(assembly.element(selected_keys_pair[1]).line).draw()
            rot_dir = 1
            step = 0.5
        
            tol_angle = assembly.get_rot_angle(step, rot_axis, rot_point, elem_line1, elem_line2, rot_dir, epsilon)
            #print tol_angle
            angle1 += tol_angle
            #print 'with tol', angle1
            #angle1 = 360-angle1
            
            current_option_rotated = assembly.element(selected_keys_pair[0]).current_option_elements(assembly, mirror_unit, unit_size, angle1, shift_value)
            elem_options += current_option_rotated
            
            if show_new_element:
                #print 'new_elem', selected_keys_pair[1], current_option_rotated[option_elem_num], point1, point2, shift_value_n, epsilon
                new_elem, p1, p2 = assembly.add_third_element(elem, assembly.element(selected_keys_pair[1]), current_option_rotated[option_elem_num], point1, point2, shift_value_n, epsilon)
                elem_options.append(new_elem)
                #print type(new_elem)
                new_elem_mesh = Artist(new_elem.mesh).draw() 
                new_elem_mesh = cylinder_to_rhino(new_elem._source)
            else:
                new_elem = None
        
#        if join_branches:
#            msgs = []
#            
#            # close a reciprocal frame unit with the option elements with the highest score
#            assembly.join_branches(selected_keys_pair, mirror_unit, angle1, shift_value, unit_size, new_elem, option_elem_num, on_ground=False)
#    
#            msgs.append('--- New elements added to key {} ---'.format(selected_keys_pair[0]))
#            
#            for msg in msgs:
#                print(msg)
    else:
        ErrorDialog('No pairs to join').display()
        assembly.selected_keys_pair = []
        assembly.connectors_pairs_list = []
        assembly.selected_connectors_ranges_intersection_point = []




#############################################################################
## CASE 2
#############################################################################

if get_joining_options and joining_case == 1:
    
    
    for i in range(len(open_connectors_ranges)):
        for j in range(i + 1, len(open_connectors_ranges)):
            is_intersecting, intersection, p_array = rg.Intersect.Intersection.SurfaceSurface(open_connectors_ranges[i][1], open_connectors_ranges[j][1], 0.001)
            if len(intersection) > 0:
                #print intersection
                joined_curve = rg.Curve.JoinCurves(intersection)
                connectors_pairs.append((open_connectors_ranges[i][0], open_connectors_ranges[j][0]))
                #print joined_curve
                intersections.append(joined_curve[0])
                
        
    #print 'Following element pair(s) {} could be joined.'.format(connectors_pairs)
    #print intersections
    
    if len(connectors_pairs) != 0:
        if pair_index > len(connectors_pairs) -1:
            ErrorDialog('Selected pair_index is bigger than number of options').display()
        
        else:
            # select intersection point on curve
            curve_param = intersections[pair_index].NormalizedLengthParameter(point_on_intersection)
            intersection_point = intersections[pair_index].PointAt(curve_param[1])
            
            selected_keys_pair = [pkey for pkey in connectors_pairs[pair_index]]
            connectors_pairs_list = [key for pair in connectors_pairs for key in pair]
            #print selected_keys_pair
            
            assembly.selected_keys_pair = selected_keys_pair
            assembly.connectors_pairs_list = connectors_pairs_list
            assembly.selected_connectors_ranges_intersection_point = intersection_point
    
            # Convert to compas point
            cp = point_to_compas(intersection_point)
            
            # Compute angle for first option pair
            open_connector_elem1 = assembly.element(selected_keys_pair[0])
            cutting_plane_origin1 = closest_point_on_line(cp, open_connector_elem1.line)
            cutting_plane1 = Plane(cutting_plane_origin1, open_connector_elem1.line.vector)
            option_elem1 = open_connector_elem1.current_option_elements(assembly, mirror_unit, unit_size, 0, shift_value)[option_elem_num]
            intersection_point1 = intersection_line_plane(option_elem1.line, cutting_plane1)
            
            p_A = intersection_point
            p_B = point_to_rhino(intersection_point1)
            p_O = point_to_rhino(cutting_plane_origin1)
            v = vector_to_rhino(open_connector_elem1.line.vector)
            
            angle1, v = angle_between_points(p_B, p_A, p_O, v)
            
            if open_connector_elem1.connector_2_state == True:
                print "Connector 2"
            else:
                print "Connector 1"
    
            # Compute angle for second option pair
            open_connector_elem2 = assembly.element(selected_keys_pair[1])
            cutting_plane_origin2 = closest_point_on_line(cp, open_connector_elem2.line)
            cutting_plane2 = Plane(cutting_plane_origin2, open_connector_elem2.line.vector)
            option_elem2 = open_connector_elem2.current_option_elements(assembly, mirror_unit, unit_size, 0, shift_value)[option_elem_num]
            intersection_point2 = intersection_line_plane(option_elem2.line, cutting_plane2)
            
            p_A = intersection_point
            p_B = point_to_rhino(intersection_point2)
            p_O = point_to_rhino(cutting_plane_origin2)
            v = vector_to_rhino(open_connector_elem2.line.vector)
            
            angle2, v = angle_between_points(p_B, p_A, p_O, v)
            
            if open_connector_elem2.connector_2_state == True:
                print "Connector 2"
            else:
                print "Connector 1"
            
            current_option_1 = assembly.element(selected_keys_pair[0]).current_option_elements(assembly, mirror_unit, unit_size, angle1, shift_value)
            current_option_2 = assembly.element(selected_keys_pair[1]).current_option_elements(assembly, mirror_unit, unit_size, angle2, shift_value)
    
            # find tolerance angle
            rot_line = Artist(open_connector_elem1.line).draw()
            rot_axis = rg.Vector3d(rot_line.From - rot_line.To)
            rot_point = Artist(assembly.element(selected_keys_pair[0]).frame.point).draw()
            elem_line1 = Artist(current_option_1[option_elem_num].line).draw()
            elem_line2 = Artist(current_option_2[option_elem_num].line).draw()
    
            rot_dir = 1
            step = 1.0
    
            tol_angle = assembly.get_rot_angle(step, rot_axis, rot_point, elem_line1, elem_line2, rot_dir, epsilon)
            print tol_angle
            #tol_angle = 30
            angle1 += tol_angle
            
            option1_rotated = assembly.element(selected_keys_pair[0]).current_option_elements(assembly, mirror_unit, unit_size, angle1, shift_value)
            option2_rotated = assembly.element(selected_keys_pair[1]).current_option_elements(assembly, mirror_unit, unit_size, angle2, shift_value)
            
            elem_options += option1_rotated
            elem_options += option2_rotated
            
            
            if show_new_element:
                new_elem, p1,p2 = assembly.add_third_element(elem, option1_rotated[option_elem_num], option2_rotated[option_elem_num], point1, point2, shift_value_n, epsilon)
                new_elem_mesh = cylinder_to_rhino(new_elem._source)
                elem_options.append(new_elem)
            else:
                new_elem = None
        
#        if join_branches:
#            print selected_keys_pair
#            msgs = []
#            
#            robot_name = 'AA'
#            robot_AA_base_frame = plane_to_compas_frame(assembly.robot_AA_base_plane)
#            robot_AB_base_frame = plane_to_compas_frame(assembly.robot_AB_base_plane)
#            
#            # join the branches for the first key in the pair
#            key_held_by_robot=None
#            stabilising_robot=None
#            assembly.close_rf_unit(selected_keys_pair[0], mirror_unit, unit_size, angle1, shift_value, robot_name, key_held_by_robot, stabilising_robot, robot_AA_base_frame, robot_AB_base_frame, on_ground=False)
#            assembly.open_connectors_keys.remove(selected_keys_pair[0])
#            msgs.append('--- New elements added to key {} ---'.format(selected_keys_pair[0]))
#            
#            # define a new pair for joining as in case 1
#            new_key = assembly.network.number_of_nodes() - 2 - option_elem_num
#            new_keys_pair = [selected_keys_pair[1], new_key]
#        
#            # join the branches for the secon key in the pair
#            assembly.join_branches(new_keys_pair, mirror_unit, angle2, shift_value, unit_size, new_elem, option_elem_num, on_ground=False)
#            msgs.append('--- New elements added to key {} ---'.format(selected_keys_pair[1]))
#            
#            for msg in msgs:
#                print(msg)

if not get_joining_options:
    assembly.selected_keys_pair = []
    assembly.connectors_pairs_list = []
    assembly.selected_connectors_ranges_intersection_point = []


# geometry for visualisation
if show_sel_con_ranges:
    if selected_keys_pair != None:
        if joining_case == 0:
            G_connectors_ranges = generate_connector_range(selected_keys_pair[0])
        elif joining_case == 1:
            for key in selected_keys_pair:
                G_connectors_ranges.append(generate_connector_range(key))
    else:
        G_connectors_ranges.append(generate_connector_range(current_key))
elif show_all_con_ranges:
    G_connectors_ranges = [geo for key, geo in open_connectors_ranges]
else:
    G_connectors_ranges = []

if get_joining_options:
    # options for stability check
    options_geo = []
    for option in elem_options:
        options_geo.append(cylinder_to_rhino(option._source))
    
    assembly.elem_options = elem_options
    
    #viz intersections
    if show_intersections:
        G_intersection = intersections

try: 
    len(assembly.selected_keys_pair)
except:
    ErrorDialog('No pairs to join. Go to Manual mode').display()

join_branch_feedback = []
if joining_case == 0:
    join_branch_feedback.append('CASE 1')
    print '-------------- CASE 1: SINGLE OPTIONS-PAIR -------------'
elif joining_case == 1:
    join_branch_feedback.append('CASE 2')
    print '-------------- CASE 2: TWO OPTIONS-PAIRS ---------------'
print 'Number of key-pairs that can be joined:', len(connectors_pairs)
print 'Selected open connectors key-pair:', assembly.selected_keys_pair
if len(assembly.selected_keys_pair) != 0:
    print 'Open connector key for option:', assembly.selected_keys_pair[0]
print 'Option 1 angle:', angle1
print 'Option 2 angle:', angle2

join_branch_feedback.append('Pairs to join: {}'.format(len(connectors_pairs)))
join_branch_feedback.append('Key-pair i{}: {}'.format(pair_index,selected_keys_pair))
# ---------- end joining_branches_new ----------
geo_4 = Geometry(joining_branches_new.G_intersection)  # disabled
line_4 = Line(joining_branches_new.elem_line2)  # disabled
geo_5 = Geometry(joining_branches_new.new_elem_mesh)  # disabled
tag = TextTag(Location=[joining_branches_new.p1, joining_branches_new.p2], Text=["p1", "p2"])  # disabled
srf = Surface(joining_branches_new.G_connectors_ranges)  # disabled
line_5 = Line(joining_branches_new.elem_line1)  # disabled
line_6 = Line(joining_branches_new.line_int)  # disabled

key_actions = GhPythonScript(
    assembly=settings_parameters.assembly,
    selected_key=settings_parameters.selected_key,
    remove=delete_all_after_key,
    close_connector=close_connector,
    open_connector=open_connector,
    assign=make_a_support)  # -> out, assembly, action_history
# ---------- key_actions: Python ----------
from compas.artists import Artist
from scriptcontext import sticky as st

from compas.geometry import Frame

action_history = []
#remove = False
#open_connectors_keys = assembly.open_connectors_keys

#############################################################################
## Open connector
#############################################################################

def check_connector(sel_connector, neigh_connectors):
    check = True # can be opened, no shared connectors
    for neigh_connector in neigh_connectors:
        if sel_connector.point.ToString() == neigh_connector.point.ToString():
            check = False # cannot be opened, since there a other elements placed at the same point
    return check


#the_key = selected_key
def open_element_connector(the_key):
    
    neighbors_keys = assembly.network.neighborhood(the_key)
    print 'neigh keys', neighbors_keys
    neighbors_keys_closed_connectors = [connector for nkey in neighbors_keys for connector in assembly.element(nkey).connectors(state='closed')]
    print neighbors_keys_closed_connectors
    
    nb_planes = [Artist(conn).draw() for conn in neighbors_keys_closed_connectors]
    con_fr_1 = Artist(assembly.element(the_key).connector_frame_1).draw()
    con_fr_2 = Artist(assembly.element(the_key).connector_frame_2).draw()
    
    open_connectors_keys = assembly.open_connectors_keys
    #selected_element = assembly.element(the_key)
    
    ## check connector 1
    #connector_1 = assembly.element(the_key).connector_frame_1
    if not assembly.element(the_key).connector_1_state:
        if check_connector(assembly.element(the_key).connector_frame_1, neighbors_keys_closed_connectors):
            assembly.element(the_key).connector_1_state = True
            assembly.element(the_key).connector_frame_1 = Frame(assembly.element(the_key).frame.point, assembly.element(the_key).frame.xaxis, assembly.element(the_key).frame.yaxis)
            open_connectors_keys.append(the_key)
            
            action_history = ['Element {}: connector 1 is open now'.format(the_key)]
        else:
            action_history = ['Element {}: connector 1 cannot be opened'.format(the_key)]
    else:
        action_history = ['Element {}: connector 1 is already open'.format(the_key)]
    
    ## check connector 2
    #connector_2 = assembly.element(the_key).connector_frame_2
    if not assembly.element(the_key).connector_2_state:
        if check_connector(assembly.element(the_key).connector_frame_2, neighbors_keys_closed_connectors):
            assembly.element(the_key).connector_2_state = True
            assembly.element(the_key).connector_frame_2 = Frame(assembly.element(the_key).frame.point, assembly.element(the_key).frame.xaxis*-1, assembly.element(the_key).frame.yaxis*-1)
            open_connectors_keys.append(the_key)
            
            action_history.append('Element {}: connector 2 is open now'.format(the_key))
        else:
            action_history.append('Element {}: connector 2 cannot be opened'.format(the_key))
    else:
        action_history.append('Element {}: connector 2 is already open'.format(the_key))
    
    return action_history


if open_connector:
    action_history = open_element_connector(selected_key)


#############################################################################
## Close connector
#############################################################################

if close_connector:
    open_connectors_keys = assembly.open_connectors_keys
    
    if selected_key in open_connectors_keys:
        action_history = 'Connector of the element {} is closed'.format(selected_key)
        print ("closed")
        assembly.element(selected_key).connector_1_state = False
        assembly.element(selected_key).connector_2_state = False
        open_connectors_keys.remove(selected_key)

    else:
        action_history = 'Not possible to close connector of the element {}'.format(selected_key)
        print("Error:TRUE")
        print("Not possible to close this connector.")

#############################################################################
## Define as supporting element
#############################################################################

if assign:
    assembly.network.node_attribute(selected_key, 'is_support', True)
    action_history = 'Element {} is defined as support'.format(selected_key)


#############################################################################
## Delete childs
#############################################################################


if remove:
    
    all_keys = [key for key in assembly.network.nodes()]
    keys_to_delete = all_keys[selected_key+1:]
    keys_to_delete.reverse()
    print keys_to_delete
    
    in_keys = assembly.network.neighbors_in(selected_key)
    n_keys = assembly.network.neighbors(selected_key)
    
    keys_to_open = []
    
    for ikey in keys_to_delete:
        if ikey in n_keys: # if element is a neighbor, hceck if it is the same unit
            for n_in_key in assembly.network.neighbors_in(ikey):
                if n_in_key in in_keys: # if elements have the same neighbor_in they are in the same unit
                    keys_to_delete.remove(ikey)
                elif n_in_key <= selected_key and n_in_key not in keys_to_open:
                    keys_to_open.append(n_in_key)
        else:
            for n_in_key in assembly.network.neighbors_in(ikey):
                if n_in_key <= selected_key and n_in_key not in keys_to_open:
                    keys_to_open.append(n_in_key)
    
    print keys_to_delete
    
    for i_key in keys_to_delete:
        assembly.delete_element(i_key)
    
    action_history = ['Elements {} deleted from assembly'.format(str(keys_to_delete))]
    
    for ikey in keys_to_open:
#        msg = open_element_connector(ikey)
        action_history += open_element_connector(ikey)
    
print assembly.network.number_of_nodes()

#selected_element = assembly.element(selected_key)
##assembly.element(selected_key).connector_frame_1 = Frame(selected_element.frame.point, selected_element.frame.xaxis, selected_element.frame.yaxis)
#plane_check_1 = Artist(assembly.element(selected_key).frame).draw()
#plane_check_2 = Artist(assembly.element(selected_key).connector_frame_1).draw()
# ---------- end key_actions ----------

joining_branches_new_2 = GhPythonScript(
    assembly=key_actions.assembly,
    elem=_1_new_assembly.elem,
    get_joining_options=list_3,
    joining_case=case,
    show_new_element=_3rd_element,
    point_on_intersection=number_slider,
    point1=point1,
    point2=point2,
    current_key=settings_parameters.current_key,
    shift_value=settings_parameters.current_shift_value,
    shift_value_n=shift_value_n,
    mirror_unit=settings_parameters.current_mirror_unit,
    unit_size=settings_parameters.current_unit_size,
    next_pair=next_2,
    previous_pair=previous_2,
    option_elem_num=option_elem_num,
    show_all_con_ranges=all_connectors_ranges,
    show_sel_con_ranges=selected_connectors_ranges,
    show_intersections=intersections,
    direction=direction)  # -> out, assembly, joining_feedback, join_branch_feedback, selected_pair, new_elem_mesh, new_elem, G_intersection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; inputs option_elem_num: Int32
# ---------- joining_branches_new_2: Python ----------
import math
import rhinoscriptsyntax as rs
import Rhino.Geometry as rg
from scriptcontext import sticky as st


from compas.geometry import Point, Vector, Frame, Plane, Vector, Line, Transformation, Rotation, Translation
from compas.geometry import angle_vectors, closest_point_on_line, intersection_line_plane, angles_points
from compas.artists import Artist
from compas_rhino.conversions import line_to_rhino_curve, point_to_compas, point_to_rhino, plane_to_compas_frame, cylinder_to_rhino, vector_to_rhino
from compas.topology import connected_components

import ghpythonlib.components as gh

import Rhino.UI
from cdf_2023.assembly.gui import ErrorDialog

connector_ranges = []
connectors_pairs = []
connectors_pairs_1 = []
connectors_pairs_2 = []

intersections_1 = []
intersections_2 = []

G_intersection = []
G_connectors_ranges = []

#option_elem_num # number of the element in the generated option which is touching other element
#                       # 0 - by robot, 1 - by human

epsilon = 0.001

open_connectors_keys = [key for key, frames in assembly.connectors(state='open')]

robot_AA_base_frame = plane_to_compas_frame(assembly.robot_AA_base_plane)
robot_AB_base_frame = plane_to_compas_frame(assembly.robot_AB_base_plane)

def generate_connector_range(key, option_elem_num):
    elem = assembly.element(key)

    # generate option based on input parameters
    elem_option, new_connector_frame = elem.current_option_elements(assembly, mirror_unit, unit_size, 0, shift_value)
    selected_elem = Artist(elem_option[option_elem_num].line).draw()
    
    rod_length =  assembly.globals['rod_length']
    l1 = math.sqrt(3)*unit_size + shift_value
    # find the point depending on the open connector
    if elem.connector_1_state == True:
        n = 0.0
        l1 = rod_length - l1 - 0.05
    if elem.connector_2_state == True:
        n = 1.0
        l1 = l1 + 0.05
    
    start_pt = rg.Line.PointAt(selected_elem, n)
    end_pt = rg.Line.PointAtLength(selected_elem, l1)
    
    # create connector range based on line
    section_line = rg.Line(start_pt, end_pt)
    rot_axis = Artist(assembly.element(key).line).draw()
    connector_range = rg.RevSurface.Create(section_line, rot_axis)
    
    return connector_range

def angle_between_points(p_A, p_B, p_O, v):
    # Vector from point O to point A
    vec_A = rg.Vector3d(p_A - p_O)
    
    # Vector from point O to point B
    vec_B = rg.Vector3d(p_B - p_O)
    
    # Cross product to find the axis of rotation
    axis_of_rotation = rg.Vector3d.CrossProduct(vec_A, vec_B)

    # Dot product to find the cosine of the angle
    cos_angle = rg.Vector3d.Multiply(vec_A, vec_B) / (vec_A.Length * vec_B.Length)
    
    # Ensure the cosine value is within the valid range
    cos_angle = max(min(cos_angle, 1.0), -1.0)
    
    # Calculate the angle in radians
    angle_rad = math.acos(cos_angle)
    
    # Convert the angle to degrees
    angle_deg = math.degrees(angle_rad)
    
    # Check the direction of rotation using the axis of rotation
    if rg.Vector3d.Multiply(axis_of_rotation, rg.Vector3d.ZAxis) < 0:
        #print 'here axis'
        angle_deg = 360 - angle_deg
        
    # Check the direction of rotation using the axis of rotation
    if rg.Vector3d.Multiply(v, rg.Vector3d.ZAxis) < 0:
        #print 'here v'
        angle_deg = 360 - angle_deg
        
    return angle_deg, v


open_connectors_keys = [key for key, frames in assembly.connectors(state='open')]
open_connectors_ranges = []
print current_key
print open_connectors_keys
elem_options = []



#############################################################################
## GENERATE CONNECTOR RANGES
#############################################################################

# Generate connector ranges based on input parameters for all open connectors
for key in open_connectors_keys:
    open_connectors_ranges.append([key, generate_connector_range(key, option_elem_num)])
    
#############################################################################
# find all the possible connections for current_key
#############################################################################
joining_feedback =  []

## CASE 1
selected_range = generate_connector_range(current_key, option_elem_num)
for key in open_connectors_keys:
    intersection = rg.Intersect.Intersection.CurveSurface(line_to_rhino_curve(assembly.element(key).line), selected_range, 0.001, 0.001)
    #print intersection
    if intersection:
        for c in intersection:
            intersections_1.append(c.PointA)
        connectors_pairs_1.append((current_key, key))

joining_feedback.append('(1) ONE pair: {}'.format(connectors_pairs_1))

## CASE 2

for i in range(len(open_connectors_ranges)):
    is_intersecting, intersection, p_array = rg.Intersect.Intersection.SurfaceSurface(selected_range, open_connectors_ranges[i][1], 0.001)
    if len(intersection) > 0:
        #print intersection
        joined_curve = rg.Curve.JoinCurves(intersection)
        connectors_pairs_2.append((current_key, open_connectors_ranges[i][0]))
        #print joined_curve
        intersections_2.append(joined_curve[0])
        

joining_feedback.append('(2) TWO pairs: {}'.format(connectors_pairs_2))

#############################################################################
## Select the pair
#############################################################################
if joining_case == 0:
    connectors_pairs = connectors_pairs_1
    intersections = intersections_1
else:
    connectors_pairs = connectors_pairs_2
    intersections = intersections_2

pair_index = 0
if next_pair and st[pair_index] < len(connectors_pairs)-1:
    st[pair_index] += 1
if previous_pair and st[pair_index] <= len(connectors_pairs)-1:
    st[pair_index] -= 1
    if st[pair_index] < 1:
        st[pair_index] = 0

if pair_index not in st or None:
    st[pair_index] = 0

try:
    selected_pair = str(connectors_pairs[st[pair_index]])
except:
    st[pair_index] = 0
    try:
        selected_pair = str(connectors_pairs[st[pair_index]])
    except:
        selected_pair = "None"

#selected_keys_pair = connectors_pairs[st[pair_index]]

#############################################################################
## CASE 1
#############################################################################

if get_joining_options and joining_case == 0:
    
    if len(connectors_pairs) != 0:

        intersection_point = intersections[st[pair_index]]
        selected_keys_pair = [pkey for pkey in connectors_pairs[st[pair_index]]]
        #connectors_pairs_list = [key for pair in connectors_pairs for key in pair]
        
        assembly.selected_keys_pair = [selected_keys_pair[0]]
        #print selected_keys_pair[0]
        #assembly.connectors_pairs_list = connectors_pairs_list
        assembly.selected_connectors_ranges_intersection_point = intersection_point
        
        # Convert in COMPAS Point
        cp = point_to_compas(intersection_point)
        
        # Compute angle for option pair
        open_connector_elem_1 = assembly.element(selected_keys_pair[0])
        #print open_connector_elem_1
        cutting_plane_origin_1 = closest_point_on_line(cp, open_connector_elem_1.line) #
        cutting_plane_1 = Plane(cutting_plane_origin_1, open_connector_elem_1.line.vector)
        
        elem_option, new_connector_frame = open_connector_elem_1.current_option_elements(assembly, mirror_unit, unit_size, 0, shift_value)
        line_int = Artist(elem_option[option_elem_num].line).draw()
        intersection_point_1 = intersection_line_plane(elem_option[option_elem_num].line, cutting_plane_1)
        
        
        p_A = intersection_point
        p_B = point_to_rhino(intersection_point_1)
        p_O = point_to_rhino(cutting_plane_origin_1)
        v = vector_to_rhino(open_connector_elem_1.line.vector)
        
        angle1, v = angle_between_points(p_B, p_A, p_O, v)
        
        current_option, new_connector_frame = assembly.element(selected_keys_pair[0]).current_option_elements(assembly, mirror_unit, unit_size, angle1, shift_value)
        
        rot_line = Artist(assembly.element(selected_keys_pair[0]).line).draw()
        rot_axis = rg.Vector3d(rot_line.From - rot_line.To)
        rot_point = Artist(assembly.element(selected_keys_pair[0]).frame.point).draw()
        elem_line1 = Artist(current_option[option_elem_num].line).draw()
        elem_line2 = Artist(assembly.element(selected_keys_pair[1]).line).draw()

        rot_dir = direction
        step = 0.5
    
        tol_angle = assembly.get_rot_angle(step, rot_axis, rot_point, elem_line1, elem_line2, rot_dir, epsilon)
        #print tol_angle
        angle1 += tol_angle
        #print 'with tol', angle1
        #angle1 = 360-angle1
        
        current_option_rotated, new_connector_frame  = assembly.element(selected_keys_pair[0]).current_option_elements(assembly, mirror_unit, unit_size, angle1, shift_value)
        elem_options += current_option_rotated
        
        if show_new_element:
            #print 'new_elem', selected_keys_pair[1], current_option_rotated[option_elem_num], point1, point2, shift_value_n, epsilon
            new_elem, p1, p2 = assembly.add_third_element(elem, assembly.element(selected_keys_pair[1]), current_option_rotated[option_elem_num], point1, point2, shift_value_n, epsilon)
            elem_options.append(new_elem)
            #print type(new_elem)
            new_elem_mesh = Artist(new_elem.mesh).draw() 
            new_elem_mesh = cylinder_to_rhino(new_elem._source)
        else:
            new_elem = None
    
    else:
        ErrorDialog('No pairs to join').display()
        assembly.selected_keys_pair = []
        #assembly.connectors_pairs_list = []
        assembly.selected_connectors_ranges_intersection_point = []



#############################################################################
## CASE 2
#############################################################################

if get_joining_options and joining_case == 1:
    
    
    if len(connectors_pairs) != 0:
        # select intersection point on curve
        curve_param = intersections[st[pair_index]].NormalizedLengthParameter(point_on_intersection)
        intersection_point = intersections[st[pair_index]].PointAt(curve_param[1])
        
        selected_keys_pair = [pkey for pkey in connectors_pairs[st[pair_index]]]
        #connectors_pairs_list = [key for pair in connectors_pairs for key in pair]
        #print selected_keys_pair
        
        assembly.selected_keys_pair = selected_keys_pair
        #assembly.connectors_pairs_list = connectors_pairs_list
        assembly.selected_connectors_ranges_intersection_point = intersection_point

        # Convert to compas point
        cp = point_to_compas(intersection_point)
        
        # Compute angle for first option pair
        open_connector_elem1 = assembly.element(selected_keys_pair[0])
        cutting_plane_origin1 = closest_point_on_line(cp, open_connector_elem1.line)
        cutting_plane1 = Plane(cutting_plane_origin1, open_connector_elem1.line.vector)
        option_elem_1, new_connector_frame_1 = open_connector_elem1.current_option_elements(assembly, mirror_unit, unit_size, 0, shift_value)
        
        selected_elem_1 = option_elem_1[option_elem_num]
        intersection_point1 = intersection_line_plane(selected_elem_1.line, cutting_plane1)
        
        p_A = intersection_point
        p_B = point_to_rhino(intersection_point1)
        p_O = point_to_rhino(cutting_plane_origin1)
        v = vector_to_rhino(open_connector_elem1.line.vector)
        
        angle1, v = angle_between_points(p_B, p_A, p_O, v)
        
        if open_connector_elem1.connector_2_state == True:
            print "Connector 2"
        else:
            print "Connector 1"

        # Compute angle for second option pair
        open_connector_elem_2 = assembly.element(selected_keys_pair[1])
        cutting_plane_origin_2 = closest_point_on_line(cp, open_connector_elem_2.line)
        cutting_plane_2 = Plane(cutting_plane_origin_2, open_connector_elem_2.line.vector)
        option_elem_2, new_connector_frame_2 = open_connector_elem_2.current_option_elements(assembly, mirror_unit, unit_size, 0, shift_value)
        
        selected_elem_2 = option_elem_2[option_elem_num]
        intersection_point_2 = intersection_line_plane(selected_elem_2.line, cutting_plane_2)
        
        p_A = intersection_point
        p_B = point_to_rhino(intersection_point_2)
        p_O = point_to_rhino(cutting_plane_origin_2)
        v = vector_to_rhino(open_connector_elem_2.line.vector)
        
        angle2, v = angle_between_points(p_B, p_A, p_O, v)
        
        if open_connector_elem_2.connector_2_state == True:
            print "Connector 2"
        else:
            print "Connector 1"
        
        current_option_1, new_connector_frame_1 = assembly.element(selected_keys_pair[0]).current_option_elements(assembly, mirror_unit, unit_size, angle1, shift_value)
        current_option_2, new_connector_frame_2 = assembly.element(selected_keys_pair[1]).current_option_elements(assembly, mirror_unit, unit_size, angle2, shift_value)

        # find tolerance angle
        rot_line = Artist(open_connector_elem1.line).draw()
        rot_axis = rg.Vector3d(rot_line.From - rot_line.To)
        rot_point = Artist(assembly.element(selected_keys_pair[0]).frame.point).draw()
        elem_line1 = Artist(current_option_1[option_elem_num].line).draw()
        elem_line2 = Artist(current_option_2[option_elem_num].line).draw()

        rot_dir = direction
        step = 1.0

        tol_angle = assembly.get_rot_angle(step, rot_axis, rot_point, elem_line1, elem_line2, rot_dir, epsilon)
        print tol_angle
        #tol_angle = 30
        angle1 += tol_angle
        
        option1_rotated, new_connector_frame_1 = assembly.element(selected_keys_pair[0]).current_option_elements(assembly, mirror_unit, unit_size, angle1, shift_value)
        option2_rotated, new_connector_frame_2 = assembly.element(selected_keys_pair[1]).current_option_elements(assembly, mirror_unit, unit_size, angle2, shift_value)
        
        elem_options += option1_rotated
        elem_options += option2_rotated
        
        
        if show_new_element:
            new_elem, p1,p2 = assembly.add_third_element(elem, option1_rotated[option_elem_num], option2_rotated[option_elem_num], point1, point2, shift_value_n, epsilon)
            new_elem_mesh = cylinder_to_rhino(new_elem._source)
            elem_options.append(new_elem)
        else:
            new_elem = None

if not get_joining_options:
    assembly.selected_keys_pair = []
    #assembly.connectors_pairs_list = []
    assembly.selected_connectors_ranges_intersection_point = []


# geometry for visualisation
if show_sel_con_ranges:
    if selected_keys_pair != None:
        if joining_case == 0:
            G_connectors_ranges = generate_connector_range(selected_keys_pair[0], option_elem_num)
        elif joining_case == 1:
            for key in selected_keys_pair:
                G_connectors_ranges.append(generate_connector_range(key, option_elem_num))
    else:
        G_connectors_ranges.append(generate_connector_range(current_key, option_elem_num))
elif show_all_con_ranges:
    G_connectors_ranges = [geo for key, geo in open_connectors_ranges]
else:
    G_connectors_ranges = []

if get_joining_options:
    # options for stability check
    options_geo = []
    for option in elem_options:
        options_geo.append(cylinder_to_rhino(option._source))
    
    assembly.elem_options = elem_options
    
    #viz intersections
    if show_intersections:
        G_intersection = intersections

try: 
    len(assembly.selected_keys_pair)
except:
    ErrorDialog('No pairs to join. Go to Manual mode').display()

join_branch_feedback = []
if joining_case == 0:
    join_branch_feedback.append('CASE 1')
    print '-------------- CASE 1: SINGLE OPTIONS-PAIR -------------'
elif joining_case == 1:
    join_branch_feedback.append('CASE 2')
    print '-------------- CASE 2: TWO OPTIONS-PAIRS ---------------'
print 'Number of key-pairs that can be joined:', len(connectors_pairs)
print 'Selected open connectors key-pair:', assembly.selected_keys_pair
if len(assembly.selected_keys_pair) != 0:
    print 'Open connector key for option:', assembly.selected_keys_pair[0]
print 'Option 1 angle:', angle1
print 'Option 2 angle:', angle2

join_branch_feedback.append('Pairs to join: {}'.format(len(connectors_pairs)))
join_branch_feedback.append('Key-pair i{}: {}'.format(pair_index,selected_keys_pair))
# ---------- end joining_branches_new_2 ----------
geo_6 = Geometry(joining_branches_new_2.new_elem_mesh)
geo_7 = Geometry(joining_branches_new_2.G_intersection)
srf_2 = Surface(joining_branches_new_2.G_connectors_ranges)
pt_7 = Point(joining_branches_new_2.intersection_point)
tag_2 = TextTag(Location=[joining_branches_new_2.p1, joining_branches_new_2.p2], Text=["p1", "p2"])

selected_pair = Panel(joining_branches_new_2.selected_pair)

possible_joining_options_for_selected_ke = Panel(joining_branches_new_2.joining_feedback)  # "Possible joining options for selected key"
preview_3 = CustomPreview(Geometry=geo_6, Material=ColourSwatch(SwatchColor=RGBA(255, 85, 0, 120)))

# ----
# 2.2 Check constraints
stability_viz = GhPythonScript(
    assembly=joining_branches_new_2.assembly,
    current_key=settings_parameters.current_key,
    selected_mode=settings_parameters.selected_mode,
    la_limit=la_limit,
    show_resultant=stability_feedback,
    selected_keys_pair=joining_branches_new_2.selected_keys_pair)  # -> out, stability_feedback, resultant, resultant_colors, sp_branches, sp_planar_branches, resultant_pt, la_text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; inputs current_key: Int32, selected_keys_pair: list
# ---------- stability_viz: Python ----------
from compas.topology import connected_components
import Rhino.Geometry as rg

import copy

#############################################################################
## LOCAL EQUILIBRIUM CHECK
#############################################################################

lever_arm_branches = []
resultant_branches = []
resultant = []
print current_key

elem_options = assembly.elem_options

if assembly.stability_check == 'local':
    
    if selected_mode == '(1) Manual' or selected_mode == '(2) Automatic':
        # Identify the connected elements (branches) in the assembly.
        branches = connected_components(assembly.network.adjacency)
        sel_key = current_key
    
    if selected_mode == '(3) Join branches':
        #selected_keys_pair = assembly.selected_keys_pair
        print selected_keys_pair
        if selected_keys_pair != [None]:
        # Identify the connected elements (branches) in the assembly.
            adj = copy.deepcopy(assembly.network.adjacency)
            adj[selected_keys_pair[0]].update({selected_keys_pair[1]: None})
            adj[selected_keys_pair[1]].update({selected_keys_pair[0]: None})
            
            branches = connected_components(adj)
            sel_key = selected_keys_pair[0]
        else:
            branches = connected_components(assembly.network.adjacency)
            sel_key = current_key
    
    print(branches)
    
    stability_feedback = []
    
    # calculate stability for all branches

    lever_arm_branches, resultant_branches, sp_branches, sp_planar_branches, stability_feedback, key_held_by_robot, stabilising_robot  = assembly.calculate_local_equilibrium_in_all_branches(sel_key, elem_options, la_limit, branches)

    print key_held_by_robot, stabilising_robot
else:
    stability_feedback = "No stability criteria selected."
    
#print lever_arm_branches
#print resultant_branches
print sp_planar_branches
resultant_pt = []
resultant_colors = []
print current_key

if show_resultant:
    
    la_text = []
    for resultant_line, lever_arm in zip(resultant_branches, lever_arm_branches):
        cone_base_plane = rg.Plane(resultant_line.PointAt(0), rg.Vector3d.ZAxis*-1)
        #cone_base_plane.Translate(rg.Vector3d.ZAxis*0.136)
        if lever_arm != 0:
            resultant.append(rg.Circle(cone_base_plane,lever_arm))
            la_text.append('la= {len:.3f}m'.format(len=float(lever_arm)))
        else:
            resultant.append(rg.Circle(cone_base_plane,0.01))
            la_text.append('')
        
        resultant_pt.append(cone_base_plane)
        
        if lever_arm > la_limit:
            resultant_colors.append('255,13,0 (103)')
        else:
            resultant_colors.append('70,128,0 (103)')
# ---------- end stability_viz ----------
srf_3 = Surface(stability_viz.resultant)
pt_8 = Point(stability_viz.resultant_pt)
preview_4 = CustomPreview(Geometry=srf_3, Material=stability_viz.resultant_colors)
preview_5 = CustomPreview(Geometry=stability_viz.sp_planar_branches, Material=stability_viz.resultant_colors)
dots = DotDisplay(Point=stability_viz.sp_branches, Colour=ColourSwatch(SwatchColor=RGB(0, 0, 255)), Size=0.03)
dots_2 = DotDisplay(Point=pt_8, Colour=stability_viz.resultant_colors, Size=0.01)
tag_3 = TextTag(Location=stability_viz.resultant_pt, Text=stability_viz.la_text, Colour=RGB(84, 84, 84))

# ----
# Feedback
joining_mode = Panel(joining_branches_new_2.out)
stability_feedback_2 = Panel(stability_viz.stability_feedback)
target_geometry = Panel(settings_parameters.target_geo_feedback)
stab_robot = Panel(stability_viz.stabilising_robot)
key_to_stab = Panel(stability_viz.key_held_by_robot)

grow_assembly = GhPythonScript(
    assembly=joining_branches_new_2.assembly,
    selected_mode=settings_parameters.selected_mode,
    key=settings_parameters.current_key,
    angle=settings_parameters.current_angle,
    angle1=joining_branches_new_2.angle1,
    angle2=joining_branches_new_2.angle2,
    shift_value=settings_parameters.current_shift_value,
    mirror_unit=settings_parameters.current_mirror_unit,
    unit_size=settings_parameters.current_unit_size,
    key_held_by_robot=stability_viz.key_held_by_robot,
    stabilising_robot=stability_viz.stabilising_robot,
    add=add,
    joining_case=case,
    selected_keys_pair=joining_branches_new_2.selected_keys_pair,
    new_elem=joining_branches_new_2.new_elem,
    option_elem_num=joining_branches_new_2.option_elem_num)  # -> out, test, action_history, assembly; inputs mirror_unit: Boolean, selected_keys_pair: list
# ---------- grow_assembly: Python ----------
from compas_rhino.conversions import plane_to_compas_frame

import Rhino.UI
from cdf_2023.assembly.gui import ErrorDialog


robot_AA_base_frame = plane_to_compas_frame(assembly.robot_AA_base_plane)
robot_AB_base_frame = plane_to_compas_frame(assembly.robot_AB_base_plane)
#print robot_AA_base_frame

action_history = []

#############################################################################
## ADD ELEMENTS TO ASSEMBLY BY SELECTED  KEY, ANGLE AND SHIFT_VALUE
#############################################################################

robot_name = assembly.get_free_robot_name()

if add and (selected_mode == "(1) Manual" or selected_mode == "(2) Automatic"):
    #msgs = []
    
    if not is_colliding:
        print 'before', list(assembly.network.nodes())
        # close a reciprocal frame unit with the option elements with the highest score
        assembly.close_rf_unit(key, mirror_unit, unit_size, angle, shift_value, robot_name, key_held_by_robot, stabilising_robot, robot_AA_base_frame, robot_AB_base_frame, on_ground=False)
        print 'after',list(assembly.network.nodes())
        assembly.open_connectors_keys.remove(key)
        
        action_history = '--- New elements added to key {} ---'.format(key)
        #msgs.append('--- New elements added to key {} ---'.format(key))
    else:
        ErrorDialog('Elements are colliding, not possible to add elements').display()
        #msgs.append('--- Elements are colliding, not possible to add elements ---')
        action_history = '--- Elements are colliding, not possible to add elements ---'
        
    #for msg in msgs:
        #print(msg)

print list(assembly.network.nodes())
print list(assembly.network.edges())

#############################################################################
## JOIN BRANCHES
#############################################################################

if add and selected_mode == "(3) Join branches":

## CASE 1
    if joining_case == 0:
        msgs = []
        if not is_colliding:
            # close a reciprocal frame unit with the option elements with the highest score
            assembly.join_branches(selected_keys_pair, mirror_unit, angle1, shift_value, unit_size, new_elem, option_elem_num, robot_name, key_held_by_robot, stabilising_robot, on_ground=False)
            assembly.open_connectors_keys.remove(key for key in selected_keys_pair)
            action_history = '--- New elements added to key {} ---'.format(selected_keys_pair[0])
            #msgs.append('--- New elements added to key {} ---'.format(selected_keys_pair[0]))
        
        else:
            ErrorDialog('Elements are colliding, not possible to add elements').display()
            action_history = '--- Elements are colliding, not possible to add elements ---'
            #msgs.append('--- Elements are colliding, not possible to add elements ---')
        
        #for msg in msgs:
            #print(msg)

## CASE 2
    if joining_case == 1:
        #print selected_keys_pair
        msgs = []
        
        robot_AA_base_frame = plane_to_compas_frame(assembly.robot_AA_base_plane)
        robot_AB_base_frame = plane_to_compas_frame(assembly.robot_AB_base_plane)
        
        if not is_colliding:
            # join the branches for the first key in the pair
            assembly.close_rf_unit(selected_keys_pair[0], mirror_unit, unit_size, angle1, shift_value, robot_name, key_held_by_robot, stabilising_robot, robot_AA_base_frame, robot_AB_base_frame, on_ground=False)
            assembly.open_connectors_keys.remove(selected_keys_pair[0])
            action_history = '--- New elements added to key {} ---'.format(selected_keys_pair[0])
            #msgs.append('--- New elements added to key {} ---'.format(selected_keys_pair[0]))
            
            
            # define a new pair for joining as in case 1
            new_key = assembly.network.number_of_nodes() - 2 - option_elem_num
            new_keys_pair = [selected_keys_pair[1], new_key]
        
            # join the branches for the secon key in the pair
            assembly.join_branches(new_keys_pair, mirror_unit, angle2, shift_value, unit_size, new_elem, option_elem_num, robot_name, key_held_by_robot, stabilising_robot, on_ground=False)
            
            action_history.append('--- New elements added to key {} ---'.format(selected_keys_pair[1]))
            #msgs.append('--- New elements added to key {} ---'.format(selected_keys_pair[1]))
        else:
            ErrorDialog('Elements are colliding, not possible to add elements').display()
            action_history = '--- Elements are colliding, not possible to add elements ---'
            #msgs.append('--- Elements are colliding, not possible to add elements ---')
        
        #for msg in msgs:
            #print(msg)
# ---------- end grow_assembly ----------

# ----
# Story of added Elements
# Orange round button
# -> recording in process
# Press X to clean
rec = DataRecorder([key_actions.action_history, grow_assembly.action_history], DataLimit=-10, RecordData=True)
messages = Panel(rec)

attrib = GhPythonScript(assembly=grow_assembly.assembly)  # -> out
# ---------- attrib: Python ----------
"""status_robot_AA = 'FREE'
status_robot_AB = 'FREE'

N = assembly.network.number_of_nodes()
r_stabilizing = assembly.network.node_attribute(N-1, 'stabilizing_robot')
print r_stabilizing
#r_stabilizing = assembly.network.node_attribute(N-1, 'placed_by')

if r_stabilizing == 'AA':
    status_robot_AA = 'Stab.'
if r_stabilizing == 'AB':
    status_robot_AB = 'Stab.'"""
    
#print status_robot_AA, status_robot_AB

for key, element in assembly.elements():
    print key
    print assembly.network.node_attribute(key, 'placed_by'), assembly.network.node_attribute(key, 'robot_name'),assembly.network.node_attribute(key, 'stabilizing_robot'),assembly.network.node_attribute(key, 'key_held_by_robot')
# ---------- end attrib ----------
panel_20 = Panel(attrib)
key_actions_2 = GhPythonScript(
    assembly=settings_parameters.assembly,
    selected_key=settings_parameters.selected_key,
    remove=delete_all_after_key,
    close_connector=close_connector,
    open_connector=open_connector,
    assign=make_a_support)  # -> out, assembly, action_history, plane_check_2, plane_check_1; disabled
# ---------- key_actions_2: Python ----------
from compas.artists import Artist
from scriptcontext import sticky as st

from compas.geometry import Frame

action_history = []

open_connectors_keys = assembly.open_connectors_keys

#############################################################################
## Open connector
#############################################################################

def check_connector(sel_connector, neigh_connectors):
    check = True
    for neigh_connector in neigh_connectors:
        if sel_connector.point == neigh_connector.point:
            check = False
    return check

def open_element_connector(the_key):
    neighbors_keys = assembly.network.neighbors(the_key)
    neighbors_keys_closed_connectors = [connector for nkey in neighbors_keys for connector in assembly.element(nkey).connectors(state='closed')]
    
    open_connectors_keys = assembly.open_connectors_keys
    #selected_element = assembly.element(the_key)
    
    ## check connector 1
    connector_1 = assembly.element(the_key).connector_frame_1
    if not assembly.element(the_key).connector_1_state:
        if check_connector(connector_1, neighbors_keys_closed_connectors):
            assembly.element(the_key).connector_1_state = True
            assembly.element(the_key).connector_frame_1 = Frame(assembly.element(the_key).frame.point, assembly.element(the_key).frame.xaxis, assembly.element(the_key).frame.yaxis)
            open_connectors_keys.append(the_key)
            
            action_history = ['Element {}: connector 1 is open now'.format(the_key)]
        else:
            action_history = ['Element {}: connector 1 cannot be opened'.format(the_key)]
    else:
        action_history = ['Element {}: connector 1 is already open'.format(the_key)]
    
    ## check connector 2
    connector_2 = assembly.element(the_key).connector_frame_2
    if not assembly.element(the_key).connector_2_state:
        if check_connector(connector_2, neighbors_keys_closed_connectors):
            assembly.element(the_key).connector_2_state = True
            assembly.element(the_key).connector_frame_2 = Frame(assembly.element(the_key).frame.point, assembly.element(the_key).frame.xaxis*-1, assembly.element(the_key).frame.yaxis*-1)
            open_connectors_keys.append(the_key)
            action_history.append('Element {}: connector 2 is open now'.format(the_key))
        else:
            action_history.append('Element {}: connector 2 cannot be opened'.format(the_key))
    else:
        action_history.append('Element {}: connector 2 is already open'.format(the_key))
    
    return action_history


if open_connector:
    action_history = open_element_connector(selected_key)


#############################################################################
## Close connector
#############################################################################

if close_connector:
    open_connectors_keys = assembly.open_connectors_keys
    
    if selected_key in open_connectors_keys:
        action_history = 'Connector of the element {} is closed'.format(selected_key)
        print ("closed")
        assembly.element(selected_key).connector_1_state = False
        assembly.element(selected_key).connector_2_state = False
        open_connectors_keys.remove(selected_key)

    else:
        action_history = 'Not possible to close connector of the element {}'.format(selected_key)
        print("Error:TRUE")
        print("Not possible to close this connector.")

#############################################################################
## Define as supporting element
#############################################################################

if assign:
    assembly.network.node_attribute(selected_key, 'is_support', True)
    action_history = 'Element {} is defined as support'.format(selected_key)


#############################################################################
## Delete childs
#############################################################################

all_keys = [key for key in assembly.network.nodes()]
keys_to_delete = all_keys[selected_key+1:]
keys_to_delete.reverse()
print keys_to_delete

#print 'nn', assembly.network.degree_out(selected_key+1)

#for i_key in keys_to_delete:
    


if remove:
    for i_key in keys_to_delete:
        assembly.delete_element(i_key)
    
    action_history = ['Elements {} deleted from assembly'.format(str(keys_to_delete))]
    
    msg = open_element_connector(selected_key)
    print selected_key
    print msg
    action_history += msg
    
print assembly.network.number_of_nodes()

selected_element = assembly.element(selected_key)
#assembly.element(selected_key).connector_frame_1 = Frame(selected_element.frame.point, selected_element.frame.xaxis, selected_element.frame.yaxis)
plane_check_1 = Artist(assembly.element(selected_key).frame).draw()
plane_check_2 = Artist(assembly.element(selected_key).connector_frame_1).draw()
# ---------- end key_actions_2 ----------

# ---- group: Rotation angle Visualised
pt_9 = GhPythonScript(p=joining_branches_new_2.cutting_plane_origin_1)  # -> out, pt; inputs p: list; disabled
# ---------- pt_9: Python ----------
__author__ = "lovek"
__version__ = "2024.01.09"

import rhinoscriptsyntax as rs
print str('{'+'{},{},{}'.format(p[0],p[1],p[2])+'}')
# ---------- end pt_9 ----------
pt_10 = GhPythonScript()  # -> out, pt; inputs p: list; disabled; same code as pt_9
swatch = ColourSwatch(SwatchColor=RGB(94, 130, 3))  # disabled
a = Point(pt_9.out)  # disabled
c = Point(joining_branches_new_2.intersection_point)  # disabled
b = Point(pt_10.out)  # disabled
pline = PolyLine(Vertices=flatten([c, a, b]), Closed=False)  # disabled
preview_6 = CustomPreview(Geometry=b, Material=swatch)  # disabled
vec2pt = Vector2Pt(PointA=a, PointB=b, Unitize=False)  # -> Vector, Length; disabled
vec2pt_2 = Vector2Pt(PointA=a, PointB=c, Unitize=False)  # -> Vector, Length; disabled
pl_3pt = Plane3Pt(PointA=a, PointB=b, PointC=c)  # disabled
angle_2 = Angle(VectorA=vec2pt.Vector, VectorB=vec2pt_2.Vector)  # -> Angle, Reflex; disabled
vdis_2 = VectorDisplay(Anchor=a)  # disabled
deg = Degrees(Radians=angle_2.Angle)  # disabled
deg_2 = Degrees(Radians=angle_2.Reflex)  # disabled
panel_21 = Panel(deg_2)  # disabled
panel_22 = Panel(deg)  # disabled

# ----
key_actions_3 = GhPythonScript(assembly=settings_parameters.assembly, selected_key=settings_parameters.selected_key, remove=delete_all_after_key)  # -> out, assembly, action_history, plane_check_2, plane_check_1, nb_planes, con_fr_1, con_fr_2; disabled
# ---------- key_actions_3: Python ----------
from compas.artists import Artist
from scriptcontext import sticky as st

from compas.geometry import Frame

action_history = []

open_connectors_keys = assembly.open_connectors_keys

#############################################################################
## Open connector
#############################################################################

def check_connector(sel_connector, neigh_connectors):
    check = True # can be opened, no shared connectors
    for neigh_connector in neigh_connectors:
        if sel_connector.point == neigh_connector.point:
            check = False # cannot be opened, since there a other elements placed at the same point
    return check


#the_key = selected_key
def open_element_connector(the_key):
    
    neighbors_keys = assembly.network.neighbors(the_key)
    print 'neigh keys', neighbors_keys
    neighbors_keys_closed_connectors = [connector for nkey in neighbors_keys for connector in assembly.element(nkey).connectors(state='closed')]
    print neighbors_keys_closed_connectors
    
    nb_planes = [Artist(conn).draw() for conn in neighbors_keys_closed_connectors]
    con_fr_1 = Artist(assembly.element(the_key).connector_frame_1).draw()
    con_fr_2 = Artist(assembly.element(the_key).connector_frame_2).draw()
    
    open_connectors_keys = assembly.open_connectors_keys
    #selected_element = assembly.element(the_key)
    
    ## check connector 1
    #connector_1 = assembly.element(the_key).connector_frame_1
    if not assembly.element(the_key).connector_1_state:
        if check_connector(assembly.element(the_key).connector_frame_1, neighbors_keys_closed_connectors):
            assembly.element(the_key).connector_1_state = True
            assembly.element(the_key).connector_frame_1 = Frame(assembly.element(the_key).frame.point, assembly.element(the_key).frame.xaxis, assembly.element(the_key).frame.yaxis)
            open_connectors_keys.append(the_key)
            
            action_history = ['Element {}: connector 1 is open now'.format(the_key)]
        else:
            action_history = ['Element {}: connector 1 cannot be opened'.format(the_key)]
    else:
        action_history = ['Element {}: connector 1 is already open'.format(the_key)]
    
    ## check connector 2
    #connector_2 = assembly.element(the_key).connector_frame_2
    if not assembly.element(the_key).connector_2_state:
        if check_connector(assembly.element(the_key).connector_frame_2, neighbors_keys_closed_connectors):
            assembly.element(the_key).connector_2_state = True
            assembly.element(the_key).connector_frame_2 = Frame(assembly.element(the_key).frame.point, assembly.element(the_key).frame.xaxis*-1, assembly.element(the_key).frame.yaxis*-1)
            open_connectors_keys.append(the_key)
            
            action_history.append('Element {}: connector 2 is open now'.format(the_key))
        else:
            action_history.append('Element {}: connector 2 cannot be opened'.format(the_key))
    else:
        action_history.append('Element {}: connector 2 is already open'.format(the_key))
    
    return action_history


#if open_connector:
    #action_history = open_element_connector(selected_key)


#############################################################################
## Close connector
#############################################################################

if close_connector:
    open_connectors_keys = assembly.open_connectors_keys
    
    if selected_key in open_connectors_keys:
        action_history = 'Connector of the element {} is closed'.format(selected_key)
        print ("closed")
        assembly.element(selected_key).connector_1_state = False
        assembly.element(selected_key).connector_2_state = False
        open_connectors_keys.remove(selected_key)

    else:
        action_history = 'Not possible to close connector of the element {}'.format(selected_key)
        print("Error:TRUE")
        print("Not possible to close this connector.")

#############################################################################
## Define as supporting element
#############################################################################

if assign:
    assembly.network.node_attribute(selected_key, 'is_support', True)
    action_history = 'Element {} is defined as support'.format(selected_key)


#############################################################################
## Delete childs
#############################################################################

all_keys = [key for key in assembly.network.nodes()]
keys_to_delete = all_keys[selected_key+1:]
keys_to_delete.reverse()
print keys_to_delete

#print 'nn', assembly.network.degree_out(selected_key+1)

#for i_key in keys_to_delete:
    


if remove:
    for i_key in keys_to_delete:
        assembly.delete_element(i_key)
    
    action_history = ['Elements {} deleted from assembly'.format(str(keys_to_delete))]
    
    #msg = open_element_connector(selected_key)
    #print selected_key
    #print msg
    #action_history += msg
    
print assembly.network.number_of_nodes()

#selected_element = assembly.element(selected_key)
##assembly.element(selected_key).connector_frame_1 = Frame(selected_element.frame.point, selected_element.frame.xaxis, selected_element.frame.yaxis)
#plane_check_1 = Artist(assembly.element(selected_key).frame).draw()
#plane_check_2 = Artist(assembly.element(selected_key).connector_frame_1).draw()
# ---------- end key_actions_3 ----------
rec_2 = DataRecorder(settings_parameters.out, DataLimit=-10, RecordData=True)
messages_2 = Panel(rec_2)
key_actions_4 = GhPythonScript(
    assembly=settings_parameters.assembly,
    key=settings_parameters.selected_key,
    remove=delete_all_after_key,
    close_connector=close_connector,
    assign=make_a_support)  # -> out, assembly; disabled
# ---------- key_actions_4: Python ----------
from compas.artists import Artist
from scriptcontext import sticky as st

#############################################################################
## Delete element
#############################################################################

if remove:
    assembly.delete_element(key)

#############################################################################
## Close connector
#############################################################################

if close_connector:

    open_connectors_keys = assembly.open_connectors_keys
    print key, open_connectors_keys
    
    if key in open_connectors_keys:
        print ("closed")
        assembly.element(key).connector_1_state = False
        assembly.element(key).connector_2_state = False
        open_connectors_keys.remove(key)

    else:
        print("Error:TRUE")
        print("Not possible to close this connector.")

#############################################################################
## Define as supporting element
#############################################################################

if assign:
    assembly.network.node_attribute(key, 'is_support', True)
# ---------- end key_actions_4 ----------

# ----
# 5. Mobile robots
geo_8 = Geometry([<mesh referenced from the Rhino model> x48])
geo_9 = Geometry([<mesh referenced from the Rhino model> x48])
show_robots = BooleanToggle(True)
M_2 = MeshJoin(Meshes=geo_8)
M_3 = MeshJoin(Meshes=geo_9)
robot_viz = GhPythonScript(assembly=grow_assembly.assembly, robot_geo_AA=M_2, robot_geo_AB=M_3, show_robots=show_robots)  # -> out, G_rob_AA, color_AA, G_rob_AB, color_AB
# ---------- robot_viz: Python ----------
status_robot_AA, status_robot_AB = assembly.robot_status()
print status_robot_AA, status_robot_AB

color_red = '180,0,0 (50)'
color_yellow = '186,105,0 (50)'
#color_yellow = '224,165,27 (50)'
color_green = '44,138,0 (50)'

status_colors = {'FREE': color_green, 'Place': color_yellow, 'Stabilizing': color_yellow}

if show_robots:
    G_rob_AA = robot_geo_AA
    color_AA = status_colors[status_robot_AA]
    
    G_rob_AB = robot_geo_AB
    color_AB = status_colors[status_robot_AB]
# ---------- end robot_viz ----------
preview_7 = CustomPreview(Geometry=robot_viz.G_rob_AA, Material=robot_viz.color_AA)
preview_8 = CustomPreview(Geometry=robot_viz.G_rob_AB, Material=robot_viz.color_AB)

open_conn = GhPythonScript(assembly=settings_parameters.assembly, key=settings_parameters.selected_key)  # -> out, assembly; disabled
# ---------- open_conn: Python ----------
from compas.artists import Artist


assembly.element(key).connector_1_state = True
assembly.element(key).connector_2_state = False
# ---------- end open_conn ----------

# ----
# Assembly visualization
# 1. Visualize assembly.
# 2. Visualize selected option.
# 3. Visuilize current options (all/filtered).
support_geometry = BooleanToggle(True)
shortest_distance = BooleanToggle(False)
target_geometry_2 = BooleanToggle(True)
support_elems = BooleanToggle(False)
selected_key_2 = BooleanToggle(True)
assembly = BooleanToggle(True)
open_keys = BooleanToggle(True)
all_keys = BooleanToggle(True)
option = BooleanToggle(True)
joints = BooleanToggle(True)
assembly_viz = PythonScript(
    assembly=grow_assembly.assembly,
    selected_mode=settings_parameters.selected_mode,
    preview_mode=mode,
    show_assembly=assembly,
    show_target_geo=target_geometry_2,
    show_support_geo=support_geometry,
    show_support=support_elems,
    show_selected=selected_key_2,
    show_option=option,
    show_intersection=intersections,
    show_joining_options=list_3,
    show_open_keys=open_keys,
    show_all_keys=all_keys,
    show_short_dist=shortest_distance,
    show_joints=joints,
    show_open_connectors=open_connectors,
    selected_key=settings_parameters.selected_key,
    current_key=settings_parameters.current_key,
    collision_det=collision_check,
    angle=settings_parameters.current_angle,
    angle1=joining_branches_new_2.angle1,
    angle2=joining_branches_new_2.angle2,
    mirror_unit=settings_parameters.current_mirror_unit,
    unit_size=settings_parameters.current_unit_size,
    shift_value=settings_parameters.current_shift_value)  # -> out, G_target_geo, G_support_geo, G_planned_elems, planned_mat, branch_geo, colors_branches, gradient_colors_br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; inputs current_key: Int32, dist_elem: list, short_line: Line
# ---------- assembly_viz: Python ----------
import os
import sys
from scriptcontext import sticky as st
import Rhino.Geometry as rg
from cdf_2023.assembly import gui

import ghpythonlib.components as gh

import math
from math import pi

from compas.geometry import Vector, Translation, Frame, Transformation
from compas.artists import Artist
from compas.colors import Color
from compas_rhino.conversions import cylinder_to_rhino, frame_to_rhino
from compas.topology import connected_components


show_collision = True

G_opt_collision = []
G_selected = []
G_dist_elems = []

G_placed_by_human = []
G_placed_by_robot = []

G_supports = []

G_planned_elems = []
planned_connector_planes = []
G_built_elems = []
G_support_elems = []
G_branches =[]

G_no_open_connectors_elems = []
G_open_connectors_elems = []

G_connectors_ranges = []
G_close_pairs = []
G_intersection = []

G_joints = []

robots_reach = []
elem_options = []

key_tag_text = []
key_tag_location= []
lines = []
support_pt = []

flip = 'AA'

red_feedback = []


# Color coding
color_coding = {'color_close_pairs': Color(1.0, 0., 0.0, 1.0),
                'color_is_planned': Color(1.0, 0.752941176471, 0.0, 1.0), 
                'color_is_support': Color(0.0, 0.0, 1.0, 1.0), 
                'color_has_open_connector': Color(0.494117647059, 1.0, 0.239215686275, 1.0), 
                'color_has_no_open_connectors': Color(0.78431372549, 0.78431372549, 0.78431372549, 1.0), 
                'color_is_built': Color(0.811764705882, 1.0, 0.709803921569, 1.0), 
                'color_is_built_by_robot': Color(0.686274509804, 0.878431372549, 0.862745098039, 1.0), 
                'color_is_built_by_human': Color(0.949019607843, 0.898039215686, 0.0, 1.0)}

def generate_colors(n):
    colors = []
    x = 70
    for i in range(n):
        r = 0
        g = int((i / (n - 1)) * (255-x) + x)  # Varying from x to 255
        b = 0
        
        # Create a Color object and get the RGB values
        color = Color.FromArgb(r, g, b)
        rgb_values = "{},{},{}".format(color.R, color.G, color.B)
        
        # Append the RGB values to the colors list
        colors.append(rgb_values)
    
    return colors

def generate_gradient(color_start, color_end, n):
    colors = []
    # Extract RGB components from start and end colors
    r_start, g_start, b_start = color_start
    r_end, g_end, b_end = color_end
    
    if n > 1:
        for i in range(n):
            # Calculate the RGB values for the gradient
            r = int(r_start + (i / (n - 1)) * (r_end - r_start))
            g = int(g_start + (i / (n - 1)) * (g_end - g_start))
            b = int(b_start + (i / (n - 1)) * (b_end - b_start))
        
            # Append the RGB values to the colors list
            rgb = '{},{},{}'.format(r,g,b)
            colors.append(rgb)
    else:
        rgb = '{},{},{}'.format(r_end,g_end,b_end)
        colors.append(rgb)
    
    return colors


keys = [key for key, element in assembly.elements()]
lines = [Artist(assembly.element(key).line).draw() for key in keys]

open_connectors_frames = [assembly.element(key).connectors(state='open') for key, element in assembly.elements()]
all_connectors_frames = [assembly.element(key).connectors() for key, element in assembly.elements()]
element_frames = [assembly.element(key).frame for key, element in assembly.elements()]

# Identify the connected elements (branches) in the assembly.
branches = connected_components(assembly.network.adjacency)
#print ('branch', branches, len(branches))

selected_element = assembly.element(current_key)

selected_connectors_ranges = [assembly.element(key).connectors_ranges(state='open') for key in keys if key == current_key or key in assembly.selected_keys_pair]
#selected_connectors_ranges = [assembly.element(key).connectors_ranges(state='open') for key in keys if key in assembly.selected_keys_pair]
all_connectors_ranges = [assembly.element(key).connectors_ranges(state='open') for key in keys if key]

if show_open_connectors:
    open_connectors_planes = [Artist(connector).draw() for connectors in all_connectors_frames for connector in connectors if connectors != []]
"""iif show_all_frames:
    all_connectors_planes = [Artist(connector).draw() for connectors in all_connectors_frames for connector in connectors if connectors != []]
    all_element_planes = [Artist(elem).draw() for elem in element_frames]"""
    
#if show_all_connectors_ranges and not show_selected_connectors_ranges:
#    G_connectors_ranges = [Artist(connector).draw() for connectors in all_connectors_ranges for connector in connectors if connectors != []]
    
#elif show_selected_connectors_ranges and not show_all_connectors_ranges:
#    T = Translation.from_vector(selected_element.frame.xaxis * 0)
#    connectors_ranges = [connector.transform(T) for connectors in selected_connectors_ranges for connector in connectors if connectors != []]
#    G_connectors_ranges = [Artist(connector).draw() for connectors in connectors_ranges]
    
#else:
#    G_connectors_ranges = []
    
"""if show_intersection:
    if len(assembly.selected_connectors_ranges_intersection_point) > 0:
        G_intersection = assembly.selected_connectors_ranges_intersection_point"""
    
def show(element, output_geo, color):
    mesh = Artist(element.mesh).draw(color)
    output_geo.append(mesh)

def show_multiple(elements, output_geo, color):
    for element in elements:
        mesh = Artist(element.mesh).draw(color)
        output_geo.append(mesh)
        
"""if show_robots_reach:
    robots_reach.append(rg.Sphere(assembly.ur_arm_AA_base_plane.Origin, 1.25))
    robots_reach.append(rg.Sphere(assembly.ur_arm_AB_base_plane.Origin, 1.25))"""
    

if assembly:
    
    if current_key != None:
        keys_display = ''
        elem_options = assembly.elem_options
        
        if selected_mode == "(3) Join branches": 
            for key in assembly.selected_keys_pair:
                keys_display += '{} '.format(key)
            #keys_display = '{},{}'.format(assembly.selected_keys_pair[0], assembly.selected_keys_pair[1])
        else:
            keys_display = current_key
    
    else:
        current_element = None
        elem_options = []
    
    if len(elem_options) != 0:
        elem_option = elem_options[0]
        print elem_option
        #all_connectors_frames = [assembly.element(key).connectors() for key, element in assembly.elements()]
        #planned_connector_frames = [elem.connectors() for elem in elem_option]
    
    
    planned_keys = list(assembly.network.nodes_where({'is_planned':True, 'is_built':False}))
    built_keys = list(assembly.network.nodes_where({'is_built':True}))
    unbuilt_keys = [key for key, element in assembly.elements() if key not in built_keys]
    support_keys = list(assembly.network.nodes_where({'is_support':True}))
    #open_connectors_keys = [key for key, frames in assembly.connectors('open') if frames != []]
    open_connectors_keys = assembly.open_connectors_keys
    no_open_connectors_keys = [key for key in planned_keys if key not in open_connectors_keys]
    
    robot_keys = list(assembly.network.nodes_where({'placed_by':'robot'}))
    print('robot', robot_keys)
    human_keys = list(assembly.network.nodes_where({'placed_by':'human'}))
    
    mirrored_keys = list(assembly.network.nodes_where({'is_mirrored':True}))
    unmirrored_keys = list(assembly.network.nodes_where({'is_mirrored':False}))
    #support_keys = [key for key in support_keys if key not in assembly.open_connectors_keys]
    
    print 'robot keys:', robot_keys
    print 'human keys:', human_keys
    
    print 'planned keys:', planned_keys
    print 'built keys:', built_keys
    print 'unbuilt keys:', unbuilt_keys
    
    print 'support keys:', support_keys
    print 'open connectors keys:', open_connectors_keys
    print 'no open connectors keys:', no_open_connectors_keys
    
    robot_elements = [assembly.element(key) for key in robot_keys] 
    human_elements = [assembly.element(key) for key in human_keys] 
    
    planned_elements = [assembly.element(key) for key in planned_keys] 
    built_elements = [assembly.element(key) for key in built_keys] 
    
    mirrored_elements = [assembly.element(key) for key in mirrored_keys] 
    unmirrored_elements = [assembly.element(key) for key in unmirrored_keys] 
    
    support_elements = [assembly.element(key) for key in support_keys] 
    open_connectors_elements = [assembly.element(key) for key in open_connectors_keys]
    no_open_connectors_elements = [assembly.element(key) for key in no_open_connectors_keys]
    open_keys = [key for key, frames in assembly.connectors('open') if frames != []]
    


    # Vizualize current connector 
    planned_mat = []
    if show_option and show_assembly:
        if elem_options:
            is_colliding, dist, dist_elem, short_line = assembly.collision_check(current_key, elem_options, tolerance=-0.001)
            print elem_options
            
            for element in elem_options:
                сurrent_color = "255,170,0 (120)"
                # check robot reachability
                if element.frame.point.z > 3.0:
                    сurrent_color = "255,0,0 (120)"
                    red_feedback = ['Not reachable by robot']
                
                # check for collision
                if is_colliding and element == dist_elem[1]:
                    сurrent_color = "255,0,0 (120)"
                
                # add element and color
                G_planned_elems.append(cylinder_to_rhino(element._source))
                planned_mat.append(сurrent_color)
            
            if is_colliding:
                colliding_key = dist_elem[0]
                G_elem_coll = cylinder_to_rhino(assembly.element(colliding_key)._source)
                red_feedback.append('Elements are colliding')
                
            if show_short_dist:
                G_short_line = short_line
                line_middle = gh.CurveMiddle(short_line)
                dist_label = '{}mm'.format(int(dist*1000))
    
    
    # Visualize assembly
    if show_assembly:
        if preview_mode == 3: # Sequence
            colors_sequence = []
            G_sequence = []
            i = 0
            total_elements = assembly.network.number_of_nodes()
            gradient_colors_seq = generate_gradient((235,235,255), (0,0,255), total_elements)
            
            for key, element in assembly.elements():
                c = gradient_colors_seq[i]
                geo = cylinder_to_rhino(assembly.element(key)._source)
                G_sequence.append(geo)
                colors_sequence.append(c)
                i +=1
        
        if preview_mode == 2: # Branches
            colors_branches = []
            branch_geo =[]
            
            branches = connected_components(assembly.network.adjacency)
            gradient_colors_br = generate_gradient((186,217,193), (0,128,0), len(branches))
            
            if show_selected:
                if selected_mode != "(3) Join branches": 
                    G_selected_elem = cylinder_to_rhino(assembly.element(selected_key)._source)
                else:
                    G_selected_elem = [cylinder_to_rhino(assembly.element(key)._source) for key in assembly.selected_keys_pair]
            i = 0
            for branch in branches:
                c = gradient_colors_br[i]
                for key in branch:
                    geo = cylinder_to_rhino(assembly.element(key)._source)
                    branch_geo.append(geo)
                    colors_branches.append(c)
                    
                i +=1
        
#        if preview_mode == 2: # Assembly workflow
#            for element in planned_elements:
#                geo = cylinder_to_rhino(element._source)
#          geo = cylinder_to_rhino(element._source)
#                line = element.line.draw()
#                support_pt.append(element.line.draw())
#                #G_support_elems.append(geo)
                
        
        elif preview_mode == 1: # Design Generation
            for element in support_elements:
                geo = cylinder_to_rhino(element._source)
                G_support_elems.append(geo)
                
            for element in open_connectors_elements:
                geo = cylinder_to_rhino(element._source)
                G_open_connectors_elems.append(geo)
                
            for element in no_open_connectors_elements:
                geo = cylinder_to_rhino(element._source)
                G_no_open_connectors_elems.append(geo)
                
            if show_selected:
                if selected_mode != "(3) Join branches": 
                    try:
                        G_selected_elem = cylinder_to_rhino(assembly.element(selected_key)._source)
                    except:
                        G_selected_elem = []
                else:
                    try:
                        G_selected_elem = [cylinder_to_rhino(assembly.element(key)._source) for key in assembly.selected_keys_pair]
                    except:
                        G_selected_elem = []
            
        else: # Build by human/robot
            for element in robot_elements:
                geo = cylinder_to_rhino(element._source)
                G_placed_by_robot.append(geo)
                
            for element in human_elements:
                geo = cylinder_to_rhino(element._source)
                G_placed_by_human.append(geo)
        
        
        # visualise joints: find middle point of distance line between connected elements
        if show_joints:
            pairs =  assembly.connections()
            
            j_R = assembly.globals['rod_radius']*2 + assembly.globals['joint_dist']/2
            joint_cps = []
            
            for pair in pairs:
                line1 = Artist(assembly.element(pair[0]).line).draw()
                line2 = Artist(assembly.element(pair[1]).line).draw()
                
                d, node_line = assembly.shortest_distance_between_two_lines(line1,line2)
                joint_cp = gh.CurveMiddle(node_line)
                joint_cps.append(joint_cp)
    
    # show the keys
    if show_open_keys:
        for key, element in assembly.elements():
            if key in open_connectors_keys:
                key_tag_text.append(str(key))
                key_tag_location.append(Artist(element.frame).draw().Origin)
    
    if show_all_keys:
        for key, element in assembly.elements():
            key_tag_text.append(str(key))
            key_tag_location.append(Artist(element.frame).draw().Origin)
            

    # visualise target geometry
    if show_target_geo:
        G_target_geo = assembly.target_geo
    
    # visualise supporting geo
    if show_support_geo:
        G_support_geo = assembly.support
# ---------- end assembly_viz ----------
geo_10 = Geometry(assembly_viz.G_target_geo)
geo_11 = Geometry(assembly_viz.G_support_geo)
geo_12 = Geometry(assembly_viz.G_planned_elems)
geo_13 = Geometry(assembly_viz.G_opt_collision)
geo_14 = Geometry(assembly_viz.G_elem_coll)
geo_15 = Geometry(assembly_viz.G_placed_by_human)
geo_16 = Geometry(assembly_viz.G_placed_by_robot)
line_7 = Line(assembly_viz.G_short_line)
geo_17 = Geometry(assembly_viz.G_built_elems)
geo_18 = Geometry(assembly_viz.G_selected_elem)
mesh_2 = Mesh(assembly_viz.G_close_pairs)
geo_19 = Geometry(assembly_viz.G_open_connectors_elems)
geo_20 = Geometry(assembly_viz.G_support_elems)
geo_21 = Geometry(assembly_viz.G_no_open_connectors_elems)
sph = Sphere(Base=assembly_viz.joint_cps, Radius=assembly_viz.j_R)
line_8 = Line(flatten(assembly_viz.lines))
rot = GhPythonScript(plane=assembly_viz.elem_option_robot, angle=Slider(42, range=0..360))  # -> out, plane; disabled
# ---------- rot: Python ----------
import math
from compas.geometry import Frame, Rotation
from compas.artists import Artist

frame = Frame(plane.Origin, plane.XAxis, plane.YAxis)

R = Rotation.from_axis_and_angle(frame.xaxis, math.radians(angle), frame.point)
frame.transform(R)

plane = Artist(frame).draw()
# ---------- end rot ----------
tag_4 = TextTag(Location=assembly_viz.line_middle, Text=assembly_viz.dist_label, Colour=RGB(0, 0, 0))
tag_5 = TextTag(Location=assembly_viz.key_tag_location, Text=assembly_viz.key_tag_text, Colour=RGB(0, 0, 0))
pln_3 = Plane(assembly_viz.open_connectors_planes)
panel_23 = Panel(assembly_viz.keys_display)

is_colliding = Panel(assembly_viz.is_colliding)

# ----
# Current parameters
key = Panel(assembly_viz.keys_display)
angle_3 = Panel(settings_parameters.current_angle)
shift_value_2 = Panel(settings_parameters.current_shift_value)
unit_size_2 = Panel(settings_parameters.current_unit_size)
mirrored = Panel(settings_parameters.current_mirror_unit)

element_geometry = Geometry(assembly_viz.G_sequence)
option_2 = Geometry(geo_12)
python_2 = GhPythonScript(assembly=settings_parameters.assembly)  # -> out, sp; disabled
# ---------- python_2: Python ----------
from compas.artists import Artist

import rhinoscriptsyntax as rs
import ghpythonlib.components as gh

support_geo = assembly.support

sp = []
line = Artist(assembly.element(0).line).draw()
int_pt = gh.BrepXCurve(support_geo,line)[1]
print len(int_pt)
print int_pt[1]
print type(None)
print type([])

if int_pt != None:
    if type(int_pt) == type([]):
        sp.append(int_pt[1])
    else:
        sp.append(int_pt)

print sp
# ---------- end python_2 ----------

# ----
# Set to built
keys = Slider(18, range=0..100)  # disabled
button = Button()  # disabled
button_2 = Button()  # disabled
set_to_built = GhPythonScript(assembly=grow_assembly.assembly, built_keys=keys, set_keys_to_built=button, set_all_to_unbuilt=button_2)  # -> out, assembly; inputs built_keys: Int32; disabled
# ---------- set_to_built: Python ----------
import rhinoscriptsyntax as rs

if set_keys_to_built:
    for i in range(built_keys):
        #assembly.network.node_attribute(i, 'is_planned', True)
        assembly.network.node_attribute(i, 'is_built', True)
        
if set_all_to_unbuilt:
    for key, element in assembly.elements():
    #    assembly.network.node_attribute(key, 'is_planned', True)
        assembly.network.node_attribute(key, 'is_built', False)
        
for key, element in assembly.elements():
    print assembly.network.node_attribute(key, 'robot_AA_base_frame')
# ---------- end set_to_built ----------

key_actions_5 = GhPythonScript(
    assembly=settings_parameters.assembly,
    selected_key=settings_parameters.selected_key,
    remove=delete_all_after_key,
    close_connector=close_connector,
    open_connector=open_connector,
    assign=make_a_support)  # -> out, assembly, action_history, plane_check_2, plane_check_1, nb_planes, con_fr_1, con_fr_2; disabled
# ---------- key_actions_5: Python ----------
from compas.artists import Artist
from scriptcontext import sticky as st

from compas.geometry import Frame

action_history = []


#############################################################################
## Open connector
#############################################################################

def check_connector(sel_connector, neigh_connectors):
    check = True # can be opened, no shared connectors
    for neigh_connector in neigh_connectors:
        if sel_connector.point.ToString() == neigh_connector.point.ToString():
            check = False # cannot be opened, since there a other elements placed at the same point

    return check


the_key = selected_key


neighbors_keys = assembly.network.neighborhood(the_key)
print 'neigh keys', neighbors_keys
neighbors_keys_closed_connectors = [connector for nkey in neighbors_keys for connector in assembly.element(nkey).connectors(state='closed')]
print neighbors_keys_closed_connectors

nb_planes = [Artist(conn).draw() for conn in neighbors_keys_closed_connectors]
con_fr_1 = Artist(assembly.element(the_key).connector_frame_1).draw()
con_fr_2 = Artist(assembly.element(the_key).connector_frame_2).draw()

open_connectors_keys = assembly.open_connectors_keys
#selected_element = assembly.element(the_key)

## check connector 1
#connector_1 = assembly.element(the_key).connector_frame_1
if not assembly.element(the_key).connector_1_state:
    print check_connector(assembly.element(the_key).connector_frame_1, neighbors_keys_closed_connectors)
    if check_connector(assembly.element(the_key).connector_frame_1, neighbors_keys_closed_connectors):
        #assembly.element(the_key).connector_1_state = True
        #assembly.element(the_key).connector_frame_1 = Frame(assembly.element(the_key).frame.point, assembly.element(the_key).frame.xaxis, assembly.element(the_key).frame.yaxis)
        #open_connectors_keys.append(the_key)
        
        action_history = ['Element {}: connector 1 is open now'.format(the_key)]
    else:
        action_history = ['Element {}: connector 1 cannot be opened'.format(the_key)]
else:
    action_history = ['Element {}: connector 1 is already open'.format(the_key)]

## check connector 2
#connector_2 = assembly.element(the_key).connector_frame_2
if not assembly.element(the_key).connector_2_state:
    if check_connector(assembly.element(the_key).connector_frame_2, neighbors_keys_closed_connectors):
        #assembly.element(the_key).connector_2_state = True
        #assembly.element(the_key).connector_frame_2 = Frame(assembly.element(the_key).frame.point, assembly.element(the_key).frame.xaxis*-1, assembly.element(the_key).frame.yaxis*-1)
        #open_connectors_keys.append(the_key)
        
        action_history.append('Element {}: connector 2 is open now'.format(the_key))
    else:
        action_history.append('Element {}: connector 2 cannot be opened'.format(the_key))
else:
    action_history.append('Element {}: connector 2 is already open'.format(the_key))


all_keys = [key for key in assembly.network.nodes()]
keys_to_delete = all_keys[selected_key+1:]
keys_to_delete.reverse()
print keys_to_delete

in_keys = assembly.network.neighbors_in(the_key)
n_keys = assembly.network.neighbors(the_key)
#in_keys_smaller = [key for key in in_keys if key < the_key]
#print in_keys_smaller

keys_to_open = []
for ikey in keys_to_delete:

    if ikey in n_keys:
        for n_in_key in assembly.network.neighbors_in(ikey):
            if n_in_key in in_keys:
                keys_to_delete.remove(ikey)
            if n_in_key <= the_key and n_in_key not in keys_to_open:
                keys_to_open.append(n_in_key)
    else:
        for n_in_key in assembly.network.neighbors_in(ikey):
            if n_in_key <= the_key and n_in_key not in keys_to_open:
                keys_to_open.append(n_in_key)

print keys_to_delete
print keys_to_open
#print the_key
#print assembly.network.neighbors(the_key)
#print assembly.network.neighbors_in(the_key)
#print assembly.network.neighbors_out(the_key)


#print assembly.network.number_of_nodes()

#selected_element = assembly.element(selected_key)
##assembly.element(selected_key).connector_frame_1 = Frame(selected_element.frame.point, selected_element.frame.xaxis, selected_element.frame.yaxis)
plane_check_1 = Artist(assembly.element(selected_key).frame).draw()
plane_check_2 = Artist(assembly.element(selected_key).connector_frame_1).draw()
# ---------- end key_actions_5 ----------
pln_4 = Plane(key_actions_5.con_fr_2)  # disabled
pln_5 = Plane(key_actions_5.nb_planes)  # disabled
pln_6 = Plane(key_actions_5.con_fr_1)  # disabled

# ---- group: Option
preview_9 = CustomPreview(Geometry=geo_12, Material=assembly_viz.planned_mat)

# ---- group: Geometry / Joints
sup_geo = ColourSwatch(SwatchColor=RGBA(196, 196, 196, 233))
joints_2 = ColourSwatch(SwatchColor=RGBA(189, 189, 189, 177))
tar_geo = ColourSwatch(SwatchColor=RGBA(152, 147, 189, 79))
preview_10 = CustomPreview(Geometry=geo_10, Material=tar_geo)
preview_11 = CustomPreview(Geometry=geo_11, Material=sup_geo)
preview_12 = CustomPreview(Geometry=sph, Material=joints_2)

# ---- group: Design Generation
support = ColourSwatch(SwatchColor=RGB(0, 0, 255))
open = ColourSwatch(SwatchColor=RGB(121, 255, 54))
closed = ColourSwatch(SwatchColor=RGB(158, 158, 158))
preview_13 = CustomPreview(Geometry=geo_19, Material=open)
preview_14 = CustomPreview(Geometry=[geo_17, geo_21], Material=closed)
preview_15 = CustomPreview(Geometry=geo_20, Material=support)

# ---- group: Branches
preview_16 = CustomPreview(Geometry=assembly_viz.branch_geo, Material=assembly_viz.colors_branches)

# ----
targ_geo = GhPythonScript(assembly=settings_parameters.assembly, sel_key=settings_parameters.selected_key)  # -> out, plane, origin_pl, centr_plane, v; disabled
# ---------- targ_geo: Python ----------
import rhinoscriptsyntax as rs
import Rhino.Geometry as rg
import ghpythonlib.components as gh
from compas_rhino.conversions import plane_to_rhino

from compas.geometry import centroid_points, Plane
from compas.artists import Artist

def distance_to_target_geo(assembly, key, elem_option, input_geo):
    
    # three point - middle of elements
    p_A = assembly.element(key).frame.point
    p_B = elem_option[0].frame.point
    p_C = elem_option[1].frame.point
    centroid = centroid_points([p_A,p_B,p_C])
    
    # create a plane with the origin in the centroid of the three points
    centroid = centroid_points([p_A,p_B,p_C])
    centr_plane = Plane.from_three_points(centroid, p_B, p_C)
    plane = plane_to_rhino(centr_plane)

    # find vector between sohrtest_line and normal
    closest_point = input_geo.ClosestPoint(plane.Origin)
    distance = closest_point.DistanceTo(plane.Origin)

    vector = rg.Vector3d(closest_point) - rg.Vector3d(plane.Origin)

    return distance, vector, plane

dist, v, plane = distance_to_target_geo(assembly, sel_key, assembly.elem_options, assembly.target_geo)
print dist, v
# ---------- end targ_geo ----------

# ---- group: Human/Robot
robot = ColourSwatch(SwatchColor=RGB(175, 224, 220))
hum = ColourSwatch(SwatchColor=RGB(242, 229, 0))
preview_17 = CustomPreview(Geometry=geo_15, Material=hum)
preview_18 = CustomPreview(Geometry=geo_16, Material=robot)

# ---- group: Selected/Collision
selected = ColourSwatch(SwatchColor=RGBA(51, 61, 0, 168))
elem = ColourSwatch(SwatchColor=RGB(255, 0, 0))
preview_19 = CustomPreview(Geometry=geo_18, Material=selected)
preview_20 = CustomPreview(Geometry=geo_14, Material=elem)

# ---- group: Sequence
preview_21 = CustomPreview(Geometry=assembly_viz.G_sequence, Material=assembly_viz.colors_sequence)

# ----
vdis_3 = VectorDisplay(Anchor=targ_geo.plane, Vector=targ_geo.v)  # disabled
planesrf = PlaneSurface(Plane=targ_geo.plane, XSize=Domain(-10, 10), YSize=Domain(-10, 10))  # disabled

# ----
# Network visualization
network_graph = BooleanToggle(True)
network_viz = GhPythonScript(assembly=key_actions.assembly, show_network=network_graph, key=Slider(0, range=0..67))  # -> out, nodes, edges; inputs key: Int32
# ---------- network_viz: Python ----------
import sys, os
import ghpythonlib.components as ghcomp
from compas.datastructures import Network
from compas_ghpython.artists import NetworkArtist
from compas_rhino.geometry import RhinoLine

import compas_ghpython
import Rhino.Geometry as rg


data = assembly.network.to_data()
network = Network.from_data(data)

print assembly.network.number_of_nodes()

def draw_network(network):
    """Draw a network in Grasshopper.
    """
    points = []
    for key, attr in network.nodes(True):
        try:
            points.append({
                'pos': network.node_coordinates(key),
            })
        except:
            print 'error'

    lines = []
    for (u, v), attr in network.edges(True):
        lines.append({
            'start': network.node_coordinates(u),
            'end': network.node_coordinates(v),
        })

    points_rg = compas_ghpython.draw_points(points)
    lines_rg = compas_ghpython.draw_lines(lines)

    return points_rg, lines_rg

if show_network:
    nodes, edges = draw_network(network)
    
    current_node = {'pos': network.node_coordinates(key), 'radius': 0.03}
    current_node = compas_ghpython.draw_spheres([current_node])
    
    current_node_neighbors_keys = network.neighbors(key)
    current_node_neighbors = [{'pos': network.node_coordinates(key), 'radius': 0.02} for key in current_node_neighbors_keys]
    current_node_neighbors = compas_ghpython.draw_spheres(current_node_neighbors)
# ---------- end network_viz ----------
pt_11 = Point(network_viz.nodes)
line_9 = Line(network_viz.edges)
colour_swatch = ColourSwatch(SwatchColor=RGB(0, 0, 0))
preview_22 = CustomPreview(Geometry=line_9, Material=colour_swatch)
dots_3 = DotDisplay(Point=pt_11, Colour=colour_swatch, Size=0.04)  # disabled

# ----
# Screen Feedback
status = BooleanToggle(True)
feedback_to_screen = GhPythonScript(
    STATUS=status,
    preview_mode=mode,
    assembly_select=list,
    assembly=settings_parameters.assembly,
    selected_mode=settings_parameters.selected_mode,
    current_key=settings_parameters.selected_key,
    keys_display=assembly_viz.keys_display,
    current_angle=settings_parameters.current_angle,
    current_shift_value=settings_parameters.current_shift_value,
    unit_size=settings_parameters.current_unit_size,
    current_mirror_unit=settings_parameters.current_mirror_unit,
    is_colliding=assembly_viz.is_colliding,
    collision_det=collision_check,
    red_feedback=assembly_viz.red_feedback,
    get_key_by_index=by_index,
    get_joining_options=list_3,
    join_branch_params=joining_branches_new_2.join_branch_feedback,
    stability_feedback=stability_viz.stability_feedback,
    key_held_by_robot=stability_viz.key_held_by_robot,
    la_limit=la_limit,
    branch_colors=assembly_viz.gradient_colors_br,
    msg=settings_parameters.out,
    default_size=Slider(20, range=0..50))  # -> out, text, location, size, color; inputs preview_mode: Int32, red_feedback: list, join_branch_params: list, stability_feedback: list, branch_colors: list, msg: list
# ---------- feedback_to_screen: Python ----------
feedback_text = {
                'text': [],
                'location': [],
                'size': default_size,
                'color': []
                }

y0 = 100
x0 = 50
offset = default_size*0.5
x_curr = x0
y_curr = y0
x_curr_2col = x0 + 15*default_size
y_curr_2col = y0

color_red = '180,0,0'
color_yellow = '186,105,0'
color_green = '44,138,0'
color_black = '0,0,0'

status_colors = {'FREE': color_green, 'Place': color_yellow, 'Stabilizing': color_yellow}

def add_text_line(text, value, x, y, color='0,0,0'):
    global x_curr,y_curr
    feedback_text['text'].append(text.format(value))
    feedback_text['location'].append('{}, {}, 0'.format(x,y))
    feedback_text['color'].append(color)
    
    if y is y_curr:
        y_curr += default_size
        y_curr += offset

keys = [key for key, element in assembly.elements()]

preview_mode_names = ['Built by Human/Robot','Design Generation','Branches', 'Sequence']
current_mode_names = ['(1) Manual','(2) Automatic','(3) Join branches']


# ----------- Assembly Status --------------- 

total_joints = assembly.network.number_of_edges()
total_elements = assembly.network.number_of_nodes()

#y_B = screen_height
assembly_type = 'New' if assembly_select == 1 else 'Loaded'
add_text_line('ASSEMBLY: {}',assembly_type, x_curr,y_curr)
#y_B += default_size
#y_B += offset*2
add_text_line('Total Elements: {}',total_elements, x_curr,y_curr)
#y_B += default_size
#y_B += offset
add_text_line('Total Joints: {}',total_joints, x_curr,y_curr)
y_curr += offset*3

# ----------- Robots Status --------------- 

status_robot_AA, status_robot_AB = assembly.robot_status()

# check which elements is stabilized to display it in status
last_key_held_by_robot = assembly.network.node_attribute(total_elements-1, 'key_held_by_robot')
stab_robot = assembly.network.node_attribute(total_elements-1, 'stabilizing_robot')

if stab_robot == 'AA':
    text_AA = '{} key {}'.format(status_robot_AA, last_key_held_by_robot)
else: 
    text_AA = status_robot_AA

if stab_robot == 'AB':
    text_AB = '{} key {}'.format(status_robot_AB, last_key_held_by_robot)
else: 
    text_AB = status_robot_AB

add_text_line('Robot AA: {}',text_AA, x_curr_2col ,y_curr_2col, color= status_colors[status_robot_AA])
y_curr_2col += default_size
y_curr_2col += offset
add_text_line('Robot AB: {}',text_AB, x_curr_2col ,y_curr_2col, color= status_colors[status_robot_AB])
y_curr_2col += default_size
y_curr_2col += offset


# ----------- Stability limit --------------- 

add_text_line('Stability la limit: {}m',la_limit, x_curr_2col,y_curr_2col)
#y_curr += offset*3

# ----------- Preview mode ---------------
add_text_line('PREVIEW mode: {}',preview_mode_names[preview_mode],x_curr,y_curr)
y_curr += offset*3

if preview_mode == 2: # Branches
    i = 0
    for t in stability_feedback:
        add_text_line('{}',t,x_curr,y_curr, color=branch_colors[i])
        i +=1
    y_curr += offset*3

add_text_line('GENERATION mode: {}', selected_mode,x_curr,y_curr)
y_curr += offset*3

if get_key_by_index:
    add_text_line('Key by index: {}','ON',x_curr,y_curr,color=color_green)
    y_curr += offset*1

if current_key in assembly.open_connectors_keys:
    keys_display = '{} (open)'.format(current_key)
    key_color = color_black
elif current_key in keys:
    keys_display = '{} (closed)'.format(current_key)
    key_color = color_yellow
else:
    keys_display = '{} (not exists)'.format(current_key)
    key_color = color_red


add_text_line('Selected key: {}', keys_display,x_curr,y_curr, key_color)
y_curr += offset*3

#y_curr += offset*3

#feedback_text['text'].append(current_mode)
#feedback_text['location'].append('{}, {}, 0'.format(x,y))

#if current_mode == 'Automatic' or current_mode == 'Manual':
    #add_text_line('     Key: {}',current_key,x_curr,y_curr)
    #add_text_line('     Angle: {}°',current_angle,x_curr,y_curr)
    #add_text_line('     Shift: {} cm',current_shift_value*100,x_curr,y_curr)
    #add_text_line('     Unit size: {} cm',unit_size*100,x_curr,y_curr)
    #add_text_line('     Mirrored: {}',current_mirror_unit,x_curr,y_curr)

if red_feedback != None:
    for line in red_feedback:
        add_text_line('{}',line,x_curr,y_curr, color=color_red)

"""if collision_det and total_elements>1:
    if is_colliding:
        add_text_line('Is colliding: {}',is_colliding,x_curr,y_curr, color=color_red)
        y_curr += offset*3
else:
    add_text_line('Collision detection: {}',collision_det,x_curr,y_curr)
    y_curr += offset*3"""

if selected_mode == '(3) Join branches': # join branches
    #if get_joining_options:
    #    add_text_line('Get joining options: {}',get_joining_options,x_curr,y_curr, color=color_green)
    #else:
    #    add_text_line('Get joining options: {}',get_joining_options,x_curr,y_curr, color=color_red)
    #y_curr += offset*3
    
    for t in join_branch_params:
        add_text_line('{}',t,x_curr,y_curr)
    
    y_curr += offset*3

y_curr += offset*3

# ----------- ADD ERRORS --------------- 
"""y += offset*3
for t in msg:
    feedback_text['text'].append('ERROR: {}'.format(t))
    feedback_text['location'].append('{}, {}, 0'.format(x,y))
    y += default_size
    y += offset"""

# ----------- PRINT --------------- 
if STATUS:
    text = feedback_text['text']
    location = feedback_text['location']
    size = feedback_text['size']
    color = feedback_text['color']
else:
    text = []
    location = []
    size = []
    color = []
# ---------- end feedback_to_screen ----------
panel_24 = Panel(feedback_to_screen.text)
texttoscreen = RenderTextToScreen(
    Text=feedback_to_screen.text,
    Location=feedback_to_screen.location,
    Size=feedback_to_screen.size,
    Color=feedback_to_screen.color,
    Font="Roboto",
    m_scWithvp=False)

export = PythonScript(
    DATA=py.DATA,
    joint_elem=_1_new_assembly.joint_elem,
    assembly=grow_assembly.assembly,
    project_name=project_name,
    export_to_json=export_assembly)  # -> filename, saved_file, joints_points, joints_lines, planes_list, G_joints
# ---------- export: Python ----------
import os
from compas.datastructures.mesh import mesh_quads_to_triangles
from compas.datastructures.mesh import mesh_unify_cycles
from compas.geometry import Transformation, Frame

from datetime import datetime
import json
import compas
from compas.artists import Artist
import ghpythonlib.components as gh
from compas_rhino.conversions import line_to_rhino, plane_to_compas_frame
import Rhino.Geometry as rg

now = datetime.now() # current date and time

filename = "{}_{}_{}_{}.json".format(project_name, 'assembly', '{total_elems}', '{date}_{time}')
if export_to_json:
   # filename = "start_assembly.json"
    date_time = now.strftime("%Y-%m-%d_%H-%M")
    filename = "{}_{}_{}_{}.json".format(project_name, 'assembly', total_elements, date_time)
    PATH = os.path.join(DATA, "assembly", filename)
    saved_file = filename

    # the assembly has to be serialized such that it can be called from CPython, True to enable pretty print
    
#    for key, element in assembly.elements():
#        assembly.network.adjacency.clear()
##       assembly.network.node_attribute(key, 'type', 1)
#        assembly.network.node_attribute(key, 'frame_measured', False)
#        assembly.element(key).mesh = None
#        assembly.element(key)._source = None
#        assembly.element(key).connector_frame_1 = None
#        assembly.element(key).connector_frame_2 = None
#        assembly.element(key).connector_range_1 = None
#        assembly.element(key).connector_range_2 = None
#        assembly.element(key).line = None

    assembly.to_json(PATH, True)
    
    #assembly_to_json(PATH, True)
    #joints_to_json(PATH2, True)

def assembly_to_json(path, pretty):
    
    assembly_data = {"node":{}}

    for key, element, data in assembly.elements(data=True):
        print data
        elem_dict = {}
        elem_dict["element"] = {"frame" : assembly.element(key).frame.to_data()}
        elem_dict['is_planned'] = data['is_planned'],
        elem_dict["is_built"] = data['is_built'],
        elem_dict["placed_by"] = data["placed_by"],
        elem_dict["is_support"] = data["is_support"],
        elem_dict["is_held_by_robot"] = data["is_held_by_robot"],
        elem_dict["robot_frame"] = data["robot_frame"],
        elem_dict["frame_measured"] = data["frame_measured"]
        
        assembly_data["node"][str(key)] = elem_dict
        
    compas.json_dump(assembly_data, path, pretty)

new_adjacency = []
total_elements = assembly.network.number_of_nodes()

for key, element in assembly.elements():
    print key
    adjacency = assembly.network.adjacency[key].keys()
    #print adjacency
    if len(adjacency) > 2:
        #print key, adjacency
        adjacency.sort()
    for index in adjacency:
        if [index, key] not in new_adjacency:
            new_adjacency.append([key, index])

print len(new_adjacency)


joints_points = []
joints_origins = []
joints_lines = []

for list in new_adjacency:
    crv1 = line_to_rhino(assembly.element(list[0]).line)
    crv2 = line_to_rhino(assembly.element(list[1]).line)
    a, b, d = gh.CurveProximity(crv1, crv2)
    axis = rg.Vector3d(b)-rg.Vector3d(a)
    
    joint_plane_origin = rg.Point3d((a.X + b.X)/2, (a.Y + b.Y)/2, (a.Z + b.Z)/2)
    joints_points.append(a)
    joints_points.append(b)
    line = rg.Line(a,b)
    joints_lines.append(line)
    joints_origins.append([joint_plane_origin, axis])


planes_list = []

for pair, origin_axis in zip(new_adjacency, joints_origins):
    xaxis = assembly.element(pair[0]).frame.xaxis
    xaxis_rg = rg.Vector3d(xaxis.x, xaxis.y, xaxis.z)
    zaxis = origin_axis[1]
    yaxis = rg.Vector3d.CrossProduct(xaxis_rg, zaxis)
    plane = rg.Plane(origin_axis[0], xaxis_rg, yaxis)
    planes_list.append(plane)


frames_list = [plane_to_compas_frame(plane) for plane in planes_list]

def joints_to_json(path, pretty):
    
    joints_data = {"joint":{}}
    i = 0
    for pair, origin_axis in zip(new_adjacency, joints_origins):
        xaxis = assembly.element(pair[0]).frame.xaxis
        xaxis_rg = rg.Vector3d(xaxis.x, xaxis.y, xaxis.z)
        zaxis = origin_axis[1]
        yaxis = rg.Vector3d.CrossProduct(xaxis_rg, zaxis)
        plane = rg.Plane(origin_axis[0], xaxis_rg, yaxis)
        frame = plane_to_compas_frame(plane)
        joint_dict = {}

        joint_dict["element"] = {"frame":frame.to_data()}
        joint_dict["adjacency"] = pair


        joints_data["joint"][str(i)] = joint_dict
        i +=1
    compas.json_dump(joints_data, path, pretty)
    
if export_joint_to_json:
    filename = "{}_{}.json".format(project_name, 'joints')
    PATH = os.path.join(DATA, "assembly", filename)
    joints_to_json(PATH, True)
    


G_joints = []

#for frame in frames_list:
#    T = Transformation.from_frame_to_frame(Frame.worldXY(), frame)
#    new_joint = joint_elem.transformed(T)
#    G_joints.append(Artist(new_joint.mesh).draw())
# ---------- end export ----------
python_3 = GhPythonScript(G=option_2, L=name_of_the_layer, B=bake)  # -> out, a
# ---------- python_3: Python ----------
"""Provides a scripting component.
    Inputs:
        G: Geometry to bake
        L: Layer name for bake
        B: Bake Activate
    Output:
        a: The a output variable"""
 
__author__ = "ScottD"
__version__ = "2019.08.10"
 
import rhinoscriptsyntax as rs
import scriptcontext
import Rhino
 
 
if B:
 
    print(type(G)) #debug message to Python output
 
    #we obtain the reference in the Rhino doc
    doc_object = scriptcontext.doc.Objects.Find(G)
    print(type(doc_object))
 
    attributes = doc_object.Attributes
    print('the type of attributes is: ' + str(type(attributes)))     #debug message to Python output
 
    geometry = doc_object.Geometry
    print('the type of geometry is: ' + str(type(doc_object)))     #debug message to Python output
 
    #we change the scriptcontext
    scriptcontext.doc = Rhino.RhinoDoc.ActiveDoc
 
    #we add both the geometry and the attributes to the Rhino doc
    rhino_brep = scriptcontext.doc.Objects.Add(geometry, attributes)
    print('the Rhino doc ID is: ' + str(rhino_brep))     #debug message to Python output
 
    #we can for example change the layer in Rhino...
    if not rs.IsLayer(L):
        rs.AddLayer(L)
    rs.ObjectLayer(rhino_brep, L)
 
    #we put back the original Grasshopper document as default
    scriptcontext.doc = ghdoc
    a = G
# ---------- end python_3 ----------
pt_12 = Point(export.joints_points)
line_10 = Line(export.joints_lines)
pln_7 = Plane(export.planes_list)
mesh_3 = Mesh(export.G_joints)

comments = Panel(python_3.out)

output_filename_2 = Panel(export.filename)

rec_3 = DataRecorder(export.saved_file, DataLimit=-10, RecordData=True)

clean = CleanTree(RemoveNulls=True, RemoveInvalid=True, RemoveEmpty=False, Tree=rec_3)

last_saved_files = Panel(clean)

# ----
# Join keys Manually
key_2 = Slider(1, range=0..200)  # disabled
join = Button()  # disabled

join_keys = GhPythonScript(assembly=key_actions.assembly, key_1=settings_parameters.current_key, key_2=key_2, join=join)  # -> out, assembly, distance, dist_soll; disabled
# ---------- join_keys: Python ----------
from compas.artists import Artist

import Rhino.UI
from cdf_2023.assembly.gui import ErrorDialog

tolerance = 0.01
dist_soll = assembly.globals['rod_radius']*2 + assembly.globals['joint_dist']

total_elements = assembly.network.number_of_nodes()
if total_elements > 1:
    try:
        # check the distance between two elements
        line1 = Artist(assembly.element(key_1).line).draw()
        line2 = Artist(assembly.element(key_2).line).draw()
        distance, dist_line = assembly.shortest_distance_between_two_lines(line1, line2)
    except:
        distance = ""

if join:
    if distance < (dist_soll + tolerance):
        assembly.network.add_edge(key_1, key_2, edge_to='neighbour')
    else:
        ErrorDialog("This elements are two far away form each other. Consider that the distance should be similar to the displayed {}".format(dist_soll)).display()
# ---------- end join_keys ----------

distance = Panel(join_keys.distance)  # disabled
distance_soll = Panel(join_keys.dist_soll)  # disabled
