# Grasshopper definition ex3_assembly_target_geometry_growth_NOTcleaned_24-01-2024.ghx (Grasshopper 1.0.7)
# plug-ins: Human, Karamba3D

# Mode
# (1) Manual mode: define all the values yourself
# (2) Automatic mode: calculate selected values
#       based on target geometry
# (3) Join branches: automatically join
#       two branches, if they are close enough
list = ValueList({"1. 'Manual mode'": 0, "2. 'Automatic mode'": 1, "3. 'Join branches'": 2}, selected="1. 'Manual mode'")

x = Curve(<curve referenced from the Rhino model>)
x_2 = Curve(<curve referenced from the Rhino model>)
pt = Point(Point(2.850512028, 0.7105172375, 0.3578444119))
y = Curve(<curve referenced from the Rhino model>)
pt_2 = Point(Point(2.850512028, 0.009962099276, 0.3484417416))
x_3 = Curve(<curve referenced from the Rhino model>)
y_2 = Curve(<curve referenced from the Rhino model>)
pt_3 = Point(Point(2.850512028, -0.6718962648, 0.3484417416))
y_3 = Curve(<curve referenced from the Rhino model>)
pl = ConstructPlane(Origin=pt_2, XAxis=x_3, YAxis=y_2)
pl_2 = ConstructPlane(Origin=pt, XAxis=x, YAxis=y)
pl_3 = ConstructPlane(Origin=pt_3, XAxis=x_2, YAxis=y_3)

panel = Panel("Geometry Studies")
panel_2 = Panel("Constrains")
panel_3 = Panel("Assembly step-by-step")
panel_4 = Panel("""orange
42,88,88 (255)""")
panel_5 = Panel("""green
97,51,64 (255)""")
option_3_umbrella = Brep(<brep referenced from the Rhino model>)
option_4_tipi = Brep(<brep referenced from the Rhino model>)
option_2_dome = Brep(<brep referenced from the Rhino model>)
support_geo_umb = Brep(<brep referenced from the Rhino model>)
support_geo_tipi = Brep(<brep referenced from the Rhino model>)
plane = Plane([pl_2, pl, pl_3])

# ----
# Define Constraints
# 2. Support geometry:
#     (Foundation of the structure)
# 1. Target geometry:
#     Describes the general appearence of the structure
# 1.    Choose assembly
option_1_arch = Brep(<brep referenced from the Rhino model>)
guiding_geo = Mesh(option_1_arch)
support_geo_arch = Brep(<brep referenced from the Rhino model>)

# ----
# - Set parameters
list_2 = ValueList({"(1) Add ONE options-pair": 0, "(2) Add TWO options-pairs": 1}, selected="(2) Add TWO options-pairs")
number_slider = Slider(0.4, range=0..1)

# ----
# (1) 'Manual mode'
# define all the values yourself
angle = Slider(21, range=0..360)

unit_size = Slider(0.14, range=0.08..0.5)
shift_value = Slider(0.07, range=0..0.5)
mirror_unit = BooleanToggle(True)

# ----
# Step-By-Step Generation
previous = Button()
# - Set parameters
next = Button()
key_at_index = Slider(36, range=0..80)
get_key_by_index = BooleanToggle(True)

panel_6 = Panel("TEST_Branches_assembly_8_2024-01-16_15-43.json")
# 2.     Design Generation
panel_7 = Panel("TEST_Branches_WeirdStructure_assembly_20_2024-01-18_11-45.json")

# ----
# Select if you want to create a new assembly or load existing one
# Assembly
list_3 = ValueList({"(1) New assembly": 1, "(2) Load assembly (.json)": 2}, selected="(2) Load assembly (.json)")

# ----
# (2) Load assembly (.json)
# 1. Write the name of your saved assembly:
panel_8 = Panel("TEST_Arch_assembly_39_2024-01-12_20-22.json")
filename = Text(panel_8)

option_0_worldxy = Plane(PlaneXY(0, 0, 0))
option_1_4_planes = Plane([Plane(origin=(-0.002611679333, -0.7707588361, 0.4118038534), x=(0.00338212045, -0.1931022184, 0.9811728158), y=(-0.9998466536, -0.01751197807, 0)), Plane(origin=(-0.7707588361, 0.002611679333, 0.4118038534), x=(-0.1931022184, -0.00338212045, 0.9811728158), y=(-0.01751197807, 0.9998466536, 0)), Plane(origin=(0.002611679333, 0.7707588361, 0.4118038534), x=(-0.00338212045, 0.1931022184, 0.9811728158), y=(0.9998466536, 0.01751197807, 0)), Plane(origin=(0.7707588361, -0.002611679333, 0.4118038534), x=(0.1931022184, 0.00338212045, 0.9811728158), y=(0.01751197807, -0.9998466536, 0))])
option_3_3_planes = Plane([Plane(origin=(-0.001322382405, -0.4694115256, 0.1787689775), x=(0.3398541508, 0.09989969682, 0.9351573166), y=(-0.9398572889, -4.83719427e-05, 0.3415673786)), Plane(origin=(0.4071834972, 0.233560546, 0.1787689775), x=(-0.2564427507, 0.2443724798, 0.9351573166), y=(0.4699705358, -0.8139161022, 0.3415673786)), Plane(origin=(-0.4058611148, 0.2358509795, 0.1787689776), x=(-0.08341140028, -0.3442721775, 0.9351573162), y=(-0.4698867533, -0.8139644737, -0.3415673794))])
option_4_3_planes = Plane([Plane(origin=(0.4071834972, 0.233560546, 0.1787689775), x=(-0.08627357513, -0.05036917882, 0.994997395), y=(-0.5000418324, 0.8660011165, 0.0004817786491)), Plane(origin=(-0.001322382405, -0.4694115256, 0.1787689775), x=(-0.0004842008583, 0.09989969714, 0.994997395), y=(0.9999998828, 4.837152477e-05, 0.0004817786491)), Plane(origin=(-0.4058611148, 0.2358509796, 0.1787689775), x=(0.08675777599, -0.04953051833, 0.994997395), y=(-0.4999580504, -0.866049488, 0.0004817786491))])

rod_radius = Slider(0.01, range=0.01..0.02)
rod_length = Slider(1, range=0.7..1.7)
joint_dist = Slider(0.015, range=0..0.03)

# ----
# positioning 3rd element
_3rd_new_element = BooleanToggle(False)
shift_value_n = Slider(0.4, range=-1..1)
point1 = Slider(0.41, range=0..1)
point2 = Slider(0.38, range=0..1)

# ----
# (1) 'Manual mode' and (2) 'Automatic mode'
# - Select Key
reset_key = Button()

# ----
# (1) New assembly
# 1. Define material parameters:
# 2. Connect one option from suggested to define supports :
supports = Plane(plane)

# ----
# (3) 'Joining branches'
# automatically join two branches, if they are close enough:
# (1) with one rf-unit      (2) with 2 rf-units
# - Select Key Pair
get_joining_options = BooleanToggle(False)
pair_index = Slider(2, range=0..10)

# ----
# (2) 'Automatic mode'
# Calculate selected values based on target geometry,
# other values are taken from Manual mode.
# (Angle is always culculated automatically)
compute = ValueList({"unit_size", "shift_value", "mirror_unit"}, selected="shift_value")

automatic = BooleanToggle(False)
recompute = Button()

# ---- group: Set as default
la_limit = Slider(0.5, range=0..1)

# ----
# Key Actions
key = Slider(22, range=0..80)

make_a_support = Button()
delete_element = Button()
close_connector = Button()

import = Button(ExpressionNormal="True", ExpressionPressed="False")
reset = Button()
add = Button()

# ---- group: set to default
options_num = Slider(100, range=1..300)
distance_weight = Slider(1, range=0..1)
angle_weight = Slider(0.1, range=0.1..1.1)

# ----
panel_9 = Panel("Unload libraries")
bang = Button()
unload = PythonScript(bang=bang)
# ---------- unload: Python ----------
from compas_rhino.utilities.misc import get_tolerance
from compas_rhino.utilities.misc import unload_modules

unload_modules("cdf_2023")
# ---------- end unload ----------

ghpython_script = GhPythonScript(support_geo=support_geo_arch)  # -> out, bbox_z; inputs support_geo: Brep
# ---------- ghpython_script: Python ----------
import Rhino.Geometry as rg
import ghpythonlib.components as gh

pt = rg.Point3d(0, 0, 0)
bbox = gh.BoundingBox(support_geo, gh.XYPlane(pt))[0]
bbox_z = gh.DeconstructBox(bbox)[3]
print type(bbox_z)
#bbox_z_pl = gh.ConstructPlane(
# ---------- end ghpython_script ----------
join = Button()  # disabled
random_key = BooleanToggle(False)
py = PythonScript()  # -> ENVIRONMENT_NAME, HERE, DATA
# ---------- py: Python ----------
import os
import compas_bootstrapper

HERE = os.path.dirname(ghdoc.Path)
DATA = os.path.abspath(os.path.join(HERE, "..", "data"))
ENVIRONMENT_NAME = compas_bootstrapper.ENVIRONMENT_NAME
print(HERE)
print(DATA)
print(ENVIRONMENT_NAME)
# ---------- end py ----------
initial_assembly = GhPythonScript(DATA=py.DATA, filename=filename, import_from_json=import)  # -> out, assembly; inputs import_from_json: Boolean
# ---------- initial_assembly: Python ----------
import os
import json
from scriptcontext import sticky
import Rhino.Geometry as rg
import math

from cdf_2023.assembly import Assembly
from compas_ghpython import draw_frame
from compas.geometry import Translation

if import_from_json:
    PATH = os.path.join(DATA, "assembly", filename)
    assembly = Assembly.from_json(PATH)

    

# create a dictionary to store global value in 
#assembly.globals = {}
#
## define global values
#assembly.globals['rod_radius'] = 0.01
#assembly.globals['rod_length'] = 0.9
#assembly.globals['rf_unit_offset'] = 0.07
#assembly.globals['rf_unit_radius'] = 0.25
#assembly.globals['joint_dist'] = 0.015

#T = Translation.from_vector(assembly.element(40).frame.xaxis*-0.24)
#assembly.element(40).transform(T)
# ---------- end initial_assembly ----------
panel_10 = Panel(ghpython_script.bbox_z)

# ---- group: Platzhalter
bcf_wcs_aa = Plane(Plane(origin=(-1.117452192, -0.4208430177, 0.01980614689), x=(0.5723915496, -0.8199742309, 0.003189757304), y=(0.8199580906, 0.5723429035, -0.009608873971)))
bcf_wcs_ab = Plane(Plane(origin=(0.9896612368, 0.9287122403, 0.007218178072), x=(-0.9475576884, 0.3195482043, -0.004834489242), y=(-0.3195383255, -0.9475694642, -0.002714584304)))
aa_arm = Plane(Plane(origin=(-1.117452192, -0.4208430177, 1.019806147), x=(0.5723915496, -0.8199742309, 0.003189757304), y=(0.8199580906, 0.5723429035, -0.009608873971)))
ab_arm = Plane(Plane(origin=(0.9896612368, 0.9287122403, 1.007218178), x=(-0.9475576884, 0.3195482043, -0.004834489242), y=(-0.3195383255, -0.9475694642, -0.002714584304)))

# ----
unit_size_2 = Slider(0.17, range=0.08..0.34)
offset = Slider(0, range=0..0.1)

panel_11 = Panel(py.ENVIRONMENT_NAME)

# ----
# Preview Mode
mode = Slider(2, range=0..3)
panel_12 = Panel("""Built by Human/Robot
Design Generation
Branches
Sequence""")
list_item = ListItem(List=panel_12, Index=mode, Wrap=True)
panel_13 = Panel(list_item)

gui = GhPythonScript()  # -> out, a; disabled
# ---------- gui: Python ----------
import Rhino.UI
from cdf_2023.assembly.gui import ErrorDialog

ErrorDialog('test').display()
# ---------- end gui ----------

# ----
# 4. Collision detection
collision_check = BooleanToggle(True)

# ---- group: Robot
colour_swatch = ColourSwatch(SwatchColor=RGBA(0, 30, 255, 26))

# ----
status = BooleanToggle(True)
pline_nodes = Curve([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])  # disabled
support_point = Point(Point(3.009321598, 0.9550013688, -0.04836616171))  # disabled
pline_rods = Curve([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])  # disabled

pline_rods_2 = Curve(pline_rods)  # disabled
pline_nodes_2 = Curve(pline_nodes)  # disabled
support_point_2 = Point(support_point)  # disabled
colour_swatch_2 = ColourSwatch(SwatchColor=RGB(184, 144, 88))  # disabled
material_selection_karamba3d = MaterialSelectionKaramba3D(Color=colour_swatch_2, menu=[dropdown(2), dropdown(3)])  # disabled
cross_section_karamba3d = CrossSectionKaramba3D(
    FamilyNameOfCrossSection="DefaultCroSec",
    Color=colour_swatch_2,
    Material=material_selection_karamba3d,
    Diameter_cm=2.5,
    WallThickness_cm=1.25,
    mode="Circular Hollow")  # disabled
line_to_beam_karamba3d = LineToBeamKaramba3D(
    Line=pline_nodes_2,
    Color=colour_swatch_2,
    CrossSection=cross_section_karamba3d,
    New=True,
    Remove=True,
    LimitDistance_m=0.005,
    Bending=True,
    SetBucklingLength=True,
    ToPolylineMaxAngle=0.03,
    ToPolylineTolerance=0.01,
    ToPolylineMaxEdgeLength=0.25)  # -> Element, Points, Info; disabled
line_to_beam_karamba3d_2 = LineToBeamKaramba3D(
    Line=pline_rods_2,
    Color=colour_swatch_2,
    CrossSection=cross_section_karamba3d,
    New=True,
    Remove=True,
    LimitDistance_m=0.005,
    Bending=True,
    SetBucklingLength=True,
    ToPolylineMaxAngle=0.03,
    ToPolylineTolerance=0.01,
    ToPolylineMaxEdgeLength=0.25)  # -> Element, Points, Info; disabled
support_karamba3d = SupportKaramba3D(PosInd=support_point_2, menu=[buttons(on, on, on, on, on, on)])  # disabled
loads_karamba3d = LoadsKaramba3D(Vector=Vector(0, 0, -1), LCase="0", mode="Gravity")  # disabled
assemble_model_karamba3d = AssembleModelKaramba3D(
    Elem=flatten([line_to_beam_karamba3d_2.Element, line_to_beam_karamba3d.Element]),
    Support=support_karamba3d,
    Load=loads_karamba3d,
    LimitDistance_m=0.005)  # -> Model, Info, Mass_kg, CenterOfGravity, LoadCaseNames; disabled
analyze_karamba3d = AnalyzeKaramba3D(Model=assemble_model_karamba3d.Model)  # -> CalculatedModel, MaximumDisplacement_cm, ResultingForceOfGravity_kN, ElasticEnergyChange_kNm; disabled
model_view_karamba3d = ModelViewKaramba3D(Model=analyze_karamba3d.CalculatedModel, ResultFactors=1, ResultCase=-1)  # -> Model, DeformedMesh, DeformedAxes, DeformedModel; disabled
beam_view_karamba3d = BeamViewKaramba3D(Model=model_view_karamba3d.Model)  # -> Model, MeshesOfRenderedBeams, DeformedBeamAxes, LegendColors, LegendTags; disabled

panel_14 = Panel(ColourSwatch(SwatchColor=RGBA(255, 0, 0, 120)))
panel_15 = Panel(ColourSwatch(SwatchColor=RGB(255, 129, 120)))
panel_16 = Panel([ColourSwatch(SwatchColor=RGB(181, 0, 0)), ColourSwatch(SwatchColor=RGB(186, 105, 0)), ColourSwatch(SwatchColor=RGB(70, 128, 0))])

# ----
# 3.     Export                           _
# Export .json
project_name = Panel("TEST_Branches_WeirdStructure")
export_assembly = Button()

# ----
# Capture to bitmap
view_name = Panel("Constrains")
capture = Button()

# ----
# Bake Geometry to Rhino
name_of_the_layer = Panel("Test layer")
bake = Button()

selected_connectors_ranges = BooleanToggle(False)
all_connectors_ranges = BooleanToggle(False)
option_elem_num = Slider(0, range=0..1)

capture_to_bitmap = PythonScript(DATA=py.DATA, viewport_name=view_name, idx=Slider(1, range=0..10), capture=capture)  # -> out, filename_short; inputs idx: Int32
# ---------- capture_to_bitmap: Python ----------
import Rhino
import System.Drawing
from scriptcontext import sticky as st

import sys, os
import ghpythonlib.components as ghcomp
import Grasshopper as gh
from datetime import datetime


ghComp = ghenv.Component
ghDoc = ghComp.OnPingDocument()

def rCommonCap(filePath, viewportName,scaleFactor):
    RhinoDocument = Rhino.RhinoDoc.ActiveDoc
    view = RhinoDocument.Views.Find(viewportName, False)
    vp = view.ActiveViewport
    size = System.Drawing.Size(vp.Size.Width*scaleFactor,vp.Size.Height*scaleFactor)
    capture = view.CaptureToBitmap(size)
    capture.Save(filePath);

now = datetime.now() # current date and time
date_time = now.strftime("%Y-%m-%d_%H-%M")

filename_short = 'capture_{}_{}_{}.png'.format(viewport_name,idx, "{date}")
export_dir = os.path.join(DATA, 'parameter_studies')
if not os.path.isdir(export_dir): os.mkdir(export_dir)
print export_dir
filename = os.path.join(export_dir, 'capture_{}_{}_{}.png'.format(viewport_name,idx,date_time)) 
print filename

zoom = 1

if capture:
    rCommonCap(filename, viewport_name, zoom)
# ---------- end capture_to_bitmap ----------

output_filename = Panel(capture_to_bitmap.filename_short)

# ----
# Create an element object.
mesh = Mesh(<mesh referenced from the Rhino model>)
brep = Brep(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)
brep_2 = Brep(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)
globals = GhPythonScript(
    reset=reset,
    rod_radius=rod_radius,
    rod_length=rod_length,
    rf_unit_offset=offset,
    joint_dist=joint_dist,
    unit_size=unit_size_2)  # -> assembly
# ---------- globals: Python ----------
from cdf_2023.assembly import Assembly

# create assembly
assembly = Assembly()

# create a dictionary to store global value in 
assembly.globals = {}

# define global values
assembly.globals['rod_radius'] = rod_radius
assembly.globals['rod_length'] = rod_length
assembly.globals['rf_unit_offset'] = rf_unit_offset
assembly.globals['rf_unit_radius'] = unit_size
assembly.globals['joint_dist'] = joint_dist
#assembly.globals['foundation_height'] = found_h

assembly.joints = []
print(assembly.globals)
# ---------- end globals ----------
elem_60_def = GhPythonScript(assembly=globals, joint_geo=mesh, cr1=brep, cr2=brep_2)  # -> assembly, elem, joint_elem, joint_elem_mir, joints_planes; inputs joint_geo: Mesh, cr1: Surface, cr2: Surface
# ---------- elem_60_def: Python ----------
import os
import sys
import json
import math

import rhinoscriptsyntax as rs

from compas.geometry import Frame, Plane, Rotation, Vector, Point
from compas.geometry import Circle, Cylinder, Translation, Line, Cone
from compas.artists import Artist
from compas_rhino.conversions import RhinoSurface, RhinoMesh
from cdf_2023.assembly import Element

rf_unit_offset = assembly.globals['rf_unit_offset']
rf_unit_radius = assembly.globals['rf_unit_radius']
radius = assembly.globals['rod_radius']
length = assembly.globals['rod_length']
joint_dist = assembly.globals['joint_dist']

cross_section_plane = Plane.from_frame(Frame.worldYZ())
cross_section = Circle(cross_section_plane, radius)

elem_geo = Cylinder(cross_section, length)

elem = Element.from_shape(elem_geo, Frame.worldXY())
print(elem.frame)

#connector_frame_1 = Frame([(length/2-rf_unit_radius/2-rf_unit_offset),-rf_unit_radius/(2*math.sqrt(3)),0], [1,0,0], [0,1,0])
#connector_frame_2 = Frame([-(length/2-rf_unit_radius/2-rf_unit_offset),rf_unit_radius/(2*math.sqrt(3)),0], [-1,0,0], [0,-1,0])

connector_frame_1 = Frame([0,0,0], [1,0,0], [0,1,0])
connector_frame_2 = Frame([0,0,0], [-1,0,0], [0,-1,0])

#connector_frame_1 = elem.frame.transformed()
#T1 = Translation.from_vector(elem.frame.xaxis*-1)
#T2 = Translation.from_vector(elem.frame.yaxis*-1)
#connector_frame_2 = Frame([0,0,0], [-1,0,0], [0,-1,0])
check_frame = Frame(elem.frame.point,elem.frame.xaxis*-1, elem.frame.yaxis*-1)
print elem.frame.point
print check_frame

#print connector_frame_1
#print connector_frame_2
#print (connector_frame_1.xaxis*-1)

# this angle with "-" will be the mirrored unit
#angle = math.asin((2 * radius + joint_dist)/(math.sqrt(3) * rf_unit_radius))
angle = math.asin((2 * radius + joint_dist)/rf_unit_radius)
print angle

#R1 = Rotation.from_axis_and_angle(connector_frame_1.yaxis, -angle, connector_frame_1.point)
#R2 = Rotation.from_axis_and_angle(connector_frame_2.yaxis, -angle, connector_frame_2.point)

#connector_frame_1.transform(R1)
#connector_frame_2.transform(R2)

elem.connector_frame_1 = connector_frame_1
elem.connector_frame_2 = connector_frame_2

R3 = Rotation.from_axis_and_angle(connector_frame_1.zaxis, math.radians(60), connector_frame_1.point)
R4 = Rotation.from_axis_and_angle(connector_frame_2.zaxis, math.radians(60), connector_frame_2.point)

connector_frame_1_trnsf = connector_frame_1.transformed(R3)
connector_frame_2_trnsf = connector_frame_2.transformed(R4)

T1 = Translation.from_vector(connector_frame_1_trnsf.yaxis*rf_unit_radius)
T2 = Translation.from_vector(connector_frame_2_trnsf.yaxis*rf_unit_radius)

joint_frame_1 = connector_frame_1.transformed(T1)
joint_frame_2 = connector_frame_2.transformed(T2)

R5 = Rotation.from_axis_and_angle(joint_frame_1.zaxis, math.radians(0), joint_frame_1.point)
R6 = Rotation.from_axis_and_angle(joint_frame_2.zaxis, math.radians(0), joint_frame_2.point)

joint_frame_1.transform(R5)
joint_frame_2.transform(R6)

elem.joint_frame_1 = joint_frame_1
elem.joint_frame_2 = joint_frame_2


joints_planes =[]

joints_planes.append(Artist(joint_frame_1).draw())
joints_planes.append(Artist(joint_frame_2).draw())

elem.line = Line([-length/2.,0,0],[length/2.,0,0])

#circle_frame_1 = Frame([-0.34,0,0],[0,0,-1],[0,1,0])
#circle_frame_2 = Frame([0.34,0,0],[0,0,1],[0,1,0])
#circle_1 = Circle(Plane.from_frame(circle_frame_1), 0.5)
#circle_2 = Circle(Plane.from_frame(circle_frame_2), 0.5)
#cone_2 = Cone(circle_1, 0.32)
#cone_1 = Cone(circle_2, 0.32)
#
#elem.connector_range_1 = cone_1
#elem.connector_range_2 = cone_2

#print elem.connector_range_1

source1 = RhinoSurface.from_geometry(cr1)
source2 = RhinoSurface.from_geometry(cr2)

joint_rhino_mesh = RhinoMesh.from_geometry(joint_geo)
joint_compas_mesh = joint_rhino_mesh.to_compas()
joint_elem = Element.from_shape(joint_compas_mesh, Frame.worldXY())

joint_geo_mir = rs.MirrorObject(joint_geo, (0,0,0) , (0,1,0), True)
joint_rhino_mesh = RhinoMesh.from_geometry(joint_geo)
joint_compas_mesh = joint_rhino_mesh.to_compas()
joint_elem_mir = Element.from_shape(joint_compas_mesh, Frame.worldXY())

elem.connector_range_1 = source1.to_compas()
elem.connector_range_2 = source2.to_compas()
# ---------- end elem_60_def ----------

python = GhPythonScript(selection=list_3, new_assembly=elem_60_def.assembly, imported_assembly=initial_assembly.assembly)  # -> out, assembly
# ---------- python: Python ----------
import rhinoscriptsyntax as rs

if selection == 1:
    assembly = new_assembly
else:
    assembly = imported_assembly
    
print assembly.globals
# ---------- end python ----------

initial_configuration = GhPythonScript(assembly=python.assembly, selection=list_3, planes=supports, elem=elem_60_def.elem)  # -> out, assembly; inputs planes: list of Plane
# ---------- initial_configuration: Python ----------
import Rhino.Geometry as rg
import math
from scriptcontext import sticky as st

from compas.geometry import Frame, Vector
from compas.geometry import Rotation, Transformation
from compas.artists import Artist

show_open_connectors = False 

connector_planes = []
support_keys = []


if selection == 1:
    
    radius = assembly.globals['rod_radius']
    length = assembly.globals['rod_length']
    rf_unit_offset = assembly.globals['rf_unit_offset']
    rf_unit_radius = assembly.globals['rf_unit_radius']

    for plane in planes:
        T1 = Transformation.from_frame_to_frame(Frame.worldXY(), Frame(plane.Origin, plane.XAxis, plane.YAxis))
        new_elem = elem.transformed(T1)
        
        R1 = Rotation.from_axis_and_angle(new_elem.frame.zaxis, math.radians(120), [0,0,0])
        R2 = Rotation.from_axis_and_angle(new_elem.frame.zaxis, math.radians(240), [0,0,0])
        
        # set connector state
        new_elem.connector_1_state = True
        new_elem.connector_2_state = False
    
        # add element to assembly
        assembly.add_element(new_elem, 
                             placed_by='human', 
                             robot_name='AA',
                             robot_AA_base_frame=Frame.worldXY(),
                             robot_AB_base_frame=Frame.worldXY(),
                             is_support=True,
                             is_built=True,
                             is_planned=True)
            
    # show open connectors
    if show_open_connectors:
        for key, connectors in assembly.connectors(state='open'):
            for connector in connectors:
                connector_planes.append(Artist(connector).draw())
    
#    for key, element in assembly.elements():
#        assembly.network.node_attribute(key, 'is_support', True)
        
    #assembly.support_keys = support_keys
# ---------- end initial_configuration ----------

j_r = GhPythonScript(assembly=globals)  # -> joint_r; disabled
# ---------- j_r: Python ----------
from cdf_2023.assembly import Assembly

joint_r = assembly.globals['rod_radius']*2 + assembly.globals['joint_dist']/2
# ---------- end j_r ----------

update = GhPythonScript(trigger=[join, close_connector, delete_element, make_a_support])  # -> update; inputs trigger: list
# ---------- update: Python ----------
update = False

for value in trigger:
    if value:
        update = True

print update
# ---------- end update ----------

# ----
# Stability vis
stability_feedback = BooleanToggle(False)

settings_parameters = GhPythonScript(
    assembly=initial_configuration.assembly,
    mode=list,
    automatic=automatic,
    next_element=next,
    prev_element=previous,
    get_key_by_index=get_key_by_index,
    key_at_index=key_at_index,
    selected_angle=angle,
    selected_shift_value=shift_value,
    selected_unit_size=unit_size,
    selected_mirror_unit=mirror_unit,
    reset_key=reset_key,
    compute=recompute,
    random_options_num=options_num,
    generate_random_key=random_key,
    random_params=compute,
    target_geo=guiding_geo,
    support_geo=flatten(support_geo_arch),
    distance_weight=distance_weight,
    angle_weight=angle_weight,
    robot_AA_base_plane=bcf_wcs_aa,
    ur_arm_AA_base_plane=aa_arm,
    robot_AB_base_plane=bcf_wcs_ab,
    ur_arm_AB_base_plane=ab_arm,
    show_resultant=stability_feedback,
    collision=collision_check,
    la_limit=la_limit,
    get_joining_options=get_joining_options,
    update=update)  # -> out, assembly, selected_mode, selected_key, current_key, current_angle, current_shift_value, current_mirror_unit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; inputs key_at_index: Int32, random_options_num: Int32, generate_random_key: Boolean, random_params: list, target_geo: Mesh, support_geo: Brep, robot_AA_base_plane: Plane
# ---------- settings_parameters: Python ----------
import math
import random
import System.Threading.Tasks as tasks
from scriptcontext import sticky as st
import Rhino.Geometry as rg
import rhinoscriptsyntax as rs

import ghpythonlib.components as ghcomp

from compas.geometry import Frame, Box, Point, Plane
from compas.geometry import Vector, Translation, angle_vectors, Rotation
from compas.artists import Artist
from compas.topology import connected_components
from compas_rhino.conversions import plane_to_compas_frame

import Rhino.UI
from cdf_2023.assembly.gui import ErrorDialog

import time
import sys


msg = []

#print 'start'

filter_keys = False

all_options = []
distances = []
vectors = []
origins = []
filtered_keys = []

stability_check = {0:'global', 1:'local', 2:'no_stability_check'}
stability_criteria = 1 # pre-definiert
assembly.stability_check = stability_check[stability_criteria]
print assembly.stability_check
assembly.support = support_geo
assembly.target_geo = target_geo

#assembly.globals['rf_unit_radius'] = unit_size

fitness_table = []

total_elements = assembly.network.number_of_nodes()
#print total_elements

shift = 0
set_random_shift = False
parallel = True
only_grow_top = True
top_keys = 30
iterations = 1


def get_key(open_keys):
    if "key" in random_params:
        random_key = random.choice(open_keys)
    else:
        random_key = selected_key
    print random_key
    #if not generate_random_key:
    #if selected_key in open_keys and not generate_random_key:
        #random_key = key_at_index
        #random_key = selected_key
    #else:
        #random_key = random.choice(open_keys)
    #print random_key
    return random_key


def generate_option(support_centroid, fitness_table, open_keys, cp=None):
    # The calculation order was adapted to the ratio of elements which do not pass the tests. There is a high properbility that the output value test is failed.
    # Therefore, this test is perofrmed first and we immeditely return if it failed and do not do any further calculations.
    
    # pick a key
    option_key = get_key(open_keys)
    #print option_key
    # generate a random angle and shift
    random_angle = random.randint(0, 90) * 4
    random_shift = selected_shift_value if not "shift_value" in random_params else round(random.uniform(0, 0.15),2)
    random_bool_mirror_unit = selected_mirror_unit if not "mirror_unit" in random_params else bool(random.getrandbits(1))
    random_unit_size = selected_unit_size if not "unit_size" in random_params else round(random.uniform(0.08, 0.20),2)
    #print ('unit_size', random_unit_size)


    # get the current option elements of the random key with the given angle and shift value
    random_option_elems = assembly.element(option_key).current_option_elements(assembly, random_bool_mirror_unit, random_unit_size, random_angle, random_shift)
    #print("option elems", random_option_elems)

    # calculate the orientation to the target geometry and the distance to the target geometry
    elem = random_option_elems[0]
    #output_value, vector1 = assembly.orientation_to_target_geo(option_key, random_angle,
    #                                                           assembly.target_geo)
    output_value, vector1 = assembly.orientation_to_target_geo(option_key, random_angle,
                                                               assembly.target_geo)

    if not output_value > 80.0:
        return

    # check if the random option elements collide with anything
    coll, d, d_elems, line = assembly.collision_check(option_key, random_option_elems, tolerance=-0.001)
    #print collsion, d
    if coll:
        #print collision
        return

    # check if all the random option elements are away from the ground
    random_elems_frames = [element.frame for element in random_option_elems]
    if not all(frame.point.z > 0.2 for frame in random_elems_frames):
        return

    distance, vector2 = assembly.distance_to_target_geo(option_key, random_angle, assembly.target_geo)

    if not distance < 1:
        return

    #if assembly.stability_check == 'global':
    # calculate global equilibrium and the resultant force of the random option elements
    global_equilibrium, resultant, msg = assembly.calculate_global_equilibrium(assembly.support,
                                                                               random_option_elems, radius=0.01)

    if not global_equilibrium:
        return

    # calculate the distance between the resultant force and the surface area centroid of the support
    dist = rs.Distance(rs.CurveEndPoint(resultant), support_centroid)

    # calculate the score of the random option elements
    score = output_value * angle_weight + distance * distance_weight + 1 / dist

#    elif assembly.stability_check == 'local':
#        cp_with_random = cp + [Artist(random_option_elem.line.midpoint).draw() for random_option_elem in
#                               random_option_elems]
#        sp = [Artist(assembly.element(0).line.end).draw()]
#
#        # calculate local equilibrium (level arm) and the resultant point of the random option elements
#        lever_arm, resultant_point = assembly.calculate_local_equilibrium_in_a_branch(cp_with_random, sp,
#                                                                          assembly.globals['rod_length'],
#                                                                          assembly.globals['rod_radius'])
#
#        score = output_value * angle_weight + 1 / distance * distance_weight + 1 / lever_arm[0]
#
#    elif assembly.stability_check == 'no_stability_check':
#        score = output_value * angle_weight + 1 / distance * distance_weight

    # create a fitness table the random values and corresponding scores
    fitness_table.append([option_key, random_angle, random_unit_size, random_shift, random_bool_mirror_unit, score])

def get_option_with_highest_score():
    computed_values = []
    msgs = []
    if assembly.stability_check == 'local':
        cp = [Artist(assembly.element(bkey).line.midpoint).draw() for bkey, element in assembly.elements()]
    else:
        cp = None

    start_time_loop = time.time()  # timestamp

    for i in range(iterations):
        fitness_table = []
        # precompute the keys of open connectors
        #open_keys = [key for key, frames in assembly.connectors('open') if frames != []]
        open_keys = open_connectors_keys
        #print(open_keys)
        
        
        # To ensure that the algorithm does not lose efficiency when growing along a geometry due to the increasing options, we only choose between the top keys
        if len(open_keys) > top_keys:
            open_keys = open_keys[len(open_keys)-top_keys:]
            
        #print open_keys

        # precompute the surface area centroid of the support
        support_centroid = rs.SurfaceAreaCentroid(assembly.support)[0]

        # Here we leverage multiple cores at once. If the computer has more then one core this speeds of significantly
        if parallel:
            #print 'yes'
            #tasks.Parallel.ForEach(xrange(random_options_num), lambda i: generate_option(support_centroid, fitness_table, open_keys, cp=cp))
        #else:
            for i in range(random_options_num):
                generate_option(support_centroid, fitness_table, open_keys, cp=cp)

        fitness_table_sorted = sorted(fitness_table, key=lambda x: x[5], reverse=True)
        
        msgs.append('{}. ITERATION:'.format(i))

        if fitness_table_sorted:
            msgs.append(
                'Element key {} with the highest score: {}'.format(fitness_table_sorted[0][0], fitness_table_sorted[0][5]))

            best_key = fitness_table_sorted[0][0]
            best_angle = fitness_table_sorted[0][1]
            best_unit_size = fitness_table_sorted[0][2]
            best_shift_value = fitness_table_sorted[0][3]
            best_mirror_unit = fitness_table_sorted[0][4]

            computed_values = {'key': best_key, 'angle': best_angle, 'unit_size': best_unit_size, 'shift_value': best_shift_value, "mirror_unit": best_mirror_unit}
            
        else:
            msgs.append('No elements found which fit to the assembly. Increase the number of options or try finding a fit manually.')
    #print("--- Total time %s seconds ---" % (time.time() - start_time_loop))
    # print the messages
    for msg in msgs:
        print(msg)
    
    #print computed_values
    return computed_values

# all keys
key_index = assembly.network.key_index()
index_keys = [key_index[key] for key in assembly.network.nodes()]
keys = [key for key in assembly.network.nodes()]
#print index_keys
#print keys
all_elements = [assembly.element(key) for key in keys]


#############################################################################
## ALL OPEN CONNECTORS KEYS
#############################################################################

open_connectors_keys = [key for key, frames in assembly.connectors(state='open')]
#print open_connectors_keys
assembly.open_connectors_keys = open_connectors_keys

#############################################################################
## Filter key according to current robot location
#############################################################################

assembly.robot_AA_base_plane = robot_AA_base_plane
assembly.ur_arm_AA_base_plane = ur_arm_AA_base_plane
assembly.robot_AB_base_plane = robot_AB_base_plane
assembly.ur_arm_AB_base_plane = ur_arm_AB_base_plane

if filter_keys:
    for key, element in assembly.elements():
        if key in open_connectors_keys:
            distance1 = element.frame.point.distance_to_point(ur_arm_AA_base_plane.Origin)
            distance2 = element.frame.point.distance_to_point(ur_arm_AB_base_plane.Origin)
    #        print distance
    #        print distance, key
    #        print distance2, key
            if distance1 < 1.25 or distance2 < 1.25:
                filtered_keys.append(key)
    open_connectors_keys = filtered_keys


#############################################################################
## SELECT A KEY MANUALLY
#############################################################################

guid = str(ghenv.Component.InstanceGuid)
#print guid
element_key = "elem_" + guid
#print element_key
#print(st)

#print(open_connectors_keys)
#print(st[element_key])
if next_element:
    if get_key_by_index:
        ErrorDialog('Get_key_by_index is tunrned on. Set it to FALSE to proceed').display()
        #print("Error:TRUE")
        #print("Get_key_by_index is tunrned on. Set it to FALSE to proceed")
    if st[element_key] < len(open_connectors_keys) - 1:
        #print 'here'
        st[element_key] += 1

if prev_element:
    if get_key_by_index:
        ErrorDialog('Get_key_by_index is tunrned on. Set it to FALSE to proceed').display()
        #print("Error:TRUE")
        #print("Get_key_by_index is tunrned on. Set it to FALSE to proceed")
    if st[element_key] <= len(open_connectors_keys) - 1:
        st[element_key] -= 1

    if st[element_key] < 1:
        st[element_key] = 0

if element_key not in st or None:
    st[element_key] = 0

if reset_key:
    st[element_key] = 0

#############################################################################
## OPEN CONNECTORS
#############################################################################

selected_mode = "(1) Manual" # set as default


#selected_mode = "(1) Manual" if mode == 0 else "(2) Automatic" if mode == 1 else "(3) Join branches"
if get_joining_options:
    selected_mode = "(3) Join branches"
if automatic:
    selected_mode = "(2) Automatic"

if get_key_by_index and (selected_mode == "(1) Manual" or selected_mode == "(2) Automatic"):
    selected_key = key_at_index

if not get_key_by_index and (selected_mode == "(1) Manual" or selected_mode == "(2) Automatic"):
    if len(open_connectors_keys) == 0: 
        ErrorDialog('No open connectors available! Suggestion: RESET KEY!').display()
        
#        print("Error:TRUE")
#        print("No open connectors available!")
#        #msg.append ("!!! NO OPEN CONNECTORS AVAILABLE !!!")
#        #msg.append ("Suggestion: RESET KEY!")
#        #selected_key = 0
#        #print("!!! NO OPEN CONNECTORS AVAILABLE !!!")
#        print("Suggestion: RESET KEY!")
        
    else:
        try:
            selected_key = open_connectors_keys[st[element_key]]
        except:
            ErrorDialog('Index out of range. Reset the key').display()
            
#            error = "True"
#            error_text = "Index out of range. Reset the key"
#            print("Error:TRUE")
#            print(error_text)


#################### Go to selected if get_key_by_index is not in open key
"""if selected_key not in open_connectors_keys:
    #print("ERROR:True")
    #print("Probably key_by_index is turned on. Set value to False")
    current_key = open_connectors_keys[0]
    selected_key = open_connectors_keys[0]"""

    
#if 'selected_key':
    #print "Selected key:", selected_key
"""current_key = selected_key

selected_mode = "(1) Manual" if mode == 0 else "(2) Automatic" if mode == 1 else "(3) Join branches"

if not get_key_by_index and selected_mode == "(1) Manual":
    if len(open_connectors_keys) == 0: 
        #selected_key = 0
        print("!!! NO OPEN CONNECTORS AVAILABLE !!!")
        print("Suggestion: RESET KEY!")
        
    else:
        selected_key = open_connectors_keys[st[element_key]]

if get_key_by_index and selected_mode == "(1) Manual":
    selected_key = key_at_index
    
if selected_mode == "(2) Automatic":
    selected_key = open_connectors_keys[st[element_key]]
    if not generate_random_key:
        current_key = selected_key
    
if 'selected_key':
    print "Selected key:", selected_key
"""

#############################################################################
## GET PARAMETERS
#############################################################################
params = 'params'

if params not in st or st['params'] is None:
    st[params] = {'key' : selected_key, 'angle': 0,  'unit_size': 0.15,'shift_value': 0, 'mirror_unit': False}


if selected_mode == "(1) Manual" or selected_mode == "(3) Join branches":
    st[params] = {'key' : selected_key, 'angle': selected_angle, 'unit_size': selected_unit_size, 'shift_value': selected_shift_value, 'mirror_unit': selected_mirror_unit}


print 'compute', compute
if selected_mode == "(2) Automatic":
#if compute:
    try: 
        st[params]['key'] == selected_key 
    except:
        ErrorDialog('Probably the target geometry is too far away from the current key. Firstly return back to Manual Mode').display()

#        error = "True"
#        error_text = "Probably the target geometry is too far away from the current key. Firstly return back to Manual Mode"
#        print("Error:TRUE")
#        print(error_text)
#        msg.append('Probably the target geometry is too far away from the current key')
        
    #print st[params]
    if compute:
        st[params] = get_option_with_highest_score()
        #print st[params]
#elif selected_mode == "(1) Manual" or selected_mode == "(3) Join branches":
#    st[params] = {'key' : selected_key, 'angle': selected_angle, 'unit_size': selected_unit_size, 'shift_value': selected_shift_value, 'mirror_unit': selected_mirror_unit}

parameters = st[params]

print(msg)

#print 'Current parameters:', parameters

current_key = parameters['key']
current_angle = parameters['angle']
current_unit_size = parameters['unit_size']
current_shift_value = parameters['shift_value']
current_mirror_unit = parameters['mirror_unit']


#print 'Current key:', current_key

if current_key not in open_connectors_keys:
    #print("ERROR:True")
    #print("Probably key_by_index is turned on. Set value to False")
    current_key = open_connectors_keys[0]
    selected_key = open_connectors_keys[0]
if current_key != None:
    selected_elem = assembly.network.node[current_key]['element']

assembly.parameters = parameters
#try:
#   .... use of selected_key....
#expect:
#   print("selected_key does not exist, but no problem.)
#   

#############################################################################
## DISPLAY SELECTED CONNECTOR
#############################################################################

if current_key != None and current_key in open_connectors_keys:

    selected_connector_frame = assembly.element(current_key).connectors(state='open')[0]
    #selected_connector_frame

    R = Rotation.from_axis_and_angle(selected_elem.frame.xaxis, math.radians(current_angle), selected_elem.frame.point)
    T = Translation.from_vector(selected_elem.frame.xaxis * selected_shift_value)
    
    selected_connector_frame_copy = selected_connector_frame.transformed(R)
    selected_connector_frame_copy.transform(T)
    selected_connector_plane = Artist(selected_connector_frame_copy).draw()
    
    elem_options = assembly.element(current_key).current_option_elements(assembly, current_mirror_unit, current_unit_size, current_angle, current_shift_value)
    #assembly.elem_options = elem_options

if elem_options != None:
    assembly.elem_options = elem_options

#############################################################################
## COLLISION CHECK
#############################################################################

# check if the selected option elements collide with anything
#if selected_mode == "(2) Automatic" or selected_mode == "(1) Manual":
#    if collision and total_elements > 1:
#        is_colliding, dist, dist_elem, short_line = assembly.collision_check(current_key, elem_options, tolerance=-0.001)


#############################################################################
## GLOBAL/LOCAL EQUILIBRIUM CHECK
#############################################################################

"""if selected_mode == "(2) Automatic" or selected_mode == "(1) Manual":
    lever_arm_branches = []
    resultant_branches = []
    resultant = []
    
    if stability_criteria == 0:
        # calculate global equilibrium and the resultant force of the selected option elements
        equlibrium, resultant_line, stability_feedback = assembly.calculate_global_equilibrium(support_geo, elem_options, radius=0.01)
        resultant_line = rs.coercecurve(resultant_line)    
        print resultant_line
        
    elif stability_criteria == 1:
        
        # Identify the connected elements (branches) in the assembly.
        branches = connected_components(assembly.network.adjacency)
        
        stability_feedback = []
        # calculate stability for all branches without robot support
        lever_arm_branches, resultant_branches, sp_branches, sp_planar_branches, stability_feedback  = assembly.calculate_local_equilibrium_in_all_branches(current_key, elem_options, la_limit)
        
        #for i, lever_arm in enumerate(lever_arm_branches):
        #    stability_feedback.append("Lever arm of branch {} is {len:.3f}m long.".format(i, len=float(lever_arm)))
    else:
        stability_feedback = "No stability criteria selected."
        
    #print lever_arm_branches
    #print resultant_branches
    print sp_planar_branches
    resultant_pt = []
    resultant_colors = []
    
    if show_resultant:
        if stability_criteria == 0:
            cone_base_plane = rg.Plane(resultant_line.PointAt(0), rg.Vector3d.ZAxis*-1)
            #cone_base_plane.Translate(rg.Vector3d.ZAxis*0.136)
            resultant.append(rg.Cone(cone_base_plane,-0.4, 0.02))
            resultant_pt.append(cone_base_plane)
        else:
            la_text = []
            for resultant_line, lever_arm in zip(resultant_branches, lever_arm_branches):
                cone_base_plane = rg.Plane(resultant_line.PointAt(0), rg.Vector3d.ZAxis*-1)
                #cone_base_plane.Translate(rg.Vector3d.ZAxis*0.136)
                if lever_arm != 0:
                    resultant.append(rg.Circle(cone_base_plane,lever_arm))
                    la_text.append('la= {len:.3f}m'.format(len=float(lever_arm)))
                else:
                    resultant.append(rg.Circle(cone_base_plane,0.01))
                    la_text.append('')
                
                resultant_pt.append(cone_base_plane)
                
                if lever_arm > la_limit:
                    resultant_colors.append('255,13,0 (103)')
                else:
                    resultant_colors.append('70,128,0 (103)')"""


#############################################################################
## DISTANCE TO INPUT GEO
#############################################################################

distance, shortest_vector_1 = assembly.distance_to_target_geo(current_key, current_angle, target_geo)

# Vector Display
vectors.append(shortest_vector_1)
origins.append(selected_connector_plane.Origin)

target_geo_feedback = ['Key {}: Distance to target geometry: {dist:.2f}m'. format(current_key, dist=distance)]

#############################################################################
## ORIENTATION TO INPUT GEO
#############################################################################

output_value, shortest_vector_2 = assembly.orientation_to_target_geo(current_key, current_angle, target_geo)

# Vector Dispaly
vectors.append(rg.Vector3d(shortest_vector_2.x,shortest_vector_2.y,shortest_vector_2.z))
origins.append(selected_connector_plane.Origin)

target_geo_feedback.append('Key {}: Orientation to target geometry: {len:.2f}%'. format(current_key, len=output_value))

#############################################################################
## LAST ADDED KEYS
#############################################################################

new_keys = keys[-2:]
assembly.last_added = new_keys
#print 'Last added keys:', ', '.join(map(str, new_keys))

#############################################################################
## Close connector
#############################################################################


"""if close_connector:
    if selected_key in open_connectors_keys:
        print ("closed")
        assembly.element(selected_key).connector_1_state = False
        assembly.element(selected_key).connector_2_state = False
    else:
        print("Error:TRUE")
        print("Not possible to close this connector.")
        """

#for key, element in assembly.elements():
#    if element.frame.point.z < 2.57:
#        assembly.element(key).connector_1_state = False
#        assembly.element(key).connector_2_state = False

assembly.open_connectors_keys = open_connectors_keys

robot_AA_base_frame = plane_to_compas_frame(robot_AA_base_plane)
robot_AB_base_frame = plane_to_compas_frame(robot_AB_base_plane)

for key, element in assembly.elements():

    assembly.network.node_attribute(key, 'robot_AA_base_frame', robot_AA_base_frame)
    assembly.network.node_attribute(key, 'robot_AB_base_frame', robot_AB_base_frame)

#assembly.element(13).connector_2_state = True
#assembly.element(13).connector_1_state = False
# ---------- end settings_parameters ----------
stats = GhPythonScript(assembly=settings_parameters.assembly)  # -> out
# ---------- stats: Python ----------
from compas.topology import connected_components
from compas_rhino.conversions import frame_to_rhino


# Identify the connected elements (branches) in the assembly.
branches = connected_components(assembly.network.adjacency)


#print '-------------------- ELEMENTS --------------------'
total_elements = assembly.network.number_of_nodes()
print "Total ELEMENTS:", total_elements


#print '--------------------- JOINTS ----------------------'
total_joints = assembly.network.number_of_edges()
print "Total JOINTS:", total_joints
# ---------- end stats ----------
vdis = VectorDisplay(Anchor=settings_parameters.origins, Vector=settings_parameters.vectors)

sel_key = Panel(settings_parameters.selected_key)

# ----
# Current parameters
key_2 = Panel(settings_parameters.current_key)
angle_2 = Panel(settings_parameters.current_angle)
shift_value_2 = Panel(settings_parameters.current_shift_value)
unit_size_3 = Panel(settings_parameters.current_unit_size)
mirrored = Panel(settings_parameters.current_mirror_unit)

# ----
# Current mode
panel_17 = Panel(settings_parameters.selected_mode)

# ----
# Status bar
panel_18 = Panel(stats)

joining_branches_new = GhPythonScript(
    assembly=settings_parameters.assembly,
    elem=elem_60_def.elem,
    get_joining_options=get_joining_options,
    joining_case=list_2,
    show_new_element=_3rd_new_element,
    pair_index=pair_index,
    point_on_intersection=number_slider,
    point1=point1,
    point2=point2,
    current_key=settings_parameters.current_key,
    shift_value=settings_parameters.current_shift_value,
    shift_value_n=shift_value_n,
    join_branches=join,
    mirror_unit=settings_parameters.current_mirror_unit,
    unit_size=settings_parameters.current_unit_size,
    option_elem_num=option_elem_num,
    show_all_con_ranges=all_connectors_ranges,
    show_sel_con_ranges=selected_connectors_ranges)  # -> out, assembly, elem_line1, elem_line2, new_elem_mesh, intersections, angle1, angle2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; inputs pair_index: Int32, option_elem_num: Int32; disabled
# ---------- joining_branches_new: Python ----------
import math
import rhinoscriptsyntax as rs
import Rhino.Geometry as rg

from compas.geometry import Point, Vector, Frame, Plane, Vector, Line, Transformation, Rotation, Translation
from compas.geometry import angle_vectors, closest_point_on_line, intersection_line_plane, angles_points
from compas.artists import Artist
from compas_rhino.conversions import line_to_rhino_curve, point_to_compas, point_to_rhino, plane_to_compas_frame, cylinder_to_rhino

import ghpythonlib.components as gh

connector_ranges = []
connectors_pairs = []
intersections = []

G_connectors_ranges = []

#option_elem_num # number of the element in the generated option which is touching other element
#                       # 0 - by robot, 1 - by human

epsilon = 0.0000001

open_connectors_keys = [key for key, frames in assembly.connectors(state='open')]

robot_AA_base_frame = plane_to_compas_frame(assembly.robot_AA_base_plane)
robot_AB_base_frame = plane_to_compas_frame(assembly.robot_AB_base_plane)

def generate_connector_range(key):
    elem = assembly.element(key)

    # generate option based on input parameters
    elem_options = elem.current_option_elements(assembly, mirror_unit, unit_size, 0, shift_value)
    selected_option = Artist(elem_options[option_elem_num].line).draw()
    
    rod_length =  assembly.globals['rod_length']
    l1 = math.sqrt(3)*unit_size + shift_value
    # find the point depending on the open connector
    if elem.connector_1_state == True:
        n = 0.0
        l1 = rod_length - l1 - 0.05
    if elem.connector_2_state == True:
        n = 1.0
        l1 = l1 + 0.05
    
    start_pt = rg.Line.PointAt(selected_option, n)
    end_pt = rg.Line.PointAtLength(selected_option, l1)
    
    # create connector range based on line
    section_line = rg.Line(start_pt, end_pt)
    rot_axis = Artist(assembly.element(key).line).draw()
    connector_range = rg.RevSurface.Create(section_line, rot_axis)
    
    return connector_range

open_connectors_keys = [key for key, frames in assembly.connectors(state='open')]
open_connectors_ranges = []
#print open_connectors_keys



#############################################################################
## CASE 1
#############################################################################

if get_joining_options and joining_case == 0:
    
    # Generate connector ranges based on input parameters for all open connectors
    for key in open_connectors_keys:
        open_connectors_ranges.append([key, generate_connector_range(key)])
    
    
    for i in range(len(open_connectors_ranges)):
        for open_connectors_key in open_connectors_keys:
            intersection = rg.Intersect.Intersection.CurveSurface(line_to_rhino_curve(assembly.element(open_connectors_key).line), open_connectors_ranges[i][1], 0.001, 0.001)
            if intersection:
                for c in intersection:
                    intersections.append(c.PointA)
                connectors_pairs.append((open_connectors_ranges[i][0], open_connectors_key))
    
    #print connectors_pairs
    #print len(intersection_curves)
    
    if len(connectors_pairs) != 0:
        intersection_point = intersections[pair_index]
        selected_keys_pair = [pkey for pkey in connectors_pairs[pair_index]]
        connectors_pairs_list = [key for pair in connectors_pairs for key in pair]
        
        #print intersection_point
        #print 'selected pair', selected_keys_pair
        #print connectors_pairs_list
    
        assembly.selected_keys_pair = [selected_keys_pair[0]]
        print selected_keys_pair[0]
        assembly.connectors_pairs_list = connectors_pairs_list
        assembly.selected_connectors_ranges_intersection_point = intersection_point
        
        # Convert in COMPAS Point
        cp = point_to_compas(intersection_point)
        
        # Compute angle for option pair
        open_connector_elem_1 = assembly.element(selected_keys_pair[0])
        #print open_connector_elem_1
        cutting_plane_origin_1 = closest_point_on_line(cp, open_connector_elem_1.line)
        cutting_plane_1 = Plane(cutting_plane_origin_1, open_connector_elem_1.line.vector)
        plane_pt = Artist(cutting_plane_1.point).draw()
        plane_v = Artist(cutting_plane_1.normal).draw()
        line_int = Artist(open_connector_elem_1.current_option_elements(assembly, mirror_unit, unit_size, 0, shift_value)[option_elem_num].line).draw()
        intersection_point_1 = intersection_line_plane(open_connector_elem_1.current_option_elements(assembly, mirror_unit, unit_size, 0, shift_value)[option_elem_num].line, cutting_plane_1)

        angles1 = angles_points(cutting_plane_origin_1, intersection_point_1, cp, deg=True)
        #print 'list deg', angles1
        angle1 = angles1[1] # not the smallest angle
        #print 'around', angle1
        
        if open_connector_elem_1.connector_1_state == True:
            #print "Connector 1"
            angle1 = 360-angle1
        
        
        current_option = assembly.element(selected_keys_pair[0]).current_option_elements(assembly, mirror_unit, unit_size, angle1, shift_value)
    
        rot_line = Artist(assembly.element(selected_keys_pair[0]).line).draw()
        start_p = rot_line.From
        rot_axis = rg.Vector3d(rot_line.From - rot_line.To)
        rot_point = Artist(assembly.element(selected_keys_pair[0]).frame.point).draw()
        elem_line1 = Artist(current_option[option_elem_num].line).draw()
        elem_line2 = Artist(assembly.element(selected_keys_pair[1]).line).draw()
        rot_dir = 1
        step = 0.5
    
        tol_angle = assembly.get_rot_angle(step, rot_axis, rot_point, elem_line1, elem_line2, rot_dir, epsilon)
        angle1 += tol_angle
        #print 'with tol', angle1
        #angle1 = 360-angle1
        
        current_option_rotated = assembly.element(selected_keys_pair[0]).current_option_elements(assembly, mirror_unit, unit_size, angle1, shift_value)
        
        if show_new_element:
            #print 'new_elem', selected_keys_pair[1], current_option_rotated[option_elem_num], point1, point2, shift_value_n, epsilon
            new_elem = assembly.add_third_element(elem, assembly.element(selected_keys_pair[1]), current_option_rotated[option_elem_num], point1, point2, shift_value_n, epsilon)
            #print type(new_elem)
            new_elem_mesh = Artist(new_elem.mesh).draw() 
            new_elem_mesh = cylinder_to_rhino(new_elem._source)
        
        if join_branches:
            msgs = []
            
            # close a reciprocal frame unit with the option elements with the highest score
            assembly.join_branches(selected_keys_pair, mirror_unit, angle1, shift_value, unit_size, new_elem, option_elem_num, on_ground=False)
    
            msgs.append('--- New element added to assembly ---')
            
            for msg in msgs:
                print(msg)
    else:
        assembly.selected_keys_pair = []
        assembly.connectors_pairs_list = []
        assembly.selected_connectors_ranges_intersection_point = []

#############################################################################
## CASE 2
#############################################################################

if get_joining_options and joining_case == 1:
    
    # Generate connector ranges based on input parameters for all open connectors
    for key in open_connectors_keys:
        open_connectors_ranges.append([key, generate_connector_range(key)])
    
    # geometry for visualisation
    if show_all_con_ranges:
        G_connectors_ranges = [geo for key, geo in open_connectors_ranges]
    #if show_sel_con_ranges:
        #G_connectors_ranges = open_connectors_ranges[selected_keys_pair[0]][1]
    #print connectors_pairs
    
    """for i in range(len(open_connectors_ranges)):
        for open_connectors_key in open_connectors_keys:
            intersection = rg.Intersect.Intersection.CurveSurface(line_to_rhino_curve(assembly.element(open_connectors_key).line), open_connectors_ranges[i][1], 0.001, 0.001)
            if intersection:
                for c in intersection:
                    intersections.append(c.PointA)
                connectors_pairs.append((open_connectors_ranges[i][0], open_connectors_key))"""

    for i in range(len(open_connectors_ranges)):
        for j in range(i + 1, len(open_connectors_ranges)):
            is_intersecting, intersection, p_array = rg.Intersect.Intersection.SurfaceSurface(open_connectors_ranges[i][1], open_connectors_ranges[j][1], 0.001)
            if len(intersection) > 0:
                #print intersection
                joined_curve = rg.Curve.JoinCurves(intersection)
                connectors_pairs.append((open_connectors_ranges[i][0], open_connectors_ranges[j][0]))
                #print joined_curve
                intersections.append(joined_curve[0])
                
        
    #print 'Following element pair(s) {} could be joined.'.format(connectors_pairs)
    #print intersections
    
    if len(connectors_pairs) != 0:
        curve_param = intersections[pair_index].NormalizedLengthParameter(point_on_intersection)
        intersection_point = intersections[pair_index].PointAt(curve_param[1])
        
        selected_keys_pair = [pkey for pkey in connectors_pairs[pair_index]]
        connectors_pairs_list = [key for pair in connectors_pairs for key in pair]
    
        assembly.selected_keys_pair = selected_keys_pair
        print selected_keys_pair
        assembly.connectors_pairs_list = connectors_pairs_list
        assembly.selected_connectors_ranges_intersection_point = intersection_point

        # Convert to compas point
        cp = point_to_compas(intersection_point)
        
        # Compute angle for first option pair
        open_connector_elem1 = assembly.element(selected_keys_pair[0])
        cutting_plane_origin1 = closest_point_on_line(cp, open_connector_elem1.line)
        cutting_plane1 = Plane(cutting_plane_origin1, open_connector_elem1.line.vector)
        option_elem1 = open_connector_elem1.current_option_elements(assembly, mirror_unit, unit_size, 0, 0)[1]
        intersection_point1 = intersection_line_plane(option_elem1.line, cutting_plane1)
        
        angle1 = angles_points(cutting_plane_origin1, intersection_point1, cp) 
        angle1 = math.degrees(angle1[0])
        
        # Compute angle for second option pair
        open_connector_elem2 = assembly.element(selected_keys_pair[1])
        cutting_plane_origin2 = closest_point_on_line(cp, open_connector_elem2.line)
        cutting_plane2 = Plane(cutting_plane_origin2, open_connector_elem2.line.vector)
        option_elem2 = open_connector_elem2.current_option_elements(assembly, mirror_unit, unit_size, 0, 0)[1]
        intersection_point2 = intersection_line_plane(option_elem2.line, cutting_plane2)
        
        angle2 = angles_points(cutting_plane_origin2, intersection_point2, cp)
        angle2 = math.degrees(angle2[0])
        
        rot_line = Artist(open_connector_elem1.line).draw()
        start_p = rot_line.From
        rot_axis = rg.Vector3d(rot_line.From - rot_line.To)
        rot_point = Artist(assembly.element(selected_keys_pair[0]).frame.point).draw()
        elem_line1 = Artist(option_elem1.line).draw()
        elem_line2 = Artist(option_elem2.line).draw()

        rot_dir = 1
        step = 6.0

        tol_angle = assembly.get_rot_angle(step, rot_axis, rot_point, elem_line1, elem_line2, rot_dir, epsilon)
        angle1 += tol_angle
        
        option1_rotated = assembly.element(selected_keys_pair[0]).current_option_elements(assembly, mirror_unit, unit_size, angle1, 0)
        option2_rotated = assembly.element(selected_keys_pair[1]).current_option_elements(assembly, mirror_unit, unit_size, angle2, 0)
        
        if show_new_element:
            new_elem = assembly.add_third_element(elem, option1_rotated[1], option2_rotated[1], point1, point2, shift_value, epsilon)
            new_elem_mesh = Artist(new_elem.mesh).draw()

if not get_joining_options:
    assembly.selected_keys_pair = []
    assembly.connectors_pairs_list = []
    assembly.selected_connectors_ranges_intersection_point = []


# geometry for visualisation
if show_sel_con_ranges:
    G_connectors_ranges = generate_connector_range(selected_keys_pair[0])
elif show_all_con_ranges:
    G_connectors_ranges = [geo for key, geo in open_connectors_ranges]
else:
    G_connectors_ranges = []


if joining_case == 0:
    print '-------------- CASE 1: SINGLE OPTIONS-PAIR -------------'
elif joining_case == 1:
    print '-------------- CASE 2: TWO OPTIONS-PAIRS ---------------'
print 'Number of key-pairs that can be joined:', len(connectors_pairs)
print 'Selected open connectors key-pair:', assembly.selected_keys_pair
if len(assembly.selected_keys_pair) != 0:
    print 'Open connector key for option:', assembly.selected_keys_pair[0]
print 'Option 1 angle:', angle1
print 'Option 2 angle:', angle2
# ---------- end joining_branches_new ----------
joining_branches_old = GhPythonScript(
    assembly=settings_parameters.assembly,
    elem=elem_60_def.elem,
    get_joining_options=get_joining_options,
    joining_case=list_2,
    show_new_element=_3rd_new_element,
    pair_index=pair_index,
    point_on_intersection=number_slider,
    point1=point1,
    point2=point2,
    current_key=settings_parameters.current_key,
    shift_value=settings_parameters.current_shift_value,
    join_branches=join,
    mirror_unit=settings_parameters.current_mirror_unit,
    unit_size=settings_parameters.current_unit_size)  # -> out, assembly, elem_line1, elem_line2, new_elem_mesh, intersections, angle1, angle2, T_point; inputs pair_index: Int32; disabled
# ---------- joining_branches_old: Python ----------
import math
import rhinoscriptsyntax as rs
import Rhino.Geometry as rg

from compas.geometry import Point, Vector, Frame, Plane, Vector, Line, Transformation, Rotation, Translation
from compas.geometry import angle_vectors, closest_point_on_line, intersection_line_plane, angles_points
from compas.artists import Artist
from compas_rhino.conversions import line_to_rhino_curve, point_to_compas, point_to_rhino, plane_to_compas_frame

import ghpythonlib.components as gh

mirror_unit = False

connector_ranges = []
connectors_pairs = []
intersections = []


epsilon = 0.0000001

open_connectors_keys = [key for key, frames in assembly.connectors(state='open')]

robot_AA_base_frame = plane_to_compas_frame(assembly.robot_AA_base_plane)
robot_AB_base_frame = plane_to_compas_frame(assembly.robot_AB_base_plane)

rod_length =  assembly.globals['rod_length']
l1 = rod_length - (math.sqrt(3)*unit_size + shift_value)
print l1

T_point = Translation.from_vector(assembly.element(current_key).frame.xaxis)

#p0 = assembly.element(current_key).frame
#T1 = Translation.from_vector(current_connector_frame.xaxis*(length/2-unit_size/2*math.sqrt(3)-rf_unit_offset))



#############################################################################
## CASE 1
#############################################################################

if get_joining_options and joining_case == 0:

    for key, connector_range in assembly.connectors_ranges(state='open'):
        if len(connector_range) != 0:
            connector_ranges.append((key, Artist(connector_range[0]).draw()))

    for i in range(len(connector_ranges)):
        for open_connectors_key in open_connectors_keys:
            intersection = rg.Intersect.Intersection.CurveSurface(line_to_rhino_curve(assembly.element(open_connectors_key).line), connector_ranges[i][1], 0.001, 0.001)
            if intersection:
                for c in intersection:
                    intersections.append(c.PointA)
                connectors_pairs.append((connector_ranges[i][0], open_connectors_key))

    #print len(intersection_curves)

    if len(connectors_pairs) != 0:
        intersection_point = intersections[pair_index]
        selected_keys_pair = [pkey for pkey in connectors_pairs[pair_index]]
        connectors_pairs_list = [key for pair in connectors_pairs for key in pair]
    
        assembly.selected_keys_pair = [selected_keys_pair[0]]
        assembly.connectors_pairs_list = connectors_pairs_list
        assembly.selected_connectors_ranges_intersection_point = intersection_point
        
        # Convert in COMPAS Point
        cp = point_to_compas(intersection_point)
        
        # Compute angle for option pair
        open_connector_elem_1 = assembly.element(selected_keys_pair[0])
        cutting_plane_origin_1 = closest_point_on_line(cp, open_connector_elem_1.line)
        cutting_plane_1 = Plane(cutting_plane_origin_1, open_connector_elem_1.line.vector)
        intersection_point_1 = intersection_line_plane(open_connector_elem_1.current_option_elements(assembly, mirror_unit, unit_size, 0, 0)[1].line, cutting_plane_1)

        angle1 = angles_points(cutting_plane_origin_1, intersection_point_1, cp) 
        angle1 = math.degrees(angle1[1])
        print angle1
        
        current_option = assembly.element(selected_keys_pair[0]).current_option_elements(assembly, mirror_unit, unit_size, angle1, 0)

        rot_line = Artist(assembly.element(selected_keys_pair[0]).line).draw()
        start_p = rot_line.From
        rot_axis = rg.Vector3d(rot_line.From - rot_line.To)
        rot_point = Artist(assembly.element(selected_keys_pair[0]).frame.point).draw()
        elem_line1 = Artist(current_option[1].line).draw()
        elem_line2 = Artist(assembly.element(selected_keys_pair[1]).line).draw()
        rot_dir = 1
        step = 1.0

        tol_angle = assembly.get_rot_angle(step, rot_axis, rot_point, elem_line1, elem_line2, rot_dir, epsilon)
        angle1 += tol_angle
        
        current_option_rotated = assembly.element(selected_keys_pair[0]).current_option_elements(assembly, mirror_unit, unit_size, angle1, 0)
        
        if show_new_element:
            new_elem = assembly.add_third_element(elem, assembly.element(selected_keys_pair[1]), current_option_rotated[1], point1, point2, shift_value, epsilon)
            new_elem_mesh = Artist(new_elem.mesh).draw()
        
        if join_branches:
            msgs = []
            
            # close a reciprocal frame unit with the option elements with the highest score
            assembly.join_branches(selected_keys_pair, mirror_unit, angle1, 0, new_elem, robot_frame=BCF, on_ground=False)

            msgs.append('--- New element added to assembly ---')
            
            for msg in msgs:
                print(msg)
    else:
        assembly.selected_keys_pair = []
        assembly.connectors_pairs_list = []
        assembly.selected_connectors_ranges_intersection_point = []
        
#############################################################################
## CASE 2
#############################################################################

if get_joining_options and joining_case == 1:
    for key, connector_range in assembly.connectors_ranges(state='open'):
        if len(connector_range) != 0:
            #print connector_range
            connector_ranges.append((key, Artist(connector_range[0]).draw()))

    for i in range(len(connector_ranges)):
        for j in range(i + 1, len(connector_ranges)):
            is_intersecting, intersection, p_array = rg.Intersect.Intersection.SurfaceSurface(connector_ranges[i][1], connector_ranges[j][1], 0.001)
            if len(intersection) > 0:
                #print intersection
                joined_curve = rg.Curve.JoinCurves(intersection)
                connectors_pairs.append((connector_ranges[i][0], connector_ranges[j][0]))
                #print joined_curve
                intersections.append(joined_curve[0])
                
        
    #print 'Following element pair(s) {} could be joined.'.format(connectors_pairs)
    #print intersections
    
    if len(connectors_pairs) != 0:
        curve_param = intersections[pair_index].NormalizedLengthParameter(point_on_intersection)
        intersection_point = intersections[pair_index].PointAt(curve_param[1])
        
        selected_keys_pair = [pkey for pkey in connectors_pairs[pair_index]]
        connectors_pairs_list = [key for pair in connectors_pairs for key in pair]
    
        assembly.selected_keys_pair = selected_keys_pair
        assembly.connectors_pairs_list = connectors_pairs_list
        assembly.selected_connectors_ranges_intersection_point = intersection_point

        # Convert to compas point
        cp = point_to_compas(intersection_point)
        
        # Compute angle for first option pair
        open_connector_elem1 = assembly.element(selected_keys_pair[0])
        cutting_plane_origin1 = closest_point_on_line(cp, open_connector_elem1.line)
        cutting_plane1 = Plane(cutting_plane_origin1, open_connector_elem1.line.vector)
        option_elem1 = open_connector_elem1.current_option_elements(assembly, mirror_unit, unit_size, 0, 0)[1]
        intersection_point1 = intersection_line_plane(option_elem1.line, cutting_plane1)
        
        angle1 = angles_points(cutting_plane_origin1, intersection_point1, cp) 
        angle1 = math.degrees(angle1[0])
        
        # Compute angle for second option pair
        open_connector_elem2 = assembly.element(selected_keys_pair[1])
        cutting_plane_origin2 = closest_point_on_line(cp, open_connector_elem2.line)
        cutting_plane2 = Plane(cutting_plane_origin2, open_connector_elem2.line.vector)
        option_elem2 = open_connector_elem2.current_option_elements(assembly, mirror_unit, unit_size, 0, 0)[1]
        intersection_point2 = intersection_line_plane(option_elem2.line, cutting_plane2)
        
        angle2 = angles_points(cutting_plane_origin2, intersection_point2, cp)
        angle2 = math.degrees(angle2[0])
        
        rot_line = Artist(open_connector_elem1.line).draw()
        start_p = rot_line.From
        rot_axis = rg.Vector3d(rot_line.From - rot_line.To)
        rot_point = Artist(assembly.element(selected_keys_pair[0]).frame.point).draw()
        elem_line1 = Artist(option_elem1.line).draw()
        elem_line2 = Artist(option_elem2.line).draw()

        rot_dir = 1
        step = 6.0

        tol_angle = assembly.get_rot_angle(step, rot_axis, rot_point, elem_line1, elem_line2, rot_dir, epsilon)
        angle1 += tol_angle
        
        option1_rotated = assembly.element(selected_keys_pair[0]).current_option_elements(assembly, mirror_unit, unit_size, angle1, 0)
        option2_rotated = assembly.element(selected_keys_pair[1]).current_option_elements(assembly, mirror_unit, unit_size, angle2, 0)
        
        if show_new_element:
            new_elem = assembly.add_third_element(elem, option1_rotated[1], option2_rotated[1], point1, point2, shift_value, epsilon)
            new_elem_mesh = Artist(new_elem.mesh).draw()

if not get_joining_options:
    assembly.selected_keys_pair = []
    assembly.connectors_pairs_list = []
    assembly.selected_connectors_ranges_intersection_point = []


if joining_case == 0:
    print '-------------- CASE 1: SINGLE OPTIONS-PAIR -------------'
elif joining_case == 1:
    print '-------------- CASE 2: TWO OPTIONS-PAIRS ---------------'
print 'Number of key-pairs that can be joined:', len(connectors_pairs)
print 'Selected open connectors key-pair:', assembly.selected_keys_pair
if len(assembly.selected_keys_pair) != 0:
    print 'Open connector key for option:', assembly.selected_keys_pair[0]
print 'Option 1 angle:', angle1
print 'Option 2 angle:', angle2
# ---------- end joining_branches_old ----------
error = GhPythonScript(input=settings_parameters.out)  # -> out, reset_key; inputs input: list
# ---------- error: Python ----------
import Rhino.UI
from cdf_2023.assembly.gui import ErrorDialog


for line in input:
    if "KeyError" in line:
        ErrorDialog('Error Key. Try to reset the key and check if key_by_index is set to False').display()
# ---------- end error ----------
key_actions = GhPythonScript(
    assembly=settings_parameters.assembly,
    key=key,
    remove=delete_element,
    close_connector=close_connector,
    assign=make_a_support)  # -> out, assembly
# ---------- key_actions: Python ----------
from compas.artists import Artist

#############################################################################
## Delete element
#############################################################################

if remove:
    assembly.delete_element(key)

#############################################################################
## Close connector
#############################################################################

if close_connector:
    print open_connectors_keys
    open_connectors_keys = assembly.open_connectors_keys
    print key, open_connectors_keys
    
    if key in open_connectors_keys:
        print ("closed")
        assembly.element(key).connector_1_state = False
        assembly.element(key).connector_2_state = False
    else:
        print("Error:TRUE")
        print("Not possible to close this connector.")

#############################################################################
## Define as supporting element
#############################################################################

if assign:
    assembly.network.node_attribute(key, 'is_support', True)
# ---------- end key_actions ----------
rec = DataRecorder(settings_parameters.out, DataLimit=-10, RecordData=True)
panel_19 = Panel(rec)

# ---- group: TEMP_stability
ghpython_script_2 = GhPythonScript(elem_options=settings_parameters.elem_options, current_key=settings_parameters.current_key)  # -> out, sp, sp1, l, a, cp0, cp, rp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; inputs elem_options: list; disabled
# ---------- ghpython_script_2: Python ----------
import math
import random
import System.Threading.Tasks as tasks
from scriptcontext import sticky as st
import Rhino.Geometry as rg
import rhinoscriptsyntax as rs

import ghpythonlib.components as gh

from compas.geometry import Frame, Box, Point, Plane
from compas.geometry import Vector, Translation, angle_vectors, Rotation
from compas.artists import Artist
from compas.topology import connected_components
from compas_rhino.conversions import plane_to_compas_frame

import time
import sys

support_geo = assembly.support
print type(support_geo)
sp_lines = []
int_pts = []

branches = connected_components(assembly.network.adjacency)
support_keys = list(assembly.network.nodes_where({'is_support':True}))
for i, branch in enumerate(branches):
    cp = [Artist(assembly.element(bkey).line.midpoint).draw() for bkey in branch]
    sp_line = [Artist(assembly.element(bkey).line).draw() for bkey in branch if bkey in support_keys]
    
    for line in sp_line:
        int_pt = gh.BrepXLine(support_geo,line)[1]
        print(int_pt)
        if int_pt != None:
            int_pts.append(int_pt[1])


    sp1 = int_pts

   # Add option to branch
    if current_key in branch:
        #print elem_options
        cp += [Artist(elem_option.line.midpoint).draw() for elem_option in elem_options]
        sp1.append(Artist(elem_options[0].line.midpoint).draw())


#lever_arm, resultant_point = assembly.calculate_local_equilibrium_in_a_branch(cp, sp, assembly.globals['rod_length'], assembly.globals['rod_radius'])

l = assembly.globals['rod_length']
r = assembly.globals['rod_radius']

"""Calculates the local static Equilibrium condition.

Parameters
----------
cp : point
    The mid points of the elements.

Returns
-------
la: float
    The lever arm of the branch [m].
rp: point
    The position of the resultant z-vector [point].

"""

if cp and sp1:
    # Variables:
    # cp = Center Points of the individual elements of one branch
    # sp = Planar Supports of the branch
    # l = #Length of the Rods [m]
    # r = #Radius of the Pipe Elements

    z_0 = min([p[2] for p in sp1])
    print(z_0)
    # Step 1: Calculate single Resultants
    vol = l * math.pi * r**2 #Volume Vector for Rods; Material weight is considered as constant
    cp0 = [(p[0], p[1], 0) for p in cp] #Planar Center Points of the Resultant
    #print len(sp1)
    sp = [(p[0], p[1], 0) for p in sp1] #Make Supports planar


    # Step 2: Calculate the Resultant for each element
    res_pos_x = 0
    res_pos_y = 0

    for i, cp0l in enumerate(cp0):
        m_x = cp0l[0] * vol
        m_y = cp0l[1] * vol

        res_pos_x += m_x # Local Moment in x-dir
        res_pos_y += m_y # Local Moment in y-dir

        res_pos_x_loc = res_pos_x / (vol*(i+1)) # Position of Resultant in x-dir
        res_pos_y_loc = res_pos_y / (vol*(i+1)) # Position of Resultant in y-dir

        rp = rs.AddPoint(res_pos_x_loc, res_pos_y_loc, 0)

        # Lever Arm for a single support
        if len(sp) == 1:
            la = rs.Distance(rp, sp[0])
            print(la)

        # Lever Arm for two supports
        if len(sp) == 2:
            l = rs.AddLine(sp[0], sp[1])
            la1 = rs.EvaluateCurve(l, rs.CurveClosestPoint(l, rp))
            la = rs.Distance(la1, rp)
            print(la)

        # Lever Arm for multiple supports
        if len(sp) > 2:
            sp.append(sp[0])
            l = rs.AddPolyline(sp)

            check = rs.PointInPlanarClosedCurve(rp, l)
            if check == 1 or check == 2: la = 0
            if check == 0: la = rs.Distance(rs.EvaluateCurve(l, rs.CurveClosestPoint(l, rp)), rp)

else:
    la = 'No Input'
    rp = 'No Input'
# ---------- end ghpython_script_2 ----------
point = Point(ghpython_script_2.cp)  # disabled
point_2 = Point(ghpython_script_2.rp)  # disabled
curve = Curve(ghpython_script_2.l_2)  # disabled
pt_4 = GhPythonScript(pt=ghpython_script_2.cp0)  # -> out, pt; inputs pt: list; disabled
# ---------- pt_4: Python ----------
__author__ = "lovek"
__version__ = "2024.01.09"

import rhinoscriptsyntax as rs
for p in pt:
    print str('{'+'{},{},{}'.format(p[0],p[1],p[2])+'}')
# ---------- end pt_4 ----------
pt_5 = GhPythonScript(pt=ghpython_script_2.sp)  # -> out, pt; inputs pt: list; disabled; same code as pt_4
rec_2 = DataRecorder(ghpython_script_2.la, DataLimit=-10, RecordData=True)  # disabled
circle = Circle(Plane=point_2, Radius=ghpython_script_2.la)  # disabled
rec_3 = DataRecorder(ghpython_script_2.rp, DataLimit=-10, RecordData=True)  # disabled
point_3 = Point(pt_4.out)  # disabled
point_4 = Point(ghpython_script_2.sp1)  # disabled
point_5 = Point(pt_5.out)  # disabled
panel_20 = Panel(rec_3)  # disabled
panel_21 = Panel(rec_2)  # disabled

# ----
panel_22 = Panel(ghpython_script_2.int_pts)  # disabled
curve_2 = Curve(ghpython_script_2.line)  # disabled
panel_23 = Panel(ghpython_script_2.int_pt)  # disabled
panel_24 = Panel(settings_parameters.elem_options)  # disabled

# ----
# Feedback
target_geometry = Panel(settings_parameters.target_geo_feedback)

# ----
# Assembly visualization
# 1. Visualize assembly.
# 2. Visualize selected option.
# 3. Visuilize current options (all/filtered).
open_connectors_planes = BooleanToggle(False)
support_geometry = BooleanToggle(True)
shortest_distance = BooleanToggle(False)
target_geometry_2 = BooleanToggle(False)
support_elems = BooleanToggle(False)
robots_reach = BooleanToggle(False)
intersections = BooleanToggle(True)
selected_key = BooleanToggle(True)
assembly = BooleanToggle(True)
open_keys = BooleanToggle(True)
all_frames = BooleanToggle(False)
all_keys = BooleanToggle(False)
option = BooleanToggle(True)
joints = BooleanToggle(True)

# ----
# 5. Mobile robots
geometry = Geometry([<mesh referenced from the Rhino model> x48])
geometry_2 = Geometry([<mesh referenced from the Rhino model> x48])
show_robots = BooleanToggle(True)
M = MeshJoin(Meshes=geometry)
M_2 = MeshJoin(Meshes=geometry_2)

# ----
# Network visualization
network_graph = BooleanToggle(False)

unit_z = UnitZ(Factor=1)  # disabled
unit_z_2 = UnitZ(Factor=-1)  # disabled
A = Point(<point referenced from the Rhino model>)  # disabled
B = Point(<point referenced from the Rhino model>)  # disabled
O = Point(<point referenced from the Rhino model>)  # disabled
ghpython_script_3 = GhPythonScript(p_A=A, p_B=B, p_O=O, v=unit_z_2)  # -> out, result_angle, v; inputs p_A: Point3d, p_B: Point3d, p_O: Point3d, v: Vector3d; disabled
# ---------- ghpython_script_3: Python ----------
import Rhino.Geometry as rg
import math

def angle_between_points(p_A, p_B, p_O, v):
    # Vector from point O to point A
    vec_A = rg.Vector3d(p_A - p_O)
    
    # Vector from point O to point B
    vec_B = rg.Vector3d(p_B - p_O)
    
    # Cross product to find the axis of rotation
    v = v
    
    # Dot product to find the cosine of the angle
    cos_angle = rg.Vector3d.Multiply(vec_A, vec_B) / (vec_A.Length * vec_B.Length)
    
    # Ensure the cosine value is within the valid range
    cos_angle = max(min(cos_angle, 1.0), -1.0)
    
    # Calculate the angle in radians
    angle_rad = math.acos(cos_angle)
    
    # Convert the angle to degrees
    angle_deg = math.degrees(angle_rad)
    
    # Check the direction of rotation using the axis of rotation
    if rg.Vector3d.Multiply(v, rg.Vector3d.ZAxis) < 0:
        angle_deg = 360 - angle_deg
    
    return angle_deg, v


result_angle, v = angle_between_points(p_A, p_B, p_O, v)
print("Angle between points A and B around point O:", result_angle)
# ---------- end ghpython_script_3 ----------
panel_25 = Panel(unit_z)  # disabled
text_tag = TextTag(Location=[A, B, O], Text=["A", "B", "O"])  # disabled
panel_26 = Panel(ghpython_script_3.result_angle)  # disabled
panel_27 = Panel(ghpython_script_3.v)  # disabled

# ---- group: Option/Selected/Collision
colour_swatch_3 = ColourSwatch(SwatchColor=RGBA(255, 170, 0, 120))

# ----
# Set to built
keys = Slider(18, range=0..100)

# ----
# Join keys Manually
key_2_2 = Slider(1, range=0..200)  # disabled
join_2 = Button()  # disabled

join_keys = GhPythonScript(assembly=key_actions.assembly, key_1=settings_parameters.current_key, key_2=key_2_2, join=join_2)  # -> out, assembly, distance, dist_soll, error, error_msg
# ---------- join_keys: Python ----------
from compas.artists import Artist

import Rhino.UI
from cdf_2023.assembly.gui import ErrorDialog

tolerance = 0.01
dist_soll = assembly.globals['rod_radius']*2 + assembly.globals['joint_dist']

total_elements = assembly.network.number_of_nodes()
if total_elements > 1:
    try:
        # check the distance between two elements
        line1 = Artist(assembly.element(key_1).line).draw()
        line2 = Artist(assembly.element(key_2).line).draw()
        distance, dist_line = assembly.shortest_distance_between_two_lines(line1, line2)
    except:
        distance = ""

if join:
    if distance < (dist_soll + tolerance):
        assembly.network.add_edge(key_1, key_2, edge_to='neighbour')
    else:
        ErrorDialog("This elements are two far away form each other. Consider that the distance should be similar to the displayed {}".format(dist_soll)).display()
# ---------- end join_keys ----------
joining_branches_new_2 = GhPythonScript(
    assembly=join_keys.assembly,
    elem=elem_60_def.elem,
    get_joining_options=get_joining_options,
    joining_case=list_2,
    show_new_element=_3rd_new_element,
    pair_index=pair_index,
    point_on_intersection=number_slider,
    point1=point1,
    point2=point2,
    current_key=settings_parameters.current_key,
    shift_value=settings_parameters.current_shift_value,
    shift_value_n=shift_value_n,
    join_branches=join,
    mirror_unit=settings_parameters.current_mirror_unit,
    unit_size=settings_parameters.current_unit_size,
    option_elem_num=option_elem_num,
    show_all_con_ranges=all_connectors_ranges,
    show_sel_con_ranges=selected_connectors_ranges,
    show_resultant=stability_feedback,
    la_limit=la_limit)  # -> out, assembly, elem_line1, elem_line2, new_elem_mesh, new_elem, intersections, angle1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; inputs pair_index: Int32, option_elem_num: Int32
# ---------- joining_branches_new_2: Python ----------
import math
import rhinoscriptsyntax as rs
import Rhino.Geometry as rg


from compas.geometry import Point, Vector, Frame, Plane, Vector, Line, Transformation, Rotation, Translation
from compas.geometry import angle_vectors, closest_point_on_line, intersection_line_plane, angles_points
from compas.artists import Artist
from compas_rhino.conversions import line_to_rhino_curve, point_to_compas, point_to_rhino, plane_to_compas_frame, cylinder_to_rhino, vector_to_rhino
from compas.topology import connected_components

import ghpythonlib.components as gh

connector_ranges = []
connectors_pairs = []
intersections = []

G_connectors_ranges = []

#option_elem_num # number of the element in the generated option which is touching other element
#                       # 0 - by robot, 1 - by human

epsilon = 0.001

open_connectors_keys = [key for key, frames in assembly.connectors(state='open')]

robot_AA_base_frame = plane_to_compas_frame(assembly.robot_AA_base_plane)
robot_AB_base_frame = plane_to_compas_frame(assembly.robot_AB_base_plane)

def generate_connector_range(key):
    elem = assembly.element(key)

    # generate option based on input parameters
    elem_options = elem.current_option_elements(assembly, mirror_unit, unit_size, 0, shift_value)
    selected_option = Artist(elem_options[option_elem_num].line).draw()
    
    rod_length =  assembly.globals['rod_length']
    l1 = math.sqrt(3)*unit_size + shift_value
    # find the point depending on the open connector
    if elem.connector_1_state == True:
        n = 0.0
        l1 = rod_length - l1 - 0.05
    if elem.connector_2_state == True:
        n = 1.0
        l1 = l1 + 0.05
    
    start_pt = rg.Line.PointAt(selected_option, n)
    end_pt = rg.Line.PointAtLength(selected_option, l1)
    
    # create connector range based on line
    section_line = rg.Line(start_pt, end_pt)
    rot_axis = Artist(assembly.element(key).line).draw()
    connector_range = rg.RevSurface.Create(section_line, rot_axis)
    
    return connector_range

def angle_between_points(p_A, p_B, p_O, v):
    # Vector from point O to point A
    vec_A = rg.Vector3d(p_A - p_O)
    
    # Vector from point O to point B
    vec_B = rg.Vector3d(p_B - p_O)
    
    # Cross product to find the axis of rotation
    axis_of_rotation = rg.Vector3d.CrossProduct(vec_A, vec_B)

    # Dot product to find the cosine of the angle
    cos_angle = rg.Vector3d.Multiply(vec_A, vec_B) / (vec_A.Length * vec_B.Length)
    
    # Ensure the cosine value is within the valid range
    cos_angle = max(min(cos_angle, 1.0), -1.0)
    
    # Calculate the angle in radians
    angle_rad = math.acos(cos_angle)
    
    # Convert the angle to degrees
    angle_deg = math.degrees(angle_rad)
    
    # Check the direction of rotation using the axis of rotation
    if rg.Vector3d.Multiply(axis_of_rotation, rg.Vector3d.ZAxis) < 0:
        print 'here axis'
        angle_deg = 360 - angle_deg
        
    # Check the direction of rotation using the axis of rotation
    if rg.Vector3d.Multiply(v, rg.Vector3d.ZAxis) < 0:
        print 'here v'
        angle_deg = 360 - angle_deg
        
    return angle_deg, v


open_connectors_keys = [key for key, frames in assembly.connectors(state='open')]
open_connectors_ranges = []
#print open_connectors_keys
elem_options = []

#############################################################################
## CASE 1
#############################################################################

if get_joining_options and joining_case == 0:
    
    # Generate connector ranges based on input parameters for all open connectors
    for key in open_connectors_keys:
        open_connectors_ranges.append([key, generate_connector_range(key)])
    
    for i in range(len(open_connectors_ranges)):
        for open_connectors_key in open_connectors_keys:
            intersection = rg.Intersect.Intersection.CurveSurface(line_to_rhino_curve(assembly.element(open_connectors_key).line), open_connectors_ranges[i][1], 0.001, 0.001)
            if intersection:
                for c in intersection:
                    intersections.append(c.PointA)
                connectors_pairs.append((open_connectors_ranges[i][0], open_connectors_key))
    
    #print connectors_pairs
    #print len(intersection_curves)
    
    if len(connectors_pairs) != 0:
        intersection_point = intersections[pair_index]
        selected_keys_pair = [pkey for pkey in connectors_pairs[pair_index]]
        connectors_pairs_list = [key for pair in connectors_pairs for key in pair]
        
        assembly.selected_keys_pair = [selected_keys_pair[0]]
        print selected_keys_pair[0]
        assembly.connectors_pairs_list = connectors_pairs_list
        assembly.selected_connectors_ranges_intersection_point = intersection_point
        
        # Convert in COMPAS Point
        cp = point_to_compas(intersection_point)
        
        # Compute angle for option pair
        open_connector_elem_1 = assembly.element(selected_keys_pair[0])
        #print open_connector_elem_1
        cutting_plane_origin_1 = closest_point_on_line(cp, open_connector_elem_1.line) # 
        cutting_plane_1 = Plane(cutting_plane_origin_1, open_connector_elem_1.line.vector)
        plane_pt = Artist(cutting_plane_1.point).draw()#
        plane_v = Artist(cutting_plane_1.normal).draw()#
        line_int = Artist(open_connector_elem_1.current_option_elements(assembly, mirror_unit, unit_size, 0, shift_value)[option_elem_num].line).draw()
        intersection_point_1 = intersection_line_plane(open_connector_elem_1.current_option_elements(assembly, mirror_unit, unit_size, 0, shift_value)[option_elem_num].line, cutting_plane_1)
        
        
        #angles1 = angles_points(cutting_plane_origin_1, intersection_point_1, cp, deg=True)
        #print angles1
        #angles1 = angles_points(cutting_plane_origin_1, cp, intersection_point_1, deg=True)
        #print angles1
        
        p_A = intersection_point
        p_B = point_to_rhino(intersection_point_1)
        p_O = point_to_rhino(cutting_plane_origin_1)
        v = vector_to_rhino(open_connector_elem_1.line.vector)
        #print type(v)
        
        angle1, v = angle_between_points(p_B, p_A, p_O, v)
       # print result_angle
        
        #print 'list deg', angles1
        #angle1 = result_angle # not the smallest angle
        #print 'around', angle1
        
        if open_connector_elem_1.connector_2_state == True:
            print "Connector 2"
        else:
            print "Connector 1"
        
        
        current_option = assembly.element(selected_keys_pair[0]).current_option_elements(assembly, mirror_unit, unit_size, angle1, shift_value)
        
        rot_line = Artist(assembly.element(selected_keys_pair[0]).line).draw()
        rot_axis = rg.Vector3d(rot_line.From - rot_line.To)
        rot_point = Artist(assembly.element(selected_keys_pair[0]).frame.point).draw()
        elem_line1 = Artist(current_option[option_elem_num].line).draw()
        elem_line2 = Artist(assembly.element(selected_keys_pair[1]).line).draw()
        rot_dir = 1
        step = 0.5
    
        tol_angle = assembly.get_rot_angle(step, rot_axis, rot_point, elem_line1, elem_line2, rot_dir, epsilon)
        print tol_angle
        angle1 += tol_angle
        #print 'with tol', angle1
        #angle1 = 360-angle1
        
        current_option_rotated = assembly.element(selected_keys_pair[0]).current_option_elements(assembly, mirror_unit, unit_size, angle1, shift_value)
        elem_options += current_option_rotated
        
        if show_new_element:
            #print 'new_elem', selected_keys_pair[1], current_option_rotated[option_elem_num], point1, point2, shift_value_n, epsilon
            new_elem = assembly.add_third_element(elem, assembly.element(selected_keys_pair[1]), current_option_rotated[option_elem_num], point1, point2, shift_value_n, epsilon)
            elem_options.append(new_elem)
            #print type(new_elem)
            new_elem_mesh = Artist(new_elem.mesh).draw() 
            new_elem_mesh = cylinder_to_rhino(new_elem._source)
        else:
            new_elem = None
        
#        if join_branches:
#            msgs = []
#            
#            # close a reciprocal frame unit with the option elements with the highest score
#            assembly.join_branches(selected_keys_pair, mirror_unit, angle1, shift_value, unit_size, new_elem, option_elem_num, on_ground=False)
#    
#            msgs.append('--- New elements added to key {} ---'.format(selected_keys_pair[0]))
#            
#            for msg in msgs:
#                print(msg)
    else:
        assembly.selected_keys_pair = []
        assembly.connectors_pairs_list = []
        assembly.selected_connectors_ranges_intersection_point = []




#############################################################################
## CASE 2
#############################################################################

if get_joining_options and joining_case == 1:
    
    # Generate connector ranges based on input parameters for all open connectors
    for key in open_connectors_keys:
        open_connectors_ranges.append([key, generate_connector_range(key)])
    
    for i in range(len(open_connectors_ranges)):
        for j in range(i + 1, len(open_connectors_ranges)):
            is_intersecting, intersection, p_array = rg.Intersect.Intersection.SurfaceSurface(open_connectors_ranges[i][1], open_connectors_ranges[j][1], 0.001)
            if len(intersection) > 0:
                #print intersection
                joined_curve = rg.Curve.JoinCurves(intersection)
                connectors_pairs.append((open_connectors_ranges[i][0], open_connectors_ranges[j][0]))
                #print joined_curve
                intersections.append(joined_curve[0])
                
        
    #print 'Following element pair(s) {} could be joined.'.format(connectors_pairs)
    #print intersections
    
    if len(connectors_pairs) != 0:
        # select intersection point on curve
        curve_param = intersections[pair_index].NormalizedLengthParameter(point_on_intersection)
        intersection_point = intersections[pair_index].PointAt(curve_param[1])
        
        selected_keys_pair = [pkey for pkey in connectors_pairs[pair_index]]
        connectors_pairs_list = [key for pair in connectors_pairs for key in pair]
        #print selected_keys_pair
        
        assembly.selected_keys_pair = selected_keys_pair
        assembly.connectors_pairs_list = connectors_pairs_list
        assembly.selected_connectors_ranges_intersection_point = intersection_point

        # Convert to compas point
        cp = point_to_compas(intersection_point)
        
        # Compute angle for first option pair
        open_connector_elem1 = assembly.element(selected_keys_pair[0])
        cutting_plane_origin1 = closest_point_on_line(cp, open_connector_elem1.line)
        cutting_plane1 = Plane(cutting_plane_origin1, open_connector_elem1.line.vector)
        option_elem1 = open_connector_elem1.current_option_elements(assembly, mirror_unit, unit_size, 0, shift_value)[option_elem_num]
        intersection_point1 = intersection_line_plane(option_elem1.line, cutting_plane1)
        
        p_A = intersection_point
        p_B = point_to_rhino(intersection_point1)
        p_O = point_to_rhino(cutting_plane_origin1)
        v = vector_to_rhino(open_connector_elem1.line.vector)
        
        angle1, v = angle_between_points(p_B, p_A, p_O, v)
        
        if open_connector_elem1.connector_2_state == True:
            print "Connector 2"
        else:
            print "Connector 1"

        # Compute angle for second option pair
        open_connector_elem2 = assembly.element(selected_keys_pair[1])
        cutting_plane_origin2 = closest_point_on_line(cp, open_connector_elem2.line)
        cutting_plane2 = Plane(cutting_plane_origin2, open_connector_elem2.line.vector)
        option_elem2 = open_connector_elem2.current_option_elements(assembly, mirror_unit, unit_size, 0, shift_value)[option_elem_num]
        intersection_point2 = intersection_line_plane(option_elem2.line, cutting_plane2)
        
        p_A = intersection_point
        p_B = point_to_rhino(intersection_point2)
        p_O = point_to_rhino(cutting_plane_origin2)
        v = vector_to_rhino(open_connector_elem2.line.vector)
        
        angle2, v = angle_between_points(p_B, p_A, p_O, v)
        
        if open_connector_elem2.connector_2_state == True:
            print "Connector 2"
        else:
            print "Connector 1"
        
        current_option_1 = assembly.element(selected_keys_pair[0]).current_option_elements(assembly, mirror_unit, unit_size, angle1, shift_value)
        current_option_2 = assembly.element(selected_keys_pair[1]).current_option_elements(assembly, mirror_unit, unit_size, angle2, shift_value)

        # find tolerance angle
        rot_line = Artist(open_connector_elem1.line).draw()
        rot_axis = rg.Vector3d(rot_line.From - rot_line.To)
        rot_point = Artist(assembly.element(selected_keys_pair[0]).frame.point).draw()
        elem_line1 = Artist(current_option_1[option_elem_num].line).draw()
        elem_line2 = Artist(current_option_2[option_elem_num].line).draw()

        rot_dir = 1
        step = 1.0

        tol_angle = assembly.get_rot_angle(step, rot_axis, rot_point, elem_line1, elem_line2, rot_dir, epsilon)
        print tol_angle
        #tol_angle = 30
        angle1 += tol_angle
        
        option1_rotated = assembly.element(selected_keys_pair[0]).current_option_elements(assembly, mirror_unit, unit_size, angle1, shift_value)
        option2_rotated = assembly.element(selected_keys_pair[1]).current_option_elements(assembly, mirror_unit, unit_size, angle2, shift_value)
        
        elem_options += option1_rotated
        elem_options += option2_rotated
        
        
        if show_new_element:
            new_elem = assembly.add_third_element(elem, option1_rotated[option_elem_num], option2_rotated[option_elem_num], point1, point2, shift_value_n, epsilon)
            new_elem_mesh = cylinder_to_rhino(new_elem._source)
            elem_options.append(new_elem)
        else:
            new_elem = None
        
#        if join_branches:
#            print selected_keys_pair
#            msgs = []
#            
#            robot_name = 'AA'
#            robot_AA_base_frame = plane_to_compas_frame(assembly.robot_AA_base_plane)
#            robot_AB_base_frame = plane_to_compas_frame(assembly.robot_AB_base_plane)
#            
#            # join the branches for the first key in the pair
#            key_held_by_robot=None
#            stabilising_robot=None
#            assembly.close_rf_unit(selected_keys_pair[0], mirror_unit, unit_size, angle1, shift_value, robot_name, key_held_by_robot, stabilising_robot, robot_AA_base_frame, robot_AB_base_frame, on_ground=False)
#            assembly.open_connectors_keys.remove(selected_keys_pair[0])
#            msgs.append('--- New elements added to key {} ---'.format(selected_keys_pair[0]))
#            
#            # define a new pair for joining as in case 1
#            new_key = assembly.network.number_of_nodes() - 2 - option_elem_num
#            new_keys_pair = [selected_keys_pair[1], new_key]
#        
#            # join the branches for the secon key in the pair
#            assembly.join_branches(new_keys_pair, mirror_unit, angle2, shift_value, unit_size, new_elem, option_elem_num, on_ground=False)
#            msgs.append('--- New elements added to key {} ---'.format(selected_keys_pair[1]))
#            
#            for msg in msgs:
#                print(msg)

if not get_joining_options:
    assembly.selected_keys_pair = []
    assembly.connectors_pairs_list = []
    assembly.selected_connectors_ranges_intersection_point = []

if get_joining_options:
    # geometry for visualisation
    if show_sel_con_ranges and selected_keys_pair != None :
        if joining_case == 0:
            G_connectors_ranges = generate_connector_range(selected_keys_pair[0])
        if joining_case == 1:
            for key in selected_keys_pair:
                G_connectors_ranges.append(generate_connector_range(key))
    elif show_all_con_ranges:
        G_connectors_ranges = [geo for key, geo in open_connectors_ranges]
    else:
        G_connectors_ranges = []

    # options for stability check
    options_geo = []
    for option in elem_options:
        options_geo.append(cylinder_to_rhino(option._source))
    
    assembly.elem_options = elem_options


if joining_case == 0:
    print '-------------- CASE 1: SINGLE OPTIONS-PAIR -------------'
elif joining_case == 1:
    print '-------------- CASE 2: TWO OPTIONS-PAIRS ---------------'
print 'Number of key-pairs that can be joined:', len(connectors_pairs)
print 'Selected open connectors key-pair:', assembly.selected_keys_pair
if len(assembly.selected_keys_pair) != 0:
    print 'Open connector key for option:', assembly.selected_keys_pair[0]
print 'Option 1 angle:', angle1
print 'Option 2 angle:', angle2
# ---------- end joining_branches_new_2 ----------
line = Line(joining_branches_new_2.line_int)
geo = Geometry(joining_branches_new_2.new_elem_mesh)
geo_2 = Geometry(joining_branches_new_2.intersections)
surface = Surface(joining_branches_new_2.G_connectors_ranges)
geo_3 = Geometry(joining_branches_new_2.options_geo)
line_2 = Line(joining_branches_new_2.elem_line2)
line_3 = Line(joining_branches_new_2.elem_line1)

keys_2 = Panel(joining_branches_new_2.selected_keys_pair)
ass_data = GhPythonScript(assembly=joining_branches_new_2.assembly)  # -> out, a
# ---------- ass_data: Python ----------
"""status_robot_AA = 'FREE'
status_robot_AB = 'FREE'

N = assembly.network.number_of_nodes()
r_stabilizing = assembly.network.node_attribute(N-1, 'stabilizing_robot')
print r_stabilizing
#r_stabilizing = assembly.network.node_attribute(N-1, 'placed_by')

if r_stabilizing == 'AA':
    status_robot_AA = 'Stab.'
if r_stabilizing == 'AB':
    status_robot_AB = 'Stab.'"""
    
#print status_robot_AA, status_robot_AB

for key, element in assembly.elements():
    print key
    print assembly.network.node_attribute(key, 'placed_by'), assembly.network.node_attribute(key, 'robot_name'),assembly.network.node_attribute(key, 'stabilizing_robot'),assembly.network.node_attribute(key, 'key_held_by_robot')
# ---------- end ass_data ----------
panel_28 = Panel(ass_data.out)
rec_4 = DataRecorder(joining_branches_new_2.out, DataLimit=-10, RecordData=True)
panel_29 = Panel(rec_4)
ghpython_script_4 = GhPythonScript(
    assembly=join_keys.assembly,
    elem=elem_60_def.elem,
    current_key=settings_parameters.current_key,
    unit_size=settings_parameters.current_unit_size,
    shift_value=settings_parameters.current_shift_value,
    elem_options=settings_parameters.elem_options,
    mirror_unit=settings_parameters.current_mirror_unit,
    pair_index=pair_index,
    show_new_element=_3rd_new_element,
    join_branches=join,
    point1=point1,
    point2=point2)  # -> out, assembly, selected_connector_range, open_connectors_ranges_viz, intersections, selected_keys_pair, new_elem_mesh, angle1; inputs elem_options: list, pair_index: Int32; disabled
# ---------- ghpython_script_4: Python ----------
import rhinoscriptsyntax as rs
import Rhino.Geometry as rg
import math


from compas.geometry import Point, Vector, Frame, Plane, Vector, Line, Transformation, Rotation, Translation
from compas.geometry import angle_vectors, closest_point_on_line, intersection_line_plane, angles_points
from compas.artists import Artist
from compas_rhino.conversions import line_to_rhino_curve, point_to_compas, point_to_rhino, plane_to_compas_frame


#print elem_options
intersections = []
connectors_pairs = []

epsilon = 0.0000001

def generate_connector_range(current_key):
    elem = assembly.element(current_key)

    # generate option based on input parameters
    elem_options = elem.current_option_elements(assembly, mirror_unit, unit_size, 0, shift_value)
    selected_option = Artist(elem_options[0].line).draw()
    
    rod_length =  assembly.globals['rod_length']
    l1 = math.sqrt(3)*unit_size + shift_value
    # find the point depending on the open connector
    if elem.connector_1_state == True:
        n = 0.0
        l1 = rod_length - l1 - 0.05
    if elem.connector_2_state == True:
        n = 1.0
        l1 = l1 + 0.05
    
    start_pt = rg.Line.PointAt(selected_option, n)
    end_pt = rg.Line.PointAtLength(selected_option, l1)
    
    # create connector range based on line
    section_line = rg.Line(start_pt, end_pt)
    #print (section_line.Length)
    rot_axis = Artist(assembly.element(current_key).line).draw()
    connector_range = rg.RevSurface.Create(section_line, rot_axis)
    
    return connector_range

#selected_connector_range = generate_connector_range(3)

open_connectors_keys = [key for key, frames in assembly.connectors(state='open')]
#print open_connectors_keys

open_connectors_ranges = []

for key in open_connectors_keys:
    
    open_connectors_ranges.append([key, generate_connector_range(key)])
    
    
for i in range(len(open_connectors_ranges)):
    for open_connectors_key in open_connectors_keys:
        intersection = rg.Intersect.Intersection.CurveSurface(line_to_rhino_curve(assembly.element(open_connectors_key).line), open_connectors_ranges[i][1], 0.001, 0.001)
        if intersection:
            for c in intersection:
                intersections.append(c.PointA)
            connectors_pairs.append((open_connectors_ranges[i][0], open_connectors_key))

open_connectors_ranges_viz = [range for key, range in open_connectors_ranges]
print connectors_pairs

if len(connectors_pairs) != 0:
    intersection_point = intersections[pair_index]
    selected_keys_pair = [pkey for pkey in connectors_pairs[pair_index]]
    connectors_pairs_list = [key for pair in connectors_pairs for key in pair]
    
    print selected_keys_pair
    
    assembly.selected_keys_pair = [selected_keys_pair[0]]
    assembly.connectors_pairs_list = connectors_pairs_list
    assembly.selected_connectors_ranges_intersection_point = intersection_point
    
    # Convert in COMPAS Point
    cp = point_to_compas(intersection_point)
    
    # Compute angle for option pair
    open_connector_elem_1 = assembly.element(selected_keys_pair[0])
    cutting_plane_origin_1 = closest_point_on_line(cp, open_connector_elem_1.line)
    cutting_plane_1 = Plane(cutting_plane_origin_1, open_connector_elem_1.line.vector)
    intersection_point_1 = intersection_line_plane(open_connector_elem_1.current_option_elements(assembly, mirror_unit, unit_size, 0, shift_value)[1].line, cutting_plane_1)

    angle1 = angles_points(cutting_plane_origin_1, intersection_point_1, cp) 
    angle1 = math.degrees(angle1[0])
    
    current_option = assembly.element(selected_keys_pair[0]).current_option_elements(assembly, mirror_unit, unit_size, angle1, 0)

    rot_line = Artist(assembly.element(selected_keys_pair[0]).line).draw()
    start_p = rot_line.From
    rot_axis = rg.Vector3d(rot_line.From - rot_line.To)
    rot_point = Artist(assembly.element(selected_keys_pair[0]).frame.point).draw()
    elem_line1 = Artist(current_option[0].line).draw()
    elem_line2 = Artist(assembly.element(selected_keys_pair[1]).line).draw()
    rot_dir = 1
    step = 0.5
    
    print rot_point

    #tol_angle = assembly.get_rot_angle(step, rot_axis, rot_point, elem_line1, elem_line2, rot_dir, epsilon)
    #angle1 += tol_angle
    print angle1
    current_option_rotated = assembly.element(selected_keys_pair[0]).current_option_elements(assembly, mirror_unit, unit_size, angle1, shift_value)
    
    if show_new_element:
        new_elem = assembly.add_third_element(elem, assembly.element(selected_keys_pair[1]), current_option_rotated[1], point1, point2, shift_value, epsilon)
        new_elem_mesh = Artist(new_elem.mesh).draw()
    
    if join_branches:
        msgs = []
        
        # close a reciprocal frame unit with the option elements with the highest score
        assembly.join_branches(selected_keys_pair, mirror_unit, angle1, 0, new_elem, robot_frame=BCF, on_ground=False)

        msgs.append('--- New element added to assembly ---')
        
        for msg in msgs:
            print(msg)
else:
    assembly.selected_keys_pair = []
    assembly.connectors_pairs_list = []
    assembly.selected_connectors_ranges_intersection_point = []
# ---------- end ghpython_script_4 ----------
preview = CustomPreview(Geometry=geo, Material=ColourSwatch(SwatchColor=RGBA(255, 85, 0, 120)))

# ---- group: Rotation angle Visualised
pt_6 = GhPythonScript(p=joining_branches_new_2.cutting_plane_origin_1)  # -> out, pt; inputs p: list
# ---------- pt_6: Python ----------
__author__ = "lovek"
__version__ = "2024.01.09"

import rhinoscriptsyntax as rs
print str('{'+'{},{},{}'.format(p[0],p[1],p[2])+'}')
# ---------- end pt_6 ----------
pt_7 = GhPythonScript(p=joining_branches_new_2.intersection_point_1)  # -> out, pt; inputs p: list; same code as pt_6
a = Point(pt_6.out)
c = Point(joining_branches_new_2.intersection_point)
b = Point(pt_7.out)
polyline = PolyLine(Vertices=flatten([c, a, b]), Closed=False)
custom_preview = CustomPreview(Geometry=b, Material=ColourSwatch(SwatchColor=RGB(94, 130, 3)))
vector_2pt = Vector2Pt(PointA=a, PointB=b, Unitize=False)  # -> Vector, Length
vector_2pt_2 = Vector2Pt(PointA=a, PointB=c, Unitize=False)  # -> Vector, Length
plane_3pt = Plane3Pt(PointA=a, PointB=b, PointC=c)
angle_3 = Angle(VectorA=vector_2pt.Vector, VectorB=vector_2pt_2.Vector)  # -> Angle, Reflex
vector_display = VectorDisplay(Anchor=a, Vector=joining_branches_new_2.v)
degrees = Degrees(Radians=angle_3.Angle)
degrees_2 = Degrees(Radians=angle_3.Reflex)
panel_30 = Panel(degrees_2)
panel_31 = Panel(degrees)

# ----
surface_2 = Surface(ghpython_script_4.selected_connector_range)  # disabled
surface_3 = Surface(ghpython_script_4.open_connectors_ranges_viz)  # disabled
point_6 = Point(ghpython_script_4.intersections)  # disabled
mesh_2 = Mesh(ghpython_script_4.new_elem_mesh)  # disabled
error_2 = GhPythonScript(error=join_keys.error, error_msg=join_keys.error_msg)  # -> out; disabled
# ---------- error_2: Python ----------
################################################################################
# SampleEtoDialog.py
# MIT License - Copyright (c) 2017 Robert McNeel & Associates.
# See License.md in the root of this repository for details.
################################################################################
from Rhino.UI import *
from Eto.Forms import *
from Eto.Drawing import *

################################################################################
# Sample dialog
################################################################################
import Eto.Forms as forms
import Rhino.UI
from Eto.Drawing import *

class ErrorDialog(forms.Dialog):
    def __init__(self, error_message):
        self.Title = "Error Dialog"
        self.Padding = Padding(20)
        self.ClientSize = Size(500, 100)
        
        self.layout = forms.DynamicLayout()
        
        self.error_label = forms.Label(Text=error_message)
        self.layout.AddRow(self.error_label)
        
        # Create the OK button and set its size
        self.ok_button = forms.Button(Text="OK")
        self.ok_button.Size = Size(100, 40)  # Set the button size explicitly
        self.ok_button.Click += self.on_ok_button_click
        self.layout.AddRow(None, self.ok_button)  # Align the button to the right
        
        self.Content = self.layout

    def on_ok_button_click(self, sender, e):
        self.Close()

# Function to display the error dialog
def display_error_dialog(error_message):
    dialog = ErrorDialog(error_message)
    rc = dialog.ShowModal(Rhino.UI.RhinoEtoApp.MainWindow)


################################################################################
# Check to see if this file is being executed as the "main" python
# script instead of being used as a module by some other python script
# This allows us to use the module which ever way we want.
################################################################################

#error = True

# Example usage: Call this function with an error message to display the dialog
if error:
    display_error_dialog(error_msg)
# ---------- end error_2 ----------

stability_vis = GhPythonScript(
    assembly=joining_branches_new_2.assembly,
    current_key=settings_parameters.current_key,
    selected_mode=settings_parameters.selected_mode,
    la_limit=la_limit,
    show_resultant=stability_feedback,
    selected_keys_pair=joining_branches_new_2.selected_keys_pair)  # -> out, stability_feedback, resultant, resultant_colors, sp_branches, sp_planar_branches, resultant_pt, la_text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; inputs current_key: Int32, selected_keys_pair: list
# ---------- stability_vis: Python ----------
from compas.topology import connected_components
import Rhino.Geometry as rg

import copy

#############################################################################
## LOCAL EQUILIBRIUM CHECK
#############################################################################

lever_arm_branches = []
resultant_branches = []
resultant = []
print current_key

elem_options = assembly.elem_options

if assembly.stability_check == 'local':
    
    if selected_mode == '(1) Manual' or selected_mode == '(2) Automatic':
        # Identify the connected elements (branches) in the assembly.
        branches = connected_components(assembly.network.adjacency)
        sel_key = current_key
    
    if selected_mode == '(3) Join branches':
        #selected_keys_pair = assembly.selected_keys_pair
        print selected_keys_pair
        if selected_keys_pair != [None]:
        # Identify the connected elements (branches) in the assembly.
            adj = copy.deepcopy(assembly.network.adjacency)
            adj[selected_keys_pair[0]].update({selected_keys_pair[1]: None})
            adj[selected_keys_pair[1]].update({selected_keys_pair[0]: None})
            
            branches = connected_components(adj)
            sel_key = selected_keys_pair[0]
        else:
            branches = connected_components(assembly.network.adjacency)
            sel_key = current_key
    
    print(branches)
    
    stability_feedback = []
    
    # calculate stability for all branches
    lever_arm_branches, resultant_branches, sp_branches, sp_planar_branches, stability_feedback, key_held_by_robot, stabilising_robot  = assembly.calculate_local_equilibrium_in_all_branches(sel_key, elem_options, la_limit, branches)
    print key_held_by_robot, stabilising_robot
else:
    stability_feedback = "No stability criteria selected."
    
#print lever_arm_branches
#print resultant_branches
print sp_planar_branches
resultant_pt = []
resultant_colors = []
print current_key

if show_resultant:
    
    la_text = []
    for resultant_line, lever_arm in zip(resultant_branches, lever_arm_branches):
        cone_base_plane = rg.Plane(resultant_line.PointAt(0), rg.Vector3d.ZAxis*-1)
        #cone_base_plane.Translate(rg.Vector3d.ZAxis*0.136)
        if lever_arm != 0:
            resultant.append(rg.Circle(cone_base_plane,lever_arm))
            la_text.append('la= {len:.3f}m'.format(len=float(lever_arm)))
        else:
            resultant.append(rg.Circle(cone_base_plane,0.01))
            la_text.append('')
        
        resultant_pt.append(cone_base_plane)
        
        if lever_arm > la_limit:
            resultant_colors.append('255,13,0 (103)')
        else:
            resultant_colors.append('70,128,0 (103)')
# ---------- end stability_vis ----------
srf = Surface(stability_vis.resultant)
pt_8 = Point(stability_vis.resultant_pt)
dot_display = DotDisplay(Point=pt_8, Colour=stability_vis.resultant_colors, Size=0.01)
dot_display_2 = DotDisplay(Point=stability_vis.sp_branches, Colour=ColourSwatch(SwatchColor=RGB(0, 0, 255)), Size=0.03)
text_tag_2 = TextTag(Location=stability_vis.resultant_pt, Text=stability_vis.la_text, Colour=RGB(84, 84, 84))

joining_branches = Panel(joining_branches_new_2.out)
stability_feedback_2 = Panel(stability_vis.stability_feedback)
key_to_stab = Panel(stability_vis.key_held_by_robot)

stab_robot = Panel(stability_vis.stabilising_robot)

grow_assembly = GhPythonScript(
    assembly=joining_branches_new_2.assembly,
    selected_mode=settings_parameters.selected_mode,
    key=settings_parameters.current_key,
    angle=settings_parameters.current_angle,
    angle1=joining_branches_new_2.angle1,
    angle2=joining_branches_new_2.angle2,
    shift_value=settings_parameters.current_shift_value,
    mirror_unit=settings_parameters.current_mirror_unit,
    unit_size=settings_parameters.current_unit_size,
    key_held_by_robot=stability_vis.key_held_by_robot,
    stabilising_robot=stability_vis.stabilising_robot,
    add=add,
    joining_case=list_2,
    selected_keys_pair=joining_branches_new_2.selected_keys_pair,
    new_elem=joining_branches_new_2.new_elem,
    option_elem_num=joining_branches_new_2.option_elem_num)  # -> out, test, msgs, assembly; inputs mirror_unit: Boolean, selected_keys_pair: list
# ---------- grow_assembly: Python ----------
from compas_rhino.conversions import plane_to_compas_frame

import Rhino.UI
from cdf_2023.assembly.gui import ErrorDialog


robot_AA_base_frame = plane_to_compas_frame(assembly.robot_AA_base_plane)
robot_AB_base_frame = plane_to_compas_frame(assembly.robot_AB_base_plane)
#print robot_AA_base_frame

#############################################################################
## ADD ELEMENTS TO ASSEMBLY BY SELECTED  KEY, ANGLE AND SHIFT_VALUE
#############################################################################

robot_name = assembly.get_free_robot_name()

if add and (selected_mode == "(1) Manual" or selected_mode == "(2) Automatic"):
    msgs = []
    
    if not is_colliding:
        # close a reciprocal frame unit with the option elements with the highest score
        assembly.close_rf_unit(key, mirror_unit, unit_size, angle, shift_value, robot_name, key_held_by_robot, stabilising_robot, robot_AA_base_frame, robot_AB_base_frame, on_ground=False)
        assembly.open_connectors_keys.remove(key)
        msgs.append('--- New elements added to key {} ---'.format(key))
    else:
        ErrorDialog('Elements are colliding, not possible to add elements').display()
        msgs.append('--- Elements are colliding, not possible to add elements ---')
        
    for msg in msgs:
        print(msg)



#############################################################################
## JOIN BRANCHES
#############################################################################

if add and selected_mode == "(3) Join branches":

## CASE 1
    if joining_case == 0:
        msgs = []
        if not is_colliding:
            # close a reciprocal frame unit with the option elements with the highest score
            assembly.join_branches(selected_keys_pair, mirror_unit, angle1, shift_value, unit_size, new_elem, option_elem_num, robot_name, key_held_by_robot, stabilising_robot, on_ground=False)
            
            msgs.append('--- New elements added to key {} ---'.format(selected_keys_pair[0]))
        
        else:
            ErrorDialog('Elements are colliding, not possible to add elements').display()
            msgs.append('--- Elements are colliding, not possible to add elements ---')
        
        for msg in msgs:
            print(msg)

## CASE 2
    if joining_case == 1:
        #print selected_keys_pair
        msgs = []
        
        robot_AA_base_frame = plane_to_compas_frame(assembly.robot_AA_base_plane)
        robot_AB_base_frame = plane_to_compas_frame(assembly.robot_AB_base_plane)
        
        if not is_colliding:
            # join the branches for the first key in the pair
            assembly.close_rf_unit(selected_keys_pair[0], mirror_unit, unit_size, angle1, shift_value, robot_name, key_held_by_robot, stabilising_robot, robot_AA_base_frame, robot_AB_base_frame, on_ground=False)
            assembly.open_connectors_keys.remove(selected_keys_pair[0])
            msgs.append('--- New elements added to key {} ---'.format(selected_keys_pair[0]))
            
            # define a new pair for joining as in case 1
            new_key = assembly.network.number_of_nodes() - 2 - option_elem_num
            new_keys_pair = [selected_keys_pair[1], new_key]
        
            # join the branches for the secon key in the pair
            assembly.join_branches(new_keys_pair, mirror_unit, angle2, shift_value, unit_size, new_elem, option_elem_num, robot_name, key_held_by_robot, stabilising_robot, on_ground=False)
            msgs.append('--- New elements added to key {} ---'.format(selected_keys_pair[1]))
        else:
            ErrorDialog('Elements are colliding, not possible to add elements').display()
            msgs.append('--- Elements are colliding, not possible to add elements ---')
        
        for msg in msgs:
            print(msg)
# ---------- end grow_assembly ----------

# ----
# Story of added Elements
# Orange round button
# -> recording in process
# Press X to clean
rec_5 = DataRecorder(grow_assembly.out, DataLimit=-10, RecordData=True)
messages = Panel(rec_5)

# ----
# Story of added Elements
# Orange round button
# -> recording in process
# Press X to clean
rec_6 = DataRecorder(grow_assembly.msgs, DataLimit=-10, RecordData=True)
messages_2 = Panel(rec_6)

preview_2 = CustomPreview(Geometry=srf, Material=stability_vis.resultant_colors)
preview_3 = CustomPreview(Geometry=stability_vis.sp_planar_branches, Material=stability_vis.resultant_colors)

assembly_viz = PythonScript(
    assembly=grow_assembly.assembly,
    selected_mode=settings_parameters.selected_mode,
    viz=reset,
    joint_elem=elem_60_def.joint_elem,
    joint_elem_mirrored=elem_60_def.joint_elem_mir,
    preview_mode=mode,
    show_assembly=assembly,
    show_target_geo=target_geometry_2,
    show_support_geo=support_geometry,
    show_robots_reach=robots_reach,
    show_support=support_elems,
    show_selected=selected_key,
    show_option=option,
    show_open_connectors_planes=open_connectors_planes,
    show_all_frames=all_frames,
    show_selected_connectors_ranges=selected_connectors_ranges,
    show_all_connectors_ranges=all_connectors_ranges,
    show_intersection=intersections,
    show_joining_options=get_joining_options,
    show_open_keys=open_keys,
    show_all_keys=all_keys,
    show_short_dist=shortest_distance,
    show_joints=joints,
    selected_key=settings_parameters.selected_key,
    current_key=settings_parameters.current_key,
    collision_det=collision_check,
    angle=settings_parameters.current_angle,
    angle1=joining_branches_new_2.angle1,
    angle2=joining_branches_new_2.angle2,
    mirror_unit=settings_parameters.current_mirror_unit,
    unit_size=settings_parameters.current_unit_size,
    shift_value=settings_parameters.current_shift_value)  # -> out, G_target_geo, G_support_geo, G_planned_elems, planned_mat, branch_geo, colors_branches, gradient_colors_br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; inputs current_key: Int32, dist_elem: list, short_line: Line
# ---------- assembly_viz: Python ----------
import os
import sys
from scriptcontext import sticky as st
import Rhino.Geometry as rg
from cdf_2023.assembly import gui

import ghpythonlib.components as gh

import math
from math import pi

from compas.geometry import Vector, Translation, Frame, Transformation
from compas.artists import Artist
from compas.colors import Color
from compas_rhino.conversions import cylinder_to_rhino, frame_to_rhino
from compas.topology import connected_components


show_collision = True

G_opt_collision = []
G_selected = []
G_dist_elems = []

G_placed_by_human = []
G_placed_by_robot = []

G_supports = []

G_planned_elems = []
planned_connector_planes = []
G_built_elems = []
G_support_elems = []
G_branches =[]

G_no_open_connectors_elems = []
G_open_connectors_elems = []

G_connectors_ranges = []
G_close_pairs = []
G_intersection = []

G_joints = []

robots_reach = []
elem_options = []

key_tag_text = []
key_tag_location= []
lines = []
support_pt = []

flip = 'AA'

# Color coding
color_coding = {'color_close_pairs': Color(1.0, 0., 0.0, 1.0),
                'color_is_planned': Color(1.0, 0.752941176471, 0.0, 1.0), 
                'color_is_support': Color(0.0, 0.0, 1.0, 1.0), 
                'color_has_open_connector': Color(0.494117647059, 1.0, 0.239215686275, 1.0), 
                'color_has_no_open_connectors': Color(0.78431372549, 0.78431372549, 0.78431372549, 1.0), 
                'color_is_built': Color(0.811764705882, 1.0, 0.709803921569, 1.0), 
                'color_is_built_by_robot': Color(0.686274509804, 0.878431372549, 0.862745098039, 1.0), 
                'color_is_built_by_human': Color(0.949019607843, 0.898039215686, 0.0, 1.0)}

def generate_colors(n):
    colors = []
    x = 70
    for i in range(n):
        r = 0
        g = int((i / (n - 1)) * (255-x) + x)  # Varying from x to 255
        b = 0
        
        # Create a Color object and get the RGB values
        color = Color.FromArgb(r, g, b)
        rgb_values = "{},{},{}".format(color.R, color.G, color.B)
        
        # Append the RGB values to the colors list
        colors.append(rgb_values)
    
    return colors

def generate_gradient(color_start, color_end, n):
    colors = []
    # Extract RGB components from start and end colors
    r_start, g_start, b_start = color_start
    r_end, g_end, b_end = color_end
    
    if n > 1:
        for i in range(n):
            # Calculate the RGB values for the gradient
            r = int(r_start + (i / (n - 1)) * (r_end - r_start))
            g = int(g_start + (i / (n - 1)) * (g_end - g_start))
            b = int(b_start + (i / (n - 1)) * (b_end - b_start))
        
            # Append the RGB values to the colors list
            rgb = '{},{},{}'.format(r,g,b)
            colors.append(rgb)
    else:
        rgb = '{},{},{}'.format(r_end,g_end,b_end)
        colors.append(rgb)
    
    return colors


keys = [key for key, element in assembly.elements()]
lines = [Artist(assembly.element(key).line).draw() for key in keys]

open_connectors_frames = [assembly.element(key).connectors(state='open') for key, element in assembly.elements()]
all_connectors_frames = [assembly.element(key).connectors() for key, element in assembly.elements()]
element_frames = [assembly.element(key).frame for key, element in assembly.elements()]

# Identify the connected elements (branches) in the assembly.
branches = connected_components(assembly.network.adjacency)
#print ('branch', branches, len(branches))

#print open_connectors_frames
#print element_frames

selected_element = assembly.element(current_key)

selected_connectors_ranges = [assembly.element(key).connectors_ranges(state='open') for key in keys if key == current_key or key in assembly.selected_keys_pair]
#selected_connectors_ranges = [assembly.element(key).connectors_ranges(state='open') for key in keys if key in assembly.selected_keys_pair]
all_connectors_ranges = [assembly.element(key).connectors_ranges(state='open') for key in keys if key]

if show_open_connectors_planes:
    open_connectors_planes = [Artist(connector).draw() for connectors in open_connectors_frames for connector in connectors if connectors != []]
if show_all_frames:
    all_connectors_planes = [Artist(connector).draw() for connectors in all_connectors_frames for connector in connectors if connectors != []]
    all_element_planes = [Artist(elem).draw() for elem in element_frames]
    
#if show_all_connectors_ranges and not show_selected_connectors_ranges:
#    G_connectors_ranges = [Artist(connector).draw() for connectors in all_connectors_ranges for connector in connectors if connectors != []]
    
#elif show_selected_connectors_ranges and not show_all_connectors_ranges:
#    T = Translation.from_vector(selected_element.frame.xaxis * 0)
#    connectors_ranges = [connector.transform(T) for connectors in selected_connectors_ranges for connector in connectors if connectors != []]
#    G_connectors_ranges = [Artist(connector).draw() for connectors in connectors_ranges]
    
#else:
#    G_connectors_ranges = []
    
if show_intersection:
    if len(assembly.selected_connectors_ranges_intersection_point) > 0:
        G_intersection = assembly.selected_connectors_ranges_intersection_point
    
def show(element, output_geo, color):
    mesh = Artist(element.mesh).draw(color)
    output_geo.append(mesh)

def show_multiple(elements, output_geo, color):
    for element in elements:
        mesh = Artist(element.mesh).draw(color)
        output_geo.append(mesh)
        
if show_robots_reach:
    robots_reach.append(rg.Sphere(assembly.ur_arm_AA_base_plane.Origin, 1.25))
    robots_reach.append(rg.Sphere(assembly.ur_arm_AB_base_plane.Origin, 1.25))
    
print 'join_branches', assembly.selected_keys_pair

if assembly:
    radius = assembly.globals['rod_radius']
    if current_key != None:
        elem_options = assembly.elem_options
        
        """current_element = assembly.element(current_key)
        if show_joining_options and len(assembly.selected_keys_pair) != 0:
            elem_options = assembly_
            print 'yes'
            if len(assembly.selected_keys_pair) > 1: 
                elem_options.append(assembly.element(assembly.selected_keys_pair[0]).current_option_elements(assembly, mirror_unit, unit_size, angle1, shift_value))
                elem_options.append(assembly.element(assembly.selected_keys_pair[1]).current_option_elements(assembly, mirror_unit, unit_size, angle2, shift_value))
            else:
                elem_options.append(assembly.element(assembly.selected_keys_pair[0]).current_option_elements(assembly, mirror_unit, unit_size, angle1, shift_value))
            elem_options = [option for options in elem_options for option in options]
        else:
            elem_options = assembly.element(current_key).current_option_elements(assembly, mirror_unit, unit_size, angle, shift_value)
        #G_selected = Artist(assembly.element(current_key).mesh).draw(color_coding['color_is_support'])"""
    else:
        current_element = None
        elem_options = []
    
    if len(elem_options) != 0:
        elem_option = elem_options[0]
        print elem_option
        #all_connectors_frames = [assembly.element(key).connectors() for key, element in assembly.elements()]
        #planned_connector_frames = [elem.connectors() for elem in elem_option]
    
    if flip_human_robot:
        elem_options.reverse()
    
    planned_keys = list(assembly.network.nodes_where({'is_planned':True, 'is_built':False}))
    built_keys = list(assembly.network.nodes_where({'is_built':True}))
    unbuilt_keys = [key for key, element in assembly.elements() if key not in built_keys]
    support_keys = list(assembly.network.nodes_where({'is_support':True}))
    #open_connectors_keys = [key for key, frames in assembly.connectors('open') if frames != []]
    open_connectors_keys = assembly.open_connectors_keys
    no_open_connectors_keys = [key for key in planned_keys if key not in open_connectors_keys]
    
    robot_keys = list(assembly.network.nodes_where({'placed_by':'robot'}))
    print('robot', robot_keys)
    human_keys = list(assembly.network.nodes_where({'placed_by':'human'}))
    
    mirrored_keys = list(assembly.network.nodes_where({'is_mirrored':True}))
    unmirrored_keys = list(assembly.network.nodes_where({'is_mirrored':False}))
    #support_keys = [key for key in support_keys if key not in assembly.open_connectors_keys]
    
    print 'robot keys:', robot_keys
    print 'human keys:', human_keys
    
    print 'planned keys:', planned_keys
    print 'built keys:', built_keys
    print 'unbuilt keys:', unbuilt_keys
    
    print 'support keys:', support_keys
    print 'open connectors keys:', open_connectors_keys
    print 'no open connectors keys:', no_open_connectors_keys
    
    robot_elements = [assembly.element(key) for key in robot_keys] 
    human_elements = [assembly.element(key) for key in human_keys] 
    
    planned_elements = [assembly.element(key) for key in planned_keys] 
    built_elements = [assembly.element(key) for key in built_keys] 
    
    mirrored_elements = [assembly.element(key) for key in mirrored_keys] 
    unmirrored_elements = [assembly.element(key) for key in unmirrored_keys] 
    
    support_elements = [assembly.element(key) for key in support_keys] 
    open_connectors_elements = [assembly.element(key) for key in open_connectors_keys]
    no_open_connectors_elements = [assembly.element(key) for key in no_open_connectors_keys]
    open_keys = [key for key, frames in assembly.connectors('open') if frames != []]
    
    # assign materials for planned elements dependong on robots reach
    planned_mat = []
    for element in elem_options:
        if element.frame.point.z > 3.0:
            planned_mat.append("255,0,0 (120)")
        else:
            planned_mat.append("255,170,0 (120)")


    # Vizualize current connector 
    if show_option and show_assembly:
        if elem_options:
            is_colliding, dist, dist_elem, short_line = assembly.collision_check(current_key, elem_options, tolerance=-0.001)
            
            if is_colliding:
                colliding_key = dist_elem[0]
                G_elem_coll = cylinder_to_rhino(assembly.element(colliding_key)._source)
                for option, i in zip (elem_options, range(len(elem_options))) :
                    if option == dist_elem[1]:
                    #if i == dist_elem[1]:
                        print 'here'
                        G_opt_collision.append(cylinder_to_rhino(option._source))
                    else:
                        G_planned_elems.append(cylinder_to_rhino(option._source))
            else: 
                for option in elem_options:
                    G_planned_elems.append(cylinder_to_rhino(option._source))
                
                if show_short_dist:
                    G_short_line = short_line
                    line_middle = gh.CurveMiddle(short_line)
                    dist_label = '{}mm'.format(int(dist*1000))
        else:
            print('No open connectors')

#    if show_assembly and show_collision and show_option and short_line:
#        collision_color = '255,129,120'
#        if is_colliding:
#            collision_color = '255,0,0'
#            for element in dist_elem:
#                geo = cylinder_to_rhino(element._source)
#                G_dist_elems.append(geo)
#        else:
#            if show_short_dist:
#                G_short_line = short_line
#                line_middle = gh.CurveMiddle(short_line)
#                dist_label = '{}mm'.format(int(dist*1000))

    # Visualize assembly
    if show_assembly:
        if preview_mode == 3: # Sequence
            colors_sequence = []
            G_sequence = []
            i = 0
            total_elements = assembly.network.number_of_nodes()
            gradient_colors_seq = generate_gradient((235,235,255), (0,0,255), total_elements)
            
            for key, element in assembly.elements():
                c = gradient_colors_seq[i]
                geo = cylinder_to_rhino(assembly.element(key)._source)
                G_sequence.append(geo)
                colors_sequence.append(c)
                i +=1
        
        if preview_mode == 2: # Branches
            colors_branches = []
            branch_geo =[]
            
            branches = connected_components(assembly.network.adjacency)
            gradient_colors_br = generate_gradient((186,217,193), (0,128,0), len(branches))
            
            if show_selected and selected_mode != "(3) Join branches": 
                G_selected_elem = cylinder_to_rhino(assembly.element(selected_key)._source)
                print ("here 1")
            
            i = 0
            for branch in branches:
                c = gradient_colors_br[i]
                for key in branch:
                    geo = cylinder_to_rhino(assembly.element(key)._source)
                    branch_geo.append(geo)
                    colors_branches.append(c)
                    
                i +=1
                #G_branches.append(branch_geo)
            #print ('branch', G_branches)
        
#        if preview_mode == 2: # Assembly workflow
#            for element in planned_elements:
#                geo = cylinder_to_rhino(element._source)
#                G_planned_elems.append(geo)
#                
#            for element in built_elements:
#                geo = cylinder_to_rhino(element._source)
#                G_built_elems.append(geo)
#                
#            for element in support_elements:
#                geo = cylinder_to_rhino(element._source)
#                line = element.line.draw()
#                support_pt.append(element.line.draw())
#                #G_support_elems.append(geo)
                
            
        elif preview_mode == 1: # Design Generation
            for element in support_elements:
                geo = cylinder_to_rhino(element._source)
                G_support_elems.append(geo)
                
            for element in open_connectors_elements:
                geo = cylinder_to_rhino(element._source)
                G_open_connectors_elems.append(geo)
                
            for element in no_open_connectors_elements:
                geo = cylinder_to_rhino(element._source)
                G_no_open_connectors_elems.append(geo)
                
            if show_selected and selected_mode != "(3) Join branches": 
                G_selected_elem = cylinder_to_rhino(assembly.element(selected_key)._source)
            
        else: # Build by human/robot
            for element in robot_elements:
                geo = cylinder_to_rhino(element._source)
                G_placed_by_robot.append(geo)
                
            for element in human_elements:
                geo = cylinder_to_rhino(element._source)
                G_placed_by_human.append(geo)

    # Vizualize current connector 
    if show_option and show_assembly:
        if elem_options:
            is_colliding, dist, dist_elem, short_line = assembly.collision_check(current_key, elem_options, tolerance=-0.001)
            
            if is_colliding:
                colliding_key = dist_elem[0]
                G_elem_coll = cylinder_to_rhino(assembly.element(colliding_key)._source)
                for option, i in zip (elem_options, range(len(elem_options))) :
                    if i == dist_elem[1]:
                        G_opt_collision.append(cylinder_to_rhino(option._source))
                    else:
                        G_planned_elems.append(cylinder_to_rhino(option._source))
     
        else:
            print('No open connectors')

    #elem_option_robot = Artist(elem_options[0].frame).draw() # elem for planning robot routine



    # show the keys
    if show_open_keys:
        for key, element in assembly.elements():
            if key in open_connectors_keys:
                key_tag_text.append(str(key))
                key_tag_location.append(Artist(element.frame).draw().Origin)
    
    if show_all_keys:
        for key, element in assembly.elements():
            key_tag_text.append(str(key))
            key_tag_location.append(Artist(element.frame).draw().Origin)
            

# visualise target geometry
if show_target_geo:
    G_target_geo = assembly.target_geo

# visualise supporting geo
if show_support_geo:
    G_support_geo = assembly.support


points = []
for key, element in assembly.elements():
    points.append(Artist(element.frame.point).draw())
    
joints = []
joint_planes = []

"""if show_joints:
    #for key, element in assembly.elements():
        #joint_planes.append(Artist(element.joint_frame_1).draw())
        #joint_planes.append(Artist(element.joint_frame_2).draw())
        #robot_keys = list(assembly.network.nodes_where({'placed_by':'robot', 'is_built':True}))
    
    for key, element in assembly.elements():
        if not element.connector_1_state:
            joint_planes.append(Artist(element.joint_frame_1).draw())
            #joints.append(frame_to_rhino(element.joint_frame_1))
        #if not element.connector_2_state and key not in support_keys:
        if not element.connector_2_state:
            #joints.append(frame_to_rhino(element.joint_frame_2))
            joint_planes.append(Artist(element.joint_frame_2).draw())"""

assembly.support_keys = support_keys


if show_joints:
    pairs =  assembly.connections()
    
    j_R = assembly.globals['rod_radius']*2 + assembly.globals['joint_dist']/2
    joint_cps = []
    
    for pair in pairs:
        line1 = Artist(assembly.element(pair[0]).line).draw()
        line2 = Artist(assembly.element(pair[1]).line).draw()
        
        d, node_line = assembly.shortest_distance_between_two_lines(line1,line2)
        joint_cp = gh.CurveMiddle(node_line)
        joint_cps.append(joint_cp)

total_joints = assembly.network.number_of_edges()
total_elements = assembly.network.number_of_nodes()

print total_elements, total_joints, len(joint_cps)
# ---------- end assembly_viz ----------
geo_4 = Geometry(assembly_viz.G_selected_elem)
geo_5 = Geometry(assembly_viz.G_dist_elems)
sph = Sphere(Base=assembly_viz.joint_cps, Radius=assembly_viz.j_R)
geo_6 = Geometry(assembly_viz.G_support_elems)
geo_7 = Geometry(assembly_viz.G_target_geo)
geo_8 = Geometry(assembly_viz.G_support_geo)
geo_9 = Geometry(assembly_viz.branch_geo)
plane_2 = Plane(assembly_viz.planned_connector_planes)
geo_10 = Geometry(assembly_viz.G_built_elems)
geo_11 = Geometry(assembly_viz.G_placed_by_robot)
line_4 = Line(assembly_viz.G_short_line)
geo_12 = Geometry(assembly_viz.G_sequence)
geo_13 = Geometry(assembly_viz.G_placed_by_human)
pt_9 = Point(assembly_viz.points)
geo_14 = Geometry(assembly_viz.G_planned_elems)
mesh_3 = Mesh(assembly_viz.G_close_pairs)
pt_10 = Point(assembly_viz.G_intersection)
pln = Plane(assembly_viz.G_intersection)
geo_15 = Geometry(assembly_viz.robots_reach)
geo_16 = Geometry(assembly_viz.G_open_connectors_elems)
pln_2 = Plane(assembly_viz.all_connectors_planes)
line_5 = Line(flatten(assembly_viz.lines))
geo_17 = Geometry(assembly_viz.G_no_open_connectors_elems)
srf_2 = Surface(assembly_viz.G_connectors_ranges)
pln_3 = Plane(assembly_viz.all_element_planes)
geo_18 = Geometry(assembly_viz.G_joints)
rot = GhPythonScript(plane=assembly_viz.elem_option_robot, angle=Slider(42, range=0..360))  # -> out, plane; disabled
# ---------- rot: Python ----------
import math
from compas.geometry import Frame, Rotation
from compas.artists import Artist

frame = Frame(plane.Origin, plane.XAxis, plane.YAxis)

R = Rotation.from_axis_and_angle(frame.xaxis, math.radians(angle), frame.point)
frame.transform(R)

plane = Artist(frame).draw()
# ---------- end rot ----------
geo_19 = Geometry(assembly_viz.G_elem_coll)
geo_20 = Geometry(assembly_viz.G_opt_collision)
tag = TextTag(Location=assembly_viz.key_tag_location, Text=assembly_viz.key_tag_text, Colour=RGB(0, 0, 0))
tag_2 = TextTag(Location=assembly_viz.line_middle, Text=assembly_viz.dist_label, Colour=RGB(0, 0, 0))
preview_4 = CustomPreview(Geometry=geo_20, Material=ColourSwatch(SwatchColor=RGBA(255, 0, 0, 120)))
preview_5 = CustomPreview(Geometry=geo_19, Material=ColourSwatch(SwatchColor=RGB(255, 0, 0)))

is_colliding = Panel(assembly_viz.is_colliding)

robot_viz = GhPythonScript(assembly=grow_assembly.assembly, robot_geo_AA=M, robot_geo_AB=M_2, show_robots=show_robots)  # -> out, G_rob_AA, color_AA, G_rob_AB, color_AB
# ---------- robot_viz: Python ----------
status_robot_AA, status_robot_AB = assembly.robot_status()
print status_robot_AA, status_robot_AB

color_red = '180,0,0 (50)'
color_yellow = '186,105,0 (50)'
color_green = '44,138,0 (50)'

status_colors = {'FREE': color_green, 'Place': color_yellow, 'Stabilizing': color_red}

if show_robots:
    G_rob_AA = robot_geo_AA
    color_AA = status_colors[status_robot_AA]
    
    G_rob_AB = robot_geo_AB
    color_AB = status_colors[status_robot_AB]
# ---------- end robot_viz ----------
custom_preview_2 = CustomPreview(Geometry=robot_viz.G_rob_AA, Material=robot_viz.color_AA)
custom_preview_3 = CustomPreview(Geometry=robot_viz.G_rob_AB, Material=robot_viz.color_AB)

network_viz = GhPythonScript(assembly=grow_assembly.assembly, show_network=network_graph, key=Slider(0, range=0..67))  # -> out, nodes, edges, current_node, current_node_neighbors; inputs key: Int32
# ---------- network_viz: Python ----------
import sys, os
import ghpythonlib.components as ghcomp
from compas.datastructures import Network
from compas_ghpython.artists import NetworkArtist
from compas_rhino.geometry import RhinoLine

import compas_ghpython
import Rhino.Geometry as rg


data = assembly.network.to_data()
network = Network.from_data(data)

print assembly.network.number_of_nodes()

def draw_network(network):
    """Draw a network in Grasshopper.
    """
    points = []
    for key, attr in network.nodes(True):
        points.append({
            'pos': network.node_coordinates(key),
        })

    lines = []
    for (u, v), attr in network.edges(True):
        lines.append({
            'start': network.node_coordinates(u),
            'end': network.node_coordinates(v),
        })

    points_rg = compas_ghpython.draw_points(points)
    lines_rg = compas_ghpython.draw_lines(lines)

    return points_rg, lines_rg

if show_network:
    nodes, edges = draw_network(network)
    
    current_node = {'pos': network.node_coordinates(key), 'radius': 0.03}
    current_node = compas_ghpython.draw_spheres([current_node])
    
    current_node_neighbors_keys = network.neighbors(key)
    current_node_neighbors = [{'pos': network.node_coordinates(key), 'radius': 0.02} for key in current_node_neighbors_keys]
    current_node_neighbors = compas_ghpython.draw_spheres(current_node_neighbors)
# ---------- end network_viz ----------
line_6 = Line(network_viz.edges)
brep_3 = Brep(network_viz.current_node)
pt_11 = Point(network_viz.nodes)
brep_4 = Brep(network_viz.current_node_neighbors)
preview_6 = CustomPreview(Geometry=line_6, Material=ColourSwatch(SwatchColor=RGB(0, 0, 0)))
preview_7 = CustomPreview(Geometry=brep_4, Material=ColourSwatch(SwatchColor=RGB(255, 207, 207)))  # disabled

# ---- group: Sequence
preview_8 = CustomPreview(Geometry=geo_12, Material=assembly_viz.colors_sequence)

# ---- group: Branches
preview_9 = CustomPreview(Geometry=assembly_viz.branch_geo, Material=assembly_viz.colors_branches)

# ---- group: Geometry / Joints
preview_10 = CustomPreview(Geometry=geo_8, Material=ColourSwatch(SwatchColor=RGBA(196, 196, 196, 233)))
preview_11 = CustomPreview(Geometry=geo_7, Material=ColourSwatch(SwatchColor=RGBA(156, 0, 0, 79)))
preview_12 = CustomPreview(Geometry=sph, Material=ColourSwatch(SwatchColor=RGBA(189, 189, 189, 177)))

# ----
joints_p = GhPythonScript(assembly=grow_assembly.assembly)  # -> out, node_lines, joint_cps, j_R; disabled
# ---------- joints_p: Python ----------
from compas.artists import Artist
import ghpythonlib.components as gh

pairs =  assembly.connections()

j_R = assembly.globals['rod_radius']*2 + assembly.globals['joint_dist']/2
joint_cps = []

for pair in pairs:
    line1 = Artist(assembly.element(pair[0]).line).draw()
    line2 = Artist(assembly.element(pair[1]).line).draw()
    
    d, node_line = assembly.shortest_distance_between_two_lines(line1,line2)
    joint_cp = gh.CurveMiddle(node_line)
    joint_cps.append(joint_cp)
# ---------- end joints_p ----------

# ---- group: Human/Robot
preview_13 = CustomPreview(Geometry=geo_13, Material=ColourSwatch(SwatchColor=RGB(242, 229, 0)))
preview_14 = CustomPreview(Geometry=geo_11, Material=ColourSwatch(SwatchColor=RGB(175, 224, 220)))

# ---- group: Design Generation
preview_15 = CustomPreview(Geometry=geo_16, Material=ColourSwatch(SwatchColor=RGB(121, 255, 54)))
preview_16 = CustomPreview(Geometry=[geo_10, geo_17], Material=ColourSwatch(SwatchColor=RGBA(199, 199, 199, 115)))
preview_17 = CustomPreview(Geometry=geo_6, Material=ColourSwatch(SwatchColor=RGB(0, 0, 255)))

# ---- group: Option/Selected/Collision (continued)
preview_18 = CustomPreview(Geometry=geo_14, Material=assembly_viz.planned_mat)
preview_19 = CustomPreview(Geometry=geo_5, Material=assembly_viz.collision_color)
preview_20 = CustomPreview(Geometry=geo_4, Material=ColourSwatch(SwatchColor=RGBA(51, 61, 0, 168)))

# ----
preview_21 = CustomPreview(Geometry=geo_15, Material=colour_swatch)
sph_2 = Sphere(Base=joints_p.joint_cps, Radius=joints_p.j_R)  # disabled

angle1 = Panel(joining_branches_new_2.angles1)  # disabled
res_angle = Panel(joining_branches_new_2.result_angle)  # disabled

nodes_lines = GhPythonScript(lines=line_5)  # -> out, ptsA, ptsB, dists, node_lines, div_lines; inputs lines: list of Line; disabled
# ---------- nodes_lines: Python ----------
import ghpythonlib.components as gh

def isclose(a, b, rel_tol=1e-09, abs_tol=0.0):
    return abs(a-b) <= max(rel_tol * max(abs(a), abs(b)), abs_tol)

ptsA = []
ptsB = []
dists = []
node_lines = []
div_lines = []

for i in range(len(lines)-1):
    line_1 = lines[i]
    for j in range((i+1),len(lines)):
        line_2 = lines[j]
        ptA,ptB,dist = gh.CurveProximity(line_1,line_2)
        if isclose(dist, value, 0.10):
        #if dist < value+0.1:
            node_lines.append(gh.Line(ptA,ptB))
            ptsA.append(ptA)
            ptsB.append(ptB)
            dists.append(dist)
# ---------- end nodes_lines ----------

# ----
# Screen Feedback
feedback_to_screen = GhPythonScript(
    STATUS=status,
    preview_mode=mode,
    assembly_select=list_3,
    assembly=settings_parameters.assembly,
    selected_mode=settings_parameters.selected_mode,
    current_key=settings_parameters.current_key,
    current_angle=settings_parameters.current_angle,
    current_shift_value=settings_parameters.current_shift_value,
    unit_size=settings_parameters.current_unit_size,
    current_mirror_unit=settings_parameters.current_mirror_unit,
    is_colliding=assembly_viz.is_colliding,
    collision_det=collision_check,
    get_key_by_index=get_key_by_index,
    get_joining_options=get_joining_options,
    join_branch_params=joining_branches_new_2.out,
    stability_feedback=stability_vis.stability_feedback,
    key_held_by_robot=stability_vis.key_held_by_robot,
    la_limit=la_limit,
    branch_colors=assembly_viz.gradient_colors_br,
    msg=settings_parameters.out,
    default_size=Slider(20, range=0..50))  # -> out, text, location, size, color; inputs preview_mode: Int32, join_branch_params: list, stability_feedback: list, branch_colors: list, msg: list
# ---------- feedback_to_screen: Python ----------
feedback_text = {
                'text': [],
                'location': [],
                'size': default_size,
                'color': []
                }

y0 = 100
x0 = 50
offset = default_size*0.5
x_curr = x0
y_curr = y0
x_curr_2col = x0 + 15*default_size
y_curr_2col = y0

color_red = '180,0,0'
color_yellow = '186,105,0'
color_green = '44,138,0'

status_colors = {'FREE': color_green, 'Place': color_yellow, 'Stabilizing': color_red}

def add_text_line(text, value, x, y, color='0,0,0'):
    global x_curr,y_curr
    feedback_text['text'].append(text.format(value))
    feedback_text['location'].append('{}, {}, 0'.format(x,y))
    feedback_text['color'].append(color)
    
    if y is y_curr:
        y_curr += default_size
        y_curr += offset


preview_mode_names = ['Built by Human/Robot','Design Generation','Branches', 'Sequence']
current_mode_names = ['(1) Manual','(2) Automatic','(3) Join branches']


# ----------- Assembly Status --------------- 

total_joints = assembly.network.number_of_edges()
total_elements = assembly.network.number_of_nodes()

#y_B = screen_height
assembly_type = 'New' if assembly_select == 1 else 'Loaded'
add_text_line('ASSEMBLY: {}',assembly_type, x_curr,y_curr)
#y_B += default_size
#y_B += offset*2
add_text_line('Total Elements: {}',total_elements, x_curr,y_curr)
#y_B += default_size
#y_B += offset
add_text_line('Total Joints: {}',total_joints, x_curr,y_curr)
y_curr += offset*3

# ----------- Robots Status --------------- 

status_robot_AA, status_robot_AB = assembly.robot_status()

# check which elements is stabilized to display it in status
last_key_held_by_robot = assembly.network.node_attribute(total_elements-1, 'key_held_by_robot')
stab_robot = assembly.network.node_attribute(total_elements-1, 'stabilizing_robot')

if stab_robot == 'AA':
    text_AA = '{} key {}'.format(status_robot_AA, last_key_held_by_robot)
else: 
    text_AA = status_robot_AA

if stab_robot == 'AB':
    text_AB = '{} key {}'.format(status_robot_AB, last_key_held_by_robot)
else: 
    text_AB = status_robot_AB

add_text_line('Robot AA: {}',text_AA, x_curr_2col ,y_curr_2col, color= status_colors[status_robot_AA])
y_curr_2col += default_size
y_curr_2col += offset
add_text_line('Robot AB: {}',text_AB, x_curr_2col ,y_curr_2col, color= status_colors[status_robot_AB])
y_curr_2col += default_size
y_curr_2col += offset


# ----------- Stability limit --------------- 

add_text_line('Stability la limit: {}m',la_limit, x_curr_2col,y_curr_2col)
#y_curr += offset*3

# ----------- Preview mode ---------------
add_text_line('PREVIEW mode: {}',preview_mode_names[preview_mode],x_curr,y_curr)
y_curr += offset*3

if preview_mode == 2: # Branches
    i = 0
    for t in stability_feedback:
        add_text_line('{}',t,x_curr,y_curr, color=branch_colors[i])
        i +=1
    y_curr += offset*3

add_text_line('CURRENT mode: {}', selected_mode,x_curr,y_curr)
y_curr += offset*3

if get_key_by_index:
    add_text_line('Key by index: {}','ON',x_curr,y_curr,color=color_green)
    y_curr += offset*1
#y_curr += offset*3

#feedback_text['text'].append(current_mode)
#feedback_text['location'].append('{}, {}, 0'.format(x,y))

#if current_mode == 'Automatic' or current_mode == 'Manual':
    #add_text_line('     Key: {}',current_key,x_curr,y_curr)
    #add_text_line('     Angle: {}°',current_angle,x_curr,y_curr)
    #add_text_line('     Shift: {} cm',current_shift_value*100,x_curr,y_curr)
    #add_text_line('     Unit size: {} cm',unit_size*100,x_curr,y_curr)
    #add_text_line('     Mirrored: {}',current_mirror_unit,x_curr,y_curr)


if collision_det and total_elements>1:
    if is_colliding:
        add_text_line('Is colliding: {}',is_colliding,x_curr,y_curr, color=color_red)
        y_curr += offset*3
else:
    add_text_line('Collision detection: {}',collision_det,x_curr,y_curr)
    y_curr += offset*3

#if selected_mode == '(3) Join branches': # join branches
#    if get_joining_options:
#        add_text_line('Get joining options: {}',get_joining_options,x_curr,y_curr, color=color_green)
#    else:
#        add_text_line('Get joining options: {}',get_joining_options,x_curr,y_curr, color=color_red)
#    y_curr += offset*3
#    
#    for t in join_branch_params:
#        add_text_line('{}',t,x_curr,y_curr)
#    
#    y_curr += offset*3

y_curr += offset*3

# ----------- ADD ERRORS --------------- 
"""y += offset*3
for t in msg:
    feedback_text['text'].append('ERROR: {}'.format(t))
    feedback_text['location'].append('{}, {}, 0'.format(x,y))
    y += default_size
    y += offset"""

# ----------- PRINT --------------- 
if STATUS:
    text = feedback_text['text']
    location = feedback_text['location']
    size = feedback_text['size']
    color = feedback_text['color']
else:
    text = []
    location = []
    size = []
    color = []
# ---------- end feedback_to_screen ----------
panel_33 = Panel(feedback_to_screen.text)
render_text_to_screen = RenderTextToScreen(
    Text=feedback_to_screen.text,
    Location=feedback_to_screen.location,
    Size=feedback_to_screen.size,
    Color=feedback_to_screen.color,
    Font="Roboto",
    m_scWithvp=False)

# ---- group: curtting plane 1 vis
plane_normal = PlaneNormal(Origin=joining_branches_new_2.plane_pt, ZAxis=joining_branches_new_2.plane_v)  # disabled
plane_surface = PlaneSurface(Plane=plane_normal, XSize=Domain(-10, 10), YSize=Domain(-10, 10))  # disabled

# ----
line_7 = Line(flatten(nodes_lines.div_lines))  # disabled
line_8 = Line(flatten(line_5))  # disabled

distance = Panel(join_keys.distance)  # disabled
distance_soll = Panel(join_keys.dist_soll)  # disabled

set_to_built = GhPythonScript(assembly=grow_assembly.assembly, built_keys=keys, set_keys_to_built=Button(), set_all_to_unbuilt=Button())  # -> out, assembly; inputs built_keys: Int32
# ---------- set_to_built: Python ----------
import rhinoscriptsyntax as rs

if set_keys_to_built:
    for i in range(built_keys):
        #assembly.network.node_attribute(i, 'is_planned', True)
        assembly.network.node_attribute(i, 'is_built', True)
        
if set_all_to_unbuilt:
    for key, element in assembly.elements():
    #    assembly.network.node_attribute(key, 'is_planned', True)
        assembly.network.node_attribute(key, 'is_built', False)
        
for key, element in assembly.elements():
    print assembly.network.node_attribute(key, 'robot_AA_base_frame')
# ---------- end set_to_built ----------

export = PythonScript(
    DATA=py.DATA,
    joint_elem=elem_60_def.joint_elem,
    assembly=grow_assembly.assembly,
    project_name=project_name,
    export_to_json=export_assembly)  # -> filename, saved_file, joints_points, joints_lines, planes_list, G_joints
# ---------- export: Python ----------
import os
from compas.datastructures.mesh import mesh_quads_to_triangles
from compas.datastructures.mesh import mesh_unify_cycles
from compas.geometry import Transformation, Frame

from datetime import datetime
import json
import compas
from compas.artists import Artist
import ghpythonlib.components as gh
from compas_rhino.conversions import line_to_rhino, plane_to_compas_frame
import Rhino.Geometry as rg

now = datetime.now() # current date and time

filename = "{}_{}_{}_{}.json".format(project_name, 'assembly', '{total_elems}', '{date}_{time}')
if export_to_json:
   # filename = "start_assembly.json"
    date_time = now.strftime("%Y-%m-%d_%H-%M")
    filename = "{}_{}_{}_{}.json".format(project_name, 'assembly', total_elements, date_time)
    PATH = os.path.join(DATA, "assembly", filename)
    saved_file = filename

    # the assembly has to be serialized such that it can be called from CPython, True to enable pretty print
    
#    for key, element in assembly.elements():
#        assembly.network.adjacency.clear()
##       assembly.network.node_attribute(key, 'type', 1)
#        assembly.network.node_attribute(key, 'frame_measured', False)
#        assembly.element(key).mesh = None
#        assembly.element(key)._source = None
#        assembly.element(key).connector_frame_1 = None
#        assembly.element(key).connector_frame_2 = None
#        assembly.element(key).connector_range_1 = None
#        assembly.element(key).connector_range_2 = None
#        assembly.element(key).line = None

    assembly.to_json(PATH, True)
    
    #assembly_to_json(PATH, True)
    #joints_to_json(PATH2, True)

def assembly_to_json(path, pretty):
    
    assembly_data = {"node":{}}

    for key, element, data in assembly.elements(data=True):
        print data
        elem_dict = {}
        elem_dict["element"] = {"frame" : assembly.element(key).frame.to_data()}
        elem_dict['is_planned'] = data['is_planned'],
        elem_dict["is_built"] = data['is_built'],
        elem_dict["placed_by"] = data["placed_by"],
        elem_dict["is_support"] = data["is_support"],
        elem_dict["is_held_by_robot"] = data["is_held_by_robot"],
        elem_dict["robot_frame"] = data["robot_frame"],
        elem_dict["frame_measured"] = data["frame_measured"]
        
        assembly_data["node"][str(key)] = elem_dict
        
    compas.json_dump(assembly_data, path, pretty)

new_adjacency = []
total_elements = assembly.network.number_of_nodes()

for key, element in assembly.elements():
    print key
    adjacency = assembly.network.adjacency[key].keys()
    #print adjacency
    if len(adjacency) > 2:
        #print key, adjacency
        adjacency.sort()
    for index in adjacency:
        if [index, key] not in new_adjacency:
            new_adjacency.append([key, index])

print len(new_adjacency)


joints_points = []
joints_origins = []
joints_lines = []

for list in new_adjacency:
    crv1 = line_to_rhino(assembly.element(list[0]).line)
    crv2 = line_to_rhino(assembly.element(list[1]).line)
    a, b, d = gh.CurveProximity(crv1, crv2)
    axis = rg.Vector3d(b)-rg.Vector3d(a)
    
    joint_plane_origin = rg.Point3d((a.X + b.X)/2, (a.Y + b.Y)/2, (a.Z + b.Z)/2)
    joints_points.append(a)
    joints_points.append(b)
    line = rg.Line(a,b)
    joints_lines.append(line)
    joints_origins.append([joint_plane_origin, axis])


planes_list = []

for pair, origin_axis in zip(new_adjacency, joints_origins):
    xaxis = assembly.element(pair[0]).frame.xaxis
    xaxis_rg = rg.Vector3d(xaxis.x, xaxis.y, xaxis.z)
    zaxis = origin_axis[1]
    yaxis = rg.Vector3d.CrossProduct(xaxis_rg, zaxis)
    plane = rg.Plane(origin_axis[0], xaxis_rg, yaxis)
    planes_list.append(plane)


frames_list = [plane_to_compas_frame(plane) for plane in planes_list]

def joints_to_json(path, pretty):
    
    joints_data = {"joint":{}}
    i = 0
    for pair, origin_axis in zip(new_adjacency, joints_origins):
        xaxis = assembly.element(pair[0]).frame.xaxis
        xaxis_rg = rg.Vector3d(xaxis.x, xaxis.y, xaxis.z)
        zaxis = origin_axis[1]
        yaxis = rg.Vector3d.CrossProduct(xaxis_rg, zaxis)
        plane = rg.Plane(origin_axis[0], xaxis_rg, yaxis)
        frame = plane_to_compas_frame(plane)
        joint_dict = {}

        joint_dict["element"] = {"frame":frame.to_data()}
        joint_dict["adjacency"] = pair


        joints_data["joint"][str(i)] = joint_dict
        i +=1
    compas.json_dump(joints_data, path, pretty)
    
if export_joint_to_json:
    filename = "{}_{}.json".format(project_name, 'joints')
    PATH = os.path.join(DATA, "assembly", filename)
    joints_to_json(PATH, True)
    


G_joints = []

#for frame in frames_list:
#    T = Transformation.from_frame_to_frame(Frame.worldXY(), frame)
#    new_joint = joint_elem.transformed(T)
#    G_joints.append(Artist(new_joint.mesh).draw())
# ---------- end export ----------
ghpython_script_5 = GhPythonScript(G=geo_8, L=name_of_the_layer, B=bake)  # -> out, a
# ---------- ghpython_script_5: Python ----------
"""Provides a scripting component.
    Inputs:
        G: Geometry to bake
        L: Layer name for bake
        B: Bake Activate
    Output:
        a: The a output variable"""
 
__author__ = "ScottD"
__version__ = "2019.08.10"
 
import rhinoscriptsyntax as rs
import scriptcontext
import Rhino
 
 
if B:
 
    print(type(G)) #debug message to Python output
 
    #we obtain the reference in the Rhino doc
    doc_object = scriptcontext.doc.Objects.Find(G)
    print(type(doc_object))
 
    attributes = doc_object.Attributes
    print('the type of attributes is: ' + str(type(attributes)))     #debug message to Python output
 
    geometry = doc_object.Geometry
    print('the type of geometry is: ' + str(type(doc_object)))     #debug message to Python output
 
    #we change the scriptcontext
    scriptcontext.doc = Rhino.RhinoDoc.ActiveDoc
 
    #we add both the geometry and the attributes to the Rhino doc
    rhino_brep = scriptcontext.doc.Objects.Add(geometry, attributes)
    print('the Rhino doc ID is: ' + str(rhino_brep))     #debug message to Python output
 
    #we can for example change the layer in Rhino...
    if not rs.IsLayer(L):
        rs.AddLayer(L)
    rs.ObjectLayer(rhino_brep, L)
 
    #we put back the original Grasshopper document as default
    scriptcontext.doc = ghdoc
    a = G
# ---------- end ghpython_script_5 ----------
line_9 = Line(export.joints_lines)
pln_4 = Plane(export.planes_list)
pt_12 = Point(export.joints_points)
mesh_4 = Mesh(export.G_joints)

comments = Panel(ghpython_script_5.out)

output_filename_2 = Panel(export.filename)

rec_7 = DataRecorder(export.saved_file, DataLimit=-10, RecordData=True)

clean_tree = CleanTree(RemoveNulls=True, RemoveInvalid=True, RemoveEmpty=False, Tree=rec_7)

saved_files = Panel(clean_tree)
