# Grasshopper definition ex3_assembly_target_geometry_growth_weirdJoints.ghx (Grasshopper 1.0.7)
# plug-ins: CEM_Build_Topology, CEM_Deviation, CEM_Extract_Topology, CEM_Support, CEM_Trail, CEM_Calculate_Structure, CEM_Extract_Structure, CEM_Origin_Node, CEM_Load

r_m = Slider(2.3, range=0.1..100)
l_int = Slider(9, range=2..100)
res_int = Slider(10, range=4..100)

# ----
# 00 - Input
tp = GhPythonScript(r=r_m, l=l_int, res=res_int)  # -> T, N, Dt, D, S; inputs r: Int32, l: Int32, res: Int32
# ---------- tp: Python ----------
"""Creates a CEM Topology.
    Inputs:
        r: Base radius [m]
        l: Number of layer [int]
        res: Resolution [int]
    Output:
        T: Trail elements
        N: Nodes of the strucutre
        Dt: First Ring of Deviation Elements
        D: Deviation Elements
        S: Support Nodes"""

__author__ = "Frederic Chovghi"

import ghpythonlib.components as gh



###########################################################
## Create CEM Topology
###########################################################

T = []
N = []
Dt = []
D = []
S = []

bp = gh.XYPlane(gh.ConstructPoint(0,0,0)) #Base  plane

for i in range(l):
    
    circle = gh.Circle(bp, r+(i*0.5))
    cp = gh.DivideCurve(circle, res, False)[0]
    N.extend(cp)
    
    pl = gh.PolyLine(cp, True)
    pl = gh.Explode(pl, True)[0]
    
    if i != 0:
        tl = [gh.Line(cp[x], cpp[x]) for x in range(len(cp))]
        T.extend(tl)
    
    cpp = cp[:]
    
    #Export Elements
    if i == 0: Dt.extend(pl)
    if i != 0: D.extend(pl)
    
    if i ==l-1: S.extend(cp)
# ---------- end tp ----------

number_slider = Slider(2, range=-100..100)

# ----
# New assembly & element definition
# Create an element object.
unit_size = Slider(0.25, range=0.08..0.34)
joint_dist = Slider(0.015, range=0..0.03)
reset_assembly = Button()
image_sampler = ImageSampler(
    FilePath="C:\Users\lovek\Data Storage\TUM Master Arch 2021-24\Master Thesis\03 Bilder\global parameters-01.jpg",
    Filter="Colour",
    Interpolate=False,
    Umax=1,
    Umin=0,
    Vmax=1,
    Vmin=0,
    Wrap=1)
globals = GhPythonScript(reset=reset_assembly, unit_size=unit_size, joint_dist=joint_dist)  # -> out, assembly
# ---------- globals: Python ----------
from cdf_2023.assembly import Assembly

# create assembly
assembly = Assembly()

# create a dictionary to store global value in 
assembly.globals = {}

# define global values
assembly.globals['rod_radius'] = 0.01
assembly.globals['rod_length'] = 0.8
assembly.globals['rf_unit_offset'] = 0.07
assembly.globals['rf_unit_radius'] = unit_size
assembly.globals['joint_dist'] = joint_dist


print(assembly.globals)
# ---------- end globals ----------
assembly_globals = Panel(globals.out)
show = BooleanToggle(True)
show_2 = BooleanToggle(False)
mesh = Mesh(<mesh referenced from the Rhino model>)
brep = Brep(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)
brep_2 = Brep(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)
elem_60_def = GhPythonScript(assembly=globals.assembly, show_connectors=show_2, joint_geo=mesh, cr1=brep, cr2=brep_2)  # -> assembly, elem, joint_elem, joints_planes; inputs joint_geo: Mesh, cr1: Surface, cr2: Surface
# ---------- elem_60_def: Python ----------
import os
import sys
import json
import math

from compas.geometry import Frame, Plane, Rotation, Vector, Point
from compas.geometry import Circle, Cylinder, Translation, Line, Cone
from compas.artists import Artist
from compas_rhino.conversions import RhinoSurface, RhinoMesh
from cdf_2023.assembly import Element

rf_unit_offset = assembly.globals['rf_unit_offset']
rf_unit_radius = assembly.globals['rf_unit_radius']
radius = assembly.globals['rod_radius']
length = assembly.globals['rod_length']
joint_dist = assembly.globals['joint_dist']

cross_section_plane = Plane.from_frame(Frame.worldYZ())
cross_section = Circle(cross_section_plane, radius)

elem_geo = Cylinder(cross_section, length)

elem = Element.from_shape(elem_geo, Frame.worldXY())
print(elem.frame)

#connector_frame_1 = Frame([(length/2-rf_unit_radius/2-rf_unit_offset),-rf_unit_radius/(2*math.sqrt(3)),0], [1,0,0], [0,1,0])
#connector_frame_2 = Frame([-(length/2-rf_unit_radius/2-rf_unit_offset),rf_unit_radius/(2*math.sqrt(3)),0], [-1,0,0], [0,-1,0])

connector_frame_1 = Frame([0,0,0], [1,0,0], [0,1,0])
connector_frame_2 = Frame([0,0,0], [-1,0,0], [0,-1,0])


# this angle with "-" will be the mirrored unit
#angle = math.asin((2 * radius + joint_dist)/(math.sqrt(3) * rf_unit_radius))
angle_rf_unit = math.asin((2 * radius + joint_dist)/rf_unit_radius)
print angle_rf_unit

#R1 = Rotation.from_axis_and_angle(connector_frame_1.yaxis, -angle_rf_unit, connector_frame_1.point)
#R2 = Rotation.from_axis_and_angle(connector_frame_2.yaxis, -angle_rf_unit, connector_frame_2.point)

#connector_frame_1.transform(R1)
#connector_frame_2.transform(R2)

elem.connector_frame_1 = connector_frame_1
elem.connector_frame_2 = connector_frame_2

elem.joint_frame_1 = connector_frame_1
elem.joint_frame_2 = connector_frame_2


R3 = Rotation.from_axis_and_angle(connector_frame_1.zaxis, math.radians(60), connector_frame_1.point)
R4 = Rotation.from_axis_and_angle(connector_frame_2.zaxis, math.radians(60), connector_frame_2.point)

connector_frame_1_trnsf = connector_frame_1.transformed(R3)
connector_frame_2_trnsf = connector_frame_2.transformed(R4)

T1 = Translation.from_vector(connector_frame_1_trnsf.yaxis*rf_unit_radius)
T2 = Translation.from_vector(connector_frame_2_trnsf.yaxis*rf_unit_radius)

joint_frame_1 = connector_frame_1.transformed(T1)
joint_frame_2 = connector_frame_2.transformed(T2)

"""connector_frame_1_test = Frame([(length/2-rf_unit_radius/2-rf_unit_offset),-rf_unit_radius/(2*math.sqrt(3)),0], [1,0,0], [0,1,0])
R1 = Rotation.from_axis_and_angle(connector_frame_1_test.yaxis, -angle_rf_unit, connector_frame_1_test.point)
joint_frame_1 = connector_frame_1_test.transformed(R1)"""

R5 = Rotation.from_axis_and_angle(joint_frame_1.zaxis, math.radians(0), joint_frame_1.point)
R6 = Rotation.from_axis_and_angle(joint_frame_2.zaxis, math.radians(0), joint_frame_2.point)

joint_frame_1.transform(R5)
joint_frame_2.transform(R6)

elem.joint_frame_1 = joint_frame_1
elem.joint_frame_2 = joint_frame_2


joints_planes =[]

#joints_planes.append(Artist(joint_frame_1).draw())
#joints_planes.append(Artist(connector_frame_1_test).draw())
#joints_planes.append(Artist(joint_frame_2).draw())

elem.line = Line([-length/2.,0,0],[length/2.,0,0])

#circle_frame_1 = Frame([-0.34,0,0],[0,0,-1],[0,1,0])
#circle_frame_2 = Frame([0.34,0,0],[0,0,1],[0,1,0])
#circle_1 = Circle(Plane.from_frame(circle_frame_1), 0.5)
#circle_2 = Circle(Plane.from_frame(circle_frame_2), 0.5)
#cone_2 = Cone(circle_1, 0.32)
#cone_1 = Cone(circle_2, 0.32)
#
#elem.connector_range_1 = cone_1
#elem.connector_range_2 = cone_2

#print elem.connector_range_1

source1 = RhinoSurface.from_geometry(cr1)
source2 = RhinoSurface.from_geometry(cr2)

joint_rhino_mesh = RhinoMesh.from_geometry(joint_geo)
joint_compas_mesh = joint_rhino_mesh.to_compas()
joint_elem = Element.from_shape(joint_compas_mesh, Frame.worldXY())

elem.connector_range_1 = source1.to_compas()
elem.connector_range_2 = source2.to_compas()
# ---------- end elem_60_def ----------
draw = PythonScript(elements=elem_60_def.elem, show=show)  # -> M, F, C; inputs elements: list
# ---------- draw: Python ----------
from compas.artists import Artist

M = []
C = []
F = []
T = []

if show:
    for elem in elements:
        C.append(Artist(elem.connector_frame_1).draw())
        C.append(Artist(elem.connector_frame_2).draw())
        M += [Artist(elem._mesh).draw([0,0,1,1])]
        F += [Artist(elem.frame).draw()]
        T += [Artist(elem.tool_frame).draw()]
# ---------- end draw ----------
mesh_2 = Mesh(draw.M)
pln = Plane(draw.F)
pln_2 = Plane(draw.C)
point = Point(pln_2)
custom_preview = CustomPreview(Geometry=mesh_2, Material=ColourSwatch(SwatchColor=RGB(221, 0, 0)))
pln_3 = Plane(elem_60_def.joints_planes)

panel = Panel("Unload libraries")
bang = Button()
unload = PythonScript(bang=bang)
# ---------- unload: Python ----------
from compas_rhino.utilities.misc import get_tolerance
from compas_rhino.utilities.misc import unload_modules

unload_modules("cdf_2023")
# ---------- end unload ----------

panel_2 = Panel("final_assembly_assembly.json")
py = PythonScript()  # -> ENVIRONMENT_NAME, HERE, DATA
# ---------- py: Python ----------
import os
import compas_bootstrapper

HERE = os.path.dirname(ghdoc.Path)
DATA = os.path.abspath(os.path.join(HERE, "..", "data"))
ENVIRONMENT_NAME = compas_bootstrapper.ENVIRONMENT_NAME
print(HERE)
print(DATA)
print(ENVIRONMENT_NAME)
# ---------- end py ----------

# ----
# Load assembly
# Import assembly from .json.
import = Button(ExpressionNormal="True", ExpressionPressed="False")
initial_assembly = GhPythonScript(DATA=py.DATA, filename="2023_07_28_11_43_FINAL_200_assembly.json", import_from_json=import)  # -> out, assembly, planes; inputs import_from_json: Boolean
# ---------- initial_assembly: Python ----------
import os
import json
from scriptcontext import sticky
import Rhino.Geometry as rg
import math

from cdf_2023.assembly import Assembly
from compas_ghpython import draw_frame
from compas.geometry import Translation

if import_from_json:
    PATH = os.path.join(DATA, "assembly", filename)
    assembly = Assembly.from_json(PATH)

    

# create a dictionary to store global value in 
assembly.globals = {}

# define global values
assembly.globals['rod_radius'] = 0.01
assembly.globals['rod_length'] = 0.7
assembly.globals['rf_unit_offset'] = 0.22
assembly.globals['rf_unit_radius'] = 0.15


#T = Translation.from_vector(assembly.element(40).frame.xaxis*-0.24)
#assembly.element(40).transform(T)
# ---------- end initial_assembly ----------
pln_4 = Plane(initial_assembly.planes)

# ----
# Choose assembly
list = ValueList({"New assembly": 1, "From json": 2}, selected="New assembly")
python = GhPythonScript(selection=list, new_assembly=elem_60_def.assembly, imported_assembly=initial_assembly.assembly)  # -> out, assembly
# ---------- python: Python ----------
import rhinoscriptsyntax as rs

if selection == 1:
    assembly = new_assembly
else:
    assembly = imported_assembly
# ---------- end python ----------

panel_3 = Panel(py.ENVIRONMENT_NAME)
plane = Plane(Plane(origin=(1.237520475, -0.05351884472, 0), x=(0, 1, 0), y=(1, 0, 0)))
plane_2 = Plane(Plane(origin=(1.867263546, -0.01959329208, 0), x=(0, 1, 0), y=(1, 0, 0)))
show_3 = BooleanToggle(True)

# ----
# Initial Assembly
worldxy = Plane(PlaneXY(0, 0, 0))
pt = Point(Point(-0.002611679333, -0.4167082675, 0.4218038534))
y = Curve(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)
x = Curve(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)
_4_planes = Plane([Plane(origin=(-0.002611679333, -0.7707588361, 0.4118038534), x=(0.00338212045, -0.1931022184, 0.9811728158), y=(-0.9998466536, -0.01751197807, 0)), Plane(origin=(-0.7707588361, 0.002611679333, 0.4118038534), x=(-0.1931022184, -0.00338212045, 0.9811728158), y=(-0.01751197807, 0.9998466536, 0)), Plane(origin=(0.002611679333, 0.7707588361, 0.4118038534), x=(-0.00338212045, 0.1931022184, 0.9811728158), y=(0.9998466536, 0.01751197807, 0)), Plane(origin=(0.7707588361, -0.002611679333, 0.4118038534), x=(0.1931022184, 0.00338212045, 0.9811728158), y=(0.01751197807, -0.9998466536, 0))])
_3_planes = Plane([Plane(origin=(-0.001322382405, -0.4694115256, 0.1787689775), x=(0.3398541508, 0.09989969682, 0.9351573166), y=(-0.9398572889, -4.83719427e-05, 0.3415673786)), Plane(origin=(0.4071834972, 0.233560546, 0.1787689775), x=(-0.2564427507, 0.2443724798, 0.9351573166), y=(0.4699705358, -0.8139161022, 0.3415673786)), Plane(origin=(-0.4058611148, 0.2358509795, 0.1787689776), x=(-0.08341140028, -0.3442721775, 0.9351573162), y=(-0.4698867533, -0.8139644737, -0.3415673794))])
_3_planes_2 = Plane([Plane(origin=(0.4071834972, 0.233560546, 0.1787689775), x=(-0.08627357513, -0.05036917882, 0.994997395), y=(-0.5000418324, 0.8660011165, 0.0004817786491)), Plane(origin=(-0.001322382405, -0.4694115256, 0.1787689775), x=(-0.0004842008583, 0.09989969714, 0.994997395), y=(0.9999998828, 4.837152477e-05, 0.0004817786491)), Plane(origin=(-0.4058611148, 0.2358509796, 0.1787689775), x=(0.08675777599, -0.04953051833, 0.994997395), y=(-0.4999580504, -0.866049488, 0.0004817786491))])
pl = ConstructPlane(Origin=pt, XAxis=x, YAxis=y)
initial_configuration = GhPythonScript(assembly=python.assembly, selection=list, planes=worldxy, show_open_connectors=show_3, elem=elem_60_def.elem)  # -> out, assembly, connector_planes; inputs planes: list of Plane
# ---------- initial_configuration: Python ----------
import Rhino.Geometry as rg
import math
from scriptcontext import sticky as st

from compas.geometry import Frame, Vector
from compas.geometry import Rotation, Transformation
from compas.artists import Artist


connector_planes = []
support_keys = []


if selection == 1:
    
    radius = assembly.globals['rod_radius']
    length = assembly.globals['rod_length']
    rf_unit_offset = assembly.globals['rf_unit_offset']
    rf_unit_radius = assembly.globals['rf_unit_radius']

    for plane in planes:
        T1 = Transformation.from_frame_to_frame(Frame.worldXY(), Frame(plane.Origin, plane.XAxis, plane.YAxis))
        new_elem = elem.transformed(T1)
        
        R1 = Rotation.from_axis_and_angle(new_elem.frame.zaxis, math.radians(120), [0,0,0])
        R2 = Rotation.from_axis_and_angle(new_elem.frame.zaxis, math.radians(240), [0,0,0])
        
        # set connector state
        new_elem.connector_1_state = True
        new_elem.connector_2_state = False
    
        # add element to assembly
        assembly.add_element(new_elem, 
                             placed_by='human', 
                             robot_name='AA',
                             robot_AA_base_frame=Frame.worldXY(),
                             robot_AB_base_frame=Frame.worldXY(),
                             is_support=True,
                             is_built=True,
                             is_planned=True)
            
    # show open connectors
    if show_open_connectors:
        for key, connectors in assembly.connectors(state='closed'):
            for connector in connectors:
                connector_planes.append(Artist(connector).draw())
    
#    for key, element in assembly.elements():
#        assembly.network.node_attribute(key, 'is_support', True)
        
    #assembly.support_keys = support_keys
# ---------- end initial_configuration ----------
pln_5 = Plane(initial_configuration.connector_planes)

list_2 = ValueList({"1. Add a SINGLE options-pair": 0, "2. Add TWO options-pairs": 1}, selected="2. Add TWO options-pairs")
show_new_element = BooleanToggle(True)
join_branches = Button()
get_joining_options = BooleanToggle(False)

plane_3 = Plane([plane_2, plane])

compute = Button()
random_key = BooleanToggle(False)

unit_size_2 = Slider(0.31, range=0.08..0.5)
ur_arm_base_plane = Plane(Plane(origin=(0.275, 0, 1.021), x=(-0.7071067812, 0.7071067812, 0), y=(-0.7071067812, -0.7071067812, 0)))

# ----
# 5. Mobile robots
xaxis = Curve(<curve referenced from the Rhino model>)
yaxis = Curve(<curve referenced from the Rhino model>)
xaxis_2 = Curve(<curve referenced from the Rhino model>)
yaxis_2 = Curve(<curve referenced from the Rhino model>)
arm_lift = Slider(0, range=0..0.72)
arm_lift_2 = Slider(0, range=0..0.72)
plane_4 = GhPythonScript(plane_axes=[xaxis, yaxis])  # -> plane; inputs plane_axes: list of Curve
# ---------- plane_4: Python ----------
import Rhino.Geometry as rg

x_axis, y_axis = plane_axes

x_axis = rg.Line(x_axis.PointAtStart, x_axis.PointAtEnd)
y_axis = rg.Line(y_axis.PointAtStart, y_axis.PointAtEnd)

if x_axis.From.DistanceTo(y_axis.From) < 0.01:
    origin = x_axis.From
    xvec = x_axis.Direction
    yvec = y_axis.Direction
elif x_axis.To.DistanceTo(y_axis.To) < 0.01:
    origin = x_axis.To
    xvec = -x_axis.Direction
    yvec = -y_axis.Direction
elif x_axis.From.DistanceTo(y_axis.To) < 0.01:
    origin = x_axis.From
    xvec = x_axis.Direction
    yvec = -y_axis.Direction
elif x_axis.To.DistanceTo(y_axis.From) < 0.01:
    origin = x_axis.To
    xvec = -x_axis.Direction
    yvec = y_axis.Direction

plane = rg.Plane(origin, xvec, yvec)
# ---------- end plane_4 ----------
plane_5 = GhPythonScript(plane_axes=[xaxis_2, yaxis_2])  # -> plane; inputs plane_axes: list of Curve; same code as plane_4
ur_arm_base_plane_2 = Plane(Plane(origin=(0.275, 0, 1.021), x=(-0.7071067812, 0.7071067812, 0), y=(-0.7071067812, -0.7071067812, 0)))
robot_aa = GhPythonScript(robot_base_plane=plane_4, ur_arm_base_plane=ur_arm_base_plane, arm_lift=arm_lift_2)  # -> robot_geo, ur_arm_base_plane_trnsf; inputs ur_arm_base_plane: Plane
# ---------- robot_aa: Python ----------
import rhinoscriptsyntax as rs
import Rhino.Geometry as rg 
from compas.geometry import Transformation, Frame, Translation, Box
from compas_rhino.conversions import plane_to_compas_frame, frame_to_rhino_plane, RhinoBox
from compas.artists import Artist
from compas.colors import Color

ur_arm_base_frame = plane_to_compas_frame(ur_arm_base_plane)
robot_base_frame = plane_to_compas_frame(robot_base_plane)

T = Transformation.from_frame_to_frame(Frame.worldXY(), robot_base_frame)

ur_arm_base_frame_trnsf = ur_arm_base_frame.copy()
ur_arm_base_frame_trnsf.transform(T)

T_lift = Translation.from_vector(ur_arm_base_frame_trnsf.zaxis*arm_lift)
ur_arm_base_frame_trnsf.transform(T_lift)

ur_arm_base_plane_trnsf = frame_to_rhino_plane(ur_arm_base_frame_trnsf)


T1 = Translation.from_vector(robot_base_frame.zaxis*0.5)
robot_geo_frame = robot_base_frame.transformed(T1)

robot_geo_compas = Box(robot_geo_frame, 1.27, 0.76, 0.3)
robot_geo = Artist(robot_geo_compas).draw(Color(0.6,0.6,0.6,1.0))
# ---------- end robot_aa ----------
robot_ab = GhPythonScript(robot_base_plane=plane_5, ur_arm_base_plane=ur_arm_base_plane_2, arm_lift=arm_lift)  # -> robot_geo, ur_arm_base_plane_trnsf; inputs ur_arm_base_plane: Plane; same code as robot_aa
geo = Geometry(robot_aa.robot_geo)  # disabled
pln_6 = Plane(robot_aa.ur_arm_base_plane_trnsf)
geo_2 = Geometry(robot_ab.robot_geo)  # disabled
pln_7 = Plane(robot_ab.ur_arm_base_plane_trnsf)
preview = CustomPreview(Geometry=geo_2, Material=ColourSwatch(SwatchColor=RGBA(199, 199, 199, 89)))
preview_2 = CustomPreview(Geometry=geo, Material=ColourSwatch(SwatchColor=RGBA(199, 199, 199, 89)))

# ----
# 1. Mode
list_3 = ValueList({"1. 'Manual mode'": 0, "2. 'Automatic mode'": 1, "3. Join branches'": 2}, selected="1. 'Manual mode'")

bcf_wcs_aa = Plane(Plane(origin=(-1.117452192, -0.4208430177, 0.01980614689), x=(0.5723915496, -0.8199742309, 0.003189757304), y=(0.8199580906, 0.5723429035, -0.009608873971)))
bcf_wcs_ab = Plane(Plane(origin=(0.9896612368, 0.9287122403, 0.007218178072), x=(-0.9475576884, 0.3195482043, -0.004834489242), y=(-0.3195383255, -0.9475694642, -0.002714584304)))

# ----
# 4. Settings
distance_weight = Slider(0, range=0..1)
angle_weight = Slider(1, range=0.1..1.1)
list_4 = ValueList({"1. GLOBAL stability": 0, "2. LOCAL stability": 1, "3. NO stability criteria": 2}, selected="2. LOCAL stability")
show_resultant = BooleanToggle(False)
brep_3 = Brep(<brep referenced from the Rhino model>)
collision = BooleanToggle(False)
support_geo = Brep(<brep referenced from the Rhino model>)
guiding_geo = Mesh(brep_3)

show_4 = BooleanToggle(True)

# ----
# 2. Set parameters
shift_value = Slider(0, range=-0.1..0.2)
key_at_index = Slider(39, range=0..500)
get_key_by_index = BooleanToggle(False)
angle = Slider(0, range=0..360)
flip_human_robot = BooleanToggle(False)
close_connector = Button()
filter_keys = BooleanToggle(False)
previous = Button()
next = Button()

show_5 = BooleanToggle(True)

# ----
# 3. Compute parameters
options_num = Slider(100, range=1..300)

# ----
# 6. Settings
number_slider_2 = Slider(0.3, range=0..1)
shift_value_2 = Slider(0, range=-1..1)
point1 = Slider(0.31, range=0..1)
pair_index = Slider(0, range=0..10)
point2 = Slider(0.6, range=0..1)

mirror_unit = BooleanToggle(False)

remove = Button()
remove_by_key = GhPythonScript(assembly=initial_configuration.assembly, key=Slider(160, range=0..200), remove=remove)  # -> out, assembly
# ---------- remove_by_key: Python ----------
if remove:
    assembly.delete_element(key)
# ---------- end remove_by_key ----------

colour_swatch = ColourSwatch(SwatchColor=RGBA(199, 199, 199, 89))
list_5 = ValueList({"'AA'", "'AB'"}, selected="'AB'")

# ---- group: capture
# Capture to bitmap
number_slider_3 = Slider(2, range=0..10)
viewport_name = Text("workflow_2")
capture_to_bitmap = PythonScript(DATA=py.DATA, capture=Button(), viewport_name=viewport_name, idx=number_slider_3)  # -> out, a; inputs capture: Boolean, idx: Int32
# ---------- capture_to_bitmap: Python ----------
import Rhino
import System.Drawing
from scriptcontext import sticky as st

import sys, os
import ghpythonlib.components as ghcomp
import Grasshopper as gh
import datetime


ghComp = ghenv.Component
ghDoc = ghComp.OnPingDocument()

def rCommonCap(filePath, viewportName,scaleFactor):
    RhinoDocument = Rhino.RhinoDoc.ActiveDoc
    view = RhinoDocument.Views.Find(viewportName, False)
    vp = view.ActiveViewport
    size = System.Drawing.Size(vp.Size.Width*scaleFactor,vp.Size.Height*scaleFactor)
    capture = view.CaptureToBitmap(size)
    capture.Save(filePath);


export_dir = os.path.join(DATA, 'parameter_studies')
if not os.path.isdir(export_dir): os.mkdir(export_dir)
print export_dir
filename = os.path.join(export_dir, 'capture_' + str(idx) + '.png') 
print filename

zoom = 1

if capture:
    rCommonCap(filename, viewport_name, zoom)
# ---------- end capture_to_bitmap ----------

# ----
panel_4 = Panel("final_joints_app")
panel_5 = Panel("final_assembly")
panel_6 = Panel("final_assembly_app")
export = Button()

# ----
# Export .json
panel_7 = Panel("transformed_assembly")
export_2 = Button()
export_3 = PythonScript(
    DATA=py.DATA,
    joint_elem=elem_60_def.joint_elem,
    assembly=initial_assembly.assembly,
    project_name="final_joints_app",
    export_to_json=export_2,
    export_joint_to_json=export)  # -> joints_points, joints_lines, planes_list, G_joints
# ---------- export_3: Python ----------
import os
from compas.datastructures.mesh import mesh_quads_to_triangles
from compas.datastructures.mesh import mesh_unify_cycles
from compas.geometry import Transformation, Frame

from datetime import datetime
import json
import compas
from compas.artists import Artist
import ghpythonlib.components as gh
from compas_rhino.conversions import line_to_rhino, plane_to_compas_frame
import Rhino.Geometry as rg

now = datetime.now() # current date and time

if export_to_json:
   # filename = "start_assembly.json"
    date_time = now.strftime("%Y_%m_%d_%H_%M")
    filename = "{}_{}.json".format(project_name, 'assembly')
    PATH = os.path.join(DATA, "assembly", filename)
    
    # the assembly has to be serialized such that it can be called from CPython, True to enable pretty print
    
    for key, element in assembly.elements():
        assembly.network.adjacency.clear()
#       assembly.network.node_attribute(key, 'type', 1)
        assembly.network.node_attribute(key, 'frame_measured', False)
        assembly.element(key).mesh = None
        assembly.element(key)._source = None
        assembly.element(key).connector_frame_1 = None
        assembly.element(key).connector_frame_2 = None
        assembly.element(key).connector_range_1 = None
        assembly.element(key).connector_range_2 = None
        assembly.element(key).line = None

    assembly.to_json(PATH, True)
    
    #assembly_to_json(PATH, True)
    #joints_to_json(PATH2, True)

def assembly_to_json(path, pretty):
    
    assembly_data = {"node":{}}

    for key, element, data in assembly.elements(data=True):
        print data
        elem_dict = {}
        elem_dict["element"] = {"frame" : assembly.element(key).frame.to_data()}
        elem_dict['is_planned'] = data['is_planned'],
        elem_dict["is_built"] = data['is_built'],
        elem_dict["placed_by"] = data["placed_by"],
        elem_dict["is_support"] = data["is_support"],
        elem_dict["is_held_by_robot"] = data["is_held_by_robot"],
        elem_dict["robot_frame"] = data["robot_frame"],
        elem_dict["frame_measured"] = data["frame_measured"]
        
        assembly_data["node"][str(key)] = elem_dict
        
    compas.json_dump(assembly_data, path, pretty)

new_adjacency = []

for key, element in assembly.elements():
    adjacency = assembly.network.adjacency[key].keys()
    #print adjacency
    if len(adjacency) > 2:
        #print key, adjacency
        adjacency.sort()
    for index in adjacency:
        if [index, key] not in new_adjacency:
            new_adjacency.append([key, index])

print len(new_adjacency)


joints_points = []
joints_origins = []
joints_lines = []

for list in new_adjacency:
    crv1 = line_to_rhino(assembly.element(list[0]).line)
    crv2 = line_to_rhino(assembly.element(list[1]).line)
    a, b, d = gh.CurveProximity(crv1, crv2)
    axis = rg.Vector3d(b)-rg.Vector3d(a)
    
    joint_plane_origin = rg.Point3d((a.X + b.X)/2, (a.Y + b.Y)/2, (a.Z + b.Z)/2)
    joints_points.append(a)
    joints_points.append(b)
    line = rg.Line(a,b)
    joints_lines.append(line)
    joints_origins.append([joint_plane_origin, axis])


planes_list = []

for pair, origin_axis in zip(new_adjacency, joints_origins):
    xaxis = assembly.element(pair[0]).frame.xaxis
    xaxis_rg = rg.Vector3d(xaxis.x, xaxis.y, xaxis.z)
    zaxis = origin_axis[1]
    yaxis = rg.Vector3d.CrossProduct(xaxis_rg, zaxis)
    plane = rg.Plane(origin_axis[0], xaxis_rg, yaxis)
    planes_list.append(plane)


frames_list = [plane_to_compas_frame(plane) for plane in planes_list]

def joints_to_json(path, pretty):
    
    joints_data = {"joint":{}}
    i = 0
    for pair, origin_axis in zip(new_adjacency, joints_origins):
        xaxis = assembly.element(pair[0]).frame.xaxis
        xaxis_rg = rg.Vector3d(xaxis.x, xaxis.y, xaxis.z)
        zaxis = origin_axis[1]
        yaxis = rg.Vector3d.CrossProduct(xaxis_rg, zaxis)
        plane = rg.Plane(origin_axis[0], xaxis_rg, yaxis)
        frame = plane_to_compas_frame(plane)
        joint_dict = {}

        joint_dict["element"] = {"frame":frame.to_data()}
        joint_dict["adjacency"] = pair


        joints_data["joint"][str(i)] = joint_dict
        i +=1
    compas.json_dump(joints_data, path, pretty)
    
if export_joint_to_json:
    filename = "{}_{}.json".format(project_name, 'joints')
    PATH = os.path.join(DATA, "assembly", filename)
    joints_to_json(PATH, True)
    


G_joints = []

#for frame in frames_list:
#    T = Transformation.from_frame_to_frame(Frame.worldXY(), frame)
#    new_joint = joint_elem.transformed(T)
#    G_joints.append(Artist(new_joint.mesh).draw())
# ---------- end export_3 ----------
pln_8 = Plane(export_3.planes_list)
pt_2 = Point(export_3.joints_points)
line = Line(export_3.joints_lines)
mesh_3 = Mesh(export_3.G_joints)

# ----
# 01 - CEM Model
series = Series(Start=0, Step=expr("1/(x-2)", l_int), Count=expr("x-1", l_int))
graph_mapper = GraphMapper(
    series,
    x0=0,
    x1=1,
    y0=0,
    y1=1,
    container_name="Bezier",
    cpx=[0, 0.4604810774, 1, 1],
    cpy=[0.1269744635, 0.1277402639, 0.5032821894, 1])
construct_domain = ConstructDomain(DomainStart=number_slider, DomainEnd=Slider(-5, range=-100..100))
remap_numbers = RemapNumbers(Value=graph_mapper, Source=Domain(0, 1), Target=construct_domain)  # -> graft(Mapped), Clipped
repeat_data = RepeatData(Data=remap_numbers.Mapped, Length=res_int)  # -> flatten(Data)
cem_deviation = CEM_Deviation(DeviationEdge=tp.Dt, DeviationMagn=number_slider)
cem_deviation_2 = CEM_Deviation(DeviationEdge=tp.D, DeviationMagn=repeat_data)
cem_load = CEM_Load(PointLoad=tp.N, LoadMagnZ=Slider(-1, range=-100..100))
cem_trail = CEM_Trail(TrailEdge=tp.T, TrailLen=Slider(-0.5, range=-100..100))
cem_support = CEM_Support(Support=tp.S)
cem_build_topology = CEM_Build_Topology(T=flatten(cem_trail), L=cem_load, D=flatten([cem_deviation, cem_deviation_2]), S=flatten(cem_support))
cem_extract_topology = CEM_Extract_Topology(TP=cem_build_topology)  # -> Nodes, NodesID, Edges, EdgesID, ConstraintPlane, ConstraintPlaneID, OriginNode, OriginNodeID
cem_origin_node = CEM_Origin_Node(OriginNode=cem_extract_topology.OriginNode, OriginNodeID=cem_extract_topology.OriginNodeID)
cem_calculate_structure = CEM_Calculate_Structure(TP=cem_build_topology, N=cem_origin_node)
cem_extract_structure = CEM_Extract_Structure(M=cem_calculate_structure)  # -> Nodes, NodesID, Trails, TrailsID, TrailsCol, TrailsMag, Deviations, DeviationsID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
end_points = EndPoints(Curve=cem_extract_structure.ExternalForces)  # -> Start, End
scale = Scale(Geometry=cem_extract_structure.ExternalForces, Center=end_points.Start, Factor=0.25)  # -> Geometry, Transform

# ----
# 02 - Mesh model
join_curves = JoinCurves(Curves=cem_extract_structure.Deviations, Preserve=False)
construct_point = ConstructPoint(XCoordinate=100, YCoordinate=0, ZCoordinate=0)
curve_closest_point = CurveClosestPoint(Point=construct_point, Curve=join_curves)  # -> Point, Parameter, Distance
deconstruct = Deconstruct(Point=curve_closest_point.Point)  # -> XComponent, YComponent, ZComponent
seam = Seam(Curve=flatten(join_curves), Seam=flatten(curve_closest_point.Parameter))
sort_list = SortList(Keys=deconstruct.ZComponent, ValuesValuesA=seam)  # -> Keys, ValuesValuesA
mesh_4 = GhPythonScript(C=sort_list.ValuesValuesA)  # -> M; inputs C: list of Curve
# ---------- mesh_4: Python ----------
import ghpythonlib.components as gh

M = []

for i in range(len(C)-1):
    
    cp_a = gh.ControlPoints(C[i])[0]
    cp_b = gh.ControlPoints(C[i+1])[0]
    
    for k in range(len(cp_a)-1):
        
        mloc = gh.ConstructMesh([cp_a[k], cp_a[k+1], cp_b[k+1], cp_b[k]], 'Q{0;1;2;3}')
        M.append(mloc)

M = gh.MeshJoin(M)
# ---------- end mesh_4 ----------
deconstruct_box = DeconstructBox(Box=mesh_4)  # -> Plane, X, Y, Z
unit_z = UnitZ(Factor=deconstruct_box.Z)
move = Move(Geometry=mesh_4, Motion=unit_z)  # -> Geometry, Transform
custom_preview_2 = CustomPreview(Geometry=move.Geometry, Material=ColourSwatch(SwatchColor=RGBA(76, 76, 76, 44)))  # disabled

move_2 = Move(Geometry=flatten([cem_extract_structure.Trails, cem_extract_structure.Deviations]), Motion=unit_z)  # -> Geometry, Transform
move_3 = Move(Geometry=flatten(scale.Geometry), Motion=unit_z)  # -> Geometry, Transform
custom_preview_3 = CustomPreview(Geometry=move_2.Geometry, Material=[cem_extract_structure.TrailsCol, cem_extract_structure.DeviationsCol])
custom_preview_4 = CustomPreview(Geometry=move_3.Geometry, Material=cem_extract_structure.ExternalForcesCol)

# ----
# Assembly visualization
# 1. Visualize assembly.
# 2. Visualize selected option.
# 3. Visuilize current options (all/filtered).
# Preview Mode
list_6 = ValueList({"'Built by Human/Robot'": 0, "'Design Generation'": 1, "'Assembly Workflow'": 2}, selected="'Design Generation'")
show_6 = BooleanToggle(True)
show_7 = BooleanToggle(False)
show_8 = BooleanToggle(True)
show_9 = BooleanToggle(True)
show_10 = BooleanToggle(False)
show_11 = BooleanToggle(True)
show_12 = BooleanToggle(True)
show_13 = BooleanToggle(True)
show_14 = BooleanToggle(True)
show_15 = BooleanToggle(False)
show_16 = BooleanToggle(True)
number_slider_4 = Slider(42, range=0..360)  # disabled

# ----
# Add elements
add = Button()
update = GhPythonScript(trigger=[join_branches, add])  # -> update; inputs trigger: list; disabled
# ---------- update: Python ----------
update = False

for value in trigger:
    if value:
        update = True

print update
# ---------- end update ----------

# ----
# User inputs
reset_key = Button()
settings_parameters = GhPythonScript(
    assembly=remove_by_key.assembly,
    mode=list_3,
    next_element=next,
    prev_element=previous,
    get_key_by_index=get_key_by_index,
    key_at_index=key_at_index,
    selected_angle=angle,
    selected_shift_value=shift_value,
    unit_size=unit_size_2,
    mirror_unit=mirror_unit,
    filter_keys=filter_keys,
    close_connector=close_connector,
    flip_human_robot=flip_human_robot,
    reset_key=reset_key,
    compute=compute,
    random_options_num=options_num,
    generate_random_key=random_key,
    target_geo=guiding_geo,
    support_geo=support_geo,
    distance_weight=distance_weight,
    angle_weight=angle_weight,
    robot_AA_base_plane=bcf_wcs_aa,
    ur_arm_AA_base_plane=pln_6,
    robot_AB_base_plane=bcf_wcs_ab,
    ur_arm_AB_base_plane=pln_7,
    stability_criteria=list_4,
    show_resultant=show_resultant,
    collision=collision,
    reset_key_2=reset_key,
    update=update)  # -> out, assembly, selected_mode, selected_key, current_key, current_angle, current_shift_value, current_mirror_unit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; inputs key_at_index: Int32, random_options_num: Int32, generate_random_key: Boolean, target_geo: Mesh, support_geo: Brep, robot_AA_base_plane: Plane
# ---------- settings_parameters: Python ----------
import math
import random
import System.Threading.Tasks as tasks
from scriptcontext import sticky as st
import Rhino.Geometry as rg
import rhinoscriptsyntax as rs

import ghpythonlib.components as ghcomp

from compas.geometry import Frame, Box, Point, Plane
from compas.geometry import Vector, Translation, angle_vectors, Rotation
from compas.artists import Artist
from compas.topology import connected_components
from compas_rhino.conversions import plane_to_compas_frame

import time

all_options = []
distances = []
vectors = []
origins = []
filtered_keys = []

stability_check = {0:'global', 1:'local', 2:'no_stability_check'}
assembly.stability_check = stability_check[stability_criteria]
assembly.support = support_geo
assembly.target_geo = target_geo

#assembly.globals['rf_unit_radius'] = unit_size

fitness_table = []

shift = 0
set_random_shift = False
parallel = True
only_grow_top = True
top_keys = 30
iterations = 1


def get_key(open_keys):
    #if not generate_random_key:
    if selected_key in open_keys and not generate_random_key:
        #random_key = key_at_index
        random_key = selected_key
    else:
        random_key = random.choice(open_keys)
    return random_key

def collision_check(current_key, option_elems, tolerance):
    """Check for collisions with previously built elements.
    """

    collision = False
    results = []
    dist_list = []
    for key, elem in assembly.elements():
        if key != current_key:
            line1 = Artist(elem.line).draw()
            for option_elem in option_elems:
                line2 = Artist(option_elem.line).draw()
                #results.append(True if distance_line_line(elem.line, option_elem.line, tol = 0.001) < assembly.globals['rod_radius']*2. + tolerance else False)
                distance = assembly.shortest_distance_between_two_lines(line1, line2)
                #print key, distance
                results.append(True if distance < (assembly.globals['rod_radius'] * 2. + assembly.globals['joint_dist'] + tolerance) else False)
                dist_list.append(distance)
            collision = True if True in results else False
            dist = min(dist_list)

    return collision, dist

def generate_option(support_centroid, fitness_table, open_keys, cp=None):
    # The calculation order was adapted to the ratio of elements which do not pass the tests. There is a high properbility that the output value test is failed.
    # Therefore, this test is perofrmed first and we immeditely return if it failed and do not do any further calculations.
    
    # pick a key
    option_key = get_key(open_keys)
    print option_key
    # generate a random angle and shift
    random_angle = random.randint(0, 90) * 4
    random_shift = shift if not set_random_shift else random.uniform(-0.04, 0.04)
    random_bool_mirror_unit = bool(random.getrandbits(1))

    # get the current option elements of the random key with the given angle and shift value
    random_option_elems = assembly.element(option_key).current_option_elements(assembly, random_bool_mirror_unit, unit_size, random_angle, random_shift)

    # calculate the orientation to the target geometry and the distance to the target geometry
    output_value, vector1 = assembly.orientation_to_target_geo(option_key, random_angle,
                                                               assembly.target_geo)

    if not output_value > 80.0:
        return

    # check if the random option elements collide with anything
    coll, d = collision_check(option_key, random_option_elems, tolerance=-0.001)
    #print collsion, d
    if coll:
        #print collision
        return

    # check if all the random option elements are away from the ground
    random_elems_frames = [element.frame for element in random_option_elems]
    if not all(frame.point.z > 0.2 for frame in random_elems_frames):
        return

    distance, vector2 = assembly.distance_to_target_geo(option_key, random_angle, assembly.target_geo)

    if not distance < 1:
        return

    if assembly.stability_check == 'global':
        # calculate global equilibrium and the resultant force of the random option elements
        global_equilibrium, resultant, msg = assembly.calculate_global_equilibrium(assembly.support,
                                                                                   random_option_elems, radius=0.01)

        if not global_equilibrium:
            return

        # calculate the distance between the resultant force and the surface area centroid of the support
        dist = rs.Distance(rs.CurveEndPoint(resultant), support_centroid)

        # calculate the score of the random option elements
        score = output_value * angle_weight + distance * distance_weight + 1 / dist

    elif assembly.stability_check == 'local':
        cp_with_random = cp + [Artist(random_option_elem.line.midpoint).draw() for random_option_elem in
                               random_option_elems]
        sp = [Artist(assembly.element(0).line.end).draw()]

        # calculate local equilibrium (level arm) and the resultant point of the random option elements
        lever_arm, resultant_point = assembly.calculate_local_equilibrium_in_a_branch(cp_with_random, sp,
                                                                          assembly.globals['rod_length'],
                                                                          assembly.globals['rod_radius'])

        score = output_value * angle_weight + 1 / distance * distance_weight + 1 / lever_arm[0]

    elif assembly.stability_check == 'no_stability_check':
        score = output_value * angle_weight + 1 / distance * distance_weight

    # create a fitness table the random values and corresponding scores
    fitness_table.append([option_key, random_angle, random_shift, score])

def get_option_with_highest_score():
    computed_values = []
    msgs = []
    if assembly.stability_check == 'local':
        cp = [Artist(assembly.element(bkey).line.midpoint).draw() for bkey, element in assembly.elements()]
    else:
        cp = None

    start_time_loop = time.time()  # timestamp

    for i in range(iterations):
        fitness_table = []
        # precompute the keys of open connectors
        #open_keys = [key for key, frames in assembly.connectors('open') if frames != []]
        open_keys = open_connectors_keys
        
        
        # To ensure that the algorithm does not lose efficiency when growing along a geometry due to the increasing options, we only choose between the top keys
        if len(open_keys) > top_keys:
            open_keys = open_keys[len(open_keys)-top_keys:]
            
        print open_keys

        # precompute the surface area centroid of the support
        support_centroid = rs.SurfaceAreaCentroid(assembly.support)[0]

        # Here we leverage multiple cores at once. If the computer has more then one core this speeds of significantly
        if parallel:
            print 'yes'
#            tasks.Parallel.ForEach(xrange(random_options_num), lambda i: generate_option(support_centroid, fitness_table, open_keys, cp=cp))
#        else:
            for i in range(random_options_num):
                generate_option(support_centroid, fitness_table, open_keys, cp=cp)

        fitness_table_sorted = sorted(fitness_table, key=lambda x: x[3], reverse=True)
        
        msgs.append('{}. ITERATION:'.format(i))

        if fitness_table_sorted:
            msgs.append(
                'Element key {} with the highest score: {}'.format(fitness_table_sorted[0][0], fitness_table_sorted[0][3]))

            best_key = fitness_table_sorted[0][0]
            best_angle = fitness_table_sorted[0][1]
            best_shift_value = fitness_table_sorted[0][2]

            computed_values = {'key': best_key, 'angle': best_angle, 'shift_value': best_shift_value}
            
        else:
            msgs.append('No elements found which fit to the assembly. Increase the number of options or try finding a fit manually.')
    print("--- Total time %s seconds ---" % (time.time() - start_time_loop))
    # print the messages
    for msg in msgs:
        print(msg)
    
    print computed_values
    return computed_values

# all keys
key_index = assembly.network.key_index()
index_keys = [key_index[key] for key in assembly.network.nodes()]
keys = [key for key in assembly.network.nodes()]
print index_keys
print keys
all_elements = [assembly.element(key) for key in keys]

#############################################################################
## ALL OPEN CONNECTORS KEYS
#############################################################################

open_connectors_keys = [key for key, frames in assembly.connectors(state='open')]
#print open_connectors_keys

#############################################################################
## Filter key according to current robot location
#############################################################################

assembly.robot_AA_base_plane = robot_AA_base_plane
assembly.ur_arm_AA_base_plane = ur_arm_AA_base_plane
assembly.robot_AB_base_plane = robot_AB_base_plane
assembly.ur_arm_AB_base_plane = ur_arm_AB_base_plane

if filter_keys:
    for key, element in assembly.elements():
        if key in open_connectors_keys:
            distance1 = element.frame.point.distance_to_point(ur_arm_AA_base_plane.Origin)
            distance2 = element.frame.point.distance_to_point(ur_arm_AB_base_plane.Origin)
    #        print distance
    #        print distance, key
    #        print distance2, key
            if distance1 < 1.25 or distance2 < 1.25:
                filtered_keys.append(key)
    open_connectors_keys = filtered_keys


#############################################################################
## SELECT A KEY MANUALLY
#############################################################################

guid = str(ghenv.Component.InstanceGuid)
#print guid
element_key = "elem_" + guid
#print element_key
#print(st)

if element_key not in st or None:
    st[element_key] = 0

if reset_key:
    st[element_key] = 0

if next_element:
    if st[element_key] < len(open_connectors_keys) - 1:
        st[element_key] += 1

if prev_element:
    if st[element_key] <= len(open_connectors_keys) - 1:
        st[element_key] -= 1

    if st[element_key] < 1:
        st[element_key] = 0

#############################################################################
## OPEN CONNECTORS
#############################################################################

selected_mode = "Manual" if mode == 0 else "Automatic" if mode == 1 else "Join branches"

if not get_key_by_index and (selected_mode == "Manual" or selected_mode == "Automatic"):
    if len(open_connectors_keys) == 0: 
        #selected_key = 0
        print("!!! NO OPEN CONNECTORS AVAILABLE !!!")
        print("Suggestion: RESET KEY!")
        
    else:
        selected_key = open_connectors_keys[st[element_key]]

if get_key_by_index and (selected_mode == "Manual" or selected_mode == "Automatic"):
    selected_key = key_at_index
    
if 'selected_key':
    print "Selected key:", selected_key
    
"""current_key = selected_key

selected_mode = "Manual" if mode == 0 else "Automatic" if mode == 1 else "Join branches"

if not get_key_by_index and selected_mode == "Manual":
    if len(open_connectors_keys) == 0: 
        #selected_key = 0
        print("!!! NO OPEN CONNECTORS AVAILABLE !!!")
        print("Suggestion: RESET KEY!")
        
    else:
        selected_key = open_connectors_keys[st[element_key]]

if get_key_by_index and selected_mode == "Manual":
    selected_key = key_at_index
    
if selected_mode == "Automatic":
    selected_key = open_connectors_keys[st[element_key]]
    if not generate_random_key:
        current_key = selected_key
    
if 'selected_key':
    print "Selected key:", selected_key
"""

#############################################################################
## GET PARAMETERS
#############################################################################
params = 'params'

if params not in st or st['params'] is None:
    st[params] = {'key' : selected_key, 'angle': 0, 'shift_value': 0}

if selected_mode == "Automatic":
    st[params]['key'] == selected_key
    print st[params]
    if compute:
        st[params] = get_option_with_highest_score()
        print st[params]
elif selected_mode == "Manual":
    st[params] = {'key' : selected_key, 'angle': selected_angle, 'shift_value': selected_shift_value}

parameters = st[params]

print 'Current parameters:', parameters 
current_key = parameters['key']
current_angle = parameters['angle']
current_shift_value = parameters['shift_value']

print 'Current key:', current_key

if current_key not in open_connectors_keys:
    current_key = selected_key
if current_key != None:
    selected_elem = assembly.network.node[current_key]['element']

assembly.parameters = parameters
#try:
#   .... use of selected_key....
#expect:
#   print("selected_key does not exist, but no problem.)
#   

#############################################################################
## DISPLAY SELECTED CONNECTOR
#############################################################################

if current_key != None and current_key in open_connectors_keys:

    selected_connector_frame = assembly.element(current_key).connectors(state='open')[0]
    #selected_connector_frame

    R = Rotation.from_axis_and_angle(selected_elem.frame.xaxis, math.radians(current_angle), selected_elem.frame.point)
    T = Translation.from_vector(selected_elem.frame.xaxis * selected_shift_value)
    
    selected_connector_frame_copy = selected_connector_frame.transformed(R)
    selected_connector_frame_copy.transform(T)
    selected_connector_plane = Artist(selected_connector_frame_copy).draw()
    
    elem_options = assembly.element(current_key).current_option_elements(assembly, mirror_unit, unit_size, current_angle, current_shift_value)


#############################################################################
## COLLISION CHECK
#############################################################################



# check if the selected option elements collide with anything
#is_colliding, dist = collision_check(current_key, elem_options, tolerance=-0.001)

#############################################################################
## GLOBAL/LOCAL EQUILIBRIUM CHECK
#############################################################################

lever_arm_branches = []
resultant_branches = []
resultant = []

if stability_criteria == 0:
    # calculate global equilibrium and the resultant force of the selected option elements
    equlibrium, resultant_line, stability_feedback = assembly.calculate_global_equilibrium(support_geo, elem_options, radius=0.01)
    resultant_line = rs.coercecurve(resultant_line)    
    print resultant_line
    
elif stability_criteria == 1:
    
    # Identify the connected elements (branches) in the assembly.
    branches = connected_components(assembly.network.adjacency)
    
    stability_feedback = []

    lever_arm_branches, resultant_branches = assembly.calculate_local_equilibrium_in_all_branches(current_key, elem_options)
    
    for i, lever_arm in enumerate(lever_arm_branches):
        stability_feedback.append("Lever arm of branch {} is {len:.3f}m long.".format(i, len=float(lever_arm)))
else:
    stability_feedback = "No stability criteria selected."
    
#print lever_arm_branches
#print resultant_branches

if show_resultant:
    if stability_criteria == 0:
        cone_base_plane = rg.Plane(resultant_line.PointAt(0), rg.Vector3d.ZAxis*-1)
        cone_base_plane.Translate(rg.Vector3d.ZAxis*0.135)
        resultant.append(rg.Cone(cone_base_plane,-0.4, 0.02))
    else:
        for resultant_line, lever_arm in zip(resultant_branches, lever_arm_branches):
            cone_base_plane = rg.Plane(resultant_line.PointAt(0), rg.Vector3d.ZAxis*-1)
            cone_base_plane.Translate(rg.Vector3d.ZAxis*0.135)
            resultant.append(rg.Cone(cone_base_plane,-lever_arm, 0.02))


#############################################################################
## DISTANCE TO INPUT GEO
#############################################################################

distance, shortest_vector_1 = assembly.distance_to_target_geo(current_key, current_angle, target_geo)

# Vector Display
vectors.append(shortest_vector_1)
origins.append(selected_connector_plane.Origin)

target_geo_feedback = ['Key {}: Distance to target geometry: {dist:.2f}m'. format(current_key, dist=distance)]

#############################################################################
## ORIENTATION TO INPUT GEO
#############################################################################

output_value, shortest_vector_2 = assembly.orientation_to_target_geo(current_key, current_angle, target_geo)

# Vector Dispaly
vectors.append(rg.Vector3d(shortest_vector_2.x,shortest_vector_2.y,shortest_vector_2.z))
origins.append(selected_connector_plane.Origin)

target_geo_feedback.append('Key {}: Orientation to target geometry: {len:.2f}%'. format(current_key, len=output_value))

#############################################################################
## LAST ADDED KEYS
#############################################################################

new_keys = keys[-2:]
assembly.last_added = new_keys
print 'Last added keys:', ', '.join(map(str, new_keys))

#############################################################################
## Close connector
#############################################################################


if close_connector:
    assembly.element(key_at_index).connector_1_state = True
    assembly.element(key_at_index).connector_2_state = False

#for key, element in assembly.elements():
#    if element.frame.point.z < 2.57:
#        assembly.element(key).connector_1_state = False
#        assembly.element(key).connector_2_state = False

assembly.open_connectors_keys = open_connectors_keys

edges_keys = [116,123,122]


#assembly.network.add_edge(edges_keys[0],edges_keys[1])
#assembly.network.add_edge(edges_keys[0],edges_keys[2])
#assembly.network.add_edge(edges_keys[1],edges_keys[2])

#assembly.network.add_edge(109,114)
#assembly.network.delete_edge(122,76)

robot_keys = [162,164,166,168,170,190,192,188,182,158,196,154,151,194,142,144,146,148,138,140]

#for key, element in assembly.elements():
#    if key in robot_keys:
#        assembly.network.node_attribute(key, 'placed_by', 'robot')

robot_AA_base_frame = plane_to_compas_frame(robot_AA_base_plane)
robot_AB_base_frame = plane_to_compas_frame(robot_AB_base_plane)

for key, element in assembly.elements():

    assembly.network.node_attribute(key, 'robot_AA_base_frame', robot_AA_base_frame)
    assembly.network.node_attribute(key, 'robot_AB_base_frame', robot_AB_base_frame)
# ---------- end settings_parameters ----------
vdis = VectorDisplay(Anchor=settings_parameters.origins, Vector=settings_parameters.vectors)
srf = Surface(settings_parameters.resultant)
preview_3 = CustomPreview(Geometry=srf, Material=ColourSwatch(SwatchColor=RGBA(255, 13, 0, 103)))

stick_to_stick_distance = Panel(settings_parameters.dist)

# ----
# Joining branches
joining_branches = GhPythonScript(
    assembly=settings_parameters.assembly,
    elem=elem_60_def.elem,
    get_joining_options=get_joining_options,
    joining_case=list_2,
    show_new_element=show_new_element,
    pair_index=pair_index,
    point_on_intersection=number_slider_2,
    point1=point1,
    point2=point2,
    shift_value=shift_value_2,
    join_branches=join_branches,
    mirror_unit=mirror_unit,
    unit_size=unit_size_2)  # -> out, assembly, elem_line1, elem_line2, new_elem_mesh, intersections, angle1, angle2; inputs pair_index: Int32
# ---------- joining_branches: Python ----------
import math
import rhinoscriptsyntax as rs
import Rhino.Geometry as rg

from compas.geometry import Point, Vector, Frame, Plane, Vector, Line, Transformation, Rotation, Translation
from compas.geometry import angle_vectors, closest_point_on_line, intersection_line_plane, angles_points
from compas.artists import Artist
from compas_rhino.conversions import line_to_rhino_curve, point_to_compas, point_to_rhino, plane_to_compas_frame

import ghpythonlib.components as gh

mirror_unit = False

connector_ranges = []
connectors_pairs = []
intersections = []


epsilon = 0.0000001

open_connectors_keys = [key for key, frames in assembly.connectors(state='open')]

robot_AA_base_frame = plane_to_compas_frame(assembly.robot_AA_base_plane)
robot_AB_base_frame = plane_to_compas_frame(assembly.robot_AB_base_plane)

#############################################################################
## CASE 1
#############################################################################

if get_joining_options and joining_case == 0:

    for key, connector_range in assembly.connectors_ranges(state='open'):
        if len(connector_range) != 0:
            connector_ranges.append((key, Artist(connector_range[0]).draw()))

    for i in range(len(connector_ranges)):
        for open_connectors_key in open_connectors_keys:
            intersection = rg.Intersect.Intersection.CurveSurface(line_to_rhino_curve(assembly.element(open_connectors_key).line), connector_ranges[i][1], 0.001, 0.001)
            if intersection:
                for c in intersection:
                    intersections.append(c.PointA)
                connectors_pairs.append((connector_ranges[i][0], open_connectors_key))

    #print len(intersection_curves)

    if len(connectors_pairs) != 0:
        intersection_point = intersections[pair_index]
        selected_keys_pair = [pkey for pkey in connectors_pairs[pair_index]]
        connectors_pairs_list = [key for pair in connectors_pairs for key in pair]
    
        assembly.selected_keys_pair = [selected_keys_pair[0]]
        assembly.connectors_pairs_list = connectors_pairs_list
        assembly.selected_connectors_ranges_intersection_point = intersection_point
        
        # Convert in COMPAS Point
        cp = point_to_compas(intersection_point)
        
        # Compute angle for option pair
        open_connector_elem_1 = assembly.element(selected_keys_pair[0])
        cutting_plane_origin_1 = closest_point_on_line(cp, open_connector_elem_1.line)
        cutting_plane_1 = Plane(cutting_plane_origin_1, open_connector_elem_1.line.vector)
        intersection_point_1 = intersection_line_plane(open_connector_elem_1.current_option_elements(mirror_unit, 0, 0)[1].line, cutting_plane_1)

        angle1 = angles_points(cutting_plane_origin_1, intersection_point_1, cp) 
        angle1 = math.degrees(angle1[1])
        
        current_option = assembly.element(selected_keys_pair[0]).current_option_elements(mirror_unit, unit_size, angle1, 0)

        rot_line = Artist(assembly.element(selected_keys_pair[0]).line).draw()
        start_p = rot_line.From
        rot_axis = rg.Vector3d(rot_line.From - rot_line.To)
        rot_point = Artist(assembly.element(selected_keys_pair[0]).frame.point).draw()
        elem_line1 = Artist(current_option[1].line).draw()
        elem_line2 = Artist(assembly.element(selected_keys_pair[1]).line).draw()
        rot_dir = 1
        step = 1.0

        tol_angle = assembly.get_rot_angle(step, rot_axis, rot_point, elem_line1, elem_line2, rot_dir, epsilon)
        angle1 += tol_angle
        
        current_option_rotated = assembly.element(selected_keys_pair[0]).current_option_elements(mirror_unit, angle1, 0)
        
        if show_new_element:
            new_elem = assembly.add_third_element(elem, assembly.element(selected_keys_pair[1]), current_option_rotated[1], point1, point2, shift_value, epsilon)
            new_elem_mesh = Artist(new_elem.mesh).draw()
        
        if join_branches:
            msgs = []
            
            # close a reciprocal frame unit with the option elements with the highest score
            assembly.join_branches(selected_keys_pair, mirror_unit, angle1, 0, new_elem, robot_frame=BCF, on_ground=False)

            msgs.append('--- New element added to assembly ---')
            
            for msg in msgs:
                print(msg)
    else:
        assembly.selected_keys_pair = []
        assembly.connectors_pairs_list = []
        assembly.selected_connectors_ranges_intersection_point = []
        
#############################################################################
## CASE 2
#############################################################################

if get_joining_options and joining_case == 1:
    for key, connector_range in assembly.connectors_ranges(state='open'):
        if len(connector_range) != 0:
            #print connector_range
            connector_ranges.append((key, Artist(connector_range[0]).draw()))

    for i in range(len(connector_ranges)):
        for j in range(i + 1, len(connector_ranges)):
            is_intersecting, intersection, p_array = rg.Intersect.Intersection.SurfaceSurface(connector_ranges[i][1], connector_ranges[j][1], 0.001)
            if len(intersection) > 0:
                #print intersection
                joined_curve = rg.Curve.JoinCurves(intersection)
                connectors_pairs.append((connector_ranges[i][0], connector_ranges[j][0]))
                #print joined_curve
                intersections.append(joined_curve[0])
                
        
    #print 'Following element pair(s) {} could be joined.'.format(connectors_pairs)
    #print intersections
    
    if len(connectors_pairs) != 0:
        curve_param = intersections[pair_index].NormalizedLengthParameter(point_on_intersection)
        intersection_point = intersections[pair_index].PointAt(curve_param[1])
        
        selected_keys_pair = [pkey for pkey in connectors_pairs[pair_index]]
        connectors_pairs_list = [key for pair in connectors_pairs for key in pair]
    
        assembly.selected_keys_pair = selected_keys_pair
        assembly.connectors_pairs_list = connectors_pairs_list
        assembly.selected_connectors_ranges_intersection_point = intersection_point

        # Convert to compas point
        cp = point_to_compas(intersection_point)
        
        # Compute angle for first option pair
        open_connector_elem1 = assembly.element(selected_keys_pair[0])
        cutting_plane_origin1 = closest_point_on_line(cp, open_connector_elem1.line)
        cutting_plane1 = Plane(cutting_plane_origin1, open_connector_elem1.line.vector)
        option_elem1 = open_connector_elem1.current_option_elements(assembly, mirror_unit, 0, 0)[1]
        intersection_point1 = intersection_line_plane(option_elem1.line, cutting_plane1)
        
        angle1 = angles_points(cutting_plane_origin1, intersection_point1, cp) 
        angle1 = math.degrees(angle1[0])
        
        # Compute angle for second option pair
        open_connector_elem2 = assembly.element(selected_keys_pair[1])
        cutting_plane_origin2 = closest_point_on_line(cp, open_connector_elem2.line)
        cutting_plane2 = Plane(cutting_plane_origin2, open_connector_elem2.line.vector)
        option_elem2 = open_connector_elem2.current_option_elements(assembly, mirror_unit, 0, 0)[1]
        intersection_point2 = intersection_line_plane(option_elem2.line, cutting_plane2)
        
        angle2 = angles_points(cutting_plane_origin2, intersection_point2, cp)
        angle2 = math.degrees(angle2[0])
        
        rot_line = Artist(open_connector_elem1.line).draw()
        start_p = rot_line.From
        rot_axis = rg.Vector3d(rot_line.From - rot_line.To)
        rot_point = Artist(assembly.element(selected_keys_pair[0]).frame.point).draw()
        elem_line1 = Artist(option_elem1.line).draw()
        elem_line2 = Artist(option_elem2.line).draw()

        rot_dir = 1
        step = 6.0

        tol_angle = assembly.get_rot_angle(step, rot_axis, rot_point, elem_line1, elem_line2, rot_dir, epsilon)
        angle1 += tol_angle
        
        option1_rotated = assembly.element(selected_keys_pair[0]).current_option_elements(assembly, mirror_unit, angle1, 0)
        option2_rotated = assembly.element(selected_keys_pair[1]).current_option_elements(assembly, mirror_unit, angle2, 0)
        
        if show_new_element:
            new_elem = assembly.add_third_element(elem, option1_rotated[1], option2_rotated[1], point1, point2, shift_value, epsilon)
            new_elem_mesh = Artist(new_elem.mesh).draw()

if not get_joining_options:
    assembly.selected_keys_pair = []
    assembly.connectors_pairs_list = []
    assembly.selected_connectors_ranges_intersection_point = []


if joining_case == 0:
    print '-------------- CASE 1: SINGLE OPTIONS-PAIR -------------'
elif joining_case == 1:
    print '-------------- CASE 2: TWO OPTIONS-PAIRS ---------------'
print 'Number of key-pairs that can be joined:', len(connectors_pairs)
print 'Selected open connectors key-pair:', assembly.selected_keys_pair
if len(assembly.selected_keys_pair) != 0:
    print 'Open connector key for option:', assembly.selected_keys_pair[0]
print 'Option 1 angle:', angle1
print 'Option 2 angle:', angle2
# ---------- end joining_branches ----------
line_2 = Line(joining_branches.elem_line1)
line_3 = Line(joining_branches.elem_line2)
crv = Curve(joining_branches.intersections)
mesh_5 = Mesh(joining_branches.new_elem_mesh)

panel_8 = Panel(settings_parameters.selected_key)

stats = GhPythonScript(assembly=settings_parameters.assembly)  # -> out
# ---------- stats: Python ----------
from compas.topology import connected_components
from compas_rhino.conversions import frame_to_rhino


# Identify the connected elements (branches) in the assembly.
branches = connected_components(assembly.network.adjacency)

#print '-------------------- ASSEMBLY --------------------'
#print 'The assembly has {} branches.'.format(len(branches))

total_elements = assembly.network.number_of_nodes()
planned_keys = list(assembly.network.nodes_where({'is_planned':True}))
built_keys = list(assembly.network.nodes_where({'is_built':True}))
support_keys = list(assembly.network.nodes_where({'is_support':True}))

#print '-------------------- ELEMENTS --------------------'
print "Total ELEMENTS:", total_elements
#print len(built_keys), "element(s) are already built."
#print len(planned_keys), "element(s) are planned."
#print len(support_keys), "element(s) are suppports."

keys = [key for key, element in assembly.elements()]
open_connectors_keys = [key for key in keys if assembly.element(key).connectors(state='open')]
closed_connectors_keys = [key for key in keys if key not in open_connectors_keys]

#print '------------------- CONNECTORS -------------------'
#print len(open_connectors_keys), 'open connectors'
#print len(closed_connectors_keys), 'closed connectors'

edges = assembly.network.number_of_edges()
nodes = len(closed_connectors_keys)*3

#print '--------------------- JOINTS ----------------------'

joints = []
joints_frames = []

for key, element in assembly.elements():
    if not element.connector_1_state:
        joints_frames.append(element.joint_frame_1)
        #joints.append(frame_to_rhino(element.joint_frame_1))
    if not element.connector_2_state and key not in support_keys:
        joints_frames.append(element.joint_frame_2)
        #joints.append(frame_to_rhino(element.joint_frame_2))
        
print "Total JOINTS:", len(joints_frames)


assembly.joints = joints_frames
# ---------- end stats ----------
# Status bar
panel_9 = Panel(stats)

# ----
# Current mode
panel_10 = Panel(settings_parameters.selected_mode)

# ----
# Current parameters
key = Panel(settings_parameters.current_key)
angle_2 = Panel(settings_parameters.current_angle)
shift_value_3 = Panel(settings_parameters.current_shift_value)

# ----
# Feedback
stability_feedback = Panel(settings_parameters.stability_feedback)
target_geometry = Panel(settings_parameters.target_geo_feedback)
joining_branches_2 = Panel(joining_branches.out)
collision_detection = Panel(settings_parameters.is_colliding)

python_2 = GhPythonScript(assembly=settings_parameters.assembly)  # -> out, a
# ---------- python_2: Python ----------
print(dir(assembly))

for a in dir(assembly):
    print getattr(assembly,a)
# ---------- end python_2 ----------

grow_assembly = GhPythonScript(
    assembly=joining_branches.assembly,
    key=settings_parameters.current_key,
    angle=settings_parameters.current_angle,
    shift_value=settings_parameters.current_shift_value,
    mirror_unit=mirror_unit,
    unit_size=unit_size_2,
    robot_name=list_5,
    add=add)  # -> out, test, assembly; inputs mirror_unit: Boolean
# ---------- grow_assembly: Python ----------
from compas_rhino.conversions import plane_to_compas_frame


robot_AA_base_frame = plane_to_compas_frame(assembly.robot_AA_base_plane)
robot_AB_base_frame = plane_to_compas_frame(assembly.robot_AB_base_plane)
print robot_AA_base_frame

#############################################################################
## ADD ELEMENTS TO ASSEMBLY BY SELECTED  KEY, ANGLE AND SHIFT_VALUE
#############################################################################


if add:
    msgs = []
    
    # close a reciprocal frame unit with the option elements with the highest score
    assembly.close_rf_unit(key, mirror_unit, unit_size, angle, shift_value, robot_name, robot_AA_base_frame, robot_AB_base_frame, on_ground=False)
    assembly.open_connectors_keys.remove(key)
    msgs.append('--- New element added to assembly ---')
    
    for msg in msgs:
        print(msg)


#for key, element in assembly.elements():
#    print assembly.network.node_attribute(key, 'robot_frame')
# ---------- end grow_assembly ----------
rec = DataRecorder(grow_assembly.out, DataLimit=-10, RecordData=False)
messages = Panel(rec)

assembly_viz = PythonScript(
    assembly=grow_assembly.assembly,
    joint_elem=elem_60_def.joint_elem,
    preview_mode=list_6,
    show_assembly=show_14,
    show_robots_reach=show_16,
    show_support=show_15,
    show_selected=show_5,
    show_option=show_13,
    show_open_connectors_planes=show_12,
    show_all_frames=show_4,
    show_selected_connectors_ranges=show_7,
    show_all_connectors_ranges=show_10,
    show_intersection=show_11,
    show_joining_options=get_joining_options,
    show_open_keys=show_8,
    show_all_keys=show_9,
    show_joints=show_6,
    selected_key=settings_parameters.selected_key,
    current_key=settings_parameters.current_key,
    angle=settings_parameters.current_angle,
    angle1=joining_branches.angle1,
    angle2=joining_branches.angle2,
    mirror_unit=mirror_unit,
    unit_size=unit_size_2,
    shift_value=settings_parameters.current_shift_value,
    flip_human_robot=flip_human_robot)  # -> out, G_planned_elems, G_built_elems, G_placed_by_human, G_placed_by_robot, G_support_elems, G_selected_elem, G_no_open_connectors_elems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; inputs current_key: Int32
# ---------- assembly_viz: Python ----------
import os
import sys
from scriptcontext import sticky as st
import Rhino.Geometry as rg

import math
from math import pi

from compas.geometry import Vector, Translation, Frame, Transformation
from compas.artists import Artist
from compas.colors import Color
from compas_rhino.conversions import cylinder_to_rhino, frame_to_rhino

G_selected = []

G_placed_by_human = []
G_placed_by_robot = []

G_planned_elems = []
G_built_elems = []
G_support_elems = []

G_no_open_connectors_elems = []
G_open_connectors_elems = []

G_connectors_ranges = []
G_close_pairs = []
G_intersection = []

G_joints = []

robots_reach = []
elem_options = []

key_tag_text = []
key_tag_location= []
lines = []

flip = 'AA'

# Color coding
color_coding = {'color_close_pairs': Color(1.0, 0., 0.0, 1.0),
                'color_is_planned': Color(1.0, 0.752941176471, 0.0, 1.0), 
                'color_is_support': Color(0.0, 0.0, 1.0, 1.0), 
                'color_has_open_connector': Color(0.494117647059, 1.0, 0.239215686275, 1.0), 
                'color_has_no_open_connectors': Color(0.78431372549, 0.78431372549, 0.78431372549, 1.0), 
                'color_is_built': Color(0.811764705882, 1.0, 0.709803921569, 1.0), 
                'color_is_built_by_robot': Color(0.686274509804, 0.878431372549, 0.862745098039, 1.0), 
                'color_is_built_by_human': Color(0.949019607843, 0.898039215686, 0.0, 1.0)}

keys = [key for key, element in assembly.elements()]
lines = [Artist(assembly.element(key).line).draw() for key in keys]

open_connectors_frames = [assembly.element(key).connectors(state='closed') for key, element in assembly.elements()]
all_connectors_frames = [assembly.element(key).connectors() for key, element in assembly.elements()]
element_frames = [assembly.element(key).frame for key, element in assembly.elements()]
print open_connectors_frames
print element_frames

selected_element = assembly.element(current_key)

selected_connectors_ranges = [assembly.element(key).connectors_ranges(state='open') for key in keys if key == current_key or key in assembly.selected_keys_pair]
#selected_connectors_ranges = [assembly.element(key).connectors_ranges(state='open') for key in keys if key in assembly.selected_keys_pair]
all_connectors_ranges = [assembly.element(key).connectors_ranges(state='open') for key in keys if key]

if show_open_connectors_planes:
    open_connectors_planes = [Artist(connector).draw() for connectors in open_connectors_frames for connector in connectors if connectors != []]
if show_all_frames:
    all_connectors_planes = [Artist(connector).draw() for connectors in all_connectors_frames for connector in connectors if connectors != []]
    all_element_planes = [Artist(elem).draw() for elem in element_frames]
    
if show_all_connectors_ranges and not show_selected_connectors_ranges:
    G_connectors_ranges = [Artist(connector).draw() for connectors in all_connectors_ranges for connector in connectors if connectors != []]
    
elif show_selected_connectors_ranges and not show_all_connectors_ranges:
    T = Translation.from_vector(selected_element.frame.xaxis * 0)
    connectors_ranges = [connector.transform(T) for connectors in selected_connectors_ranges for connector in connectors if connectors != []]
    G_connectors_ranges = [Artist(connector).draw() for connectors in connectors_ranges]
    
else:
    G_connectors_ranges = []
    
if show_intersection:
    if len(assembly.selected_connectors_ranges_intersection_point) > 0:
        G_intersection = assembly.selected_connectors_ranges_intersection_point
    
def show(element, output_geo, color):
    mesh = Artist(element.mesh).draw(color)
    output_geo.append(mesh)

def show_multiple(elements, output_geo, color):
    for element in elements:
        mesh = Artist(element.mesh).draw(color)
        output_geo.append(mesh)
        
if show_robots_reach:
    robots_reach.append(rg.Sphere(assembly.ur_arm_AA_base_plane.Origin, 1.25))
    robots_reach.append(rg.Sphere(assembly.ur_arm_AB_base_plane.Origin, 1.25))
    
print assembly.selected_keys_pair

if assembly:
    radius = assembly.globals['rod_radius']
    if current_key != None:
        current_element = assembly.element(current_key)
        if show_joining_options and len(assembly.selected_keys_pair) != 0:
            print 'yes'
            if len(assembly.selected_keys_pair) > 1: 
                elem_options.append(assembly.element(assembly.selected_keys_pair[0]).current_option_elements(assembly, mirror_unit, unit_size, angle1, shift_value))
                elem_options.append(assembly.element(assembly.selected_keys_pair[1]).current_option_elements(assembly, mirror_unit, unit_size, angle2, shift_value))
            else:
                elem_options.append(assembly.element(assembly.selected_keys_pair[0]).current_option_elements(assembly, mirror_unit, unit_size, angle1, shift_value))
            elem_options = [option for options in elem_options for option in options]
        else:
            elem_options = assembly.element(current_key).current_option_elements(assembly, mirror_unit, unit_size, angle, shift_value)
        G_selected = Artist(assembly.element(current_key).mesh).draw(color_coding['color_is_support'])
    else:
        current_element = None
        elem_options = []
    
    if len(elem_options) != 0:
        elem_option = elem_options[0]
    
    if flip_human_robot:
        elem_options.reverse()
        

    
    planned_keys = list(assembly.network.nodes_where({'is_planned':True, 'is_built':False}))
    built_keys = list(assembly.network.nodes_where({'is_built':True}))
    unbuilt_keys = [key for key, element in assembly.elements() if key not in built_keys]
    support_keys = list(assembly.network.nodes_where({'is_support':True}))
    #open_connectors_keys = [key for key, frames in assembly.connectors('open') if frames != []]
    open_connectors_keys = assembly.open_connectors_keys
    no_open_connectors_keys = [key for key in planned_keys if key not in open_connectors_keys]
    
    robot_keys = list(assembly.network.nodes_where({'placed_by':'robot', 'is_built':True}))
    human_keys = list(assembly.network.nodes_where({'placed_by':'human', 'is_built':True}))

    #support_keys = [key for key in support_keys if key not in assembly.open_connectors_keys]
    
    print 'robot keys:', robot_keys
    print 'human keys:', human_keys
    
    print 'planned keys:', planned_keys
    print 'built keys:', built_keys
    print 'unbuilt keys:', unbuilt_keys
    
    print 'support keys:', support_keys
    print 'open connectors keys:', open_connectors_keys
    print 'no open connectors keys:', no_open_connectors_keys
    
    robot_elements = [assembly.element(key) for key in robot_keys] 
    human_elements = [assembly.element(key) for key in human_keys] 
    
    planned_elements = [assembly.element(key) for key in planned_keys] 
    built_elements = [assembly.element(key) for key in built_keys] 
    
    support_elements = [assembly.element(key) for key in support_keys] 
    open_connectors_elements = [assembly.element(key) for key in open_connectors_keys]
    no_open_connectors_elements = [assembly.element(key) for key in no_open_connectors_keys]
    open_keys = [key for key, frames in assembly.connectors('open') if frames != []]

    # Visualize assembly
    if show_assembly:
        if preview_mode == 2:
            for element in planned_elements:
                geo = cylinder_to_rhino(element._source)
                G_planned_elems.append(geo)
                
            for element in built_elements:
                geo = cylinder_to_rhino(element._source)
                G_built_elems.append(geo)
                
            for element in support_elements:
                geo = cylinder_to_rhino(element._source)
                #G_support_elems.append(geo)
                
            
        elif preview_mode == 1:
            for element in support_elements:
                geo = cylinder_to_rhino(element._source)
                G_support_elems.append(geo)
                
            for element in open_connectors_elements:
                geo = cylinder_to_rhino(element._source)
                G_open_connectors_elems.append(geo)
                
            for element in no_open_connectors_elements:
                geo = cylinder_to_rhino(element._source)
                G_no_open_connectors_elems.append(geo)
                
            if show_selected: 
                G_selected_elem = cylinder_to_rhino(assembly.element(selected_key)._source)
                print ("here")
            
        else:
            for element in robot_elements:
                geo = cylinder_to_rhino(element._source)
                G_placed_by_robot.append(geo)
                
            for element in human_elements:
                geo = cylinder_to_rhino(element._source)
                G_placed_by_human.append(geo)

    # Vizualize current connector 
    if show_option and show_assembly:
        if elem_options:

            for option in elem_options:
                G_planned_elems.append(cylinder_to_rhino(option._source))
                lines.append(Artist(option.line).draw())

        else:
            print('No open connectors')
    
    
    #elem_option_robot = Artist(elem_options[0].frame).draw() # elem for planning robot routine
    
    if show_open_keys:
        for key, element in assembly.elements():
            if key in open_connectors_keys:
                key_tag_text.append(str(key))
                key_tag_location.append(Artist(element.frame).draw().Origin)
                
    if show_all_keys:
        for key, element in assembly.elements():
            key_tag_text.append(str(key))
            key_tag_location.append(Artist(element.frame).draw().Origin)
            
    if show_support:
        G_supports.append(assembly.support)

points = []
for key, element in assembly.elements():
    points.append(Artist(element.frame.point).draw())
    
joints = []
if show_joints:
    for key, element in assembly.elements():
        if not element.connector_1_state:
            joints.append(frame_to_rhino(element.joint_frame_1))
        if not element.connector_2_state and key not in support_keys:
            joints.append(frame_to_rhino(element.joint_frame_2))
        
assembly.support_keys = support_keys

#if len(assembly.joints) > 0 and show_joints:
#    for joint_frame in assembly.joints:
#        #print joint_frame
#        T = Transformation.from_frame_to_frame(Frame.worldXY(), joint_frame)
#        joint = joint_elem.transformed(T)
#        G_joints.append(Artist(joint.mesh).draw())
# ---------- end assembly_viz ----------
rot = GhPythonScript(plane=assembly_viz.elem_option_robot, angle=number_slider_4)  # -> out, plane; disabled
# ---------- rot: Python ----------
import math
from compas.geometry import Frame, Rotation
from compas.artists import Artist

frame = Frame(plane.Origin, plane.XAxis, plane.YAxis)

R = Rotation.from_axis_and_angle(frame.xaxis, math.radians(angle), frame.point)
frame.transform(R)

plane = Artist(frame).draw()
# ---------- end rot ----------
geo_3 = Geometry(assembly_viz.G_support_elems)
line_4 = Line(flatten(assembly_viz.lines))
geo_4 = Geometry(assembly_viz.G_joints)
pt_3 = Point(assembly_viz.G_intersection)
pt_4 = Point(assembly_viz.points)
geo_5 = Geometry(assembly_viz.G_no_open_connectors_elems)
mesh_6 = Mesh(assembly_viz.G_close_pairs)
pln_9 = Plane(assembly_viz.open_connectors_planes)
geo_6 = Geometry(assembly_viz.G_open_connectors_elems)
geo_7 = Geometry(assembly_viz.G_built_elems)
geo_8 = Geometry(assembly_viz.G_placed_by_human)
geo_9 = Geometry(assembly_viz.G_placed_by_robot)
geo_10 = Geometry(assembly_viz.robots_reach)
geo_11 = Geometry(assembly_viz.G_planned_elems)
srf_2 = Surface(assembly_viz.G_connectors_ranges)
tag = TextTag(Location=assembly_viz.key_tag_location, Text=assembly_viz.key_tag_text)
cir = Circle(Plane=pln_9, Radius=0.2)
preview_4 = CustomPreview(Geometry=geo_10, Material=ColourSwatch(SwatchColor=RGBA(0, 30, 255, 26)))
preview_5 = CustomPreview(Geometry=geo_8, Material=ColourSwatch(SwatchColor=RGB(242, 229, 0)))
sph = Sphere(Base=assembly_viz.joints, Radius=0.032)
preview_6 = CustomPreview(Geometry=geo_11, Material=ColourSwatch(SwatchColor=RGBA(255, 170, 0, 119)))
preview_7 = CustomPreview(Geometry=geo_6, Material=ColourSwatch(SwatchColor=RGB(121, 255, 54)))
preview_8 = CustomPreview(Geometry=[geo_7, geo_5], Material=ColourSwatch(SwatchColor=RGBA(199, 199, 199, 115)))
preview_9 = CustomPreview(Geometry=geo_9, Material=ColourSwatch(SwatchColor=RGB(175, 224, 220)))
preview_10 = CustomPreview(Geometry=geo_3, Material=ColourSwatch(SwatchColor=RGB(0, 0, 255)))

geo_12 = Geometry(assembly_viz.G_selected_elem)
pln_10 = Plane(assembly_viz.all_element_planes)
pln_11 = Plane(assembly_viz.all_connectors_planes)
panel_11 = Panel(geo_12)
preview_11 = CustomPreview(Geometry=geo_12, Material=ColourSwatch(SwatchColor=RGB(235, 16, 16)))

# ----
# Network visualization
number_slider_5 = Slider(0, range=0..47)
show_17 = BooleanToggle(False)
network_viz = GhPythonScript(assembly=grow_assembly.assembly, show_network=show_17, key=number_slider_5)  # -> out, nodes, edges, current_node, current_node_neighbors; inputs key: Int32
# ---------- network_viz: Python ----------
import sys, os
import ghpythonlib.components as ghcomp
from compas.datastructures import Network
from compas_ghpython.artists import NetworkArtist
from compas_rhino.geometry import RhinoLine

import compas_ghpython
import Rhino.Geometry as rg


data = assembly.network.to_data()
network = Network.from_data(data)

print assembly.network.number_of_nodes()

def draw_network(network):
    """Draw a network in Grasshopper.
    """
    points = []
    for key, attr in network.nodes(True):
        points.append({
            'pos': network.node_coordinates(key),
        })

    lines = []
    for (u, v), attr in network.edges(True):
        lines.append({
            'start': network.node_coordinates(u),
            'end': network.node_coordinates(v),
        })

    points_rg = compas_ghpython.draw_points(points)
    lines_rg = compas_ghpython.draw_lines(lines)

    return points_rg, lines_rg

if show_network:
    nodes, edges = draw_network(network)
    
    current_node = {'pos': network.node_coordinates(key), 'radius': 0.03}
    current_node = compas_ghpython.draw_spheres([current_node])
    
    current_node_neighbors_keys = network.neighbors(key)
    current_node_neighbors = [{'pos': network.node_coordinates(key), 'radius': 0.02} for key in current_node_neighbors_keys]
    current_node_neighbors = compas_ghpython.draw_spheres(current_node_neighbors)
# ---------- end network_viz ----------
pt_5 = Point(network_viz.nodes)
line_5 = Line(network_viz.edges)
brep_4 = Brep(network_viz.current_node_neighbors)
brep_5 = Brep(network_viz.current_node)
preview_12 = CustomPreview(Geometry=brep_4, Material=ColourSwatch(SwatchColor=RGB(255, 207, 207)))
preview_13 = CustomPreview(Geometry=[brep_5, line_5], Material=ColourSwatch(SwatchColor=RGB(0, 0, 0)))

# ----
# Set to built
keys = Slider(18, range=0..100)
set_to_built = GhPythonScript(assembly=grow_assembly.assembly, built_keys=keys, set_keys_to_built=Button(), set_all_to_unbuilt=Button())  # -> out, assembly; inputs built_keys: Int32
# ---------- set_to_built: Python ----------
import rhinoscriptsyntax as rs

if set_keys_to_built:
    for i in range(built_keys):
        #assembly.network.node_attribute(i, 'is_planned', True)
        assembly.network.node_attribute(i, 'is_built', True)
        
if set_all_to_unbuilt:
    for key, element in assembly.elements():
    #    assembly.network.node_attribute(key, 'is_planned', True)
        assembly.network.node_attribute(key, 'is_built', False)
        
for key, element in assembly.elements():
    print assembly.network.node_attribute(key, 'robot_AA_base_frame')
# ---------- end set_to_built ----------
