# Grasshopper definition ex4_ur10e_demo.ghx (Grasshopper 1.0.7)

panel = Panel("Unload libraries")
reload = Button()
py = PythonScript(reload=reload)
# ---------- py: Python ----------
from compas_ghpython import unload_modules

if reload:
    unload_modules("compas")
    unload_modules("compas_fab")
    unload_modules("roslibpy")
    unload_modules("fabrication_manager")
    unload_modules("assembly_information_model")
    unload_modules("am_information_model")
    unload_modules("ur_fabrication_control")
    unload_modules("mobile_robot_control")
    unload_modules("extruder_control")
    unload_modules("mobile_pb_am")
# ---------- end py ----------

mesh = Mesh(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)

# ----
# IP Settings
# --> Set your IP address
# --> Set robot IP address
server_ip = ValueList({"192.168.10.44", "192.168.10.12", "192.168.10.11", "192.168.10.10", "192.168.10.2", "127.0.0.1", "192.168.10.111", "192.168.0.250", "192.168.0.30", "10.42.0.212", "10.42.0.133"}, selected="192.168.0.250")
ext_ip = ValueList({"192.168.10.10", "192.168.10.20", "192.168.10.11", "192.168.10.12", "127.0.0.1", "192.168.10.111", "192.168.0.220", "192.168.0.30", "192.168.10.50", "0.0.0.0"}, selected="192.168.0.220")
ur_ip = ValueList({"192.168.10.10", "192.168.10.20", "192.168.10.11", "192.168.10.12", "127.0.0.1", "192.168.10.111", "192.168.0.210", "192.168.0.30"}, selected="192.168.0.210")
server_port = ValueList({"50002", "50003", "50005", "50006", "50007", "50008", "50009", "50010", "50011", "50012", "50013", "50014", "50015", "50016", "50017", "50018", "50019"}, selected="50017")
ext_port = ValueList({"50003", "50004"}, selected="50004")
ur_port = ValueList({"30002"}, selected="30002")
globals = PythonScript(
    server_ip=server_ip,
    server_port=server_port,
    ur_ip=ur_ip,
    ur_port=ur_port,
    ext_ip=ext_ip,
    ext_port=ext_port,
    clear=Button())  # inputs server_port: Int32
# ---------- globals: Python ----------
from scriptcontext import sticky as st

st["server_ip"] = server_ip
st["server_port"] = server_port

st["ur_ip"] = ur_ip
st["ur_port"] = ur_port

st["ext_ip"] = ext_ip
st["ext_port"] = ext_port


if clear:
    st.clear()
# ---------- end globals ----------

# ----
# Check if UR robot
#  is available
ping = Button()
py_2 = PythonScript(ip=ur_ip, ping=ping)  # -> out, trigger
# ---------- py_2: Python ----------
from scriptcontext import sticky as st
from ur_fabrication_control.direct_control.utilities import is_available

guid = str(ghenv.Component.InstanceGuid)
txt_key = "txt_" + guid
if txt_key not in st:
    st[txt_key] = ""

if ping:
    
    available = is_available(ip)
    
    if available:
        st[txt_key] = "%s is up!" % ip
        trigger = True
    else:
        st[txt_key] = "%s is down!" % ip
        trigger = False

print(st[txt_key])
# ---------- end py_2 ----------
panel_2 = Panel(py_2.out)

# ----
# Select Plane
list = ValueList({"Plane1": 0, "Plane2": 1}, selected="Plane1")
plane2 = Plane(Plane(origin=(0.540538501, -0.5732405619, 0), x=(-1, 0, 0), y=(0, 1, 0)))
plane1 = Plane(Plane(origin=(-0.05951504325, -0.4751184201, 0), x=(1, 0, 0), y=(0, -1, 0)))
filter = StreamFilter(Gate=list, Stream0=plane1, Stream1=plane2)

robot1_base_plane = Plane(Plane(origin=(-0.8954985457, -0.9983460411, 0), x=(0.6423251942, 0.7664322181, 0), y=(-0.7664322181, 0.6423251942, 0)))
robot2_base_plane = Plane(Plane(origin=(-0.8954985457, -0.9983460411, 0), x=(0.6423251942, 0.7664322181, 0), y=(-0.7664322181, 0.6423251942, 0)))  # disabled
worldxy = Plane(PlaneXY(0, 0, 0))

# ----
# Configuration
# Not working?
toggle = BooleanToggle(True)
planes = Plane([Plane(origin=(0.6790303737, 0.03767080974, 0), x=(-0.3344945505, 0.9423976845, 0), y=(0.9423976845, 0.3344945505, 0)), Plane(origin=(1, 0, 0), x=(0, 1, 0), y=(1, 0, 0)), Plane(origin=(1, 1, 0), x=(0, 1, 0), y=(1, 0, 0))])

visualize = PythonScript()  # -> out, robot, visual, collision_meshes_robot, collision_mesh_base, collision_meshes_obstacles, collision_meshes_attached, frames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; inputs redraw: list, attached_collision_meshes: list
# ---------- visualize: Python ----------
from compas.geometry import Vector
from compas.geometry import Point
from compas.geometry import Transformation
from compas.geometry import Frame
from compas_ghpython.artists import MeshArtist
from compas_fab.robots import Configuration

import ghpythonlib.components as ghcomp
from compas_rhino.conversions import xform_to_rhino


if robot and configuration:
    
    robot.update(configuration, visual=show_visual, collision=show_collision)
    if in_world:
        T = robot.transformation_OCF_WCF()
    else:
        T = Transformation()

    if show_visual:
        visual = robot.artist.draw_visual()
        visual += robot.base_geometry
        visual = ghcomp.Transform(visual, xform_to_rhino(T))

    if show_collision:
        collision_meshes_robot = robot.artist.draw_collision()
        collision_meshes_robot = ghcomp.Transform(collision_meshes_robot, xform_to_rhino(T))
    
    if show_end_effector_frame:
        ee_frame = robot.get_end_effector_frame(group=group, full_configuration=configuration)
        if robot.attached_tool:
            ee_frame = robot.from_t0cf_to_tcf([ee_frame])[0]
        ee_frame = ee_frame.transformed(T)
    
    if show_robot_frames:
        frames = robot.transformed_frames(configuration)
        [f.transform(T) for f in frames]

    if show_base_frame:
        base_frame = robot.get_base_frame(group, configuration)
        base_frame = base_frame.transformed(T)
    
    if show_origin_frame:
        origin_frame = robot.get_origin_frame()

    if show_picking_frame:
        picking_frame = robot.get_picking_frame()
        #picking_frame = picking_frame.transformed(T)
    
    if show_cm:
        M = []
        for cm in scene.cm:
            mesh = cm.mesh
            M.append(MeshArtist(mesh).draw())
        collision_meshes_obstacles = M
        collision_meshes_obstacles = ghcomp.Transform(collision_meshes_obstacles, xform_to_rhino(T))
    
    if show_bcm:
        if scene.bcm:
            collision_mesh_base = MeshArtist(scene.bcm.mesh).draw()
            collision_mesh_base = ghcomp.Transform(collision_mesh_base, xform_to_rhino(T))
    
    if show_acm:
        M = []
        for acm in scene.acm:
            ee_frame = robot.get_end_effector_frame(group=group, full_configuration=configuration)
            if robot.attached_tool:
                ee_frame = robot.from_t0cf_to_tcf([ee_frame])[0]
            T_ee = Transformation.from_frame_to_frame(Frame.worldXY(), ee_frame)
            mesh = acm.collision_mesh.mesh.transformed(T_ee)
            M.append(MeshArtist(mesh).draw())
            
        collision_meshes_attached = M
        collision_meshes_attached = ghcomp.Transform(collision_meshes_attached, xform_to_rhino(T))
# ---------- end visualize ----------

# ----
# Stop
stop = Button()
stop_2 = PythonScript(stop=stop)
# ---------- stop_2: Python ----------
from scriptcontext import sticky as st
from ur_fabrication_control.direct_control.common import send_stop

ur_ip = st["ur_ip"]
ur_port = st["ur_port"]

if stop:
    send_stop(ur_ip, ur_port)
# ---------- end stop_2 ----------

# ----
# Area Gripper Switch
suction = BooleanToggle(False)
blow_off = BooleanToggle(False)
digital_out = PythonScript(suction=suction, blow_off=blow_off)  # -> urscript
# ---------- digital_out: Python ----------
from ur_fabrication_control.direct_control import URScript
from ur_fabrication_control.direct_control.mixins import AreaGripMixins

class URScript_AreaGrip(URScript, AreaGripMixins):
    pass

urscript = URScript_AreaGrip()
urscript.start()

if suction == True and blow_off == False:
    urscript.areagrip_on()
elif blow_off == True:
    urscript.areagrip_blowoff()
elif suction == False and blow_off == False:
    urscript.areagrip_off()

urscript.end()
urscript = urscript.generate()
print(urscript)
# ---------- end digital_out ----------
send = Button()
send_2 = GhPythonScript(urscript=digital_out, send=send)  # -> out; inputs send: Boolean
# ---------- send_2: Python ----------
from scriptcontext import sticky as st
from ur_fabrication_control.direct_control import send_script

ur_ip = st["ur_ip"]
ur_port = st["ur_port"]

if send:
    send_script(urscript, ur_ip, ur_port)
# ---------- end send_2 ----------

# ----
# Get Pose Joint
get = Button()
pose = PythonScript(get=get)  # -> out, configuration, pose_joints
# ---------- pose: Python ----------
from scriptcontext import sticky as st
from ur_fabrication_control.direct_control.common import get_current_pose_joints
from compas_fab.robots import Configuration


robot = st["robot"]

server_ip= st["server_ip"]
server_port = st["server_port"]
ur_port = st["ur_port"]
ur_ip = st["ur_ip"]
print ur_ip

guid = str(ghenv.Component.InstanceGuid)
pose_joints_key = "pose_joints" + guid

# retrieve the current tool frame in axis angle format
if robot.attached_tool:
    tool_angle_axis = list(robot.attached_tool.frame.point) + list(robot.attached_tool.frame.axis_angle_vector)
else:
    tool0_frame = Frame([0, 0, 0], [1, 0, 0], [0, 1, 0])
    tool_angle_axis = list(tool0_frame.point) + list(tool0_frame.axis_angle_vector)

print(tool_angle_axis)

# send script to the robot to receive the current joint configuration
if get:
    st[pose_joints_key] = get_current_pose_joints(server_ip, server_port, ur_ip, ur_port, tool_angle_axis)

print(st[pose_joints_key])
configuration = Configuration.from_revolute_values(st[pose_joints_key])
pose_joints = configuration.joint_values
"""
if pose_joints_key not in st:
    configuration = Configuration.from_revolute_values([0,0,0,0,0,0])
else:
    configuration = Configuration.from_revolute_values(st[pose_joints_key])

pose_joints = configuration.values
"""
# ---------- end pose ----------
panel_3 = Panel(pose.pose_joints)

# ----
# ROSClient
panel_4 = Panel("127.0.0.1")

ros = ROSConnect(ip=panel_4, port="9090", connect=Toggle(True))  # -> ros_client, is_connected; inputs port: Int32, connect: Boolean
#   port ip: The ip address ROS. Defaults to 127.0.0.1.
#   port port: The port of ROS. Defaults to 9090.
#   port connect: If True, connects to ROS. If False, disconnects from ROS. Defaults to False.
#   port ros_client: The ROS client.
#   port is_connected: True if connection established.
# ---------- ros: Python ----------
"""
Connect or disconnect to ROS.

COMPAS FAB v0.27.0
"""
from ghpythonlib.componentbase import executingcomponent as component
from scriptcontext import sticky as st

from compas_fab.backends import RosClient
from compas_fab.ghpython.components import create_id


class ROSConnect(component):
    def RunScript(self, ip, port, connect):
        ros_client = None

        ip = ip or '127.0.0.1'
        port = port or 9090

        key = create_id(self, 'ros_client')
        ros_client = st.get(key, None)

        if ros_client:
            st[key].close()
        if connect:
            st[key] = RosClient(ip, port)
            st[key].run(5)

        ros_client = st.get(key, None)
        is_connected = ros_client.is_connected if ros_client else False
        return (ros_client, is_connected)
# ---------- end ros ----------

panel_5 = Panel(ros.is_connected)

# ----
# ROBOT
panel_6 = Panel("")
robot = ROSRobot(ros_client=ros.ros_client, prefix=panel_6, load=Toggle(True))  # -> robot; inputs load: Boolean
#   port ros_client: The ROS client.
#   port load: If True, loads the robot from ROS. Defaults to False.
# ---------- robot: Python ----------
"""
Load robot directly from ROS.

COMPAS FAB v0.27.0
"""
from compas_ghpython.artists import RobotModelArtist
from ghpythonlib.componentbase import executingcomponent as component
from scriptcontext import sticky as st

from compas_fab.ghpython.components import create_id


class ROSRobot(component):
    def RunScript(self, ros_client, prefix, load):
        key = create_id(self, 'robot')

        if ros_client and ros_client.is_connected and load:
            # Load URDF from ROS
            st[key] = ros_client.load_robot(
                    load_geometry=True, 
                    urdf_param_name= '{}/robot_description'.format(prefix),
                    srdf_param_name= '{}/robot_description_semantic'.format(prefix),
                    precision='12f')
            st[key].artist = RobotModelArtist(st[key].model)

        robot = st.get(key, None)
        if robot:  # client sometimes need to be restarted, without needing to reload geometry
            robot.client = ros_client
        return robot
# ---------- end robot ----------
scene = PlanningScene(robot=robot)  # -> scene
#   port scene: A planning scene.
# ---------- scene: Python ----------
"""
Create a planning scene.

COMPAS FAB v0.27.0
"""
from ghpythonlib.componentbase import executingcomponent as component
from scriptcontext import sticky as st

from compas_fab.ghpython.components import create_id
from compas_fab.robots import PlanningScene


class PlanningSceneComponent(component):
    def RunScript(self, robot):
        key = create_id(self, 'planning_scene')
        if robot:
            st[key] = PlanningScene(robot)
        return st.get(key, None)
# ---------- end scene ----------

# ----
# Attach mesh to robot
button = Button()
acm = AttachedCollisionMesh(
    scene=scene,
    mesh=mesh,
    identifier="elem",
    link_name="arm_tool0",
    touch_links="arm_tool0",
    add=Toggle(False),
    remove=button)  # -> attached_collision_mesh; inputs mesh: Mesh, touch_links: list, add: Boolean, remove: Boolean
#   port scene: The planning scene.
#   port mesh: A collision mesh.
#   port identifier: The identifier of the collision mesh.
#   port link_name: The robot's link name to attach the mesh to.
#   port touch_links: Names of links that the robot is allowed to touch.
#   port add: If True, adds the collision mesh to the planning scene.
#   port remove: If True, removes the collision mesh from the planning scene.
#   port attached_collision_mesh: A collision mesh that is attached to a robot's link.
# ---------- acm: Python ----------
"""
Add an attached collision mesh to the robot.

COMPAS FAB v0.27.0
"""
from ghpythonlib.componentbase import executingcomponent as component

from compas_rhino.geometry import RhinoMesh
from compas_fab.robots import AttachedCollisionMesh
from compas_fab.robots import CollisionMesh

import compas_fab
print compas_fab.__version__
class AttachedCollisionMeshComponent(component):
    def RunScript(self, scene, mesh, identifier, link_name, touch_links, add, remove):
        attached_collision_mesh = None
        if scene and mesh and identifier and link_name:
            compas_mesh = RhinoMesh.from_geometry(mesh).to_compas()
            collision_mesh = CollisionMesh(compas_mesh, identifier)
            attached_collision_mesh = AttachedCollisionMesh(collision_mesh, link_name, touch_links)
            if add:
                scene.add_attached_collision_mesh(attached_collision_mesh)
            if remove:
                scene.remove_attached_collision_mesh(identifier)
                scene.remove_collision_mesh(identifier)
        return attached_collision_mesh
# ---------- end acm ----------

# ----
# Attach mesh to scene
panel_7 = Panel("test_block")
mesh_2 = Mesh(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)
cm = CollisionMesh(scene=scene, mesh=mesh_2, identifier=panel_7, add=Toggle(True), append=Button(), remove=Button())  # -> ok; inputs mesh: Mesh, add: Boolean, append: Boolean, remove: Boolean
#   port scene: The planning scene.
#   port mesh: A collision mesh.
#   port identifier: The identifier of the collision mesh.
#   port add: If True, adds the collision mesh to the planning scene.
#   port append: If True, appends the collision mesh to the planning scene.
#   port remove: If True, removes the collision mesh from the planning scene.
#   port ok: True if the operation was successfully performed.
# ---------- cm: Python ----------
"""
Add or remove a collision mesh from the planning scene.

COMPAS FAB v0.27.0
"""
from compas_rhino.geometry import RhinoMesh
from ghpythonlib.componentbase import executingcomponent as component

from compas_fab.robots import CollisionMesh


class CollisionMeshComponent(component):
    def RunScript(self, scene, M, name, add, append, remove):
        ok = False
        self.Message = ""

        if (add and append) or (append and remove) or (add and remove):
            self.Message = "Use only one operation at a time\n(add, append or remove)"
            raise Exception(self.Message)

        if scene and M and name:
            mesh = RhinoMesh.from_geometry(M).to_compas()
            collision_mesh = CollisionMesh(mesh, name)
            if add:
                scene.add_collision_mesh(collision_mesh)
                self.Message = "Added"
                ok = True
            if append:
                scene.append_collision_mesh(collision_mesh)
                self.Message = "Appended"
                ok = True
            if remove:
                scene.remove_collision_mesh(name)
                self.Message = "Removed"
                ok = True
        return ok
# ---------- end cm ----------
panel_8 = Panel(cm)

# ----
# Base
set_base_frame = PythonScript(robot=robot, base_plane=worldxy)  # -> bang
# ---------- set_base_frame: Python ----------
from compas_ghpython import draw_frame
from compas.geometry import Frame, Point, Vector, Transformation
from compas.datastructures import Mesh
from compas_rhino.geometry import RhinoMesh
from compas_fab.robots import CollisionMesh

if base_plane:
    base_frame = Frame(base_plane.Origin, base_plane.XAxis, base_plane.YAxis)
else:
    base_frame = Frame.worldXY()

if robot:
    # base_frame is BCF in WCF
    robot.BCF = base_frame
    
    print(robot.BCF)
# ---------- end set_base_frame ----------

info = PythonScript(robot=robot)  # -> out, main_group_name
# ---------- info: Python ----------
if robot:
    robot.info()
    main_group_name = robot.main_group_name
# ---------- end info ----------
panel_9 = Panel(info.out)

# ----
# Attach tool
mesh_3 = Mesh(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)
pln = Plane(PlaneXY(0, 0, 0.06551852077))
tool = AttachedTool(
    robot=robot,
    visual_mesh=mesh_3,
    collision_mesh=mesh_3,
    tcf_plane=pln,
    group=info.main_group_name,
    attached=Toggle(True),
    detach=Button())  # -> robot; inputs visual_mesh: Mesh, collision_mesh: Mesh
#   port visual_mesh: A visual mesh for the tool.
#   port collision_mesh: A collision mesh for the tool.
#   port tcf_plane: The frame of the tool in tool0 frame.
#   port group: The planning group to which the tool should be attached.
# ---------- tool: Python ----------
"""
Attach a tool to the robot.

COMPAS FAB v0.27.0
"""
from ghpythonlib.componentbase import executingcomponent as component
from compas_rhino.conversions import RhinoMesh
from compas_rhino.conversions import plane_to_compas_frame

from compas.geometry import Frame
from compas_fab.robots import Tool


class AttachToolComponent(component):
    def RunScript(self, robot, visual_mesh, collision_mesh, tcf_plane, group, attached, detach):
        if robot and robot.client and robot.client.is_connected and visual_mesh:
            if not collision_mesh:
                collision_mesh = visual_mesh

            c_visual_mesh = RhinoMesh.from_geometry(visual_mesh).to_compas()
            c_collision_mesh = RhinoMesh.from_geometry(collision_mesh).to_compas()

            if not tcf_plane:
                frame = Frame.worldXY()
            else:
                frame = plane_to_compas_frame(tcf_plane)
            tool = Tool(c_visual_mesh, frame, c_collision_mesh)
            
            if attached:
                robot.attach_tool(tool, group)
            if detach:
                robot.detach_tool(group)

        return robot
# ---------- end tool ----------

# ----
# Zero Configuration
zero_config = ZeroConfig(robot=robot, group=info.main_group_name)  # -> config
#   port group: If assigned, it will return the zero configuration for the given group, otherwise a full zero configuration.
#   port config: The zero configuration.
# ---------- zero_config: Python ----------
"""
Get a zero configuration for a robot.

COMPAS FAB v0.27.0
"""
from ghpythonlib.componentbase import executingcomponent as component


class ConfigZero(component):
    def RunScript(self, robot, group):

        if robot:
            return robot.zero_configuration(group)

        return None
# ---------- end zero_config ----------

# ----
# Plan Cartesian Motion
# Select
# Config
plan_cartesian_motion = PlanCartesianMotion(
    robot=robot,
    planes=planes,
    start_configuration=zero_config,
    group=info.main_group_name,
    attached_collision_meshes=acm,
    compute=toggle)  # -> trajectory; inputs planes: list, attached_collision_meshes: list, path_constraints: list, compute: Boolean
#   port planes: The planes or frames through which the path is defined.
#   port start_configuration: The robot's full configuration, i.e. values for all configurable joints of the entire robot, at the starting position. Defaults to the all-zero configuration.
#   port group: The planning group used for calculation. Defaults to the robot's main planning group.
#   port attached_collision_meshes: A list of attached collision meshes to be included for planning.
#   port path_constraints: Optional constraints that can be imposed along the solution path. Note that path calculation won't work if the start_configuration violates these constraints. Defaults to None.
#   port max_step: The approximate distance between the calculated points. (Defined in the robot's units.) Defaults to 0.01.
#   port compute: If True, calculates a trajectory.
#   port trajectory: The calculated trajectory.
# ---------- plan_cartesian_motion: Python ----------
"""
Calculate a cartesian motion path (linear in tool space).

COMPAS FAB v0.27.0
"""
from compas_rhino.conversions import RhinoPlane
from ghpythonlib.componentbase import executingcomponent as component
from scriptcontext import sticky as st

from compas_fab.ghpython.components import create_id


class PlanCartesianMotion(component):
    def RunScript(self, robot, planes, start_configuration, group, attached_collision_meshes, path_constraints, max_step, compute):

        key = create_id(self, 'trajectory')

        max_step = float(max_step) if max_step else 0.01
        path_constraints = list(path_constraints) if path_constraints else None
        attached_collision_meshes = list(attached_collision_meshes) if attached_collision_meshes else None
        start_configuration = robot.zero_configuration()
        start_configuration.joint_values = (-0.042, 0.033, -2.174, 5.282, -1.528, 0.000)
        
        if robot and robot.client and robot.client.is_connected and start_configuration and planes and compute:
            frames = [RhinoPlane.from_geometry(plane).to_compas_frame() for plane in planes]
            st[key] = robot.plan_cartesian_motion(frames,
                                                  start_configuration=start_configuration,
                                                  group=group,
                                                  options=dict(
                                                      max_step=max_step,
                                                      path_constraints=path_constraints,
                                                      attached_collision_meshes=attached_collision_meshes
                                                  ))

        trajectory = st.get(key, None)
        return trajectory
# ---------- end plan_cartesian_motion ----------
trajectory_visualize = TrajectoryVisualize(robot=robot, group=info.main_group_name, trajectory=plan_cartesian_motion)  # -> start_configuration, configurations, fraction, time, planes, P, V, A
#   port group: The planning group for which this trajectory was planned.
#   port trajectory: The calculated trajectory.
#   port start_configuration: The start configuration of the trajectory.
#   port configurations: The full configurations along the trajectory.
#   port fraction: Indicates the fraction of requested trajectory that was calculated, e.g. 1 means the full trajectory was found.
#   port time: The time which is needed to execute that trajectory at full speed.
#   port planes: The planes of the robot's end-effector.
#   port P: The positions along the trajectory
#   port V: The velocities along the trajectory
#   port A: The accelerations along the trajectory
# ---------- trajectory_visualize: Python ----------
"""
Visualizes a trajectory.

COMPAS FAB v0.27.0
"""
from compas_ghpython import draw_frame
from compas_ghpython import list_to_ghtree
from ghpythonlib.componentbase import executingcomponent as component


class TrajectoryVisualize(component):
    def RunScript(self, robot, group, trajectory):
        start_configuration = None
        configurations = []
        fraction = 0.
        time = 0.

        planes = []
        positions = []
        velocities = []
        accelerations = []

        if robot and trajectory:
            group = group or robot.main_group_name

            for c in trajectory.points:
                configurations.append(robot.merge_group_with_full_configuration(c, trajectory.start_configuration, group))
                frame = robot.forward_kinematics(c, group, options=dict(solver='model'))
                planes.append(draw_frame(frame))
                positions.append(c.positions)
                velocities.append(c.velocities)
                accelerations.append(c.accelerations)

            start_configuration = trajectory.start_configuration
            fraction = trajectory.fraction
            time = trajectory.time_from_start

        P = list_to_ghtree(list(zip(*positions)))
        V = list_to_ghtree(list(zip(*velocities)))
        A = list_to_ghtree(list(zip(*accelerations)))

        # return outputs if you have them; here I try it for you:
        return (start_configuration, configurations, fraction, time, planes, P, V, A)
# ---------- end trajectory_visualize ----------

# ----
# Inverse Kinematics
ik = InverseKinematics(robot=robot, plane=filter, start_configuration=zero_config, group=info.main_group_name)  # -> configuration
#   port plane: The plane or frame to calculate the inverse kinematic for.
#   port start_configuration: If passed, calculates the inverse such that the joint positions differ the least from the start_configuration. Defaults to the zero configuration.
#   port group: The planning group used for calculation. Defaults to the robot's main planning group.
#   port configuration: The planning group's configuration.
# ---------- ik: Python ----------
"""
Calculate the robot's inverse kinematic for a given plane.

COMPAS FAB v0.27.0
"""
from compas_rhino.conversions import RhinoPlane
from ghpythonlib.componentbase import executingcomponent as component

class InverseKinematics(component):
    def RunScript(self, robot, plane, start_configuration, group):
        configuration = None
        if robot and robot.client and robot.client.is_connected and plane:
            frame = RhinoPlane.from_geometry(plane).to_compas_frame()
            configuration = robot.inverse_kinematics(frame, start_configuration, group)
        return configuration
# ---------- end ik ----------

# ----
# Plan Motion
# Select
# Config
number_slider = Slider(1, range=1..360)
constraints_from_plane = ConstraintsFromPlane(
    robot=tool,
    plane=plane2,
    group=info.main_group_name,
    tolerance_position=Slider(0.001, range=0..0.001),
    tolerance_xaxis=Slider(1, range=1..360),
    tolerance_yaxis=number_slider,
    tolerance_zaxis=Slider(1, range=1..360))  # -> constraints
#   port plane: The plane or frame from which we create position and orientation constraints.
#   port group: The planning group for which we specify the constraint. Defaults to the robot's main planning group.
#   port tolerance_position: The allowed tolerance to the frame's position (defined in the robot's units). Defaults to 0.001
#   port tolerance_xaxis: The allowed tolerance of the frame's X-axis in degrees.
#   port tolerance_yaxis: The allowed tolerance of the frame's Y-axis in degrees.
#   port tolerance_zaxis: The allowed tolerance of the frame's Z-axis in degrees.
#   port constraints: A list containing a position and an orientation constraint.
# ---------- constraints_from_plane: Python ----------
"""
Create a position and an orientation constraint from a plane calculated for the group's end-effector link.

COMPAS FAB v0.27.0
"""
import math

from compas_rhino.conversions import RhinoPlane
from ghpythonlib.componentbase import executingcomponent as component


class ConstraintsFromPlane(component):
    def RunScript(self, robot, plane, group, tolerance_position, tolerance_xaxis, tolerance_yaxis, tolerance_zaxis):
        goal_constraints = None
        if robot and plane:
            tolerance_position = tolerance_position or 0.001
            tolerance_xaxis = tolerance_xaxis or 1.
            tolerance_yaxis = tolerance_yaxis or 1.
            tolerance_zaxis = tolerance_zaxis or 1.

            frame = RhinoPlane.from_geometry(plane).to_compas_frame()
            tolerances_axes = [math.radians(tolerance_xaxis), math.radians(tolerance_yaxis), math.radians(tolerance_zaxis)]
            goal_constraints = robot.constraints_from_frame(frame, tolerance_position, tolerances_axes, group)

        return goal_constraints
# ---------- end constraints_from_plane ----------
plan_motion = PlanMotion(
    robot=tool,
    goal_constraints=constraints_from_plane,
    start_configuration=ik,
    group=info.main_group_name,
    attached_collision_meshes=acm,
    compute=Toggle(True))  # -> trajectory; inputs goal_constraints: list, attached_collision_meshes: list, path_constraints: list, compute: Boolean
#   port goal_constraints: The goal to be achieved, defined in a set of constraints. Constraints can be very specific, for example defining value domains for each joint, such that the goal configuration is included, or defining a volume in space, to which a specific robot link (e.g. the end-effector) is required to move to.
#   port start_configuration: The robot's full configuration, i.e. values for all configurable joints of the entire robot, at the starting position. Defaults to the all-zero configuration.
#   port group: The planning group used for calculation. Defaults to the robot's main planning group.
#   port attached_collision_meshes: A list of attached collision meshes to be included for planning.
#   port path_constraints: Optional constraints that can be imposed along the solution path. Note that path calculation won't work if the start_configuration violates these constraints. Defaults to None.
#   port planner_id: The name of the algorithm used for path planning. Defaults to 'RRTConnect'
#   port compute: If True, calculates a trajectory.
#   port trajectory: The calculated trajectory.
# ---------- plan_motion: Python ----------
"""
Calculate a motion path.

COMPAS FAB v0.27.0
"""
from ghpythonlib.componentbase import executingcomponent as component
from scriptcontext import sticky as st

from compas_fab.ghpython.components import create_id

class PlanMotion(component):
    def RunScript(self, robot, goal_constraints, start_configuration, group, attached_collision_meshes, path_constraints, planner_id, compute):

        key = create_id(self, 'trajectory')

        path_constraints = list(path_constraints) if path_constraints else None
        attached_collision_meshes = list(attached_collision_meshes) if attached_collision_meshes else None
        planner_id = str(planner_id) if planner_id else 'RRTConnect'

        if robot and robot.client and robot.client.is_connected and start_configuration and goal_constraints and compute:
            st[key] = robot.plan_motion(goal_constraints,
                                        start_configuration=start_configuration,
                                        group=group,
                                        options=dict(
                                            attached_collision_meshes=attached_collision_meshes,
                                            path_constraints=path_constraints,
                                            planner_id=planner_id,
                                        ))

        trajectory = st.get(key, None)
        return trajectory
# ---------- end plan_motion ----------
trajectory_visualize_2 = TrajectoryVisualize(robot=robot, group=info.main_group_name, trajectory=plan_motion)  # -> start_configuration, configurations, fraction, time, planes, P, V, A; same code as trajectory_visualize
list_2 = ValueList({"positions", "velocities", "accelerations"}, selected="positions")
vis = PythonScript(response=plan_motion, graph_type=list_2)  # -> G
# ---------- vis: Python ----------
from compas_ghpython import list_to_ghtree

if response:
    #print response.points
    positions = []
    velocities = []
    accelerations = []

    for p in response.points:
        positions.append(p.positions)
        velocities.append(p.velocities)
        accelerations.append(p.accelerations)
    #print positions
    P = list_to_ghtree(list(zip(*positions)))
    V = list_to_ghtree(list(zip(*velocities)))
    A = list_to_ghtree(list(zip(*accelerations)))

select_graph = {
    "positions": P,
    "velocities": V,
    "accelerations" : A}

G = select_graph.get(graph_type)
# ---------- end vis ----------
graph = QuickGraph(vis, SortOrder=0)

configuration = Slider(10, range=0..100)
item = ListItem(List=trajectory_visualize.configurations, Index=configuration, Wrap=True)

configuration_2 = Slider(39, range=0..100)
item_2 = ListItem(List=trajectory_visualize_2.configurations, Index=configuration_2, Wrap=True)

# ----
# Select Input
list_3 = ValueList({"Zero Configuration": 0, "Inverse Kinematics": 1, "Plan Cartesian Motion": 2, "Plan Motion": 3}, selected="Inverse Kinematics")
filter_2 = StreamFilter(Gate=list_3, Stream0=zero_config, Stream1=ik, Stream2=item, Stream3=item_2)

# ----
# Visualization
toggle_2 = BooleanToggle(True)
toggle_3 = BooleanToggle(True)
robot_visualize = RobotVisualize(
    robot=tool,
    group=info.main_group_name,
    configuration=filter_2,
    show_visual=toggle_2,
    show_collision=Toggle(False),
    show_base_frame=Toggle(False),
    show_end_effector_frame=Toggle(True),
    show_cm=toggle_3,
    show_acm=toggle_3)  # -> visual, collision, collision_meshes, attached_meshes, frames, base_frame, ee_frame; inputs show_visual: Boolean, show_collision: Boolean, show_frames: Boolean, show_base_frame: Boolean, show_end_effector_frame: Boolean, show_cm: Boolean, show_acm: Boolean
#   port group: The planning group used for end-effector and base visualization.
#   port configuration: The robot's full configuration.
#   port show_visual: Whether or not to show the robot's visual meshes.
#   port show_collision: Whether or not to show the robot's collision meshes.
#   port show_frames: Whether or not to show the robot's joint frames.
#   port show_base_frame: Whether or not to show the robot's base frame.
#   port show_end_effector_frame: Whether or not to show the robot's end-effector frame.
#   port show_cm: Whether or not to show the collision meshes (if any).
#   port show_acm: Whether or not to show the attached collision meshes (if any).
#   port visual: Rhino meshes of the robot's visual geometry (if any).
#   port collision: Rhino meshes of the robot's collision geometry (if any).
#   port collision_meshes: Rhino meshes of the scene's collision meshes (if any).
#   port attached_meshes: Rhino meshes of the scene's attached collision meshes (if any).
#   port frames: The robot's joint frames as Rhino planes (if any).
#   port base_frame: The robot's base frame as a Rhino plane (if any).
#   port ee_frame: The robot's end-effector frame as a Rhino plane (if any).
# ---------- robot_visualize: Python ----------
"""
Visualizes the robot.

COMPAS FAB v0.27.0
"""
from compas.artists import Artist
from compas.geometry import Frame
from compas.geometry import Transformation
from compas_fab.robots import PlanningScene
from ghpythonlib.componentbase import executingcomponent as component
import Rhino.Geometry as rg
import ghpythonlib.components as ghcomp


class RobotVisualize(component):
    def RunScript(
        self,
        robot,
        group,
        configuration,
        show_visual,
        show_collision,
        show_frames,
        show_base_frame,
        show_end_effector_frame,
        show_cm,
        show_acm,
    ):

        visual = None
        collision = None
        collision_meshes = None
        attached_meshes = None
        frames = None
        base_frame = None
        ee_frame = None

        if robot:
            
#            if in_world:
#                T = robot.transformation_OCF_WCF()
#            else:
#                T = Transformation()
        
            show_visual = True if show_visual is None else show_visual
            show_cm = True if show_cm is None else show_cm
            show_acm = True if show_acm is None else show_acm
            configuration = configuration or robot.zero_configuration()

            robot.update(configuration, visual=show_visual, collision=show_collision)
            compas_frames = robot.transformed_frames(configuration, group)

            if show_visual:
                visual = robot.artist.draw_visual()
                robot_BCF = Artist(robot.BCF).draw()
                init_robot_plane = rg.Plane.WorldXY
                #robot_RCF = Artist(robot.RCF_in_WCF).draw()
                #init_robot_plane = rg.Plane(rg.Point3d(0.275, 0.0, 1.105), rg.Vector3d(-0.707, 0.707, 0.0), rg.Vector3d(-0.707, -0.707,0.0))
                visual = ghcomp.Orient(visual, init_robot_plane, robot_BCF)[0]
                
            if show_collision:
                collision = robot.artist.draw_collision()

            if show_base_frame:
                base_compas_frame = compas_frames[0]
                artist = Artist(base_compas_frame)
                base_frame = artist.draw()

            if show_end_effector_frame:
                ee_compas_frame = robot.forward_kinematics(
                    configuration, group, options=dict(solver="model")
                )
                artist = Artist(ee_compas_frame)
                ee_frame = artist.draw()

            if show_frames:
                frames = []
                for compas_frame in compas_frames[1:]:
                    artist = Artist(compas_frame)
                    frame = artist.draw()
                    frames.append(frame)

            if show_cm or show_acm:
                scene = PlanningScene(robot)
                scene = robot.client.get_planning_scene()

                collision_meshes = []
                attached_meshes = []

                if show_cm:
                    for co in scene.world.collision_objects:
                        header = co.header
                        frame_id = header.frame_id
                        cms = co.to_collision_meshes()

                        for cm in cms:
                            if cm.frame != Frame.worldXY():
                                t = Transformation.from_frame(cm.frame)
                                mesh = cm.mesh.transformed(t)
                            else:
                                mesh = cm.mesh

                            collision_meshes.append(Artist(mesh).draw())

                if show_acm:
                    for aco in scene.robot_state.attached_collision_objects:
                        for acm in aco.to_attached_collision_meshes():
                            frame_id = aco.object["header"]["frame_id"]
                            frame = robot.forward_kinematics(
                                configuration, options=dict(link=frame_id)
                            )
                            t = Transformation.from_frame(frame)

                            # Local CM frame
                            if (
                                acm.collision_mesh.frame
                                and acm.collision_mesh.frame != Frame.worldXY()
                            ):
                                t = t * Transformation.from_frame(
                                    acm.collision_mesh.frame
                                )

                            mesh = acm.collision_mesh.mesh.transformed(t)

                            attached_meshes.append(Artist(mesh).draw())

        return (
            visual,
            collision,
            collision_meshes,
            attached_meshes,
            frames,
            base_frame,
            ee_frame,
        )
# ---------- end robot_visualize ----------

# ----
# Pick and place with force mode
radius = Slider(0.01, range=0..0.1)
list_4 = ValueList({"go to pick_up_plane_save": 0, "go to pick_up_plane": 1, "go to place_plane": 2, "go to place_plane_save": 3}, selected="go to place_plane")
send_3 = Button()
list_5 = ValueList({"marker_0 frame": "marker_0", "marker_2 frame": "marker_2", "marker_3 frame": "marker_3", "marker_4 frame": "marker_4"}, selected="marker_0 frame")
generate_ur_script = PythonScript(robot=robot, target_frame=list_5, routine=list_4, velocity=Slider(0.016, range=0..0.2), radius=radius)  # -> out, frame_RCF, urscript; inputs plane_WCF: Plane
# ---------- generate_ur_script: Python ----------
from ur_fabrication_control.direct_control import URScript
from ur_fabrication_control.direct_control.mixins import AreaGripMixins
import math
from scriptcontext import sticky as st
import Rhino.Geometry as rg
from compas.artists import Artist
from compas.geometry import Frame, Transformation, Translation, Vector, Rotation, Point
from compas_fab.robots import Configuration

class URScript_RSRD(URScript, AreaGripMixins):
    pass

tool_angle_axis = list(robot.attached_tool.frame.point) + list(robot.attached_tool.frame.axis_angle_vector)

# for the pick up
if routine == 0 or routine == 1:
    target_frame = 'marker_1'

# go to pose 1
if routine == 0 or routine == 2:
    pose_1_frame = Frame(st['marker_poses'][target_frame][-1].point, st['marker_poses'][target_frame][-1].zaxis, st['marker_poses'][target_frame][-1].yaxis).transformed(Translation.from_vector(Vector.Zaxis()*0.3)) #rotate them too
    pose_1_frame.transform(Translation.from_vector(-pose_1_frame.yaxis*0.1))
    pose_1_frame.transform(Rotation.from_axis_and_angle(pose_1_frame.xaxis, math.radians(-20), pose_1_frame.point))
    pose_1_frame.transform(Rotation.from_axis_and_angle(pose_1_frame.yaxis, math.radians(-20), pose_1_frame.point))
    print pose_1_frame
    commands = URScript_RSRD()
    commands.start()
    commands.set_tcp(tool_angle_axis)
    commands.move_linear(pose_1_frame, velocity, radius)
    commands.end() 

# go to pose 2
if routine == 1 or routine == 3:
    pose_2_frame = Frame(st['marker_poses'][target_frame][-1].point, st['marker_poses'][target_frame][-1].zaxis, st['marker_poses'][target_frame][-1].yaxis).transformed(Translation.from_vector(Vector.Zaxis()*0.1))
    pose_2_frame.transform(Translation.from_vector(-pose_2_frame.xaxis*0.1)*Translation.from_vector(pose_2_frame.yaxis*0.1))
    pose_2_frame.transform(Rotation.from_axis_and_angle(pose_2_frame.xaxis, math.radians(20), pose_2_frame.point))
    pose_2_frame.transform(Rotation.from_axis_and_angle(pose_2_frame.yaxis, math.radians(20), pose_2_frame.point))
    print pose_2_frame
    commands = URScript_RSRD()
    commands.start()
    commands.set_tcp(tool_angle_axis)
    commands.move_linear(pose_2_frame, velocity, radius)
    commands.end()

# pick up from marker frame
if routine == 4:
    # To set plane:
    #frame_WCF = Frame(plane_WCF.Origin, plane_WCF.XAxis, plane_WCF.YAxis)
    #frame_BCF = frame_WCF.transformed(robot.transformation_WCF_BCF())
    #frame_RCF = frame_BCF.transformed(robot.transformation_BCF_RCF())
    
    # To marker frame:
    brick_frame = Frame(st['marker_poses'][target_frame][-1].point, st['marker_poses'][target_frame][-1].yaxis, -st['marker_poses'][target_frame][-1].zaxis)
    brick_frame_safe = brick_frame.transformed(Translation.from_vector(Vector.Zaxis()*0.1))
    brick_frame_RCF = brick_frame_safe.transformed(Translation.from_vector(brick_frame_safe.xaxis*0.087))
    
    place_frame = Frame(st['marker_poses']['marker_1'][-1].point, st['marker_poses']['marker_1'][-1].yaxis, -st['marker_poses']['marker_1'][-1].zaxis)
    place_frame_RCF = place_frame.transformed(Translation.from_vector(Vector.Zaxis()*0.15))
    
    commands = URScript_RSRD()
    commands.start()
    commands.set_tcp(tool_angle_axis)
    commands.set_payload(1.140)
    
    commands.move_linear(brick_frame_RCF, velocity, radius)
    commands.add_line("\tsleep({})".format(2.0))
    commands.get_force()
    
    commands.force_mode_in_z(10.0, 0.025)
    commands.stop_by_force(10.0)
    commands.end_force_mode()
    
    commands.areagrip_on()
    commands.add_line("\tsleep({})".format(2.0))
    
    commands.set_payload(3.510)
    commands.move_linear(brick_frame_RCF, velocity, radius)
    
    commands.move_linear(place_frame_RCF, velocity, radius)
    commands.add_line("\tsleep({})".format(2.0))
    commands.get_force()
    
    commands.force_mode_in_z(10.0, 0.025)
    commands.stop_by_force(10.0)
    commands.end_force_mode()
    
    commands.areagrip_off()
    commands.add_line("\tsleep({})".format(2.0))
    commands.set_payload(1.140)
    
    commands.move_linear(place_frame_RCF, velocity, radius)
    
    commands.end() 

urscript = commands.generate()

print(urscript)
# ---------- end generate_ur_script ----------
draw = Draw(cg=generate_ur_script.frame_RCF)  # -> rg
#   port cg: The COMPAS geometry or datastructure to be drawn.
#   port rg: The Rhino geometry object.
# ---------- draw: Python ----------
"""
Draws COMPAS geometry in Grasshopper.
"""
from ghpythonlib.componentbase import executingcomponent as component

from compas.artists import Artist


class CompasToRhinoGeometry(component):
    def RunScript(self, cg):
        if not cg:
            return None

        return Artist(cg).draw()
# ---------- end draw ----------
send_4 = GhPythonScript(urscript=generate_ur_script.urscript, send=send_3)  # -> out; inputs send: Boolean
# ---------- send_4: Python ----------
from scriptcontext import sticky as st
from ur_fabrication_control.direct_control import send_script

ur_ip = st["ur_ip"]
ur_port = st["ur_port"]

print urscript
if send:
    send_script(urscript, ur_ip, ur_port)
# ---------- end send_4 ----------

# ----
# Move Joints
idx = Slider(0, range=0..100)
list_6 = ValueList({"send all positions": 0, "send only one position": 1, "send snapshot position": 2}, selected="send only one position")
send_5 = Button()

# ----
# Direct UR Control
config = GhPythonScript()  # -> out, joint_configs
# ---------- config: Python ----------
from compas_fab.robots import Configuration

#values=[-0.785, -1.571, 1.571, -1.571, -1.571, -1.571]
#((-0.785, -1.571, 1.571, -1.571, -1.571, -1.571), (0, 0, 0, 0, 0, 0))
joint_configs = [config]
# ---------- end config ----------

item_3 = ListItem(List=config.joint_configs, Index=idx, Wrap=True)
filter_3 = StreamFilter(Gate=list_6, Stream0=config.joint_configs, Stream1=item_3)
movej = PythonScript(joint_configurations=filter_3, velocity=Slider(0.04, range=0..0.5))  # -> urscript, values; inputs joint_configurations: list
# ---------- movej: Python ----------
from ur_fabrication_control.direct_control import URScript
import math

urscript = URScript()
urscript.start()
for jc in joint_configurations:
    urscript.move_joint(jc, velocity)
urscript.end()

urscript = urscript.generate()

print(urscript)
# ---------- end movej ----------
send_6 = GhPythonScript(urscript=movej.urscript, send=send_5)  # -> out; inputs send: Boolean
# ---------- send_6: Python ----------
from scriptcontext import sticky as st
from ur_fabrication_control.direct_control import send_script

ur_ip = st["ur_ip"]
ur_port = st["ur_port"]

print urscript

if send:
    send_script(urscript, ur_ip, ur_port)
# ---------- end send_6 ----------

# ----
# Get Pose Cartesian
get_2 = Button()
pose_2 = PythonScript(get=get_2)  # -> out, pose_cartesian_meter
# ---------- pose_2: Python ----------
from scriptcontext import sticky as st
#from ur_fabrication_control.online_control.ur_direct import get_current_pose_cartesian

from ur_fabrication_control.direct_control.common import get_current_pose_cartesian
from compas.geometry import Frame
from compas_ghpython import draw_frame


server_ip = st["server_ip"]
server_port = st["server_port"]
ur_port = st["ur_port"]
ur_ip = st["ur_ip"]
pose_cartesian_meter = []
print ur_ip

# retrieve the current tool frame in axis angle format
if robot.attached_tool:
    print ("attached")
    tool_angle_axis = list(robot.attached_tool.frame.point) + list(robot.attached_tool.frame.axis_angle_vector)
    
else:
    tool0_frame = Frame([0, 0, 0], [1, 0, 0], [0, 1, 0])
    tool_angle_axis = list(tool0_frame.point) + list(tool0_frame.axis_angle_vector)

print(tool_angle_axis)

guid = str(ghenv.Component.InstanceGuid)
pose_cartesian_key = "pose_cartesian" + guid


if get:
    print ("getting pose")
    st[pose_cartesian_key] = get_current_pose_cartesian(tool_angle_axis, server_ip, server_port, ur_ip, ur_port, send=True)
#    st[pose_cartesian_key] = get_current_pose_cartesian(server_ip, server_port, ur_ip, tool_angle_axis)
    

if pose_cartesian_key not in st:
    pose_cartesian_mm = []
    pose_cartesian_meter = []
else:
    pose_cartesian = st[pose_cartesian_key]

for i in pose_cartesian:
    new_c = i / 1000
    pose_cartesian_meter.append(new_c)

print (pose_cartesian_meter)
# ---------- end pose_2 ----------

rec = DataRecorder(pose_2.out, DataLimit=-10, RecordData=True)

panel_10 = Panel(rec)
