# Grasshopper definition ex4_ur10e_demo_v22.ghx (Grasshopper 1.0.7)

# ----
# ROS client
disconnect = Button()
# Setting up of all starting elements such as ROSmaster,ROStopics, Robot URDF
list = ValueList({"local computer": 0, "linux computer": 1}, selected="local computer")
connect = Button()
connect_2 = PythonScript(ip=list, connect=connect, disconnect=disconnect)  # -> out, ros_client
# ---------- connect_2: Python ----------
import sys
import scriptcontext as sc
from compas_fab.backends import RosClient

key = 'rosclient_%s' % str(ghenv.Component.InstanceGuid)
previous_client = sc.sticky.get(key, None)

if previous_client and (connect or disconnect):
    previous_client.close()

if connect:
    if ip == 0: #local, own laptop
        ros_client = RosClient('127.0.0.1', 9090)
    elif ip == 1: # linux computer
        ros_client = RosClient('172.20.10.5', 9090)
    sc.sticky[key] = ros_client
    ros_client.run(5)

ros_client = sc.sticky.get(key, None)
print('ROS connected: {}'.format(ros_client.is_connected if ros_client else 'False'))
# ---------- end connect_2 ----------
is_connected = Panel(connect_2.out)
ros_client = Data(connect_2.ros_client)

# ----
# Robot
# Load robot from local package
py = PythonScript()  # -> DATA
# ---------- py: Python ----------
import os
import getpass
import scriptcontext as sc

HERE = os.path.dirname(ghdoc.Path)
DATA = os.path.abspath(os.path.join(HERE, "..", "data\models"))
print(DATA)
# ---------- end py ----------
list_2 = ValueList({"ur_description", "ur_e_description", "ur_setups"}, selected="ur_e_description")
list_3 = ValueList({"ur3.urdf", "ur3_rot.urdf", "ur5.urdf", "ur10.urdf", "ur3e.urdf", "ur5e.urdf", "ur10e.urdf", "ur10e_rot.urdf"}, selected="ur10e_rot.urdf")
list_4 = ValueList({"ur3.srdf", "ur5.srdf", "ur10.srdf", "ur3e.srdf", "ur5e.srdf", "ur10e.srdf"}, selected="ur10e.srdf")
py_2 = PythonScript(data_path=py, package=list_2, urdf_name=list_3, srdf_name=list_4)  # -> loaders, urdf_filename, srdf_filename
# ---------- py_2: Python ----------
import os
from compas.robots import LocalPackageMeshLoader

path = os.path.join(data_path, "robot_description")

#loaders
packages = ["ur_description", "ur_e_description", "ur_end_effectors", "ur_setups"]
loaders = [LocalPackageMeshLoader(path, pck) for pck in packages]

#files
package_path = os.path.join(path, package)
print package_path

urdf_filename = os.path.join(package_path, "urdf", urdf_name)
srdf_filename = os.path.join(package_path, srdf_name)

assert os.path.isfile(urdf_filename)
assert os.path.isfile(srdf_filename)
# ---------- end py_2 ----------

panel = Panel("Unload libraries")
bang = Button()
unload = PythonScript(bang=bang)
# ---------- unload: Python ----------
from compas_rhino.utilities.misc import get_tolerance
from compas_rhino.utilities.misc import unload_modules

unload_modules("cdf_2023")
unload_modules("ur_fabrication_control")
# ---------- end unload ----------

py_3 = PythonScript()  # -> ENVIRONMENT_NAME, HERE, DATA
# ---------- py_3: Python ----------
import os
import compas_bootstrapper

HERE = os.path.dirname(ghdoc.Path)
DATA = os.path.abspath(os.path.join(HERE, "..", "data"))
ENVIRONMENT_NAME = compas_bootstrapper.ENVIRONMENT_NAME
print(HERE)
print(DATA)
print(ENVIRONMENT_NAME)
# ---------- end py_3 ----------

# ----
# Load Assembly
# Import assembly from .json.
import = Button(ExpressionNormal="True", ExpressionPressed="False")
initial_assembly = GhPythonScript(DATA=py_3.DATA, import_from_json=import)  # -> out, assembly; inputs import_from_json: Boolean
# ---------- initial_assembly: Python ----------
import os
import json
from scriptcontext import sticky

from cdf_2023.assembly import Assembly

if import_from_json:
    filename = "study_1e.json"
    PATH = os.path.join(DATA, "assembly", filename)
    assembly = Assembly.from_json(PATH)

# create a dictionary to store global value in 
assembly.globals = {}

# define global values
assembly.globals['rod_radius'] = 0.01
assembly.globals['rod_length'] = 0.8
assembly.globals['rf_unit_offset'] = 0.2
assembly.globals['rf_unit_radius'] = 0.15
# ---------- end initial_assembly ----------

brep = Brep(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)

# ----
# Assembly & Element Definition
# Create an element object.
reset_assembly = Button()
globals = GhPythonScript(reset=reset_assembly)  # -> out, assembly
# ---------- globals: Python ----------
from cdf_2023.assembly import Assembly

# create assembly
assembly = Assembly()

# create a dictionary to store global value in 
assembly.globals = {}

# define global values
assembly.globals['rod_radius'] = 0.011
assembly.globals['rod_length'] = 0.8
assembly.globals['rf_unit_offset'] = 0.22
assembly.globals['rf_unit_radius'] = 0.12


print assembly.globals
# ---------- end globals ----------
assembly_globals = Panel(globals.out)
show = BooleanToggle(False)
show_2 = BooleanToggle(False)
elem_def = GhPythonScript(assembly=globals.assembly, show_connectors=show_2, angle=Slider(6, range=4..12), conn_range=brep)  # -> assembly, elem; inputs conn_range: Brep
# ---------- elem_def: Python ----------
import os
import sys
import json
import math

from compas.geometry import Frame, Plane, Rotation, Vector, Point
from compas.geometry import Circle, Cylinder, Translation, Line, Cone
from compas.artists import Artist

from cdf_2023.assembly import Element

rf_unit_offset = assembly.globals['rf_unit_offset']
rf_unit_radius = assembly.globals['rf_unit_radius']
radius = assembly.globals['rod_radius']
length = assembly.globals['rod_length']

cross_section_plane = Plane.from_frame(Frame.worldYZ())
cross_section = Circle(cross_section_plane, radius)
elem_geo = Cylinder(cross_section, length)

elem = Element.from_shape(elem_geo, Frame.worldXY())

connector_frame_1 = Frame([rf_unit_offset,-rf_unit_radius/2,0], [1,0,0], [0,1,0])
connector_frame_2 = Frame([-rf_unit_offset,rf_unit_radius/2,0], [-1,0,0], [0,-1,0])

R1 = Rotation.from_axis_and_angle(connector_frame_1.yaxis, math.radians(angle), connector_frame_1.point)
R2 = Rotation.from_axis_and_angle(connector_frame_2.yaxis, math.radians(angle), connector_frame_2.point)

connector_frame_1.transform(R1)
connector_frame_2.transform(R2)

elem.connector_frame_1 = connector_frame_1
elem.connector_frame_2 = connector_frame_2

elem.line = Line([-length/2.,0,0],[length/2.,0,0])


circle_frame_1 = Frame([-0.34,0,0],[0,0,-1],[0,1,0])
circle_frame_2 = Frame([0.34,0,0],[0,0,1],[0,1,0])
circle_1 = Circle(Plane.from_frame(circle_frame_1), 0.5)
circle_2 = Circle(Plane.from_frame(circle_frame_2), 0.5)
cone_2 = Cone(circle_1, 0.32)
cone_1 = Cone(circle_2, 0.32)

elem.connector_range_1 = cone_1
elem.connector_range_2 = cone_2

#print elem.connector_range_1
# ---------- end elem_def ----------
draw = PythonScript(elements=elem_def.elem, show=show)  # -> M, F, C; inputs elements: list
# ---------- draw: Python ----------
from compas.artists import Artist

M = []
C = []
F = []
T = []

if show:
    for elem in elements:
        C.append(Artist(elem.connector_frame_1).draw())
        C.append(Artist(elem.connector_frame_2).draw())
        M += [Artist(elem._mesh).draw([0,0,1,1])]
        F += [Artist(elem.frame).draw()]
        T += [Artist(elem.tool_frame).draw()]
# ---------- end draw ----------
pln = Plane(draw.C)
mesh = Mesh(draw.M)
pln_2 = Plane(draw.F)
custom_preview = CustomPreview(Geometry=mesh, Material=ColourSwatch(SwatchColor=RGB(221, 0, 0)))

list_5 = ValueList({"robot_1": 0, "robot_2": 1}, selected="robot_1")

units = ValueList({"m": 1, "cm": 100, "mm": 1000}, selected="m")
load = Button()
create = PythonScript(load=load, loaders=py_2.loaders, urdf_filename=py_2.urdf_filename, srdf_filename=py_2.srdf_filename, scale_factor=units)  # -> out, robot; inputs load: Boolean, loaders: list
# ---------- create: Python ----------
import os
from scriptcontext import sticky as st

import compas

from compas.robots import RobotModel
from compas.robots import LocalPackageMeshLoader

#from compas_fab.robots import Robot
from robot_see_robot_do.robot import Robot
from compas_fab.robots import RobotSemantics

from compas_fab.ghpython import RobotArtist

compas.PRECISION = '12f'

# store robot in component
guid = str(ghenv.Component.InstanceGuid)
robot_key = "robot_" + guid

if robot_key not in st:
    st[robot_key] = None

print loaders
if load:
    model = RobotModel.from_urdf_file(urdf_filename)
    
    model.load_geometry(*loaders)
    artist = RobotArtist(model)
    semantics = RobotSemantics.from_srdf_file(srdf_filename, model)
    robot = Robot(model, artist, semantics, client=None)

    
    st[robot_key] = robot

robot = st[robot_key]


if robot:
    robot.scale(scale_factor)
# ---------- end create ----------
set = PythonScript(robot=create.robot, client=ros_client)  # -> robot
# ---------- set: Python ----------
if robot and client:
    robot.client = client
# ---------- end set ----------
robot = Data(set)

panel_2 = Panel(py_3.ENVIRONMENT_NAME)

# ----
# Info
info = PythonScript(robot=robot)  # -> out, main_group_name
# ---------- info: Python ----------
if robot:
    robot.info()
    main_group_name = robot.main_group_name

print main_group_name
# ---------- end info ----------
panel_3 = Panel(info.out)

# ----
# Generate Assembly
# Initial Assembly Configuration
pt = Point(<point referenced from the Rhino model>)
x = Curve(<curve referenced from the Rhino model>)
y = Curve(<curve referenced from the Rhino model>)
pl = ConstructPlane(Origin=pt, XAxis=x, YAxis=y)
worldxy = Plane(PlaneXY(0, 0, 0))
initial_configuration = GhPythonScript(assembly=elem_def.assembly, planes=pl, elem=elem_def.elem, show_open_connectors=Toggle(False))  # -> out, assembly, connector_planes; inputs planes: list of Plane
# ---------- initial_configuration: Python ----------
import Rhino.Geometry as rg
import math
from scriptcontext import sticky as st

from compas.geometry import Frame, Vector
from compas.geometry import Rotation, Transformation
from compas.artists import Artist


connector_planes = []
support_keys = []

radius = assembly.globals['rod_radius']
length = assembly.globals['rod_length']
rf_unit_offset = assembly.globals['rf_unit_offset']
rf_unit_radius = assembly.globals['rf_unit_radius']


for plane in planes:
    T1 = Transformation.from_frame_to_frame(Frame.worldXY(), Frame(plane.Origin, plane.XAxis, plane.YAxis))
    elem_1 = elem.transformed(T1)
    
    R1 = Rotation.from_axis_and_angle(elem_1.frame.zaxis, math.radians(120), [0,0,0])
    R2 = Rotation.from_axis_and_angle(elem_1.frame.zaxis, math.radians(240), [0,0,0])
    
    # set connector state
    elem_1.connector_1_state = True
    elem_1.connector_2_state = False

    # add element to assembly
    assembly.add_element(elem_1, placed_by='initial', is_support=True, frame_id=None)

# show open connectors
if show_open_connectors:
    for key, connectors in assembly.connectors(state='open'):
        for connector in connectors:
            connector_planes.append(Artist(connector).draw())

for key, element in assembly.elements():
    support_keys.append(key)
    
assembly.support_keys = support_keys
# ---------- end initial_configuration ----------
pln_3 = Plane(initial_configuration.connector_planes)

ur_ip = ValueList({"192.168.0.210", "192.168.10.30": "192.168.0.30"}, selected="192.168.0.210")

# ----
# Check robot availability
ping = Button()
py_4 = PythonScript(ping=ping)  # -> out, trigger
# ---------- py_4: Python ----------
from scriptcontext import sticky as st
from ur_fabrication_control.direct_control import is_available

guid = str(ghenv.Component.InstanceGuid)
txt_key = "txt_" + guid
if txt_key not in st:
    st[txt_key] = ""

ip = st["ur_ip"]
print ip

if ping:
    
    available = is_available(ip)
    
    if available:
        st[txt_key] = "%s is up!" % ip
        trigger = True
    else:
        st[txt_key] = "%s is down!" % ip
        trigger = False

print(st[txt_key])
# ---------- end py_4 ----------
panel_4 = Panel(py_4.out)

# ----
# ROBOT - IP Settings
server_ip = ValueList({"192.168.0.51"}, selected="192.168.0.51")
ur_ip_2 = ValueList({"192.168.0.210", "192.168.10.30"}, selected="192.168.0.210")
server_port = ValueList({"50000", "50002", "50003", "50004", "50005", "30003"}, selected="50004")
ur_port = ValueList({"30002", "30001"}, selected="30002")
# Robotic setup
globals_2 = PythonScript(
    server_address=server_ip,
    server_port=server_port,
    ur_ip_1=ur_ip,
    ur_ip_2=ur_ip_2,
    ur_port=ur_port,
    robot=robot,
    clear=Button(),
    robot_nr=list_5)  # inputs server_port: Int32, robot_nr: Int32
# ---------- globals_2: Python ----------
from scriptcontext import sticky as st

st["server_address"] = server_address
st["server_port"] = server_port


if robot_nr == 0:
    st["ur_ip"] = ur_ip_1
else:
    st["ur_ip"] = ur_ip_2
    
    
st["ur_port"] = ur_port

st["robot"] = robot



if clear:
    st.clear()
# ---------- end globals_2 ----------

# ----
# Transform Assembly
x_2 = Curve(<curve referenced from the Rhino model>)
pt_2 = Point(<point referenced from the Rhino model>)
y_2 = Curve(<curve referenced from the Rhino model>)
pl_2 = ConstructPlane(Origin=pt_2, XAxis=x_2, YAxis=y_2)
transform = GhPythonScript(assembly=initial_configuration.assembly, transform=Toggle(False), trnsf_plane=pl_2)  # -> out, assembly
# ---------- transform: Python ----------
from compas.geometry import Frame
from compas.geometry import Transformation
import Rhino.Geometry as rg
from compas.artists import Artist


if transform:
    T = Transformation.from_frame_to_frame(assembly.element(0).frame, Frame(trnsf_plane.Origin, trnsf_plane.XAxis, trnsf_plane.YAxis))
    assembly.transform(T)
    assembly.network.transform(T)
# ---------- end transform ----------

# ----
# Tool
panel_5 = Panel("Attach a custom tool")
list_6 = ValueList({"measurement_tip": 0, "air_pick_15mm": 1, "area_gripper": 2, "parallel_gripper": 3}, selected="parallel_gripper")
show_3 = BooleanToggle(False)
python = PythonScript(data_path=py, tool=list_6, show=show_3)  # -> tool, M, compas_mesh
# ---------- python: Python ----------
import os, math
from compas.geometry import Frame, Rotation
from compas.datastructures import Mesh
from compas_ghpython.artists import MeshArtist
from compas_fab.robots import Tool

tolerance = 0


#if tool == 0:
#    filename = 'measurement_tool_zaxis.stl'
#    ee_frame = Frame([0, 0, 0.109], [1, 0, 0], [0, 1, 0])
    
if tool == 0:
    filename = 'measurement_tip_muc.stl'
    ee_frame = Frame([0, 0, 0.20], [0, 1, 0], [-1, 0, 0])

elif tool == 1:
    filename = 'airpick_15.stl'
    ee_frame = Frame([0, 0, 0.158 + tolerance], [1, 0, 0], [0, 1, 0])
    
elif tool == 2:
    filename = 'area_gripper_zaxis.stl'
    ee_frame = Frame([0, 0, 0.10219 + tolerance], [1, 0, 0], [0, 1, 0])

elif tool == 3:
    filename = 'parallel_gripper_muc.stl'
    ee_frame = Frame([0, 0, 0.1455 + tolerance], [0, 1, 0], [-1, 0, 0])    
    
data_path = os.path.join(data_path, "tool_geometry")
fullfilename = os.path.join(data_path, filename)
print fullfilename

ee_mesh = Mesh.from_stl(fullfilename)

#R = Rotation.from_axis_and_angle(ee_frame.zaxis, math.radians(180), point=ee_frame.point)
#ee_frame.transform(R)

if show:
    artist = MeshArtist(ee_mesh)
    M = artist.draw()

tool = Tool(ee_mesh, ee_frame)
compas_mesh = ee_mesh
# ---------- end python ----------
py_5 = PythonScript(robot=robot, tool=python.tool, attach=Toggle(True))  # -> a
# ---------- py_5: Python ----------
if attach:
    robot.attach_tool(tool)
else:
    robot.detach_tool()
# ---------- end py_5 ----------

base_geo = Geometry([<mesh referenced from the Rhino model> x22])
rob1 = Plane(Plane(origin=(-2.238322, -0.293946, 1.042124), x=(-0.9796005347, -0.2003859048, 0.01510899282), y=(0.2004708923, -0.9796901253, 0.004322002411)))
rob2 = Plane(Plane(origin=(-0.442466, -0.743734, 1.034338), x=(0.9665869727, -0.2562759928, 0.00567799984), y=(0.2563094872, 0.9665744522, -0.006266993993)))

# ----
# Base
x_axis = Curve(<curve referenced from the Rhino model>)  # disabled
y_axis = Curve(<curve referenced from the Rhino model>)  # disabled
x_axis_2 = Curve(<curve referenced from the Rhino model>)
y_axis_2 = Curve(<curve referenced from the Rhino model>)  # disabled
x_axis_3 = Curve(<curve referenced from the Rhino model>)  # disabled
y_axis_3 = Curve(<curve referenced from the Rhino model>)
x_axis_4 = Curve(<curve referenced from the Rhino model>)
y_axis_4 = Curve(<curve referenced from the Rhino model>)
r_rob2 = PythonScript(plane_axes=[x_axis, y_axis])  # -> plane; inputs plane_axes: list of Curve; disabled
# ---------- r_rob2: Python ----------
import Rhino.Geometry as rg

x_axis, y_axis = plane_axes

x_axis = rg.Line(x_axis.PointAtStart, x_axis.PointAtEnd)
y_axis = rg.Line(y_axis.PointAtStart, y_axis.PointAtEnd)

if x_axis.From.DistanceTo(y_axis.From) < 0.01:
    origin = x_axis.From
    xvec = x_axis.Direction
    yvec = y_axis.Direction
elif x_axis.To.DistanceTo(y_axis.To) < 0.01:
    origin = x_axis.To
    xvec = -x_axis.Direction
    yvec = -y_axis.Direction
elif x_axis.From.DistanceTo(y_axis.To) < 0.01:
    origin = x_axis.From
    xvec = x_axis.Direction
    yvec = -y_axis.Direction
elif x_axis.To.DistanceTo(y_axis.From) < 0.01:
    origin = x_axis.To
    xvec = -x_axis.Direction
    yvec = y_axis.Direction

plane = rg.Plane(origin, xvec, yvec)
# ---------- end r_rob2 ----------
r_rob1 = PythonScript(plane_axes=[x_axis_3, y_axis_2])  # -> plane; inputs plane_axes: list of Curve; disabled; same code as r_rob2
r_rob1_2 = PythonScript(plane_axes=[x_axis_2, y_axis_3])  # -> plane; inputs plane_axes: list of Curve; same code as r_rob2
r_rob2_2 = PythonScript(plane_axes=[x_axis_4, y_axis_4])  # -> plane; inputs plane_axes: list of Curve; same code as r_rob2
filter = StreamFilter(Gate=list_5, Stream0=r_rob1_2, Stream1=r_rob2_2)
filter_2 = StreamFilter(Gate=list_5, Stream0=rob1, Stream1=rob2)
base = PythonScript(base_plane=filter_2, pickup_plane=filter)  # -> base_frame, picking_frame
# ---------- base: Python ----------
from compas.geometry import Frame
from compas.geometry import Transformation, Rotation
from compas_ghpython import draw_frame
import math
import Rhino.Geometry as rg



base_frame = Frame(base_plane.Origin, base_plane.XAxis, base_plane.YAxis)

picking_frame = Frame(pickup_plane.Origin, pickup_plane.XAxis, pickup_plane.YAxis)
# ---------- end base ----------
py_6 = PythonScript(
    robot=robot,
    origin_frame=base.base_frame,
    base_geometry=base_geo,
    picking_frame=base.picking_frame,
    set_to_origin_frame=Toggle(True))  # -> a, picking_plane_WCF; inputs base_geometry: list, set_to_origin_frame: Boolean
# ---------- py_6: Python ----------
from compas_ghpython import draw_frame
from compas.geometry import Frame, Point, Vector, Transformation
from compas.datastructures import Mesh
from compas_rhino.geometry import RhinoMesh
from compas_fab.robots import CollisionMesh



if set_to_origin_frame == True:
    robot.set_origin_frame(origin_frame)
else:
    robot.set_origin_frame(Frame.worldXY())

if len(base_geometry):
    robot.set_base_geometry(base_geometry)

if picking_frame:
    picking_frame_WCF = robot.to_world_coordinates_origin(picking_frame)
    robot.set_picking_frame(picking_frame_WCF)
    picking_plane_WCF = draw_frame(picking_frame_WCF)
# ---------- end py_6 ----------

# ---- group: capture
viewport_name = Text("workflow_2")
capture_to_bitmap = PythonScript(DATA=py_3.DATA, capture=Button(), viewport_name=viewport_name, idx=Slider(2, range=0..10))  # -> out, a; inputs capture: Boolean, idx: Int32
# ---------- capture_to_bitmap: Python ----------
import Rhino
import System.Drawing
from scriptcontext import sticky as st

import sys, os
import ghpythonlib.components as ghcomp
import Grasshopper as gh
import datetime


ghComp = ghenv.Component
ghDoc = ghComp.OnPingDocument()

def rCommonCap(filePath, viewportName,scaleFactor):
    RhinoDocument = Rhino.RhinoDoc.ActiveDoc
    view = RhinoDocument.Views.Find(viewportName, False)
    vp = view.ActiveViewport
    size = System.Drawing.Size(vp.Size.Width*scaleFactor,vp.Size.Height*scaleFactor)
    capture = view.CaptureToBitmap(size)
    capture.Save(filePath);


export_dir = os.path.join(DATA, 'parameter_studies')
if not os.path.isdir(export_dir): os.mkdir(export_dir)
print export_dir
filename = os.path.join(export_dir, 'capture_' + str(idx) + '.png') 
print filename

zoom = 1

if capture:
    rCommonCap(filename, viewport_name, zoom)
# ---------- end capture_to_bitmap ----------

# ----
# Configuration
main_planning_group = Text(info.main_group_name)

# ----
# Set Digital Out
number = Slider(1, range=0..10)
value = BooleanToggle(True)
digital_out = PythonScript(number=number, value=value)  # -> urscript; inputs number: Int32, value: Boolean
# ---------- digital_out: Python ----------
from ur_fabrication_control.direct_control import URScript

urscript = URScript()
urscript.start()
urscript.add_line("\tset_digital_out({}, {})".format(number, value))
urscript.end()
urscript = urscript.generate()

print(urscript)
# ---------- end digital_out ----------
send = Button()
send_2 = GhPythonScript(urscript=digital_out, send=send)  # -> out; inputs send: Boolean
# ---------- send_2: Python ----------
from scriptcontext import sticky as st
from ur_fabrication_control.direct_control import send_script

ur_ip = st["ur_ip"]
ur_port = st["ur_port"]

if send:
    send_script(urscript, ur_ip, ur_port)
# ---------- end send_2 ----------

a1 = Slider(-103, range=-360..360)
a2 = Slider(-58, range=-360..360)
a3 = Slider(140, range=-360..360)
a4 = Slider(-171, range=-360..360)
a5 = Slider(-90, range=-360..360)
a6 = Slider(-147, range=-360..360)
jp = GhPythonScript()  # -> joint_positions
# ---------- jp: Python ----------
import math
from compas_fab.robots import Configuration

joint_positions = [-90,-90,90,-90,-90,90]
joint_positions = [math.radians(a) for a in joint_positions]
#joint_positions = [-3.136, -0.328, -1.218, 3.129, 0.852, 0.008]
#joint_positions = [2.2576519234033405, 2.1572862505933803, -4.1258990564818259, -1.9587426260560075, -1.869705620242365, -1.5707963235765223]


joint_positions = [-1.804, -1.021, 2.435, -2.985, -1.571, -2.572]

#joint_positions = [2.4049599115039362, -2.5271117885452909, -1.7077038573998939, -1.0116016821725204, -3.082057387082354, -1.5751659132048623]

#joint_positions = [0] * 6

print joint_positions
# ---------- end jp ----------
forward_kinematics = PythonScript(robot=robot, set_joint_positions=Button(), joint_positions=jp, a1=a1, a2=a2, a3=a3, a4=a4, a5=a5, a6=a6)  # -> full_configuration; inputs joint_positions: list
# ---------- forward_kinematics: Python ----------
import math
import Grasshopper
from compas.robots import Joint
from compas_fab.robots import Configuration

if set_joint_positions:

    j = 0
    for i in range(ghenv.Component.Params.Input.Count):
        nslider = ghenv.Component.Params.Input[i].Sources[0]
        if nslider.GetType() == Grasshopper.Kernel.Special.GH_NumberSlider:
            nslider.TrySetSliderValue(math.degrees(joint_positions[j]))
            j += 1

if robot:
    joint_positions = [a1, a2, a3, a4, a5, a6]
    joint_types = robot.get_configurable_joint_types()
    for i, joint_type in enumerate(joint_types):
        if joint_type == Joint.REVOLUTE:
            joint_positions[i] = math.radians(joint_positions[i])
    full_configuration = Configuration(joint_positions, joint_types)

print(full_configuration)
# ---------- end forward_kinematics ----------

# ----
# Parallel Gripper Switch
open = BooleanToggle(True)
digital_out_2 = PythonScript(open=open)  # -> urscript
# ---------- digital_out_2: Python ----------
from ur_fabrication_control.direct_control import URScript
from ur_fabrication_control.direct_control.mixins import ParallelGripMixins

class URScript_ParallelGrip(URScript, ParallelGripMixins):
    pass

urscript = URScript_ParallelGrip()
urscript.start()

if open:
    # Open State
    urscript.parallelgrip_open()
else: 
    # Closed State
    urscript.parallelgrip_close()

urscript.end()
urscript = urscript.generate()
print(urscript)
# ---------- end digital_out_2 ----------
send_3 = Button()
send_4 = GhPythonScript(urscript=digital_out_2, send=send_3)  # -> out; inputs send: Boolean
# ---------- send_4: Python ----------
from scriptcontext import sticky as st
from ur_fabrication_control.direct_control import send_script

ur_ip = st["ur_ip"]
ur_port = st["ur_port"]

print ur_ip

if send:
    send_script(urscript, ur_ip, ur_port)
# ---------- end send_4 ----------

forward = PythonScript(robot=robot, group=main_planning_group, full_configuration=forward_kinematics)  # -> out, frame_WCF
# ---------- forward: Python ----------
"""Calculate the robot's forward kinematic.
    Inputs:
        robot: :class:`compas_fab.robots.Robot`
            The robot.
        group: str, optional
            The planning group used for calculation. Defaults to the robot's
            main planning group.
        full_configuration : :class:`compas_fab.robots.Configuration`
            The full configuration to calculate the forward kinematic for. If no
            full configuration is passed, the zero-joint state for the other
            configurable joints is assumed.
    Output:
        :class:`Frame`
            The frame in the world coordinate frame (WCF).
"""
from __future__ import print_function
import logging

import compas_fab
print(compas_fab.__version__)

LOGGER = logging.getLogger('roslibpy')

if robot and robot.client and full_configuration:
    if robot.client.is_connected:
        frame_WCF = robot.forward_kinematics(full_configuration, group, options={'backend':'model'})
        #frame_WCF = robot.forward_kinematics(full_configuration, group, backend='model')
        print(frame_WCF)
    else:
        print("Robot is not connected")
# ---------- end forward ----------
panel_6 = Panel(forward.out)

# ----
# Get Pose Cartesian
get = Button()
pose = PythonScript(get=get)  # -> pose_cartesian_meter
# ---------- pose: Python ----------
from scriptcontext import sticky as st
from ur_fabrication_control.online_control.ur_direct import get_current_pose_cartesian
from compas.geometry import Frame
from compas_ghpython import draw_frame

robot = st["robot"]

server_address = st["server_address"]
server_port = st["server_port"]
ur_port = st["ur_port"]
ur_ip = st["ur_ip"]
pose_cartesian_meter = []
print ur_ip

# retrieve the current tool frame in axis angle format
if robot.attached_tool:
    print ("attached")
    tool_angle_axis = list(robot.attached_tool.frame.point) + list(robot.attached_tool.frame.axis_angle_vector)
    
else:
    tool0_frame = Frame([0, 0, 0], [1, 0, 0], [0, 1, 0])
    tool_angle_axis = list(tool0_frame.point) + list(tool0_frame.axis_angle_vector)

print(tool_angle_axis)

guid = str(ghenv.Component.InstanceGuid)
pose_cartesian_key = "pose_cartesian" + guid


if get:
    print ("getting pose")
    #st[pose_cartesian_key] = get_current_pose_cartesian(tool_angle_axis, server_address, server_port, ur_ip, ur_port, send=True)
    st[pose_cartesian_key] = get_current_pose_cartesian(server_address, server_port, ur_ip, tool_angle_axis)
    

if pose_cartesian_key not in st:
    pose_cartesian_mm = []
    pose_cartesian_meter = []
else:
    pose_cartesian = st[pose_cartesian_key]

print(pose_cartesian)

for i in pose_cartesian:
    new_c = i / 1000
    pose_cartesian_meter.append(new_c)

print (pose_cartesian_meter)
# ---------- end pose ----------
panel_7 = Panel(pose)

# ----
# Get Pose Joint
get_2 = Button()
pose_2 = PythonScript(get=get_2)  # -> configuration, pose_joints; disabled
# ---------- pose_2: Python ----------
from scriptcontext import sticky as st
from ur_fabrication_control.online_control.ur_direct import get_current_pose_joints
from compas_fab.robots import Configuration


robot = st["robot"]

server_address = st["server_address"]
server_port = st["server_port"]
ur_port = st["ur_port"]
ur_ip = st["ur_ip"]
print ur_ip

guid = str(ghenv.Component.InstanceGuid)
pose_joints_key = "pose_joints" + guid

# retrieve the current tool frame in axis angle format
if robot.attached_tool:
    tool_angle_axis = list(robot.attached_tool.frame.point) + list(robot.attached_tool.frame.axis_angle_vector)
else:
    tool0_frame = Frame([0, 0, 0], [1, 0, 0], [0, 1, 0])
    tool_angle_axis = list(tool0_frame.point) + list(tool0_frame.axis_angle_vector)

print(tool_angle_axis)

# send script to the robot to receive the current joint configuration
if get:
    st[pose_joints_key] = get_current_pose_joints(server_address, server_port, ur_ip, tool_angle_axis)

print (st[pose_joints_key])
configuration = Configuration.from_revolute_values(st[pose_joints_key])
pose_joints = configuration.joint_values
"""
if pose_joints_key not in st:
    configuration = Configuration.from_revolute_values([0,0,0,0,0,0])
else:
    configuration = Configuration.from_revolute_values(st[pose_joints_key])

pose_joints = configuration.values
"""
# ---------- end pose_2 ----------
panel_8 = Panel(pose_2.pose_joints)

pt_r1 = Point([<point referenced from the Rhino model> x3])
pln_r1 = Plane(Plane(origin=(-2.32642658, -0.5133852699, 1.170753334), x=(-0.9123588076, -0.4093915072, 0), y=(0.4093915072, -0.9123588076, 0)))
python_2 = GhPythonScript()  # -> out, config
# ---------- python_2: Python ----------
from compas_fab.robots import JointTrajectoryPoint, Duration

elem_168 = [JointTrajectoryPoint((0.262, -1.798, 2.496, -2.269, -1.571, -2.094), (0, 0, 0, 0, 0, 0), (0.000, 0.000, 0.000, 0.000, 0.000, 0.000), (0.316, 0.000, 0.000, 0.000, 0.000, 0.000), (0.000, 0.000, 0.000, 0.000, 0.000, 0.000), Duration(0, 0)), JointTrajectoryPoint((0.358, -1.721, 2.419, -2.337, -1.612, -1.789), (0, 0, 0, 0, 0, 0), (0.192, 0.155, -0.156, -0.137, -0.082, 0.613), (0.243, 0.196, -0.197, -0.173, -0.103, 0.775), (0.000, 0.000, 0.000, 0.000, 0.000, 0.000), Duration(0, 778576217)), JointTrajectoryPoint((0.453, -1.643, 2.341, -2.406, -1.652, -1.484), (0, 0, 0, 0, 0, 0), (0.309, 0.249, -0.250, -0.220, -0.131, 0.983), (0.294, 0.237, -0.238, -0.209, -0.124, 0.936), (0.000, 0.000, 0.000, 0.000, 0.000, 0.000), Duration(1, 143933321)), JointTrajectoryPoint((0.549, -1.566, 2.264, -2.474, -1.693, -1.179), (0, 0, 0, 0, 0, 0), (0.391, 0.316, -0.317, -0.279, -0.166, 1.247), (0.293, 0.236, -0.237, -0.209, -0.124, 0.933), (0.000, 0.000, 0.000, 0.000, 0.000, 0.000), Duration(1, 413432220)), JointTrajectoryPoint((0.645, -1.489, 2.186, -2.542, -1.733, -0.874), (0, 0, 0, 0, 0, 0), (0.456, 0.369, -0.369, -0.326, -0.194, 1.455), (0.276, 0.223, -0.224, -0.197, -0.117, 0.881), (0.000, 0.000, 0.000, 0.000, 0.000, 0.000), Duration(1, 637405689)), JointTrajectoryPoint((0.741, -1.412, 2.109, -2.610, -1.774, -0.569), (0, 0, 0, 0, 0, 0), (0.510, 0.412, -0.413, -0.364, -0.216, 1.627), (0.265, 0.214, -0.215, -0.189, -0.112, 0.845), (0.000, 0.000, 0.000, 0.000, 0.000, 0.000), Duration(1, 834537647)), JointTrajectoryPoint((0.836, -1.334, 2.031, -2.679, -1.815, -0.264), (0, 0, 0, 0, 0, 0), (0.534, 0.431, -0.432, -0.381, -0.226, 1.701), (-0.020, -0.016, 0.016, 0.014, 0.009, -0.064), (0.000, 0.000, 0.000, 0.000, 0.000, 0.000), Duration(2, 13316057)), JointTrajectoryPoint((0.932, -1.257, 1.954, -2.747, -1.855, 0.041), (0, 0, 0, 0, 0, 0), (0.507, 0.410, -0.410, -0.362, -0.215, 1.617), (-0.260, -0.210, 0.210, 0.185, 0.110, -0.828), (0.000, 0.000, 0.000, 0.000, 0.000, 0.000), Duration(2, 193306777)), JointTrajectoryPoint((1.028, -1.180, 1.876, -2.815, -1.896, 0.346), (0, 0, 0, 0, 0, 0), (0.453, 0.366, -0.367, -0.324, -0.192, 1.445), (-0.276, -0.223, 0.223, 0.197, 0.117, -0.880), (0.000, 0.000, 0.000, 0.000, 0.000, 0.000), Duration(2, 391625867)), JointTrajectoryPoint((1.123, -1.102, 1.799, -2.884, -1.936, 0.652), (0, 0, 0, 0, 0, 0), (0.387, 0.313, -0.313, -0.276, -0.164, 1.234), (-0.295, -0.238, 0.239, 0.211, 0.125, -0.941), (0.000, 0.000, 0.000, 0.000, 0.000, 0.000), Duration(2, 617309921)), JointTrajectoryPoint((1.219, -1.025, 1.722, -2.952, -1.977, 0.957), (0, 0, 0, 0, 0, 0), (0.303, 0.245, -0.245, -0.216, -0.128, 0.965), (-0.294, -0.238, 0.238, 0.210, 0.125, -0.938), (0.000, 0.000, 0.000, 0.000, 0.000, 0.000), Duration(2, 890405576)), JointTrajectoryPoint((1.315, -0.948, 1.644, -3.020, -2.017, 1.262), (0, 0, 0, 0, 0, 0), (0.189, 0.153, -0.153, -0.135, -0.080, 0.602), (-0.229, -0.185, 0.185, 0.164, 0.097, -0.731), (0.000, 0.000, 0.000, 0.000, 0.000, 0.000), Duration(3, 265634250)), JointTrajectoryPoint((1.411, -0.870, 1.567, -3.089, -2.058, 1.567), (0, 0, 0, 0, 0, 0), (0.000, 0.000, 0.000, 0.000, 0.000, 0.000), (-0.314, -0.254, 0.254, 0.224, 0.133, -1.001), (0.000, 0.000, 0.000, 0.000, 0.000, 0.000), Duration(4, 46182857))]
#oint((0.262, -1.369, 2.027, -2.478, -1.471, -2.772), (0, 0, 0, 0, 0, 0), (-0.000, 0.730, -0.798, -0.355, 0.170, -1.154), (-0.000, 0.628, -0.686, -0.306, 0.146, -0.993), (0.000, 0.000, 0.000, 0.000, 0.000, 0.000), Duration(1, 163725604)), JointTrajectoryPoint((0.262, -1.226, 1.871, -2.547, -1.438,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
# ---------- end python_2 ----------
pln_r2 = Plane(PlaneXY(-0.2180956498, -0.5861341159, 1.170753334))

# ----
# Calculate Basis - 3-Point Method
# Measure basis:
# 1. Clear the recorded poses
# 2. Move robot to origin and press "get pose"
# 3. Move robot to point in positive x-axis and press "get pose"
# 4. Move robot to an other point in your basis and press "get pose"
# (The further away these positions are, the better)
# 
# 5. Alternatively change the order in the component calc base
# 6. Copy output into base component (TODO: check if it has to be inverted)
list_7 = ValueList({"o, pos.x-axis, xy pl": 0, "o, pos.y-axis, xy pl": 1}, selected="o, pos.x-axis, xy pl")
clear = Button()
rec = PythonScript(msg=pose, rec=get, clear=clear)  # -> rec; inputs msg: list
# ---------- rec: Python ----------
from scriptcontext import sticky as st

guid = str(ghenv.Component.InstanceGuid)
recorded_key =  "recorded_" + guid
just_cleared_key = "just_cleared_" + guid


if recorded_key not in st:
    st[recorded_key] = []

if just_cleared_key not in st:
    st[just_cleared_key] = False

if clear:
    st[recorded_key] = []
    st[just_cleared_key] = True
else:
    if len(msg):
        if msg != [None] and not st[just_cleared_key] and rec:
            st[recorded_key].append(msg)
    st[just_cleared_key] = False
        


rec = st[recorded_key]

print rec
# ---------- end rec ----------
calc_base = PythonScript(poses=rec, input_type=list_7)  # -> out, base_plane; inputs poses: list
# ---------- calc_base: Python ----------
import Rhino.Geometry as rg
import math


if len(poses) > 2:
    
    O = poses[0]
    P1 = poses[1]
    P2 = poses[2]
    
    if input_type == 0:
        # origin, pt on positive x-axis, pt in xy plane
        origin = rg.Point3d(O[0], O[1], O[2])
        pt_on_xaxis = rg.Point3d(P1[0], P1[1], P1[2])
        pt_in_xyplane = rg.Point3d(P2[0], P2[1], P2[2])
        
        xaxis = pt_on_xaxis - origin
        xaxis.Unitize()
        
        v = pt_in_xyplane - origin
        zaxis = rg.Vector3d.CrossProduct(v, xaxis)
        zaxis.Unitize()
        
        # zaxis must look up!
        if math.acos(rg.Vector3d.ZAxis * zaxis) > math.acos(rg.Vector3d.ZAxis * -zaxis):
            zaxis = -zaxis
        
        yaxis = rg.Vector3d.CrossProduct(zaxis, xaxis)
    
    elif input_type == 1:
        # origin, pt on positive y-axis, pt in xy plane
        origin = rg.Point3d(O[0], O[1], O[2])
        pt_on_yaxis = rg.Point3d(P1[0], P1[1], P1[2])
        pt_in_xyplane = rg.Point3d(P2[0], P2[1], P2[2])
        
        yaxis = pt_on_yaxis - origin
        yaxis.Unitize()
        
        v = pt_in_xyplane - origin
        zaxis = rg.Vector3d.CrossProduct(v, yaxis)
        zaxis.Unitize()
        
        # zaxis must look up!
        if math.acos(rg.Vector3d.ZAxis * zaxis) > math.acos(rg.Vector3d.ZAxis * -zaxis):
            zaxis = -zaxis
        
        xaxis = rg.Vector3d.CrossProduct(yaxis, zaxis)
        
        
    print "Copy the following into base component:"
    print " "
    print "origin = [%.2f, %.2f, %.2f]" % tuple(list(origin))
    print "xaxis = [%.5f, %.5f, %.5f]" % tuple(list(xaxis))
    print "yaxis = [%.5f, %.5f, %.5f]" % tuple(list(yaxis))
    

#print rg.Vector3d.CrossProduct(rg.Vector3d.YAxis, rg.Vector3d.ZAxis)
#print rg.Vector3d.CrossProduct(rg.Vector3d.ZAxis, rg.Vector3d.XAxis)

    base_plane = rg.Plane(origin, xaxis, xaxis)
# ---------- end calc_base ----------
panel_9 = Panel(rec)
panel_10 = Panel(calc_base.out)

# ----
# Direct UR Control
config = GhPythonScript()  # -> out, joint_configs
# ---------- config: Python ----------
from compas_fab.robots import Configuration

values=[-0.737876, -1.64531, 1.740348, -0.367801, -0.37385, -0.110741]
joint_configs = [Configuration.from_revolute_values(values)]
# ---------- end config ----------
pln_4 = Plane(calc_base.base_plane)

pt_r2 = Point([<point referenced from the Rhino model> x3])

# ----
# Calculate Basis - Point fitting method via RPC
toggle = BooleanToggle(False)
plane_init_guess = Plane(pln_r2)
pt_3 = Point(pt_r2)
calc_base_2 = PythonScript(poses=rec, pts_cad=pt_3, base_plane_init_guess=plane_init_guess, calc=toggle)  # -> out, pts_mtip_init_guess, pts_mtip_fit, base_plane_fit; inputs poses: list, pts_cad: list of Point3d, base_plane_init_guess: Plane
# ---------- calc_base_2: Python ----------
import ghpythonlib.components as ghcomp
import Rhino.Geometry as rg
from scriptcontext import sticky as st
from compas.geometry import Frame
import math as m
import sys
from compas.rpc import Proxy # for calling the numpy function in CPython

#icp_func = Proxy('ur_fabrication_control.optimisation.icp', python = 'C://Users//doerf//.conda//envs//rsrd_22//python.exe') #C:\Users\doerf\.conda\envs\rsrd_22
#print icp_func._python
#print poses
poses_estimation_1 = [[-0.52897499999999997, -0.51097899999999996, -0.62637199999999993, -0.00259867, 0.00166124, -0.00047402699999999997], [-0.93892399999999998, 0.52012900000000006, -0.61947699999999994, -0.00128827, 0.0021785199999999998, 0.00053505499999999999], [-0.440556, 0.52178999999999998, -0.624884, -0.00082253200000000006, 0.0027548, -0.000222504], [0.46294200000000002, 1.0241099999999999, -0.62009100000000006, 0.000672946, 0.0026381999999999998, 0.000130681]]
if len(poses):
    
    # get points from poses
    pts_mtip = [rg.Point3d(p[0], p[1], p[2]) for p in poses]
    
    T_W_R_init_guess = rg.Transform.PlaneToPlane(rg.Plane.WorldXY, base_plane_init_guess)
    pts_mtip_init_guess = [ghcomp.Transform(pt, T_W_R_init_guess) for pt in pts_mtip]
    
    # format Rhino transformation
    T_W_R_init_guess_flattened = [float(f) for f in T_W_R_init_guess.ToFloatArray(True)]
    T_W_R_init_guess_list = [T_W_R_init_guess_flattened[i:(i + 4)] for i in range(0, len(T_W_R_init_guess_flattened), 4)]  

    # format ptsA and ptsB
    dataB = [list(pt) for pt in pts_cad]
    dataA = [list(pt) for pt in pts_mtip]
    
    # call the function
    max_iterations = 100
    
    if calc:
        icp_func = Proxy('ur_fabrication_control.optimisation.icp', python = 'C://Users//lidet//anaconda3//envs//rs//python.exe')
        #icp_func = Proxy('ur_fabrication_control.optimisation.icp', python = 'C://Users//doerf//.conda//envs//rsrd_22//python.exe') #C:\Users\doerf\.conda\envs\rsrd_22
        
        
        print icp_func._python

        transformation, distances = icp_func.icp(dataA, dataB, init_guess=T_W_R_init_guess_list, max_iterations=max_iterations, tolerance=0.000001)
        
        print "distances", distances
        
        # format result
        T = rg.Transform.Identity
        for i in range(4):
            for j in range(4):
                code = "T.M%i%i = %f" % (i, j, transformation[i][j])
                print code
                exec(code)
        #print T
        
        # now transform the points with the transformation calculated
        pts_mtip_fit = [ghcomp.Transform(pt, T) for pt in pts_mtip]
        base_plane_fit = ghcomp.Transform(rg.Plane.WorldXY, T)
        
        
        #f = Frame(base_plane_fit)
        #print f.get_pose_quaternion()
        
        # correct the zvalue
        #base_plane_fit = ghcomp.Transform(base_plane_fit, rg.Transform.Translation(0,0,-3))
# ---------- end calc_base_2 ----------
pt_4 = Point(calc_base_2.pts_mtip_init_guess)
pt_5 = Point(calc_base_2.pts_mtip_fit)
pln_5 = Plane(calc_base_2.base_plane_fit)

python_3 = GhPythonScript(robot=list_5)  # -> out, placing_configurations_rob
# ---------- python_3: Python ----------
__author__ = "lidet"
__version__ = "2023.05.10"

import rhinoscriptsyntax as rs
from compas_fab.robots import Configuration, JointTrajectoryPoint, Duration

if robot == 1:
    placing_configurations_rob = [JointTrajectoryPoint((-1.804, -1.021, 2.435, -2.985, -1.571, -2.572), (0, 0, 0, 0, 0, 0), (0.000, 0.000, 0.000, 0.000, 0.000, 0.000), (0.985, 0.000, 0.000, 0.000, 0.000, 0.000), (0.000, 0.000, 0.000, 0.000, 0.000, 0.000), Duration(0, 0)),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
else:
    placing_configurations_rob = [JointTrajectoryPoint((-1.804, -1.021, 2.435, -2.985, -1.571, -2.572), (0, 0, 0, 0, 0, 0), (0.000, 0.000, 0.000, 0.000, 0.000, 0.000), (1.006, 0.000, 0.000, 0.000, 0.000, 0.000), (0.000, 0.000, 0.000, 0.000, 0.000, 0.000), Duration(0, 0)),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
# ---------- end python_3 ----------

# ----
# Stop
stop = Button()
stop_2 = PythonScript(stop=stop)
# ---------- stop_2: Python ----------
from scriptcontext import sticky as st
from ur_fabrication_control.direct_control.common import send_stop

ur_ip = st["ur_ip"]
ur_port = st["ur_port"]

if stop:
    send_stop(ur_ip, ur_port)
# ---------- end stop_2 ----------

# ----
# Settings
reset_key = Button()
shift_value = Slider(0.03, range=-0.15..0.05)
angle = Slider(325.77, range=0..360)
collision = BooleanToggle(True)
next = Button()
prev = Button()
flip = BooleanToggle(False)

# ----
# Assembly Branches
number_slider = Slider(0, range=0..10)  # disabled

# ----
# Assembly Visualization
# 1. Visualize assembly.
# 2. Visualize selected option.
# 3. Visuilize current options (all/filtered).
list_8 = ValueList({"'Built by Human/Robot'": 0, "'Design Generation'": 1, "'Assembly Workflow'": 2}, selected="'Design Generation'")
show_4 = BooleanToggle(True)
show_5 = BooleanToggle(False)
show_6 = BooleanToggle(True)
show_7 = BooleanToggle(False)
show_8 = BooleanToggle(False)
show_9 = BooleanToggle(False)
show_10 = BooleanToggle(False)

# ----
# Aggregate
iterations = Slider(1, range=1..10)
human_adds = Button()
robot_adds = Button()
aggregate = Button()
add_two = Button()
update = GhPythonScript(trigger=[robot_adds, human_adds, add_two, aggregate])  # -> update; inputs trigger: list
# ---------- update: Python ----------
update = False

for value in trigger:
    if value:
        update = True

print update
# ---------- end update ----------

inputs = GhPythonScript(
    assembly=elem_def.assembly,
    next_element=next,
    prev_element=prev,
    angle=angle,
    shift_value=shift_value,
    collision_check=collision,
    reset_key=reset_key,
    update=update)  # -> out, assembly, selected_key, angle, shift_value, selected_connector_plane
# ---------- inputs: Python ----------
import math
import random
from scriptcontext import sticky as st
import Rhino.Geometry as rg
import rhinoscriptsyntax as rs

import ghpythonlib.components as ghcomp

from compas.geometry import Rotation
from compas.artists import Artist

all_options = []
filtered_keys = []
distances = []
vectors = []
origins = []



#############################################################################
## OPTIONS
#############################################################################

for key, element in assembly.elements():
    for origin, vector in element.current_option_vectors(0.40):
        all_options.append((key, origin, vector))

assembly.current_options = all_options

# all options keys
open_connectors_keys = [option[0] for option in assembly.current_options]

open_connectors_keys = list(set(open_connectors_keys))
assembly.open_connectors_keys = open_connectors_keys

#############################################################################
## SELECT A KEY
#############################################################################

guid = str(ghenv.Component.InstanceGuid)
element_key = "elem_" + guid

if element_key not in st or None:
    st[element_key] = 0

if reset_key:
    st[element_key] = 0

if next_element:
    if st[element_key] < len(open_connectors_keys) - 1:
        st[element_key] += 1

if prev_element:
    if st[element_key] <= len(open_connectors_keys) - 1:
        st[element_key] -= 1

    if st[element_key] < 1:
        st[element_key] = 0


#############################################################################
## OPEN CONNECTORS
#############################################################################

if len(open_connectors_keys) == 0: 
    selected_key = 0
    print("!!! NO OPEN CONNECTORS AVAILABLE !!!")
    print("Suggestion: RESET KEY!")
else:
    selected_key = open_connectors_keys[st[element_key]]
    print("Element with key {} selected.".format(selected_key))
    
selected_elem = assembly.network.node[selected_key]['element']

#############################################################################
## DISPLAY SELECTED CONNECTOR
#############################################################################

if selected_key:
    selected_connenctor_frame = assembly.element(selected_key).connectors(state='open')[0]

    R = Rotation.from_axis_and_angle(selected_elem.frame.xaxis, math.radians(angle), selected_elem.frame.point)
    
    selected_connenctor_frame_copy = selected_connenctor_frame.transformed(R)
    selected_connector_plane = Artist(selected_connenctor_frame_copy).draw()

#############################################################################
## LAST ADDED KEYS
#############################################################################

key_index = assembly.network.key_index()
keys = [key_index[key] for key in assembly.network.nodes()]
new_keys = keys[-2:]
assembly.last_added = new_keys
print 'Last added keys:', ', '.join(map(str, new_keys))
# ---------- end inputs ----------
keys_status_update = Panel(inputs.out)
pln_6 = Plane(inputs.selected_connector_plane)
shift_value_2 = Panel(inputs.shift_value)
selected_key = Panel(inputs.selected_key)
angle_2 = Panel(inputs.angle)

aggregate_2 = GhPythonScript(
    assembly=transform.assembly,
    elem=elem_def.elem,
    selected_key=inputs.selected_key,
    angle=inputs.angle,
    shift_value=inputs.shift_value,
    flip_human_robot=flip,
    collision_check=collision,
    robot_adds=robot_adds,
    human_adds=human_adds,
    add_two=add_two,
    iterations=iterations,
    aggregate=aggregate)  # -> out, assembly; inputs iterations: Int32
# ---------- aggregate_2: Python ----------
import sys
import random
from scriptcontext import sticky as st
import ghpythonlib.components as ghcomp
import math

from compas.geometry import distance_line_line, Line, is_intersection_line_line, Plane, Frame, is_intersection_line_plane
from compas.artists import Artist
from compas.topology import connected_components
import Rhino.Geometry as rg
import rhinoscriptsyntax as rs

import ghpythonlib.components as gh

flip = 'AA'

#############################################################################
## ADD ELEMENTS TO ASSEMBLY
#############################################################################

# Robot adds first element
if robot_adds:
    assembly.add_rf_unit_element(selected_key, flip, angle, shift_value, placed_by ='robot', on_ground=False, unit_index=0)
    
# Human adds second element element
if human_adds:
    assembly.add_rf_unit_element(selected_key, flip, angle, shift_value, placed_by ='human', on_ground=False, unit_index=1)

# Add two elements
if add_two:
    assembly.close_rf_unit(selected_key, flip, angle, shift_value, on_ground = False)


#############################################################################
## NO STABILITY CHECK
#############################################################################

if aggregate:
    i = 0
    while i < iterations: 
        print('-------------------- Start --------------------')
        keys = [key for key, frames in assembly.connectors('open') if frames!=[]]

        random_key = random.choice(keys)
        random_angle = random.uniform(0., 360.)
        random_shift = random.uniform(-0.04, 0.04)
        random_option_elems = assembly.element(random_key).current_option_elements(flip, random_angle, random_shift)

        is_colliding = assembly.collision_check(random_option_elems, tolerance = -0.001) if collision_check else False
        
        if not is_colliding:
            if all(random_option_elem.frame.point.z > 0.4 for random_option_elem in random_option_elems):
                assembly.close_rf_unit(random_key, flip, random_angle, random_shift, on_ground = False)
                i += 1
                print('------- New elements added to assembly. -------')
            else:
                print('------- Option elements lie below ground level. -------')
        else:
            print('--- Stabilitry or collision avoidance criteria not satisfied. ---')
            
            break
# ---------- end aggregate_2 ----------
rec_2 = DataRecorder(aggregate_2.out, DataLimit=-10, RecordData=True)
panel_11 = Panel(rec_2)

branches = GhPythonScript(assembly=aggregate_2.assembly, branch_idx=number_slider)  # -> out, G_branch_elems, G_branch_midpoints, G_branches_midpoints; inputs branch_idx: Int32; disabled
# ---------- branches: Python ----------
import rhinoscriptsyntax as rs
from compas.geometry import Line
from compas.topology import connected_components
from compas.artists import Artist


branches = connected_components(assembly.network.adjacency)
print 'The assembly structure has {} branches.'.format(len(branches))
G_branch_elems = [Artist(assembly.element(key).mesh).draw() for key in branches[branch_idx]]
G_branch_midpoints = [Artist(assembly.element(key).line.midpoint).draw() for key in branches[branch_idx]]
G_branches_midpoints = [Artist(assembly.element(key).line.midpoint).draw() for branch in branches for key in branch ]
# ---------- end branches ----------
pt_6 = Point(branches.G_branch_midpoints)  # disabled
mesh_2 = Mesh(branches.G_branch_elems)  # disabled
assembly_branches = Panel(branches.out)  # disabled

assembly_viz = PythonScript(
    assembly=aggregate_2.assembly,
    preview_mode=list_8,
    show_assembly=show_4,
    show_support=show_5,
    show_option=show_6,
    show_last=show_7,
    show_arrows=show_8,
    show_open_connectors=show_9,
    show_keys=show_10,
    current_key=inputs.selected_key,
    angle=inputs.angle,
    shift_value=inputs.shift_value,
    flip_human_robot=flip,
    robot=list_5)  # -> out, G_planned, G_built, G_supports, G_open_connectors, G_selected, G_planned_2, G_held_by_robot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; inputs current_key: Int32
# ---------- assembly_viz: Python ----------
import os
import sys
from scriptcontext import sticky as st
import Rhino.Geometry as rg

import math
from math import pi

from compas.geometry import Vector, Translation, Frame
from compas.artists import Artist
from compas.colors import Color

G_selected = []
G_planned = []
G_built = []
G_supports = []
G_held_by_robot = []
G_open_connectors = []
G_cones = []

connectors_ranges = []

option_vectors = []
origin_option_vectors = []
flip = 'AA'

key_tag_text = []
key_tag_location= []
lines = []

# Color coding
color_coding = {'color_is_planned': Color(1.0, 0.752941176471, 0.0, 1.0), 'color_is_support': Color(0.0, 0.0, 1.0, 1.0), 'color_has_open_connector': Color(0.494117647059, 1.0, 0.239215686275, 1.0), 'color_has_no_open_connectors': Color(0.78431372549, 0.78431372549, 0.78431372549, 1.0), 'color_is_built': Color(0.811764705882, 1.0, 0.709803921569, 1.0), 'color_is_built_by_robot': Color(0.686274509804, 0.878431372549, 0.862745098039, 1.0), 'color_is_built_by_human': Color(0.949019607843, 0.898039215686, 0.0, 1.0)}

keys = [key for key, element in assembly.elements()]
print len(keys)
lines = [Artist(assembly.element(key).line).draw() for key in keys]

open_connectors_frames = [assembly.element(key).connectors(state='open') for key in keys]
#open_connectors_ranges = [assembly.element(key).connectors_ranges(state='open') for key in keys]
#open_connectors_ranges = [Artist(connector).draw() for connectors in open_connectors_ranges for connector in connectors if connectors != []]

if show_open_connectors:
    open_connectors_planes = [Artist(connector).draw() for connectors in open_connectors_frames for connector in connectors if connectors != []]

def show(element, output_geo, color):
    mesh = Artist(element.mesh).draw(color)
    output_geo.append(mesh)

def show_multiple(elements, output_geo, color):
    for element in elements:
        mesh = Artist(element.mesh).draw(color)
        output_geo.append(mesh)

if assembly:
    radius = assembly.globals['rod_radius']
    
    if current_key != None:
        current_element = assembly.element(current_key)
        elem_options = assembly.element(current_key).current_option_elements(flip, angle, shift_value)
        G_selected = Artist(assembly.element(current_key).mesh).draw(color_coding['color_is_support'])
    else:
        current_element = None
        elem_options = []
    
    if len(elem_options) != 0:
        elem_option = elem_options[0]
    
    if flip_human_robot:
        elem_options.reverse()
    
        
    planned_keys = list(assembly.network.nodes_where({'is_planned':True}))
    built_keys = list(assembly.network.nodes_where({'is_built':True}))
    support_keys = assembly.support_keys
    built_keys = [key for key in built_keys if key not in assembly.open_connectors_keys and key not in support_keys]
    #support_keys = [key for key in support_keys if key not in assembly.open_connectors_keys]
    
    print 'planned keys:', planned_keys
    print 'built keys:', built_keys
    print 'support keys:', support_keys
    print 'open connectors keys:', assembly.open_connectors_keys
    
    planned_elements = [assembly.element(key) for key in planned_keys] 
    built_elements = [assembly.element(key) for key in built_keys if key not in assembly.last_added] 
    support_elements = [assembly.element(key) for key in support_keys] 
    open_connectors_elements = [assembly.element(key) for key in assembly.open_connectors_keys if key not in assembly.last_added]
    
    # Visualize assembly
    if show_assembly:
        for element in planned_elements:
            mesh = Artist(element.mesh).draw(color_coding['color_is_planned'])
            G_planned.append(mesh)
        for element in built_elements:
            mesh = Artist(element.mesh).draw(color_coding['color_has_no_open_connectors'])
            G_built.append(mesh)
        for element in support_elements:
            mesh = Artist(element.mesh).draw(color_coding['color_is_support'])
            G_supports.append(mesh)
        for element in open_connectors_elements:
            mesh = Artist(element.mesh).draw(color_coding['color_has_open_connector'])
            G_open_connectors.append(mesh)
    
    # Vizualize current connector 
    if show_option and show_assembly:
        if elem_options:
            show(elem_options[0], G_held_by_robot, color_coding['color_is_planned'])
            show(elem_options[1], G_planned, color_coding['color_is_planned'])
            
            print elem_options[0].line
        else:
            print('No open connectors')
    
    if show_last and show_assembly:
        if len(assembly.last_added) > 1:
            show(assembly.element(assembly.last_added[0]), G_held_by_robot, color_coding['color_has_open_connector'])
            show(assembly.element(assembly.last_added[1]), G_planned, color_coding['color_has_open_connector'])
        else:
            print('No open connectors')
    
    # Visualize all options
    if show_arrows and show_assembly:
        for key, o, v in assembly.current_options:
                option_vectors.append(rg.Vector3d(*tuple(v)))
                origin_option_vectors.append(rg.Point3d(o.x, o.y, o.z))
                
    #elem_option_robot = Artist(elem_options[0].frame).draw() # elem for planning robot routine
    if robot == 1:
        elem_option_robot = elem_options[0] # elem for planning robot routine
    else:
        elem_option_robot = elem_options[1] # elem for planning robot routine
    
    if show_keys:
        for key, element in assembly.elements():
            key_tag_text.append(str(key))
            key_tag_location.append(Artist(element.frame).draw().Origin)
            
    if show_support:
        G_supports.append(assembly.support)
# ---------- end assembly_viz ----------
rot = GhPythonScript(plane=assembly_viz.elem_option_robot, angle=Slider(62, range=0..360))  # -> out, plane; disabled
# ---------- rot: Python ----------
import math
from compas.geometry import Frame, Rotation
from compas.artists import Artist

frame = Frame(plane.Origin, plane.XAxis, plane.YAxis)

R = Rotation.from_axis_and_angle(frame.xaxis, math.radians(angle), frame.point)
frame.transform(R)

plane = Artist(frame).draw()
# ---------- end rot ----------
mesh_3 = Mesh(assembly_viz.G_built)
mesh_4 = Mesh(assembly_viz.G_planned_2)
vdis = VectorDisplay(Anchor=assembly_viz.origin_option_vectors, Vector=assembly_viz.option_vectors)
mesh_5 = Mesh(assembly_viz.G_planned)
mesh_6 = Mesh(assembly_viz.G_supports)
mesh_7 = Mesh(assembly_viz.G_open_connectors)
mesh_8 = Mesh(assembly_viz.G_selected)  # disabled
mesh_9 = Mesh(assembly_viz.G_held_by_robot)
pln_7 = Plane(assembly_viz.open_connectors_planes)
tag = TextTag(Location=assembly_viz.key_tag_location, Text=assembly_viz.key_tag_text)
cir = Circle(Plane=pln_7, Radius=0.2)

pt_7 = Point(branches.G_branches_midpoints)  # disabled
preview = CustomPreview(Geometry=[mesh_4, mesh_9], Material=ColourSwatch(SwatchColor=RGB(245, 187, 96)))
preview_2 = CustomPreview(Geometry=mesh_6, Material=ColourSwatch(SwatchColor=RGB(45, 25, 233)))

# ----
# Network Visualization
number_slider_2 = Slider(0, range=0..47)
show_11 = BooleanToggle(False)
network_viz = GhPythonScript(assembly=aggregate_2.assembly, show_network=show_11, key=number_slider_2)  # -> out, nodes, edges, current_node, current_node_neighbors; inputs key: Int32
# ---------- network_viz: Python ----------
import sys, os
import ghpythonlib.components as ghcomp
from compas.datastructures import Network
from compas_ghpython.artists import NetworkArtist
from compas_rhino.geometry import RhinoLine

import compas_ghpython
import Rhino.Geometry as rg


data = assembly.network.to_data()
network = Network.from_data(data)

print assembly.network.number_of_nodes()

def draw_network(network):
    """Draw a network in Grasshopper.
    """
    points = []
    for key, attr in network.nodes(True):
        points.append({
            'pos': network.node_coordinates(key),
        })

    lines = []
    for (u, v), attr in network.edges(True):
        lines.append({
            'start': network.node_coordinates(u),
            'end': network.node_coordinates(v),
        })

    points_rg = compas_ghpython.draw_points(points)
    lines_rg = compas_ghpython.draw_lines(lines)

    return points_rg, lines_rg

if show_network:
    nodes, edges = draw_network(network)
    
    current_node = {'pos': network.node_coordinates(key), 'radius': 0.03}
    current_node = compas_ghpython.draw_spheres([current_node])
    
    current_node_neighbors_keys = network.neighbors(key)
    current_node_neighbors = [{'pos': network.node_coordinates(key), 'radius': 0.02} for key in current_node_neighbors_keys]
    current_node_neighbors = compas_ghpython.draw_spheres(current_node_neighbors)
# ---------- end network_viz ----------
pt_8 = Point(network_viz.nodes)
line = Line(network_viz.edges)
brep_2 = Brep(network_viz.current_node)
brep_3 = Brep(network_viz.current_node_neighbors)
preview_3 = CustomPreview(Geometry=brep_3, Material=ColourSwatch(SwatchColor=RGB(255, 207, 207)))
preview_4 = CustomPreview(Geometry=[brep_2, line], Material=ColourSwatch(SwatchColor=RGB(0, 0, 0)))

# ----
# Planning scene
scene = PythonScript(robot=robot)  # -> scene
# ---------- scene: Python ----------
from scriptcontext import sticky as st

from compas_fab.robots import PlanningScene

# store scene in component
guid = str(ghenv.Component.InstanceGuid)
scene_key = "scene_" + guid

if scene_key not in st:
    st[scene_key] = None

if robot:
    scene = PlanningScene(robot)
    scene.cm = []
    scene.acm = []
    scene.bcm = None
    st[scene_key] = scene

scene = st[scene_key]
# ---------- end scene ----------
mesh_10 = PythonScript(assembly=aggregate_2.assembly)  # -> elems_compas_meshes, elem_compas_mesh
# ---------- mesh_10: Python ----------
from compas.geometry import Frame, Transformation
from compas.artists import Artist

elems_compas_meshes = []

for key, elem in assembly.elements():
    m = elem.mesh
    elems_compas_meshes.append(m)

elem = assembly.element(0)
T = Transformation.from_change_of_basis(Frame.worldXY(), elem.frame)
mesh_transformed = elem.mesh.transformed(T)
elem_compas_mesh = mesh_transformed
# ---------- end mesh_10 ----------

panel_12 = Panel("base collision mesh")
brep_rob = Geometry(<brep referenced from the Rhino model>)
mesh_11 = Mesh(brep_rob)
mesh_12 = PythonScript(mesh=mesh_11)  # -> compas_mesh
# ---------- mesh_12: Python ----------
from compas.datastructures import Mesh
from compas_rhino.geometry import RhinoMesh

compas_mesh = RhinoMesh.from_guid(mesh).to_compas()
# ---------- end mesh_12 ----------
remove = Button()
scale = BooleanToggle(False)
add = Button()
collision_2 = PythonScript(robot=robot, scene=scene, compas_mesh=mesh_12, scale=scale, id="base_cm", add=add, remove=remove)  # -> out, a
# ---------- collision_2: Python ----------
from compas_fab.robots import CollisionMesh


cm = CollisionMesh(compas_mesh, id)


if scene:
    if add:
        scene.add_collision_mesh(cm, scale)
        scene.bcm = cm
    if remove:
        scene.remove_collision_mesh(id)
        scene.bcm = None
# ---------- end collision_2 ----------
panel_13 = Panel(collision_2.out)

panel_14 = Panel("assembly collision mesh")
remove_2 = Button()
add_2 = Button()
collision_3 = PythonScript(robot=robot, scene=scene, compas_meshes=mesh_10.elems_compas_meshes, add=add_2, remove=remove_2)  # -> out, a; inputs compas_meshes: list
# ---------- collision_3: Python ----------
from compas_fab.robots import CollisionMesh


T = robot.transformation_WCF_OCF()

cms_OCF = []
for i, compas_mesh in enumerate(compas_meshes):
    id = 'element_' + str(i)
    compas_mesh_OCF = compas_mesh.transformed(T)
    cm_OFC = CollisionMesh(compas_mesh_OCF, id)
    cms_OCF.append(cm_OFC)


if scene:
    #print cms_OCF
    if add:
        for cm in cms_OCF:
            scene.add_collision_mesh(cm)
            #scene.cm.append(cm)
    if remove:
        for cm in cms_OCF:
            print cm.id
            scene.remove_collision_mesh(cm.id)
            #scene.cm.remove(scene.cm.id)
# ---------- end collision_3 ----------
panel_15 = Panel(collision_3.out)

# ----
# Attach an collision object
# Select link name to attach
# Select the links the object is allowed to touch
number_slider_3 = Slider(7, range=0..7)
idxs = Data([3, 4, 5, 6, 7])
py_7 = PythonScript(robot=robot, idx=number_slider_3)  # -> link_name; inputs idx: Int32
# ---------- py_7: Python ----------
if robot:
    link_names = robot.get_link_names()
    #print link_names
    link_name = link_names[idx]
# ---------- end py_7 ----------
panel_16 = Panel(py_7)
py_8 = PythonScript(robot=robot, idxs=idxs)  # -> touch_links; inputs idxs: list of Int32
# ---------- py_8: Python ----------
if robot:
    link_names = robot.get_link_names()
    touch_links = [link_names[i] for i in idxs]
# ---------- end py_8 ----------
panel_17 = Panel(py_8)
scale_2 = BooleanToggle(False)
remove_3 = Button()
add_3 = Button()
attached = PythonScript(
    scene=scene,
    compas_mesh=python.compas_mesh,
    scale=scale_2,
    id="tip",
    link_name=py_7,
    touch_links=py_8,
    add=add_3,
    remove=remove_3)  # -> acm, out; inputs touch_links: list
# ---------- attached: Python ----------
from compas_fab.robots import CollisionMesh
from compas_fab.robots import AttachedCollisionMesh

cm = CollisionMesh(compas_mesh, id)
acm = AttachedCollisionMesh(cm, link_name, touch_links)

if scene:
    if add:
        scene.add_attached_collision_mesh(acm, scale)
        scene.acm.append(acm)
    if remove:
        scene.remove_attached_collision_mesh(id)
        scene.remove_collision_mesh(id)
        scene.acm.remove(scene.acm[-1])
# ---------- end attached ----------

# ----
# Export .json
export = Button()
export_2 = Button()
# phone
# robot
export_3 = PythonScript(DATA=py_3.DATA, assembly=aggregate_2.assembly, export_to_json=export, export_to_json_unity=export_2)
# ---------- export_3: Python ----------
import os
from compas.datastructures.mesh import mesh_quads_to_triangles
from compas.datastructures.mesh import mesh_unify_cycles

if export_to_json:
    filename = "equilibrium_50_4p_3.json"
    PATH = os.path.join(DATA, "assembly", filename)
    
    # the assembly has to be serialized such that it can be called from CPython, True to enable pretty print
    assembly.to_json(PATH, True)
    

if export_to_json_unity:
    
    for key, e in assembly.elements():
    
        #convert to trimesh
        mesh_quads_to_triangles(e._mesh, check_angles=False)
        #mesh_unify_cycles(e._mesh)
        #print e._mesh.faces
        #print e._mesh.face_vertices(list(e._mesh.faces())[0])

    filename = "unity_assembly_test.json"
    PATH = os.path.join(DATA, "assembly", filename)
    assembly.to_json(PATH)
# ---------- end export_3 ----------

# ----
# Settings
rob2_2 = Slider(113, range=-180..180)
rob1_2 = BooleanToggle(False)
rob2_3 = BooleanToggle(True)
rob1_3 = Slider(180, range=-180..180)
python_4 = GhPythonScript(
    robot=robot,
    robot_nr=list_5,
    element=assembly_viz.elem_option_robot,
    rotation_angle1=rob1_3,
    rotation_angle2=rob2_2,
    flip1=rob1_2,
    flip2=rob2_3)  # -> out, start_configuration, free_move_configuration, picking_plane_WCF, placing_plane_WCF, picking_plane_safe_WCF, placing_plane_safe_WCF
# ---------- python_4: Python ----------
import math
from compas.geometry import Frame, Transformation, Translation
from compas_ghpython import draw_frame
from compas_fab.robots import Configuration
import Rhino.Geometry as rg



#if element:
picking_frame_WCF = robot.get_picking_frame()
picking_plane_WCF = draw_frame(picking_frame_WCF)

placing_frame_WCF = element.tool_frame

if robot_nr == 0:
    rotation_angle = rotation_angle1
    flip = flip1

else:
    rotation_angle = rotation_angle2
    flip = flip2

T = Translation.from_vector(placing_frame_WCF.zaxis*-0.008)
#T = Translation.from_vector(placing_frame_WCF.zaxis*0)
placing_frame_WCF.transform(T)

placing_plane_WCF = draw_frame(placing_frame_WCF)
placing_plane_WCF.Rotate(math.radians(rotation_angle), placing_plane_WCF.XAxis)


if flip:
    placing_plane_WCF.Rotate(math.radians(180), placing_plane_WCF.ZAxis)


picking_plane_safe_WCF = rg.Plane(picking_plane_WCF)
picking_plane_safe_WCF.Translate(picking_plane_WCF.ZAxis*-0.20)

placing_plane_safe_WCF = rg.Plane(placing_plane_WCF)
placing_plane_safe_WCF.Translate(placing_plane_WCF.ZAxis*-0.15)
#placing_plane_safe_WCF.Translate(placing_plane_safe_WCF.XAxis*0.2)

start_configuration = Configuration((-1.804, -1.021, 2.435, -2.985, -1.571, -2.572), (0, 0, 0, 0, 0, 0), ('shoulder_pan_joint', 'shoulder_lift_joint', 'elbow_joint', 'wrist_1_joint', 'wrist_2_joint', 'wrist_3_joint'))
# ---------- end python_4 ----------

py_9 = PythonScript(robot=robot)  # -> configuration
# ---------- py_9: Python ----------
from compas_fab.robots import Configuration

if robot:
    types = robot.get_configurable_joint_types()
    values = [0] * len(types)
    configuration = Configuration(values, types)
    print configuration
    print robot.get_configurable_joint_names()
# ---------- end py_9 ----------
start_configuration = Data(forward_kinematics)
list_9 = ValueList({"start": 0, "end": 1, "placing": 2}, selected="placing")
list_10 = ValueList({"0", "1"}, selected="0")
filter_3 = StreamFilter(Gate=list_10, Stream0=start_configuration, Stream1=py_9)
filter_4 = StreamFilter(
    Gate=list_9,
    Stream0=python_4.picking_plane_safe_WCF,
    Stream1=python_4.placing_plane_safe_WCF,
    Stream2=python_4.placing_plane_WCF)
inverse = PythonScript(robot=robot, group=main_planning_group, start_configuration=filter_3, plane=filter_4, compute=Toggle(True))  # -> out, configuration
# ---------- inverse: Python ----------
import scriptcontext as sc
import logging
import math

from compas.geometry import Frame

from compas_fab.backends.ros import RosError
from compas_fab.robots import Configuration

LOGGER = logging.getLogger('roslibpy')

frame_WCF = Frame(plane.Origin, plane.XAxis, plane.YAxis)
frame_OCF = robot.to_local_coordinates_origin(frame_WCF) # express within the robot frame
if robot.attached_tool:
    frame_OCF = robot.from_tcf_to_t0cf([frame_OCF])[0]

if robot:
    if robot.client and compute:
        if robot.client.is_connected:
            configuration = robot.inverse_kinematics(frame_OCF, start_configuration, group)
            print(configuration)
        else:
            print("Robot is not connected")

###
for i,v in enumerate(configuration.joint_values):
    
    if v>math.pi:
        v-=2*math.pi
    if v<-math.pi:
        v+=2*math.pi
    configuration.joint_values[i]=v
print configuration
# ---------- end inverse ----------
panel_18 = Panel(inverse.out)

# ----
# Move Cartesian
clear_2 = Button()
add_4 = Button()
crv = Curve(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)
list_11 = ValueList({"send all positions": 0, "send only one position": 1, "from inverse": 2}, selected="send all positions")
idx = Slider(0, range=0..100)
hframes = HorizontalFrames(Curve=crv, Count=10)  # -> Frames, Parameters
rec_car = PythonScript(rec=add_4, clear=clear_2)  # -> rec; same code as rec
item = ListItem(List=python_4.start_configuration, Index=idx, Wrap=True)
filter_5 = StreamFilter(Gate=list_11, Stream0=hframes.Frames, Stream1=item, Stream2=rec_car)
radius = Slider(0.5, range=0..0.5)
movel = PythonScript(planes_WCS=filter_5, velocity=Slider(0.075, range=0..0.5), radius=radius)  # -> urscript; inputs planes_WCS: list
# ---------- movel: Python ----------
import Rhino.Geometry as rg
from compas.geometry import Frame
from compas.geometry import Transformation, Rotation
from compas_ghpython import draw_frame
from compas_fab.robots import robot
from ur_fabrication_control import direct_control 
import math

from scriptcontext import sticky as st
from ur_fabrication_control.direct_control import URScript

robot = st["robot"]

# retrieve the current tool frame in axis angle format
if robot.attached_tool:
    tool_angle_axis = list(robot.attached_tool.frame.point) + list(robot.attached_tool.frame.axis_angle_vector)
else:
    tool0_frame = Frame([0, 0, 0], [1, 0, 0], [0, 1, 0])
    tool_angle_axis = list(tool0_frame.point) + list(tool0_frame.axis_angle_vector)

frames_RCS = []
for plane_WCS in planes_WCS:
    frame_WCS = Frame(plane_WCS.Origin, plane_WCS.XAxis, plane_WCS.YAxis)
    frame_RCS = robot.to_local_coordinates(frame_WCS)
    frames_RCS.append(frame_RCS)

urscript = URScript()
urscript.start()
urscript.moves_linear(frames_RCS, velocity, radius)
urscript.end()

urscript = urscript.generate()

print(urscript)
# ---------- end movel ----------
send_5 = Button()
send_6 = GhPythonScript(urscript=movel, send=send_5)  # -> out; inputs send: Boolean; same code as send_2

# ----
# Move Joints
idx_2 = Slider(0, range=0..100)
clear_3 = Button()
add_5 = Button()
rec_joints = PythonScript(msg=pose_2.configuration, rec=add_5, clear=clear_3)  # -> rec
# ---------- rec_joints: Python ----------
from scriptcontext import sticky as st

guid = str(ghenv.Component.InstanceGuid)
recorded_key =  "recorded_" + guid
just_cleared_key = "just_cleared_" + guid


if recorded_key not in st:
    st[recorded_key] = []

if just_cleared_key not in st:
    st[just_cleared_key] = False

if clear:
    st[recorded_key] = []
    st[just_cleared_key] = True
else:
    if msg != [None] and not st[just_cleared_key] and rec:
        st[recorded_key].append(msg)
    st[just_cleared_key] = False
        


rec = st[recorded_key]

print rec
# ---------- end rec_joints ----------
list_12 = ValueList({"send all positions": 0, "send only one position": 1, "from selected": 2}, selected="from selected")
send_7 = Button()

# ----
# 2. 'Move' free-space motion
# If you specify the tolerance vector with [360, 1, 1], it means that
#     the frame's y-axis and z-axis are allowed to rotate about the x-axis by an
#     angle of 360 degrees, whereas the x-axis can only change 1 degree.
# TODO Example:
# Add path constraints
number_slider_4 = Slider(1, range=1..360)
group = Data(main_planning_group)
list_13 = ValueList({"don't use attached collision mesh": 0, "use attached collision mesh": 1}, selected="use attached collision mesh")
python_5 = PythonScript(
    robot=robot,
    group=group,
    goal_plane=python_4.placing_plane_safe_WCF,
    tolerance_position=Slider(0.001, range=0..0.001),
    tolerance_xaxis_deg=Slider(1, range=1..360),
    tolerance_yaxis_deg=number_slider_4,
    tolerance_zaxis_deg=Slider(1, range=1..360))  # -> goal_constraints
# ---------- python_5: Python ----------
import math
from compas.geometry import Frame

frame_WCF = Frame(goal_plane.Origin, goal_plane.XAxis, goal_plane.YAxis)
frame_OCF = robot.to_local_coordinates_origin(frame_WCF)

if robot.attached_tool:
    frame_OCF = robot.from_tcf_to_t0cf([frame_OCF])[0]

tolerances_axes = [math.radians(tolerance_xaxis_deg), math.radians(tolerance_yaxis_deg), math.radians(tolerance_zaxis_deg)]

if robot:
    goal_constraints = robot.constraints_from_frame(frame_OCF, tolerance_position, tolerances_axes, group)
# ---------- end python_5 ----------
py_10 = PythonScript(configurations=forward_kinematics)  # -> last_configuration; inputs configurations: list
# ---------- py_10: Python ----------
from compas_fab.robots import Configuration

if list(configurations) != [None]:
    last_configuration = Configuration(configurations[-1].joint_values, configurations[-1].joint_types)
    print last_configuration
# ---------- end py_10 ----------
start = Button()
reset = Button()
step = Button()
compute = Button()
list_14 = ValueList({"RRT", "RRT*": "RRTStar", "EST", "PRM": "RPM", "PRM*": "RPMStar", "SPARS"}, selected="RRT")
filter_6 = StreamFilter(Gate=list_13, Stream1=attached.acm)
plan_motion = PythonScript(
    robot=robot,
    group=group,
    start_configuration=python_4.start_configuration,
    goal_constraints=python_5,
    planner_id=list_14,
    attached_collision_meshes=filter_6,
    compute=compute)  # -> out, trajectory; inputs goal_constraints: list, attached_collision_meshes: list
# ---------- plan_motion: Python ----------
"""Calculates a motion path.
    Inputs:
        robot: The robot
        group: str, optional
            The planning group used for calculation. Defaults to the robot's
            main planning group.
        start_configuration: :class:`compas_fab.robots.Configuration`, optional
            The robot's full configuration, i.e. values for all configurable
            joints of the entire robot cell, at the starting position. Defaults
            to the all-zero configuration.
        goal_constraints: list of :class:`compas_fab.robots.Constraint`
            The goal to be achieved, defined in a set of constraints.
            Constraints can be very specific, for example defining value domains
            for each joint, such that the goal configuration is included,
            or defining a volume in space, to which a specific robot link (e.g.
            the end-effector) is required to move to.
        planner_id: str
            The name of the algorithm used for path planning. Defaults to 'RRT'.
        attached_collision_meshes: list of :class:`compas_fab.robots.AttachedCollisionMesh`
            Defaults to None.
        compute: bool
            Press to calculate solution.
    Output:
        :class:`compas_fab.robots.JointTrajectory`
            The calculated trajectory.
"""
from __future__ import print_function
import logging
import scriptcontext as sc

guid = str(ghenv.Component.InstanceGuid)
response_key = "response_" + guid
if response_key not in sc.sticky:
    sc.sticky[response_key] = None

LOGGER = logging.getLogger('roslibpy')

if robot and robot.client and start_configuration and compute:
    if robot.client.is_connected:
        
        sc.sticky[response_key] = robot.plan_motion(goal_constraints,
                                                    start_configuration,
                                                    group,
                                                    options={
                                                        'planner_id': str(planner_id),
                                                        'attached_collision_meshes': list(attached_collision_meshes),
                                                    })
    else:
        print("Robot client is not connected.")

trajectory = sc.sticky[response_key]
# ---------- end plan_motion ----------
vis = PythonScript(response=plan_motion.trajectory)  # -> P, V, A, time
# ---------- vis: Python ----------
from compas_ghpython import list_to_ghtree

if response:

    positions = []
    velocities = []
    accelerations = []
    time_from_start = []

    for p in response.points:
        positions.append(p.positions)
        velocities.append(p.velocities)
        accelerations.append(p.accelerations)
        time_from_start.append(p.time_from_start.seconds)

    P = list_to_ghtree(list(zip(*positions)))
    V = list_to_ghtree(list(zip(*velocities)))
    A = list_to_ghtree(list(zip(*accelerations)))

    time = time_from_start[-1]
    print time
# ---------- end vis ----------
time_s = Panel(vis.time)
prismatic = QuickGraph(vis.P, SortOrder=0)
panel_19 = Panel(plan_motion.out)
panel_20 = Panel("positions")
graph = QuickGraph(vis.V, SortOrder=0)
graph_2 = QuickGraph(vis.A, SortOrder=0)
panel_21 = Panel("velocities")
panel_22 = Panel("accelerations")

list_15 = ValueList({"0 forward_kinematics": 0, "1 inverse_kinematics": 1, "2 free-space motion": 3, "3 'pick and place'": 4}, selected="0 forward_kinematics")

start_2 = Button()
reset_2 = Button()
stop_3 = Button()

# ----
# Generate and send robot routines
list_16 = ValueList({"1. pick_place_hold": 0, "2. release_and_move_to_home": 1, "3. movel_to_placing_frame": 2, "4. movel_to_placing_frame_safe": 3, "5. movel_to_picking_frame": 4, "6. movel_to_picking_frame_safe": 5}, selected="1. pick_place_hold")
radius_2 = Slider(0.01, range=0..0.1)
send_8 = Button()

# ----
# Visualisation
# Select configuration input: from fk, ik, path, or from real robot
show_end_effector_frame = BooleanToggle(True)
show_picking_frame = BooleanToggle(False)
show_origin_frame = BooleanToggle(False)
show_base_frame = BooleanToggle(False)
show_collision = BooleanToggle(False)
show_in_world = BooleanToggle(True)
show_frames = BooleanToggle(False)
show_visual = BooleanToggle(True)
show_bcm = BooleanToggle(False)
show_acm = BooleanToggle(True)
show_cm = BooleanToggle(False)

py_11 = PythonScript(robot=robot, group=group, trajectory=plan_motion.trajectory, in_world=show_in_world)  # -> start_configuration, configurations, full_configurations, frames, planes
# ---------- py_11: Python ----------
from compas.geometry import Transformation
from compas.geometry import Frame
from compas_ghpython import draw_frame
from compas_rhino.conversions import xform_to_rhino

import ghpythonlib.components as ghcomp
import math

joint_positions = []

if in_world:
    T = robot.transformation_OCF_WCF()
else:
    T = Transformation()


if trajectory:
    configurations = trajectory.points
    start_configuration = trajectory.start_configuration
    fraction = trajectory.fraction
    time = trajectory.time_from_start
    full_configurations = [robot.merge_group_with_full_configuration(c, trajectory.start_configuration, group) for c in configurations]
    frames = [robot.forward_kinematics(c, group, options=dict(solver='model')) for c in full_configurations]
    if robot.attached_tool:
        frames = [robot.from_t0cf_to_tcf([frame])[0] for frame in frames]
        
    planes = [draw_frame(frame) for frame in frames]
    planes = ghcomp.Transform(planes, xform_to_rhino(T))
    
    print configurations
    print full_configurations[0]


#for c in configurations:
#    #print c
#    for i,v in enumerate(c.joint_values):
#        
#        if v>math.pi:
#            v-=2*math.pi
#        if v<-math.pi:
#            v+=2*math.pi
#        c.joint_values[i]=v
#print configurations
# ---------- end py_11 ----------
pline = PolyLine(Vertices=py_11.planes, Closed=False)
counter = CountThroughList(L=py_11.full_configurations, start=start, step=step, reset=reset)  # -> item; inputs L: list, start: Boolean
# ---------- counter: Python ----------
from scriptcontext import sticky as st
from compas_ghpython.utilities import update_component


interval = 1

# store data in component
guid = str(ghenv.Component.InstanceGuid)
counter_key = "counter_" + guid
running_key = "running_" + guid

if counter_key not in st:
    st[counter_key] = 0

if running_key not in st:
    st[running_key] = False

if start:
    st[running_key] = True

if step:
    if st[counter_key] < len(L) - 1:
        st[counter_key] += 1
    
if len(L):
    item = L[st[counter_key]]

if st[running_key]:
    if st[counter_key] < len(L) - 1:
        st[counter_key] += 1
        update_component(ghenv, interval)
    else:
        st[counter_key] = 0
        st[running_key] = False
# ---------- end counter ----------
preview_5 = CustomPreview(Geometry=pline, Material=ColourSwatch(SwatchColor=RGB(139, 59, 161)))

python_6 = PythonScript(trajectory2=py_11.configurations)  # -> trajectory; inputs trajectory1: list, trajectory2: list, trajectory3: list
# ---------- python_6: Python ----------
trajectory = []

if trajectory1 != [None]:
    trajectory += trajectory1

if trajectory2 != [None]:
    trajectory += trajectory2

if trajectory3 != [None]:
    trajectory += trajectory3
# ---------- end python_6 ----------
counter_2 = CountThroughList(L=python_6, start=start_2, stop=stop_3, step=False, reset=reset_2, interval=50)  # -> item; inputs L: list, start: Boolean, stop: Boolean
# ---------- counter_2: Python ----------
from scriptcontext import sticky as st
from compas_ghpython.utilities import update_component

if not interval:
    interval = 5

# store data in component
guid = str(ghenv.Component.InstanceGuid)
counter_key = "counter_" + guid
running_key = "running_" + guid

if counter_key not in st:
    st[counter_key] = 0

if running_key not in st:
    st[running_key] = False

if start:
    st[running_key] = True

if stop:
    st[running_key] = False

if step:
    if st[counter_key] < len(L) - 1:
        st[counter_key] += 1

if back:
    if st[counter_key] > 1:
        st[counter_key] -= 1

if len(L):
    item = L[st[counter_key]]

if st[running_key]:
    if st[counter_key] < len(L) - 1:
        st[counter_key] += 1
        update_component(ghenv, interval)
    else:
        st[counter_key] = 0
        st[running_key] = False


print interval
# ---------- end counter_2 ----------

filter_7 = StreamFilter(Gate=list_15, Stream0=forward_kinematics, Stream1=inverse.configuration, Stream2=counter, Stream3=counter_2)

item_2 = ListItem(List=py_11.full_configurations, Index=idx_2, Wrap=True)
filter_8 = StreamFilter(Gate=list_12, Stream0=config.joint_configs, Stream1=item_2, Stream2=filter_7)
movej = PythonScript(joint_configurations=filter_8, velocity=Slider(0.053, range=0..0.5))  # -> urscript, values; inputs joint_configurations: list
# ---------- movej: Python ----------
from ur_fabrication_control.direct_control import URScript
import math


print joint_configurations


"""
for c in joint_configurations:
    #print c
    for i,v in enumerate(c.joint_values):
        
        if v>math.pi:
            v-=2*math.pi
        if v<-math.pi:
            v+=2*math.pi
        c.joint_values[i]=v
print joint_configurations


joint_values = joint_configurations[0].joint_values

print([math.degrees(v) for v in joint_values])
"""


urscript = URScript()
urscript.start()
for jc in joint_configurations:
    urscript.move_joint(jc, velocity)
urscript.end()

urscript = urscript.generate()

print(urscript)
# ---------- end movej ----------
send_9 = GhPythonScript(urscript=movej.urscript, send=send_7)  # -> out; inputs send: Boolean
# ---------- send_9: Python ----------
from scriptcontext import sticky as st
from ur_fabrication_control.direct_control import send_script

ur_ip = st["ur_ip"]
ur_port = st["ur_port"]

print urscript

if send:
    send_script(urscript, ur_ip, ur_port)
# ---------- end send_9 ----------

cdf_ur_script = PythonScript(
    robot=robot,
    start_configuration=python_4.start_configuration,
    picking_plane_WCF=python_4.picking_plane_WCF,
    placing_plane_WCF=python_4.placing_plane_WCF,
    picking_plane_safe_WCF=python_4.picking_plane_safe_WCF,
    placing_plane_safe_WCF=python_4.placing_plane_safe_WCF,
    placing_configurations=python_3.placing_configurations_rob,
    routine=list_16,
    velocity=Slider(0.1, range=0..0.1),
    radius=radius_2,
    in_world=show_in_world)  # -> out, urscript; inputs placing_configurations: list, routine: Int32
# ---------- cdf_ur_script: Python ----------
from ur_fabrication_control.direct_control import URScript
from ur_fabrication_control.direct_control.mixins import ParallelGripMixins

import math
from scriptcontext import sticky as st
import Rhino.Geometry as rg

from compas.geometry import Frame, Transformation


class URScript_RSRD(URScript, ParallelGripMixins):
    pass

tool_angle_axis = list(robot.attached_tool.frame.point) + list(robot.attached_tool.frame.axis_angle_vector)
sleep = 1.0

def plane_to_frame(plane_WCS):
    frame_WCS = Frame(plane_WCS.Origin, plane_WCS.XAxis, plane_WCS.YAxis)
    if in_world:
        T = robot.transformation_WCF_OCF()
    else:
        T = Transformation()
    frame_WCS.transform(T)
    return frame_WCS

# 
#traj_frames = []
#for plane in traj_planes_WCF:
#    traj_frames.append(plane_to_frame(plane))

reversed_joint_configs = placing_configurations[::-1]

#commands
picking_frame = plane_to_frame(picking_plane_WCF) 
placing_frame = plane_to_frame(placing_plane_WCF)
picking_frame_safe = plane_to_frame(picking_plane_safe_WCF)
placing_frame_safe = plane_to_frame(placing_plane_safe_WCF)


#placing_configuration.remove(placing_configuration[0])
#print len(placing_configuration)

if routine == 0:
    commands = URScript_RSRD()
    commands.start()
    commands.set_tcp(tool_angle_axis)
    commands.move_joint(start_configuration, velocity, radius)  
    commands.move_linear(picking_frame_safe, velocity, radius)
    commands.parallelgrip_open()    
    commands.add_line("\tsleep({})".format(sleep))                   
    commands.move_linear(picking_frame, velocity, radius=0) 
    commands.parallelgrip_close() 
    commands.add_line("\tsleep({})".format(sleep))
    commands.move_linear(picking_frame_safe, velocity, radius)
    commands.moves_joint([joint_move_configuration for joint_move_configuration in placing_configurations], velocity+0.05, radius) 
    commands.move_linear(placing_frame_safe, radius) 
    commands.move_linear(placing_frame, velocity, radius=0)
    commands.end()     

# release and move to home
if routine == 1:
    commands = URScript_RSRD()
    commands.start()
    commands.set_tcp(tool_angle_axis)
    commands.parallelgrip_open()  
    commands.add_line("\tsleep({})".format(sleep))
    commands.move_linear(placing_frame_safe, velocity)
    #commands.parallelgrip_close() 
    commands.moves_joint([joint_move_configuration for joint_move_configuration in reversed_joint_configs], velocity, radius) 
    commands.move_linear(picking_frame_safe, velocity, radius)
    commands.end()

# move to placing_frame
if routine == 2:
    commands = URScript_RSRD()
    commands.start()
    commands.set_tcp(tool_angle_axis)
    commands.move_linear(placing_frame, velocity, radius=0)
    commands.end()      
    
# move to placing_frame_safe
if routine == 3:
    commands = URScript_RSRD()
    commands.start()
    commands.set_tcp(tool_angle_axis)
    commands.move_linear(placing_frame_safe, velocity, radius=0)
    commands.end()    

# move to picking_frame
if routine == 4:
    commands = URScript_RSRD()
    commands.start()
    commands.set_tcp(tool_angle_axis)
    commands.move_linear(picking_frame, velocity, radius=0)
    commands.end()      
    
# move to picking_frame_safe
if routine == 5:
    commands = URScript_RSRD()
    commands.start()
    commands.set_tcp(tool_angle_axis)
    commands.move_linear(picking_frame_safe, velocity, radius=0)
    commands.end() 
    
urscript = commands.generate()

print(urscript)
# ---------- end cdf_ur_script ----------
send_10 = GhPythonScript(urscript=cdf_ur_script.urscript, send=send_8)  # -> out; inputs send: Boolean
# ---------- send_10: Python ----------
from scriptcontext import sticky as st
from ur_fabrication_control.direct_control import send_script

ur_ip = st["ur_ip"]
ur_port = st["ur_port"]

print urscript
if send:
    send_script(urscript, ur_ip, ur_port)
# ---------- end send_10 ----------
panel_23 = Panel(send_10)

visualize = PythonScript(
    robot=robot,
    group=main_planning_group,
    scene=scene,
    configuration=filter_7,
    redraw=[py_6.a, collision_3.a, collision_2.a, py_5],
    show_visual=show_visual,
    show_collision=show_collision,
    show_end_effector_frame=show_end_effector_frame,
    show_robot_frames=show_frames,
    show_base_frame=show_base_frame,
    show_origin_frame=show_origin_frame,
    show_picking_frame=show_picking_frame,
    show_cm=show_cm,
    show_bcm=show_bcm,
    show_acm=show_acm,
    in_world=show_in_world)  # -> out, robot, visual, collision_meshes_robot, collision_mesh_base, collision_meshes_obstacles, collision_meshes_attached, frames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; inputs redraw: list, attached_collision_meshes: list
# ---------- visualize: Python ----------
from compas.geometry import Vector
from compas.geometry import Point
from compas.geometry import Transformation
from compas.geometry import Frame
from compas_ghpython.artists import MeshArtist
from compas_fab.robots import Configuration

import ghpythonlib.components as ghcomp
from compas_rhino.conversions import xform_to_rhino


if robot and configuration:
    
    robot.update(configuration, visual=show_visual, collision=show_collision)
    if in_world:
        T = robot.transformation_OCF_WCF()
    else:
        T = Transformation()

    if show_visual:
        visual = robot.artist.draw_visual()
        visual += robot.base_geometry
        visual = ghcomp.Transform(visual, xform_to_rhino(T))

    if show_collision:
        collision_meshes_robot = robot.artist.draw_collision()
        collision_meshes_robot = ghcomp.Transform(collision_meshes_robot, xform_to_rhino(T))
    
    if show_end_effector_frame:
        ee_frame = robot.get_end_effector_frame(group=group, full_configuration=configuration)
        if robot.attached_tool:
            ee_frame = robot.from_t0cf_to_tcf([ee_frame])[0]
        ee_frame = ee_frame.transformed(T)
    
    if show_robot_frames:
        frames = robot.transformed_frames(configuration)
        [f.transform(T) for f in frames]

    if show_base_frame:
        base_frame = robot.get_base_frame(group, configuration)
        base_frame = base_frame.transformed(T)
    
    if show_origin_frame:
        origin_frame = robot.get_origin_frame()

    if show_picking_frame:
        picking_frame = robot.get_picking_frame()
        #picking_frame = picking_frame.transformed(T)
    
    if show_cm:
        M = []
        for cm in scene.cm:
            mesh = cm.mesh
            M.append(MeshArtist(mesh).draw())
        collision_meshes_obstacles = M
        collision_meshes_obstacles = ghcomp.Transform(collision_meshes_obstacles, xform_to_rhino(T))
    
    if show_bcm:
        if scene.bcm:
            collision_mesh_base = MeshArtist(scene.bcm.mesh).draw()
            collision_mesh_base = ghcomp.Transform(collision_mesh_base, xform_to_rhino(T))
    
    if show_acm:
        M = []
        for acm in scene.acm:
            ee_frame = robot.get_end_effector_frame(group=group, full_configuration=configuration)
            if robot.attached_tool:
                ee_frame = robot.from_t0cf_to_tcf([ee_frame])[0]
            T_ee = Transformation.from_frame_to_frame(Frame.worldXY(), ee_frame)
            mesh = acm.collision_mesh.mesh.transformed(T_ee)
            M.append(MeshArtist(mesh).draw())
            
        collision_meshes_attached = M
        collision_meshes_attached = ghcomp.Transform(collision_meshes_attached, xform_to_rhino(T))
# ---------- end visualize ----------
draw_2 = GhPythonScript(
    frames=[visualize.frames, visualize.ee_frame, visualize.base_frame, visualize.origin_frame, visualize.picking_frame],
    scale=Slider(0.2, range=0..1))  # -> P, V, C, W; inputs frames: list
# ---------- draw_2: Python ----------
from System.Drawing import Color
from compas_ghpython.utilities import draw_frame

red = Color.FromArgb(255, 0, 0)
green = Color.FromArgb(0, 255, 0)
blue = Color.FromArgb(0, 0, 255)

P = []
V = []
C = []

scale = float(scale)

for frame in frames:
    if not frame:
        continue
    plane = draw_frame(frame)
    P += [plane.Origin] * 3
    V.append(plane.XAxis * scale)
    V.append(plane.YAxis * scale)
    V.append(plane.ZAxis * scale)
    C += [red, green, blue]

W = 3
# ---------- end draw_2 ----------
geo = Geometry(visualize.collision_meshes_robot)
geo_2 = Geometry(visualize.collision_mesh_base)
geo_3 = Geometry(visualize.collision_meshes_obstacles)
geo_4 = Geometry(visualize.collision_meshes_attached)
geo_5 = Geometry(visualize.visual)
preview_6 = CustomPreview(Geometry=geo_5, Shader=ColourSwatch(SwatchColor=RGB(105, 105, 105)))
preview_7 = CustomPreview(Geometry=[geo, geo_3, geo_4, geo_2], Shader=ColourSwatch(SwatchColor=RGB(108, 79, 255)))
vdisex = VectorDisplayEx(Point=draw_2.P, Vector=draw_2.V, Colour=draw_2.C, Width=draw_2.W)
