# Grasshopper definition ex_base_map_reuleax_reachability [Feb-02 '24, 2011(1)].ghx (Grasshopper 1.0.7)
# plug-ins: Pufferfish, LunchBox

number_slider = Slider(10, range=0..10)  # disabled
number_slider_2 = Slider(0.2, range=0..1)  # disabled
square = Square(Plane=PlaneXY(0, 0, 0), Size=1, ExtentX=5, ExtentY=5)  # -> Cells, Points; disabled
series = Series(Start=0, Step=number_slider_2, Count=number_slider)  # disabled
construct_point = ConstructPoint(XCoordinate=graft(series), YCoordinate=series, ZCoordinate=0)  # disabled
grid_structure = GridStructure(UDivisions=10, VDivisions=10)  # -> StructureLines, StructureNodes; disabled

# ---- group: Load map
value_list = ValueList({"rbvogui_xl_ur10e_and_liftkit_0_4": "rbvogui_xl_ur10e_and_liftkit_0_4.json"}, selected="rbvogui_xl_ur10e_and_liftkit_0_4")
# Reachabilitymap from JSON
py = PythonScript()  # -> DATA
# ---------- py: Python ----------
import os

HERE = os.path.dirname(ghdoc.Path)
DATA = os.path.abspath(os.path.join(HERE, "..", "data"))
print(DATA)
# ---------- end py ----------
file = GhPythonScript(DATA=py, file=value_list)  # -> filepath
# ---------- file: Python ----------
__author__ = "Gido"
__version__ = "2023.04.18"

import os
import rhinoscriptsyntax as rs

filepath = os.path.join(DATA, file)
print filepath
# ---------- end file ----------
from_json = GhPythonScript(filepath=file, load=Toggle(True))  # -> out, reachabilitymap
# ---------- from_json: Python ----------
__author__ = "Gido"
__version__ = "2023.04.18"

import rhinoscriptsyntax as rs
from cdf_2023.robot import ReuleauxReachability

if load:
    reachabilitymap = ReuleauxReachability.from_json(filepath)
# ---------- end from_json ----------

# ---- group: moving area of robot
rectangle = Rectangle({Plane=PlaneXY(-0.02476985265, -0.02581318351, 0), Size=Domain2(u=-2.093293587..2.093293587, v=-1.886502282..1.886502282)})
number_slider_3 = Slider(5, range=0..10)
number_slider_4 = Slider(5, range=0..10)
boundary_surfaces = BoundarySurfaces(Edges=rectangle)
divide_surface = DivideSurface(Surface=boundary_surfaces, UCount=10, VCount=10)  # -> Points, Normals, Parameters
plane = Plane(flatten(divide_surface.Points))

# ---- group: Point to grab
point = Point(<point referenced from the Rhino model>)

# ----
surface = Surface(<surface referenced from the Rhino model>)

# ---- group: Points of structure to avoid
brep = Brep([<brep referenced from the Rhino model> x2])
mesh = Mesh(brep)
divide_surface_2 = DivideSurface(Surface=surface, UCount=10, VCount=10)  # -> Points, Normals, Parameters
deconstruct_mesh = DeconstructMesh(Mesh=mesh)  # -> Vertices, Faces, Colours, Normals
point_2 = Point(flatten([divide_surface_2.Points, deconstruct_mesh.Vertices]))

# ----
mesh_join = MeshJoin(Meshes=mesh)
ghpython_script = GhPythonScript(input_mesh=mesh_join)  # -> out, a; inputs input_mesh: Mesh; disabled
# ---------- ghpython_script: Python ----------
__author__ = "lovek"
__version__ = "2024.02.02"

import rhinoscriptsyntax as rs
#from compas.datastructures.mesh.mesh.Mesh import to_points

from compas_rhino.conversions import RhinoSurface, RhinoMesh

#joint_rhino_mesh = RhinoMesh.from_geometry(joint_geo)
#joint_compas_mesh = joint_rhino_mesh.to_compas()

input_mesh = RhinoMesh.from_geometry(input_mesh)
compas_mesh = input_mesh.to_compas()
print compas_mesh.to_vertices_and_faces()
print dir(compas_mesh)
print type(compas_mesh)
#print compas_mesh.to_points()
#to_points
# ---------- end ghpython_script ----------
surface_closest_point = SurfaceClosestPoint(Point=point, Surface=surface)  # -> Point, UVPoint, Distance
evaluate_surface = EvaluateSurface(Surface=surface, Point=surface_closest_point.UVPoint)  # -> Point, Normal, UDirection, VDirection, Frame

# ---- group: Visualization
visualize_map = GhPythonScript(reachabilitymap=from_json.reachabilitymap)  # -> out, reachabilitymap, sphere_points, resolution, reachability_index
# ---------- visualize_map: Python ----------
__author__ = "Gido"
__version__ = "2023.04.17"

import rhinoscriptsyntax as rs

from compas.geometry import Frame
from compas_ghpython.utilities import draw_frame


sphere_points = []
reachability_index = []
for point, ri in reachabilitymap.spheres_data(yield_ri=True):
    sphere_points.append(draw_frame(Frame(point, [1,0,0], [0,1,0])))
    reachability_index.append(ri)
#sphere_points = draw_frames(sphere_frames)
if reachabilitymap.resolution != 0:
    resolution = reachabilitymap.resolution
else:
    resolution = 0.1
# ---------- end visualize_map ----------
gradient = Gradient(
    LowerLimit=0,
    UpperLimit=100,
    Parameter=visualize_map.reachability_index,
    stops=[0: RGB(234, 38, 0), 0.25: RGB(234, 126, 0), 0.5: RGB(254, 244, 84), 0.75: RGB(173, 203, 249), 1: RGB(75, 107, 169)])
dot_display = DotDisplay(Point=visualize_map.sphere_points, Colour=gradient, Size=expr("x/5", visualize_map.resolution))

# ----
# ROS client
list = ValueList({"local": "127.0.0.1", "linux computer": "192.168.0.42", "linux eduroam": "10.181.95.254", "robot": "192.168.0.200"}, selected="local")
connect = BooleanToggle(True)
ros = ROSConnect(ip=list, port="9090", connect=connect)  # -> ros_client, is_connected; inputs port: Int32, connect: Boolean
#   port ip: The ip address ROS. Defaults to 127.0.0.1.
#   port port: The port of ROS. Defaults to 9090.
#   port connect: If True, connects to ROS. If False, disconnects from ROS. Defaults to False.
#   port ros_client: The ROS client.
#   port is_connected: True if connection established.
# ---------- ros: Python ----------
"""
Connect or disconnect to ROS.

COMPAS FAB v0.27.0
"""
from ghpythonlib.componentbase import executingcomponent as component
from scriptcontext import sticky as st

from compas_fab.backends import RosClient
from compas_fab.ghpython.components import create_id


class ROSConnect(component):
    def RunScript(self, ip, port, connect):
        ros_client = None

        ip = ip or '127.0.0.1'
        port = port or 9090

        key = create_id(self, 'ros_client')
        ros_client = st.get(key, None)

        if ros_client:
            st[key].close()
        if connect:
            st[key] = RosClient(ip, port)
            st[key].run(5)

        ros_client = st.get(key, None)
        is_connected = ros_client.is_connected if ros_client else False
        return (ros_client, is_connected)
# ---------- end ros ----------
panel = Panel(ros.is_connected)

reverse = Reverse(Vector=evaluate_surface.Normal)
vector_display = VectorDisplay(Anchor=surface_closest_point.Point, Vector=evaluate_surface.Normal)
point_3 = Point(evaluate_surface.Point)

plane_2 = Plane(PlaneXY(0.1801181693, -0.7807762412, 0))
# Your input here!
point_4 = Point(<point referenced from the Rhino model>)

plane_normal = PlaneNormal(Origin=point, ZAxis=reverse)

plane_3 = Plane()
point_5 = Point()

# ----
# Load robot from ROS
# Load robot from ROS
load = Button()
robot = ROSRobot(ros_client=ros.ros_client, load=load)  # -> mobile_robot; inputs load: Boolean
#   port ros_client: The ROS client.
#   port load: If True, loads the robot from ROS. Defaults to False.
# ---------- robot: Python ----------
"""
Load robot directly from ROS.

COMPAS FAB v0.27.0
"""
from mobile_robot_control.mobile_robot import MobileRobot
from mobile_robot_control.mobile_robot_client import MobileRobotClient

from compas_ghpython.artists import RobotModelArtist
from ghpythonlib.componentbase import executingcomponent as component
from scriptcontext import sticky as st

from compas_fab.ghpython.components import create_id


class ROSRobot(component):
    def RunScript(self, ros_client, prefix, load):
        key = create_id(self, 'robot')

        if ros_client and ros_client.is_connected and load:
            # Load URDF from ROS
            robot = ros_client.load_robot(
                    load_geometry=True, 
                    urdf_param_name= '{}/robot_description'.format(prefix),
                    srdf_param_name= '{}/robot_description_semantic'.format(prefix),
                    precision='12f')
            robot.artist = RobotModelArtist(robot.model)
            mobile_robot = MobileRobot(robot.model, robot.artist, robot.semantics, client=None, wheel_type="indoor")
            st[key] = mobile_robot

        mobile_robot = st.get(key, None)
        if mobile_robot:  # client sometimes need to be restarted, without needing to reload geometry
            mobile_robot.mobile_client = MobileRobotClient(ros_client)
            mobile_robot.client = ros_client
        return mobile_robot
# ---------- end robot ----------

# ----
# Array of positions
resolution = Slider(0.4, range=0..1)
ghpython_script_2 = GhPythonScript(
    goal_points=point,
    base_poses=plane,
    reuleaux_map=from_json.reachabilitymap,
    map_resolution=resolution,
    compute=Toggle(True))  # -> out, base_map; inputs goal_points: list of Point3d, base_poses: list
# ---------- ghpython_script_2: Python ----------
__author__ = "Gido"
__version__ = "2023.09.12"

import rhinoscriptsyntax as rs
from compas.geometry import Frame, Pointcloud
from cdf_2023.robot import BaseMap
from compas_ghpython.utilities import draw_points

if compute:
    base_map = BaseMap()
    goal_pointcloud = Pointcloud(goal_points)
    if reuleaux_map.resolution == 0:
        reuleaux_map.resolution = map_resolution
    for base_pose in base_poses:
        base_frame = Frame(base_pose.Origin, base_pose.XAxis, base_pose.YAxis)
        base_map.get_reuleaux_index_by_base_pose(base_frame, reuleaux_map, goal_pointcloud, None)
# ---------- end ghpython_script_2 ----------

# ----
# Single position
# Can be used with optimizers like galapagos!
resolution_2 = Slider(0.4, range=0..1)
# Base Map Reuleaux Calculation
boolean_toggle = BooleanToggle(True)
ghpython_script_3 = GhPythonScript(create=boolean_toggle)  # -> out, base_map
# ---------- ghpython_script_3: Python ----------
__author__ = "Gido"
__version__ = "2023.09.18"

import rhinoscriptsyntax as rs
from cdf_2023.robot import BaseMap

if create:
    base_map = BaseMap()
# ---------- end ghpython_script_3 ----------
ghpython_script_4 = GhPythonScript(
    base_map=ghpython_script_3.base_map,
    goal_points=point,
    base_pose=plane_2,
    reuleaux_map=from_json.reachabilitymap,
    map_resolution=resolution_2,
    compute=Toggle(True))  # -> out, base_map; inputs goal_points: list of Point3d
# ---------- ghpython_script_4: Python ----------
__author__ = "Gido"
__version__ = "2023.09.12"

import rhinoscriptsyntax as rs
from compas.geometry import Frame, Pointcloud
from cdf_2023.robot import BaseMap
from compas_ghpython.utilities import draw_points

#cpts = [pt for pt in points]
if compute:
    goal_pointcloud = Pointcloud(goal_points)
    if reuleaux_map.resolution == 0:
        reuleaux_map.resolution = map_resolution
    base_frame = Frame(base_pose.Origin, base_pose.XAxis, base_pose.YAxis)
    base_map.get_reuleaux_index_by_base_pose(base_frame, reuleaux_map, goal_pointcloud, None)
# ---------- end ghpython_script_4 ----------

list_2 = ValueList({"ur10e", "ur10e_and_liftkit"}, selected="ur10e")
rotate = Rotate(Angle=1.570796327, Plane=PlaneXY(0, 0, 0))  # -> Geometry, Transform
brep_2 = Brep(<brep referenced from the Rhino model>)
ab = Plane(Plane(origin=(-1.084170562, 0.7922380273, -0.01724155293), x=(-0.2489890089, -0.9684362534, -0.0116488869), y=(0.9684285526, -0.2491034178, 0.00967604469)))
aa = Plane(Plane(origin=(-1.953706358, -1.230419, -0.01535271743), x=(0.8419616606, 0.539506278, -0.005791206799), y=(-0.5395157985, 0.8419754709, -9.758253372e-05)))

# ---- group: All base poses
# Base Map Visualization
boolean_toggle_2 = BooleanToggle(True)
ghpython_script_5 = GhPythonScript(base_map=ghpython_script_2.base_map, show=boolean_toggle_2)  # -> out, planes, reuleaux_indices
# ---------- ghpython_script_5: Python ----------
__author__ = "Gido"
__version__ = "2023.09.12"

import rhinoscriptsyntax as rs
from compas_ghpython.utilities import draw_frame
from statistics import mean

planes = []
reuleaux_indices = []
if show:
    for node, data in base_map.base_map.nodes(data=True):
        planes.append(draw_frame(data['frame']))
        reuleaux_data = data['reuleaux_data']
        goal_ri_mean = mean(reuleaux_data['goal_reuleaux_index'])
        ri_mean = goal_ri_mean
        reuleaux_indices.append(ri_mean)
# ---------- end ghpython_script_5 ----------
bounds = Bounds(Numbers=ghpython_script_5.reuleaux_indices)
deconstruct_domain = DeconstructDomain(Domain=bounds)  # -> Start, End
gradient_2 = Gradient(
    LowerLimit=expr("x-1", deconstruct_domain.Start),
    UpperLimit=deconstruct_domain.End,
    Parameter=ghpython_script_5.reuleaux_indices,
    stops=[0.001: RGB(0, 0, 0), 0.276: RGB(254, 244, 84), 0.75: RGB(173, 203, 249), 1: RGB(75, 107, 169)])
dot_display_2 = DotDisplay(Point=ghpython_script_5.planes, Colour=gradient_2, Size=expr("x/10", Slider(0.75, range=0..1)))

# ----
shift_value = Slider(0, range=-0.25..0.25)
# Configuration
l = Slider(0, range=0..0.72)
plane_4 = Plane(plane_normal)
select_configuration_aa = Slider(0, range=0..7)
approach_plane_top = Plane(Plane(origin=(-1.187685767, -1.00513099, 2.409582425), x=(-0.02094047858, -0.5758988517, -0.8172527204), y=(0.06174631941, -0.8166164791, 0.5738683805)))  # disabled
approach_plane_left = Plane(Plane(origin=(-1.285048766, -1.395245102, 0.9388493092), x=(-0.368867444, 0.3715653368, -0.8519835733), y=(0.709678534, 0.7045256407, 0)))  # disabled
list_3 = ValueList({"ur10e", "ur10e_and_liftkit"}, selected="ur10e")
pln = Plane(Plane(origin=(1.221977133, 1.294710655, 1.014515308), x=(-0.9475576884, 0.3195482043, -0.004834489242), y=(0.3195383255, 0.9475694642, 0.002714584304)))  # disabled
point_6 = Point(point_2)

# ----
# Closeness penalty
penalty_factor = Slider(10, range=0..100)
minimum_distance = Slider(0.4, range=0..100)

# ---- group: Define distance and replace negative values
closest_point = ClosestPoint(Point=ghpython_script_5.planes, Cloud=point_6)  # -> ClosestPoint, CPIndex, Distance
smaller_than = SmallerThan(FirstNumber=closest_point.Distance, SecondNumber=minimum_distance)  # -> SmallerThan, OrEqualTo
dispatch = Dispatch(List=closest_point.Distance, DispatchPattern=smaller_than.SmallerThan)  # -> ListA, ListB
item_index = ItemIndex(List=closest_point.Distance, Item=dispatch.ListA)
subtraction = Subtraction(A=closest_point.Distance, B=minimum_distance)
replace_items = ReplaceItems(List=subtraction, Item=0, Indices=item_index, Wrap=False)
bounds_2 = Bounds(Numbers=replace_items)
remap_numbers = RemapNumbers(Value=replace_items, Source=bounds_2, Target=Domain(-1, 0))  # -> Mapped, Clipped

# ----
point_7 = Point()
show_robot_frame = BooleanToggle(False)

# ---- group: Penalty factor
penalty_factor_2 = GraphMapper(remap_numbers.Mapped, x0=-1, x1=0, y0=-1, y1=0, Cx=0.3823914528, Cy=0.7545644045, container_name="Conic")
multiplication = Multiplication(A=penalty_factor_2, B=penalty_factor)

# ---- group: Penalty application
addition = Addition(A=multiplication, B=ghpython_script_5.reuleaux_indices)
larger_than = LargerThan(FirstNumber=addition, SecondNumber=ghpython_script_5.reuleaux_indices)  # -> LargerThan, OrEqualTo
list_indices = ListIndices(List=ghpython_script_5.reuleaux_indices)
cull_pattern = CullPattern(List=list_indices, CullPattern=larger_than.OrEqualTo)
list_item = ListItem(List=ghpython_script_5.reuleaux_indices, Index=cull_pattern, Wrap=True)
replace_items_2 = ReplaceItems(List=addition, Item=list_item, Indices=cull_pattern, Wrap=False)

# ----
# Select
# Config
configuration = Slider(21, range=0..100)

# ---- group: Visualization
bounds_3 = Bounds(Numbers=ghpython_script_5.reuleaux_indices)
deconstruct_domain_2 = DeconstructDomain(Domain=bounds_3)  # -> Start, End
gradient_3 = Gradient(
    LowerLimit=deconstruct_domain_2.Start,
    UpperLimit=deconstruct_domain_2.End,
    Parameter=replace_items_2,
    stops=[0.001: RGB(0, 0, 0), 0.276: RGB(254, 244, 84), 0.75: RGB(173, 203, 249), 1: RGB(75, 107, 169)])
dot_display_3 = DotDisplay(Point=ghpython_script_5.planes, Colour=gradient_3, Size=expr("x/10", Slider(0.4, range=0..1)))

# ---- group: Ideal pose
sort_list = SortList(Keys=replace_items_2, ValuesA=replace_items_2)  # -> Keys, ValuesA
list_item_2 = ListItem(List=sort_list.ValuesA, Index=0, Wrap=True)  # -> Item1, Item
item_index_2 = ItemIndex(List=replace_items_2, Item=list_item_2.Item1)
list_item_3 = ListItem(List=ghpython_script_5.planes, Index=item_index_2, Wrap=True)

# ----
value_list_2 = ValueList({"Manual input": 0, "Ideal pose": 1}, selected="Ideal pose")
manual = Slider(0, range=0..100)
stream_filter = StreamFilter(Gate=value_list_2, Stream0=manual, Stream1=item_index_2)
ghpython_script_6 = GhPythonScript(base_map=ghpython_script_2.base_map, reachabilitymap=from_json.reachabilitymap, idx=stream_filter, show=Toggle(True))  # -> out, base_plane, reuleaux_points, reuleaux_data, reuleaux_index, reachability_indices, points, values
# ---------- ghpython_script_6: Python ----------
__author__ = "Gido"
__version__ = "2023.09.12"

import rhinoscriptsyntax as rs
from compas_ghpython.utilities import draw_frame, draw_points

planes = []
reuleaux_indices = []
if show:
    i = 0
    for node, data in base_map.base_map.nodes(data=True):
        if i == idx:
            base_plane = draw_frame(data['frame'])
            reuleaux_index = data['mean_reuleaux_index']
            reuleaux_data = data['reuleaux_data']
            reuleaux_points = draw_points([{'pos': [pt.x, pt.y, pt.z]} for pt in reuleaux_data['reuleaux_points']])
            reachability_indices = [ri for point, ri in reachabilitymap.spheres_data(yield_ri=True)]
            points = draw_points([{'pos': [pt.x, pt.y, pt.z]} for pt in reuleaux_data['goal_points']])
            values = reuleaux_data['goal_reuleaux_index']
            break
        i += 1
# ---------- end ghpython_script_6 ----------
base_pose = Plane(ghpython_script_6.base_plane)

# ---- group: Reachability of evaluated goal_points
bounds_4 = Bounds(Numbers=ghpython_script_6.values)
deconstruct_domain_3 = DeconstructDomain(Domain=bounds_4)  # -> Start, End
gradient_4 = Gradient(
    LowerLimit=deconstruct_domain_3.Start,
    UpperLimit=deconstruct_domain_3.End,
    Parameter=ghpython_script_6.values,
    stops=[0: RGB(118, 216, 81), 0.001: RGB(0, 0, 0), 0.276: RGB(254, 244, 84), 0.75: RGB(173, 203, 249), 1: RGB(75, 107, 169)])
dot_display_4 = DotDisplay(Point=ghpython_script_6.points, Colour=gradient_4, Size=expr("x/10", Slider(0.2, range=0..1)))

# ---- group: Reachabilitymap at base_pose
gradient_5 = Gradient(
    LowerLimit=0,
    UpperLimit=100,
    Parameter=ghpython_script_6.reachability_indices,
    stops=[0.001: RGB(0, 0, 0), 0.276: RGB(254, 244, 84), 0.75: RGB(173, 203, 249), 1: RGB(75, 107, 169)])
dot_display_5 = DotDisplay(Point=ghpython_script_6.reuleaux_points, Colour=gradient_5, Size=expr("x/10", Slider(0.4, range=0..1)))

# ----
# All poses
deconstruct_plane = DeconstructPlane(Plane=ghpython_script_5.planes)  # -> Origin, XAxis, YAxis, ZAxis
multiplication_2 = Multiplication(A=deconstruct_plane.XAxis, B=Slider(0.1, range=0..1))
vector_display_2 = VectorDisplay(Vector=deconstruct_plane.XAxis)
vector_display_ex = VectorDisplayEx(Point=deconstruct_plane.Origin, Vector=multiplication_2, Colour=gradient_3, Width=Slider(4, range=0..10))

plane_5 = Plane(plane_normal)  # disabled

# ---- group: Ideal pose / Selected position
plane_6 = Plane(list_item_3)

# ----
r_aa_position = Plane(plane_6)

# ----
# Ideal pose
deconstruct_plane_2 = DeconstructPlane(Plane=plane_6)  # -> Origin, XAxis, YAxis, ZAxis
colour_swatch = ColourSwatch(SwatchColor=RGB(255, 255, 255))
multiplication_3 = Multiplication(A=deconstruct_plane_2.XAxis, B=Slider(0.848, range=0..1))
vector_display_ex_2 = VectorDisplayEx(Point=deconstruct_plane_2.Origin, Vector=multiplication_3, Colour=colour_swatch, Width=Slider(6, range=0..10))
dot_display_6 = DotDisplay(Point=plane_6, Colour=colour_swatch, Size=expr("x/10", Slider(0.4, range=0..1)))

r_aa_position_2 = Plane(plane_6)  # disabled

# ----
# Get 'robot AB' frame
# from Realtime Database
connect_2 = BooleanToggle(False)  # disabled
get = Button()  # disabled
read_robot_ab = PythonScript(get_robot_base_frame=get, connect=connect_2)  # -> robot_AB_base_frame; inputs current_index: Int32, connect: Boolean; disabled
# ---------- read_robot_ab: Python ----------
import os
import compas
from compas.rpc import Proxy
from compas_rhino.conversions import plane_to_compas_frame

robot_name ="AA"

if connect:
    p = Proxy(package = 'cdf_2023.firebase.realtime_database', path=path +'\src')
    p.stop_server()
    p.start_server()

#    if get_robot_base_frame:
#        sticky["current_stick"] = p.get_json_data("Design", "currentstick")
#    current_index = int(sticky["current_stick"])
# ---------- end read_robot_ab ----------

# ----
# Robot Model
# Load robot from local package
value_list_3 = ValueList({"indoor", "outdoor"}, selected="indoor")  # disabled
py_2 = PythonScript()  # -> mobile_robot_data_path, ur_data_path; disabled
# ---------- py_2: Python ----------
import os

"""
ASSUMING THE BELOW PACKAGES ARE STORED IN THE SAME LOCATION:
    ur_fabrication_control;
    rbvogui_common; and
    mobile_additive_manufacturing.
"""

repositories_path = os.path.abspath(os.path.join(ghdoc.Path,"../../../"))

assert os.path.exists(os.path.join(repositories_path, "ur_fabrication_control/data"))
assert os.path.exists(os.path.join(repositories_path, "mobile_robot_control/data/rbvogui_xl_lift_ur10e_description"))

ur_data_path = os.path.abspath(os.path.join(ghdoc.Path,"../../../ur_fabrication_control/data"))
mobile_robot_data_path = os.path.abspath(os.path.join(ghdoc.Path,"../../../mobile_robot_control/data"))
# ---------- end py_2 ----------

# ----
# Load robot locally
py_3 = PythonScript(mobile_robot_data_path=py_2.mobile_robot_data_path, ur_data_path=py_2.ur_data_path, wheel_type=value_list_3)  # -> loaders, urdf_filename, srdf_filename; disabled
# ---------- py_3: Python ----------
import os
from compas.robots import LocalPackageMeshLoader

#loaders

ur_path = os.path.join(ur_data_path, "robot_description")
ur_packages = ["ur_e_description"]
ur_loaders = [LocalPackageMeshLoader(ur_path, pck) for pck in ur_packages]

mobile_robot_path = os.path.join(mobile_robot_data_path, "rbvogui_xl_lift_ur10e_description")
mobile_robot_packages = ["rbvogui_description", "ewellix_description", "robotnik_sensors"]
mobile_robot_loaders = [LocalPackageMeshLoader(mobile_robot_path, pck) for pck in mobile_robot_packages]

loaders = ur_loaders + mobile_robot_loaders

#files
if wheel_type=="indoor":
    urdf_filename = os.path.join(mobile_robot_data_path, r"rbvogui_xl_lift_ur10e_indoor.urdf")
if wheel_type == "outdoor":
    urdf_filename = os.path.join(mobile_robot_data_path, r"rbvogui_xl_lift_ur10e.urdf")
srdf_filename = os.path.join(mobile_robot_data_path, r"rbvogui.srdf")

assert os.path.isfile(urdf_filename)
assert os.path.isfile(srdf_filename)
# ---------- end py_3 ----------
units = ValueList({"m": 1, "cm": 100, "mm": 1000}, selected="m")  # disabled
load_2 = Button()  # disabled
create = PythonScript(
    load=load_2,
    loaders=py_3.loaders,
    urdf_filename=py_3.urdf_filename,
    srdf_filename=py_3.srdf_filename,
    scale_factor=units,
    wheel_type=value_list_3)  # -> out, robot; inputs load: Boolean, loaders: list; disabled
# ---------- create: Python ----------
import os
from scriptcontext import sticky as st

import compas

from compas_ghpython import draw_frame
from compas.robots import RobotModel
from compas.robots import LocalPackageMeshLoader

from mobile_robot_control.mobile_robot import MobileRobot
from compas_fab.robots import RobotSemantics
from compas_fab.ghpython import RobotArtist

compas.PRECISION = '12f'

# store robot in component
guid = str(ghenv.Component.InstanceGuid)
robot_key = "robot"

if robot_key not in st:
    st[robot_key] = None

#print loaders
if load:
    model = RobotModel.from_urdf_file(urdf_filename)
    model.load_geometry(*loaders)
    artist = RobotArtist(model)
    semantics = RobotSemantics.from_srdf_file(srdf_filename, model)
    robot = MobileRobot(model, artist, semantics, client=None)
    
    st[robot_key] = robot

robot = st[robot_key]
robot.wheel_type = wheel_type
print(robot)

rcf = draw_frame(robot.get_RCF())
print(rcf)
# ---------- end create ----------

# ----
# Viz robot AB
robot_ab_mesh = Mesh([<mesh referenced from the Rhino model> x48])  # disabled
bcf_wcs_ab_0 = Plane(Plane(origin=(-3.030951514, -0.01961621159, 0), x=(0.8777617717, -0.4790973515, 0), y=(0.4790973515, 0.8777617717, -6.375666571e-12)))  # disabled
python = GhPythonScript(robot_meshes=robot_ab_mesh, plane=bcf_wcs_ab_0)  # -> out, robot_transformed; inputs robot_meshes: list of Mesh; disabled
# ---------- python: Python ----------
from compas.geometry import Transformation, Frame
from compas_rhino.conversions import RhinoMesh
from compas.artists import Artist

robot_frame = Frame(plane.Origin, plane.XAxis, plane.YAxis)
T = Transformation.from_frame_to_frame(Frame.worldXY(), robot_frame)

robot_transformed = []

for mesh in robot_meshes:
    compas_mesh = RhinoMesh.from_geometry(mesh).to_compas()
    compas_mesh.transform(T)
    robot_transformed.append(Artist(compas_mesh).draw())
# ---------- end python ----------
mesh_2 = Mesh(python.robot_transformed)

robot_2 = Data(create.robot)  # disabled
info = PythonScript(robot=robot_2)  # -> out, main_group_name; disabled
# ---------- info: Python ----------
if robot:
    robot.info()
    main_group_name = robot.main_group_name
# ---------- end info ----------
panel_2 = Panel(info.out)  # disabled

# ----
# Attach tool
value_list_4 = ValueList({"measurement_tool": 0, "area_gripper": 1, "parallel_gripper": 2, "parallel_gripper_with_mtip": 3}, selected="parallel_gripper")  # disabled
show = BooleanToggle(False)  # disabled
py_4 = PythonScript()  # -> DATA; disabled
# ---------- py_4: Python ----------
import os

#package_path = os.path.dirname(mobile_fabrication_control.__file__)
#DATA = os.path.abspath(os.path.join(package_path,"../../data"))

package_path = ghdoc.Path
# package_path = os.path.dirname(ur_fabrication_control.__file__)
#DATA = os.path.abspath(os.path.join(package_path,"../../data"))

# .stl files not stored in am_hackathon repo. but in mobile_fabrication_control
DATA = os.path.abspath(os.path.join(package_path,"../../../mobile_robot_control/data"))

print(package_path)
print(DATA)
# ---------- end py_4 ----------
tool = PythonScript(data_path=py_4, tool=value_list_4, show=show)  # -> tool, M, ee_plane; disabled
# ---------- tool: Python ----------
import os, math
from compas.geometry import Frame, Rotation
from compas.datastructures import Mesh
from compas_ghpython.artists import MeshArtist
from compas_fab.robots import Tool
from compas_ghpython.utilities import draw_frame

tolerance = 0

if tool == 0:
    filename = 'measurement_tool_zaxis.stl'
    ee_frame = Frame([0, 0, 0.109], [1, 0, 0], [0, 1, 0])

elif tool == 1:
    filename = 'area_gripper_zaxis.stl'
    ee_frame = Frame([0, 0, 0.10219 + tolerance], [0, 1, 0], [-1, 0, 0])

elif tool == 2:
    filename = 'parallel_gripper.stl'
    ee_frame = Frame([0, 0, 0.1455 + tolerance], [0, 1, 0], [-1, 0, 0]) 

elif tool == 3:
    filename = 'parallel_gripper_with_mtip.stl'
    ee_frame = Frame([0, 0, 0.20], [0, 1, 0], [-1, 0, 0])

data_path = os.path.join(data_path, "tool_geometry")
fullfilename = os.path.join(data_path, filename)
print fullfilename

ee_mesh = Mesh.from_stl(fullfilename)

if show:
    artist = MeshArtist(ee_mesh)
    M = artist.draw()
    ee_plane = draw_frame(ee_frame)

tool = Tool(ee_mesh, ee_frame)

print(ee_frame.quaternion.xyzw)
ee_framek = Frame([0.0110607,0.00809854,0.41498], [0,1,0], [1,0,0])
print(ee_framek.quaternion.xyzw)
# ---------- end tool ----------
panel_3 = Panel("Attach a custom tool")  # disabled
remove = Button()  # disabled
add = Button()  # disabled
attach_remove = PythonScript(robot=robot_2, tool=tool.tool, attach=add, remove=remove)  # -> out, bang; disabled
# ---------- attach_remove: Python ----------
if attach:
    robot.attach_tool(tool)
if remove:
    robot.detach_tool()
# ---------- end attach_remove ----------

mesh_3 = Mesh(tool.M)  # disabled
plane_7 = Plane(tool.ee_plane)  # disabled

# ----
# Move mobile robot base
angle = Slider(101, range=0..360)  # disabled
base_origin = Point(Point(0.4817730379, -1.392966048, 0))  # disabled
set_to_origin = BooleanToggle(False)  # disabled
base_plane = GhPythonScript(origin=base_origin, angle=angle)  # -> base_plane; inputs origin: Point3d; disabled
# ---------- base_plane: Python ----------
import Rhino.Geometry as rg
import math

base_plane = rg.Plane(origin, rg.Vector3d.XAxis, rg.Vector3d.YAxis)
base_plane.Rotate(math.radians(angle), rg.Vector3d.ZAxis)
# ---------- end base_plane ----------
set_base_frame = PythonScript(robot=robot_2, set_to_origin=set_to_origin, base_plane=r_aa_position_2)  # -> bang; disabled
# ---------- set_base_frame: Python ----------
from compas_ghpython import draw_frame
from compas.geometry import Frame, Point, Vector, Transformation
from compas.datastructures import Mesh
from compas_rhino.geometry import RhinoMesh
from compas_fab.robots import CollisionMesh

if set_to_origin:
    base_frame = Frame.worldXY()
else:
    base_frame = Frame(base_plane.Origin, base_plane.XAxis, base_plane.YAxis)

# Base_frame is BCF in WCF
if robot:
    robot.BCF = base_frame
    
    
plane = robot.RCF

print plane
# ---------- end set_base_frame ----------

# ---- group: forward kinematics
# Configuration
l_2 = Slider(0.245, range=0..0.72)  # disabled
a1 = Slider(0, range=-360..360)  # disabled
a2 = Slider(-90, range=-360..360)  # disabled
a3 = Slider(90, range=-360..360)  # disabled
a6 = Slider(0, range=-360..360)  # disabled
a4 = Slider(0, range=-360..360)  # disabled
a5 = Slider(90, range=-360..360)  # disabled
jp = GhPythonScript()  # -> joint_positions; disabled
# ---------- jp: Python ----------
import math

joint_positions = [0,0,-90,90,0,90,0]
joint_positions = [math.radians(a) for a in joint_positions]
#joint_positions = [-3.136, -0.328, -1.218, 3.129, 0.852, 0.008]
#joint_positions = [0] * 6



#joint_positions = [1.6239667567485938, 0.25439606475392273, 4.409424838594969-2*3.14, 3.1901607306255908, 1.5707963267948954, 0.053170429953696939]
#joint_positions = [1.598543436748912, 0.23021224965157744, 4.712232135219824-2*3.14, 6.0531299026928744, 4.7123889803846915, 0.027747109954015234]
#joint_positions = [-1.1373533430447322, 4.0117247163121572, 5.4083762087596021-2*3.14, 1.5754733624925168, 4.7123889803846879, 3.5750356373399574]
print joint_positions
# ---------- end jp ----------
button = Button()  # disabled
forward_kinematics = PythonScript(robot=robot_2, set_joint_positions=button, joint_positions=jp, lift=l_2, a1=a1, a2=a2, a3=a3, a4=a4, a5=a5, a6=a6)  # -> full_configuration; inputs joint_positions: list; disabled
# ---------- forward_kinematics: Python ----------
import math
import Grasshopper
from compas.robots import Joint
from compas_fab.robots import Configuration

if set_joint_positions:
    j = 0
    for i in range(ghenv.Component.Params.Input.Count):
        nslider = ghenv.Component.Params.Input[i].Sources[0]
        if nslider.GetType() == Grasshopper.Kernel.Special.GH_NumberSlider:
            nslider.TrySetSliderValue(math.degrees(joint_positions[j]))
            j += 1

if robot:
    joints = robot.get_configurable_joints()
    joint_types = [joint.type for joint in joints]
    joint_names = [joint.name for joint in joints]
    
    joint_positions = [a1, a2, a3, a4, a5, a6]
    joint_positions = [math.radians(position) for position in joint_positions]
    
    if len(joints) == 7:
        joint_positions = [lift] + joint_positions
    
    print joint_types, joint_names, joint_positions
    full_configuration = Configuration(joint_positions, joint_types, joint_names)
    
print(full_configuration)
# ---------- end forward_kinematics ----------

# ---- group: inverse kinematics
plane_8 = Plane(plane_5)  # disabled
select_configuration = Slider(0, range=0..7)  # disabled
analytic_inverse = PythonScript(robot=robot_2, lift=l_2, plane_WCS=plane_8, idx=select_configuration, bang=attach_remove.bang)  # -> out, configuration; inputs plane_WCS: Plane, idx: Int32, bang: list; disabled
# ---------- analytic_inverse: Python ----------
import Rhino.Geometry as rg
import math
from compas.geometry import Frame, Transformation, Rotation
from compas_fab.robots import Configuration
from ur_fabrication_control.kinematics.ur_kinematics import inverse_kinematics
from ur_fabrication_control.kinematics.ur_params import ur_params
from compas_ghpython import draw_frame

robot.lift_height = lift

frame_WCS = Frame(plane_WCS.Origin, plane_WCS.XAxis, plane_WCS.YAxis)

# transform frame to robot coordinate system
frame_RCS = frame_WCS.transformed(robot.transformation_WCF_RCF())

if robot.attached_tool:
    tool0_RCS = robot.from_tcf_to_t0cf([frame_RCS])[0]
else:
    tool0_RCS = frame_RCS

plane_tool0_RCS = draw_frame(tool0_RCS)
plane_RCS = draw_frame(frame_RCS)

# calculate solutions to frame
ur_params = ur_params["ur10e"] # get the parameters according to the robot model
print ur_params
solutions = inverse_kinematics(tool0_RCS, ur_params)
print solutions

if not len(solutions):
    joint_values = [0, 0, 0, 0, 0, 0, 0]
    configuration = Configuration.from_revolute_values(joint_values)
else:
    joint_values = [lift] + solutions[idx]
    configuration = [Configuration.from_revolute_values(joint_values)]

print(configuration)
# ---------- end analytic_inverse ----------

# ---- group: zero configuration
zero_config = ZeroConfig(robot=robot_2, group=info.main_group_name)  # -> config; disabled
#   port group: If assigned, it will return the zero configuration for the given group, otherwise a full zero configuration.
#   port config: The zero configuration.
# ---------- zero_config: Python ----------
"""
Get a zero configuration for a robot.

COMPAS FAB v0.27.0
"""
from ghpythonlib.componentbase import executingcomponent as component


class ConfigZero(component):
    def RunScript(self, robot, group):

        if robot:
            return robot.zero_configuration(group)

        return None
# ---------- end zero_config ----------

# ----
value_list_5 = ValueList({"0 zero_configuration": 0, "1 forward_kinematics": 1, "2 inverse_kinematics": 2}, selected="2 inverse_kinematics")  # disabled
stream_filter_2 = StreamFilter(Gate=value_list_5, Stream0=zero_config, Stream1=forward_kinematics, Stream2=analytic_inverse.configuration)  # disabled

bang = GhPythonScript(x=[set_base_frame, attach_remove.bang])  # -> out, flatten(x); inputs x: list; disabled
# ---------- bang: Python ----------
print x
# ---------- end bang ----------

# ----
# Visualisation
show_end_effector_frame = BooleanToggle(False)  # disabled
show_base_frame = BooleanToggle(False)  # disabled
show_collision = BooleanToggle(False)  # disabled
show_frames = BooleanToggle(False)  # disabled
show_reach = BooleanToggle(False)  # disabled
show_visual = BooleanToggle(True)  # disabled
show_acm = BooleanToggle(False)  # disabled
show_cm = BooleanToggle(False)  # disabled
robot_visualize = RobotVisualize(
    robot=robot_2,
    group=info.main_group_name,
    configuration=stream_filter_2,
    show_visual=show_visual,
    show_collision=show_collision,
    show_frames=show_frames,
    show_base_frame=show_base_frame,
    show_end_effector_frame=show_end_effector_frame,
    show_reach=show_reach,
    show_cm=show_cm,
    show_acm=show_acm,
    redraw=bang.x)  # -> visual, collision, collision_meshes, attached_meshes, all_frames, base_frame, ee_frame, reach; inputs show_visual: Boolean, show_collision: Boolean, show_frames: Boolean, show_base_frame: Boolean, show_end_effector_frame: Boolean, show_cm: Boolean, show_acm: Boolean, redraw: list; disabled
#   port group: The planning group used for end-effector and base visualization.
#   port configuration: The robot's full configuration.
#   port show_visual: Whether or not to show the robot's visual meshes.
#   port show_collision: Whether or not to show the robot's collision meshes.
#   port show_frames: Whether or not to show the robot's joint frames.
#   port show_base_frame: Whether or not to show the robot's base frame.
#   port show_end_effector_frame: Whether or not to show the robot's end-effector frame.
#   port show_cm: Whether or not to show the collision meshes (if any).
#   port show_acm: Whether or not to show the attached collision meshes (if any).
#   port visual: Rhino meshes of the robot's visual geometry (if any).
#   port collision: Rhino meshes of the robot's collision geometry (if any).
#   port collision_meshes: Rhino meshes of the scene's collision meshes (if any).
#   port attached_meshes: Rhino meshes of the scene's attached collision meshes (if any).
#   port all_frames: The robot's joint frames as Rhino planes (if any).
#   port base_frame: The robot's base frame as a Rhino plane (if any).
#   port ee_frame: The robot's end-effector frame as a Rhino plane (if any).
# ---------- robot_visualize: Python ----------
"""
Visualizes the robot.

COMPAS FAB v0.27.0
"""
import Rhino.Geometry as rg
import ghpythonlib.components as ghcomp
from compas.artists import Artist
from compas.geometry import Frame
from compas.geometry import Transformation
from compas_fab.robots import PlanningScene
from compas_ghpython.utilities import draw_frame
from ghpythonlib.componentbase import executingcomponent as component

class RobotVisualize(component):
    def RunScript(
        self,
        robot,
        group,
        configuration,
        show_visual,
        show_collision,
        show_frames,
        show_base_frame,
        show_end_effector_frame,
        show_reach,
        show_cm,
        show_acm,
        redraw
    ):

        visual = None
        collision = None
        collision_meshes = None
        attached_meshes = None
        frames = None
        base_frame = None
        ee_frame = None
        all_frames = None
        reach = None

        if robot:
            show_visual = True if show_visual is None else show_visual
            show_cm = True if show_cm is None else show_cm
            show_acm = True if show_acm is None else show_acm
            configuration = configuration or robot.zero_configuration()

            robot.update(configuration, visual=show_visual, collision=show_collision)
            frames = robot.transformed_frames(configuration, group)

            if show_visual:
                visual = robot.artist.draw_visual()
                # orient the robot to its base plane:
                robot_BCF = draw_frame(robot.BCF) 
                init_robot_plane = rg.Plane.WorldXY
                visual = ghcomp.Orient(visual, init_robot_plane, robot_BCF)[0]
                #picking_frame = robot.to_world_coordinates(robot.PCF)

            if show_collision:
                collision = robot.artist.draw_collision()

            if show_base_frame:
                base_frame = robot.BCF

            if show_end_effector_frame:
                ee_frame = robot.forward_kinematics(
                    configuration, group, options=dict(solver="model")
                )

            if show_frames:
                all_frames = [robot.to_world_coordinates(frame) for frame in frames]
            
            if show_reach:
                ur_base_plane = draw_frame(robot.RCF)
                reach = rg.Sphere(ur_base_plane, 1.25 + robot.attached_tool.frame.point.z)

            if show_cm or show_acm:
                scene = PlanningScene(robot)
                scene = robot.client.get_planning_scene()

                collision_meshes = []
                attached_meshes = []

                if show_cm:
                    for co in scene.world.collision_objects:
                        header = co.header
                        frame_id = header.frame_id
                        cms = co.to_collision_meshes()

                        for cm in cms:
                            if cm.frame != Frame.worldXY():
                                t = Transformation.from_frame(cm.frame)
                                mesh = cm.mesh.transformed(t)
                            else:
                                mesh = cm.mesh

                            collision_meshes.append(Artist(mesh).draw())

                if show_acm:
                    for aco in scene.robot_state.attached_collision_objects:
                        for acm in aco.to_attached_collision_meshes():
                            frame_id = aco.object["header"]["frame_id"]
                            frame = robot.forward_kinematics(
                                configuration, options=dict(link=frame_id)
                            )
                            t = Transformation.from_frame(frame)

                            # Local CM frame
                            if (
                                acm.collision_mesh.frame
                                and acm.collision_mesh.frame != Frame.worldXY()
                            ):
                                t = t * Transformation.from_frame(
                                    acm.collision_mesh.frame
                                )

                            mesh = acm.collision_mesh.mesh.transformed(t)

                            attached_meshes.append(Artist(mesh).draw())

        return (
            visual,
            collision,
            collision_meshes,
            attached_meshes,
            all_frames,
            base_frame,
            ee_frame,
            reach
        )
# ---------- end robot_visualize ----------
geometry = Geometry(robot_visualize.visual)  # disabled
geometry_2 = Geometry(robot_visualize.collision)  # disabled
geometry_3 = Geometry(robot_visualize.reach)  # disabled
number_slider_5 = Slider(0.1, range=0..1)  # disabled
draw = GhPythonScript(frames=robot_visualize.all_frames, scale=number_slider_5)  # -> P, V, C, W; inputs frames: list; disabled
# ---------- draw: Python ----------
from System.Drawing import Color
from compas_ghpython.utilities import draw_frame

red = Color.FromArgb(255, 0, 0)
green = Color.FromArgb(0, 255, 0)
blue = Color.FromArgb(0, 0, 255)

P = []
V = []
C = []

scale = float(scale)

for frame in frames:
    if not frame:
        continue
    plane = draw_frame(frame)
    P += [plane.Origin] * 3
    V.append(plane.XAxis * scale)
    V.append(plane.YAxis * scale)
    V.append(plane.ZAxis * scale)
    C += [red, green, blue]

W = 3
# ---------- end draw ----------
colour_swatch_2 = ColourSwatch(SwatchColor=RGBA(255, 212, 212, 97))  # disabled
custom_preview = CustomPreview(Geometry=geometry_3, Shader=colour_swatch_2)  # disabled
colour_swatch_3 = ColourSwatch(SwatchColor=RGB(105, 105, 105))  # disabled
custom_preview_2 = CustomPreview(Geometry=geometry, Shader=colour_swatch_3)  # disabled
colour_swatch_4 = ColourSwatch(SwatchColor=RGB(255, 255, 255))  # disabled
custom_preview_3 = CustomPreview(Geometry=geometry_2, Shader=colour_swatch_4)  # disabled
vector_display_ex_3 = VectorDisplayEx(Point=draw.P, Vector=draw.V, Colour=draw.C, Width=draw.W)  # disabled

# ----
# Attach tool
list_4 = ValueList({"measurement_tool": 0, "area_gripper": 1, "parallel_gripper": 2, "parallel_gripper_with_mtip": 3}, selected="parallel_gripper")
show_2 = BooleanToggle(True)
remove_2 = Button()
add_2 = Button()
py_5 = PythonScript()  # -> DATA; same code as py_4
tool_2 = PythonScript(data_path=py_5, tool=list_4, show=show_2)  # -> tool, M, ee_plane
# ---------- tool_2: Python ----------
import os, math
from compas.geometry import Frame, Rotation
from compas.datastructures import Mesh
from compas_ghpython.artists import MeshArtist
from compas_fab.robots import Tool
from compas_ghpython.utilities import draw_frame

tolerance = 0

if tool == 0:
    filename = 'measurement_tool_zaxis.stl'
    ee_frame = Frame([0, 0, 0.109], [1, 0, 0], [0, 1, 0])

elif tool == 1:
    filename = 'area_gripper_zaxis.stl'
    ee_frame = Frame([0, 0, 0.10219 + tolerance], [0, 1, 0], [-1, 0, 0])

elif tool == 2:
    filename = 'parallel_gripper_small.stl'
    ee_frame = Frame([0, 0, 0.1455 + tolerance], [0, 1, 0], [-1, 0, 0]) 

elif tool == 3:
    filename = 'parallel_gripper_with_mtip.stl'
    ee_frame = Frame([0, 0, 0.20], [0, 1, 0], [-1, 0, 0])

    
data_path = os.path.join(data_path, "tool_geometry")
fullfilename = os.path.join(data_path, filename)
print fullfilename

ee_mesh = Mesh.from_stl(fullfilename)

if show:
    artist = MeshArtist(ee_mesh)
    M = artist.draw()
    ee_plane = draw_frame(ee_frame)

tool = Tool(ee_mesh, ee_frame)

print(ee_frame.quaternion.xyzw)
ee_framek = Frame([0.0110607,0.00809854,0.41498], [0,1,0], [1,0,0])
print(ee_framek.quaternion.xyzw)
# ---------- end tool_2 ----------
panel_4 = Panel("Attach a custom tool")
mesh_4 = Mesh(tool_2.M)
pln_2 = Plane(tool_2.ee_plane)
tool_3 = AttachedTool(robot=robot, visual_mesh=mesh_4, collision_mesh=mesh_4, tcf_plane=pln_2, group=list_2)  # -> robot; inputs visual_mesh: Mesh, collision_mesh: Mesh
#   port visual_mesh: A visual mesh for the tool.
#   port collision_mesh: A collision mesh for the tool.
#   port tcf_plane: The frame of the tool in tool0 frame.
#   port group: The planning group to which the tool should be attached.
# ---------- tool_3: Python ----------
"""
Attach a tool to the robot.

COMPAS FAB v0.27.0
"""
from ghpythonlib.componentbase import executingcomponent as component
from compas_rhino.conversions import RhinoMesh
from compas_rhino.conversions import plane_to_compas_frame

from compas.geometry import Frame
from compas_fab.robots import Tool


class AttachToolComponent(component):
    def RunScript(self, robot, visual_mesh, collision_mesh, tcf_plane, group):
        if robot and robot.client and robot.client.is_connected and visual_mesh:
            if not collision_mesh:
                collision_mesh = visual_mesh

            c_visual_mesh = RhinoMesh.from_geometry(visual_mesh).to_compas()
            c_collision_mesh = RhinoMesh.from_geometry(collision_mesh).to_compas()

            if not tcf_plane:
                frame = Frame.worldXY()
            else:
                frame = plane_to_compas_frame(tcf_plane)
            tool = Tool(c_visual_mesh, frame, c_collision_mesh)

            robot.attach_tool(tool, group)
            print tool.link_name

        return robot
# ---------- end tool_3 ----------

robot_3 = Data(tool_3)

# ----
# Planning scene
scene = PlanningScene(robot=robot_3)  # -> scene
#   port scene: A planning scene.
# ---------- scene: Python ----------
"""
Create a planning scene.

COMPAS FAB v0.27.0
"""
from ghpythonlib.componentbase import executingcomponent as component
from scriptcontext import sticky as st

from compas_fab.ghpython.components import create_id
from compas_fab.robots import PlanningScene


class PlanningSceneComponent(component):
    def RunScript(self, robot):
        key = create_id(self, 'planning_scene')
        if robot:
            st[key] = PlanningScene(robot)
        return st.get(key, None)
# ---------- end scene ----------

attach_remove_2 = PythonScript(robot=robot_3, tool=tool_2.tool, attach=add_2, remove=remove_2)  # -> out, bang
# ---------- attach_remove_2: Python ----------
if attach:
    robot.attach_tool(tool)
if remove:
    robot.detach_tool()

print tool.link_name
# ---------- end attach_remove_2 ----------

x_axis = Curve(<curve referenced from the Rhino model>)
y_axis = Curve(<curve referenced from the Rhino model>)
plane_9 = PythonScript(plane_axes=[x_axis, y_axis])  # -> plane; inputs plane_axes: list of Curve
# ---------- plane_9: Python ----------
import Rhino.Geometry as rg

x_axis, y_axis = plane_axes

x_axis = rg.Line(x_axis.PointAtStart, x_axis.PointAtEnd)
y_axis = rg.Line(y_axis.PointAtStart, y_axis.PointAtEnd)

if x_axis.From.DistanceTo(y_axis.From) < 0.01:
    origin = x_axis.From
    xvec = x_axis.Direction
    yvec = y_axis.Direction
elif x_axis.To.DistanceTo(y_axis.To) < 0.01:
    origin = x_axis.To
    xvec = -x_axis.Direction
    yvec = -y_axis.Direction
elif x_axis.From.DistanceTo(y_axis.To) < 0.01:
    origin = x_axis.From
    xvec = x_axis.Direction
    yvec = -y_axis.Direction
elif x_axis.To.DistanceTo(y_axis.From) < 0.01:
    origin = x_axis.To
    xvec = -x_axis.Direction
    yvec = y_axis.Direction

plane = rg.Plane(origin, xvec, yvec)
# ---------- end plane_9 ----------
calc_bcf_wcs = GhPythonScript(robot=robot_3, RCF_WCS_plane=plane_9)  # -> out, BCF_WCS_plane
# ---------- calc_bcf_wcs: Python ----------
import rhinoscriptsyntax as rs
from compas_rhino.conversions import frame_to_rhino_plane, plane_to_compas_frame
from compas.geometry import Frame, Transformation


if robot:

    RCF_OCS_plane = frame_to_rhino_plane(robot.RCF) # TODO: RCF should move with BCF !!!! NEEDS TO BE CHECKED !!!!
    
    RCF_WCS = plane_to_compas_frame(RCF_WCS_plane)
    
    #print robot.RCF
    #print robot.BCF
    
    #Version A
    
    #RCF_RCS = RCF_WCS.transformed(robot.transformation_WCF_RCF())
    #BCF_WCS_A = RCF_RCS.transformed(robot.transformation_BCF_WCF())
    #
    #BCF_WCS_A_plane = frame_to_rhino_plane(BCF_WCS_A)
    #BCF_WCS_plane = BCF_WCS_A_plane
    
    #Version B
    
    T2 = Transformation.from_frame_to_frame(robot.RCF, RCF_WCS)
    print robot.RCF
    BCF_WCS_B = Frame.worldXY().transformed(T2)
    BCF_WCS_B_plane = frame_to_rhino_plane(BCF_WCS_B)
    
    BCF_WCS_plane = BCF_WCS_B_plane
# ---------- end calc_bcf_wcs ----------

# ----
# Move mobile robot base
# Picking plane
angle_2 = Slider(203, range=0..360)
base_origin_2 = Point(Point(1.300181003, -0.5438348267, 0))
x_axis_2 = Curve(<curve referenced from the Rhino model>)
y_axis_2 = Curve(<curve referenced from the Rhino model>)
base_plane_2 = GhPythonScript(origin=base_origin_2, angle=angle_2)  # -> base_plane; inputs origin: Point3d; same code as base_plane
set_to_origin_2 = BooleanToggle(False)
plane_10 = PythonScript(plane_axes=[x_axis_2, y_axis_2])  # -> plane; inputs plane_axes: list of Curve
# ---------- plane_10: Python ----------
import Rhino.Geometry as rg

x_axis, y_axis = plane_axes

x_axis = rg.Line(x_axis.PointAtStart, x_axis.PointAtEnd)
y_axis = rg.Line(y_axis.PointAtStart, y_axis.PointAtEnd)

if x_axis.From.DistanceTo(y_axis.From) < 0.01:
    origin = x_axis.From
    xvec = x_axis.Direction
    yvec = y_axis.Direction
elif x_axis.To.DistanceTo(y_axis.To) < 0.01:
    origin = x_axis.To
    xvec = -x_axis.Direction
    yvec = -y_axis.Direction
elif x_axis.From.DistanceTo(y_axis.To) < 0.01:
    origin = x_axis.From
    xvec = x_axis.Direction
    yvec = -y_axis.Direction
elif x_axis.To.DistanceTo(y_axis.From) < 0.01:
    origin = x_axis.To
    xvec = -x_axis.Direction
    yvec = y_axis.Direction

plane = rg.Plane(origin, xvec, yvec)

print(plane)
# ---------- end plane_10 ----------
set_base_frame_2 = PythonScript(robot=robot_3, set_to_origin=set_to_origin_2, base_plane=r_aa_position)  # -> bang, base_plane
# ---------- set_base_frame_2: Python ----------
from compas_ghpython import draw_frame
from compas.geometry import Frame, Point, Vector, Transformation
from compas.datastructures import Mesh
from compas_rhino.geometry import RhinoMesh
from compas_fab.robots import CollisionMesh

if set_to_origin:
    base_frame = Frame.worldXY()
else:
    base_frame = Frame(base_plane.Origin, base_plane.XAxis, base_plane.YAxis)


# Base_frame is BCF in WCF
if robot:
    robot.BCF = base_frame
    print(robot.BCF)
# ---------- end set_base_frame_2 ----------
python_2 = GhPythonScript(robot=robot_3, picking_plane=plane_10)
# ---------- python_2: Python ----------
from compas.geometry import Frame

if robot and picking_plane:
    picking_frame = Frame(picking_plane.Origin, picking_plane.XAxis, picking_plane.YAxis)
    robot.PCF = picking_frame
# ---------- end python_2 ----------

# ----
# Attach to scene
panel_5 = Panel("scene_elem")
remove_3 = Button()
add_3 = Button()
mesh_5 = PythonScript()  # -> elems_meshes
# ---------- mesh_5: Python ----------
from compas.geometry import Frame, Transformation
from compas.artists import Artist

elems_meshes = []

key_index = assembly.network.key_index()
keys = [key for key in assembly.network.nodes()]
elements = [assembly.element(key) for key in keys]

for element in elements[0:current_key-3]:
    m = element.mesh
    elems_meshes.append(Artist(m).draw())

elem = assembly.element(0)
T = Transformation.from_change_of_basis(Frame.worldXY(), elem.frame)
mesh_transformed = elem.mesh.transformed(T)
elem_mesh = mesh_transformed
# ---------- end mesh_5 ----------
cm = CollisionMesh(scene=scene, mesh=mesh_5, add=add_3, append=set_base_frame_2.bang, remove=remove_3)  # -> ok; inputs mesh: list, add: Boolean, append: Boolean, remove: Boolean
#   port scene: The planning scene.
#   port mesh: A collision mesh.
#   port identifier: The identifier of the collision mesh.
#   port add: If True, adds the collision mesh to the planning scene.
#   port append: If True, appends the collision mesh to the planning scene.
#   port remove: If True, removes the collision mesh from the planning scene.
#   port ok: True if the operation was successfully performed.
# ---------- cm: Python ----------
"""
Add or remove a collision mesh from the planning scene.

COMPAS FAB v0.27.0
"""
from compas_rhino.geometry import RhinoMesh
from ghpythonlib.componentbase import executingcomponent as component

from compas_fab.robots import CollisionMesh


class CollisionMeshComponent(component):
    def RunScript(self, scene, M, name, add, append, remove):
        ok = False
        self.Message = ""
        
        collision_meshes = []
        if (add and append) or (append and remove) or (add and remove):
            self.Message = "Use only one operation at a time\n(add, append or remove)"
            raise Exception(self.Message)

        if scene and M and name:
            for i, mesh in enumerate(M):
                mesh_WCS = RhinoMesh.from_geometry(mesh).to_compas()
                # transform to mobile robot base coordinate system
                name = 'elem' + str(i)
                mesh = mesh_WCS.transformed(scene.robot.transformation_WCF_BCF())
                collision_mesh = CollisionMesh(mesh, name)
                if add:
                    scene.add_collision_mesh(collision_mesh)
                    self.Message = "Added"
                    ok = True
                if append:
                    scene.append_collision_mesh(collision_mesh)
                    self.Message = "Appended"
                    ok = True
                if remove:
                    scene.remove_collision_mesh(name)
                    self.Message = "Removed"
                    ok = True
        return ok
# ---------- end cm ----------
panel_6 = Panel(cm)

info_2 = PythonScript(robot=robot_3)  # -> out, main_group_name; same code as info
panel_7 = Panel(info_2.out)

# ----
# Attach to robot
panel_8 = Panel("robot_arm_tool0")
remove_4 = Button()
add_4 = Button()
X = UnitX(Factor=expr("x*-1", shift_value))
mesh_6 = Mesh(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)
move = Move(Geometry=brep_2, Motion=X)  # -> Geometry, Transform
acm = AttachedCollisionMesh(
    scene=scene,
    mesh=move.Geometry,
    identifier="rod",
    link_name=panel_8,
    touch_links="robot_arm_tool0",
    add=add_4,
    remove=remove_4)  # -> attached_collision_mesh, bang; inputs mesh: Mesh, touch_links: list, add: Boolean, remove: Boolean
#   port scene: The planning scene.
#   port mesh: A collision mesh.
#   port identifier: The identifier of the collision mesh.
#   port link_name: The robot's link name to attach the mesh to.
#   port touch_links: Names of links that the robot is allowed to touch.
#   port add: If True, adds the collision mesh to the planning scene.
#   port remove: If True, removes the collision mesh from the planning scene.
#   port attached_collision_mesh: A collision mesh that is attached to a robot's link.
# ---------- acm: Python ----------
"""
Add an attached collision mesh to the robot.

COMPAS FAB v0.27.0
"""
from ghpythonlib.componentbase import executingcomponent as component

from compas_rhino.geometry import RhinoMesh
from compas_fab.robots import AttachedCollisionMesh
from compas_fab.robots import CollisionMesh

class AttachedCollisionMeshComponent(component):
    def RunScript(self, scene, mesh, identifier, link_name, touch_links, add, remove):
        attached_collision_mesh = None
        if scene and mesh and identifier and link_name:
            compas_mesh = RhinoMesh.from_geometry(mesh).to_compas()
            collision_mesh = CollisionMesh(compas_mesh, identifier)
            attached_collision_mesh = AttachedCollisionMesh(collision_mesh, link_name, touch_links)
            if add:
                scene.add_attached_collision_mesh(attached_collision_mesh)
            if remove:
                scene.remove_attached_collision_mesh(identifier)
                scene.remove_collision_mesh(identifier)
        return attached_collision_mesh
# ---------- end acm ----------

# ----
# Fabrication Settings
rotation_angle = Slider(244, range=0..360)
flip_plane = BooleanToggle(False)
approach_plane_right = Plane(Plane(origin=(-1.36288269, -1.177161348, 1.226122194), x=(0.726005968, -0.6835662975, 0.07518278586), y=(-0.668749938, -0.7272607974, -0.1544838275)))  # disabled
list_5 = ValueList({"left", "right", "top"}, selected="right")
python_3 = GhPythonScript(
    robot=robot_3,
    lift=l,
    approach_from=list_5,
    approach_plane_right=approach_plane_right,
    approach_plane_left=approach_plane_left,
    approach_plane_top=pln,
    current_tool_plane=plane_4,
    flip_plane=flip_plane,
    rotation_angle=rotation_angle,
    shift_value=shift_value)  # -> out, picking_safe_configuration, approach_configuration, picking_plane_RCF, approach_plane_WCF, picking_plane_safe_RCF, picking_frame_RCF, picking_frame_safe_RCF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
# ---------- python_3: Python ----------
import math
from compas.geometry import Frame, Transformation, Translation
from compas_ghpython import draw_frame
from compas_fab.robots import Configuration
import Rhino.Geometry as rg

offset = 0.00 #aa
#offset = 0.005 #ab


if robot and current_tool_plane:
    picking_frame_BCF = robot.PCF
    
    T = Translation.from_vector(picking_frame_BCF.xaxis*shift_value)
    #T = Translation.from_vector(picking_frame_BCF.zaxis*lift)
    
    picking_frame_BCF_shifted = picking_frame_BCF.transformed(T)
    picking_frame_RCF = picking_frame_BCF_shifted.transformed(robot.transformation_BCF_RCF())
    picking_plane_RCF = draw_frame(picking_frame_RCF)

    picking_plane_safe_RCF = rg.Plane(picking_plane_RCF)
    picking_plane_safe_RCF.Translate(rg.Vector3d.ZAxis*0.3)
    picking_frame_safe_RCF = Frame(picking_plane_safe_RCF.Origin, picking_plane_safe_RCF.XAxis, picking_plane_safe_RCF.YAxis)
    
    # transform picking_frame_RCF and picking_frame_safe_RCF in WCF
    picking_frame_WCF = robot.from_BCF_to_WCF(picking_frame_BCF_shifted)

    picking_frame_safe_BCF = picking_frame_safe_RCF.transformed(robot.transformation_RCF_BCF())
    picking_frame_safe_WCF = robot.from_BCF_to_WCF(picking_frame_safe_BCF)
    
    # visualize picking_frame_WCF and picking_frame_safe_WCF
    picking_plane_WCF = draw_frame(picking_frame_WCF)
    picking_plane_safe_WCF = draw_frame(picking_frame_safe_WCF)
    
    
    placing_plane_WCF = current_tool_plane
    #placing_plane_WCF.Translate(placing_plane_WCF.ZAxis*offset)
    placing_plane_WCF.Translate(rg.Vector3d.ZAxis*-0.01)
    
    #shifting X of Gripper
    placing_plane_WCF.Translate(placing_plane_WCF.XAxis*shift_value)
    placing_plane_WCF.Rotate(math.radians(rotation_angle), placing_plane_WCF.XAxis, placing_plane_WCF.Origin)
    if flip_plane:
        placing_plane_WCF = rg.Plane(placing_plane_WCF.Origin, -placing_plane_WCF.XAxis, placing_plane_WCF.YAxis)
    
    placing_plane_safe_WCF = rg.Plane(placing_plane_WCF)
    placing_plane_safe_WCF.Translate(placing_plane_WCF.ZAxis*-0.2)
    
    #placing_frame_RCF = picking_frame_BCF.transformed(robot.transformation_BCF_RCF())
    
    move_plane_safe_WCF = rg.Plane(placing_plane_WCF)
    move_plane_safe_WCF.Translate(rg.Vector3d.ZAxis*0.30)
    
    
    picking_safe_configuration = Configuration((0.000, -1.777, -1.305, 2.471, -2.736, -1.571, -2.562), (4, 0, 0, 0, 0, 0, 0))
    
    if approach_from == 'left':
        #approach_configuration = 
        approach_plane_WCF = approach_plane_left
        
    if approach_from == 'right':
        approach_configuration = Configuration((0.000, -0.963, -1.592, 2.217, -2.026, -1.542, 1.167), (2, 0, 0, 0, 0, 0, 0))
        approach_plane_WCF = approach_plane_right
    else:
        approach_configuration = Configuration((0.000, -1.034, -1.995, 0.966, -2.162, -1.883, 0.616), (2, 0, 0, 0, 0, 0, 0))
        approach_plane_WCF = approach_plane_top
# ---------- end python_3 ----------
pln_3 = Plane(python_3.placing_plane_WCF)
pln_4 = Plane(python_3.picking_plane_WCF)
pln_5 = Plane(python_3.picking_plane_safe_WCF)
pln_6 = Plane(python_3.placing_plane_safe_WCF)

# ---- group: forward kinematics
a6_2 = Slider(90, range=-360..360)
a1_2 = Slider(0, range=-360..360)
a2_2 = Slider(0, range=-360..360)
a3_2 = Slider(11, range=-360..360)
a4_2 = Slider(0, range=-360..360)
a5_2 = Slider(0, range=-360..360)
jp_2 = GhPythonScript()  # -> joint_positions
# ---------- jp_2: Python ----------
import math

joint_positions = [0,0,-90,90,0,90,0]
joint_positions = [math.radians(a) for a in joint_positions]
#joint_positions = [-3.136, -0.328, -1.218, 3.129, 0.852, 0.008]
#joint_positions = [0] * 6

#joint_positions =[0.000, 0.518, 0.046, 1.451, -3.088, -1.571, -1.236]


#joint_positions = [1.6239667567485938, 0.25439606475392273, 4.409424838594969-2*3.14, 3.1901607306255908, 1.5707963267948954, 0.053170429953696939]
#joint_positions = [1.598543436748912, 0.23021224965157744, 4.712232135219824-2*3.14, 6.0531299026928744, 4.7123889803846915, 0.027747109954015234]
#joint_positions = [-1.1373533430447322, 4.0117247163121572, 5.4083762087596021-2*3.14, 1.5754733624925168, 4.7123889803846879, 3.5750356373399574]
print joint_positions
# ---------- end jp_2 ----------
forward_kinematics_2 = PythonScript(
    robot=robot_3,
    set_joint_positions=Button(),
    joint_positions=jp_2,
    lift=l,
    a1=a1_2,
    a2=a2_2,
    a3=a3_2,
    a4=a4_2,
    a5=a5_2,
    a6=a6_2)  # -> full_configuration; inputs joint_positions: list; same code as forward_kinematics

# ---- group: zero configuration
zero_config_2 = ZeroConfig(robot=robot_3)  # -> config; same code as zero_config

# ---- group: inverse kinematics
list_6 = ValueList({"picking_plane": 0, "picking_plane_safe": 1, "placing_plane_safe": 2, "placing_plane": 3}, selected="placing_plane")
filter = StreamFilter(Gate=list_6, Stream0=pln_4, Stream1=pln_5, Stream2=pln_6, Stream3=pln_3)
analytic_inverse_2 = PythonScript(robot=robot_3, lift=l, plane_WCS=filter, idx=select_configuration_aa, bang=attach_remove_2.bang)  # -> out, configuration, frame_RCS, frame_BCS, robot_frame; inputs plane_WCS: Plane, idx: Int32, bang: list of Boolean
# ---------- analytic_inverse_2: Python ----------
import Rhino.Geometry as rg
import math
from compas.geometry import Frame, Transformation, Rotation
from compas_fab.robots import Configuration
from ur_fabrication_control.kinematics.ur_kinematics import inverse_kinematics
from ur_fabrication_control.kinematics.ur_params import ur_params
from compas_ghpython import draw_frame


if robot:
    robot.lift_height = lift
    
    frame_WCS = Frame(plane_WCS.Origin, plane_WCS.XAxis, plane_WCS.YAxis)
    
    # transform frame to robot coordinate system
    frame_BCS = frame_WCS.transformed(robot.transformation_WCF_BCF())
    frame_RCS = frame_BCS.transformed(robot.transformation_BCF_RCF())
    
    robot_frame = robot.RCF
    
    if robot.attached_tool:
        tool0_RCS = robot.from_tcf_to_t0cf([frame_RCS])[0]
    else:
        tool0_RCS = frame_RCS
    
    plane_tool0_RCS = draw_frame(tool0_RCS)
    plane_RCS = draw_frame(frame_RCS)
    
    # calculate solutions to frame
    ur_params = ur_params["ur10e"] # get the parameters according to the robot model
    print ur_params
    solutions = inverse_kinematics(tool0_RCS, ur_params)
    print solutions
    
    if not len(solutions):
        joint_values = [0, 0, 0, 0, 0, 0]
        configuration = Configuration.from_prismatic_and_revolute_values([0], joint_values)
    else:
        joint_values = solutions[idx]
        configuration = [Configuration.from_prismatic_and_revolute_values([lift], joint_values)]
    
    print configuration
# ---------- end analytic_inverse_2 ----------

# ----
x_axis_3 = Curve(<curve referenced from the Rhino model>)
y_axis_3 = Curve(<curve referenced from the Rhino model>)
plane_11 = PythonScript(plane_axes=[x_axis_3, y_axis_3])  # -> plane; inputs plane_axes: list of Curve; same code as plane_9
ik = InverseKinematics(robot=robot_3, plane=filter, start_configuration=forward_kinematics_2, group=list_3)  # -> configuration
#   port plane: The plane or frame to calculate the inverse kinematic for.
#   port start_configuration: If passed, calculates the inverse such that the joint positions differ the least from the start_configuration. Defaults to the zero configuration.
#   port group: The planning group used for calculation. Defaults to the robot's main planning group.
#   port configuration: The planning group's configuration.
# ---------- ik: Python ----------
"""
Calculate the robot's inverse kinematic for a given plane.

COMPAS FAB v0.27.0
"""
from compas_rhino.conversions import RhinoPlane
from ghpythonlib.componentbase import executingcomponent as component


class InverseKinematics(component):
    def RunScript(self, robot, plane, start_configuration, group):
        configuration = None
        if robot and robot.client and robot.client.is_connected and plane:
            frame = RhinoPlane.from_geometry(plane).to_compas_frame()
            
            frame_BCS = frame.transformed(robot.transformation_WCF_BCF())
            configuration = robot.inverse_kinematics(frame_BCS, start_configuration, group, use_attached_tool_frame=True)
            print configuration
        return configuration
# ---------- end ik ----------

# ---- group: inverse kinematics
select_configuration_2 = Slider(0, range=0..7)
picking_safe_inverse = PythonScript(robot=robot_3, lift=l, plane_WCS=pln_5, idx=select_configuration_2, bang=attach_remove_2.bang)  # -> out, configuration; inputs plane_WCS: Plane, idx: Int32, bang: list of Boolean
# ---------- picking_safe_inverse: Python ----------
import Rhino.Geometry as rg
import math
from compas.geometry import Frame, Transformation, Rotation
from compas_fab.robots import Configuration
from ur_fabrication_control.kinematics.ur_kinematics import inverse_kinematics
from ur_fabrication_control.kinematics.ur_params import ur_params
from compas_ghpython import draw_frame

if robot: 
    robot.lift_height = lift
    
    frame_WCS = Frame(plane_WCS.Origin, plane_WCS.XAxis, plane_WCS.YAxis)
    
    # transform frame to robot coordinate system
    frame_BCS = frame_WCS.transformed(robot.transformation_WCF_BCF())
    frame_RCS = frame_BCS.transformed(robot.transformation_BCF_RCF())
    
    robot_frame = robot.RCF
    
    if robot.attached_tool:
        tool0_RCS = robot.from_tcf_to_t0cf([frame_RCS])[0]
    else:
        tool0_RCS = frame_RCS
    
    plane_tool0_RCS = draw_frame(tool0_RCS)
    plane_RCS = draw_frame(frame_RCS)
    
    # calculate solutions to frame
    ur_params = ur_params["ur10e"] # get the parameters according to the robot model
    print ur_params
    solutions = inverse_kinematics(tool0_RCS, ur_params)
    print solutions
    
    if not len(solutions):
        joint_values = [0, 0, 0, 0, 0, 0]
        configuration = Configuration.from_prismatic_and_revolute_values([0], joint_values)
    else:
        joint_values = solutions[idx]
        configuration = [Configuration.from_prismatic_and_revolute_values([lift], joint_values)]
    
    print configuration
# ---------- end picking_safe_inverse ----------

# ----
pln_7 = Plane(python_3.approach_plane_WCF)
pln_8 = Plane(python_3.picking_plane_safe_RCF)
pln_9 = Plane(python_3.picking_plane_RCF)

list_7 = ValueList({"0 zero_configuration": 0, "1 forward_kinematics": 1, "2 inverse_kinematics analytical": 2, "3 inverse_kinematics MoveIt": 3, "4 motion_planning": 4, "5 cartesian_motion_planning": 5, "6 'pick_and_place'": 6, "7 from json": 7, "8 picking_configuration_safe": 8}, selected="4 motion_planning")
filter_2 = StreamFilter(
    Gate=list_7,
    Stream0=zero_config_2,
    Stream1=forward_kinematics_2,
    Stream2=analytic_inverse_2.configuration,
    Stream3=ik,
    Stream8=picking_safe_inverse.configuration)

# ----
# Plan 'free' motion
list_8 = ValueList({"ur10e", "ur10e_and_liftkit"}, selected="ur10e")
number_slider_6 = Slider(1, range=1..360)
number_slider_7 = Slider(1, range=1..360)
number_slider_8 = Slider(1, range=1..360)
constraints_from_target_configuration = ConstraintsFromTargetConfiguration(robot=robot_3, target_configuration=analytic_inverse_2.configuration, group=list_8)  # -> constraints
#   port target_configuration: The target configuration.
#   port tolerance_above: The tolerances above the targeted joint value of each configurable joint, defining the upper bound in radians/meters to be achieved.
#   port tolerance_below: The tolerances below the targeted joint value of each configurable joint, defining the lower bound in radians/meters to be achieved.
#   port group: The planning group for which we specify the constraint. Defaults to the robot's main planning group.
#   port constraints: A list joint constraints in radians/meters.
# ---------- constraints_from_target_configuration: Python ----------
"""
Create joint constraints for each of the robot's configurable joints based on a given target configuration.

COMPAS FAB v0.27.0
"""
import math

from ghpythonlib.componentbase import executingcomponent as component
from compas_fab.robots import Configuration


class ConstraintsFromTargetConfiguration(component):
    
    DEFAULT_TOLERANCE_METERS = .001
    DEFAULT_TOLERANCE_RADIANS = math.radians(1)

    def RunScript(self, robot, target_configuration, tolerance_above, tolerance_below, group):
        if robot and target_configuration:
            target_configuration = Configuration.from_revolute_values(target_configuration.revolute_values)
            tolerance_above = tolerance_above or self._generate_default_tolerances(robot.get_configurable_joints(group))
            tolerance_below = tolerance_below or self._generate_default_tolerances(robot.get_configurable_joints(group))

            
            constraints = robot.constraints_from_configuration(
                configuration=target_configuration,
                tolerances_above=tolerance_above,
                tolerances_below=tolerance_below,
                group=group
            )

            return constraints

    def _generate_default_tolerances(self, joints):
        return [
            self.DEFAULT_TOLERANCE_METERS if j.is_scalable()
            else self.DEFAULT_TOLERANCE_RADIANS
            for j in joints
        ]
# ---------- end constraints_from_target_configuration ----------
plan_motion = PlanMotion(
    robot=robot_3,
    goal_constraints=constraints_from_target_configuration,
    start_configuration=picking_safe_inverse.configuration,
    group=list_8,
    compute=Button())  # -> trajectory; inputs goal_constraints: list, attached_collision_meshes: list, path_constraints: list, compute: Boolean
#   port goal_constraints: The goal to be achieved, defined in a set of constraints. Constraints can be very specific, for example defining value domains for each joint, such that the goal configuration is included, or defining a volume in space, to which a specific robot link (e.g. the end-effector) is required to move to.
#   port start_configuration: The robot's full configuration, i.e. values for all configurable joints of the entire robot, at the starting position. Defaults to the all-zero configuration.
#   port group: The planning group used for calculation. Defaults to the robot's main planning group.
#   port attached_collision_meshes: A list of attached collision meshes to be included for planning.
#   port path_constraints: Optional constraints that can be imposed along the solution path. Note that path calculation won't work if the start_configuration violates these constraints. Defaults to None.
#   port planner_id: The name of the algorithm used for path planning. Defaults to 'RRTConnect'
#   port compute: If True, calculates a trajectory.
#   port trajectory: The calculated trajectory.
# ---------- plan_motion: Python ----------
"""
Calculate a motion path.

COMPAS FAB v0.27.0
"""
from ghpythonlib.componentbase import executingcomponent as component
from scriptcontext import sticky as st
from compas_fab.robots import JointConstraint
from compas_fab.ghpython.components import create_id


class PlanMotion(component):
    def RunScript(self, robot, goal_constraints, start_configuration, group, attached_collision_meshes, path_constraints, planner_id, compute):

        key = create_id(self, 'trajectory')
        
        path_constraints = list(path_constraints) if path_constraints else None
        
        attached_collision_meshes = list(attached_collision_meshes) if attached_collision_meshes else None
        planner_id = str(planner_id) if planner_id else 'RRTConnect'
        
        if robot and robot.client and robot.client.is_connected and start_configuration and goal_constraints and compute:
            st[key] = robot.plan_motion(goal_constraints,
                                        start_configuration=start_configuration,
                                        group=group,
                                        options=dict(
                                            attached_collision_meshes=attached_collision_meshes,
                                            path_constraints=path_constraints,
                                            planner_id=planner_id,
                                        ))

        trajectory = st.get(key, None)
        return trajectory
# ---------- end plan_motion ----------
trajectory_visualize = TrajectoryVisualize(robot=robot_3, lift=l, group=list_8, trajectory=plan_motion)  # -> start_configuration, configurations, fraction, time, planes, P, V, A
#   port group: The planning group for which this trajectory was planned.
#   port trajectory: The calculated trajectory.
#   port start_configuration: The start configuration of the trajectory.
#   port configurations: The full configurations along the trajectory.
#   port fraction: Indicates the fraction of requested trajectory that was calculated, e.g. 1 means the full trajectory was found.
#   port time: The time which is needed to execute that trajectory at full speed.
#   port planes: The planes of the robot's end-effector.
#   port P: The positions along the trajectory
#   port V: The velocities along the trajectory
#   port A: The accelerations along the trajectory
# ---------- trajectory_visualize: Python ----------
"""
Visualizes a trajectory.

COMPAS FAB v0.27.0
"""
from compas_ghpython import draw_frame
from compas_ghpython import list_to_ghtree
from compas_fab.robots import Configuration
from ghpythonlib.componentbase import executingcomponent as component
from compas.geometry import Translation

class TrajectoryVisualize(component):
    def RunScript(self, robot, lift, group, trajectory):
        start_configuration = None
        configurations = []
        fraction = 0.
        time = 0.

        planes = []
        positions = []
        velocities = []
        accelerations = []

        if robot and trajectory:
            group = group or robot.main_group_name

            for c in trajectory.points:
                config = robot.merge_group_with_full_configuration(c, trajectory.start_configuration, group)
                joint_names_ordered = ['robot_ewellix_lift_top_joint', 'robot_arm_shoulder_pan_joint', 'robot_arm_shoulder_lift_joint', 'robot_arm_elbow_joint', 'robot_arm_wrist_1_joint', 'robot_arm_wrist_2_joint', 'robot_arm_wrist_3_joint']
                joint_values_ordered = [config.joint_values[config.joint_names.index(joint_name)] for joint_name in joint_names_ordered]
                joint_types_ordered = [config.joint_types[config.joint_names.index(joint_name)] for joint_name in joint_names_ordered]
                mobile_robot_config = Configuration(joint_values_ordered, joint_types_ordered, joint_names_ordered)
                configurations.append(mobile_robot_config)
                frame = robot.forward_kinematics(c, group, options=dict(solver='model'))
                T = Translation.from_vector(robot.RCF.zaxis*lift)
                frame.transform(T)
                # transform the planes to mobile robot base
                planes.append(draw_frame(frame.transformed(robot.transformation_BCF_WCF())))
                positions.append(c.positions)
                velocities.append(c.velocities)
                accelerations.append(c.accelerations)

            start_configuration = trajectory.start_configuration
            fraction = trajectory.fraction
            time = trajectory.time_from_start

        P = list_to_ghtree(list(zip(*positions)))
        V = list_to_ghtree(list(zip(*velocities)))
        A = list_to_ghtree(list(zip(*accelerations)))

        # return outputs if you have them; here I try it for you:
        #print configurations
        return (start_configuration, configurations, fraction, time, planes, P, V, A)
# ---------- end trajectory_visualize ----------
python_4 = GhPythonScript(configurations=trajectory_visualize.configurations)  # -> first_configuration, last_configuration, reversed_free_motion_configurations; inputs configurations: list
# ---------- python_4: Python ----------
import rhinoscriptsyntax as rs

if configurations:
    first_configuration = configurations[0]
    last_configuration = configurations[-1]
    reversed_free_motion_configurations = configurations[::-1]
# ---------- end python_4 ----------

bang_2 = GhPythonScript(x=[acm.bang, cm])  # -> out, flatten(x); inputs x: list; same code as bang

# ----
# Visualisation
show_end_effector_frame_2 = BooleanToggle(False)
show_base_frame_2 = BooleanToggle(True)
show_collision_2 = BooleanToggle(False)
show_frames_2 = BooleanToggle(False)
show_visual_2 = BooleanToggle(True)
show_reach_2 = BooleanToggle(False)
show_acm_2 = BooleanToggle(True)
show_cm_2 = BooleanToggle(False)
robot_visualize_2 = RobotVisualize(
    robot=robot_3,
    group=list_3,
    configuration=filter_2,
    show_visual=show_visual_2,
    show_collision=show_collision_2,
    show_frames=show_frames_2,
    show_base_frame=show_base_frame_2,
    show_robot_frame=show_robot_frame,
    show_end_effector_frame=show_end_effector_frame_2,
    show_reach=show_reach_2,
    show_cm=show_cm_2,
    show_acm=show_acm_2,
    redraw=bang_2.x)  # -> visual, collision, collision_meshes, attached_meshes, all_frames, base_frame, robot_frame, ee_frame, reach; inputs show_visual: Boolean, show_collision: Boolean, show_frames: Boolean, show_base_frame: Boolean, show_end_effector_frame: Boolean, show_cm: Boolean, show_acm: Boolean, redraw: list
#   port group: The planning group used for end-effector and base visualization.
#   port configuration: The robot's full configuration.
#   port show_visual: Whether or not to show the robot's visual meshes.
#   port show_collision: Whether or not to show the robot's collision meshes.
#   port show_frames: Whether or not to show the robot's joint frames.
#   port show_base_frame: Whether or not to show the robot's base frame.
#   port show_end_effector_frame: Whether or not to show the robot's end-effector frame.
#   port show_cm: Whether or not to show the collision meshes (if any).
#   port show_acm: Whether or not to show the attached collision meshes (if any).
#   port visual: Rhino meshes of the robot's visual geometry (if any).
#   port collision: Rhino meshes of the robot's collision geometry (if any).
#   port collision_meshes: Rhino meshes of the scene's collision meshes (if any).
#   port attached_meshes: Rhino meshes of the scene's attached collision meshes (if any).
#   port all_frames: The robot's joint frames as Rhino planes (if any).
#   port base_frame: The robot's base frame as a Rhino plane (if any).
#   port ee_frame: The robot's end-effector frame as a Rhino plane (if any).
# ---------- robot_visualize_2: Python ----------
"""
Visualizes the robot.

COMPAS FAB v0.27.0
"""
import Rhino.Geometry as rg
import ghpythonlib.components as ghcomp
from compas.artists import Artist
from compas.geometry import Frame
from compas.geometry import Transformation
from compas_fab.robots import PlanningScene
from compas_ghpython.utilities import draw_frame
from ghpythonlib.componentbase import executingcomponent as component

class RobotVisualize(component):
    def RunScript(
        self,
        robot,
        group,
        configuration,
        show_visual,
        show_collision,
        show_frames,
        show_base_frame,
        show_robot_frame,
        show_end_effector_frame,
        show_reach,
        show_cm,
        show_acm,
        redraw
    ):

        visual = None
        collision = None
        collision_meshes = None
        attached_meshes = None
        frames = None
        base_frame = None
        robot_frame = None
        ee_frame = None
        all_frames = None
        reach = None

        if robot:
            show_visual = True if show_visual is None else show_visual
            show_cm = True if show_cm is None else show_cm
            show_acm = True if show_acm is None else show_acm
            configuration = configuration or robot.zero_configuration()

            robot.update(configuration, visual=show_visual, collision=show_collision)
            frames = robot.transformed_frames(configuration, group)

            if show_visual:
                visual = robot.artist.draw_visual()
                # orient the robot to its base plane:
                robot_BCF = draw_frame(robot.BCF) 
                init_robot_plane = rg.Plane.WorldXY
                visual = ghcomp.Orient(visual, init_robot_plane, robot_BCF)[0]

            if show_collision:
                collision = robot.artist.draw_collision()

            if show_base_frame:
                base_frame = robot.BCF

            if show_robot_frame:
                robot_frame = robot.RCF
                #robot_frame = robot.to_world_coordinates(robot_frame)
                
            if show_end_effector_frame:
                ee_frame = robot.forward_kinematics(
                    configuration, group, options=dict(solver="model")
                )

            if show_frames:
                all_frames = [robot.to_world_coordinates(frame) for frame in frames]
                
            if show_reach:
                ur_base_plane = draw_frame(robot.RCF)
                reach = rg.Sphere(ur_base_plane, 1.25 + robot.attached_tool.frame.point.z)

            if show_cm or show_acm:
                scene = PlanningScene(robot)
                scene = robot.client.get_planning_scene()

                collision_meshes = []
                attached_meshes = []

                if show_cm:
                    for co in scene.world.collision_objects:
                        header = co.header
                        frame_id = header.frame_id
                        cms = co.to_collision_meshes()

                        for cm in cms:
                            if cm.frame != Frame.worldXY():
                                t = Transformation.from_frame(cm.frame)
                                mesh = cm.mesh.transformed(t)
                            else:
                                mesh = cm.mesh
                            
                            mesh_t = mesh.transformed(robot.transformation_BCF_WCF())
                            collision_meshes.append(Artist(mesh_t).draw())

                if show_acm:
                    for aco in scene.robot_state.attached_collision_objects:
                        for acm in aco.to_attached_collision_meshes():
                            frame_id = aco.object["header"]["frame_id"]
                            frame = robot.forward_kinematics(
                                configuration, options=dict(link=frame_id)
                            )
                            t = Transformation.from_frame(frame)

                            # Local CM frame
                            if (
                                acm.collision_mesh.frame
                                and acm.collision_mesh.frame != Frame.worldXY()
                            ):
                                t = t * Transformation.from_frame(
                                    acm.collision_mesh.frame
                                )

                            mesh = acm.collision_mesh.mesh.transformed(t)
                            # transform to mobile robot base
                            mesh_t = mesh.transformed(robot.transformation_BCF_WCF())

                            attached_meshes.append(Artist(mesh_t).draw())

        return (
            visual,
            collision,
            collision_meshes,
            attached_meshes,
            all_frames,
            base_frame,
            robot_frame,
            ee_frame,
            reach
        )
# ---------- end robot_visualize_2 ----------
geo = Geometry(robot_visualize_2.visual)
geo_2 = Geometry(robot_visualize_2.collision_meshes)
geo_3 = Geometry(robot_visualize_2.collision)
geo_4 = Geometry(robot_visualize_2.attached_meshes)
geo_5 = Geometry(robot_visualize_2.reach)
draw_2 = GhPythonScript(
    frames=[robot_visualize_2.robot_frame, robot_visualize_2.all_frames, robot_visualize_2.ee_frame],
    scale=Slider(0.2, range=0..1))  # -> P, V, C, W; inputs frames: list; same code as draw
preview = CustomPreview(Geometry=geo_5, Shader=ColourSwatch(SwatchColor=RGBA(255, 212, 212, 97)))
vdisex = VectorDisplayEx(Point=draw_2.P, Vector=draw_2.V, Colour=draw_2.C, Width=draw_2.W)
preview_2 = CustomPreview(Geometry=geo, Shader=ColourSwatch(SwatchColor=RGB(105, 105, 105)))

planes = Plane(trajectory_visualize.planes)
preview_3 = CustomPreview(Geometry=geo_4, Material=ColourSwatch(SwatchColor=RGB(255, 235, 199)))
interpolate = Interpolate(Vertices=planes, Degree=3, Periodic=False, KnotStyle=1)  # -> Curve, Length, Domain

measured_robot_plane = Plane(set_base_frame_2.base_plane)  # disabled
robot_name = Panel("AA")  # disabled

# ----
# Update "robot AA" frame
# to Realtime Database
connect_3 = BooleanToggle(False)  # disabled
update = Button()  # disabled
upload = PythonScript(robot_name=robot_name, measured_robot_plane=measured_robot_plane, update_robot_base_plane=update, connect=connect_3)  # inputs current_index: Int32, connect: Boolean; disabled
# ---------- upload: Python ----------
import os
import compas
from compas.rpc import Proxy
from compas_rhino.conversions import plane_to_compas_frame

if robot_name =="AA":
    robot_frame = "robot_AA_base_frame"
elif robot_name == "AB":
    robot_frame = "robot_AB_base_frame"

if connect:
    p = Proxy(package = 'cdf_2023.firebase.realtime_database', path=path +'\src')
    p.stop_server()
    p.start_server()

if update_robot_base_plane and measured_robot_plane and current_index != None:
    measured_robot_frame = plane_to_compas_frame(measured_robot_plane)
    p.update_robot_frame(current_index,robot_name, robot_frame, measured_robot_frame.to_data())
# ---------- end upload ----------
