# Grasshopper definition ex3_assembly_target_geometry_growth_RemotePanel.ghx (Grasshopper 1.0.7)
# plug-ins: CEM_Calculate_Structure, Human

cem_calculate_structure = CEM_Calculate_Structure(TP=<missing>, N=<missing>)
image_sampler = ImageSampler(
    FilePath="C:\Users\lovek\Data Storage\TUM Master Arch 2021-24\Master Thesis\03 Bilder\global parameters-01.jpg",
    Filter="Colour",
    Interpolate=False,
    Umax=1,
    Umin=0,
    Vmax=1,
    Vmin=0,
    Wrap=0)

panel = Panel("Unload libraries")
bang = Button()
unload = PythonScript(bang=bang)
# ---------- unload: Python ----------
from compas_rhino.utilities.misc import get_tolerance
from compas_rhino.utilities.misc import unload_modules

unload_modules("cdf_2023")
# ---------- end unload ----------

rod_length = Slider(0.9, range=0.7..1.7)
offset = Slider(0.06, range=0..0.1)
joint_dist = Slider(0.014, range=0..0.03)
unit_size = Slider(0.25, range=0.08..0.34)
# 1. Define material parameters:
rod_radius = Slider(0.01, range=0.01..0.05)

py = PythonScript()  # -> ENVIRONMENT_NAME, HERE, DATA
# ---------- py: Python ----------
import os
import compas_bootstrapper

HERE = os.path.dirname(ghdoc.Path)
DATA = os.path.abspath(os.path.join(HERE, "..", "data"))
ENVIRONMENT_NAME = compas_bootstrapper.ENVIRONMENT_NAME
print(HERE)
print(DATA)
print(ENVIRONMENT_NAME)
# ---------- end py ----------

# ----
# 5. Mobile robots
yaxis = Curve(<curve referenced from the Rhino model>)
xaxis = Curve(<curve referenced from the Rhino model>)
xaxis_2 = Curve(<curve referenced from the Rhino model>)
yaxis_2 = Curve(<curve referenced from the Rhino model>)
arm_lift = Slider(0, range=0..0.72)
arm_lift_2 = Slider(0, range=0..0.72)
plane = GhPythonScript(plane_axes=[xaxis_2, yaxis_2])  # -> plane; inputs plane_axes: list of Curve
# ---------- plane: Python ----------
import Rhino.Geometry as rg

x_axis, y_axis = plane_axes

x_axis = rg.Line(x_axis.PointAtStart, x_axis.PointAtEnd)
y_axis = rg.Line(y_axis.PointAtStart, y_axis.PointAtEnd)

if x_axis.From.DistanceTo(y_axis.From) < 0.01:
    origin = x_axis.From
    xvec = x_axis.Direction
    yvec = y_axis.Direction
elif x_axis.To.DistanceTo(y_axis.To) < 0.01:
    origin = x_axis.To
    xvec = -x_axis.Direction
    yvec = -y_axis.Direction
elif x_axis.From.DistanceTo(y_axis.To) < 0.01:
    origin = x_axis.From
    xvec = x_axis.Direction
    yvec = -y_axis.Direction
elif x_axis.To.DistanceTo(y_axis.From) < 0.01:
    origin = x_axis.To
    xvec = -x_axis.Direction
    yvec = y_axis.Direction

plane = rg.Plane(origin, xvec, yvec)
# ---------- end plane ----------
plane_2 = GhPythonScript(plane_axes=[xaxis, yaxis])  # -> plane; inputs plane_axes: list of Curve; same code as plane
ur_arm_base_plane = Plane(Plane(origin=(0.275, 0, 1.021), x=(-0.7071067812, 0.7071067812, 0), y=(-0.7071067812, -0.7071067812, 0)))
ur_arm_base_plane_2 = Plane(Plane(origin=(0.275, 0, 1.021), x=(-0.7071067812, 0.7071067812, 0), y=(-0.7071067812, -0.7071067812, 0)))
robot_aa = GhPythonScript(robot_base_plane=plane, ur_arm_base_plane=ur_arm_base_plane, arm_lift=arm_lift)  # -> robot_geo, ur_arm_base_plane_trnsf; inputs ur_arm_base_plane: Plane
# ---------- robot_aa: Python ----------
import rhinoscriptsyntax as rs
import Rhino.Geometry as rg 
from compas.geometry import Transformation, Frame, Translation, Box
from compas_rhino.conversions import plane_to_compas_frame, frame_to_rhino_plane, RhinoBox
from compas.artists import Artist
from compas.colors import Color

ur_arm_base_frame = plane_to_compas_frame(ur_arm_base_plane)
robot_base_frame = plane_to_compas_frame(robot_base_plane)

T = Transformation.from_frame_to_frame(Frame.worldXY(), robot_base_frame)

ur_arm_base_frame_trnsf = ur_arm_base_frame.copy()
ur_arm_base_frame_trnsf.transform(T)

T_lift = Translation.from_vector(ur_arm_base_frame_trnsf.zaxis*arm_lift)
ur_arm_base_frame_trnsf.transform(T_lift)

ur_arm_base_plane_trnsf = frame_to_rhino_plane(ur_arm_base_frame_trnsf)


T1 = Translation.from_vector(robot_base_frame.zaxis*0.5)
robot_geo_frame = robot_base_frame.transformed(T1)

robot_geo_compas = Box(robot_geo_frame, 1.27, 0.76, 0.3)
robot_geo = Artist(robot_geo_compas).draw(Color(0.6,0.6,0.6,1.0))
# ---------- end robot_aa ----------
robot_ab = GhPythonScript(robot_base_plane=plane_2, ur_arm_base_plane=ur_arm_base_plane_2, arm_lift=arm_lift_2)  # -> robot_geo, ur_arm_base_plane_trnsf; inputs ur_arm_base_plane: Plane; same code as robot_aa
pln = Plane(robot_aa.ur_arm_base_plane_trnsf)
geo = Geometry(robot_aa.robot_geo)  # disabled
geo_2 = Geometry(robot_ab.robot_geo)  # disabled
pln_2 = Plane(robot_ab.ur_arm_base_plane_trnsf)
preview = CustomPreview(Geometry=geo, Material=ColourSwatch(SwatchColor=RGBA(199, 199, 199, 89)))
preview_2 = CustomPreview(Geometry=geo_2, Material=ColourSwatch(SwatchColor=RGBA(199, 199, 199, 89)))

ghpython_script = GhPythonScript()  # -> out, a; disabled
# ---------- ghpython_script: Python ----------
################################################################################
# SampleEtoViewCaptureDialog.py
# MIT License - Copyright (c) 2017 Robert McNeel & Associates.
# See License.md in the root of this repository for details.
################################################################################

# Imports from
from Rhino.UI import *
from Eto.Forms import *
from Eto.Drawing import *

# Imports
import Rhino
import Rhino.UI
import Eto
import scriptcontext
import System

################################################################################
# SampleEtoViewCaptureDialog dialog class
################################################################################
class SampleEtoViewCaptureDialog(Eto.Forms.Dialog[bool]):
    
    # Class initializer
    def __init__(self):
        # Initialize dialog box
        self.Title = 'SampleEtoViewCaptureDialog'
        self.Padding = Padding(10)
        # Create a table layout and add all the controls
        layout = TableLayout()
        layout.Padding = Padding(10)
        layout.Spacing = Size(5, 5)
        layout.Rows.Add(self.CreateLabel())
        layout.Rows.Add(self.CreateImageView())
        layout.Rows.Add(None) # spacer
        layout.Rows.Add(self.CreateButtons())
        # Set the dialog content
        self.Content = layout
    
    # Create the dialog label
    def CreateLabel(self):
        self.m_label = Label(Text = 'Click the "Capture" button...')
        return self.m_label
    
    # Create the dialog image list
    def CreateImageView(self):
        self.m_image_view = ImageView()
        self.m_image_view.Size = Size(300, 200)
        self.m_image_view.Image = None
        return self.m_image_view
    
    # Close button click handler
    def OnCloseButtonClick(self, sender, e):
        rc = self.m_image_view.Image is not None
        if rc:
            self.Close(True)
        else:
            self.Close(False)
        
    # Capture button click handler 
    def OnCaptureButtonClick(self, sender, e): 
        # Capture the active view to a System.Drawing.Bitmap
        view = scriptcontext.doc.Views.ActiveView
        bitmap = view.CaptureToBitmap()
        # Convert the System.Drawing.Bitmap to an Eto.Drawing.Bitmap
        # which is required for an Eto image view control
        stream = System.IO.MemoryStream()
        format = System.Drawing.Imaging.ImageFormat.Png
        System.Drawing.Bitmap.Save(bitmap, stream, format)
        if stream.Length != 0:
          self.m_image_view.Image = Bitmap(stream)
        stream.Dispose()
        # Update the text label
        self.m_label.Text = 'Captured view: {}'.format(view.ActiveViewport.Name)
        # Disable the default button
        self.DefaultButton.Enabled = False

    # Create the dialog buttons
    def CreateButtons(self):
        # Create the default button
        self.DefaultButton = Button(Text = 'Capture')
        self.DefaultButton.Click += self.OnCaptureButtonClick
        # Create the abort button
        self.AbortButton = Button(Text = 'Close')
        self.AbortButton.Click += self.OnCloseButtonClick
        # Create button layout
        button_layout = TableLayout()
        button_layout.Spacing = Size(5, 5)
        if Rhino.Runtime.HostUtils.RunningOnWindows:
            button_layout.Rows.Add(TableRow(None, self.DefaultButton, self.AbortButton))
        else:
            button_layout.Rows.Add(TableRow(None, self.AbortButton, self.DefaultButton))
        return button_layout
        
    # Returns the captured image
    def Image(self):
        return self.m_image_view.Image
    
################################################################################
# Function to test the capture dialog
################################################################################
def TestSampleEtoViewCaptureDialog():
    dialog = SampleEtoViewCaptureDialog();
    rc = dialog.ShowModal(RhinoEtoApp.MainWindow)
    if (rc):
        print 'have image'
    
################################################################################
# Check to see if this file is being executed as the "main" python
# script instead of being used as a module by some other python script
# This allows us to use the module which ever way we want.
################################################################################
if __name__ == "__main__":
    TestSampleEtoViewCaptureDialog()
# ---------- end ghpython_script ----------
ghpython_script_2 = GhPythonScript()  # -> out, a; disabled
# ---------- ghpython_script_2: Python ----------
################################################################################
# SampleAppearanceColors.py
# MIT License - Copyright (c) 2017 Robert McNeel & Associates.
# See License.md in the root of this repository for details.
################################################################################
import Rhino
import Rhino.ApplicationSettings as settings

def RGB(val):
    return str.format("(R={0}, G={1}, B={2})", val.R, val.G, val.B)

def PrintHeading(label):
    Rhino.RhinoApp.WriteLine(label)

def PrintColor(label, color):
    Rhino.RhinoApp.WriteLine("\t{0}: {1}", label, RGB(color))

# Prints Rhino's appearance colors to the command line
def SampleAppearanceColors():
    PrintHeading("Command prompt");
    PrintColor("Background", settings.AppearanceSettings.CommandPromptBackgroundColor);
    PrintColor("Text color", settings.AppearanceSettings.CommandPromptTextColor);
    PrintColor("Hover color", settings.AppearanceSettings.CommandPromptBackgroundColor);
    
    PrintHeading("Viewport colors");
    PrintColor("Background", settings.AppearanceSettings.ViewportBackgroundColor);
    PrintColor("Major grid line", settings.AppearanceSettings.GridThickLineColor);
    PrintColor("Minor grid line", settings.AppearanceSettings.GridThinLineColor);
    PrintColor("X-axis line", settings.AppearanceSettings.GridXAxisLineColor);
    PrintColor("Y-axis line", settings.AppearanceSettings.GridYAxisLineColor);
    PrintColor("Z-axis line", settings.AppearanceSettings.GridZAxisLineColor);
    PrintColor("World axis icon X", settings.AppearanceSettings.WorldCoordIconXAxisColor);
    PrintColor("World axis icon Y", settings.AppearanceSettings.WorldCoordIconYAxisColor);
    PrintColor("World axis icon Z", settings.AppearanceSettings.WorldCoordIconZAxisColor);
    PrintColor("Layout", settings.AppearanceSettings.PageviewPaperColor);
    
    PrintHeading("Object display");
    PrintColor("Selected objects", settings.AppearanceSettings.SelectedObjectColor);
    PrintColor("Locked objects", settings.AppearanceSettings.LockedObjectColor);
    PrintColor("New layer", settings.AppearanceSettings.DefaultLayerColor);
    
    PrintHeading("Interface objects");
    PrintColor("Feedback", settings.AppearanceSettings.CrosshairColor);
    PrintColor("Tracking lines", settings.AppearanceSettings.CrosshairColor);
    PrintColor("Crosshair", settings.AppearanceSettings.CrosshairColor);
    
    PrintHeading("Layer dialog box");
    PrintColor("Layout settings background", settings.AppearanceSettings.CurrentLayerBackgroundColor);
    
    PrintHeading("General");
    PrintColor("Window color 1", settings.AppearanceSettings.GetPaintColor(settings.PaintColor.NormalStart));
    PrintColor("Window color 2", settings.AppearanceSettings.GetPaintColor(settings.PaintColor.NormalEnd));
    PrintColor("Window color 3", settings.AppearanceSettings.GetPaintColor(settings.PaintColor.HotStart));
    PrintColor("Window border", settings.AppearanceSettings.GetPaintColor(settings.PaintColor.NormalBorder));
    PrintColor("Window text", settings.AppearanceSettings.GetPaintColor(settings.PaintColor.TextEnabled));
    PrintColor("Active viewport title", settings.AppearanceSettings.GetPaintColor(settings.PaintColor.ActiveViewportTitle));
    PrintColor("Inactive viewport title", settings.AppearanceSettings.GetPaintColor(settings.PaintColor.InactiveViewportTitle));
    
    PrintHeading("Widget colors");
    PrintColor("U-axis", settings.AppearanceSettings.GetWidgetColor(settings.WidgetColor.UAxisColor));
    PrintColor("V-axis", settings.AppearanceSettings.GetWidgetColor(settings.WidgetColor.VAxisColor));
    PrintColor("W-axis", settings.AppearanceSettings.GetWidgetColor(settings.WidgetColor.WAxisColor));
    
# Check to see if this file is being executed as the "main" python
# script instead of being used as a module by some other python script
# This allows us to use the module which ever way we want.
if __name__ == "__main__":
    SampleAppearanceColors()
# ---------- end ghpython_script_2 ----------
panel_2 = Panel(py.ENVIRONMENT_NAME)
ghpython_script_3 = GhPythonScript()  # -> out, a; disabled
# ---------- ghpython_script_3: Python ----------
################################################################################
# SampleEtoCollapsibleDialog.py
# MIT License - Copyright (c) 2017 Robert McNeel & Associates.
# See License.md in the root of this repository for details.
################################################################################
import scriptcontext
import rhinoscriptsyntax as rs
import clr
import sys

from Rhino.UI import *
from Eto.Forms import Form, Dialog, Label, TextBox, StackLayout, Orientation, Button, HorizontalAlignment, VerticalAlignment, TextAlignment, NumericUpDown, MessageBox, DropDown, CheckBox, TableLayout, StackLayoutItem, DynamicLayout, Control, Panel, Form
from Eto.Drawing import *

# Custom label helper to set alignment
def L(text):
	return Label(Text = text, VerticalAlignment = VerticalAlignment.Center, TextAlignment = TextAlignment.Right)

form = Dialog[bool]() # return True or False from ShowModal()
form.Title = "My Collapsible Eto Form"
form.Resizable = True
form.Padding = Padding(5)

# set content of the collapsed section
collapsePanel = DynamicLayout(Visible = False, Padding = Padding(40, 10), DefaultSpacing = Size(5, 5))
collapsePanel.BeginVertical()
collapsePanel.AddRow(None, L("Density:"), NumericUpDown())
collapsePanel.AddRow(None, L("Maximum angle:"), NumericUpDown())
collapsePanel.AddRow(None, L("Maximum aspect ratio:"), NumericUpDown())
collapsePanel.AddRow(None, L("Minimum edge length:"), NumericUpDown())
collapsePanel.AddRow(None, L("Maximum edge length:"), NumericUpDown())
collapsePanel.AddRow(None, L("Maximum distance, edge to surface:"), NumericUpDown())
collapsePanel.AddRow(None, L("Minimum initial grid quads:"), NumericUpDown())
collapsePanel.EndVertical()
collapsePanel.BeginVertical()
collapsePanel.AddRow(None, CheckBox(Text = "Refine mesh"))
collapsePanel.AddRow(None, CheckBox(Text = "Jagged seams"), CheckBox(Text = "Pack textures"), None)
collapsePanel.AddRow(None, CheckBox(Text = "Simple planes"))
collapsePanel.EndVertical()

# button to toggle collapsing
collapseButton = Button(Text = "v", MinimumSize = Size.Empty)
def collapseButton_Click(sender, e):
	try:
		if collapsePanel.Visible:
			form.ClientSize = Size(form.ClientSize.Width, form.ClientSize.Height - collapsePanel.Height)
			collapsePanel.Visible = False
			collapseButton.Text = "^"
		else:
			collapsePanel.Visible = True
			collapseButton.Text = "v"
			form.ClientSize = Size(max(form.ClientSize.Width, collapsePanel.Width), form.ClientSize.Height + collapsePanel.Height)
	except:
		print "Unexpected error:", sys.exc_info()[0]
		pass # so we don't bring down rhino if there's a bug in the script

collapseButton.Click += collapseButton_Click


# a few buttons always shown at the bottom
previewButton = Button(Text = "Preview")

cancelButton = Button(Text = "Cancel")
def cancelButton_Click (sender, e):
	try:
		form.Close(False)
	except:
		print "Unexpected error:", sys.exc_info()[0]
		pass # so we don't bring down rhino if there's a bug in the script
cancelButton.Click += cancelButton_Click;

okButton = Button(Text = "OK")
def okButton_Click (sender, e):
	try:
		form.Close(True)
	except:
		print "Unexpected error:", sys.exc_info()[0]
		pass # so we don't bring down rhino if there's a bug in the script
okButton.Click += okButton_Click

# set default buttons when user presses enter or escape anywhere on the form
form.DefaultButton = okButton
form.AbortButton = cancelButton
toleranceUpDown = NumericUpDown()

# our main layout
layout = DynamicLayout(DefaultSpacing = Size(2,2))
layout.AddSeparateRow(None, L("Tolerance"), toleranceUpDown, L("millimeters"), collapseButton)
layout.AddCentered(collapsePanel) # we need this auto-sized so we can get its width to adjust form height
layout.Add(None); # expanding space, in case you want the form re-sizable
layout.AddSeparateRow(None, previewButton, cancelButton, okButton);
form.Content = layout;
	
	
if form.ShowModal():
	print "Do something, user clicked OK"
# ---------- end ghpython_script_3 ----------
modelessform = GhPythonScript()  # -> out, a; disabled
# ---------- modelessform: Python ----------
################################################################################
# SampleEtoModelessForm.py
# Copyright (c) 2017 Robert McNeel & Associates.
# See License.md in the root of this repository for details.
################################################################################

import System
import Rhino
import Rhino.UI
import Eto.Drawing as drawing
import Eto.Forms as forms
import scriptcontext as sc

################################################################################
# SampleEtoModelessForm class
################################################################################
class SampleEtoModelessForm(forms.Form):
    
    # Initializer
    def __init__(self):
        self.m_selecting = False
        # Basic form initialization
        self.Initialize()
        # Create the form's controls
        self.CreateFormControls()
        # Fill the form's listbox
        self.FillListBox()
        # Create Rhino event handlers
        self.CreateEvents()
    
    # Basic form initialization
    def Initialize(self):
        self.Title = 'Sample Modeless Form'
        self.Padding = drawing.Padding(5)
        self.Resizable = True
        self.Maximizable = False
        self.Minimizable = False
        self.ShowInTaskbar = False
        self.MinimumSize = drawing.Size(200, 150)
        # FormClosed event handler
        self.Closed += self.OnFormClosed
    
    # Adds a listitem to the listbox
    def AddObject(self, obj):
        item = forms.ListItem()
        item.Text = obj.ShortDescription(False)
        if obj.Name:
            item.Text += " - " + obj.Name
        item.Tag = obj.Id
        self.m_listbox.Items.Add(item)
        
    # Fills the listbox with document objects
    def FillListBox(self):
        iter = Rhino.DocObjects.ObjectEnumeratorSettings()
        iter.NormalObjects = True
        iter.LockedObjects = False
        iter.IncludeLights = True
        iter.IncludeGrips = False
        #objects = sc.doc.Objects.GetObjectList(iter)
        #for obj in objects:
        #    self.AddObject(obj)
     
    # CloseDocument event handler
    def OnCloseDocument(self, sender, e):
        self.m_listbox.Items.Clear()
        
    # NewDocument event handler
    def OnNewDocument(self, sender, e):
        self.FillListBox()
        
    # EndOpenDocument event handler
    def OnEndOpenDocument(self, sender, e):
        self.FillListBox()
        
    # OnAddRhinoObject event handler
    def OnAddRhinoObject(self, sender, e):
        self.AddObject(e.TheObject)
    
    # OnDeleteRhinoObject event handler
    def OnDeleteRhinoObject(self, sender, e):
        for item in self.m_listbox.Items:
            if item.Tag == e.ObjectId:
                self.m_listbox.Items.Remove(item)
                break
    
    # OnSelectObjects event handler
    def OnSelectObjects(self, sender, e):
        if self.m_selecting == True:
            return
        if e.RhinoObjects.Length == 1:
            i = 0
            for item in self.m_listbox.Items:
                if item.Tag == e.RhinoObjects[0].Id:
                    self.m_listbox.SelectedIndex = i
                    break
                else:
                    i += 1
        else:
            self.m_listbox.SelectedIndex = -1
    
    # OnDeselectAllObjects event handler
    def OnDeselectAllObjects(self, sender, e):
        if self.m_selecting == True:
            return
        self.m_listbox.SelectedIndex = -1
    
    # Create Rhino event handlers
    def CreateEvents(self):
        Rhino.RhinoDoc.CloseDocument += self.OnCloseDocument
        Rhino.RhinoDoc.NewDocument += self.OnNewDocument
        Rhino.RhinoDoc.EndOpenDocument += self.OnEndOpenDocument
        Rhino.RhinoDoc.AddRhinoObject += self.OnAddRhinoObject
        Rhino.RhinoDoc.DeleteRhinoObject += self.OnDeleteRhinoObject
        Rhino.RhinoDoc.SelectObjects += self.OnSelectObjects
        Rhino.RhinoDoc.DeselectAllObjects += self.OnDeselectAllObjects
        
    # Remove Rhino event handlers
    def RemoveEvents(self):        
        Rhino.RhinoDoc.CloseDocument -= self.OnCloseDocument
        Rhino.RhinoDoc.NewDocument -= self.OnNewDocument
        Rhino.RhinoDoc.EndOpenDocument -= self.OnEndOpenDocument
        Rhino.RhinoDoc.AddRhinoObject -= self.OnAddRhinoObject
        Rhino.RhinoDoc.DeleteRhinoObject -= self.OnDeleteRhinoObject
        Rhino.RhinoDoc.SelectObjects -= self.OnSelectObjects
        Rhino.RhinoDoc.DeselectAllObjects -= self.OnDeselectAllObjects
        
    # Create all of the controls used by the form
    def CreateFormControls(self):
        # Create table layout
        layout = forms.TableLayout()
        layout.Padding = drawing.Padding(10)
        layout.Spacing = drawing.Size(5, 5)
        # Add controls to layout
        layout.Rows.Add(forms.Label(Text = 'Rhino Objects:'))
        layout.Rows.Add(self.CreateListBoxRow())
        layout.Rows.Add(self.CreateButtonRow())
        # Set the content
        self.Content = layout
    
    # Listbox.SelectedIndexChanged event handler
    def OnSelectedIndexChanged(self, sender, e):
        index = self.m_listbox.SelectedIndex
        if index >= 0:
            self.m_selecting = True
            item = self.m_listbox.Items[index]
            Rhino.RhinoApp.RunScript("_SelNone", False)
            Rhino.RhinoApp.RunScript("_SelId " + item.Tag.ToString() + " _Enter", False)
            self.m_selecting = False
    
    # Called by CreateFormControls to creates the
    # table row that contains the listbox
    def CreateListBoxRow(self):
        # Create the listbox
        self.m_listbox = forms.ListBox()
        self.m_listbox.Size = drawing.Size(200, 100)
        self.m_listbox.SelectedIndexChanged += self.OnSelectedIndexChanged
        # Create the table row
        table_row = forms.TableRow()
        table_row.ScaleHeight = True
        table_row.Cells.Add(self.m_listbox)
        return table_row
    
    # 'Select' button click handler
    def OnSelectClick(self, sender, e):
        self.m_selecting = True
        self.m_listbox.SelectedIndex = -1
        Rhino.RhinoApp.RunScript("_SelAll", False)
        self.m_selecting = False
    
    # 'Clear' button click handler
    def OnClearClick(self, sender, e):
        self.m_selecting = True
        self.m_listbox.SelectedIndex = -1
        Rhino.RhinoApp.RunScript("_SelNone", False)
        self.m_selecting = False
    
    # Called by CreateFormControls to creates the
    # table row that contains the button controls.
    def CreateButtonRow(self):
        # Select button
        select_button = forms.Button(Text = 'Select All')
        select_button.Click += self.OnSelectClick
        # Clear button
        clear_button = forms.Button(Text = 'Clear')
        clear_button.Click += self.OnClearClick
        # Create layout
        layout = forms.TableLayout(Spacing = drawing.Size(5, 5))
        layout.Rows.Add(forms.TableRow(None, select_button, clear_button, None))
        return layout
    
    # Form Closed event handler
    def OnFormClosed(self, sender, e):
        # Remove the events added in the initializer
        self.RemoveEvents()
        # Dispose of the form and remove it from the sticky dictionary
        if sc.sticky.has_key('sample_modeless_form'):
            form = sc.sticky['sample_modeless_form']
            if form:
                form.Dispose()
                form = None
            sc.sticky.Remove('sample_modeless_form')
    
################################################################################
# TestSampleEtoModelessForm function
################################################################################
def TestSampleEtoModelessForm():
    
    # See if the form is already visible
    if sc.sticky.has_key('sample_modeless_form'):
        return
    
    # Create and show form
    form = SampleEtoModelessForm()
    form.Owner = Rhino.UI.RhinoEtoApp.MainWindow
    form.Show()
    # Add the form to the sticky dictionary so it
    # survives when the main function ends.
    sc.sticky['sample_modeless_form'] = form
    
################################################################################
# Check to see if this file is being executed as the 'main' python
# script instead of being used as a module by some other python script
# This allows us to use the module which ever way we want.
################################################################################
if __name__ == '__main__':
    TestSampleEtoModelessForm()
# ---------- end modelessform ----------
mode = Slider(1, range=0..4)

# ----
# Preview Mode
list = ValueList({"Built by Human/Robot": 0, "Design Generation": 1, "Assembly Workflow": 2, "Branches": 3, "Sequence": 4}, selected="Sequence")

panel_3 = Panel("""Built by Human/Robot
Design Generation
Assembly Workflow
Branches
Sequence""")

y = Curve(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)  # disabled
pt = Point(Point(-0.002611679333, -0.4167082675, 0.4218038534))  # disabled
x = Curve(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)  # disabled
pl = ConstructPlane(Origin=pt, XAxis=x, YAxis=y)  # disabled

import = Button(ExpressionNormal="True", ExpressionPressed="False")

# ----
# (2) Load assembly (.json)
# 1. Write the name of your saved assembly file
# or select one from suggested:
# Type your name...
panel_4 = Panel("2023_07_28_11_43_FINAL_200_assembly.json")
panel_5 = Panel("final_assembly_assembly.json")
initial_assembly = GhPythonScript(DATA=py.DATA, filename=panel_4, import_from_json=import)  # -> out, assembly; inputs import_from_json: Boolean
# ---------- initial_assembly: Python ----------
import os
import json
from scriptcontext import sticky
import Rhino.Geometry as rg
import math

from cdf_2023.assembly import Assembly
from compas_ghpython import draw_frame
from compas.geometry import Translation

if import_from_json:
    PATH = os.path.join(DATA, "assembly", filename)
    assembly = Assembly.from_json(PATH)

    

# create a dictionary to store global value in 
assembly.globals = {}

# define global values
assembly.globals['rod_radius'] = 0.01
assembly.globals['rod_length'] = 0.7
assembly.globals['rf_unit_offset'] = 0.22
assembly.globals['rf_unit_radius'] = 0.15


#T = Translation.from_vector(assembly.element(40).frame.xaxis*-0.24)
#assembly.element(40).transform(T)
# ---------- end initial_assembly ----------

reset = Button()

# ----
# (1) New assembly
# Create an element object.
globals = GhPythonScript(
    reset=reset,
    rod_radius=rod_radius,
    rod_length=rod_length,
    rf_unit_offset=offset,
    joint_dist=joint_dist,
    unit_size=unit_size)  # -> assembly
# ---------- globals: Python ----------
from cdf_2023.assembly import Assembly

# create assembly
assembly = Assembly()

# create a dictionary to store global value in 
assembly.globals = {}

# define global values
assembly.globals['rod_radius'] = rod_radius
assembly.globals['rod_length'] = rod_length
assembly.globals['rf_unit_offset'] = rf_unit_offset
assembly.globals['rf_unit_radius'] = unit_size
assembly.globals['joint_dist'] = joint_dist

assembly.joints = []
print(assembly.globals)
# ---------- end globals ----------
mesh = Mesh(<mesh referenced from the Rhino model>)
brep = Brep(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)
brep_2 = Brep(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)
elem_60_def = GhPythonScript(assembly=globals, joint_geo=mesh, cr1=brep_2, cr2=brep)  # -> assembly, elem, joint_elem, joint_elem_mir, joints_planes; inputs joint_geo: Mesh, cr1: Surface, cr2: Surface
# ---------- elem_60_def: Python ----------
import os
import sys
import json
import math

import rhinoscriptsyntax as rs

from compas.geometry import Frame, Plane, Rotation, Vector, Point
from compas.geometry import Circle, Cylinder, Translation, Line, Cone
from compas.artists import Artist
from compas_rhino.conversions import RhinoSurface, RhinoMesh
from cdf_2023.assembly import Element

rf_unit_offset = assembly.globals['rf_unit_offset']
rf_unit_radius = assembly.globals['rf_unit_radius']
radius = assembly.globals['rod_radius']
length = assembly.globals['rod_length']
joint_dist = assembly.globals['joint_dist']

cross_section_plane = Plane.from_frame(Frame.worldYZ())
cross_section = Circle(cross_section_plane, radius)

elem_geo = Cylinder(cross_section, length)

elem = Element.from_shape(elem_geo, Frame.worldXY())
print(elem.frame)

#connector_frame_1 = Frame([(length/2-rf_unit_radius/2-rf_unit_offset),-rf_unit_radius/(2*math.sqrt(3)),0], [1,0,0], [0,1,0])
#connector_frame_2 = Frame([-(length/2-rf_unit_radius/2-rf_unit_offset),rf_unit_radius/(2*math.sqrt(3)),0], [-1,0,0], [0,-1,0])

connector_frame_1 = Frame([0,0,0], [1,0,0], [0,1,0])
connector_frame_2 = Frame([0,0,0], [-1,0,0], [0,-1,0])

#connector_frame_1 = elem.frame.transformed()
#T1 = Translation.from_vector(elem.frame.xaxis*-1)
#T2 = Translation.from_vector(elem.frame.yaxis*-1)
#connector_frame_2 = Frame([0,0,0], [-1,0,0], [0,-1,0])
check_frame = Frame(elem.frame.point,elem.frame.xaxis*-1, elem.frame.yaxis*-1)
print elem.frame.point
print check_frame

#print connector_frame_1
#print connector_frame_2
#print (connector_frame_1.xaxis*-1)

# this angle with "-" will be the mirrored unit
angle = math.asin((2 * radius + joint_dist)/(math.sqrt(3) * rf_unit_radius))
#angle = math.asin((2 * radius + joint_dist)/rf_unit_radius)
print angle

#R1 = Rotation.from_axis_and_angle(connector_frame_1.yaxis, -angle, connector_frame_1.point)
#R2 = Rotation.from_axis_and_angle(connector_frame_2.yaxis, -angle, connector_frame_2.point)

#connector_frame_1.transform(R1)
#connector_frame_2.transform(R2)

elem.connector_frame_1 = connector_frame_1
elem.connector_frame_2 = connector_frame_2

R3 = Rotation.from_axis_and_angle(connector_frame_1.zaxis, math.radians(60), connector_frame_1.point)
R4 = Rotation.from_axis_and_angle(connector_frame_2.zaxis, math.radians(60), connector_frame_2.point)

connector_frame_1_trnsf = connector_frame_1.transformed(R3)
connector_frame_2_trnsf = connector_frame_2.transformed(R4)

T1 = Translation.from_vector(connector_frame_1_trnsf.yaxis*rf_unit_radius)
T2 = Translation.from_vector(connector_frame_2_trnsf.yaxis*rf_unit_radius)

joint_frame_1 = connector_frame_1.transformed(T1)
joint_frame_2 = connector_frame_2.transformed(T2)

R5 = Rotation.from_axis_and_angle(joint_frame_1.zaxis, math.radians(0), joint_frame_1.point)
R6 = Rotation.from_axis_and_angle(joint_frame_2.zaxis, math.radians(0), joint_frame_2.point)

joint_frame_1.transform(R5)
joint_frame_2.transform(R6)

elem.joint_frame_1 = joint_frame_1
elem.joint_frame_2 = joint_frame_2


joints_planes =[]

joints_planes.append(Artist(joint_frame_1).draw())
joints_planes.append(Artist(joint_frame_2).draw())

elem.line = Line([-length/2.,0,0],[length/2.,0,0])

#circle_frame_1 = Frame([-0.34,0,0],[0,0,-1],[0,1,0])
#circle_frame_2 = Frame([0.34,0,0],[0,0,1],[0,1,0])
#circle_1 = Circle(Plane.from_frame(circle_frame_1), 0.5)
#circle_2 = Circle(Plane.from_frame(circle_frame_2), 0.5)
#cone_2 = Cone(circle_1, 0.32)
#cone_1 = Cone(circle_2, 0.32)
#
#elem.connector_range_1 = cone_1
#elem.connector_range_2 = cone_2

#print elem.connector_range_1

source1 = RhinoSurface.from_geometry(cr1)
source2 = RhinoSurface.from_geometry(cr2)

joint_rhino_mesh = RhinoMesh.from_geometry(joint_geo)
joint_compas_mesh = joint_rhino_mesh.to_compas()
joint_elem = Element.from_shape(joint_compas_mesh, Frame.worldXY())

joint_geo_mir = rs.MirrorObject(joint_geo, (0,0,0) , (0,1,0), True)
joint_rhino_mesh = RhinoMesh.from_geometry(joint_geo)
joint_compas_mesh = joint_rhino_mesh.to_compas()
joint_elem_mir = Element.from_shape(joint_compas_mesh, Frame.worldXY())

elem.connector_range_1 = source1.to_compas()
elem.connector_range_2 = source2.to_compas()
# ---------- end elem_60_def ----------

# ----
# 1.    Choose assembly
# 1. Select if you want to create a new assembly or load existing one
list_2 = ValueList({"(1) New assembly": 1, "(2) Load assembly (.json)": 2}, selected="(1) New assembly")
python = GhPythonScript(selection=list_2, new_assembly=elem_60_def.assembly, imported_assembly=initial_assembly.assembly)  # -> out, assembly
# ---------- python: Python ----------
import rhinoscriptsyntax as rs

if selection == 1:
    assembly = new_assembly
else:
    assembly = imported_assembly
# ---------- end python ----------

# ----
# 2. Connect one option from suggested
#     to define supports:
option_0_worldxy = Plane(PlaneXY(0, 0, 0))
option_1_4_planes = Plane([Plane(origin=(-0.002611679333, -0.7707588361, 0.4118038534), x=(0.00338212045, -0.1931022184, 0.9811728158), y=(-0.9998466536, -0.01751197807, 0)), Plane(origin=(-0.7707588361, 0.002611679333, 0.4118038534), x=(-0.1931022184, -0.00338212045, 0.9811728158), y=(-0.01751197807, 0.9998466536, 0)), Plane(origin=(0.002611679333, 0.7707588361, 0.4118038534), x=(-0.00338212045, 0.1931022184, 0.9811728158), y=(0.9998466536, 0.01751197807, 0)), Plane(origin=(0.7707588361, -0.002611679333, 0.4118038534), x=(0.1931022184, 0.00338212045, 0.9811728158), y=(0.01751197807, -0.9998466536, 0))])
option_3_3_planes = Plane([Plane(origin=(-0.001322382405, -0.4694115256, 0.1787689775), x=(0.3398541508, 0.09989969682, 0.9351573166), y=(-0.9398572889, -4.83719427e-05, 0.3415673786)), Plane(origin=(0.4071834972, 0.233560546, 0.1787689775), x=(-0.2564427507, 0.2443724798, 0.9351573166), y=(0.4699705358, -0.8139161022, 0.3415673786)), Plane(origin=(-0.4058611148, 0.2358509795, 0.1787689776), x=(-0.08341140028, -0.3442721775, 0.9351573162), y=(-0.4698867533, -0.8139644737, -0.3415673794))])
option_4_3_planes = Plane([Plane(origin=(0.4071834972, 0.233560546, 0.1787689775), x=(-0.08627357513, -0.05036917882, 0.994997395), y=(-0.5000418324, 0.8660011165, 0.0004817786491)), Plane(origin=(-0.001322382405, -0.4694115256, 0.1787689775), x=(-0.0004842008583, 0.09989969714, 0.994997395), y=(0.9999998828, 4.837152477e-05, 0.0004817786491)), Plane(origin=(-0.4058611148, 0.2358509796, 0.1787689775), x=(0.08675777599, -0.04953051833, 0.994997395), y=(-0.4999580504, -0.866049488, 0.0004817786491))])
supports = Plane(option_3_3_planes)
initial_configuration = GhPythonScript(assembly=python.assembly, selection=list_2, planes=supports, elem=elem_60_def.elem)  # -> out, assembly; inputs planes: list of Plane
# ---------- initial_configuration: Python ----------
import Rhino.Geometry as rg
import math
from scriptcontext import sticky as st

from compas.geometry import Frame, Vector
from compas.geometry import Rotation, Transformation
from compas.artists import Artist

show_open_connectors = False 

connector_planes = []
support_keys = []


if selection == 1:
    
    radius = assembly.globals['rod_radius']
    length = assembly.globals['rod_length']
    rf_unit_offset = assembly.globals['rf_unit_offset']
    rf_unit_radius = assembly.globals['rf_unit_radius']

    for plane in planes:
        T1 = Transformation.from_frame_to_frame(Frame.worldXY(), Frame(plane.Origin, plane.XAxis, plane.YAxis))
        new_elem = elem.transformed(T1)
        
        R1 = Rotation.from_axis_and_angle(new_elem.frame.zaxis, math.radians(120), [0,0,0])
        R2 = Rotation.from_axis_and_angle(new_elem.frame.zaxis, math.radians(240), [0,0,0])
        
        # set connector state
        new_elem.connector_1_state = True
        new_elem.connector_2_state = False
    
        # add element to assembly
        assembly.add_element(new_elem, 
                             placed_by='human', 
                             robot_name='AA',
                             robot_AA_base_frame=Frame.worldXY(),
                             robot_AB_base_frame=Frame.worldXY(),
                             is_support=True,
                             is_built=True,
                             is_planned=True)
            
    # show open connectors
    if show_open_connectors:
        for key, connectors in assembly.connectors(state='closed'):
            for connector in connectors:
                connector_planes.append(Artist(connector).draw())
    
#    for key, element in assembly.elements():
#        assembly.network.node_attribute(key, 'is_support', True)
        
    #assembly.support_keys = support_keys
# ---------- end initial_configuration ----------

show = BooleanToggle(True)  # disabled
draw = PythonScript(elements=elem_60_def.elem, show=show)  # -> M, F, C; inputs elements: list; disabled
# ---------- draw: Python ----------
from compas.artists import Artist

M = []
C = []
F = []
T = []

if show:
    for elem in elements:
        C.append(Artist(elem.connector_frame_1).draw())
        C.append(Artist(elem.connector_frame_2).draw())
        M += [Artist(elem._mesh).draw([0,0,1,1])]
        F += [Artist(elem.frame).draw()]
        T += [Artist(elem.tool_frame).draw()]
# ---------- end draw ----------
pln_3 = Plane(draw.C)  # disabled
pln_4 = Plane(draw.F)  # disabled
mesh_2 = Mesh(draw.M)  # disabled
point = Point(pln_3)  # disabled
colour_swatch = ColourSwatch(SwatchColor=RGB(221, 0, 0))  # disabled
custom_preview = CustomPreview(Geometry=mesh_2, Material=colour_swatch)  # disabled

list_item = ListItem(List=panel_3, Index=mode, Wrap=True)
panel_6 = Panel(list_item)

option_4_tipi = Brep(<brep referenced from the Rhino model>)
# 2.     Design Generation
option_1_arch = Brep(<brep referenced from the Rhino model>)
option_2_dome = Brep(<brep referenced from the Rhino model>)
option_3_umbrella = Brep(<brep referenced from the Rhino model>)

ghpython_script_4 = GhPythonScript()  # -> out, a; disabled
# ---------- ghpython_script_4: Python ----------
import Eto.Forms as forms
import Rhino.UI
from Eto.Drawing import *

class ModeDialog(forms.Dialog):
    def __init__(self):
        
        self.Title = "Mode Selection Dialog"
        self.ClientSize = Size(300, 200)
        self.Padding = Padding(20)
        
        self.layout = forms.DynamicLayout()
        
        # Dropdown to select mode
        self.mode_dropdown = forms.DropDown()
        self.mode_dropdown.Items.Add("Manual mode")
        self.mode_dropdown.Items.Add("Automatic mode")
        self.mode_dropdown.Items.Add("Joining branches")
        self.mode_dropdown.SelectedIndexChanged += self.on_mode_changed
        
        # Set default selection to Manual mode
        #self.mode_dropdown.SelectedIndex = 0
        
        # Parameters for Manual mode
        self.shift_value_label = forms.Label(Text="Shift Value:")
        self.shift_value_slider = forms.Slider()
        self.shift_value_slider.MinValue = -0.10
        self.shift_value_slider.MaxValue = 0.10
        self.shift_value_slider.Value = 0.0
        
        self.angle_label = forms.Label(Text="Angle:")
        self.angle_numeric = forms.NumericUpDown()
        self.angle_numeric.MinValue = 0
        self.angle_numeric.MaxValue = 360
        self.angle_numeric.Value = 180
        
        self.unit_size_label = forms.Label(Text="Unit Size:")
        self.unit_size_slider = forms.Slider()
        self.unit_size_slider.MinValue = 0.07
        self.unit_size_slider.MaxValue = 0.40
        self.unit_size_slider.Value = 0.2
        
        self.mirror_unit_checkbox = forms.CheckBox(Text="Mirror Unit")
        
        # Parameters for Automatic mode
        self.random_key_checkbox = forms.CheckBox(Text="Random Key")
        self.option_num_label = forms.Label(Text="Option Number:")
        self.option_num_numeric = forms.NumericUpDown()
        self.option_num_numeric.MinValue = 1
        self.option_num_numeric.MaxValue = 200
        self.option_num_numeric.Value = 100
        
        # Add controls to the layout
        self.layout.AddRow(forms.Label(Text="Select Mode:"))
        self.layout.AddRow(self.mode_dropdown)
        
        # Initial visibility settings for parameters
        self.layout.AddRow(self.shift_value_label, self.shift_value_slider)
        self.layout.AddRow(self.angle_label, self.angle_numeric)
        self.layout.AddRow(self.unit_size_label, self.unit_size_slider)
        self.layout.AddRow(self.mirror_unit_checkbox)
        
        self.Content = self.layout

    def on_mode_changed(self, sender, e):
        selected_index = self.mode_dropdown.SelectedIndex
        
        # Show/hide parameters based on selected mode
        self.shift_value_label.Visible = selected_index == 0  # Manual mode
        self.shift_value_slider.Visible = selected_index == 0
        self.angle_label.Visible = selected_index == 0
        self.angle_numeric.Visible = selected_index == 0
        self.unit_size_label.Visible = selected_index == 0
        self.unit_size_slider.Visible = selected_index == 0
        self.mirror_unit_checkbox.Visible = selected_index == 0
        
        self.random_key_checkbox.Visible = selected_index == 1  # Automatic mode
        self.option_num_label.Visible = selected_index == 1
        self.option_num_numeric.Visible = selected_index == 1

# Function to display the mode selection dialog
def display_mode_dialog():
    dialog = ModeDialog()
    rc = dialog.ShowModal(Rhino.UI.RhinoEtoApp.MainWindow)

# Example usage: Call this function to display the dialog
display_mode_dialog()
# ---------- end ghpython_script_4 ----------
error = GhPythonScript()  # -> out; disabled
# ---------- error: Python ----------
################################################################################
# SampleEtoDialog.py
# MIT License - Copyright (c) 2017 Robert McNeel & Associates.
# See License.md in the root of this repository for details.
################################################################################
from Rhino.UI import *
from Eto.Forms import *
from Eto.Drawing import *

################################################################################
# Sample dialog
################################################################################
import Eto.Forms as forms
import Rhino.UI
from Eto.Drawing import *

class ErrorDialog(forms.Dialog):
    def __init__(self, error_message):
        self.Title = "Error Dialog"
        self.Padding = Padding(20)
        self.ClientSize = Size(500, 80)
        
        self.layout = forms.DynamicLayout()
        
        self.error_label = forms.Label(Text=error_message)
        self.layout.AddRow(self.error_label)
        
        # Create the OK button and set its size
        self.ok_button = forms.Button(Text="OK")
        self.ok_button.Size = Size(100, 40)  # Set the button size explicitly
        self.ok_button.Click += self.on_ok_button_click
        self.layout.AddRow(None, self.ok_button)  # Align the button to the right
        
        self.Content = self.layout

    def on_ok_button_click(self, sender, e):
        self.Close()

# Function to display the error dialog
def display_error_dialog(error_message):
    dialog = ErrorDialog(error_message)
    rc = dialog.ShowModal(Rhino.UI.RhinoEtoApp.MainWindow)


################################################################################
# Check to see if this file is being executed as the "main" python
# script instead of being used as a module by some other python script
# This allows us to use the module which ever way we want.
################################################################################

#error = True

# Example usage: Call this function with an error message to display the dialog
if error:
    error_message = "Elements are colliding, not possible to add elements"
    display_error_dialog(error_message)
# ---------- end error ----------

# ----
# Delete Element
number_slider = Slider(33, range=0..200)
remove = Button()
remove_by_key = GhPythonScript(assembly=initial_configuration.assembly, key=number_slider, remove=remove)  # -> out, assembly
# ---------- remove_by_key: Python ----------
if remove:
    assembly.delete_element(key)
# ---------- end remove_by_key ----------

# ----
# Set parameters
list_3 = ValueList({"(1) Add a SINGLE options-pair": 0, "(2) Add TWO options-pairs": 1}, selected="(1) Add a SINGLE options-pair")
get_joining_options = BooleanToggle(False)
show_new_element = BooleanToggle(False)
shift_value = Slider(0, range=-1..1)
pair_index = Slider(0, range=0..10)
point1 = Slider(0.31, range=0..1)
point2 = Slider(0.6, range=0..1)

# ----
# 1. Mode
# (1) 'Manual mode' and (2) 'Automatic mode'
list_4 = ValueList({"1. 'Manual mode'": 0, "2. 'Automatic mode'": 1, "3. Join branches'": 2}, selected="2. 'Automatic mode'")

# ----
# Step-By-Step Generation
# - Set parameters
reset_key = Button()

# ----
# Constraints
# 2. Support geometry
#     (Foundation of the structure)
# 1. Target geometry
#     Describes the general appearence of the structure
guiding_geo = Mesh(option_1_arch)
support_geo = Brep(<brep referenced from the Rhino model>)

# ----
# (2) 'Automatic  mode'
distance_weight = Slider(0, range=0..1)
angle_weight = Slider(1, range=0.1..1.1)
random_key = BooleanToggle(False)
options_num = Slider(100, range=1..300)
compute = Button()

ghpython_script_5 = GhPythonScript()  # -> out, a; disabled
# ---------- ghpython_script_5: Python ----------
import Rhino
import scriptcontext
import System.Guid

def AddAnnotationText():
    pt = Rhino.Geometry.Point3d(10, 0, 0)
    text = "Hello RhinoCommon"
    height = 2.0
    font = "Arial"
    plane = scriptcontext.doc.Views.ActiveView.ActiveViewport.ConstructionPlane()
    plane.Origin = pt
    id = scriptcontext.doc.Objects.AddText(text, plane, height, font, False, False)
    if id!=System.Guid.Empty:
        scriptcontext.doc.Views.Redraw()
        return Rhino.Commands.Result.Success
    return Rhino.Commands.Result.Failure


if __name__=="__main__":
    AddAnnotationText()
# ---------- end ghpython_script_5 ----------

key_at_index = Slider(0, range=0..500)
get_key_by_index = BooleanToggle(False)

previous = Button()
next = Button()

click_me = GhPythonScript()  # -> out, a; disabled
# ---------- click_me: Python ----------
import Eto.Forms as forms
import Rhino.UI

class MyDialog(forms.Dialog):
    def __init__(self):
        self.Title = "My Eto Form"
#        self.Padding = forms.Padding(10)
        
        self.content = forms.StackLayout()
        
        self.label = forms.Label(Text="Hello, Eto!")
        self.content.Items.Add(self.label)
        
        self.button = forms.Button(Text="Click Me")
        self.button.Click += self.on_button_click
        self.content.Items.Add(self.button)
        
        self.Content = self.content
    
    def on_button_click(self, sender, e):
        self.label.Text = "Button Clicked!"

# Create and display the dialog
dialog = MyDialog()
rc = dialog.ShowModal(Rhino.UI.RhinoEtoApp.MainWindow)
# ---------- end click_me ----------
error1 = GhPythonScript()  # -> out, a; disabled
# ---------- error1: Python ----------
import Eto.Forms as forms
import Rhino.UI
from Eto.Drawing import *

class ErrorDialog(forms.Dialog):
    def __init__(self, error_message):
        self.Title = "Error Dialog"
        self.Padding = Padding(20)
        self.Resizable = False
        self.ClientSize = Size(400, 100)
        
        self.content = forms.StackLayout()
        
        self.error_label = forms.Label(Text=error_message)
        self.content.Items.Add(self.error_label)
        
        self.ok_button = forms.Button(Text="OK")
        self.ok_button.Click += self.on_ok_button_click
        self.content.Items.Add(self.ok_button)
        
        self.Content = self.content
    
    def on_ok_button_click(self, sender, e):
        self.Close()

# Function to display the error dialog
def display_error_dialog(error_message):
    dialog = ErrorDialog(error_message)
    rc = dialog.ShowModal(Rhino.UI.RhinoEtoApp.MainWindow)

# Example usage: Call this function with an error message to display the dialog
error_message = "An error occurred!"
display_error_dialog(error_message)
# ---------- end error1 ----------
error2 = GhPythonScript()  # -> out, a; disabled
# ---------- error2: Python ----------
import Eto.Forms as forms
import Rhino.UI
from Eto.Drawing import *

class ErrorDialog(forms.Dialog):
    def __init__(self, error_message):
        self.Title = "Error Dialog"
        self.Padding = Padding(20)
        self.ClientSize = Size(400, 80)
        
        self.layout = forms.DynamicLayout()
        
        self.error_label = forms.Label(Text=error_message)
        self.layout.AddRow(self.error_label)
        
        # Create the OK button and set its size
        self.ok_button = forms.Button(Text="OK")
        self.ok_button.Size = Size(100, 40)  # Set the button size explicitly
        self.ok_button.Click += self.on_ok_button_click
        self.layout.AddRow(None, self.ok_button)  # Align the button to the right
        
        self.Content = self.layout

    def on_ok_button_click(self, sender, e):
        self.Close()

# Function to display the error dialog
def display_error_dialog(error_message):
    dialog = ErrorDialog(error_message)
    rc = dialog.ShowModal(Rhino.UI.RhinoEtoApp.MainWindow)

# Example usage: Call this function with an error message to display the dialog
error_message = "An error occurred!"
display_error_dialog(error_message)
# ---------- end error2 ----------

# ----
# (1) 'Manual mode'
angle = Slider(12.89, range=0..360)
shift_value_2 = Slider(-0.02, range=-0.1..0.2)
mirror_unit = BooleanToggle(False)
unit_size_2 = Slider(0.21, range=0.08..0.5)

panel_7 = Panel("""'Manual mode'
'Automatic mode'
'Join branches'""")
mode_2 = Slider(0, range=0..3)
panel_8 = Panel(list_4)

# ----
# - Select Key
close_connector = Button()

ghpython_script_6 = GhPythonScript()  # -> out, a; disabled
# ---------- ghpython_script_6: Python ----------
################################################################################
# SampleEtoDialog.py
# MIT License - Copyright (c) 2017 Robert McNeel & Associates.
# See License.md in the root of this repository for details.
################################################################################
from Rhino.UI import *
from Eto.Forms import *
from Eto.Drawing import *

################################################################################
# Sample dialog
################################################################################
def TestSampleEtoDialog():
    dialog = Dialog()
    dialog.Title = "Sample Eto Dialog"
    dialog.ClientSize = Size(200, 200)
    dialog.Padding = Padding(5)
    dialog.Resizable = False

    label = Label()
    label.Text = "Hello Rhino.Python!"
    dialog.Content = label

    dialog.ShowModal(RhinoEtoApp.MainWindow)
    
################################################################################
# Check to see if this file is being executed as the "main" python
# script instead of being used as a module by some other python script
# This allows us to use the module which ever way we want.
################################################################################
if __name__ == "__main__":
    TestSampleEtoDialog()
# ---------- end ghpython_script_6 ----------
list_item_2 = ListItem(List=panel_7, Index=mode_2, Wrap=True)

# ----
# 3. Stability calculation
#     Local - in the branch
#     Global - in the whole assembly
# make it always true and delete parameter??
list_5 = ValueList({"(1) GLOBAL stability": 0, "(2) LOCAL stability": 1, "(3) NO stability criteria": 2}, selected="(2) LOCAL stability")
show_resultant = BooleanToggle(True)

panel_9 = Panel(list_item_2)

# ---- group: ADD
add = Button()

# ----
# 4. Collision detection
collision_check = BooleanToggle(True)

show_2 = ValueList({"ASSEMBLY": "show_assembly", "Target Geometry": "show_target_geometry", "Support Geometry": "show_support_geometry", "Joints": "show_joints"}, selected=[])  # disabled
show_3 = ValueList({"Option": "show_option", "Support Elements": "show_support_elements", "Selected Key": "show_selected_key", "Collision": "show_collision"}, selected=[])  # disabled
show_4 = ValueList({"Open keys": "show_open_keys", "All keys": "show_all_keys"}, selected=[])  # disabled
show_5 = ValueList({"Selected connectors ranges": "show_selected_connectors_ranges", "All connectors ranges": "show_all_connectors_ranges", "Intersections": "show_intersection"}, selected=[])  # disabled
show_6 = ValueList({"Open connector planes": "show_open_connectors_planes", "All frames": "show_all_frames", "Robots reach": "show_robots_reach"}, selected=[])  # disabled

# ----
# Preview Mode
list_6 = ValueList({"Built by Human/Robot": 0, "Design Generation": 1, "Assembly Workflow": 2, "Branches": 3, "Sequence": 4}, selected="Design Generation")  # disabled

# ---- group: Platzhalter
bcf_wcs_aa = Plane(Plane(origin=(-1.117452192, -0.4208430177, 0.01980614689), x=(0.5723915496, -0.8199742309, 0.003189757304), y=(0.8199580906, 0.5723429035, -0.009608873971)))
bcf_wcs_ab = Plane(Plane(origin=(0.9896612368, 0.9287122403, 0.007218178072), x=(-0.9475576884, 0.3195482043, -0.004834489242), y=(-0.3195383255, -0.9475694642, -0.002714584304)))

# ----
# 3.     Export
# Export .json
# Type your name...
panel_10 = Panel("assembly_preview_modes_Check")
export = Button()
export_2 = Button()
export_3 = PythonScript(
    DATA=py.DATA,
    joint_elem=elem_60_def.joint_elem,
    assembly=initial_assembly.assembly,
    project_name=panel_10,
    export_to_json=export,
    export_joint_to_json=export_2)  # -> joints_points, joints_lines, planes_list, G_joints
# ---------- export_3: Python ----------
import os
from compas.datastructures.mesh import mesh_quads_to_triangles
from compas.datastructures.mesh import mesh_unify_cycles
from compas.geometry import Transformation, Frame

from datetime import datetime
import json
import compas
from compas.artists import Artist
import ghpythonlib.components as gh
from compas_rhino.conversions import line_to_rhino, plane_to_compas_frame
import Rhino.Geometry as rg

now = datetime.now() # current date and time

if export_to_json:
   # filename = "start_assembly.json"
    date_time = now.strftime("%Y_%m_%d_%H_%M")
    filename = "{}_{}.json".format(project_name, 'assembly')
    PATH = os.path.join(DATA, "assembly", filename)
    
    # the assembly has to be serialized such that it can be called from CPython, True to enable pretty print
    
#    for key, element in assembly.elements():
#        assembly.network.adjacency.clear()
##       assembly.network.node_attribute(key, 'type', 1)
#        assembly.network.node_attribute(key, 'frame_measured', False)
#        assembly.element(key).mesh = None
#        assembly.element(key)._source = None
#        assembly.element(key).connector_frame_1 = None
#        assembly.element(key).connector_frame_2 = None
#        assembly.element(key).connector_range_1 = None
#        assembly.element(key).connector_range_2 = None
#        assembly.element(key).line = None

    assembly.to_json(PATH, True)
    
    #assembly_to_json(PATH, True)
    #joints_to_json(PATH2, True)

def assembly_to_json(path, pretty):
    
    assembly_data = {"node":{}}

    for key, element, data in assembly.elements(data=True):
        print data
        elem_dict = {}
        elem_dict["element"] = {"frame" : assembly.element(key).frame.to_data()}
        elem_dict['is_planned'] = data['is_planned'],
        elem_dict["is_built"] = data['is_built'],
        elem_dict["placed_by"] = data["placed_by"],
        elem_dict["is_support"] = data["is_support"],
        elem_dict["is_held_by_robot"] = data["is_held_by_robot"],
        elem_dict["robot_frame"] = data["robot_frame"],
        elem_dict["frame_measured"] = data["frame_measured"]
        
        assembly_data["node"][str(key)] = elem_dict
        
    compas.json_dump(assembly_data, path, pretty)

new_adjacency = []

for key, element in assembly.elements():
    print key
    adjacency = assembly.network.adjacency[key].keys()
    #print adjacency
    if len(adjacency) > 2:
        #print key, adjacency
        adjacency.sort()
    for index in adjacency:
        if [index, key] not in new_adjacency:
            new_adjacency.append([key, index])

print len(new_adjacency)


joints_points = []
joints_origins = []
joints_lines = []

for list in new_adjacency:
    crv1 = line_to_rhino(assembly.element(list[0]).line)
    crv2 = line_to_rhino(assembly.element(list[1]).line)
    a, b, d = gh.CurveProximity(crv1, crv2)
    axis = rg.Vector3d(b)-rg.Vector3d(a)
    
    joint_plane_origin = rg.Point3d((a.X + b.X)/2, (a.Y + b.Y)/2, (a.Z + b.Z)/2)
    joints_points.append(a)
    joints_points.append(b)
    line = rg.Line(a,b)
    joints_lines.append(line)
    joints_origins.append([joint_plane_origin, axis])


planes_list = []

for pair, origin_axis in zip(new_adjacency, joints_origins):
    xaxis = assembly.element(pair[0]).frame.xaxis
    xaxis_rg = rg.Vector3d(xaxis.x, xaxis.y, xaxis.z)
    zaxis = origin_axis[1]
    yaxis = rg.Vector3d.CrossProduct(xaxis_rg, zaxis)
    plane = rg.Plane(origin_axis[0], xaxis_rg, yaxis)
    planes_list.append(plane)


frames_list = [plane_to_compas_frame(plane) for plane in planes_list]

def joints_to_json(path, pretty):
    
    joints_data = {"joint":{}}
    i = 0
    for pair, origin_axis in zip(new_adjacency, joints_origins):
        xaxis = assembly.element(pair[0]).frame.xaxis
        xaxis_rg = rg.Vector3d(xaxis.x, xaxis.y, xaxis.z)
        zaxis = origin_axis[1]
        yaxis = rg.Vector3d.CrossProduct(xaxis_rg, zaxis)
        plane = rg.Plane(origin_axis[0], xaxis_rg, yaxis)
        frame = plane_to_compas_frame(plane)
        joint_dict = {}

        joint_dict["element"] = {"frame":frame.to_data()}
        joint_dict["adjacency"] = pair


        joints_data["joint"][str(i)] = joint_dict
        i +=1
    compas.json_dump(joints_data, path, pretty)
    
if export_joint_to_json:
    filename = "{}_{}.json".format(project_name, 'joints')
    PATH = os.path.join(DATA, "assembly", filename)
    joints_to_json(PATH, True)
    


G_joints = []

#for frame in frames_list:
#    T = Transformation.from_frame_to_frame(Frame.worldXY(), frame)
#    new_joint = joint_elem.transformed(T)
#    G_joints.append(Artist(new_joint.mesh).draw())
# ---------- end export_3 ----------
pt_2 = Point(export_3.joints_points)
line = Line(export_3.joints_lines)
pln_5 = Plane(export_3.planes_list)
mesh_3 = Mesh(export_3.G_joints)

# ----
# Capture to bitmap
number_slider_2 = Slider(2, range=0..10)
capture = Button()
capture_to_bitmap = PythonScript(DATA=py.DATA, viewport_name="Type name of the view to save...", idx=number_slider_2, capture=capture)  # -> out, a; inputs idx: Int32
# ---------- capture_to_bitmap: Python ----------
import Rhino
import System.Drawing
from scriptcontext import sticky as st

import sys, os
import ghpythonlib.components as ghcomp
import Grasshopper as gh
import datetime


ghComp = ghenv.Component
ghDoc = ghComp.OnPingDocument()

def rCommonCap(filePath, viewportName,scaleFactor):
    RhinoDocument = Rhino.RhinoDoc.ActiveDoc
    view = RhinoDocument.Views.Find(viewportName, False)
    vp = view.ActiveViewport
    size = System.Drawing.Size(vp.Size.Width*scaleFactor,vp.Size.Height*scaleFactor)
    capture = view.CaptureToBitmap(size)
    capture.Save(filePath);


export_dir = os.path.join(DATA, 'parameter_studies')
if not os.path.isdir(export_dir): os.mkdir(export_dir)
print export_dir
filename = os.path.join(export_dir, 'capture_' + str(idx) + '.png') 
print filename

zoom = 1

if capture:
    rCommonCap(filename, viewport_name, zoom)
# ---------- end capture_to_bitmap ----------

viewport_name = Text("workflow_2")
value_list = ValueList({"Show Assembly": "Show assembly", "Target Geometry": "Show target geometry", "Support Geometry": "Show support geometry", "Four": Sqrt(16)}, selected=["Show Assembly", "Target Geometry", "Support Geometry", "Four"])
panel_11 = Panel(value_list)

curve = Curve([<curve referenced from the Rhino model> x3])  # disabled
number_slider_3 = Slider(0.01, range=0..0.01)  # disabled
curve_proximity = CurveProximity(CurveA=curve, CurveB=graft(curve))  # -> PointA, PointB, Distance; disabled
boolean_toggle = BooleanToggle(True)  # disabled
line_2 = Line(StartPoint=curve_proximity.PointA, EndPoint=curve_proximity.PointB)  # disabled
circle = Circle(Plane=curve_proximity.PointA, Radius=number_slider_3)  # disabled
circle_cnr = CircleCNR(Center=curve_proximity.PointA, Normal=curve, Radius=number_slider_3)  # disabled
clean_tree = CleanTree(RemoveNulls=boolean_toggle, RemoveInvalid=boolean_toggle, RemoveEmpty=boolean_toggle, Tree=line_2)  # -> flatten(Tree); disabled

ghpython_script_7 = GhPythonScript()  # -> out, G_dict_elem; inputs dist_elem: list
# ---------- ghpython_script_7: Python ----------
import os
import sys
from scriptcontext import sticky as st
import Rhino.Geometry as rg

import math
from math import pi

from compas.geometry import Vector, Translation, Frame, Transformation
from compas.artists import Artist
from compas.colors import Color
from compas_rhino.conversions import cylinder_to_rhino, frame_to_rhino

G_dict_elem = []

for element in dist_elem:
    geo = cylinder_to_rhino(element._source)
    G_dict_elem.append(geo)
# ---------- end ghpython_script_7 ----------
preview_3 = CustomPreview(Geometry=ghpython_script_7.G_dict_elem, Material=ColourSwatch(SwatchColor=RGBA(255, 13, 0, 103)))
ghpython_script_8 = GhPythonScript()  # -> out, colors_list
# ---------- ghpython_script_8: Python ----------
import clr
clr.AddReference("System.Drawing")
from System.Drawing import Color

def generate_colors(n):
    colors = []
    x = 70
    for i in range(n):
        r = 0
        g = int((i / (n - 1)) * (255-x) + x)  # Varying from x to 255
        b = 0
        
        # Create a Color object and get the RGB values
        color = Color.FromArgb(r, g, b)
        rgb_values = "{},{},{}".format(color.R, color.G, color.B)
        
        # Append the RGB values to the colors list
        colors.append(rgb_values)
    
    return colors

# Replace N with the number of colors you want in the list
N = 10
colors_list = generate_colors(N)
print(colors_list)
# ---------- end ghpython_script_8 ----------
ghpython_script_9 = GhPythonScript()  # -> out, gradient_colors
# ---------- ghpython_script_9: Python ----------
def generate_gradient(color_start, color_end, n):
    colors = []
    # Extract RGB components from start and end colors
    r_start, g_start, b_start = color_start
    r_end, g_end, b_end = color_end
    
    for i in range(n):
        # Calculate the RGB values for the gradient
        r = int(r_start + (i / (n - 1)) * (r_end - r_start))
        g = int(g_start + (i / (n - 1)) * (g_end - g_start))
        b = int(b_start + (i / (n - 1)) * (b_end - b_start))
        
        # Append the RGB values to the colors list
        rgb = '{},{},{}'.format(r,g,b)
        colors.append(rgb)
    
    return colors

# Define the start and end colors as tuples (R, G, B)
color_start = (255, 255, 255)
color_end = (0, 128, 0)

# Define the number of colors in the gradient
N = 5
gradient_colors = generate_gradient(color_start, color_end, N)
print(gradient_colors)
# ---------- end ghpython_script_9 ----------
panel_12 = Panel(ghpython_script_8.colors_list)
panel_13 = Panel(ghpython_script_9.gradient_colors)
panel_14 = Panel("""0
0.5
0.8
0.99""")
gradient = Gradient(
    LowerLimit=Slider(0, range=0..100),
    UpperLimit=Slider(1, range=0..1),
    Parameter=panel_14,
    stops=[0: RGB(255, 255, 255), 1: RGB(0, 128, 0)])
ghpython_script_10 = GhPythonScript()  # -> out, a; inputs x: list
# ---------- ghpython_script_10: Python ----------
if "Show assembly" in x:
    print 'show_assembly'

print x
# ---------- end ghpython_script_10 ----------
panel_15 = Panel(ColourSwatch(SwatchColor=RGB(255, 0, 0)))
panel_16 = Panel(ghpython_script_10.out)
panel_17 = Panel(ColourSwatch(SwatchColor=RGB(242, 242, 242)))
panel_18 = Panel(gradient)
font_table = FontTable()
panel_19 = Panel(font_table)
panel_20 = Panel([ColourSwatch(SwatchColor=RGB(0, 0, 255)), ColourSwatch(SwatchColor=RGB(237, 237, 255))])
rectangle = Rectangle({Plane=PlaneXY(-2.189418637, 0.7364675478, 0), Size=Domain2(u=-0.1620588735..0.1620588735, v=-0.2599371405..0.2599371405)})
legend = Legend(
    Colour=[ColourSwatch(SwatchColor=RGB(207, 255, 204)), ColourSwatch(SwatchColor=RGB(186, 217, 193)), ColourSwatch(SwatchColor=RGB(186, 217, 193)), ColourSwatch(SwatchColor=RGB(186, 217, 193)), ColourSwatch(SwatchColor=RGB(186, 217, 193))],
    Tags=["One Fish", "Two Fish", "Red Fish", "Blue Fish"],
    Rectangle=rectangle,
    LegendType=1)

# ----
# Assembly visualization / OLD
# 1. Visualize assembly.
# 2. Visualize selected option.
# 3. Visuilize current options (all/filtered).
selected_connectors_ranges = BooleanToggle(False)
open_connectors_planes = BooleanToggle(False)
all_connectors_ranges = BooleanToggle(False)
support_elems = BooleanToggle(False)
robots_reach = BooleanToggle(False)
intersections = BooleanToggle(False)
support_geo_2 = BooleanToggle(True)
selected_key = BooleanToggle(False)
assembly = BooleanToggle(True)
target_geo = BooleanToggle(False)
open_keys = BooleanToggle(True)
all_frames = BooleanToggle(False)
collision = BooleanToggle(False)
all_keys = BooleanToggle(False)
option = BooleanToggle(True)
joints = BooleanToggle(False)

# ----
# (3) 'Joining branches'
join = Button()

# ----
# Network visualization
number_slider_4 = Slider(0, range=0..47)
show_7 = BooleanToggle(False)

# ----
# Assembly visualization
# 1. Visualize assembly.
# 2. Visualize selected option.
# 3. Visuilize current options (all/filtered).
merge = Merge(Data1=show_2, Data2=show_3, Data3=show_5, Data4=show_4, Data5=show_6)  # disabled
number_slider_5 = Slider(42, range=0..360)  # disabled

# ----
# Story of added Elements
# Orange round button
# -> recording in process
update = GhPythonScript(trigger=[join, add])  # -> update; inputs trigger: list; disabled
# ---------- update: Python ----------
update = False

for value in trigger:
    if value:
        update = True

print update
# ---------- end update ----------

settings_parameters = GhPythonScript(
    assembly=remove_by_key.assembly,
    mode=mode_2,
    next_element=next,
    prev_element=previous,
    get_key_by_index=get_key_by_index,
    key_at_index=key_at_index,
    selected_angle=angle,
    selected_shift_value=shift_value_2,
    unit_size=unit_size_2,
    selected_mirror_unit=mirror_unit,
    close_connector=close_connector,
    reset_key=reset_key,
    compute=compute,
    random_options_num=options_num,
    generate_random_key=random_key,
    target_geo=guiding_geo,
    support_geo=support_geo,
    distance_weight=distance_weight,
    angle_weight=angle_weight,
    robot_AA_base_plane=bcf_wcs_aa,
    ur_arm_AA_base_plane=pln,
    robot_AB_base_plane=bcf_wcs_ab,
    ur_arm_AB_base_plane=pln_2,
    stability_criteria=list_5,
    show_resultant=show_resultant,
    collision=collision_check,
    reset_key_2=reset_key,
    update=update)  # -> out, assembly, selected_mode, selected_key, current_key, current_angle, current_shift_value, current_mirror_unit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; inputs key_at_index: Int32, random_options_num: Int32, generate_random_key: Boolean, target_geo: Mesh, support_geo: Brep, robot_AA_base_plane: Plane
# ---------- settings_parameters: Python ----------
import math
import random
import System.Threading.Tasks as tasks
from scriptcontext import sticky as st
import Rhino.Geometry as rg
import rhinoscriptsyntax as rs

import ghpythonlib.components as ghcomp

from compas.geometry import Frame, Box, Point, Plane
from compas.geometry import Vector, Translation, angle_vectors, Rotation
from compas.artists import Artist
from compas.topology import connected_components
from compas_rhino.conversions import plane_to_compas_frame

import time
import sys

msg = []

filter_keys = False

all_options = []
distances = []
vectors = []
origins = []
filtered_keys = []

stability_check = {0:'global', 1:'local', 2:'no_stability_check'}
assembly.stability_check = stability_check[stability_criteria]
assembly.support = support_geo
assembly.target_geo = target_geo

#assembly.globals['rf_unit_radius'] = unit_size

fitness_table = []

total_elements = assembly.network.number_of_nodes()
print total_elements

shift = 0
set_random_shift = False
parallel = True
only_grow_top = True
top_keys = 30
iterations = 1


def get_key(open_keys):
    #if not generate_random_key:
    if selected_key in open_keys and not generate_random_key:
        #random_key = key_at_index
        random_key = selected_key
    else:
        random_key = random.choice(open_keys)
    return random_key

def collision_check(current_key, option_elems, tolerance):
    """Check for collisions with previously built elements.
    """

    collision = False
    results = []
    dist_list = []
    for key, elem in assembly.elements():
        if key != current_key:
            line1 = Artist(elem.line).draw()
            for option_elem in option_elems:
                line2 = Artist(option_elem.line).draw()
                #results.append(True if distance_line_line(elem.line, option_elem.line, tol = 0.001) < assembly.globals['rod_radius']*2. + tolerance else False)
                distance, dist_line = assembly.shortest_distance_between_two_lines(line1, line2)
                print(dist_line)
                #print key, distance
                #results.append(True if distance < (assembly.globals['rod_radius'] * 2. + assembly.globals['joint_dist'] + tolerance) else False)
                results.append(True if distance < (assembly.globals['rod_radius'] * 2. + tolerance) else False)
                dist_list.append([distance,[elem,option_elem], dist_line])
            collision = True if True in results else False
            dist_list_sorted = sorted(dist_list, key=lambda x: x[0])
            #dist = min(dist_list)
            dist = dist_list_sorted[0][0]
            dist_elem = dist_list_sorted[0][1]
            short_line = dist_list_sorted[0][2]

    return collision, dist, dist_elem, short_line

def generate_option(support_centroid, fitness_table, open_keys, cp=None):
    # The calculation order was adapted to the ratio of elements which do not pass the tests. There is a high properbility that the output value test is failed.
    # Therefore, this test is perofrmed first and we immeditely return if it failed and do not do any further calculations.
    
    # pick a key
    option_key = get_key(open_keys)
    #print option_key
    # generate a random angle and shift
    random_angle = random.randint(0, 90) * 4
    random_shift = shift if not set_random_shift else random.uniform(-0.04, 0.04)
    random_bool_mirror_unit = bool(random.getrandbits(1))
    #print("mirror", random_bool_mirror_unit)
    #random_bool_mirror_unit = mirror_unit

    # get the current option elements of the random key with the given angle and shift value
    random_option_elems = assembly.element(option_key).current_option_elements(assembly, random_bool_mirror_unit, unit_size, random_angle, random_shift)
    #print("option elems", random_option_elems)

    # calculate the orientation to the target geometry and the distance to the target geometry
    elem = random_option_elems[0]
    #output_value, vector1 = assembly.orientation_to_target_geo(option_key, random_angle,
    #                                                           assembly.target_geo)
    output_value, vector1 = assembly.orientation_to_target_geo(option_key, random_angle,
                                                               assembly.target_geo)

    if not output_value > 80.0:
        return

    # check if the random option elements collide with anything
    coll, d, d_elems = collision_check(option_key, random_option_elems, tolerance=-0.001)
    #print collsion, d
    if coll:
        #print collision
        return

    # check if all the random option elements are away from the ground
    random_elems_frames = [element.frame for element in random_option_elems]
    if not all(frame.point.z > 0.2 for frame in random_elems_frames):
        return

    distance, vector2 = assembly.distance_to_target_geo(option_key, random_angle, assembly.target_geo)

    if not distance < 1:
        return

    if assembly.stability_check == 'global':
        # calculate global equilibrium and the resultant force of the random option elements
        global_equilibrium, resultant, msg = assembly.calculate_global_equilibrium(assembly.support,
                                                                                   random_option_elems, radius=0.01)

        if not global_equilibrium:
            return

        # calculate the distance between the resultant force and the surface area centroid of the support
        dist = rs.Distance(rs.CurveEndPoint(resultant), support_centroid)

        # calculate the score of the random option elements
        score = output_value * angle_weight + distance * distance_weight + 1 / dist

    elif assembly.stability_check == 'local':
        cp_with_random = cp + [Artist(random_option_elem.line.midpoint).draw() for random_option_elem in
                               random_option_elems]
        sp = [Artist(assembly.element(0).line.end).draw()]

        # calculate local equilibrium (level arm) and the resultant point of the random option elements
        lever_arm, resultant_point = assembly.calculate_local_equilibrium_in_a_branch(cp_with_random, sp,
                                                                          assembly.globals['rod_length'],
                                                                          assembly.globals['rod_radius'])

        score = output_value * angle_weight + 1 / distance * distance_weight + 1 / lever_arm[0]

    elif assembly.stability_check == 'no_stability_check':
        score = output_value * angle_weight + 1 / distance * distance_weight

    # create a fitness table the random values and corresponding scores
    fitness_table.append([option_key, random_angle, random_shift, random_bool_mirror_unit, score])

def get_option_with_highest_score():
    computed_values = []
    msgs = []
    if assembly.stability_check == 'local':
        cp = [Artist(assembly.element(bkey).line.midpoint).draw() for bkey, element in assembly.elements()]
    else:
        cp = None

    start_time_loop = time.time()  # timestamp

    for i in range(iterations):
        fitness_table = []
        # precompute the keys of open connectors
        #open_keys = [key for key, frames in assembly.connectors('open') if frames != []]
        open_keys = open_connectors_keys
        
        
        # To ensure that the algorithm does not lose efficiency when growing along a geometry due to the increasing options, we only choose between the top keys
        if len(open_keys) > top_keys:
            open_keys = open_keys[len(open_keys)-top_keys:]
            
        #print open_keys

        # precompute the surface area centroid of the support
        support_centroid = rs.SurfaceAreaCentroid(assembly.support)[0]

        # Here we leverage multiple cores at once. If the computer has more then one core this speeds of significantly
        if parallel:
            #print 'yes'
            #tasks.Parallel.ForEach(xrange(random_options_num), lambda i: generate_option(support_centroid, fitness_table, open_keys, cp=cp))
        #else:
            for i in range(random_options_num):
                generate_option(support_centroid, fitness_table, open_keys, cp=cp)

        fitness_table_sorted = sorted(fitness_table, key=lambda x: x[4], reverse=True)
        
        msgs.append('{}. ITERATION:'.format(i))

        if fitness_table_sorted:
            msgs.append(
                'Element key {} with the highest score: {}'.format(fitness_table_sorted[0][0], fitness_table_sorted[0][4]))

            best_key = fitness_table_sorted[0][0]
            best_angle = fitness_table_sorted[0][1]
            best_shift_value = fitness_table_sorted[0][2]
            best_mirror_unit = fitness_table_sorted[0][3]

            computed_values = {'key': best_key, 'angle': best_angle, 'shift_value': best_shift_value, "mirror_unit": best_mirror_unit}
            
        else:
            msgs.append('No elements found which fit to the assembly. Increase the number of options or try finding a fit manually.')
    #print("--- Total time %s seconds ---" % (time.time() - start_time_loop))
    # print the messages
    for msg in msgs:
        print(msg)
    
    #print computed_values
    return computed_values

# all keys
key_index = assembly.network.key_index()
index_keys = [key_index[key] for key in assembly.network.nodes()]
keys = [key for key in assembly.network.nodes()]
#print index_keys
#print keys
all_elements = [assembly.element(key) for key in keys]

#############################################################################
## ALL OPEN CONNECTORS KEYS
#############################################################################

open_connectors_keys = [key for key, frames in assembly.connectors(state='open')]
#print open_connectors_keys

#############################################################################
## Filter key according to current robot location
#############################################################################

assembly.robot_AA_base_plane = robot_AA_base_plane
assembly.ur_arm_AA_base_plane = ur_arm_AA_base_plane
assembly.robot_AB_base_plane = robot_AB_base_plane
assembly.ur_arm_AB_base_plane = ur_arm_AB_base_plane

if filter_keys:
    for key, element in assembly.elements():
        if key in open_connectors_keys:
            distance1 = element.frame.point.distance_to_point(ur_arm_AA_base_plane.Origin)
            distance2 = element.frame.point.distance_to_point(ur_arm_AB_base_plane.Origin)
    #        print distance
    #        print distance, key
    #        print distance2, key
            if distance1 < 1.25 or distance2 < 1.25:
                filtered_keys.append(key)
    open_connectors_keys = filtered_keys


#############################################################################
## SELECT A KEY MANUALLY
#############################################################################

guid = str(ghenv.Component.InstanceGuid)
#print guid
element_key = "elem_" + guid
#print element_key
#print(st)

if element_key not in st or None:
    st[element_key] = 0

if reset_key:
    st[element_key] = 0

if next_element:
    if st[element_key] < len(open_connectors_keys) - 1:
        st[element_key] += 1

if prev_element:
    if st[element_key] <= len(open_connectors_keys) - 1:
        st[element_key] -= 1

    if st[element_key] < 1:
        st[element_key] = 0

#############################################################################
## OPEN CONNECTORS
#############################################################################

selected_mode = "Manual" if mode == 0 else "Automatic" if mode == 1 else "Join branches"

if not get_key_by_index and (selected_mode == "Manual" or selected_mode == "Automatic"):
    if len(open_connectors_keys) == 0: 
        msg.append ("!!! NO OPEN CONNECTORS AVAILABLE !!!")
        msg.append ("Suggestion: RESET KEY!")
        #selected_key = 0
        print("!!! NO OPEN CONNECTORS AVAILABLE !!!")
        print("Suggestion: RESET KEY!")
        
    else:
        selected_key = open_connectors_keys[st[element_key]]

if get_key_by_index and (selected_mode == "Manual" or selected_mode == "Automatic"):
    selected_key = key_at_index
    
if 'selected_key':
    print "Selected key:", selected_key
"""current_key = selected_key

selected_mode = "Manual" if mode == 0 else "Automatic" if mode == 1 else "Join branches"

if not get_key_by_index and selected_mode == "Manual":
    if len(open_connectors_keys) == 0: 
        #selected_key = 0
        print("!!! NO OPEN CONNECTORS AVAILABLE !!!")
        print("Suggestion: RESET KEY!")
        
    else:
        selected_key = open_connectors_keys[st[element_key]]

if get_key_by_index and selected_mode == "Manual":
    selected_key = key_at_index
    
if selected_mode == "Automatic":
    selected_key = open_connectors_keys[st[element_key]]
    if not generate_random_key:
        current_key = selected_key
    
if 'selected_key':
    print "Selected key:", selected_key
"""

#############################################################################
## GET PARAMETERS
#############################################################################
params = 'params'

if params not in st or st['params'] is None:
    st[params] = {'key' : selected_key, 'angle': 0, 'shift_value': 0, 'mirror_unit': False}

if selected_mode == "Automatic":
    try: 
        st[params]['key'] == selected_key 
    except: 
        msg.append('Probably the target geometry is too far away from the current key')
    #print st[params]
    if compute:
        st[params] = get_option_with_highest_score()
        #print st[params]
elif selected_mode == "Manual":
    st[params] = {'key' : selected_key, 'angle': selected_angle, 'shift_value': selected_shift_value, 'mirror_unit': selected_mirror_unit}

parameters = st[params]

print(msg)

#print 'Current parameters:', parameters

current_key = parameters['key']
current_angle = parameters['angle']
current_shift_value = parameters['shift_value']
current_mirror_unit = parameters['mirror_unit']


#print 'Current key:', current_key

if current_key not in open_connectors_keys:
    current_key = selected_key
if current_key != None:
    selected_elem = assembly.network.node[current_key]['element']

assembly.parameters = parameters
#try:
#   .... use of selected_key....
#expect:
#   print("selected_key does not exist, but no problem.)
#   

#############################################################################
## DISPLAY SELECTED CONNECTOR
#############################################################################

if current_key != None and current_key in open_connectors_keys:

    selected_connector_frame = assembly.element(current_key).connectors(state='open')[0]
    #selected_connector_frame

    R = Rotation.from_axis_and_angle(selected_elem.frame.xaxis, math.radians(current_angle), selected_elem.frame.point)
    T = Translation.from_vector(selected_elem.frame.xaxis * selected_shift_value)
    
    selected_connector_frame_copy = selected_connector_frame.transformed(R)
    selected_connector_frame_copy.transform(T)
    selected_connector_plane = Artist(selected_connector_frame_copy).draw()
    
    elem_options = assembly.element(current_key).current_option_elements(assembly, current_mirror_unit, unit_size, current_angle, current_shift_value)


#############################################################################
## COLLISION CHECK
#############################################################################



# check if the selected option elements collide with anything
if collision and total_elements > 1:
    is_colliding, dist, dist_elem, short_line = collision_check(current_key, elem_options, tolerance=-0.001)

#############################################################################
## GLOBAL/LOCAL EQUILIBRIUM CHECK
#############################################################################

lever_arm_branches = []
resultant_branches = []
resultant = []

if stability_criteria == 0:
    # calculate global equilibrium and the resultant force of the selected option elements
    equlibrium, resultant_line, stability_feedback = assembly.calculate_global_equilibrium(support_geo, elem_options, radius=0.01)
    resultant_line = rs.coercecurve(resultant_line)    
    print resultant_line
    
elif stability_criteria == 1:
    
    # Identify the connected elements (branches) in the assembly.
    branches = connected_components(assembly.network.adjacency)
    
    stability_feedback = []

    lever_arm_branches, resultant_branches = assembly.calculate_local_equilibrium_in_all_branches(current_key, elem_options)
    
    for i, lever_arm in enumerate(lever_arm_branches):
        stability_feedback.append("Lever arm of branch {} is {len:.3f}m long.".format(i, len=float(lever_arm)))
else:
    stability_feedback = "No stability criteria selected."
    
#print lever_arm_branches
#print resultant_branches

if show_resultant:
    if stability_criteria == 0:
        cone_base_plane = rg.Plane(resultant_line.PointAt(0), rg.Vector3d.ZAxis*-1)
        cone_base_plane.Translate(rg.Vector3d.ZAxis*0.135)
        resultant.append(rg.Cone(cone_base_plane,-0.4, 0.02))
    else:
        for resultant_line, lever_arm in zip(resultant_branches, lever_arm_branches):
            cone_base_plane = rg.Plane(resultant_line.PointAt(0), rg.Vector3d.ZAxis*-1)
            cone_base_plane.Translate(rg.Vector3d.ZAxis*0.135)
            resultant.append(rg.Cone(cone_base_plane,-lever_arm, 0.02))


#############################################################################
## DISTANCE TO INPUT GEO
#############################################################################

distance, shortest_vector_1 = assembly.distance_to_target_geo(current_key, current_angle, target_geo)

# Vector Display
vectors.append(shortest_vector_1)
origins.append(selected_connector_plane.Origin)

target_geo_feedback = ['Key {}: Distance to target geometry: {dist:.2f}m'. format(current_key, dist=distance)]

#############################################################################
## ORIENTATION TO INPUT GEO
#############################################################################

output_value, shortest_vector_2 = assembly.orientation_to_target_geo(current_key, current_angle, target_geo)

# Vector Dispaly
vectors.append(rg.Vector3d(shortest_vector_2.x,shortest_vector_2.y,shortest_vector_2.z))
origins.append(selected_connector_plane.Origin)

target_geo_feedback.append('Key {}: Orientation to target geometry: {len:.2f}%'. format(current_key, len=output_value))

#############################################################################
## LAST ADDED KEYS
#############################################################################

new_keys = keys[-2:]
assembly.last_added = new_keys
#print 'Last added keys:', ', '.join(map(str, new_keys))

#############################################################################
## Close connector
#############################################################################


if close_connector:
    assembly.element(key_at_index).connector_1_state = True
    assembly.element(key_at_index).connector_2_state = False

#for key, element in assembly.elements():
#    if element.frame.point.z < 2.57:
#        assembly.element(key).connector_1_state = False
#        assembly.element(key).connector_2_state = False

assembly.open_connectors_keys = open_connectors_keys

edges_keys = [116,123,122]


#assembly.network.add_edge(edges_keys[0],edges_keys[1])
#assembly.network.add_edge(edges_keys[0],edges_keys[2])
#assembly.network.add_edge(edges_keys[1],edges_keys[2])

#assembly.network.add_edge(109,114)
#assembly.network.delete_edge(122,76)

robot_keys = [162,164,166,168,170,190,192,188,182,158,196,154,151,194,142,144,146,148,138,140]

#for key, element in assembly.elements():
#    if key in robot_keys:
#        assembly.network.node_attribute(key, 'placed_by', 'robot')

robot_AA_base_frame = plane_to_compas_frame(robot_AA_base_plane)
robot_AB_base_frame = plane_to_compas_frame(robot_AB_base_plane)

for key, element in assembly.elements():

    assembly.network.node_attribute(key, 'robot_AA_base_frame', robot_AA_base_frame)
    assembly.network.node_attribute(key, 'robot_AB_base_frame', robot_AB_base_frame)
# ---------- end settings_parameters ----------
stats = GhPythonScript(assembly=settings_parameters.assembly)  # -> out, total_elements, total_joints
# ---------- stats: Python ----------
from compas.topology import connected_components
from compas_rhino.conversions import frame_to_rhino


# Identify the connected elements (branches) in the assembly.
branches = connected_components(assembly.network.adjacency)

#print '-------------------- ASSEMBLY --------------------'
#print 'The assembly has {} branches.'.format(len(branches))

total_elements = assembly.network.number_of_nodes()
planned_keys = list(assembly.network.nodes_where({'is_planned':True}))
built_keys = list(assembly.network.nodes_where({'is_built':True}))
support_keys = list(assembly.network.nodes_where({'is_support':True}))

#print '-------------------- ELEMENTS --------------------'
print "Total ELEMENTS:", total_elements
#print len(built_keys), "element(s) are already built."
#print len(planned_keys), "element(s) are planned."
#print len(support_keys), "element(s) are suppports."

keys = [key for key, element in assembly.elements()]
open_connectors_keys = [key for key in keys if assembly.element(key).connectors(state='open')]
closed_connectors_keys = [key for key in keys if key not in open_connectors_keys]

#print '------------------- CONNECTORS -------------------'
#print len(open_connectors_keys), 'open connectors'
#print len(closed_connectors_keys), 'closed connectors'

edges = assembly.network.number_of_edges()
nodes = len(closed_connectors_keys)*3

#print '--------------------- JOINTS ----------------------'

joints = []
joints_frames = []

for key, element in assembly.elements():
    if not element.connector_1_state:
        joints_frames.append(element.joint_frame_1)
        #joints.append(frame_to_rhino(element.joint_frame_1))
    if not element.connector_2_state and key not in support_keys:
        joints_frames.append(element.joint_frame_2)
        #joints.append(frame_to_rhino(element.joint_frame_2))

total_joints = len(joints_frames)
print "Total JOINTS:", total_joints

assembly.joints = joints_frames
# ---------- end stats ----------
srf = Surface(settings_parameters.resultant)
preview_4 = CustomPreview(Geometry=srf, Material=ColourSwatch(SwatchColor=RGBA(255, 13, 0, 103)))
vdis = VectorDisplay(Anchor=settings_parameters.origins, Vector=settings_parameters.vectors)

joining_branches = GhPythonScript(
    assembly=settings_parameters.assembly,
    elem=elem_60_def.elem,
    get_joining_options=get_joining_options,
    joining_case=list_3,
    show_new_element=show_new_element,
    pair_index=pair_index,
    point_on_intersection=Slider(0.3, range=0..1),
    point1=point1,
    point2=point2,
    shift_value=shift_value,
    join_branches=join,
    mirror_unit=settings_parameters.current_mirror_unit,
    unit_size=unit_size_2)  # -> out, assembly, elem_line1, elem_line2, new_elem_mesh, intersections, angle1, angle2; inputs pair_index: Int32
# ---------- joining_branches: Python ----------
import math
import rhinoscriptsyntax as rs
import Rhino.Geometry as rg

from compas.geometry import Point, Vector, Frame, Plane, Vector, Line, Transformation, Rotation, Translation
from compas.geometry import angle_vectors, closest_point_on_line, intersection_line_plane, angles_points
from compas.artists import Artist
from compas_rhino.conversions import line_to_rhino_curve, point_to_compas, point_to_rhino, plane_to_compas_frame

import ghpythonlib.components as gh

mirror_unit = False

connector_ranges = []
connectors_pairs = []
intersections = []


epsilon = 0.0000001

open_connectors_keys = [key for key, frames in assembly.connectors(state='open')]

robot_AA_base_frame = plane_to_compas_frame(assembly.robot_AA_base_plane)
robot_AB_base_frame = plane_to_compas_frame(assembly.robot_AB_base_plane)

#############################################################################
## CASE 1
#############################################################################

if get_joining_options and joining_case == 0:

    for key, connector_range in assembly.connectors_ranges(state='open'):
        if len(connector_range) != 0:
            connector_ranges.append((key, Artist(connector_range[0]).draw()))

    for i in range(len(connector_ranges)):
        for open_connectors_key in open_connectors_keys:
            intersection = rg.Intersect.Intersection.CurveSurface(line_to_rhino_curve(assembly.element(open_connectors_key).line), connector_ranges[i][1], 0.001, 0.001)
            if intersection:
                for c in intersection:
                    intersections.append(c.PointA)
                connectors_pairs.append((connector_ranges[i][0], open_connectors_key))

    #print len(intersection_curves)

    if len(connectors_pairs) != 0:
        intersection_point = intersections[pair_index]
        selected_keys_pair = [pkey for pkey in connectors_pairs[pair_index]]
        connectors_pairs_list = [key for pair in connectors_pairs for key in pair]
    
        assembly.selected_keys_pair = [selected_keys_pair[0]]
        assembly.connectors_pairs_list = connectors_pairs_list
        assembly.selected_connectors_ranges_intersection_point = intersection_point
        
        # Convert in COMPAS Point
        cp = point_to_compas(intersection_point)
        
        # Compute angle for option pair
        open_connector_elem_1 = assembly.element(selected_keys_pair[0])
        cutting_plane_origin_1 = closest_point_on_line(cp, open_connector_elem_1.line)
        cutting_plane_1 = Plane(cutting_plane_origin_1, open_connector_elem_1.line.vector)
        intersection_point_1 = intersection_line_plane(open_connector_elem_1.current_option_elements(mirror_unit, 0, 0)[1].line, cutting_plane_1)

        angle1 = angles_points(cutting_plane_origin_1, intersection_point_1, cp) 
        angle1 = math.degrees(angle1[1])
        
        current_option = assembly.element(selected_keys_pair[0]).current_option_elements(mirror_unit, unit_size, angle1, 0)

        rot_line = Artist(assembly.element(selected_keys_pair[0]).line).draw()
        start_p = rot_line.From
        rot_axis = rg.Vector3d(rot_line.From - rot_line.To)
        rot_point = Artist(assembly.element(selected_keys_pair[0]).frame.point).draw()
        elem_line1 = Artist(current_option[1].line).draw()
        elem_line2 = Artist(assembly.element(selected_keys_pair[1]).line).draw()
        rot_dir = 1
        step = 1.0

        tol_angle = assembly.get_rot_angle(step, rot_axis, rot_point, elem_line1, elem_line2, rot_dir, epsilon)
        angle1 += tol_angle
        
        current_option_rotated = assembly.element(selected_keys_pair[0]).current_option_elements(mirror_unit, angle1, 0)
        
        if show_new_element:
            new_elem = assembly.add_third_element(elem, assembly.element(selected_keys_pair[1]), current_option_rotated[1], point1, point2, shift_value, epsilon)
            new_elem_mesh = Artist(new_elem.mesh).draw()
        
        if join_branches:
            msgs = []
            
            # close a reciprocal frame unit with the option elements with the highest score
            assembly.join_branches(selected_keys_pair, mirror_unit, angle1, 0, new_elem, robot_frame=BCF, on_ground=False)

            msgs.append('--- New element added to assembly ---')
            
            for msg in msgs:
                print(msg)
    else:
        assembly.selected_keys_pair = []
        assembly.connectors_pairs_list = []
        assembly.selected_connectors_ranges_intersection_point = []
        
#############################################################################
## CASE 2
#############################################################################

if get_joining_options and joining_case == 1:
    for key, connector_range in assembly.connectors_ranges(state='open'):
        if len(connector_range) != 0:
            #print connector_range
            connector_ranges.append((key, Artist(connector_range[0]).draw()))

    for i in range(len(connector_ranges)):
        for j in range(i + 1, len(connector_ranges)):
            is_intersecting, intersection, p_array = rg.Intersect.Intersection.SurfaceSurface(connector_ranges[i][1], connector_ranges[j][1], 0.001)
            if len(intersection) > 0:
                #print intersection
                joined_curve = rg.Curve.JoinCurves(intersection)
                connectors_pairs.append((connector_ranges[i][0], connector_ranges[j][0]))
                #print joined_curve
                intersections.append(joined_curve[0])
                
        
    #print 'Following element pair(s) {} could be joined.'.format(connectors_pairs)
    #print intersections
    
    if len(connectors_pairs) != 0:
        curve_param = intersections[pair_index].NormalizedLengthParameter(point_on_intersection)
        intersection_point = intersections[pair_index].PointAt(curve_param[1])
        
        selected_keys_pair = [pkey for pkey in connectors_pairs[pair_index]]
        connectors_pairs_list = [key for pair in connectors_pairs for key in pair]
    
        assembly.selected_keys_pair = selected_keys_pair
        assembly.connectors_pairs_list = connectors_pairs_list
        assembly.selected_connectors_ranges_intersection_point = intersection_point

        # Convert to compas point
        cp = point_to_compas(intersection_point)
        
        # Compute angle for first option pair
        open_connector_elem1 = assembly.element(selected_keys_pair[0])
        cutting_plane_origin1 = closest_point_on_line(cp, open_connector_elem1.line)
        cutting_plane1 = Plane(cutting_plane_origin1, open_connector_elem1.line.vector)
        option_elem1 = open_connector_elem1.current_option_elements(assembly, mirror_unit, unit_size, 0, 0)[1]
        intersection_point1 = intersection_line_plane(option_elem1.line, cutting_plane1)
        
        angle1 = angles_points(cutting_plane_origin1, intersection_point1, cp) 
        angle1 = math.degrees(angle1[0])
        
        # Compute angle for second option pair
        open_connector_elem2 = assembly.element(selected_keys_pair[1])
        cutting_plane_origin2 = closest_point_on_line(cp, open_connector_elem2.line)
        cutting_plane2 = Plane(cutting_plane_origin2, open_connector_elem2.line.vector)
        option_elem2 = open_connector_elem2.current_option_elements(assembly, mirror_unit, unit_size, 0, 0)[1]
        intersection_point2 = intersection_line_plane(option_elem2.line, cutting_plane2)
        
        angle2 = angles_points(cutting_plane_origin2, intersection_point2, cp)
        angle2 = math.degrees(angle2[0])
        
        rot_line = Artist(open_connector_elem1.line).draw()
        start_p = rot_line.From
        rot_axis = rg.Vector3d(rot_line.From - rot_line.To)
        rot_point = Artist(assembly.element(selected_keys_pair[0]).frame.point).draw()
        elem_line1 = Artist(option_elem1.line).draw()
        elem_line2 = Artist(option_elem2.line).draw()

        rot_dir = 1
        step = 6.0

        tol_angle = assembly.get_rot_angle(step, rot_axis, rot_point, elem_line1, elem_line2, rot_dir, epsilon)
        angle1 += tol_angle
        
        option1_rotated = assembly.element(selected_keys_pair[0]).current_option_elements(assembly, mirror_unit, unit_size, angle1, 0)
        option2_rotated = assembly.element(selected_keys_pair[1]).current_option_elements(assembly, mirror_unit, unit_size, angle2, 0)
        
        if show_new_element:
            new_elem = assembly.add_third_element(elem, option1_rotated[1], option2_rotated[1], point1, point2, shift_value, epsilon)
            new_elem_mesh = Artist(new_elem.mesh).draw()

if not get_joining_options:
    assembly.selected_keys_pair = []
    assembly.connectors_pairs_list = []
    assembly.selected_connectors_ranges_intersection_point = []


if joining_case == 0:
    print '-------------- CASE 1: SINGLE OPTIONS-PAIR -------------'
elif joining_case == 1:
    print '-------------- CASE 2: TWO OPTIONS-PAIRS ---------------'
print 'Number of key-pairs that can be joined:', len(connectors_pairs)
print 'Selected open connectors key-pair:', assembly.selected_keys_pair
if len(assembly.selected_keys_pair) != 0:
    print 'Open connector key for option:', assembly.selected_keys_pair[0]
print 'Option 1 angle:', angle1
print 'Option 2 angle:', angle2
# ---------- end joining_branches ----------
line_3 = Line(joining_branches.elem_line1)
line_4 = Line(joining_branches.elem_line2)
mesh_4 = Mesh(joining_branches.new_elem_mesh)
crv = Curve(joining_branches.intersections)

# ----
# Status bar
panel_21 = Panel(stats.out)

# ----
# Current parameters
key = Panel(settings_parameters.current_key)
angle_2 = Panel(settings_parameters.current_angle)
shift_value_3 = Panel(settings_parameters.current_shift_value)

# ----
# Feedback
joining_branches_2 = Panel(joining_branches.out)
stick_to_stick_distance = Panel(settings_parameters.dist)
target_geometry = Panel(settings_parameters.target_geo_feedback)
stability_feedback = Panel(settings_parameters.stability_feedback)
collision_detection = Panel(settings_parameters.is_colliding)

grow_assembly = GhPythonScript(
    assembly=joining_branches.assembly,
    key=settings_parameters.current_key,
    angle=settings_parameters.current_angle,
    shift_value=settings_parameters.current_shift_value,
    mirror_unit=settings_parameters.current_mirror_unit,
    unit_size=unit_size_2,
    is_colliding=settings_parameters.is_colliding,
    add=add)  # -> out, test, error, msg, assembly; inputs mirror_unit: Boolean
# ---------- grow_assembly: Python ----------
from compas_rhino.conversions import plane_to_compas_frame

robot_name = 'AA'
error = False

robot_AA_base_frame = plane_to_compas_frame(assembly.robot_AA_base_plane)
robot_AB_base_frame = plane_to_compas_frame(assembly.robot_AB_base_plane)
#print robot_AA_base_frame

#############################################################################
## ADD ELEMENTS TO ASSEMBLY BY SELECTED  KEY, ANGLE AND SHIFT_VALUE
#############################################################################

if add:
    msgs = []
    
    if not is_colliding:
        # close a reciprocal frame unit with the option elements with the highest score
        assembly.close_rf_unit(key, mirror_unit, unit_size, angle, shift_value, robot_name, robot_AA_base_frame, robot_AB_base_frame, on_ground=False)
        assembly.open_connectors_keys.remove(key)
        msgs.append('--- New elements added to key {} ---'.format(key))
    else:
        error = True
        error_text = 'Elements are colliding, not possible to add elements'
        msgs.append('--- Elements are colliding, not possible to add elements ---')
        
    for msg in msgs:
        print(msg)



#for key, element in assembly.elements():
#    print assembly.network.node_attribute(key, 'robot_frame')
# ---------- end grow_assembly ----------
rec = DataRecorder(grow_assembly.out, DataLimit=-10, RecordData=True)
messages = Panel(rec)

assembly_viz = PythonScript(
    assembly=grow_assembly.assembly,
    selected_mode=settings_parameters.selected_mode,
    viz=reset,
    joint_elem=elem_60_def.joint_elem,
    joint_elem_mirrored=elem_60_def.joint_elem_mir,
    preview_mode=mode,
    show_assembly=assembly,
    show_target_geo=target_geo,
    show_support_geo=support_geo_2,
    show_robots_reach=robots_reach,
    show_support=support_elems,
    show_selected=selected_key,
    show_option=option,
    show_open_connectors_planes=open_connectors_planes,
    show_all_frames=all_frames,
    show_selected_connectors_ranges=selected_connectors_ranges,
    show_all_connectors_ranges=all_connectors_ranges,
    show_intersection=intersections,
    show_joining_options=get_joining_options,
    show_open_keys=open_keys,
    show_all_keys=all_keys,
    show_collision=collision,
    show_joints=joints,
    is_colliding=settings_parameters.is_colliding,
    selected_key=settings_parameters.selected_key,
    current_key=settings_parameters.current_key,
    collision_det=collision_check,
    dist_elem=settings_parameters.dist_elem,
    dist=settings_parameters.dist,
    short_line=settings_parameters.short_line,
    angle=settings_parameters.current_angle,
    angle1=joining_branches.angle1,
    angle2=joining_branches.angle2,
    mirror_unit=settings_parameters.current_mirror_unit,
    unit_size=unit_size_2,
    shift_value=settings_parameters.current_shift_value)  # -> out, G_target_geo, G_support_geo, G_planned_elems, branch_geo, colors_branches, G_sequence, colors_sequence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; inputs current_key: Int32, dist_elem: list, short_line: Line
# ---------- assembly_viz: Python ----------
import os
import sys
from scriptcontext import sticky as st
import Rhino.Geometry as rg

import ghpythonlib.components as gh

import math
from math import pi

from compas.geometry import Vector, Translation, Frame, Transformation
from compas.artists import Artist
from compas.colors import Color
from compas_rhino.conversions import cylinder_to_rhino, frame_to_rhino
from compas.topology import connected_components


G_selected = []
G_dist_elems = []

G_placed_by_human = []
G_placed_by_robot = []

G_supports = []

G_planned_elems = []
planned_connector_planes = []
G_built_elems = []
G_support_elems = []
G_branches =[]

G_no_open_connectors_elems = []
G_open_connectors_elems = []

G_connectors_ranges = []
G_close_pairs = []
G_intersection = []

G_joints = []

robots_reach = []
elem_options = []

key_tag_text = []
key_tag_location= []
lines = []

flip = 'AA'

# Color coding
color_coding = {'color_close_pairs': Color(1.0, 0., 0.0, 1.0),
                'color_is_planned': Color(1.0, 0.752941176471, 0.0, 1.0), 
                'color_is_support': Color(0.0, 0.0, 1.0, 1.0), 
                'color_has_open_connector': Color(0.494117647059, 1.0, 0.239215686275, 1.0), 
                'color_has_no_open_connectors': Color(0.78431372549, 0.78431372549, 0.78431372549, 1.0), 
                'color_is_built': Color(0.811764705882, 1.0, 0.709803921569, 1.0), 
                'color_is_built_by_robot': Color(0.686274509804, 0.878431372549, 0.862745098039, 1.0), 
                'color_is_built_by_human': Color(0.949019607843, 0.898039215686, 0.0, 1.0)}

def generate_colors(n):
    colors = []
    x = 70
    for i in range(n):
        r = 0
        g = int((i / (n - 1)) * (255-x) + x)  # Varying from x to 255
        b = 0
        
        # Create a Color object and get the RGB values
        color = Color.FromArgb(r, g, b)
        rgb_values = "{},{},{}".format(color.R, color.G, color.B)
        
        # Append the RGB values to the colors list
        colors.append(rgb_values)
    
    return colors

def generate_gradient(color_start, color_end, n):
    colors = []
    # Extract RGB components from start and end colors
    r_start, g_start, b_start = color_start
    r_end, g_end, b_end = color_end
    
    for i in range(n):
        # Calculate the RGB values for the gradient
        r = int(r_start + (i / (n - 1)) * (r_end - r_start))
        g = int(g_start + (i / (n - 1)) * (g_end - g_start))
        b = int(b_start + (i / (n - 1)) * (b_end - b_start))
        
        # Append the RGB values to the colors list
        rgb = '{},{},{}'.format(r,g,b)
        colors.append(rgb)
    
    return colors


keys = [key for key, element in assembly.elements()]
lines = [Artist(assembly.element(key).line).draw() for key in keys]

open_connectors_frames = [assembly.element(key).connectors(state='open') for key, element in assembly.elements()]
all_connectors_frames = [assembly.element(key).connectors() for key, element in assembly.elements()]
element_frames = [assembly.element(key).frame for key, element in assembly.elements()]

# Identify the connected elements (branches) in the assembly.
branches = connected_components(assembly.network.adjacency)
#print ('branch', branches, len(branches))

#print open_connectors_frames
#print element_frames

selected_element = assembly.element(current_key)

selected_connectors_ranges = [assembly.element(key).connectors_ranges(state='open') for key in keys if key == current_key or key in assembly.selected_keys_pair]
#selected_connectors_ranges = [assembly.element(key).connectors_ranges(state='open') for key in keys if key in assembly.selected_keys_pair]
all_connectors_ranges = [assembly.element(key).connectors_ranges(state='open') for key in keys if key]

if show_open_connectors_planes:
    open_connectors_planes = [Artist(connector).draw() for connectors in open_connectors_frames for connector in connectors if connectors != []]
if show_all_frames:
    all_connectors_planes = [Artist(connector).draw() for connectors in all_connectors_frames for connector in connectors if connectors != []]
    all_element_planes = [Artist(elem).draw() for elem in element_frames]
    
if show_all_connectors_ranges and not show_selected_connectors_ranges:
    G_connectors_ranges = [Artist(connector).draw() for connectors in all_connectors_ranges for connector in connectors if connectors != []]
    
elif show_selected_connectors_ranges and not show_all_connectors_ranges:
    T = Translation.from_vector(selected_element.frame.xaxis * 0)
    connectors_ranges = [connector.transform(T) for connectors in selected_connectors_ranges for connector in connectors if connectors != []]
    G_connectors_ranges = [Artist(connector).draw() for connectors in connectors_ranges]
    
else:
    G_connectors_ranges = []
    
if show_intersection:
    if len(assembly.selected_connectors_ranges_intersection_point) > 0:
        G_intersection = assembly.selected_connectors_ranges_intersection_point
    
def show(element, output_geo, color):
    mesh = Artist(element.mesh).draw(color)
    output_geo.append(mesh)

def show_multiple(elements, output_geo, color):
    for element in elements:
        mesh = Artist(element.mesh).draw(color)
        output_geo.append(mesh)
        
if show_robots_reach:
    robots_reach.append(rg.Sphere(assembly.ur_arm_AA_base_plane.Origin, 1.25))
    robots_reach.append(rg.Sphere(assembly.ur_arm_AB_base_plane.Origin, 1.25))
    
print assembly.selected_keys_pair

if assembly:
    radius = assembly.globals['rod_radius']
    if current_key != None:
        current_element = assembly.element(current_key)
        if show_joining_options and len(assembly.selected_keys_pair) != 0:
            print 'yes'
            if len(assembly.selected_keys_pair) > 1: 
                elem_options.append(assembly.element(assembly.selected_keys_pair[0]).current_option_elements(assembly, mirror_unit, unit_size, angle1, shift_value))
                elem_options.append(assembly.element(assembly.selected_keys_pair[1]).current_option_elements(assembly, mirror_unit, unit_size, angle2, shift_value))
            else:
                elem_options.append(assembly.element(assembly.selected_keys_pair[0]).current_option_elements(assembly, mirror_unit, unit_size, angle1, shift_value))
            elem_options = [option for options in elem_options for option in options]
        else:
            elem_options = assembly.element(current_key).current_option_elements(assembly, mirror_unit, unit_size, angle, shift_value)
        #G_selected = Artist(assembly.element(current_key).mesh).draw(color_coding['color_is_support'])
    else:
        current_element = None
        elem_options = []
    
    if len(elem_options) != 0:
        elem_option = elem_options[0]
        #all_connectors_frames = [assembly.element(key).connectors() for key, element in assembly.elements()]
        #planned_connector_frames = [elem.connectors() for elem in elem_option]
    
    if flip_human_robot:
        elem_options.reverse()
    
    planned_keys = list(assembly.network.nodes_where({'is_planned':True, 'is_built':False}))
    built_keys = list(assembly.network.nodes_where({'is_built':True}))
    unbuilt_keys = [key for key, element in assembly.elements() if key not in built_keys]
    support_keys = list(assembly.network.nodes_where({'is_support':True}))
    #open_connectors_keys = [key for key, frames in assembly.connectors('open') if frames != []]
    open_connectors_keys = assembly.open_connectors_keys
    no_open_connectors_keys = [key for key in planned_keys if key not in open_connectors_keys]
    
    robot_keys = list(assembly.network.nodes_where({'placed_by':'robot', 'is_built':True}))
    print('robot', robot_keys)
    human_keys = list(assembly.network.nodes_where({'placed_by':'human', 'is_built':True}))
    
    mirrored_keys = list(assembly.network.nodes_where({'is_mirrored':True}))
    unmirrored_keys = list(assembly.network.nodes_where({'is_mirrored':False}))
    #support_keys = [key for key in support_keys if key not in assembly.open_connectors_keys]
    
    print 'robot keys:', robot_keys
    print 'human keys:', human_keys
    
    print 'planned keys:', planned_keys
    print 'built keys:', built_keys
    print 'unbuilt keys:', unbuilt_keys
    
    print 'support keys:', support_keys
    print 'open connectors keys:', open_connectors_keys
    print 'no open connectors keys:', no_open_connectors_keys
    
    robot_elements = [assembly.element(key) for key in robot_keys] 
    human_elements = [assembly.element(key) for key in human_keys] 
    
    planned_elements = [assembly.element(key) for key in planned_keys] 
    built_elements = [assembly.element(key) for key in built_keys] 
    
    mirrored_elements = [assembly.element(key) for key in mirrored_keys] 
    unmirrored_elements = [assembly.element(key) for key in unmirrored_keys] 
    
    support_elements = [assembly.element(key) for key in support_keys] 
    open_connectors_elements = [assembly.element(key) for key in open_connectors_keys]
    no_open_connectors_elements = [assembly.element(key) for key in no_open_connectors_keys]
    open_keys = [key for key, frames in assembly.connectors('open') if frames != []]

    # Visualize assembly
    if show_assembly:
        if preview_mode == 4: # Sequence
            colors_sequence = []
            G_sequence = []
            i = 0
            total_elements = assembly.network.number_of_nodes()
            gradient_colors = generate_gradient((235,235,255), (0,0,255), total_elements)
            
            for key, element in assembly.elements():
                c = gradient_colors[i]
                geo = cylinder_to_rhino(assembly.element(key)._source)
                G_sequence.append(geo)
                colors_sequence.append(c)
                i +=1
        
        if preview_mode == 3: # Branches
            colors_branches = []
            branch_geo =[]
            
            branches = connected_components(assembly.network.adjacency)
            gradient_colors = generate_gradient((186,217,193), (0,128,0), len(branches))
            
            i = 0
            for branch in branches:
                c = gradient_colors[i]
                for key in branch:
                    geo = cylinder_to_rhino(assembly.element(key)._source)
                    branch_geo.append(geo)
                    colors_branches.append(c)
                i +=1
                #G_branches.append(branch_geo)
            #print ('branch', G_branches)
        
        if preview_mode == 2: # Assembly workflow
            for element in planned_elements:
                geo = cylinder_to_rhino(element._source)
                G_planned_elems.append(geo)
                
            for element in built_elements:
                geo = cylinder_to_rhino(element._source)
                G_built_elems.append(geo)
                
            for element in support_elements:
                geo = cylinder_to_rhino(element._source)
                #G_support_elems.append(geo)
                
            
        elif preview_mode == 1: # Design Generation
            for element in support_elements:
                geo = cylinder_to_rhino(element._source)
                G_support_elems.append(geo)
                
            for element in open_connectors_elements:
                geo = cylinder_to_rhino(element._source)
                G_open_connectors_elems.append(geo)
                
            for element in no_open_connectors_elements:
                geo = cylinder_to_rhino(element._source)
                G_no_open_connectors_elems.append(geo)
                
            if show_selected and selected_mode != 'Join branches': 
                G_selected_elem = cylinder_to_rhino(assembly.element(selected_key)._source)
                #print ("here")
            
        else: # Build by human/robot
            for element in robot_elements:
                geo = cylinder_to_rhino(element._source)
                G_placed_by_robot.append(geo)
                
            for element in human_elements:
                geo = cylinder_to_rhino(element._source)
                G_placed_by_human.append(geo)

    # Vizualize current connector 
    if show_option and show_assembly:
        if elem_options:

            for option in elem_options:
                G_planned_elems.append(cylinder_to_rhino(option._source))
                lines.append(Artist(option.line).draw())
                
                for connector in option.connectors():
                    connector_plane = Artist(connector).draw()
                    planned_connector_planes.append(connector_plane)
                
                """all_connectors_frames = option.connectors(state='open')
                connector_planes = [Artist(connector).draw() for connector in closed_connector_frame]
                planned_connector_planes.append(connector_planes)
                print(planned_connector_planes)
                
                all_connectors_planes = [Artist(connector).draw() for connectors in all_connectors_frames for connector in connectors if connectors != []]"""
                #all_element_planes = [Artist(elem).draw() for elem in element_frames]
                #planned_connector_frames = [elem.connectors() for elem in elem_option]
                #planned_connector_planes.append([Artist(connector).draw() for connectors in frames for connector in connectors if connectors != []]

        else:
            print('No open connectors')
        #print(planned_connector_planes)
    
    #elem_option_robot = Artist(elem_options[0].frame).draw() # elem for planning robot routine


    if show_assembly and show_collision and show_option and short_line:
        collision_color = '255,129,120'
        if is_colliding:
            collision_color = '255,0,0'
            for element in dist_elem:
                geo = cylinder_to_rhino(element._source)
                G_dist_elems.append(geo)
        else:
            G_short_line = short_line
            line_middle = gh.CurveMiddle(short_line)
            dist_label = '{}mm'.format(int(dist*1000))


    if show_open_keys:
        for key, element in assembly.elements():
            if key in open_connectors_keys:
                key_tag_text.append(str(key))
                key_tag_location.append(Artist(element.frame).draw().Origin)
                
    if show_all_keys:
        for key, element in assembly.elements():
            key_tag_text.append(str(key))
            key_tag_location.append(Artist(element.frame).draw().Origin)
            
    if show_support:
        G_supports.append(assembly.support)

# visualise target geometry
if show_target_geo:
    G_target_geo = assembly.target_geo

# visualise xupporting geo
if show_support_geo:
    G_support_geo = assembly.support


points = []
for key, element in assembly.elements():
    points.append(Artist(element.frame.point).draw())
    
joints = []
joint_planes = []
if show_joints:
    #for key, element in assembly.elements():
        #joint_planes.append(Artist(element.joint_frame_1).draw())
        #joint_planes.append(Artist(element.joint_frame_2).draw())
        #robot_keys = list(assembly.network.nodes_where({'placed_by':'robot', 'is_built':True}))
    
    for key, element in assembly.elements():
        if not element.connector_1_state:
            joint_planes.append(Artist(element.joint_frame_1).draw())
            #joints.append(frame_to_rhino(element.joint_frame_1))
        if not element.connector_2_state and key not in support_keys:
            #joints.append(frame_to_rhino(element.joint_frame_2))
            joint_planes.append(Artist(element.joint_frame_2).draw())
        
assembly.support_keys = support_keys


if len(assembly.joints) > 0 and show_joints:
    print('joints', assembly.joints)
    for joint_frame in assembly.joints:
        #print joint_frame
        T = Transformation.from_frame_to_frame(Frame.worldXY(), joint_frame)
        #joint_elem_mirrored = rs.MirrorObject(joint_elem, (0,0,0) , (0,1,0), True)
        joint = joint_elem.transformed(T)
        G_joints.append(Artist(joint.mesh).draw())

"""robot_keys = list(assembly.network.nodes_where({'placed_by':'robot', 'is_built':True}))
for elem in assembly.elements():
    print elem.{'placed_by'}"""
# ---------- end assembly_viz ----------
geo_3 = Geometry(assembly_viz.G_joints)
geo_4 = Geometry(assembly_viz.G_support_elems)
geo_5 = Geometry(assembly_viz.G_target_geo)
geo_6 = Geometry(assembly_viz.G_support_geo)
geo_7 = Geometry(assembly_viz.G_planned_elems)
geo_8 = Geometry(assembly_viz.branch_geo)
plane_3 = Plane(assembly_viz.planned_connector_planes)
geo_9 = Geometry(assembly_viz.G_built_elems)
geo_10 = Geometry(assembly_viz.G_placed_by_robot)
geo_11 = Geometry(assembly_viz.G_dist_elems)
geo_12 = Geometry(assembly_viz.G_sequence)
geo_13 = Geometry(assembly_viz.G_placed_by_human)
geo_14 = Geometry(assembly_viz.G_selected_elem)
geo_15 = Geometry(assembly_viz.joint_elem_mirrored)
pt_3 = Point(assembly_viz.G_intersection)
pln_6 = Plane(assembly_viz.G_intersection)
geo_16 = Geometry(assembly_viz.G_open_connectors_elems)
srf_2 = Surface(assembly_viz.G_connectors_ranges)
mesh_5 = Mesh(assembly_viz.G_close_pairs)
pln_7 = Plane(assembly_viz.all_connectors_planes)
pln_8 = Plane(assembly_viz.joint_planes)
geo_17 = Geometry(assembly_viz.robots_reach)
line_5 = Line(flatten(assembly_viz.lines))
geo_18 = Geometry(assembly_viz.G_no_open_connectors_elems)
pln_9 = Plane(assembly_viz.all_element_planes)
pt_4 = Point(assembly_viz.points)
line_6 = Line(assembly_viz.G_short_line)
tag = TextTag(Location=assembly_viz.line_middle, Text=assembly_viz.dist_label, Colour=RGB(0, 0, 0))
cir = Circle(Plane=pln_6, Radius=0.2)
tag_2 = TextTag(Location=assembly_viz.key_tag_location, Text=assembly_viz.key_tag_text, Colour=RGB(0, 0, 0))
sph = Sphere(Base=assembly_viz.joints, Radius=0.032)
rot = GhPythonScript(plane=assembly_viz.elem_option_robot, angle=Slider(42, range=0..360))  # -> out, plane
# ---------- rot: Python ----------
import math
from compas.geometry import Frame, Rotation
from compas.artists import Artist

frame = Frame(plane.Origin, plane.XAxis, plane.YAxis)

R = Rotation.from_axis_and_angle(frame.xaxis, math.radians(angle), frame.point)
frame.transform(R)

plane = Artist(frame).draw()
# ---------- end rot ----------

# ---- group: Branches
preview_5 = CustomPreview(Geometry=assembly_viz.branch_geo, Material=assembly_viz.colors_branches)

# ---- group: Sequence
preview_6 = CustomPreview(Geometry=geo_12, Material=assembly_viz.colors_sequence)

# ---- group: Geometry / Joints
preview_7 = CustomPreview(Geometry=geo_5, Material=ColourSwatch(SwatchColor=RGBA(196, 196, 196, 30)))
preview_8 = CustomPreview(Geometry=geo_6, Material=ColourSwatch(SwatchColor=RGB(196, 196, 196)))
preview_9 = CustomPreview(Geometry=geo_3, Material=ColourSwatch(SwatchColor=RGB(204, 204, 204)))

# ---- group: Option/Selected/Collision
preview_10 = CustomPreview(Geometry=geo_7, Material=ColourSwatch(SwatchColor=RGBA(255, 170, 0, 119)))
preview_11 = CustomPreview(Geometry=geo_14, Material=ColourSwatch(SwatchColor=RGB(0, 62, 133)))
preview_12 = CustomPreview(Geometry=geo_11, Material=assembly_viz.collision_color)

# ---- group: Human/Robot
preview_13 = CustomPreview(Geometry=geo_13, Material=ColourSwatch(SwatchColor=RGB(242, 229, 0)))
preview_14 = CustomPreview(Geometry=geo_10, Material=ColourSwatch(SwatchColor=RGB(175, 224, 220)))

# ---- group: Design Generation
preview_15 = CustomPreview(Geometry=geo_16, Material=ColourSwatch(SwatchColor=RGB(121, 255, 54)))
preview_16 = CustomPreview(Geometry=[geo_9, geo_18], Material=ColourSwatch(SwatchColor=RGBA(199, 199, 199, 115)))
preview_17 = CustomPreview(Geometry=geo_4, Material=ColourSwatch(SwatchColor=RGB(0, 0, 255)))

# ---- group: Robot
preview_18 = CustomPreview(Geometry=geo_17, Material=ColourSwatch(SwatchColor=RGBA(0, 30, 255, 26)))

# ----
circle_2 = Circle(Plane=plane_3, Radius=unit_size_2)

network_viz = GhPythonScript(assembly=grow_assembly.assembly, show_network=show_7, key=number_slider_4)  # -> out, nodes, edges, current_node, current_node_neighbors; inputs key: Int32
# ---------- network_viz: Python ----------
import sys, os
import ghpythonlib.components as ghcomp
from compas.datastructures import Network
from compas_ghpython.artists import NetworkArtist
from compas_rhino.geometry import RhinoLine

import compas_ghpython
import Rhino.Geometry as rg


data = assembly.network.to_data()
network = Network.from_data(data)

print assembly.network.number_of_nodes()

def draw_network(network):
    """Draw a network in Grasshopper.
    """
    points = []
    for key, attr in network.nodes(True):
        points.append({
            'pos': network.node_coordinates(key),
        })

    lines = []
    for (u, v), attr in network.edges(True):
        lines.append({
            'start': network.node_coordinates(u),
            'end': network.node_coordinates(v),
        })

    points_rg = compas_ghpython.draw_points(points)
    lines_rg = compas_ghpython.draw_lines(lines)

    return points_rg, lines_rg

if show_network:
    nodes, edges = draw_network(network)
    
    current_node = {'pos': network.node_coordinates(key), 'radius': 0.03}
    current_node = compas_ghpython.draw_spheres([current_node])
    
    current_node_neighbors_keys = network.neighbors(key)
    current_node_neighbors = [{'pos': network.node_coordinates(key), 'radius': 0.02} for key in current_node_neighbors_keys]
    current_node_neighbors = compas_ghpython.draw_spheres(current_node_neighbors)
# ---------- end network_viz ----------
line_7 = Line(network_viz.edges)
brep_3 = Brep(network_viz.current_node)
brep_4 = Brep(network_viz.current_node_neighbors)
pt_5 = Point(network_viz.nodes)
preview_19 = CustomPreview(Geometry=brep_4, Material=ColourSwatch(SwatchColor=RGB(255, 207, 207)))
preview_20 = CustomPreview(Geometry=[brep_3, line_7], Material=ColourSwatch(SwatchColor=RGB(0, 0, 0)))

# ----
# Current mode
panel_22 = Panel(settings_parameters.selected_mode)

assembly_viz_2 = PythonScript(
    assembly=grow_assembly.assembly,
    selected_mode=settings_parameters.selected_mode,
    viz=reset,
    joint_elem=elem_60_def.joint_elem,
    joint_elem_mirrored=elem_60_def.joint_elem_mir,
    preview_mode=list_6,
    show_joining_options=get_joining_options,
    is_colliding=settings_parameters.is_colliding,
    selected_key=settings_parameters.selected_key,
    current_key=settings_parameters.current_key,
    collision_det=collision_check,
    dist_elem=settings_parameters.dist_elem,
    dist=settings_parameters.dist,
    short_line=settings_parameters.short_line,
    angle=settings_parameters.current_angle,
    angle1=joining_branches.angle1,
    angle2=joining_branches.angle2,
    mirror_unit=settings_parameters.current_mirror_unit,
    unit_size=unit_size_2,
    shift_value=settings_parameters.current_shift_value,
    visibility_list=merge)  # -> out, G_target_geo, G_support_geo, G_planned_elems, branch_geo, colors_branches, G_sequence, colors_sequence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; inputs current_key: Int32, dist_elem: list, short_line: Line, visibility_list: list; disabled
# ---------- assembly_viz_2: Python ----------
import os
import sys
from scriptcontext import sticky as st
import Rhino.Geometry as rg

import ghpythonlib.components as gh

import math
from math import pi

from compas.geometry import Vector, Translation, Frame, Transformation
from compas.artists import Artist
from compas.colors import Color
from compas_rhino.conversions import cylinder_to_rhino, frame_to_rhino
from compas.topology import connected_components


G_selected = []
G_dist_elems = []

G_placed_by_human = []
G_placed_by_robot = []

G_planned_elems = []
planned_connector_planes = []
G_built_elems = []
G_support_elems = []
G_branches =[]

G_no_open_connectors_elems = []
G_open_connectors_elems = []

G_connectors_ranges = []
G_close_pairs = []
G_intersection = []

G_joints = []
G_supports = []

robots_reach = []
elem_options = []

key_tag_text = []
key_tag_location= []
lines = []

flip = 'AA'

# Color coding
color_coding = {'color_close_pairs': Color(1.0, 0., 0.0, 1.0),
                'color_is_planned': Color(1.0, 0.752941176471, 0.0, 1.0), 
                'color_is_support': Color(0.0, 0.0, 1.0, 1.0), 
                'color_has_open_connector': Color(0.494117647059, 1.0, 0.239215686275, 1.0), 
                'color_has_no_open_connectors': Color(0.78431372549, 0.78431372549, 0.78431372549, 1.0), 
                'color_is_built': Color(0.811764705882, 1.0, 0.709803921569, 1.0), 
                'color_is_built_by_robot': Color(0.686274509804, 0.878431372549, 0.862745098039, 1.0), 
                'color_is_built_by_human': Color(0.949019607843, 0.898039215686, 0.0, 1.0)}

def generate_colors(n):
    colors = []
    x = 70
    for i in range(n):
        r = 0
        g = int((i / (n - 1)) * (255-x) + x)  # Varying from x to 255
        b = 0
        
        # Create a Color object and get the RGB values
        color = Color.FromArgb(r, g, b)
        rgb_values = "{},{},{}".format(color.R, color.G, color.B)
        
        # Append the RGB values to the colors list
        colors.append(rgb_values)
    
    return colors

def generate_gradient(color_start, color_end, n):
    colors = []
    # Extract RGB components from start and end colors
    r_start, g_start, b_start = color_start
    r_end, g_end, b_end = color_end
    
    for i in range(n):
        # Calculate the RGB values for the gradient
        r = int(r_start + (i / (n - 1)) * (r_end - r_start))
        g = int(g_start + (i / (n - 1)) * (g_end - g_start))
        b = int(b_start + (i / (n - 1)) * (b_end - b_start))
        
        # Append the RGB values to the colors list
        rgb = '{},{},{}'.format(r,g,b)
        colors.append(rgb)
    
    return colors


keys = [key for key, element in assembly.elements()]
lines = [Artist(assembly.element(key).line).draw() for key in keys]

open_connectors_frames = [assembly.element(key).connectors(state='open') for key, element in assembly.elements()]
all_connectors_frames = [assembly.element(key).connectors() for key, element in assembly.elements()]
element_frames = [assembly.element(key).frame for key, element in assembly.elements()]

# Identify the connected elements (branches) in the assembly.
branches = connected_components(assembly.network.adjacency)
#print ('branch', branches, len(branches))

#print open_connectors_frames
#print element_frames

selected_element = assembly.element(current_key)

selected_connectors_ranges = [assembly.element(key).connectors_ranges(state='open') for key in keys if key == current_key or key in assembly.selected_keys_pair]
#selected_connectors_ranges = [assembly.element(key).connectors_ranges(state='open') for key in keys if key in assembly.selected_keys_pair]
all_connectors_ranges = [assembly.element(key).connectors_ranges(state='open') for key in keys if key]

if 'show_open_connectors_planes' in visibility_list:
    open_connectors_planes = [Artist(connector).draw() for connectors in open_connectors_frames for connector in connectors if connectors != []]
if 'show_all_frames' in visibility_list:
    all_connectors_planes = [Artist(connector).draw() for connectors in all_connectors_frames for connector in connectors if connectors != []]
    all_element_planes = [Artist(elem).draw() for elem in element_frames]
    
if 'show_all_connectors_ranges' in visibility_list and  'show_selected_connectors_ranges' not in visibility_list:
    G_connectors_ranges = [Artist(connector).draw() for connectors in all_connectors_ranges for connector in connectors if connectors != []]
    
elif 'show_selected_connectors_ranges' in visibility_list and 'show_all_connectors_ranges' not in visibility_list:
    T = Translation.from_vector(selected_element.frame.xaxis * 0)
    connectors_ranges = [connector.transform(T) for connectors in selected_connectors_ranges for connector in connectors if connectors != []]
    G_connectors_ranges = [Artist(connector).draw() for connectors in connectors_ranges]
    
else:
    G_connectors_ranges = []
    
if 'show_intersection' in visibility_list:
    if len(assembly.selected_connectors_ranges_intersection_point) > 0:
        G_intersection = assembly.selected_connectors_ranges_intersection_point
    
def show(element, output_geo, color):
    mesh = Artist(element.mesh).draw(color)
    output_geo.append(mesh)

def show_multiple(elements, output_geo, color):
    for element in elements:
        mesh = Artist(element.mesh).draw(color)
        output_geo.append(mesh)
        
if 'show_robots_reach' in visibility_list:
    robots_reach.append(rg.Sphere(assembly.ur_arm_AA_base_plane.Origin, 1.25))
    robots_reach.append(rg.Sphere(assembly.ur_arm_AB_base_plane.Origin, 1.25))
    
print assembly.selected_keys_pair

if assembly:
    radius = assembly.globals['rod_radius']
    if current_key != None:
        current_element = assembly.element(current_key)
        if show_joining_options and len(assembly.selected_keys_pair) != 0:
            print 'yes'
            if len(assembly.selected_keys_pair) > 1: 
                elem_options.append(assembly.element(assembly.selected_keys_pair[0]).current_option_elements(assembly, mirror_unit, unit_size, angle1, shift_value))
                elem_options.append(assembly.element(assembly.selected_keys_pair[1]).current_option_elements(assembly, mirror_unit, unit_size, angle2, shift_value))
            else:
                elem_options.append(assembly.element(assembly.selected_keys_pair[0]).current_option_elements(assembly, mirror_unit, unit_size, angle1, shift_value))
            elem_options = [option for options in elem_options for option in options]
        else:
            elem_options = assembly.element(current_key).current_option_elements(assembly, mirror_unit, unit_size, angle, shift_value)
        #G_selected = Artist(assembly.element(current_key).mesh).draw(color_coding['color_is_support'])
    else:
        current_element = None
        elem_options = []
    
    if len(elem_options) != 0:
        elem_option = elem_options[0]
        #all_connectors_frames = [assembly.element(key).connectors() for key, element in assembly.elements()]
        #planned_connector_frames = [elem.connectors() for elem in elem_option]
    
    #if flip_human_robot:
    #    elem_options.reverse()
    
    planned_keys = list(assembly.network.nodes_where({'is_planned':True, 'is_built':False}))
    built_keys = list(assembly.network.nodes_where({'is_built':True}))
    unbuilt_keys = [key for key, element in assembly.elements() if key not in built_keys]
    support_keys = list(assembly.network.nodes_where({'is_support':True}))
    #open_connectors_keys = [key for key, frames in assembly.connectors('open') if frames != []]
    open_connectors_keys = assembly.open_connectors_keys
    no_open_connectors_keys = [key for key in planned_keys if key not in open_connectors_keys]
    
    robot_keys = list(assembly.network.nodes_where({'placed_by':'robot', 'is_built':True}))
    human_keys = list(assembly.network.nodes_where({'placed_by':'human', 'is_built':True}))
    
    mirrored_keys = list(assembly.network.nodes_where({'is_mirrored':True}))
    unmirrored_keys = list(assembly.network.nodes_where({'is_mirrored':False}))
    #support_keys = [key for key in support_keys if key not in assembly.open_connectors_keys]
    
    print 'robot keys:', robot_keys
    print 'human keys:', human_keys
    
    print 'planned keys:', planned_keys
    print 'built keys:', built_keys
    print 'unbuilt keys:', unbuilt_keys
    
    print 'support keys:', support_keys
    print 'open connectors keys:', open_connectors_keys
    print 'no open connectors keys:', no_open_connectors_keys
    
    robot_elements = [assembly.element(key) for key in robot_keys] 
    human_elements = [assembly.element(key) for key in human_keys] 
    
    planned_elements = [assembly.element(key) for key in planned_keys] 
    built_elements = [assembly.element(key) for key in built_keys] 
    
    mirrored_elements = [assembly.element(key) for key in mirrored_keys] 
    unmirrored_elements = [assembly.element(key) for key in unmirrored_keys] 
    
    support_elements = [assembly.element(key) for key in support_keys] 
    open_connectors_elements = [assembly.element(key) for key in open_connectors_keys]
    no_open_connectors_elements = [assembly.element(key) for key in no_open_connectors_keys]
    open_keys = [key for key, frames in assembly.connectors('open') if frames != []]

    # Visualize assembly
    if 'show_assembly' in visibility_list:
        print('here show assembly')
        if preview_mode == 4: # Sequence
            colors_sequence = []
            G_sequence = []
            i = 0
            total_elements = assembly.network.number_of_nodes()
            gradient_colors = generate_gradient((235,235,255), (0,0,255), total_elements)
            
            for key, element in assembly.elements():
                c = gradient_colors[i]
                geo = cylinder_to_rhino(assembly.element(key)._source)
                G_sequence.append(geo)
                colors_sequence.append(c)
                i +=1
        
        if preview_mode == 3: # Branches
            colors_branches = []
            branch_geo =[]
            
            branches = connected_components(assembly.network.adjacency)
            gradient_colors = generate_gradient((186,217,193), (0,128,0), len(branches))
            
            i = 0
            for branch in branches:
                c = gradient_colors[i]
                for key in branch:
                    geo = cylinder_to_rhino(assembly.element(key)._source)
                    branch_geo.append(geo)
                    colors_branches.append(c)
                i +=1
                #G_branches.append(branch_geo)
            #print ('branch', G_branches)
        
        if preview_mode == 2: # Assembly workflow
            for element in planned_elements:
                geo = cylinder_to_rhino(element._source)
                G_planned_elems.append(geo)
                
            for element in built_elements:
                geo = cylinder_to_rhino(element._source)
                G_built_elems.append(geo)
                
            for element in support_elements:
                geo = cylinder_to_rhino(element._source)
                #G_support_elems.append(geo)
                
            
        elif preview_mode == 1: # Design Generation
            for element in support_elements:
                geo = cylinder_to_rhino(element._source)
                G_support_elems.append(geo)
                
            for element in open_connectors_elements:
                geo = cylinder_to_rhino(element._source)
                G_open_connectors_elems.append(geo)
                
            for element in no_open_connectors_elements:
                geo = cylinder_to_rhino(element._source)
                G_no_open_connectors_elems.append(geo)
                
            if 'show_selected_key' in visibility_list and selected_mode != 'Join branches': 
                G_selected_elem = cylinder_to_rhino(assembly.element(selected_key)._source)
                #print ("here")
            
        else: # Build by human/robot
            for element in robot_elements:
                geo = cylinder_to_rhino(element._source)
                G_placed_by_robot.append(geo)
                
            for element in human_elements:
                geo = cylinder_to_rhino(element._source)
                G_placed_by_human.append(geo)

    # Vizualize current connector 
    if 'show_option' in visibility_list and 'show_assembly' in visibility_list:
        print('here option and assembly')
        if elem_options:

            for option in elem_options:
                G_planned_elems.append(cylinder_to_rhino(option._source))
                lines.append(Artist(option.line).draw())
                
                for connector in option.connectors():
                    connector_plane = Artist(connector).draw()
                    planned_connector_planes.append(connector_plane)
                
                """all_connectors_frames = option.connectors(state='open')
                connector_planes = [Artist(connector).draw() for connector in closed_connector_frame]
                planned_connector_planes.append(connector_planes)
                print(planned_connector_planes)
                
                all_connectors_planes = [Artist(connector).draw() for connectors in all_connectors_frames for connector in connectors if connectors != []]"""
                #all_element_planes = [Artist(elem).draw() for elem in element_frames]
                #planned_connector_frames = [elem.connectors() for elem in elem_option]
                #planned_connector_planes.append([Artist(connector).draw() for connectors in frames for connector in connectors if connectors != []]

        else:
            print('No open connectors')
        #print(planned_connector_planes)
    
    #elem_option_robot = Artist(elem_options[0].frame).draw() # elem for planning robot routine


    #if all(show in visibility_list for show in ('show_assembly', 'show_collision')):
    if 'show_assembly' in visibility_list and 'show_collision' in visibility_list and 'show_option' in visibility_list and short_line:
        print ('here collision')
        collision_color = '255,129,120'
        if is_colliding:
            collision_color = '255,0,0'
            for element in dist_elem:
                geo = cylinder_to_rhino(element._source)
                G_dist_elems.append(geo)
        else:
            G_short_line = short_line
            line_middle = gh.CurveMiddle(short_line)
            dist_label = '{}mm'.format(int(dist*1000))

    if 'show_open_keys' in visibility_list:
        print('here open keys')
        for key, element in assembly.elements():
            if key in open_connectors_keys:
                key_tag_text.append(str(key))
                key_tag_location.append(Artist(element.frame).draw().Origin)
                
    if 'show_all_keys' in visibility_list:
        print('here all keys')
        for key, element in assembly.elements():
            key_tag_text.append(str(key))
            key_tag_location.append(Artist(element.frame).draw().Origin)
            
    if 'show_support_elements' in visibility_list:
        print('here supports')
        G_supports.append(assembly.support)

# visualise target geometry
if 'show_target_geometry' in visibility_list:
    G_target_geo = assembly.target_geo

# visualise xupporting geo
if 'show_support_geometry' in visibility_list:
    G_support_geo = assembly.support


points = []
for key, element in assembly.elements():
    points.append(Artist(element.frame.point).draw())
    
joints = []
joint_planes = []
if 'show_joints' in visibility_list:
    #for key, element in assembly.elements():
        #joint_planes.append(Artist(element.joint_frame_1).draw())
        #joint_planes.append(Artist(element.joint_frame_2).draw())
        #robot_keys = list(assembly.network.nodes_where({'placed_by':'robot', 'is_built':True}))
    
    for key, element in assembly.elements():
        if not element.connector_1_state:
            joint_planes.append(Artist(element.joint_frame_1).draw())
            #joints.append(frame_to_rhino(element.joint_frame_1))
        if not element.connector_2_state and key not in support_keys:
            #joints.append(frame_to_rhino(element.joint_frame_2))
            joint_planes.append(Artist(element.joint_frame_2).draw())
        
assembly.support_keys = support_keys


if len(assembly.joints) > 0 and 'show_joints' in visibility_list:
    print('joints', assembly.joints)
    for joint_frame in assembly.joints:
        #print joint_frame
        T = Transformation.from_frame_to_frame(Frame.worldXY(), joint_frame)
        #joint_elem_mirrored = rs.MirrorObject(joint_elem, (0,0,0) , (0,1,0), True)
        joint = joint_elem.transformed(T)
        G_joints.append(Artist(joint.mesh).draw())

    #print('No joints added!')
# ---------- end assembly_viz_2 ----------
geo_19 = Geometry(assembly_viz_2.G_sequence)  # disabled
geo_20 = Geometry(assembly_viz_2.G_selected_elem)  # disabled
pt_6 = Point(assembly_viz_2.G_intersection)  # disabled
pln_10 = Plane(assembly_viz_2.all_connectors_planes)  # disabled
pln_11 = Plane(assembly_viz_2.all_element_planes)  # disabled
geo_21 = Geometry(assembly_viz_2.G_joints)  # disabled
geo_22 = Geometry(assembly_viz_2.joint_elem_mirrored)  # disabled
geo_23 = Geometry(assembly_viz_2.G_support_geo)  # disabled
geo_24 = Geometry(assembly_viz_2.G_planned_elems)  # disabled
geo_25 = Geometry(assembly_viz_2.branch_geo)  # disabled
plane_4 = Plane(assembly_viz_2.planned_connector_planes)  # disabled
geo_26 = Geometry(assembly_viz_2.G_built_elems)  # disabled
geo_27 = Geometry(assembly_viz_2.G_placed_by_human)  # disabled
geo_28 = Geometry(assembly_viz_2.G_placed_by_robot)  # disabled
geo_29 = Geometry(assembly_viz_2.G_support_elems)  # disabled
geo_30 = Geometry(assembly_viz_2.G_no_open_connectors_elems)  # disabled
geo_31 = Geometry(assembly_viz_2.G_open_connectors_elems)  # disabled
srf_3 = Surface(assembly_viz_2.G_connectors_ranges)  # disabled
mesh_6 = Mesh(assembly_viz_2.G_close_pairs)  # disabled
pln_12 = Plane(assembly_viz_2.G_intersection)  # disabled
pln_13 = Plane(assembly_viz_2.joint_planes)  # disabled
geo_32 = Geometry(assembly_viz_2.robots_reach)  # disabled
line_8 = Line(flatten(assembly_viz_2.lines))  # disabled
pt_7 = Point(assembly_viz_2.points)  # disabled
geo_33 = Geometry(assembly_viz_2.G_target_geo)  # disabled
geo_34 = Geometry(assembly_viz_2.G_dist_elems)  # disabled
rot_2 = GhPythonScript(plane=assembly_viz_2.elem_option_robot, angle=number_slider_5)  # -> out, plane; disabled; same code as rot
cir_2 = Circle(Plane=pln_12, Radius=0.2)  # disabled
sph_2 = Sphere(Base=assembly_viz_2.joints, Radius=0.032)  # disabled
tag_3 = TextTag(Location=assembly_viz_2.key_tag_location, Text=assembly_viz_2.key_tag_text, Colour=RGB(89, 0, 0))  # disabled

error_2 = GhPythonScript(error=grow_assembly.error)  # -> out; same code as error
line_9 = Line(assembly_viz_2.G_short_line)  # disabled
tag_4 = TextTag(Location=assembly_viz_2.line_middle, Text=assembly_viz_2.dist_label, Colour=RGB(0, 0, 0))  # disabled

# ---- group: Sequence
preview_21 = CustomPreview(Geometry=geo_19, Material=assembly_viz_2.colors_sequence)  # disabled

# ---- group: Branches
preview_22 = CustomPreview(Geometry=assembly_viz_2.branch_geo, Material=assembly_viz_2.colors_branches)  # disabled

# ---- group: Geometry / Joints
colour_swatch_2 = ColourSwatch(SwatchColor=RGBA(196, 196, 196, 30))  # disabled
preview_23 = CustomPreview(Geometry=geo_33, Material=colour_swatch_2)  # disabled
colour_swatch_3 = ColourSwatch(SwatchColor=RGB(196, 196, 196))  # disabled
preview_24 = CustomPreview(Geometry=geo_23, Material=colour_swatch_3)  # disabled
colour_swatch_4 = ColourSwatch(SwatchColor=RGB(204, 204, 204))  # disabled
preview_25 = CustomPreview(Geometry=geo_21, Material=colour_swatch_4)  # disabled

# ---- group: Option/Selected/Collision
preview_26 = CustomPreview(Geometry=[geo_34, line_9], Material=assembly_viz_2.collision_color)  # disabled
colour_swatch_5 = ColourSwatch(SwatchColor=RGB(0, 62, 133))  # disabled
preview_27 = CustomPreview(Geometry=geo_20, Material=colour_swatch_5)  # disabled
colour_swatch_6 = ColourSwatch(SwatchColor=RGBA(255, 170, 0, 119))  # disabled
preview_28 = CustomPreview(Geometry=geo_24, Material=colour_swatch_6)  # disabled

# ---- group: Design Generation
colour_swatch_7 = ColourSwatch(SwatchColor=RGB(121, 255, 54))  # disabled
preview_29 = CustomPreview(Geometry=geo_31, Material=colour_swatch_7)  # disabled
colour_swatch_8 = ColourSwatch(SwatchColor=RGBA(199, 199, 199, 115))  # disabled
preview_30 = CustomPreview(Geometry=[geo_26, geo_30], Material=colour_swatch_8)  # disabled
colour_swatch_9 = ColourSwatch(SwatchColor=RGB(0, 0, 255))  # disabled
preview_31 = CustomPreview(Geometry=geo_29, Material=colour_swatch_9)  # disabled

# ---- group: Human/Robot
colour_swatch_10 = ColourSwatch(SwatchColor=RGB(242, 229, 0))  # disabled
preview_32 = CustomPreview(Geometry=geo_27, Material=colour_swatch_10)  # disabled
colour_swatch_11 = ColourSwatch(SwatchColor=RGB(175, 224, 220))  # disabled
preview_33 = CustomPreview(Geometry=geo_28, Material=colour_swatch_11)  # disabled

# ---- group: Robot
colour_swatch_12 = ColourSwatch(SwatchColor=RGBA(0, 30, 255, 26))  # disabled
preview_34 = CustomPreview(Geometry=geo_32, Material=colour_swatch_12)  # disabled

# ----
# Screen Feedback
panel_23 = Panel("Top")
c_script = CSharpScript(vp=panel_23)  # -> out, Height, Width, Viewport; inputs vp: String
# ---------- c_script: C# usings ----------
using System.IO;
using System.Linq;
using System.Data;
using System.Drawing;
using System.Reflection;
using System.Windows.Forms;
using System.Xml;
using System.Xml.Linq;
using System.Runtime.InteropServices;

using Rhino.DocObjects;
using Rhino.Collections;
using GH_IO;
using GH_IO.Serialization;
# ---------- c_script: C# ----------
    var view = RhinoDoc.ActiveDoc.Views.Find(vp, false);
    if (view == null)
    {
      view = RhinoDoc.ActiveDoc.Views.ActiveView;
    }
    Height = view.ActiveViewport.Bounds.Height;
    Width = view.ActiveViewport.Bounds.Width;
    Viewport = view.ActiveViewport.Name;
# ---------- end c_script ----------
create_set = CreateSet(List=assembly_viz.colors_branches)  # -> Set, Map
feedback_to_screen = GhPythonScript(
    screen_height=c_script.Height,
    screen_width=c_script.Width,
    preview_mode=mode,
    assembly_select=list_2,
    assembly=settings_parameters.assembly,
    total_elements=stats.total_elements,
    total_joints=stats.total_joints,
    current_mode=settings_parameters.selected_mode,
    current_key=settings_parameters.current_key,
    current_angle=settings_parameters.current_angle,
    current_shift_value=settings_parameters.current_shift_value,
    unit_size=unit_size_2,
    current_mirror_unit=settings_parameters.current_mirror_unit,
    is_colliding=settings_parameters.is_colliding,
    collision_det=collision_check,
    dist=settings_parameters.dist,
    get_joining_options=get_joining_options,
    join_branch_params=joining_branches.out,
    stability_feedback=settings_parameters.stability_feedback,
    branch_colors=create_set.Set,
    msg=settings_parameters.out,
    default_size=Slider(21, range=0..50))  # -> out, text, location, size, color; inputs preview_mode: Int32, join_branch_params: list, stability_feedback: list, branch_colors: list, msg: list
# ---------- feedback_to_screen: Python ----------
feedback_text = {
                'text': [],
                'location': [],
                'size': default_size,
                'color': []
                }

y0 = 100
x0 = 50
offset = default_size*0.5
x_curr = x0
y_curr = y0


color_red = '255,0,0'
color_green = '44,138,0'

def add_text_line(text, value, x, y, color='0,0,0'):
    global x_curr,y_curr
    feedback_text['text'].append(text.format(value))
    feedback_text['location'].append('{}, {}, 0'.format(x,y))
    feedback_text['color'].append(color)
    
    if y is y_curr:
        y_curr += default_size
        y_curr += offset


preview_mode_names = ['Built by Human/Robot','Design Generation','Assembly Workflow','Branches', 'Sequence']


# ----------- Assembly Status --------------- 

#y_B = screen_height
assembly_type = 'New' if assembly_select == 1 else 'Loaded'
add_text_line('ASSEMBLY: {}',assembly_type, x_curr,y_curr)
#y_B += default_size
#y_B += offset*2
add_text_line('Total Elements: {}',total_elements, x_curr,y_curr)
#y_B += default_size
#y_B += offset
add_text_line('Total Joints: {}',total_joints, x_curr,y_curr)
y_curr += offset*3

# ----------- Preview mode ---------------
add_text_line('PREVIEW mode: {}',preview_mode_names[preview_mode],x_curr,y_curr)
y_curr += offset*3

if preview_mode == 3: # Branches
    i = 0
    for t in stability_feedback:
        add_text_line('{}',t,x_curr,y_curr, color=branch_colors[i])
        i +=1
    
y_curr += offset*3
add_text_line('Current mode: {}',current_mode,x_curr,y_curr)
y_curr += offset*3

#feedback_text['text'].append(current_mode)
#feedback_text['location'].append('{}, {}, 0'.format(x,y))

if current_mode == 'Automatic' or current_mode == 'Manual':
    add_text_line('     Key: {}',current_key,x_curr,y_curr)
    add_text_line('     Angle: {}°',current_angle,x_curr,y_curr)
    add_text_line('     Shift: {} cm',current_shift_value*100,x_curr,y_curr)
    add_text_line('     Unit size: {} cm',unit_size*100,x_curr,y_curr)
    add_text_line('     Mirrored: {}',current_mirror_unit,x_curr,y_curr)


if current_mode == 'Join branches':
    if get_joining_options:
        add_text_line('Get joining options: {}',get_joining_options,x_curr,y_curr, color=color_green)
    else:
        add_text_line('Get joining options: {}',get_joining_options,x_curr,y_curr, color=color_red)
    y_curr += offset*3
    
    for t in join_branch_params:
        add_text_line('{}',t,x_curr,y_curr)
    
    y_curr += offset*3

y_curr += offset*3

if collision_det and total_elements>1:
    add_text_line('Collision detection: {}',collision_det,x_curr,y_curr)
   #if is_colliding:
    add_text_line('     Is colliding: {}',is_colliding,x_curr,y_curr, color=color_red if is_colliding else color_green)
    #add_text_line('     Distance (elem axis): {} mm',int(dist*1000),x_curr,y_curr)
else:
    add_text_line('Collision detection: {}',collision_det,x_curr,y_curr)


# ----------- ADD ERRORS --------------- 
"""y += offset*3
for t in msg:
    feedback_text['text'].append('ERROR: {}'.format(t))
    feedback_text['location'].append('{}, {}, 0'.format(x,y))
    y += default_size
    y += offset"""

# ----------- PRINT --------------- 
text = feedback_text['text']
location = feedback_text['location']
size = feedback_text['size']
color = feedback_text['color']
# ---------- end feedback_to_screen ----------
panel_24 = Panel(feedback_to_screen.text)
render_text_to_screen = RenderTextToScreen(
    Text=feedback_to_screen.text,
    Location=feedback_to_screen.location,
    Size=feedback_to_screen.size,
    Color=feedback_to_screen.color,
    Font="Roboto",
    m_scWithvp=False)

# ----
# Bake Geometry to Rhino
# Type name of the layer...
bake = Button()
ghpython_script_11 = GhPythonScript(G=geo_6, L="Test layer", B=bake)  # -> out, a
# ---------- ghpython_script_11: Python ----------
"""Provides a scripting component.
    Inputs:
        G: Geometry to bake
        L: Layer name for bake
        B: Bake Activate
    Output:
        a: The a output variable"""
 
__author__ = "ScottD"
__version__ = "2019.08.10"
 
import rhinoscriptsyntax as rs
import scriptcontext
import Rhino
 
 
if B:
 
    print(type(G)) #debug message to Python output
 
    #we obtain the reference in the Rhino doc
    doc_object = scriptcontext.doc.Objects.Find(G)
    print(type(doc_object))
 
    attributes = doc_object.Attributes
    print('the type of attributes is: ' + str(type(attributes)))     #debug message to Python output
 
    geometry = doc_object.Geometry
    print('the type of geometry is: ' + str(type(doc_object)))     #debug message to Python output
 
    #we change the scriptcontext
    scriptcontext.doc = Rhino.RhinoDoc.ActiveDoc
 
    #we add both the geometry and the attributes to the Rhino doc
    rhino_brep = scriptcontext.doc.Objects.Add(geometry, attributes)
    print('the Rhino doc ID is: ' + str(rhino_brep))     #debug message to Python output
 
    #we can for example change the layer in Rhino...
    if not rs.IsLayer(L):
        rs.AddLayer(L)
    rs.ObjectLayer(rhino_brep, L)
 
    #we put back the original Grasshopper document as default
    scriptcontext.doc = ghdoc
    a = G
# ---------- end ghpython_script_11 ----------

# ----
# Set to built
keys = Slider(18, range=0..100)
set_to_built = GhPythonScript(assembly=grow_assembly.assembly, built_keys=keys, set_keys_to_built=Button(), set_all_to_unbuilt=Button())  # -> out, assembly; inputs built_keys: Int32
# ---------- set_to_built: Python ----------
import rhinoscriptsyntax as rs

if set_keys_to_built:
    for i in range(built_keys):
        #assembly.network.node_attribute(i, 'is_planned', True)
        assembly.network.node_attribute(i, 'is_built', True)
        
if set_all_to_unbuilt:
    for key, element in assembly.elements():
    #    assembly.network.node_attribute(key, 'is_planned', True)
        assembly.network.node_attribute(key, 'is_built', False)
        
for key, element in assembly.elements():
    print assembly.network.node_attribute(key, 'robot_AA_base_frame')
# ---------- end set_to_built ----------

ghpython_script_12 = GhPythonScript(rod_radius=rod_radius, joint_dist=joint_dist)  # -> out, d; disabled
# ---------- ghpython_script_12: Python ----------
d = joint_dist + 2*rod_radius
# ---------- end ghpython_script_12 ----------
curve_proximity_2 = CurveProximity(CurveA=line_8, CurveB=graft(line_8))  # -> PointA, PointB, Distance; disabled
number_slider_6 = Slider(0.01, range=0..0.01)  # disabled
panel_25 = Panel(ghpython_script_12.d)  # disabled
panel_26 = Panel("0.032118")  # disabled
boolean_toggle_2 = BooleanToggle(True)  # disabled
line_10 = Line(StartPoint=curve_proximity_2.PointA, EndPoint=curve_proximity_2.PointB)  # disabled
similarity = Similarity(FirstNumber=curve_proximity_2.Distance, SecondNumber=panel_25, Threshold=0.1)  # -> Similarity, AbsoluteDifference; disabled
circle_3 = Circle(Plane=curve_proximity_2.PointA, Radius=number_slider_6)  # disabled
circle_cnr_2 = CircleCNR(Center=curve_proximity_2.PointA, Normal=line_8, Radius=number_slider_6)  # disabled
panel_27 = Panel(curve_proximity_2.Distance)  # disabled
dispatch = Dispatch(List=line_10, DispatchPattern=similarity.Similarity)  # -> ListA, ListB; disabled
transform = Transform()  # disabled
clean_tree_2 = CleanTree(RemoveNulls=boolean_toggle_2, RemoveInvalid=boolean_toggle_2, RemoveEmpty=boolean_toggle_2, Tree=dispatch.ListA)  # -> flatten(Tree); disabled
