# Grasshopper definition ex9_assembly_sequence [Feb-02 '24, 1517].ghx (Grasshopper 1.0.7)
# plug-ins: Human

# ----
# Color Coding
colour_swatch = ColourSwatch(SwatchColor=RGB(255, 192, 0))
color_coding = GhPythonScript(
    is_planned=colour_swatch,
    is_built=ColourSwatch(SwatchColor=RGB(207, 255, 181)),
    is_support=ColourSwatch(SwatchColor=RGB(0, 0, 255)),
    has_open_connector=ColourSwatch(SwatchColor=RGB(126, 255, 61)),
    has_no_open_connectors=ColourSwatch(SwatchColor=RGB(200, 200, 200)),
    is_built_by_robot=ColourSwatch(SwatchColor=RGB(175, 224, 220)),
    is_built_by_human=ColourSwatch(SwatchColor=RGB(242, 229, 0)))  # -> out, color_coding
# ---------- color_coding: Python ----------
import rhinoscriptsyntax as rs
from compas.colors import Color


color_is_planned = Color(is_planned.R/255 , is_planned.G/255, is_planned.B/255)
color_is_built = Color(is_built.R/255 , is_built.G/255, is_built.B/255)
color_is_support = Color(is_support.R/255 , is_support.G/255, is_support.B/255)
color_has_open_connector = Color(has_open_connector.R/255 , has_open_connector.G/255,has_open_connector.B/255)
color_has_no_open_connectors = Color(has_no_open_connectors.R/255 , has_no_open_connectors.G/255, has_no_open_connectors.B/255)
color_is_built_by_robot = Color(is_built_by_robot.R/255 , is_built_by_robot.G/255, is_built_by_robot.B/255)
color_is_built_by_human = Color(is_built_by_human.R/255 , is_built_by_human.G/255, is_built_by_human.B/255)

color_coding = {'color_is_planned':color_is_planned, 'color_is_built':color_is_built, 'color_is_support':color_is_support, 'color_has_open_connector':color_has_open_connector, 'color_has_no_open_connectors':color_has_no_open_connectors, 'color_is_built_by_robot':color_is_built_by_robot, 'color_is_built_by_human':color_is_built_by_human}

print color_coding
# ---------- end color_coding ----------
panel = Panel(color_coding.out)

panel_2 = Panel("test_attr_assembly_3_2024-02-01_11-54.json")
panel_3 = Panel("2023_07_28_11_43_FINAL_200_assembly.json")
py = PythonScript()  # -> ENVIRONMENT_NAME, HERE, DATA
# ---------- py: Python ----------
import os
import compas_bootstrapper

HERE = os.path.dirname(ghdoc.Path)
DATA = os.path.abspath(os.path.join(HERE, "..", "data"))
ENVIRONMENT_NAME = compas_bootstrapper.ENVIRONMENT_NAME
print(HERE)
print(DATA)
print(ENVIRONMENT_NAME)
# ---------- end py ----------

panel_4 = Panel("Unload libraries")
bang = Button()
unload = PythonScript(bang=bang)
# ---------- unload: Python ----------
from compas_rhino.utilities.misc import get_tolerance
from compas_rhino.utilities.misc import unload_modules

unload_modules("cdf_2023")
unload_modules("mobile_robot_control")
# ---------- end unload ----------

panel_5 = Panel("trunk_1_assembly.json")
support_geo_arch = Brep([<brep referenced from the Rhino model> x2])
support_geo = Brep(support_geo_arch)
panel_6 = Panel(py.ENVIRONMENT_NAME)
M = MeshJoin(Meshes=support_geo)

# ----
# Load assembly model
# Import assembly from .json.
import = Button(ExpressionNormal="True", ExpressionPressed="False")
initial_assembly = GhPythonScript(DATA=py.DATA, filename="TEST_Arch_assembly_39_2024-01-13_13-59.json", import_from_json=import, support_geo=M)  # -> out, assembly; inputs import_from_json: Boolean, support_geo: Mesh
# ---------- initial_assembly: Python ----------
import os
import json
from scriptcontext import sticky

from cdf_2023.assembly import Assembly

if import_from_json:
    PATH = os.path.join(DATA, "assembly", filename)
    assembly = Assembly.from_json(PATH)
    assembly.support_keys = []
    
    assembly.support = support_geo
# ---------- end initial_assembly ----------

key = Slider(0, range=0..388)
till_key = Button()
reset = Button()
start = Button()
stop = Button()
step = Button()
full = Button()
list = ValueList({"20", "50", "100", "500", "1000", "5000"}, selected="100")

back = Button()
counter = CountThroughList(
    assembly=initial_assembly.assembly,
    start=start,
    stop=stop,
    step=step,
    step_back=back,
    reset=reset,
    full=full,
    till_key=till_key,
    key=key,
    interval=list)  # -> out, item, counter; inputs start: Boolean, stop: Boolean, step_back: Boolean, key: Int32
# ---------- counter: Python ----------
from scriptcontext import sticky as st
from compas_ghpython import update_component


L = list(assembly.elements())
# store data in component
guid = str(ghenv.Component.InstanceGuid)
counter_key = "counter_" + guid
running_key = "running_" + guid

if counter_key not in st:
    st[counter_key] = 0

if running_key not in st:
    st[running_key] = False
    

if st[running_key]:
    if st[counter_key] < len(L) - 1:
        st[counter_key] += 1
        update_component(ghenv, interval)
    else:
        st[counter_key] = 0
        st[running_key] = False
    
    
if start:
    st[running_key] = True

if stop:
    st[running_key] = False

if step:
    if st[counter_key] < len(L) - 1:
        st[counter_key] += 1

if step_back:
    if st[counter_key] < len(L):
        st[counter_key] -= 1

if reset:
    st[counter_key] = 0

if till_key:
    st[counter_key] = key

if full:
    st[counter_key] = len(L)-1

if len(L):
    item = L[st[counter_key]]



#st["visualisation_counter"] = st[counter_key]
#st[counter_key]= 500
counter = st[counter_key]
# ---------- end counter ----------

rec = DataRecorder(counter.out, DataLimit=-10, RecordData=True)
panel_7 = Panel(rec)
counter_2 = Panel(counter.counter)

stats = GhPythonScript(assembly=initial_assembly.assembly)  # -> out
# ---------- stats: Python ----------
total_elements = assembly.network.number_of_nodes()
planned_keys = list(assembly.network.nodes_where({'is_planned':True}))
built_keys = list(assembly.network.nodes_where({'is_built':True}))
support_keys = list(assembly.network.nodes_where({'is_support':True}))

print total_elements, "element(s) in assembly."
print len(built_keys), "element(s) are already built."
print len(planned_keys), "element(s) are planned."
print len(support_keys), "element(s) are suppports."

keys = [key for key, element in assembly.elements()]
open_connectors_keys = [key for key in keys if assembly.element(key).connectors(state='open')]
closed_connectors_keys = [key for key in keys if key not in open_connectors_keys]

#print len(open_connectors_keys), 'open connectors'
#print len(closed_connectors_keys), 'closed connectors'

edges = assembly.network.number_of_edges()
# ---------- end stats ----------
panel_9 = Panel(stats)

# ----
# Assembly visualization
# 1. Visualize assembly.
# 2. Visualize selected element.
# 3. Visuilize built/planned and supports.
show = BooleanToggle(False)
show_2 = BooleanToggle(False)
show_3 = BooleanToggle(True)
show_4 = BooleanToggle(True)
show_5 = BooleanToggle(True)
show_6 = BooleanToggle(False)
show_7 = BooleanToggle(True)
show_8 = BooleanToggle(False)
assembly_viz = PythonScript(
    assembly=initial_assembly.assembly,
    show_assembly=show_6,
    show_built=show_2,
    show_planned=show,
    show_supports=show_3,
    show_selected=show_4,
    show_counter=show_7,
    show_keys_till_selected=show_5,
    show_keys=show_8,
    current_key=counter.counter)  # -> out, G_placed_by_robot, G_placed_by_human, G_built, G_planned, G_elements, G_selected, key_tag_location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; inputs current_key: Int32
# ---------- assembly_viz: Python ----------
import os
import sys
from scriptcontext import sticky as st
import Rhino.Geometry as rg

import math

from compas.artists import Artist
from compas.colors import Color
from compas_ghpython import draw_frame
from compas_rhino.conversions import cylinder_to_rhino, frame_to_rhino

G_elements = []
G_placed_by_robot = []
G_placed_by_human = []

G_selected = []
G_planned = []
G_built = []
flip = 'AA'

key_tag_text = []
key_tag_location= []

# Color coding
color_coding = {'color_close_pairs': Color(1.0, 0., 0.0, 1.0),
                'color_is_planned': Color(1.0, 0.752941176471, 0.0, 1.0), 
                'color_is_support': Color(0.0, 0.0, 1.0, 1.0), 
                'color_has_open_connector': Color(0.494117647059, 1.0, 0.239215686275, 1.0), 
                'color_has_no_open_connectors': Color(0.78431372549, 0.78431372549, 0.78431372549, 1.0), 
                'color_is_built': Color(0.811764705882, 1.0, 0.709803921569, 1.0), 
                'color_is_built_by_robot': Color(0.686274509804, 0.878431372549, 0.862745098039, 1.0), 
                'color_is_built_by_human': Color(0.949019607843, 0.898039215686, 0.0, 1.0)}


def show(element, output_geo, color):
    mesh = Artist(element.mesh).draw(color)
    output_geo.append(mesh)

def show_multiple(elements, output_geo, color):
    for element in elements:
        mesh = Artist(element.mesh).draw(color)
        output_geo.append(mesh)

key_index = assembly.network.key_index()
keys = [key_index[key] for key in assembly.network.nodes()]
elements = [assembly.element(key) for key in keys]

robot_keys = list(assembly.network.nodes_where({'placed_by':'robot'}))
human_keys = list(assembly.network.nodes_where({'placed_by':'human'}))

robot_elements = [assembly.element(key) for key in robot_keys] 
human_elements = [assembly.element(key) for key in human_keys] 

for key, element in assembly.elements():
    if key < 60:
        assembly.network.node_attribute(key, 'is_built', True)
        
all_keys = [key for key, element in assembly.elements()]
planned_keys = list(assembly.network.nodes_where({'is_planned':True, 'is_built':False}))
built_keys = list(assembly.network.nodes_where({'is_built':True}))
support_keys = list(assembly.network.nodes_where({'is_support':True}))


#print 'all_keys', all_keys
print 'planned keys:', planned_keys
print 'built keys:', built_keys
#print 'support keys:', support_keys

all_elements = [assembly.element(key) for key in all_keys]
planned_elements = [assembly.element(key) for key in planned_keys] 
built_elements = [assembly.element(key) for key in built_keys] 
support_elements = [assembly.element(key) for key in support_keys] 
    
if assembly:

#if show_counter and not show_assembly:
#    elements = elements[0:current_key+1]
#    for element in elements[0:current_key+1]:
#        geo = cylinder_to_rhino(element._source)
#        G_elements.append(geo)
        
    radius = assembly.globals['rod_radius']
    
    if current_key != None:
        current_element = assembly.element(current_key)
    else:
        current_element = None
        
    if show_selected: 
        G_selected = cylinder_to_rhino(assembly.element(current_key)._source)
     
    if show_built:
        for element in built_elements:
            G_built.append(cylinder_to_rhino(element._source))
            
    if show_planned:
        for element in planned_elements:
            G_planned.append(cylinder_to_rhino(element._source))

    # Visualize assembly
    if show_assembly:
        for element in robot_elements:
            geo = cylinder_to_rhino(element._source)
            G_placed_by_robot.append(geo)
            
        for element in human_elements:
            geo = cylinder_to_rhino(element._source)
            G_placed_by_human.append(geo)


    selected_elem_plane = draw_frame(assembly.element(current_key).frame)
    
if show_keys:
    for key, element in assembly.elements():
        if show_keys_till_selected and key < current_key+1:
            key_tag_text.append(str(key))
            key_tag_location.append(Artist(element.frame).draw().Origin)
        if not show_keys_till_selected:
            key_tag_text.append(str(key))
            key_tag_location.append(Artist(element.frame).draw().Origin)
    
if show_counter and not show_assembly:
    for element in elements[0:current_key+1]:
        geo = cylinder_to_rhino(element._source)
        G_elements.append(geo)

    
if assembly.network.node_attribute(current_key, 'robot_AA_base_frame') != False and assembly.network.node_attribute(current_key, 'robot_AB_base_frame') != False:
    robot_AA_base_plane = draw_frame(assembly.network.node_attribute(current_key, 'robot_AA_base_frame'))
    robot_AB_base_plane = draw_frame(assembly.network.node_attribute(current_key, 'robot_AB_base_frame'))
    robot_name = assembly.network.node_attribute(current_key, 'robot_name')
# ---------- end assembly_viz ----------
rot = GhPythonScript(plane=assembly_viz.selected_elem_plane, angle=Slider(109, range=0..360))  # -> out, plane
# ---------- rot: Python ----------
import math
from compas.geometry import Frame, Rotation
from compas.artists import Artist

frame = Frame(plane.Origin, plane.XAxis, plane.YAxis)

R = Rotation.from_axis_and_angle(frame.xaxis, math.radians(angle), frame.point)
frame.transform(R)

plane = Artist(frame).draw()
# ---------- end rot ----------
tag = TextTag(Location=assembly_viz.key_tag_location, Text=assembly_viz.key_tag_text)
geo = Geometry(assembly_viz.G_placed_by_human)
geo_2 = Geometry(assembly_viz.G_elements)
geo_3 = Geometry(assembly_viz.G_selected)
pln = Plane(assembly_viz.robot_AB_base_plane)
pln_2 = Plane(assembly_viz.robot_AA_base_plane)
geo_4 = Geometry(assembly_viz.G_placed_by_robot)
geo_5 = Geometry(assembly_viz.G_planned)
geo_6 = Geometry(assembly_viz.G_built)
preview = CustomPreview(Geometry=geo_4, Material=ColourSwatch(SwatchColor=RGB(175, 224, 220)))
preview_2 = CustomPreview(Geometry=geo, Material=ColourSwatch(SwatchColor=RGB(242, 229, 0)))
preview_3 = CustomPreview(Geometry=geo_6, Material=ColourSwatch(SwatchColor=RGB(255, 170, 0)))
preview_4 = CustomPreview(Geometry=geo_5, Material=ColourSwatch(SwatchColor=RGBA(199, 199, 199, 89)))
preview_5 = CustomPreview(Geometry=geo_2, Material=ColourSwatch(SwatchColor=RGB(199, 175, 131)))
preview_6 = CustomPreview(Geometry=geo_3, Material=ColourSwatch(SwatchColor=RGB(0, 0, 255)))

show_9 = BooleanToggle(True)

# ----
# Assembly visualization
# 1. Visualize assembly.
# 2. Visualize selected element.
# 3. Visuilize built/planned and supports.
show_10 = BooleanToggle(False)
show_11 = BooleanToggle(True)
show_12 = BooleanToggle(True)
show_13 = BooleanToggle(True)
show_14 = BooleanToggle(True)
show_15 = BooleanToggle(True)
assembly_viz_2 = PythonScript(
    assembly=initial_assembly.assembly,
    show_assembly=show_10,
    show_counter=show_9,
    show_planned=show_12,
    show_built=show_13,
    show_supports=show_11,
    show_selected=show_14,
    show_keys=show_15,
    current_key=counter.counter)  # -> out, G_planned, G_built, G_supports, G_selected, key_tag_location, key_tag_text, robot_base_plane, selected_elem_plane; inputs current_key: Int32
# ---------- assembly_viz_2: Python ----------
import os
import sys
from scriptcontext import sticky as st
import Rhino.Geometry as rg

import math

from compas.artists import Artist
from compas.colors import Color
from compas_ghpython import draw_frame

G_selected = []
G_planned = []
G_built = []
G_supports = []


key_tag_text = []
key_tag_location= []

# Color coding
color_coding = {'color_close_pairs': Color(1.0, 0., 0.0, 1.0),
                'color_is_planned': Color(1.0, 0.752941176471, 0.0, 1.0), 
                'color_is_support': Color(0.0, 0.0, 1.0, 1.0), 
                'color_has_open_connector': Color(0.494117647059, 1.0, 0.239215686275, 1.0), 
                'color_has_no_open_connectors': Color(0.78431372549, 0.78431372549, 0.78431372549, 1.0), 
                'color_is_built': Color(0.811764705882, 1.0, 0.709803921569, 1.0), 
                'color_is_built_by_robot': Color(0.686274509804, 0.878431372549, 0.862745098039, 1.0), 
                'color_is_built_by_human': Color(0.949019607843, 0.898039215686, 0.0, 1.0)}


def show(element, output_geo, color):
    mesh = Artist(element.mesh).draw(color)
    output_geo.append(mesh)

def show_multiple(elements, output_geo, color):
    for element in elements:
        mesh = Artist(element.mesh).draw(color)
        output_geo.append(mesh)

radius = assembly.globals['rod_radius']

if current_key != None:
    current_element = assembly.element(current_key)
else:
    current_element = None
    
if show_selected: 
    G_selected = Artist(assembly.element(current_key).mesh).draw(color_coding['color_is_support'])

all_keys = [key for key, element in assembly.elements()]
planned_keys = list(assembly.network.nodes_where({'is_planned':True}))
built_keys = list(assembly.network.nodes_where({'is_built':True}))
support_keys = list(assembly.network.nodes_where({'is_support':True}))

print 'all_keys', all_keys
print 'planned keys:', planned_keys
print 'built keys:', built_keys
print 'support keys:', support_keys

all_elements = [assembly.element(key) for key in all_keys]
planned_elements = [assembly.element(key) for key in planned_keys] 
built_elements = [assembly.element(key) for key in built_keys] 
support_elements = [assembly.element(key) for key in support_keys] 
    
    
if show_counter and not show_assembly:
    # Visualize till counter
    for element in all_elements[:current_key]:
        mesh = Artist(element.mesh).draw(color_coding['color_has_no_open_connectors'])
        G_planned.append(mesh)


if show_assembly and not show_counter:
    # Visualize assembly
    if show_assembly and show_planned:
        for element in planned_elements:
            mesh = Artist(element.mesh).draw(color_coding['color_is_planned'])
            G_planned.append(mesh)
    if show_assembly and show_built:
        for element in built_elements:
            mesh = Artist(element.mesh).draw(color_coding['color_is_built'])
            G_built.append(mesh)
    if show_assembly and show_supports:
        for element in support_elements:
            mesh = Artist(element.mesh).draw(color_coding['color_is_support'])
            G_supports.append(mesh)

if show_keys:
    for key, element in assembly.elements():
        key_tag_text.append(str(key))
        key_tag_location.append(Artist(element.frame).draw().Origin)

selected_elem_plane = draw_frame(assembly.element(current_key).frame)
#if assembly.network.node_attribute(current_key, 'robot_frame') != False:
#    robot_base_plane = draw_frame(assembly.network.node_attribute(current_key, 'robot_frame'))
# ---------- end assembly_viz_2 ----------
rot_2 = GhPythonScript(plane=assembly_viz_2.selected_elem_plane, angle=Slider(0, range=0..360))  # -> out, plane; same code as rot
mesh = Mesh(assembly_viz_2.G_planned)
mesh_2 = Mesh(assembly_viz_2.G_built)
mesh_3 = Mesh(assembly_viz_2.G_supports)
mesh_4 = Mesh(assembly_viz_2.G_selected)
tag_2 = TextTag(Location=assembly_viz_2.key_tag_location, Text=assembly_viz_2.key_tag_text)

# ----
# Network visualization
number_slider = Slider(0, range=0..47)
show_16 = BooleanToggle(False)
network_viz = GhPythonScript(assembly=initial_assembly.assembly, show_network=show_16, key=number_slider)  # -> out, nodes, edges, current_node, current_node_neighbors; inputs key: Int32
# ---------- network_viz: Python ----------
import sys, os
import ghpythonlib.components as ghcomp
from compas.datastructures import Network
from compas_ghpython.artists import NetworkArtist
from compas_rhino.geometry import RhinoLine

import compas_ghpython
import Rhino.Geometry as rg


data = assembly.network.to_data()
network = Network.from_data(data)

print assembly.network.number_of_nodes()

def draw_network(network):
    """Draw a network in Grasshopper.
    """
    points = []
    for key, attr in network.nodes(True):
        points.append({
            'pos': network.node_coordinates(key),
        })

    lines = []
    for (u, v), attr in network.edges(True):
        lines.append({
            'start': network.node_coordinates(u),
            'end': network.node_coordinates(v),
        })

    points_rg = compas_ghpython.draw_points(points)
    lines_rg = compas_ghpython.draw_lines(lines)

    return points_rg, lines_rg

if show_network:
    nodes, edges = draw_network(network)
    
    current_node = {'pos': network.node_coordinates(key), 'radius': 0.03}
    current_node = compas_ghpython.draw_spheres([current_node])
    
    current_node_neighbors_keys = network.neighbors(key)
    current_node_neighbors = [{'pos': network.node_coordinates(key), 'radius': 0.02} for key in current_node_neighbors_keys]
    current_node_neighbors = compas_ghpython.draw_spheres(current_node_neighbors)
# ---------- end network_viz ----------
pt = Point(network_viz.nodes)
line = Line(network_viz.edges)
brep = Brep(network_viz.current_node)
brep_2 = Brep(network_viz.current_node_neighbors)
preview_7 = CustomPreview(Geometry=brep_2, Material=ColourSwatch(SwatchColor=RGB(255, 207, 207)))
preview_8 = CustomPreview(Geometry=[brep, line], Material=ColourSwatch(SwatchColor=RGB(0, 0, 0)))

# ----
# Export .json
export = Button()
export_2 = Button()
export_3 = PythonScript(DATA=py.DATA, assembly=initial_assembly.assembly, export_to_json=export, export_to_json_unity=export_2)
# ---------- export_3: Python ----------
import os
from compas.datastructures.mesh import mesh_quads_to_triangles
from compas.datastructures.mesh import mesh_unify_cycles

if export_to_json:
    filename = "assembly_example_02.json"
    PATH = os.path.join(DATA, "assembly", filename)
    
    # the assembly has to be serialized such that it can be called from CPython, True to enable pretty print
    assembly.to_json(PATH, True)
    

if export_to_json_unity:
    
    for key, e in assembly.elements():
    
        #convert to trimesh
        mesh_quads_to_triangles(e._mesh, check_angles=False)
        #mesh_unify_cycles(e._mesh)
        #print e._mesh.faces
        #print e._mesh.face_vertices(list(e._mesh.faces())[0])

    filename = "unity_assembly_test.json"
    PATH = os.path.join(DATA, "assembly", filename)
    assembly.to_json(PATH)
# ---------- end export_3 ----------

# ---- group: capture
viewport_name = Text("workflow_2")
capture_to_bitmap = PythonScript(DATA=py.DATA, capture=Button(), viewport_name=viewport_name, idx=Slider(2, range=0..10))  # -> out, a; inputs capture: Boolean, idx: Int32
# ---------- capture_to_bitmap: Python ----------
import Rhino
import System.Drawing
from scriptcontext import sticky as st

import sys, os
import ghpythonlib.components as ghcomp
import Grasshopper as gh
import datetime


ghComp = ghenv.Component
ghDoc = ghComp.OnPingDocument()

def rCommonCap(filePath, viewportName,scaleFactor):
    RhinoDocument = Rhino.RhinoDoc.ActiveDoc
    view = RhinoDocument.Views.Find(viewportName, False)
    vp = view.ActiveViewport
    size = System.Drawing.Size(vp.Size.Width*scaleFactor,vp.Size.Height*scaleFactor)
    capture = view.CaptureToBitmap(size)
    capture.Save(filePath);


export_dir = os.path.join(DATA, 'parameter_studies')
if not os.path.isdir(export_dir): os.mkdir(export_dir)
print export_dir
filename = os.path.join(export_dir, 'capture_' + str(idx) + '.png') 
print filename

zoom = 1

if capture:
    rCommonCap(filename, viewport_name, zoom)
# ---------- end capture_to_bitmap ----------

# ----
la_limit = Slider(0.5, range=0..1)

# ----
# Screen Feedback
status = BooleanToggle(True)
feedback_to_screen = GhPythonScript(STATUS=status, assembly=initial_assembly.assembly, current_key=counter.counter, default_size=Slider(20, range=0..50))  # -> out, text, location, size, color; inputs current_key: Int32
# ---------- feedback_to_screen: Python ----------
feedback_text = {
                'text': [],
                'location': [],
                'size': default_size,
                'color': []
                }

y0 = 100
x0 = 50
offset = default_size*0.5
x_curr = x0
y_curr = y0
x_curr_2col = x0 + 15*default_size
y_curr_2col = y0

color_red = '180,0,0'
color_yellow = '186,105,0'
color_green = '44,138,0'
color_black = '0,0,0'

status_colors = {'FREE': color_green, 'Place': color_yellow, 'Stabilizing': color_yellow}

def add_text_line(text, value, x, y, color='0,0,0'):
    global x_curr,y_curr
    feedback_text['text'].append(text.format(value))
    feedback_text['location'].append('{}, {}, 0'.format(x,y))
    feedback_text['color'].append(color)
    
    if y is y_curr:
        y_curr += default_size
        y_curr += offset



# ----------- Attribiutes --------------- 
assembly.network.node_attribute(current_key, 'placed_by')

add_text_line('Element key: {}', current_key, x_curr,y_curr)
y_curr += offset
add_text_line('is_support : {}', assembly.network.node_attribute(current_key, 'is_support'), x_curr,y_curr)
add_text_line('placed_by : {}', assembly.network.node_attribute(current_key, 'placed_by'), x_curr,y_curr)
add_text_line('key_held_by_robot : {}', assembly.network.node_attribute(current_key, 'key_held_by_robot'), x_curr,y_curr)
add_text_line('stabilizing_robot : {}', assembly.network.node_attribute(current_key, 'stabilizing_robot'), x_curr,y_curr)


# ----------- PRINT --------------- 
if STATUS:
    text = feedback_text['text']
    location = feedback_text['location']
    size = feedback_text['size']
    color = feedback_text['color']
else:
    text = []
    location = []
    size = []
    color = []
# ---------- end feedback_to_screen ----------
panel_10 = Panel(feedback_to_screen.text)
texttoscreen = RenderTextToScreen(
    Text=feedback_to_screen.text,
    Location=feedback_to_screen.location,
    Size=feedback_to_screen.size,
    Color=feedback_to_screen.color,
    Font="Roboto",
    m_scWithvp=False)

# ----
# Stability calculation
stability_feedback = BooleanToggle(True)
stability_viz = GhPythonScript(assembly=initial_assembly.assembly, la_limit=la_limit, show_resultant=stability_feedback)  # -> out, stability_feedback, resultant, resultant_colors, sp_branches, sp_planar_branches, resultant_pt, la_text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; inputs current_key: Int32, selected_keys_pair: list
# ---------- stability_viz: Python ----------
from compas.topology import connected_components
import Rhino.Geometry as rg

import copy

#############################################################################
## LOCAL EQUILIBRIUM CHECK
#############################################################################

lever_arm_branches = []
resultant_branches = []
resultant = []
print current_key

elem_options = None

branches = connected_components(assembly.network.adjacency)

lever_arm_branches, resultant_branches, sp_branches, sp_planar_branches, stability_feedback, key_held_by_robot, stabilising_robot  = assembly.calculate_local_equilibrium_in_all_branches(current_key, elem_options, la_limit)

"""if assembly.stability_check == 'local':
    
    if selected_mode == '(1) Manual' or selected_mode == '(2) Automatic':
        # Identify the connected elements (branches) in the assembly.
        branches = connected_components(assembly.network.adjacency)
        sel_key = current_key
    
    if selected_mode == '(3) Join branches':
        #selected_keys_pair = assembly.selected_keys_pair
        print selected_keys_pair
        if selected_keys_pair != [None]:
        # Identify the connected elements (branches) in the assembly.
            adj = copy.deepcopy(assembly.network.adjacency)
            adj[selected_keys_pair[0]].update({selected_keys_pair[1]: None})
            adj[selected_keys_pair[1]].update({selected_keys_pair[0]: None})
            
            branches = connected_components(adj)
            sel_key = selected_keys_pair[0]
        else:
            branches = connected_components(assembly.network.adjacency)
            sel_key = current_key
    
    print(branches)
    
    stability_feedback = []
    
    # calculate stability for all branches

    lever_arm_branches, resultant_branches, sp_branches, sp_planar_branches, stability_feedback, key_held_by_robot, stabilising_robot  = assembly.calculate_local_equilibrium_in_all_branches(sel_key, elem_options, la_limit, branches)

    print key_held_by_robot, stabilising_robot
else:
    stability_feedback = "No stability criteria selected."""
    
#print lever_arm_branches
#print resultant_branches
print sp_planar_branches
resultant_pt = []
resultant_colors = []
print current_key

if show_resultant:
    
    la_text = []
    for resultant_line, lever_arm in zip(resultant_branches, lever_arm_branches):
        cone_base_plane = rg.Plane(resultant_line.PointAt(0), rg.Vector3d.ZAxis*-1)
        #cone_base_plane.Translate(rg.Vector3d.ZAxis*0.136)
        if lever_arm != 0:
            resultant.append(rg.Circle(cone_base_plane,lever_arm))
            la_text.append('la= {len:.3f}m'.format(len=float(lever_arm)))
        else:
            resultant.append(rg.Circle(cone_base_plane,0.01))
            la_text.append('')
        
        resultant_pt.append(cone_base_plane)
        
        if lever_arm > la_limit:
            resultant_colors.append('255,13,0 (103)')
        else:
            resultant_colors.append('70,128,0 (103)')
# ---------- end stability_viz ----------
srf = Surface(stability_viz.resultant)
pt_2 = Point(stability_viz.resultant_pt)
preview_9 = CustomPreview(Geometry=srf, Material=stability_viz.resultant_colors)
preview_10 = CustomPreview(Geometry=stability_viz.sp_planar_branches, Material=stability_viz.resultant_colors)
dots = DotDisplay(Point=stability_viz.sp_branches, Colour=ColourSwatch(SwatchColor=RGB(0, 0, 255)), Size=0.03)
dots_2 = DotDisplay(Point=pt_2, Colour=stability_viz.resultant_colors, Size=0.01)
tag_3 = TextTag(Location=stability_viz.resultant_pt, Text=stability_viz.la_text, Colour=RGB(84, 84, 84))
