# Grasshopper definition ex9_assembly_sequence.ghx (Grasshopper 1.0.7)

# ----
# Color Coding
colour_swatch = ColourSwatch(SwatchColor=RGB(255, 192, 0))
color_coding = GhPythonScript(
    is_planned=colour_swatch,
    is_built=ColourSwatch(SwatchColor=RGB(207, 255, 181)),
    is_support=ColourSwatch(SwatchColor=RGB(0, 0, 255)),
    has_open_connector=ColourSwatch(SwatchColor=RGB(126, 255, 61)),
    has_no_open_connectors=ColourSwatch(SwatchColor=RGB(200, 200, 200)),
    is_built_by_robot=ColourSwatch(SwatchColor=RGB(175, 224, 220)),
    is_built_by_human=ColourSwatch(SwatchColor=RGB(242, 229, 0)))  # -> out, color_coding
# ---------- color_coding: Python ----------
import rhinoscriptsyntax as rs
from compas.colors import Color


color_is_planned = Color(is_planned.R/255 , is_planned.G/255, is_planned.B/255)
color_is_built = Color(is_built.R/255 , is_built.G/255, is_built.B/255)
color_is_support = Color(is_support.R/255 , is_support.G/255, is_support.B/255)
color_has_open_connector = Color(has_open_connector.R/255 , has_open_connector.G/255,has_open_connector.B/255)
color_has_no_open_connectors = Color(has_no_open_connectors.R/255 , has_no_open_connectors.G/255, has_no_open_connectors.B/255)
color_is_built_by_robot = Color(is_built_by_robot.R/255 , is_built_by_robot.G/255, is_built_by_robot.B/255)
color_is_built_by_human = Color(is_built_by_human.R/255 , is_built_by_human.G/255, is_built_by_human.B/255)

color_coding = {'color_is_planned':color_is_planned, 'color_is_built':color_is_built, 'color_is_support':color_is_support, 'color_has_open_connector':color_has_open_connector, 'color_has_no_open_connectors':color_has_no_open_connectors, 'color_is_built_by_robot':color_is_built_by_robot, 'color_is_built_by_human':color_is_built_by_human}

print color_coding
# ---------- end color_coding ----------
panel = Panel(color_coding.out)

py = PythonScript()  # -> ENVIRONMENT_NAME, HERE, DATA
# ---------- py: Python ----------
import os
import compas_bootstrapper

HERE = os.path.dirname(ghdoc.Path)
DATA = os.path.abspath(os.path.join(HERE, "..", "data"))
ENVIRONMENT_NAME = compas_bootstrapper.ENVIRONMENT_NAME
print(HERE)
print(DATA)
print(ENVIRONMENT_NAME)
# ---------- end py ----------

panel_2 = Panel("Unload libraries")
bang = Button()
unload = PythonScript(bang=bang)
# ---------- unload: Python ----------
from compas_rhino.utilities.misc import get_tolerance
from compas_rhino.utilities.misc import unload_modules

unload_modules("cdf_2023")
unload_modules("mobile_robot_control")
# ---------- end unload ----------

panel_3 = Panel("trunk_1_assembly.json")

# ----
# Load assembly model
# Import assembly from .json.
import = Button(ExpressionNormal="True", ExpressionPressed="False")
initial_assembly = GhPythonScript(DATA=py.DATA, filename="2023_07_28_11_43_FINAL_200_assembly.json", import_from_json=import)  # -> out, assembly; inputs import_from_json: Boolean
# ---------- initial_assembly: Python ----------
import os
import json
from scriptcontext import sticky

from cdf_2023.assembly import Assembly

if import_from_json:
    PATH = os.path.join(DATA, "assembly", filename)
    assembly = Assembly.from_json(PATH)
    assembly.support_keys = []

# create a dictionary to store global value in 
assembly.globals = {}

# define global values
assembly.globals['rod_radius'] = 0.011
assembly.globals['rod_length'] = 0.6
assembly.globals['rf_unit_offset'] = 0.2
assembly.globals['rf_unit_radius'] = 0.15
# ---------- end initial_assembly ----------

panel_4 = Panel(py.ENVIRONMENT_NAME)

key = Slider(16, range=0..388)
till_key = Button()
reset = Button()
start = Button()
stop = Button()
step = Button()
full = Button()
list = ValueList({"20", "50", "100", "500", "1000", "5000"}, selected="50")

back = Button()
counter = CountThroughList(
    assembly=initial_assembly.assembly,
    start=start,
    stop=stop,
    step=step,
    step_back=back,
    reset=reset,
    full=full,
    till_key=till_key,
    key=key,
    interval=list)  # -> item, counter; inputs start: Boolean, stop: Boolean, step_back: Boolean, key: Int32
# ---------- counter: Python ----------
from scriptcontext import sticky as st
from compas_ghpython import update_component


L = list(assembly.elements())
# store data in component
guid = str(ghenv.Component.InstanceGuid)
counter_key = "counter_" + guid
running_key = "running_" + guid

if counter_key not in st:
    st[counter_key] = 0

if running_key not in st:
    st[running_key] = False
    

if st[running_key]:
    if st[counter_key] < len(L) - 1:
        st[counter_key] += 1
        update_component(ghenv, interval)
    else:
        st[counter_key] = 0
        st[running_key] = False
    
    
if start:
    st[running_key] = True

if stop:
    st[running_key] = False

if step:
    if st[counter_key] < len(L) - 1:
        st[counter_key] += 1

if step_back:
    if st[counter_key] < len(L):
        st[counter_key] -= 1

if reset:
    st[counter_key] = 0

if till_key:
    st[counter_key] = key

if full:
    st[counter_key] = len(L)-1

if len(L):
    item = L[st[counter_key]]



#st["visualisation_counter"] = st[counter_key]
#st[counter_key]= 500
counter = st[counter_key]
# ---------- end counter ----------

counter_2 = Panel(counter.counter)

stats = GhPythonScript(assembly=initial_assembly.assembly)  # -> out
# ---------- stats: Python ----------
total_elements = assembly.network.number_of_nodes()
planned_keys = list(assembly.network.nodes_where({'is_planned':True}))
built_keys = list(assembly.network.nodes_where({'is_built':True}))
support_keys = list(assembly.network.nodes_where({'is_support':True}))

print total_elements, "element(s) in assembly."
print len(built_keys), "element(s) are already built."
print len(planned_keys), "element(s) are planned."
print len(support_keys), "element(s) are suppports."

keys = [key for key, element in assembly.elements()]
open_connectors_keys = [key for key in keys if assembly.element(key).connectors(state='open')]
closed_connectors_keys = [key for key in keys if key not in open_connectors_keys]

#print len(open_connectors_keys), 'open connectors'
#print len(closed_connectors_keys), 'closed connectors'

edges = assembly.network.number_of_edges()
# ---------- end stats ----------
panel_5 = Panel(stats)

show = BooleanToggle(True)
show_2 = BooleanToggle(False)
show_3 = BooleanToggle(False)
show_4 = BooleanToggle(False)

# ----
# Assembly visualization
# 1. Visualize assembly.
# 2. Visualize selected element.
# 3. Visuilize built/planned and supports.
show_5 = BooleanToggle(False)
show_6 = BooleanToggle(True)
show_7 = BooleanToggle(True)
show_8 = BooleanToggle(True)
show_9 = BooleanToggle(True)
show_10 = BooleanToggle(True)
assembly_viz = PythonScript(
    assembly=initial_assembly.assembly,
    show_assembly=show_5,
    show_counter=show_4,
    show_planned=show_7,
    show_built=show_8,
    show_supports=show_6,
    show_selected=show_9,
    show_keys=show_10,
    current_key=counter.counter)  # -> out, G_planned, G_built, G_supports, G_selected, key_tag_location, key_tag_text, robot_base_plane, selected_elem_plane; inputs current_key: Int32
# ---------- assembly_viz: Python ----------
import os
import sys
from scriptcontext import sticky as st
import Rhino.Geometry as rg

import math

from compas.artists import Artist
from compas.colors import Color
from compas_ghpython import draw_frame

G_selected = []
G_planned = []
G_built = []
G_supports = []

flip = 'AA'

key_tag_text = []
key_tag_location= []

# Color coding
color_coding = {'color_close_pairs': Color(1.0, 0., 0.0, 1.0),
                'color_is_planned': Color(1.0, 0.752941176471, 0.0, 1.0), 
                'color_is_support': Color(0.0, 0.0, 1.0, 1.0), 
                'color_has_open_connector': Color(0.494117647059, 1.0, 0.239215686275, 1.0), 
                'color_has_no_open_connectors': Color(0.78431372549, 0.78431372549, 0.78431372549, 1.0), 
                'color_is_built': Color(0.811764705882, 1.0, 0.709803921569, 1.0), 
                'color_is_built_by_robot': Color(0.686274509804, 0.878431372549, 0.862745098039, 1.0), 
                'color_is_built_by_human': Color(0.949019607843, 0.898039215686, 0.0, 1.0)}


def show(element, output_geo, color):
    mesh = Artist(element.mesh).draw(color)
    output_geo.append(mesh)

def show_multiple(elements, output_geo, color):
    for element in elements:
        mesh = Artist(element.mesh).draw(color)
        output_geo.append(mesh)

radius = assembly.globals['rod_radius']

if current_key != None:
    current_element = assembly.element(current_key)
else:
    current_element = None
    
if show_selected: 
    G_selected = Artist(assembly.element(current_key).mesh).draw(color_coding['color_is_support'])

all_keys = [key for key, element in assembly.elements()]
planned_keys = list(assembly.network.nodes_where({'is_planned':True}))
built_keys = list(assembly.network.nodes_where({'is_built':True}))
support_keys = list(assembly.network.nodes_where({'is_support':True}))

print 'all_keys', all_keys
print 'planned keys:', planned_keys
print 'built keys:', built_keys
print 'support keys:', support_keys

all_elements = [assembly.element(key) for key in all_keys]
planned_elements = [assembly.element(key) for key in planned_keys] 
built_elements = [assembly.element(key) for key in built_keys] 
support_elements = [assembly.element(key) for key in support_keys] 
    
    
if show_counter and not show_assembly:
    # Visualize till counter
    for element in all_elements[:current_key]:
        mesh = Artist(element.mesh).draw(color_coding['color_has_no_open_connectors'])
        G_planned.append(mesh)


if show_assembly and not show_counter:
    # Visualize assembly
    if show_assembly and show_planned:
        for element in planned_elements:
            mesh = Artist(element.mesh).draw(color_coding['color_is_planned'])
            G_planned.append(mesh)
    if show_assembly and show_built:
        for element in built_elements:
            mesh = Artist(element.mesh).draw(color_coding['color_is_built'])
            G_built.append(mesh)
    if show_assembly and show_supports:
        for element in support_elements:
            mesh = Artist(element.mesh).draw(color_coding['color_is_support'])
            G_supports.append(mesh)

if show_keys:
    for key, element in assembly.elements():
        key_tag_text.append(str(key))
        key_tag_location.append(Artist(element.frame).draw().Origin)

selected_elem_plane = draw_frame(assembly.element(current_key).frame)
if assembly.network.node_attribute(current_key, 'robot_frame') != False:
    robot_base_plane = draw_frame(assembly.network.node_attribute(current_key, 'robot_frame'))
# ---------- end assembly_viz ----------
rot = GhPythonScript(plane=assembly_viz.selected_elem_plane, angle=Slider(0, range=0..360))  # -> out, plane
# ---------- rot: Python ----------
import math
from compas.geometry import Frame, Rotation
from compas.artists import Artist

frame = Frame(plane.Origin, plane.XAxis, plane.YAxis)

R = Rotation.from_axis_and_angle(frame.xaxis, math.radians(angle), frame.point)
frame.transform(R)

plane = Artist(frame).draw()
# ---------- end rot ----------
mesh = Mesh(assembly_viz.G_built)
mesh_2 = Mesh(assembly_viz.G_selected)
mesh_3 = Mesh(assembly_viz.G_planned)
mesh_4 = Mesh(assembly_viz.G_supports)
tag = TextTag(Location=assembly_viz.key_tag_location, Text=assembly_viz.key_tag_text)

colour_swatch_2 = ColourSwatch(SwatchColor=RGB(255, 235, 199))

# ---- group: capture
viewport_name = Text("workflow_2")
capture_to_bitmap = PythonScript(DATA=py.DATA, capture=Button(), viewport_name=viewport_name, idx=Slider(2, range=0..10))  # -> out, a; inputs capture: Boolean, idx: Int32
# ---------- capture_to_bitmap: Python ----------
import Rhino
import System.Drawing
from scriptcontext import sticky as st

import sys, os
import ghpythonlib.components as ghcomp
import Grasshopper as gh
import datetime


ghComp = ghenv.Component
ghDoc = ghComp.OnPingDocument()

def rCommonCap(filePath, viewportName,scaleFactor):
    RhinoDocument = Rhino.RhinoDoc.ActiveDoc
    view = RhinoDocument.Views.Find(viewportName, False)
    vp = view.ActiveViewport
    size = System.Drawing.Size(vp.Size.Width*scaleFactor,vp.Size.Height*scaleFactor)
    capture = view.CaptureToBitmap(size)
    capture.Save(filePath);


export_dir = os.path.join(DATA, 'parameter_studies')
if not os.path.isdir(export_dir): os.mkdir(export_dir)
print export_dir
filename = os.path.join(export_dir, 'capture_' + str(idx) + '.png') 
print filename

zoom = 1

if capture:
    rCommonCap(filename, viewport_name, zoom)
# ---------- end capture_to_bitmap ----------

# ----
# Network visualization
number_slider = Slider(0, range=0..47)
show_11 = BooleanToggle(False)
network_viz = GhPythonScript(assembly=initial_assembly.assembly, show_network=show_11, key=number_slider)  # -> out, nodes, edges, current_node, current_node_neighbors; inputs key: Int32
# ---------- network_viz: Python ----------
import sys, os
import ghpythonlib.components as ghcomp
from compas.datastructures import Network
from compas_ghpython.artists import NetworkArtist
from compas_rhino.geometry import RhinoLine

import compas_ghpython
import Rhino.Geometry as rg


data = assembly.network.to_data()
network = Network.from_data(data)

print assembly.network.number_of_nodes()

def draw_network(network):
    """Draw a network in Grasshopper.
    """
    points = []
    for key, attr in network.nodes(True):
        points.append({
            'pos': network.node_coordinates(key),
        })

    lines = []
    for (u, v), attr in network.edges(True):
        lines.append({
            'start': network.node_coordinates(u),
            'end': network.node_coordinates(v),
        })

    points_rg = compas_ghpython.draw_points(points)
    lines_rg = compas_ghpython.draw_lines(lines)

    return points_rg, lines_rg

if show_network:
    nodes, edges = draw_network(network)
    
    current_node = {'pos': network.node_coordinates(key), 'radius': 0.03}
    current_node = compas_ghpython.draw_spheres([current_node])
    
    current_node_neighbors_keys = network.neighbors(key)
    current_node_neighbors = [{'pos': network.node_coordinates(key), 'radius': 0.02} for key in current_node_neighbors_keys]
    current_node_neighbors = compas_ghpython.draw_spheres(current_node_neighbors)
# ---------- end network_viz ----------
pt = Point(network_viz.nodes)
line = Line(network_viz.edges)
brep = Brep(network_viz.current_node)
brep_2 = Brep(network_viz.current_node_neighbors)
preview = CustomPreview(Geometry=brep_2, Material=ColourSwatch(SwatchColor=RGB(255, 207, 207)))
preview_2 = CustomPreview(Geometry=[brep, line], Material=ColourSwatch(SwatchColor=RGB(0, 0, 0)))

# ----
# Export .json
export = Button()
export_2 = Button()
export_3 = PythonScript(DATA=py.DATA, assembly=initial_assembly.assembly, export_to_json=export, export_to_json_unity=export_2)
# ---------- export_3: Python ----------
import os
from compas.datastructures.mesh import mesh_quads_to_triangles
from compas.datastructures.mesh import mesh_unify_cycles

if export_to_json:
    filename = "assembly_example_02.json"
    PATH = os.path.join(DATA, "assembly", filename)
    
    # the assembly has to be serialized such that it can be called from CPython, True to enable pretty print
    assembly.to_json(PATH, True)
    

if export_to_json_unity:
    
    for key, e in assembly.elements():
    
        #convert to trimesh
        mesh_quads_to_triangles(e._mesh, check_angles=False)
        #mesh_unify_cycles(e._mesh)
        #print e._mesh.faces
        #print e._mesh.face_vertices(list(e._mesh.faces())[0])

    filename = "unity_assembly_test.json"
    PATH = os.path.join(DATA, "assembly", filename)
    assembly.to_json(PATH)
# ---------- end export_3 ----------

# ----
# Assembly visualization
# 1. Visualize assembly.
# 2. Visualize selected element.
# 3. Visuilize built/planned and supports.
show_12 = BooleanToggle(False)
show_13 = BooleanToggle(False)
show_14 = BooleanToggle(False)
show_15 = BooleanToggle(True)
show_16 = BooleanToggle(True)
number_slider_2 = Slider(109, range=0..360)  # disabled
assembly_viz_2 = PythonScript(
    assembly=initial_assembly.assembly,
    show_assembly=show_14,
    show_built=show_15,
    show_planned=show,
    show_supports=show_12,
    show_selected=show_13,
    show_counter=show_2,
    show_keys_till_selected=show_3,
    show_keys=show_16,
    current_key=counter.counter)  # -> out, G_placed_by_robot, G_placed_by_human, G_built, G_planned, G_elements, G_selected, key_tag_location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; inputs current_key: Int32
# ---------- assembly_viz_2: Python ----------
import os
import sys
from scriptcontext import sticky as st
import Rhino.Geometry as rg

import math

from compas.artists import Artist
from compas.colors import Color
from compas_ghpython import draw_frame
from compas_rhino.conversions import cylinder_to_rhino, frame_to_rhino

G_elements = []
G_placed_by_robot = []
G_placed_by_human = []

G_selected = []
G_planned = []
G_built = []
flip = 'AA'

key_tag_text = []
key_tag_location= []

# Color coding
color_coding = {'color_close_pairs': Color(1.0, 0., 0.0, 1.0),
                'color_is_planned': Color(1.0, 0.752941176471, 0.0, 1.0), 
                'color_is_support': Color(0.0, 0.0, 1.0, 1.0), 
                'color_has_open_connector': Color(0.494117647059, 1.0, 0.239215686275, 1.0), 
                'color_has_no_open_connectors': Color(0.78431372549, 0.78431372549, 0.78431372549, 1.0), 
                'color_is_built': Color(0.811764705882, 1.0, 0.709803921569, 1.0), 
                'color_is_built_by_robot': Color(0.686274509804, 0.878431372549, 0.862745098039, 1.0), 
                'color_is_built_by_human': Color(0.949019607843, 0.898039215686, 0.0, 1.0)}


def show(element, output_geo, color):
    mesh = Artist(element.mesh).draw(color)
    output_geo.append(mesh)

def show_multiple(elements, output_geo, color):
    for element in elements:
        mesh = Artist(element.mesh).draw(color)
        output_geo.append(mesh)

key_index = assembly.network.key_index()
keys = [key_index[key] for key in assembly.network.nodes()]
elements = [assembly.element(key) for key in keys]

robot_keys = list(assembly.network.nodes_where({'placed_by':'robot'}))
human_keys = list(assembly.network.nodes_where({'placed_by':'human'}))

robot_elements = [assembly.element(key) for key in robot_keys] 
human_elements = [assembly.element(key) for key in human_keys] 

for key, element in assembly.elements():
    if key < 60:
        assembly.network.node_attribute(key, 'is_built', True)
        
all_keys = [key for key, element in assembly.elements()]
planned_keys = list(assembly.network.nodes_where({'is_planned':True, 'is_built':False}))
built_keys = list(assembly.network.nodes_where({'is_built':True}))
support_keys = list(assembly.network.nodes_where({'is_support':True}))


#print 'all_keys', all_keys
print 'planned keys:', planned_keys
print 'built keys:', built_keys
#print 'support keys:', support_keys

all_elements = [assembly.element(key) for key in all_keys]
planned_elements = [assembly.element(key) for key in planned_keys] 
built_elements = [assembly.element(key) for key in built_keys] 
support_elements = [assembly.element(key) for key in support_keys] 
    
if assembly:
    radius = assembly.globals['rod_radius']
    
    if current_key != None:
        current_element = assembly.element(current_key)
    else:
        current_element = None
        
    if show_selected: 
        G_selected = cylinder_to_rhino(assembly.element(current_key)._source)
     
    if show_built:
        for element in built_elements:
            G_built.append(cylinder_to_rhino(element._source))
            
    if show_planned:
        for element in planned_elements:
            G_planned.append(cylinder_to_rhino(element._source))

    # Visualize assembly
    if show_assembly:
        for element in robot_elements:
            geo = cylinder_to_rhino(element._source)
            G_placed_by_robot.append(geo)
            
        for element in human_elements:
            geo = cylinder_to_rhino(element._source)
            G_placed_by_human.append(geo)


    selected_elem_plane = draw_frame(assembly.element(current_key).frame)
    
if show_keys:
    for key, element in assembly.elements():
        if show_keys_till_selected and key < current_key+1:
            key_tag_text.append(str(key))
            key_tag_location.append(Artist(element.frame).draw().Origin)
        if not show_keys_till_selected:
            key_tag_text.append(str(key))
            key_tag_location.append(Artist(element.frame).draw().Origin)
    
if show_counter and not show_assembly:
    for element in elements[0:current_key+1]:
        geo = cylinder_to_rhino(element._source)
        G_elements.append(geo)
        
        
    
if assembly.network.node_attribute(current_key, 'robot_AA_base_frame') != False and assembly.network.node_attribute(current_key, 'robot_AB_base_frame') != False:
    robot_AA_base_plane = draw_frame(assembly.network.node_attribute(current_key, 'robot_AA_base_frame'))
    robot_AB_base_plane = draw_frame(assembly.network.node_attribute(current_key, 'robot_AB_base_frame'))
    robot_name = assembly.network.node_attribute(current_key, 'robot_name')
# ---------- end assembly_viz_2 ----------
rot_2 = GhPythonScript(plane=assembly_viz_2.selected_elem_plane, angle=number_slider_2)  # -> out, plane; disabled; same code as rot
geo = Geometry(assembly_viz_2.G_placed_by_robot)
geo_2 = Geometry(assembly_viz_2.G_placed_by_human)
geo_3 = Geometry(assembly_viz_2.G_elements)
geo_4 = Geometry(assembly_viz_2.G_selected)
tag_2 = TextTag(Location=assembly_viz_2.key_tag_location, Text=assembly_viz_2.key_tag_text)
colour_swatch_3 = ColourSwatch(SwatchColor=RGB(175, 224, 220))
colour_swatch_4 = ColourSwatch(SwatchColor=RGB(242, 229, 0))
preview_3 = CustomPreview(Geometry=geo_2, Material=colour_swatch_2)
preview_4 = CustomPreview(Geometry=geo, Material=colour_swatch_2)
preview_5 = CustomPreview(Geometry=geo_4, Material=ColourSwatch(SwatchColor=RGB(0, 0, 255)))

pln = Plane(assembly_viz_2.robot_AA_base_plane)
pln_2 = Plane(assembly_viz_2.robot_AB_base_plane)
geo_5 = Geometry(assembly_viz_2.G_built)
geo_6 = Geometry(assembly_viz_2.G_planned)

preview_6 = CustomPreview(Geometry=geo_5, Material=ColourSwatch(SwatchColor=RGB(255, 170, 0)))

preview_7 = CustomPreview(Geometry=geo_6, Material=ColourSwatch(SwatchColor=RGBA(199, 199, 199, 89)))
