# Grasshopper definition ex_base_map_reuleax_reachability.ghx (Grasshopper 1.0.7)
# plug-ins: Pufferfish

# ----
# Robot Model
# Load robot from local package
py = PythonScript()  # -> mobile_robot_data_path, ur_data_path
# ---------- py: Python ----------
import os

"""
ASSUMING THE BELOW PACKAGES ARE STORED IN THE SAME LOCATION:
    ur_fabrication_control;
    rbvogui_common; and
    mobile_additive_manufacturing.
"""

repositories_path = os.path.abspath(os.path.join(ghdoc.Path,"../../../"))

assert os.path.exists(os.path.join(repositories_path, "ur_fabrication_control/data"))
assert os.path.exists(os.path.join(repositories_path, "mobile_robot_control/data/rbvogui_xl_lift_ur10e_description"))

ur_data_path = os.path.abspath(os.path.join(ghdoc.Path,"../../../ur_fabrication_control/data"))
mobile_robot_data_path = os.path.abspath(os.path.join(ghdoc.Path,"../../../mobile_robot_control/data"))
# ---------- end py ----------
list = ValueList({"indoor", "outdoor"}, selected="indoor")

# ---- group: Load map
list_2 = ValueList({"rbvogui_xl_ur10e_and_liftkit_0_4": "rbvogui_xl_ur10e_and_liftkit_0_4.json"}, selected="rbvogui_xl_ur10e_and_liftkit_0_4")
# Reachabilitymap from JSON
py_2 = PythonScript()  # -> DATA
# ---------- py_2: Python ----------
import os

HERE = os.path.dirname(ghdoc.Path)
DATA = os.path.abspath(os.path.join(HERE, "..", "data"))
print(DATA)
# ---------- end py_2 ----------
file = GhPythonScript(DATA=py_2, file=list_2)  # -> filepath
# ---------- file: Python ----------
__author__ = "Gido"
__version__ = "2023.04.18"

import os
import rhinoscriptsyntax as rs

filepath = os.path.join(DATA, file)
print filepath
# ---------- end file ----------
from_json = GhPythonScript(filepath=file, load=Toggle(True))  # -> out, reachabilitymap
# ---------- from_json: Python ----------
__author__ = "Gido"
__version__ = "2023.04.18"

import rhinoscriptsyntax as rs
from cdf_2023.robot import ReuleauxReachability

if load:
    reachabilitymap = ReuleauxReachability.from_json(filepath)
# ---------- end from_json ----------

# ----
# Load robot locally
py_3 = PythonScript(mobile_robot_data_path=py.mobile_robot_data_path, ur_data_path=py.ur_data_path, wheel_type=list)  # -> loaders, urdf_filename, srdf_filename
# ---------- py_3: Python ----------
import os
from compas.robots import LocalPackageMeshLoader

#loaders

ur_path = os.path.join(ur_data_path, "robot_description")
ur_packages = ["ur_e_description"]
ur_loaders = [LocalPackageMeshLoader(ur_path, pck) for pck in ur_packages]

mobile_robot_path = os.path.join(mobile_robot_data_path, "rbvogui_xl_lift_ur10e_description")
mobile_robot_packages = ["rbvogui_description", "ewellix_description", "robotnik_sensors"]
mobile_robot_loaders = [LocalPackageMeshLoader(mobile_robot_path, pck) for pck in mobile_robot_packages]

loaders = ur_loaders + mobile_robot_loaders

#files
if wheel_type=="indoor":
    urdf_filename = os.path.join(mobile_robot_data_path, r"rbvogui_xl_lift_ur10e_indoor.urdf")
if wheel_type == "outdoor":
    urdf_filename = os.path.join(mobile_robot_data_path, r"rbvogui_xl_lift_ur10e.urdf")
srdf_filename = os.path.join(mobile_robot_data_path, r"rbvogui.srdf")

assert os.path.isfile(urdf_filename)
assert os.path.isfile(srdf_filename)
# ---------- end py_3 ----------
units = ValueList({"m": 1, "cm": 100, "mm": 1000}, selected="m")
load = Button()
create = PythonScript(
    load=load,
    loaders=py_3.loaders,
    urdf_filename=py_3.urdf_filename,
    srdf_filename=py_3.srdf_filename,
    scale_factor=units,
    wheel_type=list)  # -> out, robot; inputs load: Boolean, loaders: list
# ---------- create: Python ----------
import os
from scriptcontext import sticky as st

import compas

from compas_ghpython import draw_frame
from compas.robots import RobotModel
from compas.robots import LocalPackageMeshLoader

from mobile_robot_control.mobile_robot import MobileRobot
from compas_fab.robots import RobotSemantics
from compas_fab.ghpython import RobotArtist

compas.PRECISION = '12f'

# store robot in component
guid = str(ghenv.Component.InstanceGuid)
robot_key = "robot"

if robot_key not in st:
    st[robot_key] = None

#print loaders
if load:
    model = RobotModel.from_urdf_file(urdf_filename)
    model.load_geometry(*loaders)
    artist = RobotArtist(model)
    semantics = RobotSemantics.from_srdf_file(srdf_filename, model)
    robot = MobileRobot(model, artist, semantics, client=None)
    
    st[robot_key] = robot

robot = st[robot_key]
robot.wheel_type = wheel_type
print(robot)

rcf = draw_frame(robot.get_RCF())
print(rcf)
# ---------- end create ----------

# ---- group: Visualization
visualize_map = GhPythonScript(reachabilitymap=from_json.reachabilitymap)  # -> out, reachabilitymap, sphere_points, resolution, reachability_index
# ---------- visualize_map: Python ----------
__author__ = "Gido"
__version__ = "2023.04.17"

import rhinoscriptsyntax as rs

from compas.geometry import Frame
from compas_ghpython.utilities import draw_frame


sphere_points = []
reachability_index = []
for point, ri in reachabilitymap.spheres_data(yield_ri=True):
    sphere_points.append(draw_frame(Frame(point, [1,0,0], [0,1,0])))
    reachability_index.append(ri)
#sphere_points = draw_frames(sphere_frames)
if reachabilitymap.resolution != 0:
    resolution = reachabilitymap.resolution
else:
    resolution = 0.1
# ---------- end visualize_map ----------
gradient = Gradient(
    LowerLimit=0,
    UpperLimit=100,
    Parameter=visualize_map.reachability_index,
    stops=[0: RGB(234, 38, 0), 0.25: RGB(234, 126, 0), 0.5: RGB(254, 244, 84), 0.75: RGB(173, 203, 249), 1: RGB(75, 107, 169)])
dots = DotDisplay(Point=visualize_map.sphere_points, Colour=gradient, Size=expr("x/5", visualize_map.resolution))

# ----
robot = Data(create.robot)
info = PythonScript(robot=robot)  # -> out, main_group_name
# ---------- info: Python ----------
if robot:
    robot.info()
    main_group_name = robot.main_group_name
# ---------- end info ----------
panel = Panel(info.out)

# ----
# Attach tool
list_3 = ValueList({"measurement_tool": 0, "area_gripper": 1, "parallel_gripper": 2, "parallel_gripper_with_mtip": 3}, selected="parallel_gripper")
show = BooleanToggle(False)
py_4 = PythonScript()  # -> DATA
# ---------- py_4: Python ----------
import os

#package_path = os.path.dirname(mobile_fabrication_control.__file__)
#DATA = os.path.abspath(os.path.join(package_path,"../../data"))

package_path = ghdoc.Path
# package_path = os.path.dirname(ur_fabrication_control.__file__)
#DATA = os.path.abspath(os.path.join(package_path,"../../data"))

# .stl files not stored in am_hackathon repo. but in mobile_fabrication_control
DATA = os.path.abspath(os.path.join(package_path,"../../../mobile_robot_control/data"))

print(package_path)
print(DATA)
# ---------- end py_4 ----------
tool = PythonScript(data_path=py_4, tool=list_3, show=show)  # -> tool, M, ee_plane
# ---------- tool: Python ----------
import os, math
from compas.geometry import Frame, Rotation
from compas.datastructures import Mesh
from compas_ghpython.artists import MeshArtist
from compas_fab.robots import Tool
from compas_ghpython.utilities import draw_frame

tolerance = 0

if tool == 0:
    filename = 'measurement_tool_zaxis.stl'
    ee_frame = Frame([0, 0, 0.109], [1, 0, 0], [0, 1, 0])

elif tool == 1:
    filename = 'area_gripper_zaxis.stl'
    ee_frame = Frame([0, 0, 0.10219 + tolerance], [0, 1, 0], [-1, 0, 0])

elif tool == 2:
    filename = 'parallel_gripper.stl'
    ee_frame = Frame([0, 0, 0.1455 + tolerance], [0, 1, 0], [-1, 0, 0]) 

elif tool == 3:
    filename = 'parallel_gripper_with_mtip.stl'
    ee_frame = Frame([0, 0, 0.20], [0, 1, 0], [-1, 0, 0])

data_path = os.path.join(data_path, "tool_geometry")
fullfilename = os.path.join(data_path, filename)
print fullfilename

ee_mesh = Mesh.from_stl(fullfilename)

if show:
    artist = MeshArtist(ee_mesh)
    M = artist.draw()
    ee_plane = draw_frame(ee_frame)

tool = Tool(ee_mesh, ee_frame)

print(ee_frame.quaternion.xyzw)
ee_framek = Frame([0.0110607,0.00809854,0.41498], [0,1,0], [1,0,0])
print(ee_framek.quaternion.xyzw)
# ---------- end tool ----------
panel_2 = Panel("Attach a custom tool")
remove = Button()
add = Button()
attach_remove = PythonScript(robot=robot, tool=tool.tool, attach=add, remove=remove)  # -> out, bang
# ---------- attach_remove: Python ----------
if attach:
    robot.attach_tool(tool)
if remove:
    robot.detach_tool()
# ---------- end attach_remove ----------

mesh = Mesh(tool.M)
pln = Plane(tool.ee_plane)
series = Series(Start=0, Step=Slider(0.5, range=0..1), Count=Slider(7, range=0..10))
pt = ConstructPoint(XCoordinate=graft(series), YCoordinate=series, ZCoordinate=0)

# ----
# Your input here!
pt_2 = Point(<point referenced from the Rhino model>)
pln_2 = Plane(PlaneXY(0.1801181693, -0.7807762412, 0))

pt_3 = Point()
pln_3 = Plane()

pln_4 = Plane(flatten(pt))

# ----
# Array of positions
resolution = Slider(0.4, range=0..1)
python = GhPythonScript(
    goal_points=pt_2,
    base_poses=pln_4,
    reuleaux_map=from_json.reachabilitymap,
    map_resolution=resolution,
    compute=Toggle(True))  # -> out, base_map; inputs goal_points: list of Point3d, base_poses: list
# ---------- python: Python ----------
__author__ = "Gido"
__version__ = "2023.09.12"

import rhinoscriptsyntax as rs
from compas.geometry import Frame, Pointcloud
from cdf_2023.robot import BaseMap
from compas_ghpython.utilities import draw_points

if compute:
    base_map = BaseMap()
    goal_pointcloud = Pointcloud(goal_points)
    if reuleaux_map.resolution == 0:
        reuleaux_map.resolution = map_resolution
    for base_pose in base_poses:
        base_frame = Frame(base_pose.Origin, base_pose.XAxis, base_pose.YAxis)
        base_map.get_reuleaux_index_by_base_pose(base_frame, reuleaux_map, goal_pointcloud, None)
# ---------- end python ----------

# ----
# Single position
resolution_2 = Slider(0.4, range=0..1)
# Base Map Reuleaux Calculation
# Can be used with optimizers like galapagos!
toggle = BooleanToggle(True)
python_2 = GhPythonScript(create=toggle)  # -> out, base_map
# ---------- python_2: Python ----------
__author__ = "Gido"
__version__ = "2023.09.18"

import rhinoscriptsyntax as rs
from cdf_2023.robot import BaseMap

if create:
    base_map = BaseMap()
# ---------- end python_2 ----------
python_3 = GhPythonScript(
    base_map=python_2.base_map,
    goal_points=pt_2,
    base_pose=pln_2,
    reuleaux_map=from_json.reachabilitymap,
    map_resolution=resolution_2,
    compute=Toggle(True))  # -> out, base_map; inputs goal_points: list of Point3d
# ---------- python_3: Python ----------
__author__ = "Gido"
__version__ = "2023.09.12"

import rhinoscriptsyntax as rs
from compas.geometry import Frame, Pointcloud
from cdf_2023.robot import BaseMap
from compas_ghpython.utilities import draw_points

#cpts = [pt for pt in points]
if compute:
    goal_pointcloud = Pointcloud(goal_points)
    if reuleaux_map.resolution == 0:
        reuleaux_map.resolution = map_resolution
    base_frame = Frame(base_pose.Origin, base_pose.XAxis, base_pose.YAxis)
    base_map.get_reuleaux_index_by_base_pose(base_frame, reuleaux_map, goal_pointcloud, None)
# ---------- end python_3 ----------

# ---- group: forward kinematics
a6 = Slider(0, range=-360..360)
# Configuration
l = Slider(0.245, range=0..0.72)
a1 = Slider(0, range=-360..360)
a2 = Slider(-90, range=-360..360)
a3 = Slider(90, range=-360..360)
a4 = Slider(0, range=-360..360)
a5 = Slider(90, range=-360..360)
jp = GhPythonScript()  # -> joint_positions
# ---------- jp: Python ----------
import math

joint_positions = [0,0,-90,90,0,90,0]
joint_positions = [math.radians(a) for a in joint_positions]
#joint_positions = [-3.136, -0.328, -1.218, 3.129, 0.852, 0.008]
#joint_positions = [0] * 6



#joint_positions = [1.6239667567485938, 0.25439606475392273, 4.409424838594969-2*3.14, 3.1901607306255908, 1.5707963267948954, 0.053170429953696939]
#joint_positions = [1.598543436748912, 0.23021224965157744, 4.712232135219824-2*3.14, 6.0531299026928744, 4.7123889803846915, 0.027747109954015234]
#joint_positions = [-1.1373533430447322, 4.0117247163121572, 5.4083762087596021-2*3.14, 1.5754733624925168, 4.7123889803846879, 3.5750356373399574]
print joint_positions
# ---------- end jp ----------
forward_kinematics = PythonScript(robot=robot, set_joint_positions=Button(), joint_positions=jp, lift=l, a1=a1, a2=a2, a3=a3, a4=a4, a5=a5, a6=a6)  # -> full_configuration; inputs joint_positions: list
# ---------- forward_kinematics: Python ----------
import math
import Grasshopper
from compas.robots import Joint
from compas_fab.robots import Configuration

if set_joint_positions:
    j = 0
    for i in range(ghenv.Component.Params.Input.Count):
        nslider = ghenv.Component.Params.Input[i].Sources[0]
        if nslider.GetType() == Grasshopper.Kernel.Special.GH_NumberSlider:
            nslider.TrySetSliderValue(math.degrees(joint_positions[j]))
            j += 1

if robot:
    joints = robot.get_configurable_joints()
    joint_types = [joint.type for joint in joints]
    joint_names = [joint.name for joint in joints]
    
    joint_positions = [a1, a2, a3, a4, a5, a6]
    joint_positions = [math.radians(position) for position in joint_positions]
    
    if len(joints) == 7:
        joint_positions = [lift] + joint_positions
    
    print joint_types, joint_names, joint_positions
    full_configuration = Configuration(joint_positions, joint_types, joint_names)
    
print(full_configuration)
# ---------- end forward_kinematics ----------

# ---- group: inverse kinematics
select_configuration = Slider(0, range=0..7)
plane = Plane(pt_2)
analytic_inverse = PythonScript(robot=robot, lift=l, plane_WCS=plane, idx=select_configuration, bang=attach_remove.bang)  # -> out, configuration; inputs plane_WCS: Plane, idx: Int32, bang: list
# ---------- analytic_inverse: Python ----------
import Rhino.Geometry as rg
import math
from compas.geometry import Frame, Transformation, Rotation
from compas_fab.robots import Configuration
from ur_fabrication_control.kinematics.ur_kinematics import inverse_kinematics
from ur_fabrication_control.kinematics.ur_params import ur_params
from compas_ghpython import draw_frame

robot.lift_height = lift

frame_WCS = Frame(plane_WCS.Origin, plane_WCS.XAxis, plane_WCS.YAxis)

# transform frame to robot coordinate system
frame_RCS = frame_WCS.transformed(robot.transformation_WCF_RCF())

if robot.attached_tool:
    tool0_RCS = robot.from_tcf_to_t0cf([frame_RCS])[0]
else:
    tool0_RCS = frame_RCS

plane_tool0_RCS = draw_frame(tool0_RCS)
plane_RCS = draw_frame(frame_RCS)

# calculate solutions to frame
ur_params = ur_params["ur10e"] # get the parameters according to the robot model
print ur_params
solutions = inverse_kinematics(tool0_RCS, ur_params)
print solutions

if not len(solutions):
    joint_values = [0, 0, 0, 0, 0, 0, 0]
    configuration = Configuration.from_revolute_values(joint_values)
else:
    joint_values = [lift] + solutions[idx]
    configuration = [Configuration.from_revolute_values(joint_values)]

print(configuration)
# ---------- end analytic_inverse ----------

# ---- group: zero configuration
zero_config = ZeroConfig(robot=robot, group=info.main_group_name)  # -> config
#   port group: If assigned, it will return the zero configuration for the given group, otherwise a full zero configuration.
#   port config: The zero configuration.
# ---------- zero_config: Python ----------
"""
Get a zero configuration for a robot.

COMPAS FAB v0.27.0
"""
from ghpythonlib.componentbase import executingcomponent as component


class ConfigZero(component):
    def RunScript(self, robot, group):

        if robot:
            return robot.zero_configuration(group)

        return None
# ---------- end zero_config ----------

# ---- group: All base poses
# Base Map Visualization
toggle_2 = BooleanToggle(True)
python_4 = GhPythonScript(base_map=python.base_map, show=toggle_2)  # -> out, planes, reuleaux_indices
# ---------- python_4: Python ----------
__author__ = "Gido"
__version__ = "2023.09.12"

import rhinoscriptsyntax as rs
from compas_ghpython.utilities import draw_frame
from statistics import mean

planes = []
reuleaux_indices = []
if show:
    for node, data in base_map.base_map.nodes(data=True):
        planes.append(draw_frame(data['frame']))
        reuleaux_data = data['reuleaux_data']
        goal_ri_mean = mean(reuleaux_data['goal_reuleaux_index'])
        ri_mean = goal_ri_mean
        reuleaux_indices.append(ri_mean)
# ---------- end python_4 ----------
bnd = Bounds(Numbers=python_4.reuleaux_indices)
dedomain = DeconstructDomain(Domain=bnd)  # -> Start, End
gradient_2 = Gradient(
    LowerLimit=expr("x-1", dedomain.Start),
    UpperLimit=dedomain.End,
    Parameter=python_4.reuleaux_indices,
    stops=[0.001: RGB(0, 0, 0), 0.276: RGB(254, 244, 84), 0.75: RGB(173, 203, 249), 1: RGB(75, 107, 169)])
dots_2 = DotDisplay(Point=python_4.planes, Colour=gradient_2, Size=expr("x/10", Slider(0.75, range=0..1)))

# ----
list_4 = ValueList({"0 zero_configuration": 0, "1 forward_kinematics": 1, "2 inverse_kinematics": 2}, selected="2 inverse_kinematics")
filter = StreamFilter(Gate=list_4, Stream0=zero_config, Stream1=forward_kinematics, Stream2=analytic_inverse.configuration)

# ----
# Closeness penalty
penalty_factor = Slider(10, range=0..100)
minimum_distance = Slider(0.4, range=0..100)

pt_4 = Point(<point referenced from the Rhino model>)

# ---- group: Define distance and replace negative values
cp = ClosestPoint(Point=python_4.planes, Cloud=pt_4)  # -> ClosestPoint, CPIndex, Distance
smaller = SmallerThan(FirstNumber=cp.Distance, SecondNumber=minimum_distance)  # -> SmallerThan, OrEqualTo
dispatch = Dispatch(List=cp.Distance, DispatchPattern=smaller.SmallerThan)  # -> ListA, ListB
subtraction = Subtraction(A=cp.Distance, B=minimum_distance)
index = ItemIndex(List=cp.Distance, Item=dispatch.ListA)
replace = ReplaceItems(List=subtraction, Item=0, Indices=index, Wrap=False)
bnd_2 = Bounds(Numbers=replace)
remap = RemapNumbers(Value=replace, Source=bnd_2, Target=Domain(-1, 0))  # -> Mapped, Clipped

# ---- group: Penalty factor
penalty_factor_2 = GraphMapper(remap.Mapped, x0=-1, x1=0, y0=-1, y1=0, Cx=0.3823914528, Cy=0.7545644045, container_name="Conic")
multiplication = Multiplication(A=penalty_factor_2, B=penalty_factor)

# ---- group: Penalty application
addition = Addition(A=multiplication, B=python_4.reuleaux_indices)
larger = LargerThan(FirstNumber=addition, SecondNumber=python_4.reuleaux_indices)  # -> LargerThan, OrEqualTo
listdexs = ListIndices(List=python_4.reuleaux_indices)
cull = CullPattern(List=listdexs, CullPattern=larger.OrEqualTo)
item = ListItem(List=python_4.reuleaux_indices, Index=cull, Wrap=True)
replace_2 = ReplaceItems(List=addition, Item=item, Indices=cull, Wrap=False)

# ---- group: Ideal pose
sort = SortList(Keys=replace_2, ValuesA=replace_2)  # -> Keys, ValuesA
item_2 = ListItem(List=sort.ValuesA, Index=0, Wrap=True)  # -> Item1, Item
index_2 = ItemIndex(List=replace_2, Item=item_2.Item1)
item_3 = ListItem(List=python_4.planes, Index=index_2, Wrap=True)
pln_5 = Plane(item_3)

# ----
r_aa_position = Plane(pln_5)

# ----
# Move mobile robot base
angle = Slider(101, range=0..360)
base_origin = Point(Point(0.4817730379, -1.392966048, 0))
set_to_origin = BooleanToggle(False)
base_plane = GhPythonScript(origin=base_origin, angle=angle)  # -> base_plane; inputs origin: Point3d
# ---------- base_plane: Python ----------
import Rhino.Geometry as rg
import math

base_plane = rg.Plane(origin, rg.Vector3d.XAxis, rg.Vector3d.YAxis)
base_plane.Rotate(math.radians(angle), rg.Vector3d.ZAxis)
# ---------- end base_plane ----------
set_base_frame = PythonScript(robot=robot, set_to_origin=set_to_origin, base_plane=r_aa_position)  # -> bang
# ---------- set_base_frame: Python ----------
from compas_ghpython import draw_frame
from compas.geometry import Frame, Point, Vector, Transformation
from compas.datastructures import Mesh
from compas_rhino.geometry import RhinoMesh
from compas_fab.robots import CollisionMesh

if set_to_origin:
    base_frame = Frame.worldXY()
else:
    base_frame = Frame(base_plane.Origin, base_plane.XAxis, base_plane.YAxis)

# Base_frame is BCF in WCF
if robot:
    robot.BCF = base_frame
    
    
plane = robot.RCF

print plane
# ---------- end set_base_frame ----------

manual = Slider(0, range=0..100)
list_5 = ValueList({"Manual input": 0, "Ideal pose": 1}, selected="Ideal pose")
filter_2 = StreamFilter(Gate=list_5, Stream0=manual, Stream1=index_2)
python_5 = GhPythonScript(base_map=python.base_map, reachabilitymap=from_json.reachabilitymap, idx=filter_2, show=Toggle(True))  # -> out, base_plane, reuleaux_points, reuleaux_data, reuleaux_index, reachability_indices, points, values
# ---------- python_5: Python ----------
__author__ = "Gido"
__version__ = "2023.09.12"

import rhinoscriptsyntax as rs
from compas_ghpython.utilities import draw_frame, draw_points

planes = []
reuleaux_indices = []
if show:
    i = 0
    for node, data in base_map.base_map.nodes(data=True):
        if i == idx:
            base_plane = draw_frame(data['frame'])
            reuleaux_index = data['mean_reuleaux_index']
            reuleaux_data = data['reuleaux_data']
            reuleaux_points = draw_points([{'pos': [pt.x, pt.y, pt.z]} for pt in reuleaux_data['reuleaux_points']])
            reachability_indices = [ri for point, ri in reachabilitymap.spheres_data(yield_ri=True)]
            points = draw_points([{'pos': [pt.x, pt.y, pt.z]} for pt in reuleaux_data['goal_points']])
            values = reuleaux_data['goal_reuleaux_index']
            break
        i += 1
# ---------- end python_5 ----------
base_pose = Plane(python_5.base_plane)

bang = GhPythonScript(x=[set_base_frame, attach_remove.bang])  # -> out, flatten(x); inputs x: list
# ---------- bang: Python ----------
print x
# ---------- end bang ----------

# ----
# Visualisation
show_end_effector_frame = BooleanToggle(False)
show_base_frame = BooleanToggle(False)
show_collision = BooleanToggle(False)
show_frames = BooleanToggle(False)
show_reach = BooleanToggle(False)
show_visual = BooleanToggle(True)
show_acm = BooleanToggle(False)
show_cm = BooleanToggle(False)
robot_visualize = RobotVisualize(
    robot=robot,
    group=info.main_group_name,
    configuration=filter,
    show_visual=show_visual,
    show_collision=show_collision,
    show_frames=show_frames,
    show_base_frame=show_base_frame,
    show_end_effector_frame=show_end_effector_frame,
    show_reach=show_reach,
    show_cm=show_cm,
    show_acm=show_acm,
    redraw=bang.x)  # -> visual, collision, collision_meshes, attached_meshes, all_frames, base_frame, ee_frame, reach; inputs show_visual: Boolean, show_collision: Boolean, show_frames: Boolean, show_base_frame: Boolean, show_end_effector_frame: Boolean, show_cm: Boolean, show_acm: Boolean, redraw: list
#   port group: The planning group used for end-effector and base visualization.
#   port configuration: The robot's full configuration.
#   port show_visual: Whether or not to show the robot's visual meshes.
#   port show_collision: Whether or not to show the robot's collision meshes.
#   port show_frames: Whether or not to show the robot's joint frames.
#   port show_base_frame: Whether or not to show the robot's base frame.
#   port show_end_effector_frame: Whether or not to show the robot's end-effector frame.
#   port show_cm: Whether or not to show the collision meshes (if any).
#   port show_acm: Whether or not to show the attached collision meshes (if any).
#   port visual: Rhino meshes of the robot's visual geometry (if any).
#   port collision: Rhino meshes of the robot's collision geometry (if any).
#   port collision_meshes: Rhino meshes of the scene's collision meshes (if any).
#   port attached_meshes: Rhino meshes of the scene's attached collision meshes (if any).
#   port all_frames: The robot's joint frames as Rhino planes (if any).
#   port base_frame: The robot's base frame as a Rhino plane (if any).
#   port ee_frame: The robot's end-effector frame as a Rhino plane (if any).
# ---------- robot_visualize: Python ----------
"""
Visualizes the robot.

COMPAS FAB v0.27.0
"""
import Rhino.Geometry as rg
import ghpythonlib.components as ghcomp
from compas.artists import Artist
from compas.geometry import Frame
from compas.geometry import Transformation
from compas_fab.robots import PlanningScene
from compas_ghpython.utilities import draw_frame
from ghpythonlib.componentbase import executingcomponent as component

class RobotVisualize(component):
    def RunScript(
        self,
        robot,
        group,
        configuration,
        show_visual,
        show_collision,
        show_frames,
        show_base_frame,
        show_end_effector_frame,
        show_reach,
        show_cm,
        show_acm,
        redraw
    ):

        visual = None
        collision = None
        collision_meshes = None
        attached_meshes = None
        frames = None
        base_frame = None
        ee_frame = None
        all_frames = None
        reach = None

        if robot:
            show_visual = True if show_visual is None else show_visual
            show_cm = True if show_cm is None else show_cm
            show_acm = True if show_acm is None else show_acm
            configuration = configuration or robot.zero_configuration()

            robot.update(configuration, visual=show_visual, collision=show_collision)
            frames = robot.transformed_frames(configuration, group)

            if show_visual:
                visual = robot.artist.draw_visual()
                # orient the robot to its base plane:
                robot_BCF = draw_frame(robot.BCF) 
                init_robot_plane = rg.Plane.WorldXY
                visual = ghcomp.Orient(visual, init_robot_plane, robot_BCF)[0]
                #picking_frame = robot.to_world_coordinates(robot.PCF)

            if show_collision:
                collision = robot.artist.draw_collision()

            if show_base_frame:
                base_frame = robot.BCF

            if show_end_effector_frame:
                ee_frame = robot.forward_kinematics(
                    configuration, group, options=dict(solver="model")
                )

            if show_frames:
                all_frames = [robot.to_world_coordinates(frame) for frame in frames]
            
            if show_reach:
                ur_base_plane = draw_frame(robot.RCF)
                reach = rg.Sphere(ur_base_plane, 1.25 + robot.attached_tool.frame.point.z)

            if show_cm or show_acm:
                scene = PlanningScene(robot)
                scene = robot.client.get_planning_scene()

                collision_meshes = []
                attached_meshes = []

                if show_cm:
                    for co in scene.world.collision_objects:
                        header = co.header
                        frame_id = header.frame_id
                        cms = co.to_collision_meshes()

                        for cm in cms:
                            if cm.frame != Frame.worldXY():
                                t = Transformation.from_frame(cm.frame)
                                mesh = cm.mesh.transformed(t)
                            else:
                                mesh = cm.mesh

                            collision_meshes.append(Artist(mesh).draw())

                if show_acm:
                    for aco in scene.robot_state.attached_collision_objects:
                        for acm in aco.to_attached_collision_meshes():
                            frame_id = aco.object["header"]["frame_id"]
                            frame = robot.forward_kinematics(
                                configuration, options=dict(link=frame_id)
                            )
                            t = Transformation.from_frame(frame)

                            # Local CM frame
                            if (
                                acm.collision_mesh.frame
                                and acm.collision_mesh.frame != Frame.worldXY()
                            ):
                                t = t * Transformation.from_frame(
                                    acm.collision_mesh.frame
                                )

                            mesh = acm.collision_mesh.mesh.transformed(t)

                            attached_meshes.append(Artist(mesh).draw())

        return (
            visual,
            collision,
            collision_meshes,
            attached_meshes,
            all_frames,
            base_frame,
            ee_frame,
            reach
        )
# ---------- end robot_visualize ----------
geo = Geometry(robot_visualize.visual)
geo_2 = Geometry(robot_visualize.collision)
geo_3 = Geometry(robot_visualize.reach)
draw = GhPythonScript(frames=robot_visualize.all_frames, scale=Slider(0.1, range=0..1))  # -> P, V, C, W; inputs frames: list
# ---------- draw: Python ----------
from System.Drawing import Color
from compas_ghpython.utilities import draw_frame

red = Color.FromArgb(255, 0, 0)
green = Color.FromArgb(0, 255, 0)
blue = Color.FromArgb(0, 0, 255)

P = []
V = []
C = []

scale = float(scale)

for frame in frames:
    if not frame:
        continue
    plane = draw_frame(frame)
    P += [plane.Origin] * 3
    V.append(plane.XAxis * scale)
    V.append(plane.YAxis * scale)
    V.append(plane.ZAxis * scale)
    C += [red, green, blue]

W = 3
# ---------- end draw ----------
preview = CustomPreview(Geometry=geo_3, Shader=ColourSwatch(SwatchColor=RGBA(255, 212, 212, 97)))
preview_2 = CustomPreview(Geometry=geo, Shader=ColourSwatch(SwatchColor=RGB(105, 105, 105)))
preview_3 = CustomPreview(Geometry=geo_2, Shader=ColourSwatch(SwatchColor=RGB(255, 255, 255)))
vdisex = VectorDisplayEx(Point=draw.P, Vector=draw.V, Colour=draw.C, Width=draw.W)

# ---- group: Reachability of evaluated goal_points
bnd_3 = Bounds(Numbers=python_5.values)
dedomain_2 = DeconstructDomain(Domain=bnd_3)  # -> Start, End
gradient_3 = Gradient(
    LowerLimit=dedomain_2.Start,
    UpperLimit=dedomain_2.End,
    Parameter=python_5.values,
    stops=[0: RGB(118, 216, 81), 0.001: RGB(0, 0, 0), 0.276: RGB(254, 244, 84), 0.75: RGB(173, 203, 249), 1: RGB(75, 107, 169)])
dots_3 = DotDisplay(Point=python_5.points, Colour=gradient_3, Size=expr("x/10", Slider(0.2, range=0..1)))

# ---- group: Reachabilitymap at base_pose
gradient_4 = Gradient(
    LowerLimit=0,
    UpperLimit=100,
    Parameter=python_5.reachability_indices,
    stops=[0.001: RGB(0, 0, 0), 0.276: RGB(254, 244, 84), 0.75: RGB(173, 203, 249), 1: RGB(75, 107, 169)])
dots_4 = DotDisplay(Point=python_5.reuleaux_points, Colour=gradient_4, Size=expr("x/10", Slider(0.4, range=0..1)))

# ----
# Ideal pose
deplane = DeconstructPlane(Plane=pln_5)  # -> Origin, XAxis, YAxis, ZAxis
swatch = ColourSwatch(SwatchColor=RGB(255, 255, 255))
multiplication_2 = Multiplication(A=deplane.XAxis, B=Slider(0.1, range=0..1))
dots_5 = DotDisplay(Point=pln_5, Colour=swatch, Size=expr("x/10", Slider(0.4, range=0..1)))
vdisex_2 = VectorDisplayEx(Point=deplane.Origin, Vector=multiplication_2, Colour=swatch, Width=Slider(4, range=0..10))

# ---- group: Visualization
bnd_4 = Bounds(Numbers=python_4.reuleaux_indices)
dedomain_3 = DeconstructDomain(Domain=bnd_4)  # -> Start, End
gradient_5 = Gradient(
    LowerLimit=dedomain_3.Start,
    UpperLimit=dedomain_3.End,
    Parameter=replace_2,
    stops=[0.001: RGB(0, 0, 0), 0.276: RGB(254, 244, 84), 0.75: RGB(173, 203, 249), 1: RGB(75, 107, 169)])
dots_6 = DotDisplay(Point=python_4.planes, Colour=gradient_5, Size=expr("x/10", Slider(0.4, range=0..1)))

# ----
# All poses
deplane_2 = DeconstructPlane(Plane=python_4.planes)  # -> Origin, XAxis, YAxis, ZAxis
multiplication_3 = Multiplication(A=deplane_2.XAxis, B=Slider(0.1, range=0..1))
vdisex_3 = VectorDisplayEx(Point=deplane_2.Origin, Vector=multiplication_3, Colour=gradient_5, Width=Slider(4, range=0..10))
vdis = VectorDisplay(Vector=deplane_2.XAxis)
