# Grasshopper definition joint_lines.gh (Grasshopper 1.0.7)

curve = Curve([<curve referenced from the Rhino model> x3])
number_slider = Slider(0.03, range=0..0.03)
curve_proximity = CurveProximity(CurveA=curve, CurveB=graft(curve))  # -> PointA, PointB, Distance
boolean_toggle = BooleanToggle(True)
line = Line(StartPoint=curve_proximity.PointA, EndPoint=curve_proximity.PointB)
division = Division(A=curve_proximity.Distance, B=Slider(2, range=0..10))
circle_cnr = CircleCNR(Center=curve_proximity.PointA, Normal=curve, Radius=division)
clean_tree = CleanTree(RemoveNulls=boolean_toggle, RemoveInvalid=boolean_toggle, RemoveEmpty=boolean_toggle, Tree=line)  # -> flatten(Tree)
curve_2 = Curve([<curve referenced from the Rhino model> x3])
pipe = Pipe(Curve=curve_2, Radius=Slider(0.01, range=0..0.031), Caps=0)
cylinder = Cylinder(Base=PlaneXY(0, 0, 0), Radius=0.5, Length=1)
