# Grasshopper definition liuba_prototype_ex_mobile_robot_moveit_simulation_from_messages.gh (Grasshopper 1.0.7)

# ----
# Fake Dictionaries | For testing
number_slider = Slider(0, range=0..10)
ghpython_script = GhPythonScript(x=number_slider)  # -> out, a, b, c, d, e; inputs x: Int32
# ---------- ghpython_script: Python ----------
a = [{ "execute":True, "index":35, "robot_name": "AA", "count":0}]
b= [{"execute":True, "index":35, "robot_name": "AA", "count":x}]
c= [{ "execute":True, "index":35, "robot_name": "AA", "count":0}]
d= [{ "execute":True, "index":35, "robot_name": "AA", "count":1}]
e = [{ "execute":False, "index":35, "robot_name": "AA", "count":0}]

print "a = " , a
print "b = " , b
print "c = " , c
print "d = " , d
print "e = ", e
# ---------- end ghpython_script ----------
panel = Panel(ghpython_script.out)

# ---- group: ROBOT NAME BASED ON FILE FOR CONTROL
robot_name = Panel("AA")

# ----
py = PythonScript()  # -> ENVIRONMENT_NAME, HERE, DATA
# ---------- py: Python ----------
import os
import compas_bootstrapper

HERE = os.path.dirname(ghdoc.Path)
DATA = os.path.abspath(os.path.join(HERE, "..", "data"))
ENVIRONMENT_NAME = compas_bootstrapper.ENVIRONMENT_NAME
print(HERE)
print(DATA)
print(ENVIRONMENT_NAME)
# ---------- end py ----------
info = Info()  # -> info
#   port info: Environment info.
# ---------- info: Python ----------
"""
Displays information about the active COMPAS environment.
"""
import compas_bootstrapper
from ghpythonlib.componentbase import executingcomponent as component

import compas


class CompasInfo(component):
    def RunScript(self):
        self.Message = "COMPAS v{}".format(compas.__version__)
        info = "COMPAS Version: {}\nEnvironment: {}"
        return info.format(compas.__version__, compas_bootstrapper.ENVIRONMENT_NAME)
# ---------- end info ----------

# ----
# ROS client
panel_2 = Panel("9090")
# Robotic Control and Visualization
list = ValueList({"local": "127.0.0.1", "linux computer": "192.168.0.42", "linux eduroam": "10.181.95.254", "robot": "192.168.0.200"}, selected="local")
connect = BooleanToggle(True)
ros = ROSConnect(ip=list, port=panel_2, connect=connect)  # -> ros_client, is_connected; inputs port: Int32, connect: Boolean
#   port ip: The ip address ROS. Defaults to 127.0.0.1.
#   port port: The port of ROS. Defaults to 9090.
#   port connect: If True, connects to ROS. If False, disconnects from ROS. Defaults to False.
#   port ros_client: The ROS client.
#   port is_connected: True if connection established.
# ---------- ros: Python ----------
"""
Connect or disconnect to ROS.

COMPAS FAB v0.27.0
"""
from ghpythonlib.componentbase import executingcomponent as component
from scriptcontext import sticky as st

from compas_fab.backends import RosClient
from compas_fab.ghpython.components import create_id


class ROSConnect(component):
    def RunScript(self, ip, port, connect):
        ros_client = None

        ip = ip or '127.0.0.1'
        port = port or 9090

        key = create_id(self, 'ros_client')
        ros_client = st.get(key, None)

        if ros_client:
            st[key].close()
        if connect:
            st[key] = RosClient(ip, port)
            st[key].run(5)

        ros_client = st.get(key, None)
        is_connected = ros_client.is_connected if ros_client else False
        return (ros_client, is_connected)
# ---------- end ros ----------
panel_3 = Panel(ros.is_connected)

panel_4 = Panel("Unload libraries")
# Design Information | From Firebase Real time Database
bang = Button()
unload = PythonScript(bang=bang)
# ---------- unload: Python ----------
from compas_rhino.utilities.misc import get_tolerance
from compas_rhino.utilities.misc import unload_modules

unload_modules("cdf_2023")
unload_modules("mobile_robot_control")
unload_modules("ur_fabrication_control")
# ---------- end unload ----------

panel_5 = Panel(info)
panel_6 = Panel(py.ENVIRONMENT_NAME)

# ----
# 1. Define local path
data = Data("C:\Users\lidet\workspace\projects\cdf_2023")

# ----
# Load robot from ROS
# Load robot from ROS
load = Button()
robot = ROSRobot(ros_client=ros.ros_client, load=load)  # -> mobile_robot; inputs load: Boolean
#   port ros_client: The ROS client.
#   port load: If True, loads the robot from ROS. Defaults to False.
# ---------- robot: Python ----------
"""
Load robot directly from ROS.

COMPAS FAB v0.27.0
"""
from mobile_robot_control.mobile_robot import MobileRobot
from mobile_robot_control.mobile_robot_client import MobileRobotClient

from compas_ghpython.artists import RobotModelArtist
from ghpythonlib.componentbase import executingcomponent as component
from scriptcontext import sticky as st

from compas_fab.ghpython.components import create_id


class ROSRobot(component):
    def RunScript(self, ros_client, prefix, load):
        key = create_id(self, 'robot')

        if ros_client and ros_client.is_connected and load:
            # Load URDF from ROS
            robot = ros_client.load_robot(
                    load_geometry=True, 
                    urdf_param_name= '{}/robot_description'.format(prefix),
                    srdf_param_name= '{}/robot_description_semantic'.format(prefix),
                    precision='12f')
            robot.artist = RobotModelArtist(robot.model)
            mobile_robot = MobileRobot(robot.model, robot.artist, robot.semantics, client=None, wheel_type="indoor")
            st[key] = mobile_robot

        mobile_robot = st.get(key, None)
        if mobile_robot:  # client sometimes need to be restarted, without needing to reload geometry
            mobile_robot.mobile_client = MobileRobotClient(ros_client)
            mobile_robot.client = ros_client
        return mobile_robot
# ---------- end robot ----------

# ----
# IP Settings
# --> Set your IP address
# --> Set robot IP address
server_ip = ValueList({"192.168.0.48", "192.168.10.12", "192.168.10.11", "192.168.10.10", "192.168.10.2", "127.0.0.1", "192.168.10.111", "192.168.0.250", "192.168.0.30", "10.42.0.212", "10.42.0.133"}, selected="192.168.0.48")
ext_ip = ValueList({"192.168.10.10", "192.168.10.20", "192.168.10.11", "192.168.10.12", "127.0.0.1", "192.168.10.111", "192.168.0.220", "192.168.0.30", "192.168.10.50", "0.0.0.0"}, selected="192.168.0.220")
ur_ip = ValueList({"192.168.0.10", "192.168.10.20", "192.168.10.11", "192.168.10.12", "127.0.0.1", "192.168.10.111", "192.168.0.210", "192.168.0.30"}, selected="192.168.0.210")
server_port = ValueList({"50002", "50003", "50005", "50006", "50007", "50008", "50009", "50010", "50011", "50012", "50013", "50014", "50015", "50016", "50017", "50018", "50019", "50020", "50021", "50022", "50023", "50024", "50025", "50026", "50027", "50028"}, selected="50008")
ext_port = ValueList({"50003", "50004"}, selected="50004")
ur_port = ValueList({"30002"}, selected="30002")
globals = PythonScript(
    server_ip=server_ip,
    server_port=server_port,
    ur_ip=ur_ip,
    ur_port=ur_port,
    ext_ip=ext_ip,
    ext_port=ext_port,
    clear=Button())  # inputs server_port: Int32
# ---------- globals: Python ----------
from scriptcontext import sticky as st

st["server_ip"] = server_ip
st["server_port"] = server_port

st["ur_ip"] = ur_ip
st["ur_port"] = ur_port

st["ext_ip"] = ext_ip
st["ext_port"] = ext_port


if clear:
    st.clear()
# ---------- end globals ----------

# ----
# Check if UR robot
#  is available
ping = Button()
py_2 = PythonScript(ip=ur_ip, ping=ping)  # -> out, trigger
# ---------- py_2: Python ----------
from scriptcontext import sticky as st
from ur_fabrication_control.direct_control.utilities import is_available

guid = str(ghenv.Component.InstanceGuid)
txt_key = "txt_" + guid
if txt_key not in st:
    st[txt_key] = ""

if ping:
    
    available = is_available(ip)
    
    if available:
        st[txt_key] = "%s is up!" % ip
        trigger = True
    else:
        st[txt_key] = "%s is down!" % ip
        trigger = False

print(st[txt_key])
# ---------- end py_2 ----------
panel_7 = Panel(py_2.out)

# ----
# Instantiation Inputs
panel_8 = Panel("node")

length = Slider(0.4, range=0..100)
radius = Slider(0.006, range=0..100)

geometry = Geometry(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)
mesh = Mesh(geometry)

# ----
# MQTT
# Install compas_eve on your working enviroment and Rhino
#  https://github.com/gramaziokohler/compas_eve/tree/main
# if host != localhost:
# 
# DISABLE your Firewall or Ensure that the required ports for MQTT (typically 1883 or 8883 for secure connections) are open and accessible.
panel_9 = Panel("broker.hivemq.com")

# ----
# MQTT | Subscribers
# >> Subscriber | Place
panel_10 = Panel("/caa_get_place_config/")
mqtt_subscriber = MQTTSubscriber(host=panel_9, topic=panel_10, reset=Button())  # -> out, last_message
# ---------- mqtt_subscriber: Python ----------
from __future__ import print_function
import time
import json
import random
import threading
from System.Threading.Tasks import Task
from System.Threading import ManualResetEventSlim

from ghpythonlib.componentbase import executingcomponent as component
from scriptcontext import sticky as st

from compas_eve import Message, Topic, Subscriber
from compas_eve.mqtt import MqttTransport
from compas_fab.ghpython.components import create_id
from compas_ghpython import update_component

import Rhino
import System


class BackgroundWorker(object):
    def __init__(self, ghenv):
        super(BackgroundWorker, self).__init__()
        self.ghenv = ghenv
        self._is_working = False
        self._is_done = False
        self._is_cancelled = False
        self._has_requested_cancellation = False

    def is_working(self):
        return self._is_working

    def is_done(self):
        return self._is_done

    def has_requested_cancellation(self):
        return self._has_requested_cancellation

    def request_cancellation(self):
        self._has_requested_cancellation = True
        self.thread.join(timeout=3)

    def start_work(self):
        self.thread = threading.Thread(target=self.do_work)
        self.thread.start()

    def set_internal_state_to_working(self):
        self._is_working = True
        self._is_done = False
        self._is_cancelled = False

    def set_internal_state_to_done(self, result):
        self._is_working = False
        self._is_done = True
        self._is_cancelled = False
        self.result = result
        update_component(self.ghenv, 1)

    def set_internal_state_to_cancelled(self):
        self._is_working = False
        self._is_done = False
        self._is_cancelled = True
        
    def do_work(self):
        pass

    def display_progress(self, progress):
        self.display_message("Progress {:.1f}%".format(progress * 100))

    def display_message(self, message):
        def ui_callback():
            self.ghenv.Component.Message = message
            self.ghenv.Component.OnDisplayExpired(True)
        Rhino.RhinoApp.InvokeOnUiThread(System.Action(ui_callback))

    @classmethod
    def instance_by_component(cls, ghenv, force_new=False):
        """Get the worker instance assigned to the component.
        
        This will get a persistant instance of a background worker
        for a given component. For debugging purposes, `force_new` can
        be set to `True` to request a new instance to be created.
        """
        key = create_id(ghenv.Component, 'background_worker')
        worker = st.get(key)

        if worker and force_new:
            worker.request_cancellation()
            worker.display_message("Cancelled")
            del st[key]

        if not worker:
            worker = cls(ghenv)
            st[key] = worker
        
        return worker


class SimpleExampleBackgroundWorker(BackgroundWorker):
    def do_work(self):
        # This is only an example of how to write a "do_work" method in a background worker,
        # the code can do whatever, it can be blocking if needed, long/running, anything,
        # the important part is that it calls the methods `set_internal_state_to_*`
        # at the right times
        self.set_internal_state_to_working()

        t = 200
        result = dict()
        for i in range(t):
            if self.has_requested_cancellation():
                self.display_message("Cancelled")
                self.set_internal_state_to_cancelled()
                break

            self.display_progress(i / (t-1))
            time.sleep(.1)

            result['a'] = "Counted up to {}".format(t)

        self.set_internal_state_to_done(result)




class SubscriberBackgroundWorker(BackgroundWorker):
    def do_work(self):
        self.set_internal_state_to_working()
        results = {"messages": []}
        self.messages = results["messages"]
        
        def on_message(message):
            try:
                results["messages"].append(message)
                update_component(self.ghenv, 1)
            except Exception as e:
                self.display_message("Exception: {}".format(e))

        tx = MqttTransport(self.host)
        subscriber = Subscriber(Topic(self.topic, Message), callback=on_message, transport=tx)
        subscriber.subscribe()

        try:
            self.display_message("Starting...")
            while True:
                self.display_message("Received {} messages".format(len(results["messages"])))
                if self.has_requested_cancellation():
                    self.display_message("Cancelled")
                    self.set_internal_state_to_cancelled()
                    break
                
                time.sleep(0.5)
        except Exception as e:
            self.display_message("Exception in threaded worker: " + str(e))
        finally:
            subscriber.unsubscribe()

        self.set_internal_state_to_done(results)

class SubscriberComponent(component):
    def RunScript(self, host, topic, reset):
        self.worker = SubscriberBackgroundWorker.instance_by_component(ghenv, force_new=reset)
        self.worker.host = host
        self.worker.topic = topic

        if not self.worker.is_working() and not self.worker.is_done():
            self.worker.display_message("Starting work..")
            time.sleep(.5)

            self.worker.start_work()

        print("is_working", self.worker.is_working())
        print("is_done", self.worker.is_done())

        last_message = None
        if hasattr(self.worker, "messages") and len(self.worker.messages):
            last_message = self.worker.messages[-1].data
            print (last_message)
            #print("Received {} total messages".format(len(self.worker.messages)))
#            for msg in self.worker.messages:
#                print("Request #{}".format(msg))

        return (last_message, )
# ---------- end mqtt_subscriber ----------
panel_11 = Panel(mqtt_subscriber.out)

# ----
# >> Subscriber | Compute
panel_12 = Panel("/caa_calculate_trajectory/")
mqtt_subscriber_2 = MQTTSubscriber(host=panel_9, topic=panel_12, reset=Button())  # -> out, last_message
# ---------- mqtt_subscriber_2: Python ----------
from __future__ import print_function
import time
import json
import random
import threading
from System.Threading.Tasks import Task
from System.Threading import ManualResetEventSlim

from ghpythonlib.componentbase import executingcomponent as component
from scriptcontext import sticky as st

from compas_eve import Message, Topic, Subscriber
from compas_eve.mqtt import MqttTransport
from compas_fab.ghpython.components import create_id
from compas_ghpython import update_component

import Rhino
import System


class BackgroundWorker(object):
    def __init__(self, ghenv):
        super(BackgroundWorker, self).__init__()
        self.ghenv = ghenv
        self._is_working = False
        self._is_done = False
        self._is_cancelled = False
        self._has_requested_cancellation = False

    def is_working(self):
        return self._is_working

    def is_done(self):
        return self._is_done

    def has_requested_cancellation(self):
        return self._has_requested_cancellation

    def request_cancellation(self):
        self._has_requested_cancellation = True
        self.thread.join(timeout=3)

    def start_work(self):
        self.thread = threading.Thread(target=self.do_work)
        self.thread.start()

    def set_internal_state_to_working(self):
        self._is_working = True
        self._is_done = False
        self._is_cancelled = False

    def set_internal_state_to_done(self, result):
        self._is_working = False
        self._is_done = True
        self._is_cancelled = False
        self.result = result
        update_component(self.ghenv, 1)

    def set_internal_state_to_cancelled(self):
        self._is_working = False
        self._is_done = False
        self._is_cancelled = True
        
    def do_work(self):
        pass

    def display_progress(self, progress):
        self.display_message("Progress {:.1f}%".format(progress * 100))

    def display_message(self, message):
        def ui_callback():
            self.ghenv.Component.Message = message
            self.ghenv.Component.OnDisplayExpired(True)
        Rhino.RhinoApp.InvokeOnUiThread(System.Action(ui_callback))

    @classmethod
    def instance_by_component(cls, ghenv, force_new=False):
        """Get the worker instance assigned to the component.
        
        This will get a persistant instance of a background worker
        for a given component. For debugging purposes, `force_new` can
        be set to `True` to request a new instance to be created.
        """
        key = create_id(ghenv.Component, 'background_worker')
        worker = st.get(key)

        if worker and force_new:
            worker.request_cancellation()
            worker.display_message("Cancelled")
            del st[key]

        if not worker:
            worker = cls(ghenv)
            st[key] = worker
        
        return worker


class SimpleExampleBackgroundWorker(BackgroundWorker):
    def do_work(self):
        # This is only an example of how to write a "do_work" method in a background worker,
        # the code can do whatever, it can be blocking if needed, long/running, anything,
        # the important part is that it calls the methods `set_internal_state_to_*`
        # at the right times
        self.set_internal_state_to_working()

        t = 200
        result = dict()
        for i in range(t):
            if self.has_requested_cancellation():
                self.display_message("Cancelled")
                self.set_internal_state_to_cancelled()
                break

            self.display_progress(i / (t-1))
            time.sleep(.1)

            result['a'] = "Counted up to {}".format(t)

        self.set_internal_state_to_done(result)




class SubscriberBackgroundWorker(BackgroundWorker):
    def do_work(self):
        self.set_internal_state_to_working()
        results = {"messages": []}
        self.messages = results["messages"]
        
        def on_message(message):
            try:
                results["messages"].append(message)
                update_component(self.ghenv, 1)
            except Exception as e:
                self.display_message("Exception: {}".format(e))

        tx = MqttTransport(self.host)
        subscriber = Subscriber(Topic(self.topic, Message), callback=on_message, transport=tx)
        subscriber.subscribe()

        try:
            self.display_message("Starting...")
            while True:
                self.display_message("Received {} messages".format(len(results["messages"])))
                if self.has_requested_cancellation():
                    self.display_message("Cancelled")
                    self.set_internal_state_to_cancelled()
                    break
                
                time.sleep(0.5)
        except Exception as e:
            self.display_message("Exception in threaded worker: " + str(e))
        finally:
            subscriber.unsubscribe()

        self.set_internal_state_to_done(results)

class SubscriberComponent(component):
    def RunScript(self, host, topic, reset):
        self.worker = SubscriberBackgroundWorker.instance_by_component(ghenv, force_new=reset)
        self.worker.host = host
        self.worker.topic = topic

        if not self.worker.is_working() and not self.worker.is_done():
            self.worker.display_message("Starting work..")
            time.sleep(.5)

            self.worker.start_work()

        print("is_working", self.worker.is_working())
        print("is_done", self.worker.is_done())
        
        last_message = None
        if hasattr(self.worker, "messages") and len(self.worker.messages):
            last_message = self.worker.messages[-1].data
            print (last_message)
            #print("Received {} total messages".format(len(self.worker.messages)))
#            for msg in self.worker.messages:
#                print("Request #{}".format(msg))

        return (last_message, )
# ---------- end mqtt_subscriber_2 ----------
panel_13 = Panel(mqtt_subscriber_2.out)

# ----
# >> Subscriber | Execute
panel_14 = Panel("/caa_execute_trajectory/")
mqtt_subscriber_3 = MQTTSubscriber(host=panel_9, topic=panel_14, reset=Button())  # -> out, last_message; same code as mqtt_subscriber
panel_15 = Panel(mqtt_subscriber_3.out)

# ----
# Calculate Trajectory
ghpython_script_2 = GhPythonScript(
    calculate_trajectory_message=ghpython_script.b,
    calculate_topic_name=panel_12,
    safety_topic_name=panel_10,
    actual_robot_name=robot_name)  # -> out, calculate_trajectory
# ---------- ghpython_script_2: Python ----------
from scriptcontext import sticky as st

if not calculate_trajectory_message:
    ghenv.Component.Message = "No Message has been sent"

else:
    execute = calculate_trajectory_message['execute']
    index = calculate_trajectory_message['index']
    planned_robot_name = calculate_trajectory_message['robot_name']
    count = calculate_trajectory_message['count']
    
    current_index = st['current_index_key' + safety_topic_name]
    message_index = st['message_index_key'+ safety_topic_name]
    
    send_calculate_key = 'send_calculate_key' + calculate_topic_name
    
    print type(current_index)
    print type(message_index)
    print type(index)
    print execute

#If condition for seperating messages. ROBOT NAME NEEDS TO BE THE ROBOT THAT THIS FILE IS PLANNING FOR
    if planned_robot_name == actual_robot_name:
        #Check index against the sticky
        if execute and str(index) == str(message_index) and str(index) == current_index:
            st[send_calculate_key] = True
            calculate_trajectory = True
            ghenv.Component.Message = "Message Sent"
        
        #Throw error if condition
        elif execute == False:
            ghenv.Component.Message = "You received a false"
        
        #Throw error if condition
        elif str(index) != str(message_index):
            ghenv.Component.Message = "Your message index does not match place message index"
        
        #Throw error if condition
        else:
            ghenv.Component.Message = "Message Index DOES NOT match Firebase Index"
            raise Exception("Your message index DOES NOT match Firebase Index")
    else:
        ghenv.Component.Message = "THIS MESSAGE IS NOT FOR THIS ROBOT"
# ---------- end ghpython_script_2 ----------

# ----
# MQTT | Message Receiver
# Update Design Info & Place Config
ghpython_script_3 = GhPythonScript(
    get_place_message=ghpython_script.a,
    place_topic_name=panel_10,
    actual_robot_name=robot_name,
    calculate_topic_name=panel_12)  # -> out, info_update, count, index
# ---------- ghpython_script_3: Python ----------
from scriptcontext import sticky as st

message_index_key = 'message_index_key' + place_topic_name
reversed_motion_configs_key = 'reversed_motion_configs_key' + calculate_topic_name

if not get_place_message:
    ghenv.Component.Message = "No Message has been sent"

else:
    execute = get_place_message['execute']
    index = get_place_message['index']
    planned_robot_name = get_place_message['robot_name']
    count = get_place_message['count']

#If condition for seperating messages. ROBOT NAME NEEDS TO BE THE ROBOT THAT THIS FILE IS PLANNING FOR
    if planned_robot_name == actual_robot_name:
        
        if index != st[message_index_key]:
            st[message_index_key] = index
        
        
        #If your current index is the same and your count is 0 make reversed configs sticky []
        #This is confusing, but acts as a safety net for if we push the emergency stop for the robot 
        #in the middle of a trajectory
        
        elif index == st[message_index_key] and count == 0:
            st[reversed_motion_configs_key] = None
        
        #Check index against the sticky
        if execute:
            info_update = True
            ghenv.Component.Message = "Message Sent"
            
            if count > 0:
                ghenv.Component.Message = "Update Place Frame Message"
        
        elif execute == False:
            ghenv.Component.Message = "You received a false"
    
    else:
        ghenv.Component.Message = "THIS MESSAGE IS NOT FOR THIS ROBOT"
# ---------- end ghpython_script_3 ----------

# ----
# Send Trajectory
ghpython_script_4 = GhPythonScript(
    send_trajectory_message=mqtt_subscriber_3.last_message,
    send_topic_name=panel_14,
    safety_topic_name=panel_10,
    actual_robot_name=robot_name)  # -> out, send_trajectory
# ---------- ghpython_script_4: Python ----------
from scriptcontext import sticky as st

if not send_trajectory_message:
    ghenv.Component.Message = "No Message has been sent"

else:
    execute = send_trajectory_message['execute']
    index = send_trajectory_message['index']
    planned_robot_name = send_trajectory_message['robot_name']
    count = send_trajectory_message['count']
    
    current_index = st['current_index_key' + safety_topic_name]
    message_index = st['message_index_key' + safety_topic_name]
    
    print type(current_index)
    print type(message_index)
    print type(index)
    print execute
    
#If condition for seperating messages. ROBOT NAME NEEDS TO BE THE ROBOT THAT THIS FILE IS PLANNING FOR
    if planned_robot_name == actual_robot_name:
        send_trajectory_key = 'send_trajectory_key' + send_topic_name
        
        #Check index against the sticky
        if execute and str(index) == str(message_index) and str(index) == current_index:
            st[send_trajectory_key] = True
            send_trajectory = True
            ghenv.Component.Message = "Message Sent"
        
        elif execute == False:
            ghenv.Component.Message = "You received a false"
        
        elif str(index) != str(message_index):
            ghenv.Component.Message = "Your message index does not match place message index"
        
        else:
            ghenv.Component.Message = "Message Index DOES NOT match Firebase Index"
            raise Exception("Message Index DOES NOT match Firebase Index")
    
    
    else:
        ghenv.Component.Message = "THIS MESSAGE IS NOT FOR THIS ROBOT"
# ---------- end ghpython_script_4 ----------

# ----
# 2. Get Design Information
read = GhPythonScript(
    path=data,
    connect=ghpython_script_3.info_update,
    count=ghpython_script_3.count,
    parent_name="Design",
    child_name=panel_8,
    place_topic_name=panel_10)  # -> out, realtime_json_data, current_index, cm_update; inputs connect: Boolean
# ---------- read: Python ----------
#import os
#from compas.rpc import Proxy
#
#if connect:
#    p = Proxy(package = 'cdf_unity.firebase.realtime_database', path=path +'\src')
#    
#    p.stop_server()
#    p.start_server()
#    
#    stored_json.update({"node": p.get_json_data("Design", "node")})
#    realtime_json_data = [stored_json]
#    current_index = p.get_json_data("Design", "currentstick")

import os
from compas.rpc import Proxy
from scriptcontext import sticky as st

#ADD STICKY FIRST

current_index_key = 'current_index_key' + place_topic_name
design_data_key = 'design_data_key' + place_topic_name

if connect:
    if count > 0:
        cm_update = False
        current_index = st[current_index_key]
        realtime_json_data = st[design_data_key]
        
    else:
        p = Proxy(package = 'cdf_2023.firebase.realtime_database', path=path +'\src')
        p.stop_server()
        p.start_server()
        
        # retreive current design and current index
        realtime_json_data = [p.get_json_data(parent_name, child_name)]
        current_index = p.get_json_data(parent_name, "currentstick")
        
        #Update Collision Meshes
        cm_update = True
        
        #store design and current index in the sticky
        st[current_index_key] = current_index
        st[design_data_key] = realtime_json_data
# ---------- end read ----------
panel_16 = Panel(read.out)
currentstick = Panel(read.current_index)

# ----
# Fake Mesh for List Issue
# Geometry for Collision 35
cluster = Cluster(radius=radius, data=length)
mesh_2 = Mesh(cluster)

# ----
# FOC CM: Lengths
# ACHTUNG: Zero is needed because type list starts at 1 instead of the GH zero
panel_17 = Panel("""0
0.35""")

clear_st = Button()
# Sticky Management | Planning
add_st = Button()
# MAKE STICKY_CALCULATE_FALSE
print_st = Button()
ghpython_script_5 = GhPythonScript(
    place_topic_name=panel_10,
    calculate_topic_name=panel_12,
    send_topic_name=panel_14,
    add=add_st,
    clear=clear_st,
    print_current_st=print_st)  # -> out, a; inputs add: Boolean
# ---------- ghpython_script_5: Python ----------
from scriptcontext import sticky as st

send_calculate_key = 'send_calculate_key' + calculate_topic_name
planning_failure_key = 'planning_failure_key' + calculate_topic_name
send_trajectory_key = 'send_trajectory_key' + send_topic_name
current_index_key = 'current_index_key' + place_topic_name
place_config_index_key = 'place_config_index_key' + place_topic_name
#cannot put +topic name because it breaks the list and string
design_data_key = 'design_data_key' + place_topic_name
message_index_key = 'message_index_key' + place_topic_name
reversed_motion_configs_key = 'reversed_motion_configs_key' + calculate_topic_name


if add:
    #### ADD STICKYS NEEDED FOR PLACE TOPIC
    
    #SAFETY
    st[message_index_key] = None
    
    #FIREBASE
    st[current_index_key] = None
    st[design_data_key] = None
    
    #### ADD STICKY FOR PLACE CONFIG COUNTER
    st[place_config_index_key] = False
    
    #### ADD STICKYS FOR CALCULATE TOPIC
    st[send_calculate_key] = False
    
    #### ADD STICKEYS FOR SEND TOPIC
    st[send_trajectory_key] = False
    
    #### ADD STICKEYS FOR SEND TOPIC
    st[planning_failure_key] = False
    
    ### ADD REVERSED MOTION CONFIGS TO THE STICKY
    st[reversed_motion_configs_key] = None

elif clear:
    st.clear()

elif print_current_st:
    a = [message_index_key, st[message_index_key], current_index_key, st[current_index_key], design_data_key, st[send_trajectory_key], send_calculate_key, st[send_calculate_key], send_trajectory_key, st[send_trajectory_key], planning_failure_key, st[planning_failure_key], reversed_motion_configs_key, st[reversed_motion_configs_key]]
    print st
print st
a = [message_index_key, st[message_index_key], current_index_key, st[current_index_key], design_data_key, st[send_trajectory_key], send_calculate_key, st[send_calculate_key], send_trajectory_key, st[send_trajectory_key], planning_failure_key, st[planning_failure_key], reversed_motion_configs_key, st[reversed_motion_configs_key]]
# ---------- end ghpython_script_5 ----------

ghpython_script_6 = GhPythonScript(add=Button(), calculate_topic_name=panel_12)  # -> out, a
# ---------- ghpython_script_6: Python ----------
from scriptcontext import sticky as st

send_calculate_key = 'send_calculate_key' + calculate_topic_name

if add:
        st[send_calculate_key] = False
# ---------- end ghpython_script_6 ----------

# ----
# PRINT STICKY_CALCULATE
button = Button()
ghpython_script_7 = GhPythonScript(add=button, calculate_topic_name=panel_12)  # -> out, a
# ---------- ghpython_script_7: Python ----------
from scriptcontext import sticky as st

send_calculate_key = 'send_calculate_key' + calculate_topic_name

if add:
        a= st[send_calculate_key]
# ---------- end ghpython_script_7 ----------

radius_2 = Slider(0.005, range=0..100)

# ---- group: Previous Large Stick
mesh_3 = Mesh(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)

# ----
bcf_wcs_ab_0 = Plane(Plane(origin=(0.9896612368, 0.9287122403, 0.007218178072), x=(-0.9475576884, 0.3195482043, -0.004834489242), y=(-0.3195383255, -0.9475694642, -0.002714584304)))

# ----
# FOC CM
# ACHTUNG: Fake Mesh is needed because type list starts at 1 instead of the GH zero
merge = Merge(Data1=mesh, Data2=mesh_2)

# ----
# Get Information from Firebase: Real time database
# Design Data
# 3. Instantiate Geometry
data_2 = Data(read.realtime_json_data)

panel_18 = Panel(ghpython_script_7.a)
panel_19 = Panel(ghpython_script_5.out)
panel_20 = Panel(ghpython_script_5.a)

# ----
# Import and make frames and geometry from JSON
ghpython_script_8 = GhPythonScript(json=data_2, current_stick_index=currentstick, radius=radius_2, lengths=panel_17, collision_meshes=merge)  # -> out, current_stick_plane, planes, built_sticks, unbuilt_sticks, human_robot, sticks_cm, current_stick_type; inputs current_stick_index: Int32, lengths: list, collision_meshes: list of Mesh
# ---------- ghpython_script_8: Python ----------
import compas.geometry
from compas.geometry import Vector
from compas.geometry import scale_vector, add_vectors
from compas import json_load
from compas_rhino.conversions import RhinoMesh
from compas_rhino.conversions import cylinder_to_rhino
from compas.artists import Artist

def offset_frame(frame, length):
    
    offset_frame = frame.copy()
    
    if length > 0:
        frame_normal = offset_frame.normal
        frame_normal_scaled = scale_vector(frame_normal, length)
        new_frame_origin = add_vectors(offset_frame.point, frame_normal_scaled)
        offset_frame = compas.geometry.Frame(new_frame_origin, offset_frame.xaxis, offset_frame.yaxis)
        
    return offset_frame

planes=[]
built_sticks = []
unbuilt_sticks = []
sticks_cm = []
human_robot = []

print 

length = len(json)

for i in range(length-1):
    point = json[str(i)]['element']['frame']['point']
    xaxis = json[str(i)]['element']['frame']['xaxis']
    yaxis = json[str(i)]['element']['frame']['yaxis']
    zaxis = Vector.cross(Vector(xaxis[0],xaxis[1], xaxis[2]), Vector(yaxis[0], yaxis[1], yaxis[2]))
    frame = compas.geometry.Frame(point, xaxis, yaxis)
    plane = Artist(frame).draw()
    planes.append(plane)
    status = json[str(i)]["is_built"]
    builder = json[str(i)]["placed_by"]
    print i
    print json[str(i)]
    stick_type = json[str(i)]["type"]
    print stick_type
    
    instance_frame = compas.geometry.Frame(point, zaxis, yaxis)
    cylinder_frame = offset_frame(instance_frame, ((lengths[stick_type]/2)*-1))
    #print lengths[stick_type]
    circle = compas.geometry.Circle(compas.geometry.Plane.from_frame(instance_frame), radius)
    compas_stick = compas.geometry.Cylinder(circle, lengths[stick_type])
    stick = cylinder_to_rhino(compas_stick)
    
    stick_cm = collision_meshes[stick_type]
    compas_mesh = RhinoMesh.from_geometry(stick_cm).to_compas()
    #print (compas_mesh)
    world_frame = compas.geometry.Frame.worldXY()
    transformation = compas.geometry.Transformation.from_frame_to_frame(world_frame, frame)
    stick_cm = compas_mesh.transformed(transformation)
    stick_cm = Artist(stick_cm).draw()
    #print (stick_cm)
    
    if i == current_stick_index:
        current_stick_plane = plane
        current_stick_type = stick_type
    
    if status:
        sticks_cm.append(stick_cm)
        built_sticks.append(stick)
        
    else:
        unbuilt_sticks.append(stick)
        
        if builder == "human" :
            human_robot.append(True)
        else:
            human_robot.append(False)
# ---------- end ghpython_script_8 ----------

# ----
# Configuration
l = Slider(0, range=0..0.72)
select_configuration = Slider(0, range=0..7)
index_from_app = Integer(ghpython_script_3.count)

geo = Geometry(ghpython_script_8.unbuilt_sticks)
dispatch = Dispatch(List=geo, DispatchPattern=ghpython_script_8.human_robot)  # -> ListA, ListB

# ----
# Unbuilt_human
colour_swatch = ColourSwatch(SwatchColor=RGBA(253, 255, 0, 154))
custom_preview = CustomPreview(Geometry=dispatch.ListA, Material=colour_swatch)

# ----
# Unbuilt_robot
colour_swatch_2 = ColourSwatch(SwatchColor=RGBA(0, 255, 255, 111))
custom_preview_2 = CustomPreview(Geometry=dispatch.ListB, Material=colour_swatch_2)

# ----
# Built_Collision
colour_swatch_3 = ColourSwatch(SwatchColor=RGBA(94, 94, 94, 27))
custom_preview_3 = CustomPreview(Geometry=ghpython_script_8.sticks_cm, Material=colour_swatch_3)

# ----
# indices
deconstruct_plane = DeconstructPlane(Plane=ghpython_script_8.planes)  # -> Origin, XAxis, YAxis, ZAxis
# All Elements
point_list = PointList(Points=deconstruct_plane.Origin, Size=Slider(0.05, range=0..1))

# ----
# Built
colour_swatch_4 = ColourSwatch(SwatchColor=RGBA(94, 94, 94, 226))
custom_preview_4 = CustomPreview(Geometry=ghpython_script_8.built_sticks, Material=colour_swatch_4)

# ----
# Current_stick_plane
plane = Plane(ghpython_script_8.current_stick_plane)
ghpython_script_9 = GhPythonScript(plane=plane)  # -> out, adjusted_plane; inputs plane: Plane
# ---------- ghpython_script_9: Python ----------
import Rhino.Geometry as rg
import math

world_z_vector = rg.Vector3d.ZAxis

plane_x_axis = plane.XAxis

#Dot Product comparison
dot_product = rg.Vector3d.Multiply(world_z_vector, plane_x_axis)


if dot_product > 0:
    adjusted_plane = plane

else:
    angle = math.radians(180)
    rotation_axis = plane.ZAxis
    rotated_plane = plane.Clone()
    rotated_plane.Rotate(angle, rotation_axis, plane.Origin)
    adjusted_plane = rotated_plane
# ---------- end ghpython_script_9 ----------

plane_from_app = Plane(plane)
configuration = Slider(14, range=-1..50)
list_2 = ValueList({"ur10e", "ur10e_and_liftkit"}, selected="ur10e")
show_robot_frame = BooleanToggle(False)

# ----
# Get the 'current key' from Realtime Database
panel_21 = Panel("C:\Users\lidet\workspace\projects\cdf_2023")
connect_2 = BooleanToggle(False)
get = Button()
data_3 = Data(panel_21)
read_2 = GhPythonScript(path=data_3, connect=connect_2, get_current_key=get)  # -> out, current_index; inputs connect: Boolean, get_current_key: Boolean
# ---------- read_2: Python ----------
import os
from scriptcontext import sticky
import Grasshopper as gh
from compas.rpc import Proxy
import scriptcontext as rs

if "current_stick" not in sticky:
    sticky["current_stick"] = 0


if connect:
    p = Proxy(package = 'cdf_2023.firebase.realtime_database', path=path +'\src')
    
    p.stop_server()
    p.start_server()
    if get_current_key:
        sticky["current_stick"] = p.get_json_data("Design", "currentstick")
    current_index = int(sticky["current_stick"])

print type(current_index)
# ---------- end read_2 ----------
currentstick_2 = Panel(read_2.current_index)

# ----
# Load assembly model
# Import assembly from .json.
import = Button(ExpressionNormal="True", ExpressionPressed="False")
initial_assembly = GhPythonScript(DATA=py.DATA, filename="Prototype_DATA_FINAL_assembly_45_2024-03-29_21-03.json", import_from_json=import)  # -> out, assembly; inputs import_from_json: Boolean
# ---------- initial_assembly: Python ----------
import os
import json
from scriptcontext import sticky

from cdf_2023.assembly import Assembly

if import_from_json:
    PATH = os.path.join(DATA, "assembly", filename)
    assembly = Assembly.from_json(PATH)
    assembly.support_keys = []

# create a dictionary to store global value in 
assembly.globals = {}

# define global values
#assembly.globals['rod_radius'] = 0.011
#assembly.globals['rod_length'] = 0.6
#assembly.globals['rf_unit_offset'] = 0.2
#assembly.globals['rf_unit_radius'] = 0.15       

assembly.globals['joint_dist'] = 0.0076
assembly.globals['rod_length'] = 0.35
assembly.globals['rod_radius'] = 0.005

print assembly.element(35).trajectory
# ---------- end initial_assembly ----------

key = Slider(141, range=0..388)
till_key = Button()
reset = Button()
start = Button()
stop = Button()
step = Button()
full = Button()
list_3 = ValueList({"20", "50", "100", "500", "1000", "5000"}, selected="50")

back = Button()
counter = CountThroughList(
    assembly=initial_assembly.assembly,
    start=start,
    stop=stop,
    step=step,
    step_back=back,
    reset=reset,
    full=full,
    till_key=till_key,
    key=key,
    interval=list_3)  # -> item, counter; inputs start: Boolean, stop: Boolean, step_back: Boolean, key: Int32
# ---------- counter: Python ----------
from scriptcontext import sticky as st
from compas_ghpython import update_component


L = list(assembly.elements())
# store data in component
guid = str(ghenv.Component.InstanceGuid)
counter_key = "counter_" + guid
running_key = "running_" + guid

if counter_key not in st:
    st[counter_key] = 0

if running_key not in st:
    st[running_key] = False
    

if st[running_key]:
    if st[counter_key] < len(L) - 1:
        st[counter_key] += 1
        update_component(ghenv, interval)
    else:
        st[counter_key] = 0
        st[running_key] = False
    
    
if start:
    st[running_key] = True

if stop:
    st[running_key] = False

if step:
    if st[counter_key] < len(L) - 1:
        st[counter_key] += 1

if step_back:
    if st[counter_key] < len(L):
        st[counter_key] -= 1

if reset:
    st[counter_key] = 0

if till_key:
    st[counter_key] = key

if full:
    st[counter_key] = len(L)-1

if len(L):
    item = L[st[counter_key]]



#st["visualisation_counter"] = st[counter_key]
#st[counter_key]= 500
counter = st[counter_key]
# ---------- end counter ----------

counter_2 = Panel(counter.counter)

# ----
# Stop
stop_2 = Button()
stop_3 = PythonScript(stop=stop_2)
# ---------- stop_3: Python ----------
from scriptcontext import sticky as st
from ur_fabrication_control.direct_control.common import send_stop

ur_ip = st["ur_ip"]
ur_port = st["ur_port"]

if stop:
    send_stop(ur_ip, ur_port)
# ---------- end stop_3 ----------

stats = GhPythonScript(assembly=initial_assembly.assembly)  # -> out
# ---------- stats: Python ----------
total_elements = assembly.network.number_of_nodes()
planned_keys = list(assembly.network.nodes_where({'is_planned':True}))
built_keys = list(assembly.network.nodes_where({'is_built':True}))
support_keys = list(assembly.network.nodes_where({'is_support':True}))

print total_elements, "element(s) in assembly."
print len(built_keys), "element(s) are already built."
print len(planned_keys), "element(s) are planned."
print len(support_keys), "element(s) are suppports."
# ---------- end stats ----------
numbers = Panel(stats)

show = BooleanToggle(True)
show_2 = BooleanToggle(True)

# ----
# Parallel Gripper Switch
open = BooleanToggle(False)
digital_out = PythonScript(open=open)  # -> urscript
# ---------- digital_out: Python ----------
from ur_fabrication_control.direct_control import URScript
from ur_fabrication_control.direct_control.mixins import ParallelGripMixins

class URScript_ParallelGrip(URScript, ParallelGripMixins):
    pass

urscript = URScript_ParallelGrip()
urscript.start()

if open:
    # Open State
    urscript.parallelgrip_open()
else: 
    # Closed State
    urscript.parallelgrip_close()

urscript.end()
urscript = urscript.generate()
print(urscript)
# ---------- end digital_out ----------
send = Button()
send_2 = GhPythonScript(urscript=digital_out, send=send)  # -> out; inputs send: Boolean
# ---------- send_2: Python ----------
from scriptcontext import sticky as st
from ur_fabrication_control.direct_control import send_script

ur_ip = st["ur_ip"]
ur_port = st["ur_port"]

print ur_ip

if send:
    send_script(urscript, ur_ip, ur_port)
# ---------- end send_2 ----------

# ----
# Stop
stop_4 = Button()
stop_5 = PythonScript(stop=stop_4)  # same code as stop_3

# ----
# Assembly visualization
# 1. Visualize assembly.
# 2. Visualize selected element.
# 3. Visuilize built/planned and supports.
show_3 = BooleanToggle(False)
show_4 = BooleanToggle(False)
show_5 = BooleanToggle(False)
show_6 = BooleanToggle(True)
show_7 = BooleanToggle(False)
number_slider_2 = Slider(109, range=0..360)  # disabled
assembly_viz = PythonScript(
    assembly=initial_assembly.assembly,
    show_assembly=show_3,
    show_built=show_4,
    show_supports=show_5,
    show_selected=show_6,
    show_counter=show,
    show_keys_till_selected=show_2,
    show_keys=show_7,
    current_key=counter.counter)  # -> out, G_placed_by_robot, G_placed_by_human, G_built, G_elements, G_selected, key_tag_location, key_tag_text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; inputs current_key: Int32
# ---------- assembly_viz: Python ----------
import os
import sys
from scriptcontext import sticky as st
import Rhino.Geometry as rg

import math

from compas.artists import Artist
from compas.colors import Color
from compas_ghpython import draw_frame
from compas_rhino.conversions import cylinder_to_rhino, frame_to_rhino

G_elements = []
G_placed_by_robot = []
G_placed_by_human = []

flip = 'AA'

key_tag_text = []
key_tag_location= []

# Color coding
color_coding = {'color_close_pairs': Color(1.0, 0., 0.0, 1.0),
                'color_is_planned': Color(1.0, 0.752941176471, 0.0, 1.0), 
                'color_is_support': Color(0.0, 0.0, 1.0, 1.0), 
                'color_has_open_connector': Color(0.494117647059, 1.0, 0.239215686275, 1.0), 
                'color_has_no_open_connectors': Color(0.78431372549, 0.78431372549, 0.78431372549, 1.0), 
                'color_is_built': Color(0.811764705882, 1.0, 0.709803921569, 1.0), 
                'color_is_built_by_robot': Color(0.686274509804, 0.878431372549, 0.862745098039, 1.0), 
                'color_is_built_by_human': Color(0.949019607843, 0.898039215686, 0.0, 1.0)}


def show(element, output_geo, color):
    mesh = Artist(element.mesh).draw(color)
    output_geo.append(mesh)

def show_multiple(elements, output_geo, color):
    for element in elements:
        mesh = Artist(element.mesh).draw(color)
        output_geo.append(mesh)

key_index = assembly.network.key_index()
#keys = [key_index[key] for key in assembly.network.nodes()]
keys = [key for key in assembly.network.nodes()]
elements = [assembly.element(key) for key in keys]

robot_keys = list(assembly.network.nodes_where({'placed_by':'robot'}))
human_keys = list(assembly.network.nodes_where({'placed_by':'human'}))

robot_elements = [assembly.element(key) for key in robot_keys] 
human_elements = [assembly.element(key) for key in human_keys] 

if assembly:
    radius = assembly.globals['rod_radius']
    
    if current_key != None:
        current_element = assembly.element(current_key)
    else:
        current_element = None
        
    if show_selected: 
        G_selected = cylinder_to_rhino(assembly.element(current_key)._source)
        
    # Visualize assembly
    if show_assembly:
        for element in robot_elements:
            geo = cylinder_to_rhino(element._source)
            G_placed_by_robot.append(geo)
            
        for element in human_elements:
            geo = cylinder_to_rhino(element._source)
            G_placed_by_human.append(geo)


    selected_elem_plane = draw_frame(assembly.element(current_key).frame)
    
    if show_keys:
        for key, element in assembly.elements():
            if show_keys_till_selected and key < current_key+1:
                key_tag_text.append(str(key))
                key_tag_location.append(Artist(element.frame).draw().Origin)
            if not show_keys_till_selected:
                key_tag_text.append(str(key))
                key_tag_location.append(Artist(element.frame).draw().Origin)
    
if show_counter and not show_assembly:
    for element in elements[0:current_key+1]:
        geo = cylinder_to_rhino(element._source)
        G_elements.append(geo)
        
        
    
if assembly.network.node_attribute(current_key, 'robot_AA_base_frame') != False and assembly.network.node_attribute(current_key, 'robot_AB_base_frame') != False:
    robot_AA_base_plane = draw_frame(assembly.network.node_attribute(current_key, 'robot_AA_base_frame'))
    robot_AB_base_plane = draw_frame(assembly.network.node_attribute(current_key, 'robot_AB_base_frame'))
    robot_name = assembly.network.node_attribute(current_key, 'robot_name')
# ---------- end assembly_viz ----------
rot = GhPythonScript(plane=assembly_viz.selected_elem_plane, angle=number_slider_2)  # -> out, plane; disabled
# ---------- rot: Python ----------
import math
from compas.geometry import Frame, Rotation
from compas.artists import Artist

frame = Frame(plane.Origin, plane.XAxis, plane.YAxis)

R = Rotation.from_axis_and_angle(frame.xaxis, math.radians(angle), frame.point)
frame.transform(R)

plane = Artist(frame).draw()
# ---------- end rot ----------
tag = TextTag(Location=assembly_viz.key_tag_location, Text=assembly_viz.key_tag_text)
geo_2 = Geometry(assembly_viz.G_placed_by_robot)
geo_3 = Geometry(assembly_viz.G_elements)
geo_4 = Geometry(assembly_viz.G_selected)
geo_5 = Geometry(assembly_viz.G_placed_by_human)
colour_swatch_5 = ColourSwatch(SwatchColor=RGBA(199, 199, 199, 89))
preview = CustomPreview(Geometry=geo_5, Material=ColourSwatch(SwatchColor=RGB(242, 229, 0)))
preview_2 = CustomPreview(Geometry=geo_2, Material=ColourSwatch(SwatchColor=RGB(175, 224, 220)))
preview_3 = CustomPreview(Geometry=geo_3, Material=ColourSwatch(SwatchColor=RGB(255, 235, 199)))
preview_4 = CustomPreview(Geometry=geo_4, Material=ColourSwatch(SwatchColor=RGB(0, 0, 255)))

pln = Plane(assembly_viz.robot_AA_base_plane)
pln_2 = Plane(assembly_viz.robot_AB_base_plane)
pln_3 = Plane(assembly_viz.selected_elem_plane)
plane_from_local_model = Plane(pln_3)

# ----
# Network visualization
number_slider_3 = Slider(0, range=0..47)
show_8 = BooleanToggle(False)
network_viz = GhPythonScript(assembly=initial_assembly.assembly, show_network=show_8, key=number_slider_3)  # -> out, nodes, edges, current_node, current_node_neighbors; inputs key: Int32
# ---------- network_viz: Python ----------
import sys, os
import ghpythonlib.components as ghcomp
from compas.datastructures import Network
from compas_ghpython.artists import NetworkArtist
from compas_rhino.geometry import RhinoLine

import compas_ghpython
import Rhino.Geometry as rg


data = assembly.network.to_data()
network = Network.from_data(data)

print assembly.network.number_of_nodes()

def draw_network(network):
    """Draw a network in Grasshopper.
    """
    points = []
    for key, attr in network.nodes(True):
        points.append({
            'pos': network.node_coordinates(key),
        })

    lines = []
    for (u, v), attr in network.edges(True):
        lines.append({
            'start': network.node_coordinates(u),
            'end': network.node_coordinates(v),
        })

    points_rg = compas_ghpython.draw_points(points)
    lines_rg = compas_ghpython.draw_lines(lines)

    return points_rg, lines_rg

if show_network:
    nodes, edges = draw_network(network)
    
    current_node = {'pos': network.node_coordinates(key), 'radius': 0.03}
    current_node = compas_ghpython.draw_spheres([current_node])
    
    current_node_neighbors_keys = network.neighbors(key)
    current_node_neighbors = [{'pos': network.node_coordinates(key), 'radius': 0.02} for key in current_node_neighbors_keys]
    current_node_neighbors = compas_ghpython.draw_spheres(current_node_neighbors)
# ---------- end network_viz ----------
pt = Point(network_viz.nodes)
line = Line(network_viz.edges)
brep = Brep(network_viz.current_node)
brep_2 = Brep(network_viz.current_node_neighbors)
preview_5 = CustomPreview(Geometry=brep_2, Material=ColourSwatch(SwatchColor=RGB(255, 207, 207)))
preview_6 = CustomPreview(Geometry=[brep, line], Material=ColourSwatch(SwatchColor=RGB(0, 0, 0)))

export_with = ValueList({"index", "timestamp"}, selected="timestamp")

# ---- group: capture
viewport_name = Text("workflow_2")
capture_to_bitmap = PythonScript(DATA=py.DATA, capture=Button(), viewport_name=viewport_name, naming=export_with, idx=Slider(2, range=0..10))  # -> out, a; inputs capture: Boolean, idx: Int32
# ---------- capture_to_bitmap: Python ----------
import Rhino
import System.Drawing

import sys, os
import ghpythonlib.components as ghcomp
import Grasshopper as gh
from datetime import datetime


ghComp = ghenv.Component
ghDoc = ghComp.OnPingDocument()

def rCommonCap(filePath, viewportName,scaleFactor):
    RhinoDocument = Rhino.RhinoDoc.ActiveDoc
    view = RhinoDocument.Views.Find(viewportName, False)
    vp = view.ActiveViewport
    size = System.Drawing.Size(vp.Size.Width*scaleFactor,vp.Size.Height*scaleFactor)
    capture = view.CaptureToBitmap(size)
    capture.Save(filePath);

now = datetime.now() # current date and time
date_time = now.strftime("%Y_%m_%d_%H_%M_%S")

export_dir = os.path.join(DATA)
if not os.path.isdir(export_dir): os.mkdir(export_dir)
print export_dir

if naming == 'index':
    filename = os.path.join(export_dir, 'capture_' + str(idx) + '.png') 
else:
    filename = os.path.join(export_dir, 'capture_' + date_time + '.png') 
print filename

zoom = 1

if capture:
    rCommonCap(filename, viewport_name, zoom)
# ---------- end capture_to_bitmap ----------

# ----
# Export .json
export = Button()
export_2 = Button()
export_3 = PythonScript(DATA=py.DATA, assembly=initial_assembly.assembly, export_to_json=export, export_to_json_unity=export_2)
# ---------- export_3: Python ----------
import os
from compas.datastructures.mesh import mesh_quads_to_triangles
from compas.datastructures.mesh import mesh_unify_cycles

if export_to_json:
    filename = "assembly_example_02.json"
    PATH = os.path.join(DATA, "assembly", filename)
    
    # the assembly has to be serialized such that it can be called from CPython, True to enable pretty print
    assembly.to_json(PATH, True)
    

if export_to_json_unity:
    
    for key, e in assembly.elements():
    
        #convert to trimesh
        mesh_quads_to_triangles(e._mesh, check_angles=False)
        #mesh_unify_cycles(e._mesh)
        #print e._mesh.faces
        #print e._mesh.face_vertices(list(e._mesh.faces())[0])

    filename = "unity_assembly_test.json"
    PATH = os.path.join(DATA, "assembly", filename)
    assembly.to_json(PATH)
# ---------- end export_3 ----------

x_axis = Curve(<curve referenced from the Rhino model>)
y_axis = Curve(<curve referenced from the Rhino model>)
aa_est = PythonScript(plane_axes=[x_axis, y_axis])  # -> plane; inputs plane_axes: list of Curve
# ---------- aa_est: Python ----------
import Rhino.Geometry as rg

x_axis, y_axis = plane_axes

x_axis = rg.Line(x_axis.PointAtStart, x_axis.PointAtEnd)
y_axis = rg.Line(y_axis.PointAtStart, y_axis.PointAtEnd)

if x_axis.From.DistanceTo(y_axis.From) < 0.01:
    origin = x_axis.From
    xvec = x_axis.Direction
    yvec = y_axis.Direction
elif x_axis.To.DistanceTo(y_axis.To) < 0.01:
    origin = x_axis.To
    xvec = -x_axis.Direction
    yvec = -y_axis.Direction
elif x_axis.From.DistanceTo(y_axis.To) < 0.01:
    origin = x_axis.From
    xvec = x_axis.Direction
    yvec = -y_axis.Direction
elif x_axis.To.DistanceTo(y_axis.From) < 0.01:
    origin = x_axis.To
    xvec = -x_axis.Direction
    yvec = y_axis.Direction

plane = rg.Plane(origin, xvec, yvec)
# ---------- end aa_est ----------
pln_4 = Plane(aa_est)

# ----
# Attach tool
list_4 = ValueList({"measurement_tool": 0, "area_gripper": 1, "parallel_gripper": 2, "parallel_gripper_with_mtip": 3, "parallel_gripper_ethz": 4, "parallel_gripper_ethz_with_mtip": 5}, selected="parallel_gripper")
show_9 = BooleanToggle(True)
remove = Button()
add = Button()
py_3 = PythonScript()  # -> DATA
# ---------- py_3: Python ----------
import os

#package_path = os.path.dirname(mobile_fabrication_control.__file__)
#DATA = os.path.abspath(os.path.join(package_path,"../../data"))

package_path = ghdoc.Path
# package_path = os.path.dirname(ur_fabrication_control.__file__)
#DATA = os.path.abspath(os.path.join(package_path,"../../data"))

# .stl files not stored in am_hackathon repo. but in mobile_fabrication_control
DATA = os.path.abspath(os.path.join(package_path,"../../../mobile_robot_control/data"))

print(package_path)
print(DATA)
# ---------- end py_3 ----------
tool = PythonScript(data_path=py_3, tool=list_4, show=show_9)  # -> tool, M, ee_plane
# ---------- tool: Python ----------
import os, math
from compas.geometry import Frame, Rotation
from compas.datastructures import Mesh
from compas_ghpython.artists import MeshArtist
from compas_fab.robots import Tool
from compas_ghpython.utilities import draw_frame

tolerance = 0

if tool == 0:
    filename = 'measurement_tool_zaxis.stl'
    ee_frame = Frame([0, 0, 0.109], [1, 0, 0], [0, 1, 0])

elif tool == 1:
    filename = 'area_gripper_zaxis.stl'
    ee_frame = Frame([0, 0, 0.10219 + tolerance], [0, 1, 0], [-1, 0, 0])

elif tool == 2:
    filename = 'parallel_gripper_small.stl'
    ee_frame = Frame([0, 0, 0.1455 + tolerance], [0, 1, 0], [-1, 0, 0]) 

elif tool == 3:
    filename = 'parallel_gripper_with_mtip.stl'
    ee_frame = Frame([0, 0, 0.09], [0, 1, 0], [-1, 0, 0])

elif tool == 4:
    filename = 'parallel_gripper_ethz.stl'
    ee_fame = Frame([0,0,0.09], [0, 1, 0], [-1, 0, 0])

elif tool == 5:
    filename = 'parallel_gripper_ethz_with_mtip.stl'
    ee_fame = Frame([0,0,0.108], [0, 1, 0], [-1, 0, 0])

    
data_path = os.path.join(data_path, "tool_geometry")
fullfilename = os.path.join(data_path, filename)
print fullfilename

ee_mesh = Mesh.from_stl(fullfilename)

if show:
    artist = MeshArtist(ee_mesh)
    M = artist.draw()
    ee_plane = draw_frame(ee_frame)

tool = Tool(ee_mesh, ee_frame)

print(ee_frame.quaternion.xyzw)
ee_framek = Frame([0.0110607,0.00809854,0.41498], [0,1,0], [1,0,0])
print(ee_framek.quaternion.xyzw)
# ---------- end tool ----------
panel_22 = Panel("Attach a custom tool")
pln_5 = Plane(tool.ee_plane)
mesh_4 = Mesh(tool.M)
list_5 = ValueList({"ur10e", "ur10e_and_liftkit"}, selected="ur10e")
tool_2 = AttachedTool(robot=robot, visual_mesh=mesh_4, collision_mesh=mesh_4, tcf_plane=pln_5, group=list_5)  # -> robot; inputs visual_mesh: Mesh, collision_mesh: Mesh
#   port visual_mesh: A visual mesh for the tool.
#   port collision_mesh: A collision mesh for the tool.
#   port tcf_plane: The frame of the tool in tool0 frame.
#   port group: The planning group to which the tool should be attached.
# ---------- tool_2: Python ----------
"""
Attach a tool to the robot.

COMPAS FAB v0.27.0
"""
from ghpythonlib.componentbase import executingcomponent as component
from compas_rhino.conversions import RhinoMesh
from compas_rhino.conversions import plane_to_compas_frame

from compas.geometry import Frame
from compas_fab.robots import Tool


class AttachToolComponent(component):
    def RunScript(self, robot, visual_mesh, collision_mesh, tcf_plane, group):
        if robot and robot.client and robot.client.is_connected and visual_mesh:
            if not collision_mesh:
                collision_mesh = visual_mesh

            c_visual_mesh = RhinoMesh.from_geometry(visual_mesh).to_compas()
            c_collision_mesh = RhinoMesh.from_geometry(collision_mesh).to_compas()

            if not tcf_plane:
                frame = Frame.worldXY()
            else:
                frame = plane_to_compas_frame(tcf_plane)
            tool = Tool(c_visual_mesh, frame, c_collision_mesh)

            robot.attach_tool(tool, group)
            print tool.link_name

        return robot
# ---------- end tool_2 ----------

robot_2 = Data(tool_2)

# ----
# Control Collision Meshes
# Planning scene
scene = PlanningScene(robot=robot_2)  # -> scene
#   port scene: A planning scene.
# ---------- scene: Python ----------
"""
Create a planning scene.

COMPAS FAB v0.27.0
"""
from ghpythonlib.componentbase import executingcomponent as component
from scriptcontext import sticky as st

from compas_fab.ghpython.components import create_id
from compas_fab.robots import PlanningScene


class PlanningSceneComponent(component):
    def RunScript(self, robot):
        key = create_id(self, 'planning_scene')
        if robot:
            st[key] = PlanningScene(robot)
        return st.get(key, None)
# ---------- end scene ----------

attach_remove = PythonScript(robot=robot_2, tool=tool.tool, attach=add, remove=remove)  # -> out, bang
# ---------- attach_remove: Python ----------
if attach:
    robot.attach_tool(tool)
if remove:
    robot.detach_tool()

print tool.link_name
# ---------- end attach_remove ----------

x_axis_2 = Curve(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)
y_axis_2 = Curve(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)
plane_2 = PythonScript(plane_axes=[x_axis_2, y_axis_2])  # -> plane; inputs plane_axes: list of Curve; same code as aa_est
calc_bcf_wcs = GhPythonScript(robot=robot_2, RCF_WCS_plane=plane_2)  # -> out, BCF_WCS_plane
# ---------- calc_bcf_wcs: Python ----------
import rhinoscriptsyntax as rs
from compas_rhino.conversions import frame_to_rhino_plane, plane_to_compas_frame
from compas.geometry import Frame, Transformation


if robot:

    RCF_OCS_plane = frame_to_rhino_plane(robot.RCF) # TODO: RCF should move with BCF !!!! NEEDS TO BE CHECKED !!!!
    
    RCF_WCS = plane_to_compas_frame(RCF_WCS_plane)
    
    #print robot.RCF
    #print robot.BCF
    
    #Version A
    
    #RCF_RCS = RCF_WCS.transformed(robot.transformation_WCF_RCF())
    #BCF_WCS_A = RCF_RCS.transformed(robot.transformation_BCF_WCF())
    #
    #BCF_WCS_A_plane = frame_to_rhino_plane(BCF_WCS_A)
    #BCF_WCS_plane = BCF_WCS_A_plane
    
    #Version B
    
    T2 = Transformation.from_frame_to_frame(robot.RCF, RCF_WCS)
    print robot.RCF
    BCF_WCS_B = Frame.worldXY().transformed(T2)
    BCF_WCS_B_plane = frame_to_rhino_plane(BCF_WCS_B)
    
    BCF_WCS_plane = BCF_WCS_B_plane
# ---------- end calc_bcf_wcs ----------

# ----
# Move mobile robot base
# Picking plane
angle = Slider(203, range=0..360)
base_origin = Point(Point(0.7315701608, -0.8422138913, 0))
x_axis_3 = Curve(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)
y_axis_3 = Curve(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)
base_plane = GhPythonScript(origin=base_origin, angle=angle)  # -> base_plane; inputs origin: Point3d
# ---------- base_plane: Python ----------
import Rhino.Geometry as rg
import math

base_plane = rg.Plane(origin, rg.Vector3d.XAxis, rg.Vector3d.YAxis)
base_plane.Rotate(math.radians(angle), rg.Vector3d.ZAxis)
# ---------- end base_plane ----------
set_to_origin = BooleanToggle(False)
plane_3 = PythonScript(plane_axes=[x_axis_3, y_axis_3])  # -> plane; inputs plane_axes: list of Curve
# ---------- plane_3: Python ----------
import Rhino.Geometry as rg

x_axis, y_axis = plane_axes

x_axis = rg.Line(x_axis.PointAtStart, x_axis.PointAtEnd)
y_axis = rg.Line(y_axis.PointAtStart, y_axis.PointAtEnd)

if x_axis.From.DistanceTo(y_axis.From) < 0.01:
    origin = x_axis.From
    xvec = x_axis.Direction
    yvec = y_axis.Direction
elif x_axis.To.DistanceTo(y_axis.To) < 0.01:
    origin = x_axis.To
    xvec = -x_axis.Direction
    yvec = -y_axis.Direction
elif x_axis.From.DistanceTo(y_axis.To) < 0.01:
    origin = x_axis.From
    xvec = x_axis.Direction
    yvec = -y_axis.Direction
elif x_axis.To.DistanceTo(y_axis.From) < 0.01:
    origin = x_axis.To
    xvec = -x_axis.Direction
    yvec = y_axis.Direction

plane = rg.Plane(origin, xvec, yvec)

print(plane)
# ---------- end plane_3 ----------
set_base_frame = PythonScript(robot=robot_2, set_to_origin=set_to_origin, base_plane=bcf_wcs_ab_0)  # -> bang, base_plane
# ---------- set_base_frame: Python ----------
from compas_ghpython import draw_frame
from compas.geometry import Frame, Point, Vector, Transformation
from compas.datastructures import Mesh
from compas_rhino.geometry import RhinoMesh
from compas_fab.robots import CollisionMesh

if set_to_origin:
    base_frame = Frame.worldXY()
else:
    base_frame = Frame(base_plane.Origin, base_plane.XAxis, base_plane.YAxis)


# Base_frame is BCF in WCF
if robot:
    robot.BCF = base_frame
    print(robot.BCF)
# ---------- end set_base_frame ----------
python = GhPythonScript(robot=robot_2, picking_plane=plane_3)
# ---------- python: Python ----------
from compas.geometry import Frame

if robot and picking_plane:
    picking_frame = Frame(picking_plane.Origin, picking_plane.XAxis, picking_plane.YAxis)
    robot.PCF = picking_frame
# ---------- end python ----------

info_2 = PythonScript(robot=robot_2)  # -> out, main_group_name
# ---------- info_2: Python ----------
if robot:
    robot.info()
    main_group_name = robot.main_group_name
# ---------- end info_2 ----------
panel_23 = Panel(info_2.out)

# ----
# Fabrication Settings
shift_value = Slider(0, range=-0.25..0.25)
rotation_angle = Slider(0, range=-180..240)
flip_plane = BooleanToggle(False)
python_2 = GhPythonScript(
    robot=robot_2,
    lift=l,
    current_tool_plane=plane_from_local_model,
    flip_plane=flip_plane,
    rotation_angle=rotation_angle,
    shift_value=shift_value)  # -> out, picking_plane_RCF, approach_plane_WCF, picking_plane_safe_RCF, picking_frame_RCF, picking_frame_safe_RCF, picking_plane_WCF, picking_plane_safe_WCF, placing_plane_safe_WCF, placing_plane_WCF
# ---------- python_2: Python ----------
import math
from compas.geometry import Frame, Transformation, Translation
from compas_ghpython import draw_frame
from compas_fab.robots import Configuration
import Rhino.Geometry as rg

offset = 0.0


if robot and current_tool_plane:
    picking_frame_BCF = robot.PCF
    
    T = Translation.from_vector(picking_frame_BCF.xaxis*shift_value)
    #T = Translation.from_vector(picking_frame_BCF.zaxis*lift)
    
    picking_frame_BCF_shifted = picking_frame_BCF.transformed(T)
    picking_frame_RCF = picking_frame_BCF_shifted.transformed(robot.transformation_BCF_RCF())
    picking_plane_RCF = draw_frame(picking_frame_RCF)

    picking_plane_safe_RCF = rg.Plane(picking_plane_RCF)
    picking_plane_safe_RCF.Translate(rg.Vector3d.ZAxis*0.3)
    picking_frame_safe_RCF = Frame(picking_plane_safe_RCF.Origin, picking_plane_safe_RCF.XAxis, picking_plane_safe_RCF.YAxis)
    
    # transform picking_frame_RCF and picking_frame_safe_RCF in WCF
    picking_frame_WCF = robot.from_BCF_to_WCF(picking_frame_BCF_shifted)

    picking_frame_safe_BCF = picking_frame_safe_RCF.transformed(robot.transformation_RCF_BCF())
    picking_frame_safe_WCF = robot.from_BCF_to_WCF(picking_frame_safe_BCF)
    
    # visualize picking_frame_WCF and picking_frame_safe_WCF
    picking_plane_WCF = draw_frame(picking_frame_WCF)
    picking_plane_safe_WCF = draw_frame(picking_frame_safe_WCF)
    
    
    placing_plane_WCF = current_tool_plane
    placing_plane_WCF.Translate(placing_plane_WCF.ZAxis*offset)
    #shifting X of Gripper
    placing_plane_WCF.Translate(placing_plane_WCF.XAxis*shift_value)
    placing_plane_WCF.Rotate(math.radians(rotation_angle), placing_plane_WCF.XAxis, placing_plane_WCF.Origin)
    if flip_plane:
        placing_plane_WCF = rg.Plane(placing_plane_WCF.Origin, -placing_plane_WCF.XAxis, placing_plane_WCF.YAxis)
    
    placing_plane_safe_WCF = rg.Plane(placing_plane_WCF)
    placing_plane_safe_WCF.Translate(placing_plane_WCF.ZAxis*-0.1)
    
    #placing_frame_RCF = picking_frame_BCF.transformed(robot.transformation_BCF_RCF())
    
    move_plane_safe_WCF = rg.Plane(placing_plane_WCF)
    move_plane_safe_WCF.Translate(rg.Vector3d.ZAxis*0.30)
    
    
    picking_safe_configuration = Configuration((0.000, -1.777, -1.305, 2.471, -2.736, -1.571, -2.562), (4, 0, 0, 0, 0, 0, 0))
# ---------- end python_2 ----------
pln_6 = Plane(python_2.approach_plane_WCF)
pln_7 = Plane(python_2.placing_plane_safe_WCF)
pln_8 = Plane(python_2.picking_plane_RCF)
pln_9 = Plane(python_2.placing_plane_WCF)
pln_10 = Plane(python_2.picking_plane_safe_RCF)
pln_11 = Plane(python_2.picking_plane_safe_WCF)
pln_12 = Plane(python_2.picking_plane_WCF)

# ----
# Attach to robot
remove_2 = Button()
add_2 = Button()
X = UnitX(Factor=expr("x*-1", shift_value))
move = Move(Geometry=mesh_3, Motion=X)  # -> Geometry, Transform
acm = AttachedCollisionMesh(
    scene=scene,
    mesh=move.Geometry,
    identifier="rod",
    link_name="robot_arm_tool0",
    touch_links="robot_arm_tool0",
    add=add_2,
    remove=remove_2)  # -> attached_collision_mesh, bang; inputs mesh: Mesh, touch_links: list, add: Boolean, remove: Boolean
#   port scene: The planning scene.
#   port mesh: A collision mesh.
#   port identifier: The identifier of the collision mesh.
#   port link_name: The robot's link name to attach the mesh to.
#   port touch_links: Names of links that the robot is allowed to touch.
#   port add: If True, adds the collision mesh to the planning scene.
#   port remove: If True, removes the collision mesh from the planning scene.
#   port attached_collision_mesh: A collision mesh that is attached to a robot's link.
# ---------- acm: Python ----------
"""
Add an attached collision mesh to the robot.

COMPAS FAB v0.27.0
"""
from ghpythonlib.componentbase import executingcomponent as component

from compas_rhino.geometry import RhinoMesh
from compas_fab.robots import AttachedCollisionMesh
from compas_fab.robots import CollisionMesh

class AttachedCollisionMeshComponent(component):
    def RunScript(self, scene, mesh, identifier, link_name, touch_links, add, remove):
        attached_collision_mesh = None
        if scene and mesh and identifier and link_name:
            compas_mesh = RhinoMesh.from_geometry(mesh).to_compas()
            collision_mesh = CollisionMesh(compas_mesh, identifier)
            attached_collision_mesh = AttachedCollisionMesh(collision_mesh, link_name, touch_links)
            if add:
                scene.add_attached_collision_mesh(attached_collision_mesh)
            if remove:
                scene.remove_attached_collision_mesh(identifier)
                scene.remove_collision_mesh(identifier)
        return attached_collision_mesh
# ---------- end acm ----------

# ---- group: forward kinematics
a6 = Slider(90, range=-360..360)
a1 = Slider(0, range=-360..360)
a2 = Slider(0, range=-360..360)
a3 = Slider(11, range=-360..360)
a4 = Slider(0, range=-360..360)
a5 = Slider(0, range=-360..360)
jp = GhPythonScript()  # -> joint_positions
# ---------- jp: Python ----------
import math

joint_positions = [0,0,-90,90,0,90,0]
joint_positions = [math.radians(a) for a in joint_positions]
#joint_positions = [-3.136, -0.328, -1.218, 3.129, 0.852, 0.008]
#joint_positions = [0] * 6

#joint_positions =[0.000, 0.518, 0.046, 1.451, -3.088, -1.571, -1.236]


#joint_positions = [1.6239667567485938, 0.25439606475392273, 4.409424838594969-2*3.14, 3.1901607306255908, 1.5707963267948954, 0.053170429953696939]
#joint_positions = [1.598543436748912, 0.23021224965157744, 4.712232135219824-2*3.14, 6.0531299026928744, 4.7123889803846915, 0.027747109954015234]
#joint_positions = [-1.1373533430447322, 4.0117247163121572, 5.4083762087596021-2*3.14, 1.5754733624925168, 4.7123889803846879, 3.5750356373399574]
print joint_positions
# ---------- end jp ----------
forward_kinematics = PythonScript(robot=robot_2, set_joint_positions=Button(), joint_positions=jp, lift=l, a1=a1, a2=a2, a3=a3, a4=a4, a5=a5, a6=a6)  # -> full_configuration; inputs joint_positions: list
# ---------- forward_kinematics: Python ----------
import math
import Grasshopper
from compas.robots import Joint
from compas_fab.robots import Configuration

if set_joint_positions:
    j = 0
    for i in range(ghenv.Component.Params.Input.Count):
        nslider = ghenv.Component.Params.Input[i].Sources[0]
        if nslider.GetType() == Grasshopper.Kernel.Special.GH_NumberSlider:
            nslider.TrySetSliderValue(math.degrees(joint_positions[j]))
            j += 1

if robot:
    joints = robot.get_configurable_joints()
    joint_types = [joint.type for joint in joints]
    joint_names = [joint.name for joint in joints]
    
    joint_positions = [a1, a2, a3, a4, a5, a6]
    joint_positions = [math.radians(position) for position in joint_positions]
    
    if len(joints) == 7:
        joint_positions = [lift] + joint_positions
    
    print joint_types, joint_names, joint_positions
    full_configuration = Configuration(joint_positions, joint_types, joint_names)
    
print(full_configuration)
# ---------- end forward_kinematics ----------

# ---- group: inverse kinematics
# approach_place_configuration
list_6 = ValueList({"picking_plane": 0, "picking_plane_safe": 1, "placing_plane_safe": 2, "placing_plane": 3}, selected="placing_plane_safe")
filter = StreamFilter(Gate=list_6, Stream0=pln_12, Stream1=pln_11, Stream2=pln_7, Stream3=pln_9)
analytic_inverse = PythonScript(robot=robot_2, lift=l, plane_WCS=filter, idx=select_configuration, bang=attach_remove.bang)  # -> out, full_configuration, configuration, plane_tool0_RCS, frame_RCS, frame_BCS, robot_frame, place_config_bool; inputs plane_WCS: Plane, bang: list of Boolean
# ---------- analytic_inverse: Python ----------
import Rhino.Geometry as rg
import math
from compas.geometry import Frame, Transformation, Rotation
from compas_fab.robots import Configuration
from ur_fabrication_control.kinematics.ur_kinematics import inverse_kinematics
from ur_fabrication_control.kinematics.ur_params import ur_params
from compas_ghpython import draw_frame


if robot:
    #BOOL TO SET INPUT FOR SEND MESSAGE
    place_config_bool = False
    
    robot.lift_height = lift
    
    frame_WCS = Frame(plane_WCS.Origin, plane_WCS.XAxis, plane_WCS.YAxis)
    
    # transform frame to robot coordinate system
    frame_RCS = robot.from_WCF_to_RCF(frame_WCS)
    print frame_RCS
#    frame_BCS = frame_WCS.transformed(robot.transformation_WCF_BCF())
#    frame_RCS = frame_BCS.transformed(robot.transformation_BCF_RCF())
    
    robot_frame = robot.RCF
    
    if robot.attached_tool:
        tool0_RCS = robot.from_tcf_to_t0cf([frame_RCS])[0]
        
    else:
        tool0_RCS = frame_RCS
    
    plane_tool0_RCS = draw_frame(tool0_RCS)
    plane_RCS = draw_frame(frame_RCS)
    
    # calculate solutions to frame
    ur_params = ur_params["ur10e"] # get the parameters according to the robot model
#    print ur_params
    solutions = inverse_kinematics(tool0_RCS, ur_params)
#    print solutions
    
    if not len(solutions):
        # TRIGGER MQTT PLACE CONFIG FAILURE
        place_config_bool = True
        joint_values = [0, 0, 0, 0, 0, 0]
        configuration = Configuration.from_prismatic_and_revolute_values([0], joint_values)
    else:
        idx = int((idx+2) % len(solutions))
        joint_values = solutions[idx]
#        print idx
        joints = robot.get_configurable_joints()
        configuration = [Configuration.from_prismatic_and_revolute_values([lift], joint_values)]
        joint_positions = configuration[0].joint_values[1:]
        print configuration
        
        joint_types = [joint.type for joint in joints[1:]]
        joint_names = [joint.name for joint in joints[1:]]
        full_configuration = Configuration(joint_positions, joint_types, joint_names)
    
    print configuration
# ---------- end analytic_inverse ----------

# ----
y_axis_4 = Curve(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)
x_axis_4 = Curve(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)
plane_4 = PythonScript(plane_axes=[x_axis_4, y_axis_4])  # -> plane; inputs plane_axes: list of Curve; same code as aa_est
list_7 = ValueList({"ur10e", "ur10e_and_liftkit"}, selected="ur10e")
ik = InverseKinematics(robot=robot_2, plane=filter, start_configuration=forward_kinematics, group=list_7)  # -> configuration
#   port plane: The plane or frame to calculate the inverse kinematic for.
#   port start_configuration: If passed, calculates the inverse such that the joint positions differ the least from the start_configuration. Defaults to the zero configuration.
#   port group: The planning group used for calculation. Defaults to the robot's main planning group.
#   port configuration: The planning group's configuration.
# ---------- ik: Python ----------
"""
Calculate the robot's inverse kinematic for a given plane.

COMPAS FAB v0.27.0
"""
from compas_rhino.conversions import RhinoPlane
from ghpythonlib.componentbase import executingcomponent as component


class InverseKinematics(component):
    def RunScript(self, robot, plane, start_configuration, group):
        configuration = None
        if robot and robot.client and robot.client.is_connected and plane:
            frame = RhinoPlane.from_geometry(plane).to_compas_frame()
            
            frame_BCS = frame.transformed(robot.transformation_WCF_BCF())
            configuration = robot.inverse_kinematics(frame_BCS, start_configuration, group, use_attached_tool_frame=True)
            print configuration
        return configuration
# ---------- end ik ----------

# ---- group: zero configuration
zero_config = ZeroConfig(robot=robot_2)  # -> config
#   port group: If assigned, it will return the zero configuration for the given group, otherwise a full zero configuration.
#   port config: The zero configuration.
# ---------- zero_config: Python ----------
"""
Get a zero configuration for a robot.

COMPAS FAB v0.27.0
"""
from ghpythonlib.componentbase import executingcomponent as component


class ConfigZero(component):
    def RunScript(self, robot, group):

        if robot:
            return robot.zero_configuration(group)

        return None
# ---------- end zero_config ----------
# ---- group: inverse kinematics
# pick_configuration
select_configuration_2 = Slider(2, range=0..7)
picking_safe_inverse = PythonScript(robot=robot_2, lift=l, plane_WCS=pln_12, idx=select_configuration_2, bang=attach_remove.bang)  # -> out, configuration; inputs plane_WCS: Plane, idx: Int32, bang: list of Boolean
# ---------- picking_safe_inverse: Python ----------
import Rhino.Geometry as rg
import math
from compas.geometry import Frame, Transformation, Rotation
from compas_fab.robots import Configuration
from ur_fabrication_control.kinematics.ur_kinematics import inverse_kinematics
from ur_fabrication_control.kinematics.ur_params import ur_params
from compas_ghpython import draw_frame

if robot: 
    robot.lift_height = lift
    
    frame_WCS = Frame(plane_WCS.Origin, plane_WCS.XAxis, plane_WCS.YAxis)
    
    # transform frame to robot coordinate system
    frame_RCS = robot.from_WCF_to_RCF(frame_WCS)
    
    robot_frame = robot.RCF
    
    if robot.attached_tool:
        tool0_RCS = robot.from_tcf_to_t0cf([frame_RCS])[0]
    else:
        tool0_RCS = frame_RCS
    
    plane_tool0_RCS = draw_frame(tool0_RCS)
    plane_RCS = draw_frame(frame_RCS)
    
    # calculate solutions to frame
    ur_params = ur_params["ur10e"] # get the parameters according to the robot model
    print ur_params
    solutions = inverse_kinematics(tool0_RCS, ur_params)
    print solutions
    
    if not len(solutions):
        joint_values = [0, 0, 0, 0, 0, 0]
        configuration = Configuration.from_prismatic_and_revolute_values([0], joint_values)
    else:
        joint_values = solutions[idx]
        configuration = [Configuration.from_prismatic_and_revolute_values([lift], joint_values)]
    
#    print configuration
# ---------- end picking_safe_inverse ----------

# pick_configuration_safe
select_configuration_3 = Slider(2, range=0..7)
picking_safe_inverse_2 = PythonScript(robot=robot_2, lift=l, plane_WCS=pln_11, idx=select_configuration_3, bang=attach_remove.bang)  # -> out, configuration; inputs plane_WCS: Plane, idx: Int32, bang: list of Boolean; same code as picking_safe_inverse

# ----
# Plan 'free' motion
constraints_from_target_configuration = ConstraintsFromTargetConfiguration(robot=robot_2, target_configuration=analytic_inverse.configuration, group=list_2)  # -> constraints
#   port target_configuration: The target configuration.
#   port tolerance_above: The tolerances above the targeted joint value of each configurable joint, defining the upper bound in radians/meters to be achieved.
#   port tolerance_below: The tolerances below the targeted joint value of each configurable joint, defining the lower bound in radians/meters to be achieved.
#   port group: The planning group for which we specify the constraint. Defaults to the robot's main planning group.
#   port constraints: A list joint constraints in radians/meters.
# ---------- constraints_from_target_configuration: Python ----------
"""
Create joint constraints for each of the robot's configurable joints based on a given target configuration.

COMPAS FAB v0.27.0
"""
import math

from ghpythonlib.componentbase import executingcomponent as component
from compas_fab.robots import Configuration


class ConstraintsFromTargetConfiguration(component):
    
    DEFAULT_TOLERANCE_METERS = .001
    DEFAULT_TOLERANCE_RADIANS = math.radians(1)

    def RunScript(self, robot, target_configuration, tolerance_above, tolerance_below, group):
        if robot and target_configuration:
            target_configuration = Configuration.from_revolute_values(target_configuration.revolute_values)
            tolerance_above = tolerance_above or self._generate_default_tolerances(robot.get_configurable_joints(group))
            tolerance_below = tolerance_below or self._generate_default_tolerances(robot.get_configurable_joints(group))

            
            constraints = robot.constraints_from_configuration(
                configuration=target_configuration,
                tolerances_above=tolerance_above,
                tolerances_below=tolerance_below,
                group=group
            )

            return constraints

    def _generate_default_tolerances(self, joints):
        return [
            self.DEFAULT_TOLERANCE_METERS if j.is_scalable()
            else self.DEFAULT_TOLERANCE_RADIANS
            for j in joints
        ]
# ---------- end constraints_from_target_configuration ----------

bang_2 = GhPythonScript(x=[acm.bang, set_base_frame.bang])  # -> out, flatten(x); inputs x: list
# ---------- bang_2: Python ----------
print x
# ---------- end bang_2 ----------

plan_motion = PlanMotion(
    robot=robot_2,
    goal_constraints=constraints_from_target_configuration,
    start_configuration=picking_safe_inverse_2.configuration,
    group=list_2,
    compute=Button())  # -> trajectory; inputs goal_constraints: list, attached_collision_meshes: list, path_constraints: list, compute: Boolean
#   port goal_constraints: The goal to be achieved, defined in a set of constraints. Constraints can be very specific, for example defining value domains for each joint, such that the goal configuration is included, or defining a volume in space, to which a specific robot link (e.g. the end-effector) is required to move to.
#   port start_configuration: The robot's full configuration, i.e. values for all configurable joints of the entire robot, at the starting position. Defaults to the all-zero configuration.
#   port group: The planning group used for calculation. Defaults to the robot's main planning group.
#   port attached_collision_meshes: A list of attached collision meshes to be included for planning.
#   port path_constraints: Optional constraints that can be imposed along the solution path. Note that path calculation won't work if the start_configuration violates these constraints. Defaults to None.
#   port planner_id: The name of the algorithm used for path planning. Defaults to 'RRTConnect'
#   port compute: If True, calculates a trajectory.
#   port trajectory: The calculated trajectory.
# ---------- plan_motion: Python ----------
"""
Calculate a motion path.

COMPAS FAB v0.28.0
"""
from ghpythonlib.componentbase import executingcomponent as component
from scriptcontext import sticky as st

from compas_fab.ghpython.components import create_id


class PlanMotion(component):
    def RunScript(
        self,
        robot,
        goal_constraints,
        start_configuration,
        group,
        attached_collision_meshes,
        path_constraints,
        planner_id,
        compute,
    ):
        key = create_id(self, "trajectory")

        path_constraints = list(path_constraints) if path_constraints else None
        attached_collision_meshes = list(attached_collision_meshes) if attached_collision_meshes else None
        planner_id = str(planner_id) if planner_id else "RRTConnect"

        if (
            robot
            and robot.client
            and robot.client.is_connected
            and start_configuration
            and goal_constraints
            and compute
        ):
            st[key] = robot.plan_motion(
                goal_constraints,
                start_configuration=start_configuration,
                group=group,
                options=dict(
                    attached_collision_meshes=attached_collision_meshes,
                    path_constraints=path_constraints,
                    planner_id=planner_id,
                ),
            )

        trajectory = st.get(key, None)
        return trajectory
# ---------- end plan_motion ----------
plan_motion_2 = PlanMotion(
    robot=robot_2,
    goal_constraints=constraints_from_target_configuration,
    start_configuration=picking_safe_inverse_2.configuration,
    group=list_2,
    compute=ghpython_script_2.calculate_trajectory,
    calculate_topic_name=panel_12)  # -> trajectory; inputs goal_constraints: list, attached_collision_meshes: list, path_constraints: list, compute: Boolean
#   port goal_constraints: The goal to be achieved, defined in a set of constraints. Constraints can be very specific, for example defining value domains for each joint, such that the goal configuration is included, or defining a volume in space, to which a specific robot link (e.g. the end-effector) is required to move to.
#   port start_configuration: The robot's full configuration, i.e. values for all configurable joints of the entire robot, at the starting position. Defaults to the all-zero configuration.
#   port group: The planning group used for calculation. Defaults to the robot's main planning group.
#   port attached_collision_meshes: A list of attached collision meshes to be included for planning.
#   port path_constraints: Optional constraints that can be imposed along the solution path. Note that path calculation won't work if the start_configuration violates these constraints. Defaults to None.
#   port planner_id: The name of the algorithm used for path planning. Defaults to 'RRTConnect'
#   port compute: If True, calculates a trajectory.
#   port trajectory: The calculated trajectory.
# ---------- plan_motion_2: Python ----------
"""
Calculate a motion path.

COMPAS FAB v0.27.0
"""
from ghpythonlib.componentbase import executingcomponent as component
from scriptcontext import sticky as st
from compas_fab.robots import JointConstraint
from compas_fab.ghpython.components import create_id


class PlanMotion(component):
    def RunScript(self, robot, goal_constraints, start_configuration, group, attached_collision_meshes, path_constraints, planner_id, compute, calculate_topic_name):

        key = create_id(self, 'trajectory')
        
        send_calculate_key = 'send_calculate_key' + calculate_topic_name

        planning_failure_key = 'planning_failure_key' + calculate_topic_name
        st[planning_failure_key] = False

        #CHECK IF STICKY IS FALSE, AND TURN IT BACK TO TRUE.
        if st[send_calculate_key] == False:
            st[key] = None
            trajectory = st[key]
            self.Message = "A place config has not been selected yet"
            return trajectory
        
        st[send_calculate_key] = False
        
        path_constraints = list(path_constraints) if path_constraints else None
        
        attached_collision_meshes = list(attached_collision_meshes) if attached_collision_meshes else None
        planner_id = str(planner_id) if planner_id else 'RRTConnect'
        
        try:
            if robot and robot.client and robot.client.is_connected and start_configuration and goal_constraints and compute:
                st[key] = robot.plan_motion(goal_constraints,
                                            start_configuration=start_configuration,
                                            group=group,
                                            options=dict(
                                                attached_collision_meshes=attached_collision_meshes,
                                                path_constraints=path_constraints,
                                                planner_id=planner_id,
                                            ))
        except Exception as e:
        # Handle the exception here, e.g., log it, raise a custom exception, etc.
            st[send_calculate_key] = False
            st[planning_failure_key] = True
            self.Message = "Move Trajectory Planning Failed"
            raise Exception("Move trajectory planning failed".format(e))
        
        trajectory = st.get(key, None)
        self.Message = "Trajectory Successfully Planned"
        return trajectory
# ---------- end plan_motion_2 ----------
trajectory_visualize = TrajectoryVisualize(robot=robot_2, group=list_2, trajectory=plan_motion_2)  # -> start_configuration, configurations, fraction, time, planes, P, V, A
#   port group: The planning group for which this trajectory was planned.
#   port trajectory: The calculated trajectory.
#   port start_configuration: The start configuration of the trajectory.
#   port configurations: The full configurations along the trajectory.
#   port fraction: Indicates the fraction of requested trajectory that was calculated, e.g. 1 means the full trajectory was found.
#   port time: The time which is needed to execute that trajectory at full speed.
#   port planes: The planes of the robot's end-effector.
#   port P: The positions along the trajectory
#   port V: The velocities along the trajectory
#   port A: The accelerations along the trajectory
# ---------- trajectory_visualize: Python ----------
"""
Visualizes a trajectory.

COMPAS FAB v0.27.0
"""
from compas_ghpython import draw_frame
from compas_ghpython import list_to_ghtree
from compas_fab.robots import Configuration
from ghpythonlib.componentbase import executingcomponent as component
from compas.geometry import Translation

class TrajectoryVisualize(component):
    def RunScript(self, robot, group, trajectory):
        start_configuration = None
        configurations = []
        fraction = 0.
        time = 0.

        planes = []
        positions = []
        velocities = []
        accelerations = []

        if robot and trajectory:
            group = group or robot.main_group_name

            for c in trajectory.points:
                config = robot.merge_group_with_full_configuration(c, trajectory.start_configuration, group)
                joint_names_ordered = ['robot_ewellix_lift_top_joint', 'robot_arm_shoulder_pan_joint', 'robot_arm_shoulder_lift_joint', 'robot_arm_elbow_joint', 'robot_arm_wrist_1_joint', 'robot_arm_wrist_2_joint', 'robot_arm_wrist_3_joint']
                joint_values_ordered = [config.joint_values[config.joint_names.index(joint_name)] for joint_name in joint_names_ordered]
                joint_types_ordered = [config.joint_types[config.joint_names.index(joint_name)] for joint_name in joint_names_ordered]
                mobile_robot_config = Configuration(joint_values_ordered, joint_types_ordered, joint_names_ordered)
                configurations.append(mobile_robot_config)
                frame = robot.forward_kinematics(c, group, options=dict(solver='model'))
                # transform the planes to mobile robot base
                planes.append(draw_frame(frame.transformed(robot.transformation_BCF_WCF())))
                positions.append(c.positions)
                velocities.append(c.velocities)
                accelerations.append(c.accelerations)

            start_configuration = trajectory.start_configuration
            fraction = trajectory.fraction
            time = trajectory.time_from_start

        P = list_to_ghtree(list(zip(*positions)))
        V = list_to_ghtree(list(zip(*velocities)))
        A = list_to_ghtree(list(zip(*accelerations)))

        # return outputs if you have them; here I try it for you:
        #print configurations
        return (start_configuration, configurations, fraction, time, planes, P, V, A)
# ---------- end trajectory_visualize ----------
planes = Plane(trajectory_visualize.planes)
python_3 = GhPythonScript(configurations=trajectory_visualize.configurations, planes=trajectory_visualize.planes)  # -> first_configuration, last_configuration, reversed_free_motion_configurations, last_plane; inputs configurations: list, planes: list of Plane
# ---------- python_3: Python ----------
import rhinoscriptsyntax as rs

if configurations:
    first_configuration = configurations[0]
    last_configuration = configurations[-1]
    reversed_free_motion_configurations = configurations[::-1]

if planes:
    last_plane = planes[-1]
# ---------- end python_3 ----------

# ----
# Plan 'Cartesian' motion
list_item = ListItem(List=trajectory_visualize.planes, Index=0, Wrap=True)  # -> Item1, Item
step_2 = Slider(0.1, range=0..0.1)
merge_2 = Merge(Data1=pln_9)  # -> flatten(Result)
list_item_2 = ListItem(List=trajectory_visualize.configurations, Index=0, Wrap=True)  # -> Item1, Item
plan_cartesian_motion = PlanCartesianMotion(
    robot=robot_2,
    planes=merge_2,
    start_configuration=list_item_2.Item1,
    group=list_2,
    max_step=step_2,
    calculate_topic_name=ghpython_script_2.calculate_trajectory,
    compute=Toggle(True))  # -> trajectory; inputs planes: list, attached_collision_meshes: list, path_constraints: list, compute: Boolean
#   port planes: The planes or frames through which the path is defined.
#   port start_configuration: The robot's full configuration, i.e. values for all configurable joints of the entire robot, at the starting position. Defaults to the all-zero configuration.
#   port group: The planning group used for calculation. Defaults to the robot's main planning group.
#   port attached_collision_meshes: A list of attached collision meshes to be included for planning.
#   port path_constraints: Optional constraints that can be imposed along the solution path. Note that path calculation won't work if the start_configuration violates these constraints. Defaults to None.
#   port max_step: The approximate distance between the calculated points. (Defined in the robot's units.) Defaults to 0.01.
#   port compute: If True, calculates a trajectory.
#   port trajectory: The calculated trajectory.
# ---------- plan_cartesian_motion: Python ----------
"""
Calculate a cartesian motion path (linear in tool space).

COMPAS FAB v0.28.0
"""
from compas_rhino.conversions import RhinoPlane
from ghpythonlib.componentbase import executingcomponent as component
from scriptcontext import sticky as st

from compas_fab.ghpython.components import create_id


class PlanCartesianMotion(component):
    def RunScript(
        self, robot, planes, start_configuration, group, attached_collision_meshes, path_constraints, max_step, calculate_topic_name, compute
    ):
        key = create_id(self, "trajectory")
        planning_failure_key = 'planning_failure_key' + calculate_topic_name

        max_step = float(max_step) if max_step else 0.01
        path_constraints = list(path_constraints) if path_constraints else None
        attached_collision_meshes = list(attached_collision_meshes) if attached_collision_meshes else None

        if robot and robot.client and robot.client.is_connected and start_configuration and planes and compute:
            frames = [RhinoPlane.from_geometry(plane).to_compas_frame() for plane in planes]
            frames_bcf = [frame.transformed(robot.transformation_WCF_BCF()) for frame in frames]
            st[key] = robot.plan_cartesian_motion(
                frames_bcf,
                start_configuration=start_configuration,
                group=group,
                options=dict(
                    max_step=max_step,
                    path_constraints=path_constraints,
                    attached_collision_meshes=attached_collision_meshes,
                ),
            )

        trajectory = st.get(key, None)
        
        if trajectory.fraction < 1:
            st[planning_failure_key] = True
            raise Exception("Incomplete cartesian trajectory found for place trajectory. Only {:.1f}% of the trajectory could be planned".format(trajectory.fraction * 100))
        
        
        return trajectory
# ---------- end plan_cartesian_motion ----------
trajectory_visualize_2 = TrajectoryVisualize(robot=robot_2, group=list_2, trajectory=plan_cartesian_motion)  # -> start_configuration, configurations, fraction, time, planes, P, V, A
#   port group: The planning group for which this trajectory was planned.
#   port trajectory: The calculated trajectory.
#   port start_configuration: The start configuration of the trajectory.
#   port configurations: The full configurations along the trajectory.
#   port fraction: Indicates the fraction of requested trajectory that was calculated, e.g. 1 means the full trajectory was found.
#   port time: The time which is needed to execute that trajectory at full speed.
#   port planes: The planes of the robot's end-effector.
#   port P: The positions along the trajectory
#   port V: The velocities along the trajectory
#   port A: The accelerations along the trajectory
# ---------- trajectory_visualize_2: Python ----------
"""
Visualizes a trajectory.

COMPAS FAB v0.27.0
"""
from compas_ghpython import draw_frame
from compas_ghpython import list_to_ghtree
from compas_fab.robots import Configuration
from ghpythonlib.componentbase import executingcomponent as component
from compas.geometry import Translation

class TrajectoryVisualize(component):
    def RunScript(self, robot, group, trajectory):
        start_configuration = None
        configurations = []
        fraction = 0.
        time = 0.

        planes = []
        positions = []
        velocities = []
        accelerations = []

        if robot and trajectory:
            group = group or robot.main_group_name
            print len(trajectory.points)

            for c in trajectory.points:
                print len(c)
                config = robot.merge_group_with_full_configuration(c, trajectory.start_configuration, group)
                joint_names_ordered = ['robot_ewellix_lift_top_joint', 'robot_arm_shoulder_pan_joint', 'robot_arm_shoulder_lift_joint', 'robot_arm_elbow_joint', 'robot_arm_wrist_1_joint', 'robot_arm_wrist_2_joint', 'robot_arm_wrist_3_joint']
                joint_values_ordered = [config.joint_values[config.joint_names.index(joint_name)] for joint_name in joint_names_ordered]
                joint_types_ordered = [config.joint_types[config.joint_names.index(joint_name)] for joint_name in joint_names_ordered]
                mobile_robot_config = Configuration(joint_values_ordered, joint_types_ordered, joint_names_ordered)
                configurations.append(mobile_robot_config)
                frame = robot.forward_kinematics(c, group, options=dict(solver='model'))
                # transform the planes to mobile robot base
                planes.append(draw_frame(frame.transformed(robot.transformation_BCF_WCF())))
                positions.append(c.positions)
                velocities.append(c.velocities)
                accelerations.append(c.accelerations)

            start_configuration = trajectory.start_configuration
            fraction = trajectory.fraction
            time = trajectory.time_from_start

        P = list_to_ghtree(list(zip(*positions)))
        V = list_to_ghtree(list(zip(*velocities)))
        A = list_to_ghtree(list(zip(*accelerations)))

        # return outputs if you have them; here I try it for you:
        #print configurations
        return (start_configuration, configurations, fraction, time, planes, P, V, A)
# ---------- end trajectory_visualize_2 ----------
combine = GhPythonScript(free_motion_configs=trajectory_visualize.configurations, cartesian_motion_configs=trajectory_visualize_2.configurations)  # -> out, combined_motion_configs; inputs free_motion_configs: list, cartesian_motion_configs: list
# ---------- combine: Python ----------
combined_motion_configs = []

combined_motion_configs.extend(free_motion_configs)
combined_motion_configs.extend(cartesian_motion_configs)
# ---------- end combine ----------
planes_2 = Plane(trajectory_visualize_2.planes)

# ----
# Select
# Config
configuration_2 = Slider(23, range=0..100)
item = ListItem(List=trajectory_visualize.configurations, Index=configuration_2, Wrap=True)

# ----
# Combine Trajectory Info
ghpython_script_10 = GhPythonScript(
    pick_configuration=picking_safe_inverse.configuration,
    pick_safe_configuration=picking_safe_inverse_2.configuration,
    free_motion_configs=trajectory_visualize.configurations,
    place_configs=trajectory_visualize_2.configurations,
    combined_motion_configs=combine.combined_motion_configs,
    calculate_topic_name=panel_12)  # -> out, trajectory, start_of_place_path, message_bool; inputs free_motion_configs: list, place_configs: list, combined_motion_configs: list
# ---------- ghpython_script_10: Python ----------
from scriptcontext import sticky as st
from compas_fab.robots import Configuration
from compas_fab.robots import configuration

reversed_motion_configs_key = 'reversed_motion_configs_key' + calculate_topic_name

#print ("safe", len(pick_safe_configuration))
# print ("safe", pick_safe_configuration)
if pick_configuration and pick_safe_configuration and free_motion_configs and place_configs:
    
    reversed_motion_configs = list(reversed(combined_motion_configs))
    
    if st[reversed_motion_configs_key] == None or st[reversed_motion_configs_key] == reversed_motion_configs:
        
        # +2 is because there is not a multiple items between the approach and the pick it is just the two.
        start_of_place_path = 2
        
#        trajectory = pick_safe_configuration +\
#                     pick_configuration +\
#                     pick_safe_configuration +\
#                     free_motion_configs
        
        trajectory = []
        
        pick_safe_config_data = pick_safe_configuration.to_data()
        new_pick_safe_config = Configuration.from_data(pick_safe_config_data)
        print len(new_pick_safe_config)
        
        
        trajectory.append(new_pick_safe_config)
        trajectory.append(pick_configuration)
        trajectory.append(new_pick_safe_config)
        trajectory.extend(free_motion_configs)
        trajectory.extend(place_configs)
        
        print trajectory
        
    else:
        
        # +2 is because there is not a multiple items between the approach and the pick it is just the two.
        start_of_place_path = len(st[reversed_motion_configs_key]) + 2 
        
        
        #    trajectory = st[reversed_motion_configs_key] +\
        #                 pick_safe_configuration +\
        #                 pick_configuration +\
        #                 pick_safe_configuration +\
        #                 free_motion_configs
        
        trajectory = []
        
        trajectory.extend(st[reversed_motion_configs_key])
        trajectory.append(pick_safe_configuration)
        trajectory.append(pick_configuration)
        trajectory.append(pick_safe_configuration)
        trajectory.extend(free_motion_configs)
        trajectory.extend(place_configs)
    

else:
    trajectory = None
    message_bool = False
# ---------- end ghpython_script_10 ----------

list_8 = ValueList({"0 zero_configuration": 0, "1 forward_kinematics": 1, "2 inverse_kinematics analytical": 2, "3 inverse_kinematics MoveIt": 3, "4 motion_planning": 4, "5 free_motion_planning": 5, "6 'pick_and_place_routine'": 6, "7 from json": 7, "8 picking configuration": 8, "9 pick safe configuration": 9, "10 place cartesian motion": 10}, selected="2 inverse_kinematics analytical")
filter_2 = StreamFilter(
    Gate=list_8,
    Stream0=zero_config,
    Stream1=forward_kinematics,
    Stream2=analytic_inverse.configuration,
    Stream3=ik,
    Stream4=python_3.last_configuration,
    Stream5=trajectory_visualize.configurations,
    Stream6=ghpython_script_10.trajectory,
    Stream8=picking_safe_inverse.configuration,
    Stream9=picking_safe_inverse_2.configuration,
    Stream10=combine.combined_motion_configs)

list_item_3 = ListItem(List=filter_2, Index=configuration, Wrap=True)

# ----
# Visualisation
show_end_effector_frame = BooleanToggle(False)
show_base_frame = BooleanToggle(True)
show_collision = BooleanToggle(False)
show_frames = BooleanToggle(False)
show_visual = BooleanToggle(True)
show_reach = BooleanToggle(False)
show_acm = BooleanToggle(True)
show_cm = BooleanToggle(False)
robot_visualize = RobotVisualize(
    robot=robot_2,
    group=list_7,
    configuration=list_item_3,
    show_visual=show_visual,
    show_collision=show_collision,
    show_frames=show_frames,
    show_base_frame=show_base_frame,
    show_robot_frame=show_robot_frame,
    show_end_effector_frame=show_end_effector_frame,
    show_reach=show_reach,
    show_cm=show_cm,
    show_acm=show_acm,
    redraw=bang_2.x)  # -> visual, collision, collision_meshes, attached_meshes, all_frames, base_frame, robot_frame, ee_frame, reach; inputs show_visual: Boolean, show_collision: Boolean, show_frames: Boolean, show_base_frame: Boolean, show_end_effector_frame: Boolean, show_cm: Boolean, show_acm: Boolean, redraw: list
#   port group: The planning group used for end-effector and base visualization.
#   port configuration: The robot's full configuration.
#   port show_visual: Whether or not to show the robot's visual meshes.
#   port show_collision: Whether or not to show the robot's collision meshes.
#   port show_frames: Whether or not to show the robot's joint frames.
#   port show_base_frame: Whether or not to show the robot's base frame.
#   port show_end_effector_frame: Whether or not to show the robot's end-effector frame.
#   port show_cm: Whether or not to show the collision meshes (if any).
#   port show_acm: Whether or not to show the attached collision meshes (if any).
#   port visual: Rhino meshes of the robot's visual geometry (if any).
#   port collision: Rhino meshes of the robot's collision geometry (if any).
#   port collision_meshes: Rhino meshes of the scene's collision meshes (if any).
#   port attached_meshes: Rhino meshes of the scene's attached collision meshes (if any).
#   port all_frames: The robot's joint frames as Rhino planes (if any).
#   port base_frame: The robot's base frame as a Rhino plane (if any).
#   port ee_frame: The robot's end-effector frame as a Rhino plane (if any).
# ---------- robot_visualize: Python ----------
"""
Visualizes the robot.

COMPAS FAB v0.27.0
"""
import Rhino.Geometry as rg
import ghpythonlib.components as ghcomp
from compas.artists import Artist
from compas.geometry import Frame
from compas.geometry import Transformation
from compas_fab.robots import PlanningScene
from compas_ghpython.utilities import draw_frame
from ghpythonlib.componentbase import executingcomponent as component

class RobotVisualize(component):
    def RunScript(
        self,
        robot,
        group,
        configuration,
        show_visual,
        show_collision,
        show_frames,
        show_base_frame,
        show_robot_frame,
        show_end_effector_frame,
        show_reach,
        show_cm,
        show_acm,
        redraw
    ):

        visual = None
        collision = None
        collision_meshes = None
        attached_meshes = None
        frames = None
        base_frame = None
        robot_frame = None
        ee_frame = None
        all_frames = None
        reach = None

        if robot:
            show_visual = True if show_visual is None else show_visual
            show_cm = True if show_cm is None else show_cm
            show_acm = True if show_acm is None else show_acm
            configuration = configuration or robot.zero_configuration()

            robot.update(configuration, visual=show_visual, collision=show_collision)
            frames = robot.transformed_frames(configuration, group)

            if show_visual:
                visual = robot.artist.draw_visual()
                # orient the robot to its base plane:
                robot_BCF = draw_frame(robot.BCF) 
                init_robot_plane = rg.Plane.WorldXY
                visual = ghcomp.Orient(visual, init_robot_plane, robot_BCF)[0]

            if show_collision:
                collision = robot.artist.draw_collision()

            if show_base_frame:
                base_frame = robot.BCF

            if show_robot_frame:
                robot_frame = robot.RCF
                #robot_frame = robot.to_world_coordinates(robot_frame)
                
            if show_end_effector_frame:
                ee_frame = robot.forward_kinematics(
                    configuration, group, options=dict(solver="model")
                )

            if show_frames:
                all_frames = [robot.to_world_coordinates(frame) for frame in frames]
                
            if show_reach:
                ur_base_plane = draw_frame(robot.RCF)
                reach = rg.Sphere(ur_base_plane, 1.25 + robot.attached_tool.frame.point.z)

            if show_cm or show_acm:
                scene = PlanningScene(robot)
                scene = robot.client.get_planning_scene()

                collision_meshes = []
                attached_meshes = []

                if show_cm:
                    for co in scene.world.collision_objects:
                        header = co.header
                        frame_id = header.frame_id
                        cms = co.to_collision_meshes()

                        for cm in cms:
                            if cm.frame != Frame.worldXY():
                                t = Transformation.from_frame(cm.frame)
                                mesh = cm.mesh.transformed(t)
                            else:
                                mesh = cm.mesh
                            
                            mesh_t = mesh.transformed(robot.transformation_BCF_WCF())
                            collision_meshes.append(Artist(mesh_t).draw())

                if show_acm:
                    for aco in scene.robot_state.attached_collision_objects:
                        for acm in aco.to_attached_collision_meshes():
                            frame_id = aco.object["header"]["frame_id"]
                            frame = robot.forward_kinematics(
                                configuration, options=dict(link=frame_id)
                            )
                            t = Transformation.from_frame(frame)

                            # Local CM frame
                            if (
                                acm.collision_mesh.frame
                                and acm.collision_mesh.frame != Frame.worldXY()
                            ):
                                t = t * Transformation.from_frame(
                                    acm.collision_mesh.frame
                                )

                            mesh = acm.collision_mesh.mesh.transformed(t)
                            # transform to mobile robot base
                            mesh_t = mesh.transformed(robot.transformation_BCF_WCF())

                            attached_meshes.append(Artist(mesh_t).draw())

        return (
            visual,
            collision,
            collision_meshes,
            attached_meshes,
            all_frames,
            base_frame,
            robot_frame,
            ee_frame,
            reach
        )
# ---------- end robot_visualize ----------
geo_6 = Geometry(robot_visualize.reach)
geo_7 = Geometry(robot_visualize.visual)
geo_8 = Geometry(robot_visualize.collision)
geo_9 = Geometry(robot_visualize.collision_meshes)
geo_10 = Geometry(robot_visualize.attached_meshes)
draw = GhPythonScript(
    frames=[robot_visualize.robot_frame, robot_visualize.all_frames, robot_visualize.ee_frame],
    scale=Slider(0.2, range=0..1))  # -> P, V, C, W; inputs frames: list
# ---------- draw: Python ----------
from System.Drawing import Color
from compas_ghpython.utilities import draw_frame

red = Color.FromArgb(255, 0, 0)
green = Color.FromArgb(0, 255, 0)
blue = Color.FromArgb(0, 0, 255)

P = []
V = []
C = []

scale = float(scale)

for frame in frames:
    if not frame:
        continue
    plane = draw_frame(frame)
    P += [plane.Origin] * 3
    V.append(plane.XAxis * scale)
    V.append(plane.YAxis * scale)
    V.append(plane.ZAxis * scale)
    C += [red, green, blue]

W = 3
# ---------- end draw ----------
preview_7 = CustomPreview(Geometry=geo_6, Shader=ColourSwatch(SwatchColor=RGBA(255, 212, 212, 97)))
preview_8 = CustomPreview(Geometry=geo_7, Shader=ColourSwatch(SwatchColor=RGB(105, 105, 105)))
preview_9 = CustomPreview(Geometry=[geo_9, geo_10, geo_8], Shader=ColourSwatch(SwatchColor=RGB(255, 255, 255)))
vdisex = VectorDisplayEx(Point=draw.P, Vector=draw.V, Colour=draw.C, Width=draw.W)

panel_24 = Panel(ghpython_script_10.trajectory)

# ----
# Move Joints
list_9 = ValueList({"send one configuration": 0, "send multiple configuration": 1}, selected="send one configuration")
radius_3 = Slider(0.001, range=0..0.5)
filter_3 = StreamFilter(Gate=list_9, Stream0=filter_2, Stream1=trajectory_visualize.configurations)
move_joint = PythonScript(configurations=filter_3, velocity=Slider(0.064, range=0..0.5), radius=radius_3)  # -> urscript, lift, values; inputs configurations: list
# ---------- move_joint: Python ----------
from ur_fabrication_control.direct_control import URScript
from compas_fab.robots import Configuration
import math

urscript = URScript()
urscript.start()
for configuration in configurations:
    joint_configuration = Configuration.from_revolute_values(configuration.revolute_values)
    #lift = configuration
    urscript.move_joint(joint_configuration, velocity, radius)
    #urscript.move_joint(configuration, velocity)
urscript.end()

urscript = urscript.generate()

print(urscript)
# ---------- end move_joint ----------
send_3 = Button()
ur_send = GhPythonScript(urscript=move_joint.urscript, send=send_3)  # -> out; inputs send: Boolean
# ---------- ur_send: Python ----------
from scriptcontext import sticky as st
from ur_fabrication_control.direct_control import send_script

ur_ip = st["ur_ip"]
ur_port = st["ur_port"]

print urscript

if send:
    send_script(urscript, ur_ip, ur_port)
# ---------- end ur_send ----------

# ----
# Move Cartesian
list_10 = ValueList({"send one cartesian position": 0, "send all cartesian positions": 1}, selected="send all cartesian positions")
radius_4 = Slider(0, range=0..0.5)
filter_4 = StreamFilter(Gate=list_10, Stream1=python_2.picking_frame_RCF)
movel_linear = PythonScript(robot=robot_2, frames_RCS=filter_4, velocity=Slider(0.044, range=0..0.5), radius=radius_4)  # -> urscript; inputs frames_RCS: list
# ---------- movel_linear: Python ----------
import Rhino.Geometry as rg
from compas.geometry import Frame
from compas.geometry import Transformation, Rotation
from compas_ghpython import draw_frame
from ur_fabrication_control import direct_control 
import math

from scriptcontext import sticky as st
from ur_fabrication_control.direct_control import URScript

# retrieve the current tool frame in axis angle format
if robot.attached_tool:
    tool_angle_axis = list(robot.attached_tool.frame.point) + list(robot.attached_tool.frame.axis_angle_vector)
else:
    tool0_frame = Frame([0, 0, 0], [1, 0, 0], [0, 1, 0])
    tool_angle_axis = list(tool0_frame.point) + list(tool0_frame.axis_angle_vector)


urscript = URScript()
urscript.start()
urscript.set_tcp(tool_angle_axis)
for frame_RCS in frames_RCS:
    urscript.move_linear(frame_RCS, velocity, radius)
urscript.end()

urscript = urscript.generate()

print(urscript)
# ---------- end movel_linear ----------
send_4 = Button()
ur_send_2 = GhPythonScript(urscript=movel_linear, send=send_4)  # -> out; inputs send: Boolean
# ---------- ur_send_2: Python ----------
from scriptcontext import sticky as st
from ur_fabrication_control.direct_control import send_script

ur_ip = st["ur_ip"]
ur_port = st["ur_port"]

if send:
    send_script(urscript, ur_ip, ur_port)
# ---------- end ur_send_2 ----------

# ----
# MQTT
# Data Configuration | Place Config
# Data Configuration | Trajectory
ghpython_script_11 = GhPythonScript(
    trajectory=ghpython_script_10.trajectory,
    message_bool=ghpython_script_10.message_bool,
    index=ghpython_script_3.index,
    robot_name=robot_name,
    start_of_place_path=ghpython_script_10.start_of_place_path,
    calculate_topic_name=panel_12,
    robot_base_plane=bcf_wcs_ab_0)  # -> out, message_MQTT; inputs trajectory: list, message_bool: Boolean, index: Int32, robot_base_plane: Plane
# ---------- ghpython_script_11: Python ----------
from scriptcontext import sticky as st

planning_failure_key = 'planning_failure_key' + calculate_topic_name

print st[planning_failure_key]

if st[planning_failure_key] == True:
    
    trajectory_points = {"0":{"joint_values":[]}}
    
    #Turn Base Frame Elements in to lists
    point = list(robot_base_plane.Origin)
    xaxis = list(robot_base_plane.XAxis)
    yaxis = list(robot_base_plane.YAxis)
    
    #Make dictionary from Baseplane Elements
    robot_base_frame = {"point": point, "xaxis": xaxis, "yaxis": yaxis}
    
    message_MQTT = [{"result": False, "index": index, "robot_name" : robot_name, "start_of_place_path": 0, "robot_base_frame": robot_base_frame, "trajectory_points": trajectory_points}]
    ghenv.Component.Message = "A planning sequence has failed"

elif len(trajectory) == 0 or message_bool == False:
    ghenv.Component.Message = "No Message Should be Sent"

else:
    
    trajectory_points = {}
    
    i = 0
    #Make_list of joints values
    for c in trajectory:
        print i
        print c
        trajectory_points[str(i)] = {"joint_values": c.joint_values}
        i += 1
    
    #Turn Base Frame Elements in to lists
    point = list(robot_base_plane.Origin)
    xaxis = list(robot_base_plane.XAxis)
    yaxis = list(robot_base_plane.YAxis)
    
    #Make dictionary from Baseplane Elements
    robot_base_frame = {"point": point, "xaxis": xaxis, "yaxis": yaxis}
    
    
    message_MQTT = [{"result": True, "index": index, "robot_name" : robot_name, "start_of_place_path": start_of_place_path, "robot_base_frame": robot_base_frame, "trajectory_points": trajectory_points}]
    ghenv.Component.Message = "MQTT: Message Sent"

print "message = " , message_MQTT
# ---------- end ghpython_script_11 ----------
ghpython_script_12 = GhPythonScript(
    place_config=analytic_inverse.configuration,
    place_config_bool=analytic_inverse.place_config_bool,
    index=ghpython_script_3.index,
    robot_base_plane=set_base_frame.base_plane,
    robot_name=robot_name)  # -> out, message_MQTT; inputs place_config_bool: Boolean, index: Int32, robot_base_plane: Plane
# ---------- ghpython_script_12: Python ----------
if place_config == None or place_config_bool == True :
    
    #Make List from joint values
    joint_values = []
    #    print joint_values
    
    
    #Turn Base Frame Elements in to lists
    point = list(robot_base_plane.Origin)
    xaxis = list(robot_base_plane.XAxis)
    yaxis = list(robot_base_plane.YAxis)
    
    #Make dictionary from Baseplane Elements
    robot_base_frame = {"point": point, "xaxis": xaxis, "yaxis": yaxis}
    
    message_MQTT = [{"result": False, "index": index, "robot_name" : robot_name, "robot_base_frame": robot_base_frame, "joint_values": joint_values}]
    ghenv.Component.Message = "Place Config is Null"

else:
    
    #Make List from joint values
    joint_values = place_config.joint_values
    #    print joint_values
    
    
    #Turn Base Frame Elements in to lists
    point = list(robot_base_plane.Origin)
    xaxis = list(robot_base_plane.XAxis)
    yaxis = list(robot_base_plane.YAxis)
    
    #Make dictionary from Baseplane Elements
    robot_base_frame = {"point": point, "xaxis": xaxis, "yaxis": yaxis}
    
    message_MQTT = [{"result": True, "index": index, "robot_name" : robot_name, "robot_base_frame": robot_base_frame, "joint_values": joint_values}]
    ghenv.Component.Message = "MQTT: Message Sent"

print "message = " , message_MQTT
# ---------- end ghpython_script_12 ----------

# ----
# Generate 'pick and place' commands
list_11 = ValueList({"1. 'pick and place'": 0, "2. 'release and move to pick up safe'": 1, "3. 'move to pick up safe'": 2, "4. 'move to pick up'": 3, "5. 'move to place safe'": 4, "6. 'move to place'": 5}, selected="1. 'pick and place'")
send_5 = Button()
radius_5 = Slider(0.01, range=0..0.1)
generate_ur_script = PythonScript(
    robot=robot_2,
    picking_configuration_safe=picking_safe_inverse_2.configuration,
    picking_configuration=picking_safe_inverse.configuration,
    placing_configurations_freemotion=trajectory_visualize.configurations,
    placing_configurations_cartesian=trajectory_visualize_2.configurations,
    picking_frame_RCF=python_2.picking_frame_RCF,
    picking_frame_safe_RCF=python_2.picking_frame_safe_RCF,
    placing_plane_safe=pln_7,
    placing_plane=pln_9,
    routine=list_11,
    velocity=Slider(0.013, range=0..0.35),
    radius=radius_5)  # -> out, placing_frame_safe_RCF, urscript; inputs placing_configurations_freemotion: list, placing_configurations_cartesian: list, routine: Int32
# ---------- generate_ur_script: Python ----------
from ur_fabrication_control.direct_control import URScript
from ur_fabrication_control.direct_control.mixins import ParallelGripMixins
from compas_fab.robots import Configuration

import math
from scriptcontext import sticky as st
import Rhino.Geometry as rg

from compas.geometry import Frame, Transformation


class URScript_CDF(URScript, ParallelGripMixins):
    pass

if robot:
    tool_angle_axis = list(robot.attached_tool.frame.point) + list(robot.attached_tool.frame.axis_angle_vector)
sleep = 1.0

def plane_to_frame_RCF(plane_WCS):
    frame_WCS = Frame(plane_WCS.Origin, plane_WCS.XAxis, plane_WCS.YAxis)
    frame_BCS = frame_WCS.transformed(robot.transformation_WCF_BCF())
    frame_RCS = frame_BCS.transformed(robot.transformation_BCF_RCF())
    return frame_RCS

placing_frame_RCF = plane_to_frame_RCF(placing_plane) 
placing_frame_safe_RCF = plane_to_frame_RCF(placing_plane_safe)

#traj_frames = []
#for plane in traj_planes_WCF:
#    traj_frames.append(plane_to_frame(plane))

reversed_free_motion_configs = placing_configurations_freemotion[::-1]
#reversed_place_cartesian_configs = place_cartesian_configs[::-1]
#reversed_pick_cartesian_configs = pick_cartesian_configs[::-1]

if picking_configuration_safe:
    picking_configuration = Configuration.from_revolute_values(picking_configuration_safe.revolute_values)


# pick and place
if routine == 0:
    commands = URScript_CDF()
    commands.start()
    #commands.set_payload(1.4)
    commands.set_tcp(tool_angle_axis)
    commands.move_joint(picking_configuration_safe, velocity)
    
    commands.parallelgrip_open() 
    
    commands.move_joint(picking_configuration, velocity) 
    
    commands.add_line("\tsleep({})".format(sleep))
    commands.parallelgrip_close() 
    commands.add_line("\tsleep({})".format(sleep))
    #commands.set_payload(1.5)
    
    commands.move_joint(picking_configuration_safe, velocity)

    for configuration in placing_configurations_freemotion:
        joint_configuration = Configuration.from_revolute_values(configuration.revolute_values)
        commands.move_joint(joint_configuration, velocity, radius)
    
        commands.move_linear(placing_frame_RCF, velocity, radius=0)
        
    commands.end()  

# release and move to home
if routine == 1:
    commands = URScript_CDF()
    commands.start()
    #commands.set_payload(1.5)
    commands.set_tcp(tool_angle_axis)
    commands.parallelgrip_open() 
    #commands.set_payload(1.4)

    commands.move_linear(placing_frame_safe_RCF, velocity, radius=0)

    for configuration in reversed_free_motion_configs:
        joint_configuration = Configuration.from_revolute_values(configuration.revolute_values)
        commands.move_joint(joint_configuration, velocity, radius)
        
    commands.move_joint(picking_configuration, velocity)
    commands.end() 
    
# move to picking_frame_safe
if routine == 2:
    commands = URScript_CDF()
    commands.start()
    commands.set_tcp(tool_angle_axis)
    commands.move_linear(picking_frame_safe_RCF, velocity, radius=0)
    commands.end() 

# move to picking_frame
if routine == 3:
    commands = URScript_CDF()
    commands.start()
    commands.set_tcp(tool_angle_axis)
    commands.move_linear(picking_frame_RCF, velocity, radius=0)
    commands.end()    
    
# move to placing_frame_safe
if routine == 4:
    commands = URScript_CDF()
    commands.start()
    commands.set_tcp(tool_angle_axis)
    commands.move_linear(placing_frame_safe_RCF, velocity, radius=0)
    commands.end() 

# move to placing_frame
if routine == 5:
    commands = URScript_CDF()
    commands.start()
    commands.set_tcp(tool_angle_axis)
    commands.move_linear(placing_frame_RCF, velocity, radius=0)
    commands.end()  

urscript = commands.generate()

print(urscript)
# ---------- end generate_ur_script ----------
send_6 = GhPythonScript(
    urscript=generate_ur_script.urscript,
    combined_motion_configs=combine.combined_motion_configs,
    send=ghpython_script_4.send_trajectory,
    send_topic_name=panel_14,
    calculate_topic_name=panel_12)  # -> out; inputs combined_motion_configs: list, send: Boolean
# ---------- send_6: Python ----------
from scriptcontext import sticky as st
from ur_fabrication_control.direct_control import send_script

ur_ip = st["ur_ip"]
ur_port = st["ur_port"]

send_trajectory_key = 'send_trajectory_key' + send_topic_name
reversed_motion_configs_key = 'reversed_motion_configs_key' + calculate_topic_name

print urscript

if send and st[send_trajectory_key] == True:
    reversed_motion_configs = combined_motion_configs[::-1]
    st[reversed_motion_configs_key] = reversed_motion_configs
    st[send_trajectory_key] = False
    ghenv.Component.Message = "Sent Frames" #display message on component = "Send has not been received yet"
#    send_script(urscript, ur_ip, ur_port)

else:
    ghenv.Component.Message = "Send has not been received yet" #display message on component = "Send has not been received yet"
# ---------- end send_6 ----------

panel_25 = Panel(ghpython_script_12.out)

panel_26 = Panel(ghpython_script_11.out)

# ----
# PUB | Place Config
# >> Publisher MQTT
# PUB | Trajectory
panel_29 = Panel("/caa_place_config_status/")
mqtt_publisher = MQTTPublisher(host=panel_9, topic_name=panel_29, msg=ghpython_script_12.message_MQTT)  # -> topic, is_advertised
# ---------- mqtt_publisher: Python ----------
import time

import json
from ghpythonlib.componentbase import executingcomponent as component
from scriptcontext import sticky as st

from threading import Event

from compas_eve import Message
from compas_eve import Publisher
from compas_eve import Subscriber
from compas_eve import Topic
from compas_eve import set_default_transport
from compas_eve.mqtt import MqttTransport

from compas_fab.ghpython.components import create_id

class MQTTTopicPublish(component):
    
    def RunScript(self, host, topic_name, msg):
        if not host:
            raise ValueError('Please specify host')
        if not topic_name:
            raise ValueError('Please specify the name of the topic')
            
        key = create_id(self, 'mqtt_topic'+ topic_name)
        topic = st.get(key, None)
        
        if host:
            tx = MqttTransport(host)
            if not topic:
                topic = Topic(topic_name, Message)
                time.sleep(0.2)

                st[key] = topic

        self.is_advertised = topic
        
        if msg :
            Publisher(topic, transport=tx).publish(Message(msg))
            self.Message = 'Message published'
        else:
            if self.is_advertised:
                self.Message = 'Topic advertised'
                
        return (topic, self.is_advertised)
# ---------- end mqtt_publisher ----------

# ----
# >> Publisher MQTT
panel_30 = Panel("/caa_planning_status/")
mqtt_publisher_2 = MQTTPublisher(host=panel_9, topic_name=panel_30, msg=ghpython_script_11.message_MQTT)  # -> topic, is_advertised; same code as mqtt_publisher

send_7 = GhPythonScript(urscript=generate_ur_script.urscript, send=send_5)  # -> out; inputs send: Boolean; disabled
# ---------- send_7: Python ----------
from scriptcontext import sticky as st
from ur_fabrication_control.direct_control import send_script

ur_ip = st["ur_ip"]
ur_port = st["ur_port"]

print urscript
if send:
    send_script(urscript, ur_ip, ur_port)
# ---------- end send_7 ----------

# ----
# Get Pose Joint
get_2 = Button()
pose = PythonScript(robot=robot_2, get=get_2)  # -> out, configuration, pose_joints
# ---------- pose: Python ----------
from scriptcontext import sticky as st
from ur_fabrication_control.direct_control.common import get_current_pose_joints
from compas_fab.robots import Configuration
from compas.geometry import Frame


server_ip= st["server_ip"]
server_port = st["server_port"]
ur_port = st["ur_port"]
ur_ip = st["ur_ip"]
print ur_ip

guid = str(ghenv.Component.InstanceGuid)
pose_joints_key = "pose_joints" + guid

# retrieve the current tool frame in axis angle format
if robot.attached_tool:
    tool_angle_axis = list(robot.attached_tool.frame.point) + list(robot.attached_tool.frame.axis_angle_vector)
else:
    tool0_frame = Frame([0, 0, 0], [1, 0, 0], [0, 1, 0])
    tool_angle_axis = list(tool0_frame.point) + list(tool0_frame.axis_angle_vector)

print(tool_angle_axis)

# send script to the robot to receive the current joint configuration
if get:
    st[pose_joints_key] = get_current_pose_joints(server_ip, server_port, ur_ip, ur_port, tool_angle_axis)

    print(st[pose_joints_key])
    configuration = Configuration.from_revolute_values(st[pose_joints_key])
    pose_joints = configuration.joint_values
"""
if pose_joints_key not in st:
    configuration = Configuration.from_revolute_values([0,0,0,0,0,0])
else:
    configuration = Configuration.from_revolute_values(st[pose_joints_key])

pose_joints = configuration.values
"""
# ---------- end pose ----------
panel_31 = Panel(pose.pose_joints)

# ----
# Lift controller
send_8 = Button()
lift_send = GhPythonScript(robot=robot_2, lift=l, send=send_8)  # -> out
# ---------- lift_send: Python ----------
if send:
    robot.mobile_client.set_lift_height(lift)
# ---------- end lift_send ----------

# ----
# >> Subscriber | Place
button_2 = Button()
mqtt_subscriber_4 = MQTTSubscriber(host=panel_9, topic=panel_29, reset=button_2)  # -> out, last_message; same code as mqtt_subscriber
panel_32 = Panel(mqtt_subscriber_4.out)

# ----
# >> Subscriber | Trajectory
button_3 = Button()
mqtt_subscriber_5 = MQTTSubscriber(host=panel_9, topic=panel_30, reset=button_3)  # -> out, last_message; same code as mqtt_subscriber
panel_33 = Panel(mqtt_subscriber_5.out)

# ----
# Calculate BCF from measured RCF in WCS
rcf_wcs_aa_0 = Plane(Plane(origin=(-0.651762, 1.000848, 0.359071), x=(-0.1925049999, 0.9812949996, 0.001395999999), y=(-0.9812656017, -0.1924876471, -0.008143995887)))
calc_bcf_wcs_2 = GhPythonScript(robot=robot_2, RCF_WCS_plane=rcf_wcs_aa_0)  # -> out, RCF_OCS_plane, BCF_WCS_plane
# ---------- calc_bcf_wcs_2: Python ----------
import rhinoscriptsyntax as rs
from compas_rhino.conversions import frame_to_rhino_plane, plane_to_compas_frame
from compas.geometry import Frame, Transformation, Translation


#RCF_OCS_plane = frame_to_rhino_plane(robot.RCF) # TODO: RCF should move with BCF !!!! NEEDS TO BE CHECKED !!!!

RCF_WCS = plane_to_compas_frame(RCF_WCS_plane)


#print robot.RCF
#print robot.BCF

#Version A

#RCF_RCS = RCF_WCS.transformed(robot.transformation_WCF_RCF())
#BCF_WCS_A = RCF_RCS.transformed(robot.transformation_BCF_WCF())
#
#BCF_WCS_A_plane = frame_to_rhino_plane(BCF_WCS_A)
#BCF_WCS_plane = BCF_WCS_A_plane

#Version B
#
T2 = Transformation.from_frame_to_frame(robot.RCF, RCF_WCS)
print robot.RCF
BCF_WCS_B = Frame.worldXY().transformed(T2)
BCF_WCS_B_plane = frame_to_rhino_plane(BCF_WCS_B)

BCF_WCS_plane = BCF_WCS_B_plane
# ---------- end calc_bcf_wcs_2 ----------
pln_13 = Plane(calc_bcf_wcs_2.RCF_OCS_plane)
pln_14 = Plane(calc_bcf_wcs_2.BCF_WCS_plane)

# ----
# FOC: Table CM
width = Slider(0.67, range=0..1)
height = Slider(0.7, range=0..1)
# MQTT | Application Data Transfer
division = Division(A=height, B=2)
division_2 = Division(A=width, B=2)
center_box = CenterBox(Base=PlaneXY(0, 0, 0), X=division_2, Y=division_2, Z=division)

subtraction = Subtraction(A=division, B=0.025)

unit_z = UnitZ(Factor=subtraction)
negative = Negative(Value=unit_z)
move_2 = Move(Geometry=center_box, Motion=negative)  # -> Geometry, Transform
mesh_5 = Mesh(move_2.Geometry)

# ----
# Update Collision Meshes
geometry_2 = Geometry(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)
mesh_6 = Mesh(geometry_2)
ghpython_script_13 = GhPythonScript(robot=robot_2, scene=scene, sticks_cm=ghpython_script_8.sticks_cm, second_robot=mesh_6, table=mesh_5, add=read.cm_update)  # -> out, a; inputs sticks_cm: list
# ---------- ghpython_script_13: Python ----------
from compas_rhino.conversions import plane_to_compas_frame
from compas_rhino.geometry import RhinoMesh
from compas_fab.robots import CollisionMesh
from compas_fab.robots import PlanningScene

if add and robot and robot.client and robot.client.is_connected:
    scene = scene
    scene.remove_collision_mesh("sticks")
    scene.remove_collision_mesh("table")
    #Remove attached collision mesh?
#    scene.remove_collision_mesh("rod")

#    Add Stick Collision Meshes Again
    for mesh in sticks_cm:
#        print type (mesh)
        compas_mesh_WCS = RhinoMesh.from_geometry(mesh).to_compas()
        mesh = compas_mesh_WCS.transformed(scene.robot.transformation_WCF_BCF())
        stick_cm = CollisionMesh(mesh, "sticks")
        scene.append_collision_mesh(stick_cm)
    
    #Add Second Robot Collision Mesh Again
    second_robot = RhinoMesh.from_geometry(second_robot).to_compas()
    second_robot_transformed = second_robot.transformed(scene.robot.transformation_WCF_BCF())
    robot_cm = CollisionMesh(second_robot_transformed, "additional_robot")
    scene.add_collision_mesh(robot_cm)
    
    #Add Table Collision Mesh
    table_compas = RhinoMesh.from_geometry(table).to_compas()
    table_compas_transformed = table_compas.transformed(scene.robot.transformation_WCF_BCF())
    table_cm = CollisionMesh(table_compas_transformed, "additional_robot")
    scene.add_collision_mesh(table_cm)
# ---------- end ghpython_script_13 ----------

# ----
# Get Pose Cartesian
get_3 = Button()
pose_2 = PythonScript(robot=robot_2, get=get_3)  # -> out, pose_cartesian
# ---------- pose_2: Python ----------
from scriptcontext import sticky as st
#from ur_fabrication_control.online_control.ur_direct import get_current_pose_cartesian

from ur_fabrication_control.direct_control.common import get_current_pose_cartesian
from compas.geometry import Frame
from compas_ghpython import draw_frame


server_ip = st["server_ip"]
server_port = st["server_port"]
ur_port = st["ur_port"]
ur_ip = st["ur_ip"]
pose_cartesian_meter = []
print ur_ip

# retrieve the current tool frame in axis angle format
if robot.attached_tool:
    print ("attached")
    tool_angle_axis = list(robot.attached_tool.frame.point) + list(robot.attached_tool.frame.axis_angle_vector)
    
else:
    tool0_frame = Frame([0, 0, 0], [1, 0, 0], [0, 1, 0])
    tool_angle_axis = list(tool0_frame.point) + list(tool0_frame.axis_angle_vector)

print(tool_angle_axis)

guid = str(ghenv.Component.InstanceGuid)
pose_cartesian_key = "pose_cartesian" + guid


if get:
    print ("getting pose")
    st[pose_cartesian_key] = get_current_pose_cartesian(tool_angle_axis, server_ip, server_port, ur_ip, ur_port, send=True)
#    st[pose_cartesian_key] = get_current_pose_cartesian(server_ip, server_port, ur_ip, tool_angle_axis)
    

if pose_cartesian_key not in st:
    pose_cartesian_mm = []
    pose_cartesian_meter = []
else:
    pose_cartesian = st[pose_cartesian_key]
# ---------- end pose_2 ----------

# ----
# Calculate Basis - 3-Point Method
# Measure basis:
# 1. Clear the recorded poses
# 2. Move robot to origin and press "get pose"
# 3. Move robot to point in positive x-axis and press "get pose"
# 4. Move robot to an other point in your basis and press "get pose"
# (The further away these positions are, the better)
# 
# 5. Alternatively change the order in the component calc base
# 6. Copy output into base component (TODO: check if it has to be inverted)
list_12 = ValueList({"o, pos.x-axis, xy pl": 0, "o, pos.y-axis, xy pl": 1}, selected="o, pos.x-axis, xy pl")
clear = Button()
rec = PythonScript(msg=pose_2.pose_cartesian, rec=get_3, clear=clear)  # -> rec; inputs msg: list
# ---------- rec: Python ----------
from scriptcontext import sticky as st

guid = str(ghenv.Component.InstanceGuid)
recorded_key =  "recorded_" + guid
just_cleared_key = "just_cleared_" + guid


if recorded_key not in st:
    st[recorded_key] = []

if just_cleared_key not in st:
    st[just_cleared_key] = False

if clear:
    st[recorded_key] = []
    st[just_cleared_key] = True
else:
    if len(msg):
        if msg != [None] and not st[just_cleared_key] and rec:
            st[recorded_key].append(msg)
    st[just_cleared_key] = False
        


rec = st[recorded_key]

print rec
# ---------- end rec ----------
calc_robot_plane = PythonScript(poses=rec, input_type=list_12)  # -> out, robot_plane, base_plane; inputs poses: list
# ---------- calc_robot_plane: Python ----------
import Rhino.Geometry as rg
import math


if len(poses) > 2:
    
    O = poses[0]
    P1 = poses[1]
    P2 = poses[2]
    
    if input_type == 0:
        # origin, pt on positive x-axis, pt in xy plane
        origin = rg.Point3d(O[0], O[1], O[2])
        pt_on_xaxis = rg.Point3d(P1[0], P1[1], P1[2])
        pt_in_xyplane = rg.Point3d(P2[0], P2[1], P2[2])
        
        xaxis = pt_on_xaxis - origin
        xaxis.Unitize()
        
        v = pt_in_xyplane - origin
        zaxis = rg.Vector3d.CrossProduct(v, xaxis)
        zaxis.Unitize()
        
        # zaxis must look up!
        if math.acos(rg.Vector3d.ZAxis * zaxis) > math.acos(rg.Vector3d.ZAxis * -zaxis):
            zaxis = -zaxis
        
        yaxis = rg.Vector3d.CrossProduct(zaxis, xaxis)
    
    elif input_type == 1:
        # origin, pt on positive y-axis, pt in xy plane
        origin = rg.Point3d(O[0], O[1], O[2])
        pt_on_yaxis = rg.Point3d(P1[0], P1[1], P1[2])
        pt_in_xyplane = rg.Point3d(P2[0], P2[1], P2[2])
        
        yaxis = pt_on_yaxis - origin
        yaxis.Unitize()
        
        v = pt_in_xyplane - origin
        zaxis = rg.Vector3d.CrossProduct(v, yaxis)
        zaxis.Unitize()
        
        # zaxis must look up!
        if math.acos(rg.Vector3d.ZAxis * zaxis) > math.acos(rg.Vector3d.ZAxis * -zaxis):
            zaxis = -zaxis
        
        xaxis = rg.Vector3d.CrossProduct(yaxis, zaxis)
        
        
    print "Copy the following into base component:"
    print " "
    print "origin = [%.2f, %.2f, %.2f]" % tuple(list(origin))
    print "xaxis = [%.5f, %.5f, %.5f]" % tuple(list(xaxis))
    print "yaxis = [%.5f, %.5f, %.5f]" % tuple(list(yaxis))
    

#print rg.Vector3d.CrossProduct(rg.Vector3d.YAxis, rg.Vector3d.ZAxis)
#print rg.Vector3d.CrossProduct(rg.Vector3d.ZAxis, rg.Vector3d.XAxis)

    robot_plane = rg.Plane(origin, xaxis, xaxis)
# ---------- end calc_robot_plane ----------
panel_34 = Panel(rec)
panel_35 = Panel(calc_robot_plane.out)

# ----
# Direct UR control + Lift control
rec_2 = DataRecorder(pose_2.out, DataLimit=-10, RecordData=True)
pln_15 = Plane(calc_robot_plane.robot_plane)

panel_36 = Panel(rec_2)

# ----
# Calculate Basis - Point fitting method via RPC
toggle = BooleanToggle(False)
pt_2 = Point([<point referenced from the Rhino model> x3])
calc_rcf = PythonScript(poses=rec, pts_cad=pt_2, RCF_plane_init_guess=pln_4, calc=toggle)  # -> out, pts_mtip_init_guess, pts_mtip_fit, RCF_plane_fit, RCF_frame_fit; inputs poses: list, pts_cad: list of Point3d, RCF_plane_init_guess: Plane
# ---------- calc_rcf: Python ----------
import ghpythonlib.components as ghcomp
import Rhino.Geometry as rg
from scriptcontext import sticky as st
from compas.geometry import Frame
from compas.artists import Artist
import math as m
import sys
from compas.rpc import Proxy # for calling the numpy function in CPython

#icp_func = Proxy('ur_fabrication_control.optimisation.icp', python = 'C://Users//doerf//.conda//envs//rsrd_22//python.exe') #C:\Users\doerf\.conda\envs\rsrd_22
#print icp_func._python
#print poses

#RCF_plane_init_guess = Artist(RCF_frame_init_guess).draw()

#poses = [[-0.58718800000000004, -0.18371299999999999, -1.0307900000000001, -2.7211500000000002, -0.58718700000000001, 0.359176], [-0.57886499999999996, -0.51754, -1.0328200000000001, -2.5670999999999999, -1.14205, 0.790659], [-0.28750700000000001, -0.60358299999999998, -1.03515, -2.5338500000000002, -1.7267600000000001, 0.27448299999999998]]
if len(poses):
    
    # get points from poses
    pts_mtip = [rg.Point3d(p[0], p[1], p[2]) for p in poses]
    
    T_W_R_init_guess = rg.Transform.PlaneToPlane(rg.Plane.WorldXY, RCF_plane_init_guess)
    pts_mtip_init_guess = [ghcomp.Transform(pt, T_W_R_init_guess) for pt in pts_mtip]
    
    # format Rhino transformation
    T_W_R_init_guess_flattened = [float(f) for f in T_W_R_init_guess.ToFloatArray(True)]
    T_W_R_init_guess_list = [T_W_R_init_guess_flattened[i:(i + 4)] for i in range(0, len(T_W_R_init_guess_flattened), 4)]  

    # format ptsA and ptsB
    dataB = [list(pt) for pt in pts_cad]
    dataA = [list(pt) for pt in pts_mtip]
    
    # call the function
    max_iterations = 100
    
    if calc:
        icp_func = Proxy('ur_fabrication_control.optimisation.icp', python = 'C://Users//lidet//anaconda3//envs//urfab//python.exe')
        #icp_func = Proxy('ur_fabrication_control.optimisation.icp', python = 'C://Users//doerf//.conda//envs//rsrd_22//python.exe') #C:\Users\doerf\.conda\envs\rsrd_22
        
        
        print icp_func._python

        transformation, distances = icp_func.icp(dataA, dataB, init_guess=T_W_R_init_guess_list, max_iterations=max_iterations, tolerance=0.000001)
        
        print "distances", distances
        
        # format result
        T = rg.Transform.Identity
        for i in range(4):
            for j in range(4):
                code = "T.M%i%i = %f" % (i, j, transformation[i][j])
                print code
                exec(code)
        #print T
        
        # now transform the points with the transformation calculated
        pts_mtip_fit = [ghcomp.Transform(pt, T) for pt in pts_mtip]
        RCF_plane_fit = ghcomp.Transform(rg.Plane.WorldXY, T)
        RCF_frame_fit = Frame(RCF_plane_fit.Origin, RCF_plane_fit.XAxis, RCF_plane_fit.YAxis)
        
        
        #f = Frame(base_plane_fit)
        #print f.get_pose_quaternion()
        
        # correct the zvalue
        #base_plane_fit = ghcomp.Transform(base_plane_fit, rg.Transform.Translation(0,0,-3))
# ---------- end calc_rcf ----------
pt_3 = Point(calc_rcf.pts_mtip_init_guess)
pt_4 = Point(calc_rcf.pts_mtip_fit)

pln_16 = Plane(calc_rcf.RCF_plane_fit)

# ==== cluster Cluster
data = ClusterInput()
data_2 = Data(data)
division = Division(A=data_2, B=2)
unit_z = UnitZ(Factor=division)
construct_point = ConstructPoint(XCoordinate=0, YCoordinate=0, ZCoordinate=0)
negative = Negative(Value=unit_z)
move = Move(Geometry=construct_point, Motion=negative)  # -> Geometry, Transform
radius = ClusterInput()
unit_z_2 = UnitZ(Factor=data_2)
polygon = Polygon(Plane=move.Geometry, Radius=radius, Segments=6, FilletRadius=0)  # -> Polygon, Length
unit_y = UnitY(Factor=1)
extrude = Extrude(Base=polygon.Polygon, Direction=unit_z_2)
cap_holes = CapHoles(Brep=extrude)
rotate_3d = Rotate3D(Geometry=cap_holes, Angle=degrees(Slider(90, range=0..100)), Center=Point(0, 0, 0), Axis=unit_y)  # -> Geometry, Transform
geometry = ClusterOutput(rotate_3d.Geometry)
